# Grasshopper definition 2章結果用.gh (Grasshopper 1.0.8)
# plug-ins: Human, Crane, Hagoromo, NGon_RH8

mesh = Mesh(<mesh referenced from the Rhino model>)  # disabled
msmooth = SmoothMesh(Mesh=mesh, Strength=0.5, SkipNaked=True, Iterations=1)
cmesh_from_mesh = CMeshFromMesh(Mesh=msmooth)
developable = Developable()
static_solver = CraneStaticSolver(
    CMesh=cmesh_from_mesh,
    Constraints=developable,
    NRIteration=50,
    CGNRIteration=100,
    Threshold=1e-13,
    Solve=Toggle(True),
    IsRigidEdge=False,
    IsPanelFlat=True,
    IsFoldBlock=True,
    IsConstraint=True)  # -> CMesh, RigidOrigami, Residual
deconstruct_cmesh = DeconstructCMesh(CMesh=static_solver.CMesh)  # -> Mesh, Mountain, Valley, Boundary, Unassigned, Triangulate, Edges, Inner
mesh_2 = Mesh(deconstruct_cmesh.Mesh)
mbridgecm = MbridgeCM(TriangulatedMeshOrCutMesh=mesh_2)
sortcutmesh = SortCutMesh(TriangulatedMeshOrCutMesh=mbridgecm)
mbridgecm_2 = MbridgeCM(TriangulatedMeshOrCutMesh=msmooth)
meshedges = MeshEdges(Mesh=msmooth)  # -> AllE, NakedE
number_slider = Slider(100000, range=0..1000000)
sortcutmesh_2 = SortCutMesh(TriangulatedMeshOrCutMesh=mbridgecm_2)
crv = Curve(meshedges.NakedE)
number_slider_2 = Slider(1000, range=0..1000)
number_slider_3 = Slider(50, range=0..10000)
number_slider_4 = Slider(0.01, range=0..1)
number_slider_5 = Slider(400000, range=0..1000000)
number_slider_6 = Slider(1, range=0..1000)
develop = DevelopMesh(TriangulatedMesh=msmooth, Count=Slider(20000, range=0..100000))  # -> ModifiedMesh, A
mesh_3 = Mesh(develop.ModifiedMesh)
number_slider_7 = Slider(1207, range=0..100000)
元形状 = Mesh(msmooth)
developcm2 = DevelopCutMesh2(
    TriangulatedCutMesh=sortcutmesh_2,
    Iterations=Slider(210, range=0..1250),
    XyMirror=False,
    YzMirror=False,
    ZxMirror=False,
    OuterBoundaryCurves=meshedges.NakedE,
    Alpha=Slider(200, range=0..1000))
developcm2_2 = DevelopCutMesh2(
    TriangulatedCutMesh=sortcutmesh_2,
    Iterations=Slider(50, range=0..100000),
    XyMirror=False,
    YzMirror=False,
    ZxMirror=False,
    OuterBoundaryCurves=meshedges.NakedE,
    Alpha=0.1)
mbridgecm_3 = MbridgeCM(TriangulatedMeshOrCutMesh=develop.ModifiedMesh)
sortcutmesh_3 = SortCutMesh(TriangulatedMeshOrCutMesh=developcm2)
deccutmesh = DeconstructCutMesh(TriangulatedMeshOrCutMesh=sortcutmesh_3)  # -> Vertices, Faces, Edges, Dups
area = Area(Geometry=元形状)  # -> Area, Centroid
mbridgecm_4 = MbridgeCM(TriangulatedMeshOrCutMesh=元形状)
mbridgecm_5 = MbridgeCM(TriangulatedMeshOrCutMesh=developcm2)
sortcutmesh_4 = SortCutMesh(TriangulatedMeshOrCutMesh=mbridgecm_3)
deccutmesh_2 = DeconstructCutMesh(TriangulatedMeshOrCutMesh=sortcutmesh_4)  # -> Vertices, Faces, Edges, Dups
number_slider_8 = Slider(100000, range=0..100000)
number_slider_9 = Slider(50000, range=0..100000)
mbridgecm_6 = MbridgeCM(TriangulatedMeshOrCutMesh=developcm2_2)
sortcutmesh_5 = SortCutMesh(TriangulatedMeshOrCutMesh=mbridgecm_4)
deccutmesh_3 = DeconstructCutMesh(TriangulatedMeshOrCutMesh=sortcutmesh_5)  # -> Vertices, Faces, Edges, Dups
develop_2 = DevelopMesh(TriangulatedMesh=mbridgecm_6, Count=Slider(10000, range=0..10000))  # -> ModifiedMesh, A
mbridgecm_7 = MbridgeCM(TriangulatedMeshOrCutMesh=develop_2.ModifiedMesh)
提案 = Mesh(develop.ModifiedMesh)
従来 = Mesh(mbridgecm_5)
ハイブリッド = Mesh(develop_2.ModifiedMesh)
mbridgecm_8 = MbridgeCM(TriangulatedMeshOrCutMesh=ハイブリッド)
sortcutmesh_6 = SortCutMesh(TriangulatedMeshOrCutMesh=mbridgecm_8)
deccutmesh_4 = DeconstructCutMesh(TriangulatedMeshOrCutMesh=sortcutmesh_6)  # -> Vertices, Faces, Edges, Dups
dist = Distance(PointA=deccutmesh_3.Vertices, PointB=deccutmesh_4.Vertices)
sqr = Square(Value=dist)
avr = Average(Input=sqr)
division = Division(A=avr, B=area.Area)
multiplication = Multiplication(A=division, B="100")
panel = Panel(multiplication)
sortcutmesh_7 = SortCutMesh(TriangulatedMeshOrCutMesh=mbridgecm_7)
netbff = NetBFF(TriangulatedMeshOrCutMesh=sortcutmesh_7)  # -> CutMesh, FeatureLinesPolylines
cutmeshedges = CutMeshEdges(TriangulatedMeshOrCutMesh=sortcutmesh_7)  # -> MeshAllEdges, MeshNakedEdges
cutmeshedges_2 = CutMeshEdges(TriangulatedMeshOrCutMesh=netbff.CutMesh)  # -> MeshAllEdges, MeshNakedEdges
len = Length(Curve=cutmeshedges_2.MeshAllEdges)
len_2 = Length(Curve=cutmeshedges.MeshAllEdges)
subtraction = Subtraction(A=len, B=len_2)
abs = Absolute(Value=subtraction)
division_2 = Division(A=abs, B=len_2)
multiplication_2 = Multiplication(A=division_2, B=Slider(100, range=0..100))
sort = SortList(Keys=multiplication_2)  # -> Keys, ValuesA
avr_2 = Average(Input=multiplication_2)
item = ListItem(List=sort.Keys, Index=0, Wrap=True)  # -> Item1, Item
panel_2 = Panel([item.Item1, avr_2])
gradient = Gradient(
    LowerLimit="0",
    UpperLimit="3",
    Parameter=multiplication_2,
    stops=[0: RGB(75, 107, 169), 0.247: RGB(173, 203, 249), 0.5: RGB(254, 244, 84), 0.748: RGB(234, 126, 0), 1: RGB(234, 38, 0)])
object = ModelObject(Object=cutmeshedges_2.MeshAllEdges, Layer="従来", Display=gradient)  # -> Object, Geometry, Name, Layer, Visibility, Display, Drafting, Render
cache = ContentCache(Content=object.Object, Action=2)
meshedges_2 = MeshEdges(Mesh=元形状)  # -> AllE, NakedE
swatch = ColourSwatch(SwatchColor=RGBA(255, 255, 255, 80))
swatch_2 = ColourSwatch(SwatchColor=RGBA(255, 255, 255, 80))
swatch_3 = ColourSwatch(SwatchColor=RGBA(128, 128, 128, 190))
number_slider_10 = Slider(2, range=0..2)
meshedges_3 = MeshEdges(Mesh=ハイブリッド)  # -> AllE, NakedE
number_slider_11 = Slider(2, range=0..2)
number_slider_12 = Slider(2, range=0..2)
meshedges_4 = MeshEdges(Mesh=従来)  # -> AllE, NakedE
meshedges_5 = MeshEdges(Mesh=提案)  # -> AllE, NakedE
mesh_4 = Mesh(元形状)
scale = Scale(Geometry=meshedges_2.AllE, Center=Point(0, 0, 0), Factor=Slider(1.00001, range=0..10))  # -> Geometry, Transform
scale_2 = Scale(Geometry=meshedges_3.AllE, Center=Point(0, 0, 0), Factor=Slider(1.00002, range=0..10))  # -> Geometry, Transform
scale_3 = Scale(Geometry=meshedges_4.AllE, Center=Point(0, 0, 0), Factor=Slider(1.00002, range=0..10))  # -> Geometry, Transform
scale_4 = Scale(Geometry=meshedges_5.AllE, Center=Point(0, 0, 0), Factor=Slider(1.00002, range=0..10))  # -> Geometry, Transform

previewlw = CustomPreviewLineweights(
    Geometry=scale.Geometry,
    Shader=ColourSwatch(SwatchColor=RGB(0, 0, 255)),
    Thickness=Slider(2, range=0..2),
    Absolute=False)
preview = CustomPreview(Geometry=元形状, Material=swatch_3)

preview_2 = CustomPreview(Geometry=従来, Material=swatch_3)
previewlw_2 = CustomPreviewLineweights(Geometry=scale_3.Geometry, Shader=ColourSwatch(SwatchColor=RGB(0, 0, 255)), Thickness=number_slider_11, Absolute=False)
previewlw_3 = CustomPreviewLineweights(
    Geometry=scale.Geometry,
    Shader={diffuse=RGB(255, 105, 180), emission=RGB(76, 32, 54), shine=0.5, specular=RGB(255, 255, 255), transparency=0},
    Thickness=number_slider_11,
    Absolute=False)

preview_3 = CustomPreview(Geometry=提案, Material=swatch_3)
previewlw_4 = CustomPreviewLineweights(Geometry=scale_4.Geometry, Shader=ColourSwatch(SwatchColor=RGB(0, 0, 255)), Thickness=number_slider_10, Absolute=False)
previewlw_5 = CustomPreviewLineweights(
    Geometry=scale.Geometry,
    Shader={diffuse=RGB(255, 105, 180), emission=RGB(76, 32, 54), shine=0.5, specular=RGB(255, 255, 255), transparency=0},
    Thickness=number_slider_10,
    Absolute=False)

preview_4 = CustomPreview(Geometry=ハイブリッド, Material=swatch_3)
previewlw_6 = CustomPreviewLineweights(Geometry=scale_2.Geometry, Shader=ColourSwatch(SwatchColor=RGB(0, 0, 255)), Thickness=number_slider_12, Absolute=False)
previewlw_7 = CustomPreviewLineweights(
    Geometry=scale.Geometry,
    Shader={diffuse=RGB(255, 105, 180), emission=RGB(76, 32, 54), shine=0.5, specular=RGB(255, 255, 255), transparency=0},
    Thickness=number_slider_12,
    Absolute=False)
