# Grasshopper definition 3章LBFGS結果用.gh (Grasshopper 1.0.8)
# plug-ins: Heteroptera, Human, Hagoromo, NGon_RH8

crv = Curve([<curve referenced from the Rhino model> x2])
join = JoinCurves(Curves=crv, Preserve=False)
crv_2 = Curve(<curve referenced from the Rhino model>)
crv_3 = Curve(<curve referenced from the Rhino model>)
crv_4 = Curve(<curve referenced from the Rhino model>)
crv_5 = Curve(<curve referenced from the Rhino model>)
merge = Merge(Data1=join, Data2=crv_5, Data3=crv_3, Data4=crv_2, Data5=crv_4)  # -> flatten(Result)
切込み = Curve(<curve referenced from the Rhino model>)
mesh = Mesh(<mesh referenced from the Rhino model>)
meshedges = MeshEdges(Mesh=mesh)  # -> AllE, NakedE
mbridgecm = MbridgeCM(TriangulatedMeshOrCutMesh=mesh)
meshcutbylines = MeshCutWithCutLines(TriangulatedMeshOrCutMesh=mbridgecm, OpenCutLinesPolylines=切込み)
number_slider = Slider(1000, range=0..1000)
sortcutmesh = SortCutMesh(TriangulatedMeshOrCutMesh=meshcutbylines)
explode = Explode(Curve=切込み, Recursive=True)  # -> Segments, Vertices
developlbfgs = DevelopLBFGS(
    TriangulatedCutMesh=sortcutmesh,
    Iterations=Slider(10000, range=0..10000),
    XyMirror=False,
    YzMirror=False,
    ZxMirror=False,
    OuterBoundaryCurves=meshedges.NakedE,
    EdgeW="0",
    SmoothW="0",
    DevW=1)  # -> ModifiedCutMesh, DevEnergy
number_slider_2 = Slider(1, range=0..1)
center = Center(Geometry=flatten(explode.Segments))  # -> Center, Dimension
sortcutmesh_2 = SortCutMesh(TriangulatedMeshOrCutMesh=developlbfgs.ModifiedCutMesh)
cutmeshedges = CutMeshEdges(TriangulatedMeshOrCutMesh=sortcutmesh_2)  # -> MeshAllEdges, MeshNakedEdges
len = Length(Curve=cutmeshedges.MeshAllEdges)
cutmeshedges_2 = CutMeshEdges(TriangulatedMeshOrCutMesh=sortcutmesh_2)  # -> MeshAllEdges, MeshNakedEdges
_10º = PowerOf10(Value=Slider(4, range=0..10))
center_2 = Center(Geometry=meshedges.AllE)  # -> Center, Dimension
merge_2 = Merge(Data1=flatten(center_2.Center), Data2=flatten(center.Center))
mbridgecm_2 = MbridgeCM(TriangulatedMeshOrCutMesh=developlbfgs.ModifiedCutMesh)
netlbfgs2 = NetLBFGS2(TriangulatedMeshOrCutMesh=sortcutmesh_2, W0=_10º, W1=1)  # -> CutMesh, FeatureLinesPolylines
dupln = RemoveDuplicateLines(Lines=cutmeshedges_2.MeshNakedEdges, Tolerance=0.01)
cullpt = CullDuplicates(Points=merge_2, Tolerance=Slider(0.01, range=0..0.01), CullMode=1)  # -> Points, Indices, Valence
meshedges_2 = MeshEdges(Mesh=mbridgecm_2)  # -> AllE, NakedE
subtraction = Subtraction(A=cullpt.Valence, B="2")
number_slider_3 = Slider(0.0001, range=0..0.0001)
cutmeshedges_3 = CutMeshEdges(TriangulatedMeshOrCutMesh=netlbfgs2.CutMesh)  # -> MeshAllEdges, MeshNakedEdges
len_2 = Length(Curve=cutmeshedges_3.MeshAllEdges)
subtraction_2 = Subtraction(A=len_2, B=len)
abs = Absolute(Value=subtraction_2)
division = Division(A=abs, B=len)
multiplication = Multiplication(A=division, B=Slider(100, range=0..100))
sort = SortList(Keys=multiplication)  # -> Keys, ValuesA
avr = Average(Input=multiplication)
item = ListItem(List=sort.Keys, Index=0, Wrap=True)  # -> Item1, Item
merge_3 = Merge(Data1=avr, Data2=item.Item1)
gradient = Gradient(
    LowerLimit="0",
    UpperLimit="3",
    Parameter=multiplication,
    stops=[0: RGB(75, 107, 169), 0.247: RGB(173, 203, 249), 0.5: RGB(254, 244, 84), 0.748: RGB(234, 126, 0), 1: RGB(234, 38, 0)])
abs_2 = Absolute(Value=subtraction)
cull = CullPattern(List=meshedges.AllE, CullPattern=abs_2)
crv_6 = Curve(meshedges_2.NakedE)
crv_7 = Curve(dupln)
center_3 = Center(Geometry=flatten(meshedges_2.NakedE))  # -> Center, Dimension
meshedges_3 = MeshEdges(Mesh=mbridgecm_2)  # -> AllE, NakedE
checkobjective = CheckObjective(
    TriangulatedCutMesh=developlbfgs.ModifiedCutMesh,
    XyMirror=False,
    YzMirror=False,
    ZxMirror=False,
    OuterBoundaryCurves=meshedges_3.NakedE)
X = UnitX(Factor=Slider(0.1, range=0..0.1))
scale = Scale(Geometry=meshedges_3.AllE, Center=Point(0, 0, 0), Factor=Slider(1.00001, range=0..10))  # -> Geometry, Transform
scale_2 = Scale(Geometry=切込み, Center=Point(0, 0, 0), Factor=Slider(1.00001, range=0..10))  # -> Geometry, Transform
neg = Negative(Value=X)
object = ModelObject(Object=cutmeshedges_3.MeshAllEdges, Layer="LBFGS3", Display=gradient)  # -> Object, Geometry, Name, Layer, Visibility, Display, Drafting, Render
center_4 = Center(Geometry=dupln)  # -> Center, Dimension
merge_4 = Merge(Data1=flatten(center_4.Center), Data2=flatten(center_3.Center))
move = Move(Geometry=切込み, Motion=X)  # -> Geometry, Transform
cullpt_2 = CullDuplicates(Points=merge_4, Tolerance=0.1, CullMode=1)  # -> Points, Indices, Valence
subtraction_3 = Subtraction(A=cullpt_2.Valence, B="2")
abs_3 = Absolute(Value=subtraction_3)

previewlw = CustomPreviewLineweights(
    Geometry=scale.Geometry,
    Shader=ColourSwatch(SwatchColor=RGB(0, 0, 255)),
    Thickness=Slider(2, range=0..2),
    Absolute=False)
preview = CustomPreview(Geometry=mbridgecm_2, Material=ColourSwatch(SwatchColor=RGBA(128, 128, 128, 190)))
previewlw_2 = CustomPreviewLineweights(
    Geometry=meshedges.AllE,
    Shader={diffuse=RGB(255, 105, 180), emission=RGB(76, 32, 54), shine=0.5, specular=RGB(255, 255, 255), transparency=0},
    Thickness=Slider(1, range=0..2),
    Absolute=False)

previewlw_3 = CustomPreviewLineweights(
    Geometry=scale_2.Geometry,
    Shader={diffuse=RGB(255, 105, 180), emission=RGB(76, 32, 54), shine=0.5, specular=RGB(255, 255, 255), transparency=0},
    Thickness=Slider(3, range=0..10),
    Absolute=False)
preview_2 = CustomPreview(Geometry=mesh, Material=ColourSwatch(SwatchColor=RGBA(128, 128, 128, 190)))
previewlw_4 = CustomPreviewLineweights(Geometry=cull, Shader=ColourSwatch(SwatchColor=RGB(0, 0, 255)), Thickness=Slider(2, range=0..2), Absolute=False)

number_slider_4 = Slider(12, range=0..100)
cull_2 = CullPattern(List=dupln, CullPattern=abs_3)

cache = ContentCache(Content=object.Object, Action=2)
join_2 = JoinCurves(Curves=cull_2, Preserve=False)
mesh_2 = Mesh(mbridgecm_2)

panel = Panel(merge_3)
deccutmesh = DeconstructCutMesh(TriangulatedMeshOrCutMesh=developlbfgs.ModifiedCutMesh)  # -> Vertices, Faces, Edges, Dups
deccutmesh_2 = DeconstructCutMesh(TriangulatedMeshOrCutMesh=sortcutmesh)  # -> Vertices, Faces, Edges, Dups
item_2 = ListItem(List=deccutmesh_2.Vertices, Index=Slider(44, range=0..44), Wrap=True)
dist = Distance(PointA=deccutmesh.Vertices, PointB=deccutmesh_2.Vertices)
sqr = Square(Value=dist)
area = Area(Geometry=mesh)  # -> Area, Centroid
division_2 = Division(A=sqr, B=area.Area)
multiplication_2 = Multiplication(A=division_2, B="100")
avr_2 = Average(Input=multiplication_2)
sort_2 = SortList(Keys=multiplication_2)  # -> Keys, ValuesA
item_3 = ListItem(List=sort_2.Keys, Index=0, Wrap=True)  # -> Item1, Item
panel_2 = Panel([avr_2, item_3.Item1])
