# Grasshopper definition DevCheck2.gh (Grasshopper 1.0.8)
# plug-ins: Heteroptera, Pufferfish, Human, Crane, Hagoromo, Weaverbird, NGon_RH8

crv = Curve([<curve referenced from the Rhino model> x81])
project = Project(Geometry=crv, Plane=PlaneXY(0, 0, 0))  # -> Geometry, Transform
wbweave = WeaverbirdsMeshFromLinesWeaveBack(Lines=project.Geometry, MaximumValence=4)
# カットメッシュとは
crv_2 = Curve([<curve referenced from the Rhino model> x71])
meshedges = MeshEdges(Mesh=wbweave)  # -> AllE, NakedE
crv_3 = Curve(<curve referenced from the Rhino model>)
project_2 = Project(Geometry=crv_3, Plane=PlaneXY(0, 0, 0))  # -> Geometry, Transform
meshcutbylines = MeshCutWithCutLines(TriangulatedMeshOrCutMesh=wbweave, OpenCutLinesPolylines=project_2.Geometry)
X = UnitX(Factor=Slider(123, range=0..1000))
wbweave_2 = WeaverbirdsMeshFromLinesWeaveBack(Lines=crv, MaximumValence=4)
wbweave_3 = WeaverbirdsMeshFromLinesWeaveBack(Lines=crv_2, MaximumValence=4)
move = Move(Geometry=meshedges.NakedE, Motion=X)  # -> Geometry, Transform
mbridgecm = MbridgeCM(TriangulatedMeshOrCutMesh=wbweave_2)
movecm = MoveCutMesh(TriangulatedMeshOrCutMesh=meshcutbylines, MoveDirection=X)
meshedges_2 = MeshEdges(Mesh=wbweave_2)  # -> AllE, NakedE

opentreemesh = OpenTreeMesh(TriangulatedDevelopableMesh=wbweave_3)  # -> CutMesh, CutLines, MeshGraph
mbridgecm_2 = MbridgeCM(TriangulatedMeshOrCutMesh=opentreemesh.CutMesh)
cutmeshedges = CutMeshEdges(TriangulatedMeshOrCutMesh=opentreemesh.CutMesh)  # -> MeshAllEdges, MeshNakedEdges
crv_4 = Curve(cutmeshedges.MeshNakedEdges)

mbridgecm_3 = MbridgeCM(TriangulatedMeshOrCutMesh=wbweave_3)
meshedges_3 = MeshEdges(Mesh=wbweave_3)  # -> AllE, NakedE
meshcutbylines_2 = MeshCutWithCutLines(TriangulatedMeshOrCutMesh=wbweave_2, OpenCutLinesPolylines=crv_3)
developcm2 = DevelopCutMesh2(
    TriangulatedCutMesh=movecm,
    Iterations=Slider(100, range=0..100),
    XyMirror=False,
    YzMirror=False,
    ZxMirror=False,
    OuterBoundaryCurves=move.Geometry,
    Alpha=0.1)
panel = Panel("""47
49
53
61
4""")
number_slider = Slider(1000, range=0..1000)
item = ListItem(List=meshedges_3.AllE, Index=panel, Wrap=True)
mesh = Mesh(<mesh referenced from the Rhino model>)
item_2 = ListItem(List=meshedges_3.AllE, Index="78", Wrap=True)
crv_5 = Curve([<curve referenced from the Rhino model> x2])
sortcutmesh = SortCutMesh(TriangulatedMeshOrCutMesh=meshcutbylines_2)
cutmeshedges_2 = CutMeshEdges(TriangulatedMeshOrCutMesh=developcm2)  # -> MeshAllEdges, MeshNakedEdges
number_slider_2 = Slider(1000, range=0..1000)

merge = Merge(Data1=crv_5, Data2=item_2, Data3=item)  # -> flatten(Result)
meshcut = MeshCut(TriangulatedMeshOrCutMesh=mbridgecm_3, OpenCutLinesPolylines=merge)

merge_2 = Merge(Data1=crv_5, Data2=item_2)  # -> flatten(Result)
meshcut_2 = MeshCut(TriangulatedMeshOrCutMesh=mbridgecm_3, OpenCutLinesPolylines=merge_2)

number_slider_3 = Slider(4560, range=0..10000)
item_3 = ListItem(List=cutmeshedges_2.MeshAllEdges, Index="46", Wrap=True)
meshcutbylines_3 = MeshCutWithCutLines(TriangulatedMeshOrCutMesh=developcm2, OpenCutLinesPolylines=item_3)

gcurvature = GaussianCurvature(TriangulatedMesh=mesh)
sort = SortList(Keys=gcurvature, ValuesA=gcurvature)  # -> Keys, ValuesA
avr = Average(Input=gcurvature)
item_4 = ListItem(List=sort.ValuesA, Index=0, Wrap=True)  # -> Item1, Item
merge_3 = Merge(Data1=item_4.Item1, Data2=item_4.Item, Data3=avr)
panel_2 = Panel(merge_3)

sortcutmesh_2 = SortCutMesh(TriangulatedMeshOrCutMesh=meshcut_2)
develop_mesh = DevelopMesh(Mesh=mesh)  # -> DevelopMesh, FaceTree
meshnet4 = MeshNet4(TriangulatedMeshOrCutMesh=mesh)  # -> CutMesh, FeatureLinesPolylines
developcm2_2 = DevelopCutMesh2(
    TriangulatedCutMesh=sortcutmesh,
    Iterations=Slider(2000, range=0..10000),
    XyMirror=False,
    YzMirror=False,
    ZxMirror=False,
    OuterBoundaryCurves=meshedges_2.NakedE,
    Alpha=0.1)
developcm3 = DevelopCutMesh3(
    TriangulatedCutMesh=sortcutmesh,
    Iterations=Slider(100, range=0..100),
    XyMirror=False,
    YzMirror=False,
    ZxMirror=False,
    OuterBoundaryCurves=meshedges_2.NakedE,
    Alpha=Slider(0.1, range=0..0.1))
cutmeshedges_3 = CutMeshEdges(TriangulatedMeshOrCutMesh=developcm3)  # -> MeshAllEdges, MeshNakedEdges
item_5 = ListItem(List=cutmeshedges_3.MeshAllEdges, Index="46", Wrap=True)
sortcutmesh_3 = SortCutMesh(TriangulatedMeshOrCutMesh=meshcut)
meshnet4_2 = MeshNet4(TriangulatedMeshOrCutMesh=meshcutbylines_3)  # -> CutMesh, FeatureLinesPolylines
meshcutbylines_4 = MeshCutWithCutLines(TriangulatedMeshOrCutMesh=developcm3, OpenCutLinesPolylines=item_5)
number_slider_4 = Slider(9, range=0..50)
mbridgecm_4 = MbridgeCM(TriangulatedMeshOrCutMesh=meshnet4.CutMesh)
deccutmesh = DeconstructCutMesh(TriangulatedMeshOrCutMesh=sortcutmesh_2)  # -> Vertices, Faces, Edges
cutmeshedges_4 = CutMeshEdges(TriangulatedMeshOrCutMesh=developcm2_2)  # -> MeshAllEdges, MeshNakedEdges
center = Center(Geometry=wbweave_2)  # -> Center, Dimension
dividecutmesh = DivideCutMesh(TriangulatedMeshOrCutMesh=sortcutmesh_3)
meshnet4_3 = MeshNet4(TriangulatedMeshOrCutMesh=meshcutbylines_4)  # -> CutMesh, FeatureLinesPolylines
mesh_2 = Mesh(develop_mesh.DevelopMesh)
mbridgecm_5 = MbridgeCM(TriangulatedMeshOrCutMesh=meshnet4_2.CutMesh)
item_6 = ListItem(List=cutmeshedges_4.MeshAllEdges, Index="46", Wrap=True)
meshedges_4 = MeshEdges(Mesh=mbridgecm_4)  # -> AllE, NakedE
crv_6 = Curve([<curve referenced from the Rhino model> x18])
mesh_3 = Mesh(<mesh referenced from the Rhino model>)
meshcutbylines_5 = MeshCutWithCutLines(TriangulatedMeshOrCutMesh=developcm2_2, OpenCutLinesPolylines=item_6)
center_2 = Center(Geometry=mbridgecm_5)  # -> Center, Dimension
cutmeshedges_5 = CutMeshEdges(TriangulatedMeshOrCutMesh=meshcut)  # -> MeshAllEdges, MeshNakedEdges
meshedges_5 = MeshEdges(Mesh=mesh_3)  # -> AllE, NakedE
wbweave_4 = WeaverbirdsMeshFromLinesWeaveBack(Lines=crv_6, MaximumValence=4)
mbridgecm_6 = MbridgeCM(TriangulatedMeshOrCutMesh=meshnet4_3.CutMesh)
crv_7 = Curve(meshedges_4.NakedE)
len = Length(Curve=crv_7)
item_7 = ListItem(List=dividecutmesh, Index="1", Wrap=True)
crv_8 = Curve(meshedges_5.AllE)
avr_2 = Average(Input=len)
crv_9 = Curve([<curve referenced from the Rhino model> x893])
meshnet4_4 = MeshNet4(TriangulatedMeshOrCutMesh=meshcutbylines_5)  # -> CutMesh, FeatureLinesPolylines
center_3 = Center(Geometry=mbridgecm_6)  # -> Center, Dimension
center_4 = Center(Geometry=wbweave_2)  # -> Center, Dimension
opentreemesh_2 = OpenTreeMesh(TriangulatedDevelopableMesh=wbweave_4)  # -> CutMesh, CutLines, MeshGraph
move2pt = MoveToPoint(Geometry=mbridgecm_5, PointA=center_2.Center, PointB=center.Center)  # -> Moved, Vector, Transform
sortcutmesh_4 = SortCutMesh(TriangulatedMeshOrCutMesh=item_7)
move2pt_2 = MoveToPoint(Geometry=mbridgecm_6, PointA=center_3.Center, PointB=center_4.Center)  # -> Moved, Vector, Transform
center_5 = Center(Geometry=wbweave_2)  # -> Center, Dimension
wbweave_5 = WeaverbirdsMeshFromLinesWeaveBack(Lines=crv_9, MaximumValence=4)
meshnet4_5 = MeshNet4(TriangulatedMeshOrCutMesh=opentreemesh_2.CutMesh)  # -> CutMesh, FeatureLinesPolylines
mbridgecm_7 = MbridgeCM(TriangulatedMeshOrCutMesh=meshnet4_4.CutMesh)
cutmeshedges_6 = CutMeshEdges(TriangulatedCutMesh=opentreemesh_2.CutMesh)  # -> MeshAllEdges, MeshNakedEdges
deccutmesh_2 = DeconstructCutMesh(TriangulatedMeshOrCutMesh=sortcutmesh_4)  # -> Vertices, Faces, Edges
mesh_4 = Mesh(wbweave_5)
center_6 = Center(Geometry=mbridgecm_7)  # -> Center, Dimension
panel_3 = Panel("2")
item_8 = ListItem(List=deccutmesh.Edges, Index="1", Wrap=True)  # -> flatten(Item)
item_9 = ListItem(List=deccutmesh.Edges, Index="0", Wrap=True)  # -> flatten(Item)
number_slider_5 = Slider(22, range=0..50)
item_10 = ListItem(List=deccutmesh.Vertices, Index=Slider(0, range=0..30), Wrap=True)

# ----
# 曲率0に
cmesh_from_mesh = CMeshFromMesh(Mesh=wbweave_5)
developable = Developable()
static_solver = CraneStaticSolver(
    CMesh=cmesh_from_mesh,
    Constraints=developable,
    NRIteration=50,
    CGNRIteration=100,
    Threshold=1e-13,
    Solve=Toggle(True),
    IsRigidEdge=False,
    IsPanelFlat=True,
    IsFoldBlock=True,
    IsConstraint=True)  # -> CMesh, RigidOrigami, Residual
deconstruct_cmesh = DeconstructCMesh(CMesh=static_solver.CMesh)  # -> Mesh, Mountain, Valley, Boundary, Unassigned, Triangulate, Edges, Inner
develop_mesh_2 = DevelopMesh(Mesh=deconstruct_cmesh.Mesh)  # -> DevelopMesh, FaceTree
gcurvature_2 = GaussianCurvature(TriangulatedMesh=deconstruct_cmesh.Mesh)
sort_2 = SortList(Keys=gcurvature_2, ValuesA=gcurvature_2)  # -> Keys, ValuesA
avr_3 = Average(Input=gcurvature_2)
item_11 = ListItem(List=sort_2.ValuesA, Index=0, Wrap=True)  # -> Item1, Item
merge_4 = Merge(Data1=item_11.Item1, Data2=item_11.Item, Data3=avr_3)
panel_4 = Panel(merge_4)

move2pt_3 = MoveToPoint(Geometry=mbridgecm_7, PointA=center_6.Center, PointB=center_5.Center)  # -> Moved, Vector, Transform
item_12 = ListItem(List=item_9, Index=number_slider_4, Wrap=True)
item_13 = ListItem(List=item_8, Index=number_slider_4, Wrap=True)
item_14 = ListItem(List=deccutmesh.Vertices, Index=item_12, Wrap=True)
item_15 = ListItem(List=deccutmesh.Vertices, Index=item_13, Wrap=True)

develop = DevelopMesh(TriangulatedMesh=wbweave_5, Count=Slider(1000, range=0..1000))  # -> ModifiedMesh, A
gcurvature_3 = GaussianCurvature(TriangulatedMesh=develop.ModifiedMesh)
sort_3 = SortList(Keys=gcurvature_3, ValuesA=gcurvature_3)  # -> Keys, ValuesA
avr_4 = Average(Input=gcurvature_3)
item_16 = ListItem(List=sort_3.ValuesA, Index=0, Wrap=True)  # -> Item1, Item
merge_5 = Merge(Data1=item_16.Item1, Data2=item_16.Item, Data3=avr_4)
# 長さの最適化まで入れたら長さのずれが0.1倍になった
panel_5 = Panel(merge_5)

ln = Line(StartPoint=item_14, EndPoint=item_15)
meshedges_6 = MeshEdges(Mesh=develop.ModifiedMesh)  # -> AllE, NakedE
mbridgecm_8 = MbridgeCM(TriangulatedMeshOrCutMesh=wbweave_5)
len_2 = Length(Curve=meshedges_6.NakedE)
item_17 = ListItem(List=deccutmesh_2.Edges, Index="1", Wrap=True)  # -> flatten(Item)
item_18 = ListItem(List=deccutmesh_2.Edges, Index="0", Wrap=True)  # -> flatten(Item)
avr_5 = Average(Input=len_2)
developcm = DevelopCutMesh(TriangulatedCutMesh=mbridgecm_8, Count=Slider(1000, range=0..1000))
item_19 = ListItem(List=deccutmesh_2.Vertices, Index=Slider(0, range=0..30), Wrap=True)
sortcutmesh_5 = SortCutMesh(TriangulatedMeshOrCutMesh=deconstruct_cmesh.Mesh)
item_20 = ListItem(List=item_18, Index=number_slider_5, Wrap=True)
item_21 = ListItem(List=item_17, Index=number_slider_5, Wrap=True)
cutmeshedges_7 = CutMeshEdges(TriangulatedMeshOrCutMesh=developcm)  # -> MeshAllEdges, MeshNakedEdges
meshnet6 = MeshNet6(TriangulatedMeshOrCutMesh=sortcutmesh_5)
item_22 = ListItem(List=deccutmesh_2.Vertices, Index=item_20, Wrap=True)
item_23 = ListItem(List=deccutmesh_2.Vertices, Index=item_21, Wrap=True)
ln_2 = Line(StartPoint=item_22, EndPoint=item_23)
cutmeshedges_8 = CutMeshEdges(TriangulatedMeshOrCutMesh=sortcutmesh_5)  # -> MeshAllEdges, MeshNakedEdges
cutmeshedges_9 = CutMeshEdges(TriangulatedMeshOrCutMesh=meshnet6)  # -> MeshAllEdges, MeshNakedEdges
meshedges_7 = MeshEdges(Mesh=deconstruct_cmesh.Mesh)  # -> AllE, NakedE
meshedges_8 = MeshEdges(Mesh=develop_mesh_2.DevelopMesh)  # -> AllE, NakedE
len_3 = Length(Curve=cutmeshedges_8.MeshAllEdges)
len_4 = Length(Curve=cutmeshedges_9.MeshAllEdges)
len_5 = Length(Curve=meshedges_8.AllE)
len_6 = Length(Curve=meshedges_7.AllE)
mesh_5 = Mesh(<mesh referenced from the Rhino model>)
subtraction = Subtraction(A=len_3, B=len_4)
subtraction_2 = Subtraction(A=len_5, B=len_6)
abs = Absolute(Value=subtraction)
abs_2 = Absolute(Value=subtraction_2)

# ----
# 展開図
develop_mesh_3 = DevelopMesh(Mesh=develop.ModifiedMesh)  # -> DevelopMesh, FaceTree
meshedges_9 = MeshEdges(Mesh=develop_mesh_3.DevelopMesh)  # -> AllE, NakedE

sortcutmesh_6 = SortCutMesh(TriangulatedMeshOrCutMesh=develop.ModifiedMesh)
avr_6 = Average(Input=abs)
sort_4 = SortList(Keys=abs)  # -> Keys, ValuesA
avr_7 = Average(Input=abs_2)
meshnet4_6 = MeshNet4(TriangulatedMeshOrCutMesh=develop.ModifiedMesh)  # -> CutMesh, FeatureLinesPolylines
meshnet6_2 = MeshNet6(TriangulatedMeshOrCutMesh=develop.ModifiedMesh)
sort_5 = SortList(Keys=abs_2)  # -> Keys, ValuesA
item_24 = ListItem(List=sort_4.Keys, Index=0, Wrap=True)  # -> Item1, Item
item_25 = ListItem(List=sort_5.Keys, Index=0, Wrap=True)  # -> Item1, Item
cutmeshedges_10 = CutMeshEdges(TriangulatedMeshOrCutMesh=sortcutmesh_6)  # -> MeshAllEdges, MeshNakedEdges
mbridgecm_9 = MbridgeCM(TriangulatedMeshOrCutMesh=meshnet4_6.CutMesh)
cutmeshedges_11 = CutMeshEdges(TriangulatedMeshOrCutMesh=meshnet6_2)  # -> MeshAllEdges, MeshNakedEdges
crv_10 = Curve([<curve referenced from the Rhino model> x2])
merge_6 = Merge(Data1=avr_6, Data2=item_24.Item1, Data3=item_24.Item)
merge_7 = Merge(Data1=avr_7, Data2=item_25.Item1, Data3=item_25.Item)
join = JoinCurves(Curves=crv_10, Preserve=False)
crv_11 = Curve(<curve referenced from the Rhino model>)
crv_12 = Curve(<curve referenced from the Rhino model>)
meshedges_10 = MeshEdges(Mesh=mbridgecm_9)  # -> AllE, NakedE
crv_13 = Curve(<curve referenced from the Rhino model>)
crv_14 = Curve(<curve referenced from the Rhino model>)
panel_7 = Panel(merge_6)
panel_8 = Panel(merge_7)
len_7 = Length(Curve=cutmeshedges_10.MeshAllEdges)
len_8 = Length(Curve=cutmeshedges_11.MeshAllEdges)
len_9 = Length(Curve=meshedges_10.NakedE)
merge_8 = Merge(Data1=join, Data2=crv_13, Data3=crv_12, Data4=crv_11, Data5=crv_14)  # -> flatten(Result)
avr_8 = Average(Input=len_9)
cutmeshedges_12 = CutMeshEdges(TriangulatedMeshOrCutMesh=meshnet4_6.CutMesh)  # -> MeshAllEdges, MeshNakedEdges
subtraction_3 = Subtraction(A=len_8, B=len_7)
meshcutbylines_6 = MeshCutWithCutLines(TriangulatedMeshOrCutMesh=mesh_5, OpenCutLinesPolylines=merge_8)
len_10 = Length(Curve=cutmeshedges_12.MeshAllEdges)
abs_3 = Absolute(Value=subtraction_3)
mplane = MeshPlane(Boundary={Plane=PlaneXY(0, 0, 0), Size=Domain2(u=-10..10, v=-10..10)}, WidthCount=10, HeightCount=10)  # -> Mesh, Area
subtraction_4 = Subtraction(A=len_10, B=len_7)
crv_15 = Curve([<curve referenced from the Rhino model> x102])
avr_9 = Average(Input=abs_3)
tri = Triangulate(Mesh=mplane.Mesh)  # -> Mesh, Count
sort_6 = SortList(Keys=abs_3)  # -> Keys, ValuesA
abs_4 = Absolute(Value=subtraction_4)
X_2 = UnitX(Factor=Slider(194, range=0..1000))
Y = UnitY(Factor=Slider(234, range=0..1000))
move_2 = Move(Geometry=tri.Mesh, Motion=Y)  # -> Geometry, Transform
item_26 = ListItem(List=sort_6.Keys, Index=0, Wrap=True)  # -> Item1, Item
wbweave_6 = WeaverbirdsMeshFromLinesWeaveBack(Lines=crv_15, MaximumValence=4)
avr_10 = Average(Input=abs_4)
sort_7 = SortList(Keys=abs_4)  # -> Keys, ValuesA
grab = Grab(On=True, Strength=1, Range=3)
number_slider_6 = Slider(2082, range=0..10000)  # disabled
mbridgecm_10 = MbridgeCM(TriangulatedMeshOrCutMesh=mesh_5)
meshedges_11 = MeshEdges(Mesh=wbweave_6)  # -> AllE, NakedE
merge_9 = Merge(Data1=avr_9, Data2=item_26.Item1, Data3=item_26.Item)
item_27 = ListItem(List=sort_7.Keys, Index=0, Wrap=True)  # -> Item1, Item
crv_16 = Curve([<curve referenced from the Rhino model> x1348])  # disabled
X_3 = UnitX(Factor=Slider(2000, range=0..10000))
panel_9 = Panel("""38
42""")
wbweave_7 = WeaverbirdsMeshFromLinesWeaveBack(Lines=crv_16, MaximumValence=4)  # disabled
merge_10 = Merge(Data1=avr_10, Data2=item_27.Item1, Data3=item_27.Item)
meshedges_12 = MeshEdges(Mesh=mesh_5)  # -> AllE, NakedE
panel_10 = Panel(merge_9)
sortcutmesh_7 = SortCutMesh(TriangulatedMeshOrCutMesh=mbridgecm_10)
item_28 = ListItem(List=meshedges_11.AllE, Index=panel_9, Wrap=True)
develop_2 = DevelopMesh(TriangulatedMesh=wbweave_7, Count=number_slider_6)  # -> ModifiedMesh, A; disabled
meshedges_13 = MeshEdges(Mesh=mesh_5)  # -> AllE, NakedE
move_3 = Move(Geometry=meshedges_13.NakedE, Motion=X_2)  # -> Geometry, Transform
mesh_6 = Mesh(wbweave_7)  # disabled
sortcutmesh_8 = SortCutMesh(TriangulatedMeshOrCutMesh=mesh_6)  # disabled
move_4 = Move(Geometry=mesh_5, Motion=X_3)  # -> Geometry, Transform
panel_11 = Panel(merge_10)
meshcutbylines_7 = MeshCutWithCutLines(TriangulatedMeshOrCutMesh=wbweave_6, OpenCutLinesPolylines=item_28)
deccutmesh_3 = DeconstructCutMesh(TriangulatedMeshOrCutMesh=sortcutmesh_7)  # -> Vertices, Faces, Edges
sortcutmesh_9 = SortCutMesh(TriangulatedMeshOrCutMesh=develop_2.ModifiedMesh)  # disabled
sortcutmesh_10 = SortCutMesh(TriangulatedMeshOrCutMesh=meshcutbylines_7)
movecm_2 = MoveCutMesh(TriangulatedMeshOrCutMesh=meshcutbylines_6, MoveDirection=X_2)
crv_17 = Curve([<curve referenced from the Rhino model> x2])
crv_18 = Curve([<curve referenced from the Rhino model> x2])
number_slider_7 = Slider(100, range=0..100)
meshedges_14 = MeshEdges(Mesh=mesh_6)  # -> AllE, NakedE; disabled
developcm3_2 = DevelopCutMesh3(
    TriangulatedCutMesh=sortcutmesh_8,
    Iterations=number_slider_6,
    XyMirror=False,
    YzMirror=False,
    ZxMirror=False,
    OuterBoundaryCurves=meshedges_14.NakedE,
    Alpha=1)  # disabled
deccutmesh_4 = DeconstructCutMesh(TriangulatedMeshOrCutMesh=sortcutmesh_9)  # -> Vertices, Faces, Edges; disabled
cutmeshedges_13 = CutMeshEdges(TriangulatedMeshOrCutMesh=sortcutmesh_10)  # -> MeshAllEdges, MeshNakedEdges
deccutmesh_5 = DeconstructCutMesh(TriangulatedMeshOrCutMesh=developcm3_2)  # -> Vertices, Faces, Edges; disabled
divide = DivideCurve(Curve=crv_17, Count=10, Kinks=False)  # -> Points, Tangents, Parameters
divide_2 = DivideCurve(Curve=crv_18, Count=10, Kinks=False)  # -> Points, Tangents, Parameters
mbridgecm_11 = MbridgeCM(TriangulatedMeshOrCutMesh=move_4.Geometry)
mesh_7 = Mesh(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)
number_slider_8 = Slider(10000, range=0..10000)  # disabled
number_slider_9 = Slider(1000, range=0..1000)
number_slider_10 = Slider(1000, range=0..1000)
move_5 = Move(Geometry=meshedges_12.NakedE, Motion=X_3)  # -> Geometry, Transform
bang = ExplodeTree(Data=divide.Points)  # -> Branch0, Branch1
developcm2_3 = DevelopCutMesh2(
    TriangulatedCutMesh=mesh_5,
    Iterations=Slider(10000, range=0..10000),
    XyMirror=False,
    YzMirror=False,
    ZxMirror=False,
    OuterBoundaryCurves=meshedges_13.NakedE,
    Alpha=0.1)
move_6 = Move(Geometry=merge_8, Motion=X_3)  # -> Geometry, Transform
bang_2 = ExplodeTree(Data=divide_2.Points)  # -> Branch0, Branch1
crv_19 = Curve(cutmeshedges_13.MeshNakedEdges)
developcm2_4 = DevelopCutMesh2(
    TriangulatedCutMesh=meshcutbylines_7,
    Iterations=Slider(100, range=0..100),
    XyMirror=False,
    YzMirror=False,
    ZxMirror=False,
    OuterBoundaryCurves=crv_19,
    Alpha=0.1)
number_slider_11 = Slider(1000, range=0..1000)
sortcutmesh_11 = SortCutMesh(TriangulatedMeshOrCutMesh=movecm_2)
scale = Scale(Geometry=mesh_7, Center=Point(0, 0, 0), Factor=Slider(20, range=0..100))  # -> Geometry, Transform
dist = Distance(PointA=deccutmesh_4.Vertices, PointB=deccutmesh_5.Vertices)  # disabled
mesh_8 = Mesh(<mesh referenced from the Rhino model>)
number_slider_12 = Slider(1000, range=0..1000)  # disabled
number_slider_13 = Slider(0.4, range=0..1)
ln_3 = Line(StartPoint=bang.Branch0, EndPoint=bang.Branch1)
ln_4 = Line(StartPoint=bang_2.Branch0, EndPoint=bang_2.Branch1)
number_slider_14 = Slider(6000, range=0..100000)  # disabled
meshedges_15 = MeshEdges(Mesh=mesh_8)  # -> AllE, NakedE
panel_12 = Panel(dist)  # disabled
mbridgecm_12 = MbridgeCM(TriangulatedMeshOrCutMesh=developcm2_3)
develop_3 = DevelopMesh(TriangulatedMesh=scale.Geometry, Count=Slider(10000, range=0..10000))  # -> ModifiedMesh, A
mesh_9 = Mesh(develop_3.ModifiedMesh)
mbridgecm_13 = MbridgeCM(TriangulatedMeshOrCutMesh=mesh_9)
deccutmesh_6 = DeconstructCutMesh(TriangulatedMeshOrCutMesh=sortcutmesh_11)  # -> Vertices, Faces, Edges
divide_3 = DivideCurve(Curve=ln_4, Count=10, Kinks=False)  # -> Points, Tangents, Parameters
sortcutmesh_12 = SortCutMesh(TriangulatedMeshOrCutMesh=mbridgecm_11)
developcm3_3 = DevelopCutMesh3(
    TriangulatedCutMesh=movecm_2,
    Iterations=Slider(10000, range=0..10000),
    XyMirror=False,
    YzMirror=False,
    ZxMirror=False,
    OuterBoundaryCurves=move_3.Geometry,
    Alpha=Slider(0.1, range=0..0.1))  # disabled
divide_4 = DivideCurve(Curve=ln_3, Count=10, Kinks=False)  # -> Points, Tangents, Parameters
mbridgecm_14 = MbridgeCM(TriangulatedMeshOrCutMesh=developcm2_4)  # disabled
sortcutmesh_13 = SortCutMesh(TriangulatedMeshOrCutMesh=mbridgecm_13)
crv_20 = Curve(meshedges_15.AllE)
cutmeshedges_14 = CutMeshEdges(TriangulatedMeshOrCutMesh=developcm2_4)  # -> MeshAllEdges, MeshNakedEdges
developcm2_5 = DevelopCutMesh2(
    TriangulatedCutMesh=movecm_2,
    Iterations=Slider(5000, range=0..10000),
    XyMirror=False,
    YzMirror=False,
    ZxMirror=False,
    OuterBoundaryCurves=move_3.Geometry,
    Alpha=Slider(0.01, range=0..0.1))  # disabled
meshnet6_3 = MeshNet6(TriangulatedMeshOrCutMesh=sortcutmesh_13)
mbridgecm_15 = MbridgeCM(TriangulatedMeshOrCutMesh=meshnet6_3)
mbridgecm_16 = MbridgeCM(TriangulatedMeshOrCutMesh=mesh_6)  # disabled
developcm3_4 = DevelopCutMesh3(
    TriangulatedCutMesh=move_4.Geometry,
    Iterations=Slider(10000, range=0..10000),
    XyMirror=False,
    YzMirror=False,
    ZxMirror=False,
    OuterBoundaryCurves=move_5.Geometry,
    FixPointsCrv=move_6.Geometry,
    Alpha=1)  # disabled
gcurvature_4 = GaussianCurvature(TriangulatedMesh=develop_2.ModifiedMesh)  # disabled
shatter = Shatter(Curve=graft(ln_4), Parameters=divide_3.Parameters)
shatter_2 = Shatter(Curve=graft(ln_3), Parameters=divide_4.Parameters)
panel_13 = Panel(shatter_2)
developcm2_6 = DevelopCutMesh2(
    TriangulatedCutMesh=move_4.Geometry,
    Iterations=Slider(10000, range=0..10000),
    XyMirror=False,
    YzMirror=False,
    ZxMirror=False,
    OuterBoundaryCurves=move_5.Geometry,
    FixPointsCrv=move_6.Geometry,
    Alpha=0.1)  # disabled
mesh_10 = Mesh(<mesh referenced from the Rhino model>)
series = Series(Start=0, Step=1, Count=10)
cutmeshedges_15 = CutMeshEdges(TriangulatedMeshOrCutMesh=sortcutmesh_13)  # -> flatten(MeshAllEdges), MeshNakedEdges
developcm2_7 = DevelopCutMesh2(
    TriangulatedCutMesh=mesh_6,
    Iterations=number_slider_14,
    XyMirror=False,
    YzMirror=False,
    ZxMirror=False,
    OuterBoundaryCurves=meshedges_14.NakedE,
    Alpha=0.1)  # disabled
deccutmesh_7 = DeconstructCutMesh(TriangulatedMeshOrCutMesh=sortcutmesh_12)  # -> Vertices, Faces, Edges
number_slider_15 = Slider(10000, range=0..10000)  # disabled
meshnet4_7 = MeshNet4(TriangulatedMeshOrCutMesh=sortcutmesh_13)  # -> CutMesh, FeatureLinesPolylines
number_slider_16 = Slider(1000, range=0..1000)  # disabled
x_plus_one = XPlusOne(NumberX=series)
gcurvature_5 = GaussianCurvature(TriangulatedMesh=mbridgecm_14)
panel_14 = Panel("""26
50
74""")
cutmeshedges_16 = CutMeshEdges(TriangulatedMeshOrCutMesh=meshnet6_3)  # -> flatten(MeshAllEdges), MeshNakedEdges
cutmeshedges_17 = CutMeshEdges(TriangulatedMeshOrCutMesh=developcm2_7)  # -> MeshAllEdges, MeshNakedEdges; disabled
number_slider_17 = Slider(3440, range=0..10000)  # disabled
meshedges_16 = MeshEdges(Mesh=mesh_10)  # -> AllE, NakedE
deccutmesh_8 = DeconstructCutMesh(TriangulatedMeshOrCutMesh=mbridgecm_16)  # -> Vertices, Faces, Edges; disabled
sort_8 = SortList(Keys=gcurvature_4, ValuesA=gcurvature_4)  # -> Keys, ValuesA; disabled
crv_21 = Curve(cutmeshedges_17.MeshNakedEdges)  # disabled
item_29 = ListItem(List=divide_3.Points, Index=x_plus_one, Wrap=True)
flip = FlipMatrix(Data=item_29)
sort_9 = SortList(Keys=gcurvature_5, ValuesA=gcurvature_5)  # -> Keys, ValuesA
len_11 = Length(Curve=cutmeshedges_15.MeshAllEdges)
avr_11 = Average(Input=gcurvature_4)  # disabled
item_30 = ListItem(List=divide_3.Points, Index=series, Wrap=True)
crv_22 = Curve(meshedges_16.NakedE)
len_12 = Length(Curve=cutmeshedges_16.MeshAllEdges)
subtraction_5 = Subtraction(A=len_12, B=len_11)

# ----
# 移動距離が大きかったもの
number_slider_18 = Slider(30, range=0..100)
deccutmesh_9 = DeconstructCutMesh(TriangulatedMeshOrCutMesh=developcm2_6)  # -> Vertices, Faces, Edges
dist_2 = Distance(PointA=deccutmesh_7.Vertices, PointB=deccutmesh_9.Vertices)
lng = ListLength(List=dist_2)
series_2 = Series(Start=0, Step=1, Count=lng)
series_3 = Series(Start=0, Step=1, Count=number_slider_18)
x_plus_one_2 = XPlusOne(NumberX=series_3)
avr_12 = Average(Input=dist_2)
sort_10 = SortList(Keys=dist_2, ValuesA=series_2)  # -> Keys, ValuesA
neg = Negative(Value=x_plus_one_2)
item_31 = ListItem(List=sort_10.Keys, Index=0, Wrap=True)  # -> Item1, Item
item_32 = ListItem(List=sort_10.ValuesA, Index=neg, Wrap=True)
merge_11 = Merge(Data1=item_31.Item1, Data2=item_31.Item, Data3=avr_12)  # -> flatten(Result)
panel_15 = Panel(merge_11)
item_33 = ListItem(List=deccutmesh_9.Vertices, Index=item_32, Wrap=True)

# ----
# 移動距離が大きかったもの
number_slider_19 = Slider(30, range=0..100)
deccutmesh_10 = DeconstructCutMesh(TriangulatedMeshOrCutMesh=developcm3_4)  # -> Vertices, Faces, Edges
dist_3 = Distance(PointA=deccutmesh_7.Vertices, PointB=deccutmesh_10.Vertices)
lng_2 = ListLength(List=dist_3)
series_4 = Series(Start=0, Step=1, Count=lng_2)
series_5 = Series(Start=0, Step=1, Count=number_slider_19)
x_plus_one_3 = XPlusOne(NumberX=series_5)
avr_13 = Average(Input=dist_3)
sort_11 = SortList(Keys=dist_3, ValuesA=series_4)  # -> Keys, ValuesA
neg_2 = Negative(Value=x_plus_one_3)
item_34 = ListItem(List=sort_11.Keys, Index=0, Wrap=True)  # -> Item1, Item
item_35 = ListItem(List=sort_11.ValuesA, Index=neg_2, Wrap=True)
merge_12 = Merge(Data1=item_34.Item1, Data2=item_34.Item, Data3=avr_13)  # -> flatten(Result)
panel_16 = Panel(merge_12)
item_36 = ListItem(List=deccutmesh_10.Vertices, Index=item_35, Wrap=True)

item_37 = ListItem(List=cutmeshedges_14.MeshAllEdges, Index=panel_14, Wrap=True)
cull_i = CullIndex(List=flip, Indices="-1", Wrap=True)

# ----
# ガウス曲率が大きかったもの
cutmeshgcurvature = CutMeshGCurvature(TriangulatedMeshOrCutMesh=developcm3_3)
deccutmesh_11 = DeconstructCutMesh(TriangulatedMeshOrCutMesh=developcm3_3)  # -> Vertices, Faces, Edges
lng_3 = ListLength(List=cutmeshgcurvature)
abs_5 = Absolute(Value=cutmeshgcurvature)
series_6 = Series(Start=0, Step=1, Count=lng_3)
series_7 = Series(Start=0, Step=1, Count=Slider(100, range=0..100))
sort_12 = SortList(Keys=abs_5, ValuesA=series_6)  # -> Keys, ValuesA
x_plus_one_4 = XPlusOne(NumberX=series_7)
neg_3 = Negative(Value=x_plus_one_4)
item_38 = ListItem(List=sort_12.ValuesA, Index=neg_3, Wrap=True)
avr_14 = Average(Input=sort_12.Keys)
item_39 = ListItem(List=sort_12.Keys, Index=0, Wrap=True)  # -> Item1, Item
merge_13 = Merge(Data1=avr_14, Data2=item_39.Item1, Data3=item_39.Item)
panel_17 = Panel(merge_13)
item_40 = ListItem(List=deccutmesh_11.Vertices, Index=item_38, Wrap=True)

# ----
# 移動距離が大きかったもの
number_slider_20 = Slider(30, range=0..100)
deccutmesh_12 = DeconstructCutMesh(TriangulatedMeshOrCutMesh=developcm3_3)  # -> Vertices, Faces, Edges
dist_4 = Distance(PointA=deccutmesh_6.Vertices, PointB=deccutmesh_12.Vertices)
lng_4 = ListLength(List=dist_4)
series_8 = Series(Start=0, Step=1, Count=lng_4)
series_9 = Series(Start=0, Step=1, Count=number_slider_20)
x_plus_one_5 = XPlusOne(NumberX=series_9)
avr_15 = Average(Input=dist_4)
sort_13 = SortList(Keys=dist_4, ValuesA=series_8)  # -> Keys, ValuesA
neg_4 = Negative(Value=x_plus_one_5)
item_41 = ListItem(List=sort_13.Keys, Index=0, Wrap=True)  # -> Item1, Item
item_42 = ListItem(List=sort_13.ValuesA, Index=neg_4, Wrap=True)
merge_14 = Merge(Data1=item_41.Item1, Data2=item_41.Item, Data3=avr_15)  # -> flatten(Result)
panel_18 = Panel(merge_14)
item_43 = ListItem(List=deccutmesh_12.Vertices, Index=item_42, Wrap=True)

avr_16 = Average(Input=sort_9.ValuesA)

# ----
# ガウス曲率が大きかったもの
cutmeshgcurvature_2 = CutMeshGCurvature(TriangulatedMeshOrCutMesh=developcm2_5)
deccutmesh_13 = DeconstructCutMesh(TriangulatedMeshOrCutMesh=developcm2_5)  # -> Vertices, Faces, Edges
lng_5 = ListLength(List=cutmeshgcurvature_2)
abs_6 = Absolute(Value=cutmeshgcurvature_2)
series_10 = Series(Start=0, Step=1, Count=lng_5)
series_11 = Series(Start=0, Step=1, Count=Slider(59, range=0..100))
sort_14 = SortList(Keys=abs_6, ValuesA=series_10)  # -> Keys, ValuesA
x_plus_one_6 = XPlusOne(NumberX=series_11)
neg_5 = Negative(Value=x_plus_one_6)
item_44 = ListItem(List=sort_14.ValuesA, Index=neg_5, Wrap=True)
avr_17 = Average(Input=sort_14.Keys)
item_45 = ListItem(List=sort_14.Keys, Index=0, Wrap=True)  # -> Item1, Item
merge_15 = Merge(Data1=avr_17, Data2=item_45.Item1, Data3=item_45.Item)
panel_19 = Panel(merge_15)
item_46 = ListItem(List=deccutmesh_13.Vertices, Index=item_44, Wrap=True)

item_47 = ListItem(List=sort_8.ValuesA, Index=0, Wrap=True)  # -> Item1, Item; disabled
developcm3_5 = DevelopCutMesh3(
    TriangulatedCutMesh=developcm2_7,
    Iterations=number_slider_17,
    XyMirror=False,
    YzMirror=False,
    ZxMirror=False,
    OuterBoundaryCurves=crv_21,
    Alpha=1)  # disabled
deccutmesh_14 = DeconstructCutMesh(TriangulatedMeshOrCutMesh=developcm3_5)  # -> Vertices, Faces, Edges; disabled
flip_2 = FlipMatrix(Data=item_30)
cull_i_2 = CullIndex(List=flip_2, Indices="0", Wrap=True)
ln_5 = Line(StartPoint=cull_i_2, EndPoint=cull_i)
wbweave_8 = WeaverbirdsMeshFromLinesWeaveBack(Lines=flatten([ln_5, shatter_2, shatter]), MaximumValence=4)
meshedges_17 = MeshEdges(Mesh=wbweave_8)  # -> AllE, NakedE
length_line = LengthLine(Line=meshedges_17.AllE, Strength=10)
show = Show(G=wbweave_8)
solver = Solver(GoalObjects=[length_line, grab, show], Reset=Button(), Threshold=1e-15, Tolerance=0.0001, On=Toggle(False))  # -> I, V, O
mesh_11 = Mesh(solver.O)
meshedges_18 = MeshEdges(Mesh=mesh_11)  # -> AllE, NakedE
len_13 = Length(Curve=meshedges_18.AllE)
mesh_12 = Mesh(mesh_11)
develop_4 = DevelopMesh(TriangulatedMesh=mesh_12, Count=Slider(10000, range=0..10000))  # -> ModifiedMesh, A; disabled
developcm4 = DevelopCutMesh4(
    TriangulatedCutMesh=mesh_6,
    Iterations=number_slider_15,
    XyMirror=False,
    YzMirror=False,
    ZxMirror=False,
    OuterBoundaryCurves=meshedges_14.NakedE)  # disabled

# ----
# 移動距離が大きかったもの
number_slider_21 = Slider(30, range=0..100)
deccutmesh_15 = DeconstructCutMesh(TriangulatedMeshOrCutMesh=developcm2_5)  # -> Vertices, Faces, Edges
dist_5 = Distance(PointA=deccutmesh_6.Vertices, PointB=deccutmesh_15.Vertices)
lng_6 = ListLength(List=dist_5)
series_12 = Series(Start=0, Step=1, Count=lng_6)
series_13 = Series(Start=0, Step=1, Count=number_slider_21)
x_plus_one_7 = XPlusOne(NumberX=series_13)
avr_18 = Average(Input=dist_5)
sort_15 = SortList(Keys=dist_5, ValuesA=series_12)  # -> Keys, ValuesA
neg_6 = Negative(Value=x_plus_one_7)
item_48 = ListItem(List=sort_15.Keys, Index=0, Wrap=True)  # -> Item1, Item
item_49 = ListItem(List=sort_15.ValuesA, Index=neg_6, Wrap=True)
merge_16 = Merge(Data1=item_48.Item1, Data2=item_48.Item, Data3=avr_18)  # -> flatten(Result)
panel_20 = Panel(merge_16)
item_50 = ListItem(List=deccutmesh_15.Vertices, Index=item_49, Wrap=True)

mbridgecm_17 = MbridgeCM(TriangulatedMeshOrCutMesh=developcm2_7)  # disabled
panel_21 = Panel(subtraction_5)
item_51 = ListItem(List=sort_9.ValuesA, Index=0, Wrap=True)  # -> Item1, Item
dist_6 = Distance(PointA=deccutmesh_8.Vertices, PointB=deccutmesh_14.Vertices)  # disabled
meshcutbylines_8 = MeshCutWithCutLines(TriangulatedMeshOrCutMesh=developcm2_4, OpenCutLinesPolylines=item_37)
sort_16 = SortList(Keys=dist_6, ValuesA=dist_6)  # -> Keys, ValuesA; disabled

gcurvature_6 = GaussianCurvature(TriangulatedMesh=mbridgecm_17)  # disabled
sort_17 = SortList(Keys=gcurvature_6, ValuesA=gcurvature_6)  # -> Keys, ValuesA; disabled
avr_19 = Average(Input=gcurvature_6)  # disabled
item_52 = ListItem(List=sort_17.ValuesA, Index=0, Wrap=True)  # -> Item1, Item; disabled
merge_17 = Merge(Data1=item_52.Item1, Data2=item_52.Item, Data3=avr_19)  # disabled
panel_22 = Panel(merge_17)  # disabled

merge_18 = Merge(Data1=item_47.Item1, Data2=item_47.Item, Data3=avr_11)  # disabled
panel_23 = Panel(merge_18)  # disabled
merge_19 = Merge(Data1=item_51.Item1, Data2=item_51.Item, Data3=avr_16)
avr_20 = Average(Input=dist_6)  # disabled
deccutmesh_16 = DeconstructCutMesh(TriangulatedMeshOrCutMesh=developcm3_5)  # -> Vertices, Faces, Edges; disabled
mbridgecm_18 = MbridgeCM(TriangulatedMeshOrCutMesh=developcm3_5)  # disabled
mbridgecm_19 = MbridgeCM(TriangulatedMeshOrCutMesh=developcm3_5)  # disabled
mbridgecm_20 = MbridgeCM(TriangulatedMeshOrCutMesh=developcm4)  # disabled
dividecutmesh_2 = DivideCutMesh(TriangulatedMeshOrCutMesh=meshcutbylines_8)
item_53 = ListItem(List=sort_16.Keys, Index=0, Wrap=True)  # -> Item1, Item; disabled
panel_24 = Panel(merge_19)
dist_7 = Distance(PointA=deccutmesh_8.Vertices, PointB=deccutmesh_16.Vertices)  # disabled
lng_7 = ListLength(List=dist_7)  # disabled
gcurvature_7 = GaussianCurvature(TriangulatedMesh=mbridgecm_19)  # disabled
gcurvature_8 = GaussianCurvature(TriangulatedMesh=mbridgecm_18)  # disabled
lng_8 = ListLength(List=gcurvature_8)  # disabled
gcurvature_9 = GaussianCurvature(TriangulatedMesh=mbridgecm_20)  # disabled
number_slider_22 = Slider(26, range=0..100)  # disabled

# ----
# Crane
cmesh_from_mesh_2 = CMeshFromMesh(Mesh=mesh_5)
developable_2 = Developable()
static_solver_2 = CraneStaticSolver(
    CMesh=cmesh_from_mesh_2,
    Constraints=developable_2,
    NRIteration=50,
    CGNRIteration=100,
    Threshold=1e-13,
    Solve=Toggle(True),
    IsRigidEdge=False,
    IsPanelFlat=True,
    IsFoldBlock=True,
    IsConstraint=True)  # -> CMesh, RigidOrigami, Residual
deconstruct_cmesh_2 = DeconstructCMesh(CMesh=static_solver_2.CMesh)  # -> Mesh, Mountain, Valley, Boundary, Unassigned, Triangulate, Edges, Inner
develop_mesh_4 = DevelopMesh(Mesh=deconstruct_cmesh_2.Mesh)  # -> DevelopMesh, FaceTree
gcurvature_10 = GaussianCurvature(TriangulatedMesh=deconstruct_cmesh_2.Mesh)
sort_18 = SortList(Keys=gcurvature_10, ValuesA=gcurvature_10)  # -> Keys, ValuesA
avr_21 = Average(Input=gcurvature_10)
item_54 = ListItem(List=sort_18.ValuesA, Index=0, Wrap=True)  # -> Item1, Item
merge_20 = Merge(Data1=item_54.Item1, Data2=item_54.Item, Data3=avr_21)
panel_25 = Panel(merge_20)

demesh = DeconstructMesh(Mesh=deconstruct_cmesh_2.Mesh)  # -> Vertices, Faces, Colours, Normals
demesh_2 = DeconstructMesh(Mesh=mesh_5)  # -> Vertices, Faces, Colours, Normals
dist_8 = Distance(PointA=demesh.Vertices, PointB=demesh_2.Vertices)
sort_19 = SortList(Keys=dist_8)  # -> Keys, ValuesA
avr_22 = Average(Input=dist_8)
item_55 = ListItem(List=sort_19.Keys, Index=0, Wrap=True)  # -> Item1, Item
merge_21 = Merge(Data1=item_55.Item, Data2=item_55.Item1, Data3=avr_22)
panel_26 = Panel(merge_21)

merge_22 = Merge(Data1=item_53.Item1, Data2=item_53.Item, Data3=avr_20)  # disabled
panel_27 = Panel(merge_22)  # disabled
series_14 = Series(Start=0, Step=1, Count=lng_8)  # disabled
series_15 = Series(Start=0, Step=1, Count=lng_7)  # disabled
number_slider_23 = Slider(30, range=0..100)  # disabled
meshnet4_8 = MeshNet4(TriangulatedMeshOrCutMesh=dividecutmesh_2)  # -> CutMesh, FeatureLinesPolylines
demesh_3 = DeconstructMesh(Mesh=mbridgecm_18)  # -> Vertices, Faces, Colours, Normals; disabled
sort_20 = SortList(Keys=dist_7, ValuesA=series_15)  # -> flatten(Keys), ValuesA; disabled
avr_23 = Average(Input=gcurvature_8)  # -> flatten(ArithmeticMean); disabled
avr_24 = Average(Input=dist_7)  # -> flatten(ArithmeticMean); disabled
sort_21 = SortList(Keys=gcurvature_7, ValuesA=gcurvature_7)  # -> Keys, ValuesA; disabled
series_16 = Series(Start=0, Step=1, Count=number_slider_22)  # disabled
sort_22 = SortList(Keys=gcurvature_9, ValuesA=gcurvature_9)  # -> Keys, ValuesA; disabled
sort_23 = SortList(Keys=gcurvature_8, ValuesA=series_14)  # -> flatten(Keys), ValuesA; disabled

# ----
# 最適化前
# ガウス曲率が大きかったもの
cutmeshgcurvature_3 = CutMeshGCurvature(TriangulatedMeshOrCutMesh=sortcutmesh_7)
abs_7 = Absolute(Value=cutmeshgcurvature_3)
lng_9 = ListLength(List=cutmeshgcurvature_3)
series_17 = Series(Start=0, Step=1, Count=lng_9)
series_18 = Series(Start=0, Step=1, Count=Slider(30, range=0..100))
sort_24 = SortList(Keys=abs_7, ValuesA=series_17)  # -> Keys, ValuesA
x_plus_one_8 = XPlusOne(NumberX=series_18)
neg_7 = Negative(Value=x_plus_one_8)
item_56 = ListItem(List=sort_24.ValuesA, Index=neg_7, Wrap=True)
avr_25 = Average(Input=sort_24.Keys)
item_57 = ListItem(List=sort_24.Keys, Index=0, Wrap=True)  # -> Item1, Item
merge_23 = Merge(Data1=avr_25, Data2=item_57.Item1, Data3=item_57.Item)
panel_28 = Panel(merge_23)
item_58 = ListItem(List=deccutmesh_3.Vertices, Index=item_56, Wrap=True)

neg_8 = Negative(Value=series_16)  # disabled
avr_26 = Average(Input=gcurvature_7)  # disabled
item_59 = ListItem(List=sort_20.Keys, Index=0, Wrap=True)  # -> Item1, Item; disabled
avr_27 = Average(Input=gcurvature_9)  # disabled
mbridgecm_21 = MbridgeCM(TriangulatedMeshOrCutMesh=meshnet4_8.CutMesh)
series_19 = Series(Start=0, Step=1, Count=number_slider_23)  # disabled
item_60 = ListItem(List=sort_23.ValuesA, Index=neg_8, Wrap=True)  # disabled
item_61 = ListItem(List=sort_21.ValuesA, Index=0, Wrap=True)  # -> Item1, Item; disabled
item_62 = ListItem(List=sort_23.Keys, Index=0, Wrap=True)  # -> Item1, Item; disabled
X_4 = UnitX(Factor=Slider(400, range=0..100000))
msphere = MeshSphere(Base=PlaneXY(0, 0, 0), Radius=Slider(60, range=0..100), UCount=10, VCount=20)
item_63 = ListItem(List=sort_22.ValuesA, Index=0, Wrap=True)  # -> Item1, Item; disabled
neg_9 = Negative(Value=series_19)  # disabled
merge_24 = Merge(Data1=item_59.Item1, Data2=item_59.Item, Data3=avr_24)  # disabled
panel_29 = Panel(merge_24)  # disabled
item_64 = ListItem(List=demesh_3.Vertices, Index=item_60, Wrap=True)  # disabled
item_65 = ListItem(List=mbridgecm_21, Index=0, Wrap=True)
move_7 = Move(Geometry=msphere, Motion=X_4)  # -> Geometry, Transform
merge_25 = Merge(Data1=item_61.Item1, Data2=item_61.Item, Data3=avr_26)  # disabled
panel_30 = Panel(merge_25)  # disabled
merge_26 = Merge(Data1=item_62.Item1, Data2=item_62.Item, Data3=avr_23)  # disabled
panel_31 = Panel(merge_26)  # disabled
move_8 = Move(Geometry=mbridgecm_21, Motion=Vector(0, 0, 10))  # -> Geometry, Transform
merge_27 = Merge(Data1=item_63.Item1, Data2=item_63.Item, Data3=avr_27)  # disabled
panel_32 = Panel(merge_27)  # disabled
item_66 = ListItem(List=sort_20.ValuesA, Index=neg_9, Wrap=True)  # disabled
tri_2 = Triangulate(Mesh=move_7.Geometry)  # -> Mesh, Count
item_67 = ListItem(List=deccutmesh_16.Vertices, Index=item_66, Wrap=True)  # disabled
mbridgecm_22 = MbridgeCM(TriangulatedMeshOrCutMesh=deconstruct_cmesh_2.Mesh)
meshedges_19 = MeshEdges(Mesh=tri_2.Mesh)  # -> AllE, NakedE
crv_23 = Curve(meshedges_19.AllE)
crv_24 = Curve([<curve referenced from the Rhino model> x970])
number_slider_24 = Slider(23, range=0..100)
ハイブリッド = Mesh(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)
従来手法 = Mesh(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)
元形状 = Mesh(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)
新手法 = Mesh(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)
wbweave_9 = WeaverbirdsMeshFromLinesWeaveBack(Lines=crv_24, MaximumValence=4)
# 中間用
merge_28 = Merge(Data1=元形状, Data2=従来手法, Data3=新手法, Data4=ハイブリッド)  # -> flatten(Result)
X_5 = UnitX(Factor=Slider(534, range=0..1000))
move_9 = Move(Geometry=merge_28, Motion=X_5)  # -> Geometry, Transform

# ----
# 中間用
mesh_13 = Mesh(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)
mesh_14 = Mesh(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)
mesh_15 = Mesh(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)

item_68 = ListItem(List=move_9.Geometry, Index=0, Wrap=True)  # -> Item, Item1, Item2, Item3
mesh_16 = Mesh(item_68.Item)
meshedges_20 = MeshEdges(Mesh=mesh_15)  # -> AllE, NakedE
crv_25 = Curve([<curve referenced from the Rhino model> x26])
meshedges_21 = MeshEdges(Mesh=item_68.Item)  # -> AllE, NakedE
meshedges_22 = MeshEdges(Mesh=item_68.Item)  # -> AllE, NakedE
crv_26 = Curve([<curve referenced from the Rhino model> x10])
crv_27 = Curve([<curve referenced from the Rhino model> x220])
swatch = ColourSwatch(SwatchColor=RGBA(0, 0, 0, 130))
crv_28 = Curve(meshedges_22.AllE)
gcurvature_11 = GaussianCurvature(TriangulatedMesh=mesh_15)
previewlw = CustomPreviewLineweights(Geometry=meshedges_20.AllE, Shader=ColourSwatch(SwatchColor=RGBA(194, 194, 255, 0)), Absolute=False)
gcurvature_12 = GaussianCurvature(TriangulatedMesh=元形状)
wbweave_10 = WeaverbirdsMeshFromLinesWeaveBack(Lines=crv_27, MaximumValence=4)
meshedges_23 = MeshEdges(Mesh=mesh_13)  # -> AllE, NakedE
previewlw_2 = CustomPreviewLineweights(Geometry=meshedges_21.AllE, Shader=ColourSwatch(SwatchColor=RGBA(194, 194, 255, 0)), Absolute=False)
lng_10 = ListLength(List=gcurvature_11)
crv_29 = Curve([<curve referenced from the Rhino model> x1847])
previewlw_3 = CustomPreviewLineweights(Geometry=crv_26, Shader=ColourSwatch(SwatchColor=RGB(87, 87, 212)), Thickness=Slider(3, range=0..10), Absolute=False)
previewlw_4 = CustomPreviewLineweights(Geometry=crv_25, Shader=ColourSwatch(SwatchColor=RGB(232, 174, 49)), Thickness=Slider(3, range=0..10), Absolute=False)
previewlw_5 = CustomPreviewLineweights(Geometry=crv_27, Shader=ColourSwatch(SwatchColor=RGBA(173, 173, 173, 130)), Absolute=False)
preview = CustomPreview(Geometry=wbweave_10, Material=ColourSwatch(SwatchColor=RGBA(52, 92, 65, 130)))
meshedges_24 = MeshEdges(Mesh=item_68.Item3)  # -> AllE, NakedE
sort_25 = SortList(Keys=gcurvature_11, ValuesA=gcurvature_11)  # -> Keys, ValuesA
lng_11 = ListLength(List=gcurvature_12)
wbweave_11 = WeaverbirdsMeshFromLinesWeaveBack(Lines=crv_29, MaximumValence=4)
meshedges_25 = MeshEdges(Mesh=wbweave_10)  # -> AllE, NakedE
sort_26 = SortList(Keys=gcurvature_12, ValuesA=gcurvature_12)  # -> Keys, ValuesA
avr_28 = Average(Input=gcurvature_11)
multiplication = Multiplication(A=lng_10, B=avr_28)
panel_33 = Panel(multiplication)
preview_2 = CustomPreview(
    Geometry=mesh_13,
    Material={diffuse=RGB(221, 160, 221), emission=RGB(66, 48, 66), shine=0.5, specular=RGB(255, 255, 255), transparency=0})
avr_29 = Average(Input=gcurvature_12)
multiplication_2 = Multiplication(A=lng_11, B=avr_29)
previewlw_6 = CustomPreviewLineweights(Geometry=meshedges_23.AllE, Shader=ColourSwatch(SwatchColor=RGB(0, 0, 0)), Absolute=False)
crv_30 = Curve([<curve referenced from the Rhino model> x16])
crv_31 = Curve([<curve referenced from the Rhino model> x25])
crv_32 = Curve([<curve referenced from the Rhino model> x7])
crv_33 = Curve([<curve referenced from the Rhino model> x13])
item_69 = ListItem(List=sort_25.ValuesA, Index=0, Wrap=True)  # -> Item1, Item
preview_3 = CustomPreview(
    Geometry=item_68.Item3,
    Material={diffuse=RGB(221, 160, 221), emission=RGB(66, 48, 66), shine=0.5, specular=RGB(255, 255, 255), transparency=0})
mesh_17 = Mesh(wbweave_11)
previewlw_7 = CustomPreviewLineweights(Geometry=meshedges_24.AllE, Shader=ColourSwatch(SwatchColor=RGB(0, 0, 0)), Absolute=False)
deccutmesh_17 = DeconstructCutMesh(TriangulatedMeshOrCutMesh=mbridgecm_22)  # -> Vertices, Faces, Edges
crv_34 = Curve(<curve referenced from the Rhino model>)
crv_35 = Curve(<curve referenced from the Rhino model>)
item_70 = ListItem(List=sort_26.ValuesA, Index=0, Wrap=True)  # -> Item1, Item
crv_36 = Curve([<curve referenced from the Rhino model> x2])
merge_29 = Merge(Data1=crv_30, Data2=crv_31, Data3=crv_32, Data4=crv_33)  # -> flatten(Result)
developcm2_8 = DevelopCutMesh2(
    TriangulatedCutMesh=wbweave_10,
    Iterations=Slider(100000, range=0..100000),
    XyMirror=False,
    YzMirror=False,
    ZxMirror=False,
    OuterBoundaryCurves=meshedges_25.NakedE,
    Alpha=0.1)
crv_37 = Curve([<curve referenced from the Rhino model> x449])
pt = Point(<point referenced from the Rhino model>)
panel_34 = Panel(multiplication_2)
crv_38 = Curve([<curve referenced from the Rhino model> x1847])
merge_30 = Merge(Data1=crv_36, Data2=crv_34, Data3=crv_35)
merge_31 = Merge(Data1=item_69.Item1, Data2=item_69.Item, Data3=avr_28)
mbridgecm_23 = MbridgeCM(TriangulatedMeshOrCutMesh=developcm2_8)
wbweave_12 = WeaverbirdsMeshFromLinesWeaveBack(Lines=crv_37, MaximumValence=4)
crv_39 = Curve([<curve referenced from the Rhino model> x2])
yz = YZPlane(Origin=pt)
merge_32 = Merge(Data1=item_70.Item1, Data2=item_70.Item, Data3=avr_29)
mirror = Mirror(Geometry=crv_39, Plane=yz)  # -> Geometry, Transform
wbweave_13 = WeaverbirdsMeshFromLinesWeaveBack(Lines=crv_38, MaximumValence=4)
meshedges_26 = MeshEdges(Mesh=wbweave_13)  # -> AllE, NakedE
mbridgecm_24 = MbridgeCM(TriangulatedMeshOrCutMesh=wbweave_13)
developcm3_6 = DevelopCutMesh3(
    TriangulatedCutMesh=mbridgecm_24,
    Iterations=Slider(10000, range=0..10000),
    XyMirror=False,
    YzMirror=False,
    ZxMirror=False,
    OuterBoundaryCurves=meshedges_26.NakedE,
    FixPointsCrv=merge_29,
    Alpha=1)
mbridgecm_25 = MbridgeCM(TriangulatedMeshOrCutMesh=mesh_17)
mirror_2 = Mirror(Geometry=crv_37, Plane=yz)  # -> Geometry, Transform
wbweave_14 = WeaverbirdsMeshFromLinesWeaveBack(Lines=flatten([mirror_2.Geometry, crv_37]), MaximumValence=4)
mbridgecm_26 = MbridgeCM(TriangulatedMeshOrCutMesh=wbweave_12)
crv_40 = Curve([<curve referenced from the Rhino model> x1445])
merge_33 = Merge(Data1=crv_39, Data2=mirror.Geometry)  # -> flatten(Result)
meshedges_27 = MeshEdges(Mesh=wbweave_14)  # -> AllE, NakedE
crv_41 = Curve(meshedges_27.NakedE)
meshedges_28 = MeshEdges(Mesh=wbweave_14)  # -> AllE, NakedE
mbridgecm_27 = MbridgeCM(TriangulatedMeshOrCutMesh=developcm3_6)
wbweave_15 = WeaverbirdsMeshFromLinesWeaveBack(Lines=crv_40, MaximumValence=4)
mbridgecm_28 = MbridgeCM(TriangulatedMeshOrCutMesh=wbweave_14)
meshcutbylines_9 = MeshCutWithCutLines(TriangulatedMeshOrCutMesh=mbridgecm_28, OpenCutLinesPolylines=merge_33)
developcm3_7 = DevelopCutMesh3(
    TriangulatedCutMesh=meshcutbylines_9,
    Iterations=Slider(0, range=0..10000),
    XyMirror=False,
    YzMirror=False,
    ZxMirror=False,
    OuterBoundaryCurves=crv_41,
    Alpha=1)
meshcutbylines_10 = MeshCutWithCutLines(TriangulatedMeshOrCutMesh=mbridgecm_26, OpenCutLinesPolylines=crv_39)
cutmeshedges_18 = CutMeshEdges(TriangulatedMeshOrCutMesh=meshcutbylines_10)  # -> MeshAllEdges, MeshNakedEdges
develop_5 = DevelopMesh(TriangulatedMesh=wbweave_13, Count=Slider(10000, range=0..10000))  # -> ModifiedMesh, A
meshedges_29 = MeshEdges(Mesh=mbridgecm_23)  # -> AllE, NakedE
crv_42 = Curve(cutmeshedges_18.MeshNakedEdges)
gcurvature_13 = GaussianCurvature(TriangulatedMesh=wbweave_13)
meshcutbylines_11 = MeshCutWithCutLines(TriangulatedMeshOrCutMesh=mbridgecm_25, OpenCutLinesPolylines=merge_30)
meshnet4_9 = MeshNet4(TriangulatedMeshOrCutMesh=mbridgecm_27)  # -> CutMesh, FeatureLinesPolylines
cutmeshedges_19 = CutMeshEdges(TriangulatedMeshOrCutMesh=meshcutbylines_11)  # -> MeshAllEdges, MeshNakedEdges
meshnet4_10 = MeshNet4(TriangulatedMeshOrCutMesh=develop_5.ModifiedMesh)  # -> CutMesh, FeatureLinesPolylines
gcurvature_14 = GaussianCurvature(TriangulatedMesh=mbridgecm_27)
preview_4 = CustomPreview(Geometry=mbridgecm_23, Material=ColourSwatch(SwatchColor=RGBA(52, 92, 65, 130)))
previewlw_8 = CustomPreviewLineweights(Geometry=meshedges_29.AllE, Shader=ColourSwatch(SwatchColor=RGBA(0, 0, 0, 130)), Absolute=False)
developcm3_8 = DevelopCutMesh3(
    TriangulatedCutMesh=meshcutbylines_10,
    Iterations=Slider(10000, range=0..10000),
    XyMirror=False,
    YzMirror=False,
    ZxMirror=False,
    OuterBoundaryCurves=crv_42,
    Alpha=1)
gcurvature_15 = GaussianCurvature(TriangulatedMesh=develop_5.ModifiedMesh)
sort_27 = SortList(Keys=gcurvature_13, ValuesA=gcurvature_13)  # -> Keys, ValuesA
crv_43 = Curve(cutmeshedges_19.MeshNakedEdges)
meshedges_30 = MeshEdges()  # -> AllE, NakedE
develop_6 = DevelopMesh(TriangulatedMesh=mesh_17, Count=Slider(10000, range=0..10000))  # -> ModifiedMesh, A
meshnet6_4 = MeshNet6(TriangulatedMeshOrCutMesh=meshnet4_9.CutMesh)
avr_30 = Average(Input=gcurvature_13)
sort_28 = SortList(Keys=gcurvature_14, ValuesA=gcurvature_14)  # -> Keys, ValuesA
number_slider_25 = Slider(10000, range=0..10000)
develop_7 = DevelopMesh(TriangulatedMesh=wbweave_15, Count=Slider(100000, range=0..100000))  # -> ModifiedMesh, A
meshnet6_5 = MeshNet6(TriangulatedMeshOrCutMesh=develop_7.ModifiedMesh)
developcm3_9 = DevelopCutMesh3(
    TriangulatedCutMesh=meshcutbylines_11,
    Iterations=Slider(10000, range=0..10000),
    XyMirror=False,
    YzMirror=False,
    ZxMirror=False,
    OuterBoundaryCurves=crv_43,
    Alpha=1)
sort_29 = SortList(Keys=gcurvature_15, ValuesA=gcurvature_15)  # -> Keys, ValuesA
item_71 = ListItem(List=sort_27.ValuesA, Index=0, Wrap=True)  # -> Item1, Item
len_14 = Length()
avr_31 = Average(Input=gcurvature_14)
gcurvature_16 = GaussianCurvature(TriangulatedMesh=wbweave_15)
meshnet4_11 = MeshNet4(TriangulatedMeshOrCutMesh=develop_6.ModifiedMesh)  # -> CutMesh, FeatureLinesPolylines
avr_32 = Average(Input=gcurvature_15)
meshnet4_12 = MeshNet4(TriangulatedMeshOrCutMesh=developcm3_8)  # -> CutMesh, FeatureLinesPolylines
item_72 = ListItem(List=sort_28.ValuesA, Index=0, Wrap=True)  # -> Item1, Item
meshnet6_6 = MeshNet6(TriangulatedMeshOrCutMesh=develop_6.ModifiedMesh)
meshnet4_13 = MeshNet4(TriangulatedMeshOrCutMesh=develop_7.ModifiedMesh)  # -> CutMesh, FeatureLinesPolylines
mesh_18 = Mesh(wbweave_12)
gcurvature_17 = GaussianCurvature(TriangulatedMesh=develop_6.ModifiedMesh)
meshnet4_14 = MeshNet4(TriangulatedMeshOrCutMesh=developcm3_9)  # -> CutMesh, FeatureLinesPolylines
item_73 = ListItem(List=sort_29.ValuesA, Index=0, Wrap=True)  # -> Item1, Item
merge_34 = Merge(Data1=item_71.Item1, Data2=item_71.Item, Data3=avr_30)
panel_35 = Panel(merge_34)
develop_8 = DevelopMesh(TriangulatedMesh=mesh_18, Count=Slider(100000, range=0..100000))  # -> ModifiedMesh, A
sort_30 = SortList(Keys=gcurvature_16, ValuesA=gcurvature_16)  # -> Keys, ValuesA
gcurvature_18 = GaussianCurvature(TriangulatedMesh=develop_7.ModifiedMesh)
develop_mesh_5 = DevelopMesh(Mesh=develop_6.ModifiedMesh)  # -> DevelopMesh, FaceTree
merge_35 = Merge(Data1=item_72.Item1, Data2=item_72.Item, Data3=avr_31)
panel_36 = Panel(merge_35)
avr_33 = Average(Input=gcurvature_16)
sort_31 = SortList(Keys=gcurvature_17, ValuesA=gcurvature_17)  # -> Keys, ValuesA
merge_36 = Merge(Data1=item_73.Item1, Data2=item_73.Item, Data3=avr_32)
panel_37 = Panel(merge_36)
gcurvature_19 = GaussianCurvature(TriangulatedMesh=mesh_18)
X_6 = UnitX(Factor=Slider(1000, range=0..1000))
item_74 = ListItem(List=sort_30.ValuesA, Index=0, Wrap=True)  # -> Item1, Item
avr_34 = Average(Input=gcurvature_17)
sort_32 = SortList(Keys=gcurvature_18, ValuesA=gcurvature_18)  # -> Keys, ValuesA
meshnet6_7 = MeshNet6(TriangulatedMeshOrCutMesh=develop_8.ModifiedMesh)
meshnet4_15 = MeshNet4(TriangulatedMeshOrCutMesh=develop_8.ModifiedMesh)  # -> CutMesh, FeatureLinesPolylines
move_10 = Move(Geometry=develop_5.ModifiedMesh, Motion=X_6)  # -> Geometry, Transform
crv_44 = Curve(<curve referenced from the Rhino model>)
avr_35 = Average(Input=gcurvature_18)
crv_45 = Curve(<curve referenced from the Rhino model>)
item_75 = ListItem(List=sort_31.ValuesA, Index=0, Wrap=True)  # -> Item1, Item
merge_37 = Merge(Data1=item_74.Item1, Data2=item_74.Item, Data3=avr_33)
panel_38 = Panel(merge_37)
sort_33 = SortList(Keys=gcurvature_19, ValuesA=gcurvature_19)  # -> Keys, ValuesA
gcurvature_20 = GaussianCurvature(TriangulatedMesh=develop_8.ModifiedMesh)
merge_38 = Merge(Data1=crv_44, Data2=crv_45)  # -> flatten(Result)
explode = Explode(Curve=merge_38, Recursive=True)  # -> flatten(Segments), Vertices
item_76 = ListItem(List=sort_32.ValuesA, Index=0, Wrap=True)  # -> Item1, Item
preview_5 = CustomPreview(
    Geometry=develop_5.ModifiedMesh,
    Material={diffuse=RGB(221, 160, 221), emission=RGB(66, 48, 66), shine=0.5, specular=RGB(255, 255, 255), transparency=0})
avr_36 = Average(Input=gcurvature_19)
merge_39 = Merge(Data1=item_75.Item1, Data2=item_75.Item, Data3=avr_34)
panel_39 = Panel(merge_39)
meshnet7 = MeshNet7(TriangulatedMeshOrCutMesh=move_10.Geometry, FeatureLinesPolylines=merge_38)  # -> CutMesh, FeatureLinesPolylines
item_77 = ListItem(List=sort_33.ValuesA, Index=0, Wrap=True)  # -> Item1, Item
merge_40 = Merge(Data1=item_76.Item1, Data2=item_76.Item, Data3=avr_35)
panel_40 = Panel(merge_40)
meshnet6_8 = MeshNet6(TriangulatedMeshOrCutMesh=develop_5.ModifiedMesh)
len_15 = Length(Curve=explode.Segments)
sort_34 = SortList(Keys=gcurvature_20, ValuesA=gcurvature_20)  # -> Keys, ValuesA
avr_37 = Average(Input=gcurvature_20)
panel_41 = Panel(len_15)
crv_46 = Curve(meshnet7.FeatureLinesPolylines)
crv_47 = Curve(crv_46)
join_2 = JoinCurves(Curves=crv_47, Preserve=False)
merge_41 = Merge(Data1=item_77.Item1, Data2=item_77.Item, Data3=avr_36)
mbridgecm_29 = MbridgeCM(TriangulatedMeshOrCutMesh=meshnet7.CutMesh)
item_78 = ListItem(List=sort_34.ValuesA, Index=0, Wrap=True)  # -> Item1, Item
len_16 = Length(Curve=crv_46)
panel_42 = Panel(merge_41)
merge_42 = Merge(Data1=item_78.Item1, Data2=item_78.Item, Data3=avr_37)
panel_43 = Panel(merge_42)
panel_44 = Panel(len_16)
developable_3 = Developable()
cmesh_from_mesh_3 = CMeshFromMesh(Mesh=develop_6.ModifiedMesh)
static_solver_3 = CraneStaticSolver(
    CMesh=cmesh_from_mesh_3,
    Constraints=developable_3,
    NRIteration=50,
    CGNRIteration=100,
    Threshold=1e-13,
    Solve=Toggle(True),
    IsRigidEdge=False,
    IsPanelFlat=True,
    IsFoldBlock=True,
    IsConstraint=True)  # -> CMesh, RigidOrigami, Residual
deconstruct_cmesh_3 = DeconstructCMesh(CMesh=static_solver_3.CMesh)  # -> Mesh, Mountain, Valley, Boundary, Unassigned, Triangulate, Edges, Inner
mesh_19 = Mesh(<mesh referenced from the Rhino model>)
develop_mesh_6 = DevelopMesh(Mesh=deconstruct_cmesh_3.Mesh)  # -> DevelopMesh, FaceTree
gcurvature_21 = GaussianCurvature(TriangulatedMesh=deconstruct_cmesh_3.Mesh)
number_slider_26 = Slider(10000, range=0..10000)
number_slider_27 = Slider(1000, range=0..1000)
sort_35 = SortList(Keys=gcurvature_21, ValuesA=gcurvature_21)  # -> Keys, ValuesA
# 外皮1030
meshedges_31 = MeshEdges(Mesh=mesh_19)  # -> AllE, NakedE
avr_38 = Average(Input=gcurvature_21)
tri_3 = Triangulate(Mesh=mesh_19)  # -> Mesh, Count
meshedges_32 = MeshEdges(Mesh=tri_3.Mesh)  # -> AllE, NakedE
develop_9 = DevelopMesh(TriangulatedMesh=mesh_19, Count=Slider(20000, range=0..100000))  # -> ModifiedMesh, A
crv_48 = Curve(meshedges_31.AllE)
item_79 = ListItem(List=sort_35.ValuesA, Index=0, Wrap=True)  # -> Item1, Item
center_7 = Center(Geometry=meshedges_32.AllE)  # -> Center, Dimension
center_8 = Center(Geometry=meshedges_31.AllE)  # -> Center, Dimension
mesh_20 = Mesh(develop_9.ModifiedMesh)
dupln = RemoveDuplicateLines(Lines=flatten([meshedges_31.AllE, meshedges_32.AllE]), Tolerance=0.01)
cullpt = CullDuplicates(Points=flatten([center_8.Center, center_7.Center]), Tolerance=0.1, CullMode=2)  # -> Points, Indices, Valence
crv_49 = Curve(<curve referenced from the Rhino model>)
crv_50 = Curve(<curve referenced from the Rhino model>)
merge_43 = Merge(Data1=item_79.Item1, Data2=item_79.Item, Data3=avr_38)
panel_45 = Panel(merge_43)
gcurvature_22 = GaussianCurvature(TriangulatedMesh=mesh_19)
gcurvature_23 = GaussianCurvature(TriangulatedMesh=develop_9.ModifiedMesh)
merge_44 = Merge(Data1=crv_49, Data2=crv_50)
netbff = NetBFF(TriangulatedMeshOrCutMesh=mesh_20, FeatureLinesPolylines=merge_44)  # -> CutMesh, FeatureLinesPolylines
sort_36 = SortList(Keys=gcurvature_22, ValuesA=gcurvature_22)  # -> Keys, ValuesA
sort_37 = SortList(Keys=gcurvature_23, ValuesA=gcurvature_23)  # -> Keys, ValuesA
netbfflength = NetBFFLength(TriangulatedMeshOrCutMesh=mesh_20, FeatureLinesPolylines=merge_44)  # -> CutMesh, FeatureLinesPolylines
avr_39 = Average(Input=gcurvature_22)
avr_40 = Average(Input=gcurvature_23)
mbridgecm_30 = MbridgeCM(TriangulatedMeshOrCutMesh=netbff.CutMesh)
item_80 = ListItem(List=sort_36.ValuesA, Index=0, Wrap=True)  # -> Item1, Item
item_81 = ListItem(List=sort_37.ValuesA, Index=0, Wrap=True)  # -> Item1, Item
crv_51 = Curve(netbff.FeatureLinesPolylines)
mbridgecm_31 = MbridgeCM(TriangulatedMeshOrCutMesh=netbfflength.CutMesh)
crv_52 = Curve(netbfflength.FeatureLinesPolylines)
merge_45 = Merge(Data1=item_80.Item1, Data2=item_80.Item, Data3=avr_39)
merge_46 = Merge(Data1=item_81.Item1, Data2=item_81.Item, Data3=avr_40)
mesh_21 = Mesh(mbridgecm_31)
panel_46 = Panel(merge_45)
panel_47 = Panel(merge_46)

# ----
# ガウス曲率が大きかったもの
cutmeshgcurvature_4 = CutMeshGCurvature(TriangulatedMeshOrCutMesh=developcm2_6)
deccutmesh_18 = DeconstructCutMesh(TriangulatedMeshOrCutMesh=developcm2_6)  # -> Vertices, Faces, Edges
lng_12 = ListLength(List=cutmeshgcurvature_4)
abs_8 = Absolute(Value=cutmeshgcurvature_4)
series_20 = Series(Start=0, Step=1, Count=lng_12)
series_21 = Series(Start=0, Step=1, Count=Slider(100, range=0..100))
sort_38 = SortList(Keys=abs_8, ValuesA=series_20)  # -> Keys, ValuesA
x_plus_one_9 = XPlusOne(NumberX=series_21)
neg_10 = Negative(Value=x_plus_one_9)
item_82 = ListItem(List=sort_38.ValuesA, Index=neg_10, Wrap=True)
avr_41 = Average(Input=sort_38.Keys)
item_83 = ListItem(List=sort_38.Keys, Index=0, Wrap=True)  # -> Item1, Item
item_84 = ListItem(List=deccutmesh_18.Vertices, Index=item_82, Wrap=True)

cull_i_3 = CullIndex(List=sort_38.Keys, Indices=neg_10, Wrap=True)
avr_42 = Average(Input=cull_i_3)

merge_47 = Merge(Data1=avr_41, Data2=item_83.Item1, Data3=item_83.Item, Data4=avr_42)  # -> flatten(Result)
panel_48 = Panel(merge_47)

# ----
# ガウス曲率が大きかったもの
cutmeshgcurvature_5 = CutMeshGCurvature(TriangulatedMeshOrCutMesh=developcm3_4)
deccutmesh_19 = DeconstructCutMesh(TriangulatedMeshOrCutMesh=developcm3_4)  # -> Vertices, Faces, Edges
lng_13 = ListLength(List=cutmeshgcurvature_5)
abs_9 = Absolute(Value=cutmeshgcurvature_5)
series_22 = Series(Start=0, Step=1, Count=lng_13)
series_23 = Series(Start=0, Step=1, Count=Slider(100, range=0..100))
sort_39 = SortList(Keys=abs_9, ValuesA=series_22)  # -> Keys, ValuesA
x_plus_one_10 = XPlusOne(NumberX=series_23)
neg_11 = Negative(Value=x_plus_one_10)
item_85 = ListItem(List=sort_39.ValuesA, Index=neg_11, Wrap=True)
item_86 = ListItem(List=sort_39.Keys, Index=0, Wrap=True)  # -> Item1, Item
avr_43 = Average(Input=sort_39.Keys)
item_87 = ListItem(List=deccutmesh_19.Vertices, Index=item_85, Wrap=True)

cull_i_4 = CullIndex(List=sort_39.Keys, Indices=neg_11, Wrap=True)
avr_44 = Average(Input=cull_i_4)

merge_48 = Merge(Data1=avr_43, Data2=item_86.Item1, Data3=item_86.Item, Data4=avr_44)  # -> flatten(Result)
panel_49 = Panel(merge_48)

# ----
# Selfのみ
number_slider_28 = Slider(10000, range=0..10000)
number_slider_29 = Slider(100000, range=0..100000)
develop_10 = DevelopMesh(TriangulatedMesh=mesh_5, Count=number_slider_28)  # -> ModifiedMesh, A
sortcutmesh_14 = SortCutMesh(TriangulatedMeshOrCutMesh=develop_10.ModifiedMesh)
deccutmesh_20 = DeconstructCutMesh(TriangulatedMeshOrCutMesh=sortcutmesh_14)  # -> Vertices, Faces, Edges

# ----
# ハイブリッド
number_slider_30 = Slider(100000, range=0..100000)
developcm2_9 = DevelopCutMesh2(
    TriangulatedCutMesh=mesh_5,
    Iterations=number_slider_30,
    XyMirror=False,
    YzMirror=False,
    ZxMirror=False,
    OuterBoundaryCurves=meshedges_13.NakedE,
    Alpha=0.1)
cutmeshedges_20 = CutMeshEdges(TriangulatedMeshOrCutMesh=developcm2_9)  # -> MeshAllEdges, MeshNakedEdges
crv_53 = Curve(cutmeshedges_20.MeshNakedEdges)
developcm3_10 = DevelopCutMesh3(
    TriangulatedCutMesh=developcm2_9,
    Iterations=Slider(10000, range=0..10000),
    XyMirror=False,
    YzMirror=False,
    ZxMirror=False,
    OuterBoundaryCurves=crv_53,
    Alpha=1)

mbridgecm_32 = MbridgeCM(TriangulatedMeshOrCutMesh=developcm3_10)
meshnet6_9 = MeshNet6(TriangulatedMeshOrCutMesh=developcm3_10)
cutmeshedges_21 = CutMeshEdges(TriangulatedMeshOrCutMesh=meshnet6_9)  # -> MeshAllEdges, MeshNakedEdges
cutmeshedges_22 = CutMeshEdges(TriangulatedMeshOrCutMesh=developcm3_10)  # -> MeshAllEdges, MeshNakedEdges
len_17 = Length(Curve=cutmeshedges_22.MeshAllEdges)
len_18 = Length(Curve=cutmeshedges_21.MeshAllEdges)
subtraction_6 = Subtraction(A=len_18, B=len_17)
abs_10 = Absolute(Value=subtraction_6)
sort_40 = SortList(Keys=abs_10)  # -> Keys, ValuesA
avr_45 = Average(Input=abs_10)
item_88 = ListItem(List=sort_40.Keys, Index=0, Wrap=True)  # -> Item1, Item
merge_49 = Merge(Data1=item_88.Item1, Data2=item_88.Item, Data3=avr_45)  # -> flatten(Result)
panel_50 = Panel(merge_49)

# ----
# Selfのみ
number_slider_31 = Slider(2000, range=0..10000)
developcm3_11 = DevelopCutMesh3(
    TriangulatedCutMesh=mesh_5,
    Iterations=number_slider_31,
    XyMirror=False,
    YzMirror=False,
    ZxMirror=False,
    OuterBoundaryCurves=meshedges_13.NakedE,
    Alpha=1)  # disabled
deccutmesh_21 = DeconstructCutMesh(TriangulatedMeshOrCutMesh=developcm3_11)  # -> Vertices, Faces, Edges

meshnet6_10 = MeshNet6(TriangulatedMeshOrCutMesh=developcm3_11)
meshnet4_16 = MeshNet4(TriangulatedMeshOrCutMesh=developcm3_11)  # -> CutMesh, FeatureLinesPolylines
cutmeshedges_23 = CutMeshEdges(TriangulatedMeshOrCutMesh=developcm3_11)  # -> MeshAllEdges, MeshNakedEdges
cutmeshedges_24 = CutMeshEdges(TriangulatedMeshOrCutMesh=meshnet6_10)  # -> MeshAllEdges, MeshNakedEdges
cutmeshedges_25 = CutMeshEdges(TriangulatedMeshOrCutMesh=meshnet4_16.CutMesh)  # -> MeshAllEdges, MeshNakedEdges
len_19 = Length(Curve=cutmeshedges_23.MeshAllEdges)
len_20 = Length(Curve=cutmeshedges_25.MeshAllEdges)
len_21 = Length(Curve=cutmeshedges_23.MeshAllEdges)
len_22 = Length(Curve=cutmeshedges_24.MeshAllEdges)
subtraction_7 = Subtraction(A=len_20, B=len_19)
subtraction_8 = Subtraction(A=len_22, B=len_21)
abs_11 = Absolute(Value=subtraction_7)
abs_12 = Absolute(Value=subtraction_8)
sort_41 = SortList(Keys=abs_11)  # -> Keys, ValuesA
avr_46 = Average(Input=abs_11)
sort_42 = SortList(Keys=abs_12)  # -> Keys, ValuesA
avr_47 = Average(Input=abs_12)
item_89 = ListItem(List=sort_41.Keys, Index=0, Wrap=True)  # -> Item1, Item
item_90 = ListItem(List=sort_42.Keys, Index=0, Wrap=True)  # -> Item1, Item
merge_50 = Merge(Data1=item_89.Item1, Data2=item_89.Item, Data3=avr_46)  # -> flatten(Result)
panel_51 = Panel(merge_50)
merge_51 = Merge(Data1=item_90.Item1, Data2=item_90.Item, Data3=avr_47)  # -> flatten(Result)
panel_52 = Panel(merge_51)

# ----
# ガウス曲率が大きかったもの
cutmeshgcurvature_6 = CutMeshGCurvature(TriangulatedMeshOrCutMesh=developcm2_9)
abs_13 = Absolute(Value=cutmeshgcurvature_6)
lng_14 = ListLength(List=cutmeshgcurvature_6)
series_24 = Series(Start=0, Step=1, Count=lng_14)
series_25 = Series(Start=0, Step=1, Count=Slider(30, range=0..100))
sort_43 = SortList(Keys=abs_13, ValuesA=series_24)  # -> Keys, ValuesA

# ----
# ガウス曲率が大きかったもの
cutmeshgcurvature_7 = CutMeshGCurvature(TriangulatedMeshOrCutMesh=sortcutmesh_14)
lng_15 = ListLength(List=cutmeshgcurvature_7)
abs_14 = Absolute(Value=cutmeshgcurvature_7)
series_26 = Series(Start=0, Step=1, Count=lng_15)
series_27 = Series(Start=0, Step=1, Count=Slider(59, range=0..100))
sort_44 = SortList(Keys=abs_14, ValuesA=series_26)  # -> Keys, ValuesA

# ----
# ガウス曲率が大きかったもの
cutmeshgcurvature_8 = CutMeshGCurvature(TriangulatedMeshOrCutMesh=developcm3_11)
abs_15 = Absolute(Value=cutmeshgcurvature_8)
lng_16 = ListLength(List=cutmeshgcurvature_8)
series_28 = Series(Start=0, Step=1, Count=lng_16)
series_29 = Series(Start=0, Step=1, Count=Slider(30, range=0..100))
sort_45 = SortList(Keys=abs_15, ValuesA=series_28)  # -> Keys, ValuesA

# ----
# 移動距離が大きかったもの
number_slider_32 = Slider(30, range=0..100)
deccutmesh_22 = DeconstructCutMesh(TriangulatedMeshOrCutMesh=sortcutmesh_14)  # -> Vertices, Faces, Edges
dist_9 = Distance(PointA=deccutmesh_3.Vertices, PointB=deccutmesh_22.Vertices)
lng_17 = ListLength(List=dist_9)
series_30 = Series(Start=0, Step=1, Count=lng_17)
series_31 = Series(Start=0, Step=1, Count=number_slider_32)
avr_48 = Average(Input=dist_9)
sort_46 = SortList(Keys=dist_9, ValuesA=series_30)  # -> Keys, ValuesA
item_91 = ListItem(List=sort_46.Keys, Index=0, Wrap=True)  # -> Item1, Item
merge_52 = Merge(Data1=item_91.Item1, Data2=item_91.Item, Data3=avr_48)  # -> flatten(Result)
panel_53 = Panel(merge_52)

x_plus_one_11 = XPlusOne(NumberX=series_31)
x_plus_one_12 = XPlusOne(NumberX=series_27)
avr_49 = Average(Input=sort_44.Keys)
item_92 = ListItem(List=sort_44.Keys, Index=0, Wrap=True)  # -> Item1, Item
merge_53 = Merge(Data1=avr_49, Data2=item_92.Item1, Data3=item_92.Item)

neg_12 = Negative(Value=x_plus_one_11)
item_93 = ListItem(List=sort_46.ValuesA, Index=neg_12, Wrap=True)
item_94 = ListItem(List=deccutmesh_3.Vertices, Index=item_93, Wrap=True)

neg_13 = Negative(Value=x_plus_one_12)
item_95 = ListItem(List=sort_44.ValuesA, Index=neg_13, Wrap=True)
panel_54 = Panel(merge_53)
item_96 = ListItem(List=deccutmesh_20.Vertices, Index=item_95, Wrap=True)

# ----
# 移動距離が大きかったもの
number_slider_33 = Slider(30, range=0..100)
deccutmesh_23 = DeconstructCutMesh(TriangulatedMeshOrCutMesh=developcm3_11)  # -> Vertices, Faces, Edges
dist_10 = Distance(PointA=deccutmesh_3.Vertices, PointB=deccutmesh_23.Vertices)
lng_18 = ListLength(List=dist_10)
series_32 = Series(Start=0, Step=1, Count=lng_18)
series_33 = Series(Start=0, Step=1, Count=number_slider_33)
avr_50 = Average(Input=dist_10)
sort_47 = SortList(Keys=dist_10, ValuesA=series_32)  # -> Keys, ValuesA
item_97 = ListItem(List=sort_47.Keys, Index=0, Wrap=True)  # -> Item1, Item
merge_54 = Merge(Data1=item_97.Item1, Data2=item_97.Item, Data3=avr_50)  # -> flatten(Result)
panel_55 = Panel(merge_54)

x_plus_one_13 = XPlusOne(NumberX=series_33)
x_plus_one_14 = XPlusOne(NumberX=series_29)
avr_51 = Average(Input=sort_45.Keys)
item_98 = ListItem(List=sort_45.Keys, Index=0, Wrap=True)  # -> Item1, Item
merge_55 = Merge(Data1=avr_51, Data2=item_98.Item1, Data3=item_98.Item)

neg_14 = Negative(Value=x_plus_one_13)
item_99 = ListItem(List=sort_47.ValuesA, Index=neg_14, Wrap=True)
item_100 = ListItem(List=deccutmesh_3.Vertices, Index=item_99, Wrap=True)

neg_15 = Negative(Value=x_plus_one_14)
item_101 = ListItem(List=sort_45.ValuesA, Index=neg_15, Wrap=True)
item_102 = ListItem(List=deccutmesh_21.Vertices, Index=item_101, Wrap=True)
panel_56 = Panel(merge_55)

# ----
# ガウス曲率が大きかったもの
cutmeshgcurvature_9 = CutMeshGCurvature(TriangulatedMeshOrCutMesh=developcm3_10)
abs_16 = Absolute(Value=cutmeshgcurvature_9)
lng_19 = ListLength(List=cutmeshgcurvature_9)
series_34 = Series(Start=0, Step=1, Count=lng_19)
series_35 = Series(Start=0, Step=1, Count=Slider(30, range=0..100))
sort_48 = SortList(Keys=abs_16, ValuesA=series_34)  # -> Keys, ValuesA

# ----
# 移動距離が大きかったもの
number_slider_34 = Slider(30, range=0..100)
deccutmesh_24 = DeconstructCutMesh(TriangulatedMeshOrCutMesh=developcm3_10)  # -> Vertices, Faces, Edges
dist_11 = Distance(PointA=deccutmesh_3.Vertices, PointB=deccutmesh_24.Vertices)
lng_20 = ListLength(List=dist_11)
series_36 = Series(Start=0, Step=1, Count=lng_20)
series_37 = Series(Start=0, Step=1, Count=number_slider_34)
avr_52 = Average(Input=dist_11)
sort_49 = SortList(Keys=dist_11, ValuesA=series_36)  # -> Keys, ValuesA
item_103 = ListItem(List=sort_49.Keys, Index=0, Wrap=True)  # -> Item1, Item
merge_56 = Merge(Data1=item_103.Item1, Data2=item_103.Item, Data3=avr_52)  # -> flatten(Result)
panel_57 = Panel(merge_56)

x_plus_one_15 = XPlusOne(NumberX=series_25)
x_plus_one_16 = XPlusOne(NumberX=series_37)
avr_53 = Average(Input=sort_43.Keys)
item_104 = ListItem(List=sort_43.Keys, Index=0, Wrap=True)  # -> Item1, Item
x_plus_one_17 = XPlusOne(NumberX=series_35)
merge_57 = Merge(Data1=avr_53, Data2=item_104.Item1, Data3=item_104.Item)
avr_54 = Average(Input=sort_48.Keys)
item_105 = ListItem(List=sort_48.Keys, Index=0, Wrap=True)  # -> Item1, Item
merge_58 = Merge(Data1=avr_54, Data2=item_105.Item1, Data3=item_105.Item)

neg_16 = Negative(Value=x_plus_one_15)
item_106 = ListItem(List=sort_43.ValuesA, Index=neg_16, Wrap=True)
panel_58 = Panel(merge_57)
item_107 = ListItem(List=deccutmesh_3.Vertices, Index=item_106, Wrap=True)

neg_17 = Negative(Value=x_plus_one_16)
item_108 = ListItem(List=sort_49.ValuesA, Index=neg_17, Wrap=True)
item_109 = ListItem(List=deccutmesh_3.Vertices, Index=item_108, Wrap=True)

neg_18 = Negative(Value=x_plus_one_17)
item_110 = ListItem(List=sort_48.ValuesA, Index=neg_18, Wrap=True)
item_111 = ListItem(List=deccutmesh_3.Vertices, Index=item_110, Wrap=True)
panel_59 = Panel(merge_58)

# ----
# ガウス曲率が大きかったもの
cutmeshgcurvature_10 = CutMeshGCurvature(TriangulatedMeshOrCutMesh=mbridgecm_22)
lng_21 = ListLength(List=cutmeshgcurvature_10)
abs_17 = Absolute(Value=cutmeshgcurvature_10)
series_38 = Series(Start=0, Step=1, Count=lng_21)
series_39 = Series(Start=0, Step=1, Count=Slider(59, range=0..100))
sort_50 = SortList(Keys=abs_17, ValuesA=series_38)  # -> Keys, ValuesA

x_plus_one_18 = XPlusOne(NumberX=series_39)
avr_55 = Average(Input=sort_50.Keys)
item_112 = ListItem(List=sort_50.Keys, Index=0, Wrap=True)  # -> Item1, Item
merge_59 = Merge(Data1=avr_55, Data2=item_112.Item1, Data3=item_112.Item)

neg_19 = Negative(Value=x_plus_one_18)
item_113 = ListItem(List=sort_50.ValuesA, Index=neg_19, Wrap=True)
panel_60 = Panel(merge_59)
item_114 = ListItem(List=deccutmesh_17.Vertices, Index=item_113, Wrap=True)

# ----
# Selfのみ
number_slider_35 = Slider(10000, range=0..10000)
number_slider_36 = Slider(100000, range=0..100000)
develop_11 = DevelopMesh(TriangulatedMesh=wbweave_10, Count=number_slider_35)  # -> ModifiedMesh, A
sortcutmesh_15 = SortCutMesh(TriangulatedMeshOrCutMesh=develop_11.ModifiedMesh)
deccutmesh_25 = DeconstructCutMesh(TriangulatedMeshOrCutMesh=sortcutmesh_15)  # -> Vertices, Faces, Edges

meshedges_33 = MeshEdges(Mesh=develop_11.ModifiedMesh)  # -> AllE, NakedE
preview_6 = CustomPreview(Geometry=develop_11.ModifiedMesh, Material=ColourSwatch(SwatchColor=RGBA(52, 92, 65, 130)))
previewlw_9 = CustomPreviewLineweights(Geometry=meshedges_33.AllE, Shader=ColourSwatch(SwatchColor=RGBA(0, 0, 0, 130)), Absolute=False)

# ----
# ガウス曲率が大きかったもの
cutmeshgcurvature_11 = CutMeshGCurvature(TriangulatedMeshOrCutMesh=developcm2_8)
abs_18 = Absolute(Value=cutmeshgcurvature_11)
lng_22 = ListLength(List=cutmeshgcurvature_11)
series_40 = Series(Start=0, Step=1, Count=lng_22)
series_41 = Series(Start=0, Step=1, Count=Slider(30, range=0..100))
sort_51 = SortList(Keys=abs_18, ValuesA=series_40)  # -> Keys, ValuesA

x_plus_one_19 = XPlusOne(NumberX=series_41)
avr_56 = Average(Input=sort_51.Keys)
item_115 = ListItem(List=sort_51.Keys, Index=0, Wrap=True)  # -> Item1, Item
merge_60 = Merge(Data1=avr_56, Data2=item_115.Item1, Data3=item_115.Item)

neg_20 = Negative(Value=x_plus_one_19)
item_116 = ListItem(List=sort_51.ValuesA, Index=neg_20, Wrap=True)
panel_61 = Panel(merge_60)
item_117 = ListItem(List=deccutmesh_3.Vertices, Index=item_116, Wrap=True)

cutmeshgcurvature_12 = CutMeshGCurvature(TriangulatedMeshOrCutMesh=meshcutbylines_11)
abs_19 = Absolute(Value=cutmeshgcurvature_12)
lng_23 = ListLength(List=cutmeshgcurvature_12)
series_42 = Series(Start=0, Step=1, Count=lng_23)
series_43 = Series(Start=0, Step=1, Count=Slider(30, range=0..100))
sort_52 = SortList(Keys=abs_19, ValuesA=series_42)  # -> Keys, ValuesA

x_plus_one_20 = XPlusOne(NumberX=series_43)
avr_57 = Average(Input=sort_52.Keys)
item_118 = ListItem(List=sort_52.Keys, Index=0, Wrap=True)  # -> Item1, Item
merge_61 = Merge(Data1=avr_57, Data2=item_118.Item1, Data3=item_118.Item)

neg_21 = Negative(Value=x_plus_one_20)
item_119 = ListItem(List=sort_52.ValuesA, Index=neg_21, Wrap=True)
panel_62 = Panel(merge_61)

# ----
# ガウス曲率が大きかったもの
cutmeshgcurvature_13 = CutMeshGCurvature(TriangulatedMeshOrCutMesh=sortcutmesh_15)
lng_24 = ListLength(List=cutmeshgcurvature_13)
abs_20 = Absolute(Value=cutmeshgcurvature_13)
series_44 = Series(Start=0, Step=1, Count=lng_24)
series_45 = Series(Start=0, Step=1, Count=Slider(59, range=0..100))
sort_53 = SortList(Keys=abs_20, ValuesA=series_44)  # -> Keys, ValuesA

# ----
# 移動距離が大きかったもの
number_slider_37 = Slider(30, range=0..100)
deccutmesh_26 = DeconstructCutMesh(TriangulatedMeshOrCutMesh=sortcutmesh_15)  # -> Vertices, Faces, Edges
dist_12 = Distance(PointA=deccutmesh_3.Vertices, PointB=deccutmesh_26.Vertices)
lng_25 = ListLength(List=dist_12)
series_46 = Series(Start=0, Step=1, Count=lng_25)
series_47 = Series(Start=0, Step=1, Count=number_slider_37)
avr_58 = Average(Input=dist_12)
sort_54 = SortList(Keys=dist_12, ValuesA=series_46)  # -> Keys, ValuesA
item_120 = ListItem(List=sort_54.Keys, Index=0, Wrap=True)  # -> Item1, Item
merge_62 = Merge(Data1=item_120.Item1, Data2=item_120.Item, Data3=avr_58)  # -> flatten(Result)
panel_63 = Panel(merge_62)

x_plus_one_21 = XPlusOne(NumberX=series_47)
x_plus_one_22 = XPlusOne(NumberX=series_45)
avr_59 = Average(Input=sort_53.Keys)
item_121 = ListItem(List=sort_53.Keys, Index=0, Wrap=True)  # -> Item1, Item
merge_63 = Merge(Data1=avr_59, Data2=item_121.Item1, Data3=item_121.Item)

neg_22 = Negative(Value=x_plus_one_21)
item_122 = ListItem(List=sort_54.ValuesA, Index=neg_22, Wrap=True)
item_123 = ListItem(List=deccutmesh_3.Vertices, Index=item_122, Wrap=True)

neg_23 = Negative(Value=x_plus_one_22)
item_124 = ListItem(List=sort_53.ValuesA, Index=neg_23, Wrap=True)
item_125 = ListItem(List=deccutmesh_25.Vertices, Index=item_124, Wrap=True)
panel_64 = Panel(merge_63)

cutmeshgcurvature_14 = CutMeshGCurvature(TriangulatedMeshOrCutMesh=meshcutbylines_10)
abs_21 = Absolute(Value=cutmeshgcurvature_14)
lng_26 = ListLength(List=cutmeshgcurvature_14)
series_48 = Series(Start=0, Step=1, Count=lng_26)
series_49 = Series(Start=0, Step=1, Count=Slider(30, range=0..100))
sort_55 = SortList(Keys=abs_21, ValuesA=series_48)  # -> Keys, ValuesA

x_plus_one_23 = XPlusOne(NumberX=series_49)
avr_60 = Average(Input=sort_55.Keys)
item_126 = ListItem(List=sort_55.Keys, Index=0, Wrap=True)  # -> Item1, Item
merge_64 = Merge(Data1=avr_60, Data2=item_126.Item1, Data3=item_126.Item)

panel_65 = Panel(merge_64)
neg_24 = Negative(Value=x_plus_one_23)
item_127 = ListItem(List=sort_55.ValuesA, Index=neg_24, Wrap=True)

cutmeshgcurvature_15 = CutMeshGCurvature(TriangulatedMeshOrCutMesh=developcm3_8)
abs_22 = Absolute(Value=cutmeshgcurvature_15)
lng_27 = ListLength(List=cutmeshgcurvature_15)
series_50 = Series(Start=0, Step=1, Count=lng_27)
series_51 = Series(Start=0, Step=1, Count=Slider(30, range=0..100))
sort_56 = SortList(Keys=abs_22, ValuesA=series_50)  # -> Keys, ValuesA

x_plus_one_24 = XPlusOne(NumberX=series_51)
avr_61 = Average(Input=sort_56.Keys)
item_128 = ListItem(List=sort_56.Keys, Index=0, Wrap=True)  # -> Item1, Item
merge_65 = Merge(Data1=avr_61, Data2=item_128.Item1, Data3=item_128.Item)

panel_66 = Panel(merge_65)
neg_25 = Negative(Value=x_plus_one_24)
item_129 = ListItem(List=sort_56.ValuesA, Index=neg_25, Wrap=True)

cutmeshgcurvature_16 = CutMeshGCurvature(TriangulatedMeshOrCutMesh=developcm3_9)
abs_23 = Absolute(Value=cutmeshgcurvature_16)
lng_28 = ListLength(List=cutmeshgcurvature_16)
series_52 = Series(Start=0, Step=1, Count=lng_28)
series_53 = Series(Start=0, Step=1, Count=Slider(30, range=0..100))
sort_57 = SortList(Keys=abs_23, ValuesA=series_52)  # -> Keys, ValuesA

x_plus_one_25 = XPlusOne(NumberX=series_53)
avr_62 = Average(Input=sort_57.Keys)
item_130 = ListItem(List=sort_57.Keys, Index=0, Wrap=True)  # -> Item1, Item
merge_66 = Merge(Data1=avr_62, Data2=item_130.Item1, Data3=item_130.Item)

panel_67 = Panel(merge_66)
neg_26 = Negative(Value=x_plus_one_25)
item_131 = ListItem(List=sort_57.ValuesA, Index=neg_26, Wrap=True)
