# Grasshopper definition DevCheck3.gh (Grasshopper 1.0.8)
# plug-ins: Heteroptera, Pufferfish, Human, Crane, Hagoromo, Weaverbird, NGon_RH8

crv = Curve([<curve referenced from the Rhino model> x81])
project = Project(Geometry=crv, Plane=PlaneXY(0, 0, 0))  # -> Geometry, Transform
wbweave = WeaverbirdsMeshFromLinesWeaveBack(Lines=project.Geometry, MaximumValence=4)
# カットメッシュとは
crv_2 = Curve([<curve referenced from the Rhino model> x71])
meshedges = MeshEdges(Mesh=wbweave)  # -> AllE, NakedE
crv_3 = Curve(<curve referenced from the Rhino model>)
project_2 = Project(Geometry=crv_3, Plane=PlaneXY(0, 0, 0))  # -> Geometry, Transform
meshcutbylines = MeshCutWithCutLines(TriangulatedMeshOrCutMesh=wbweave, OpenCutLinesPolylines=project_2.Geometry)
X = UnitX(Factor=Slider(123, range=0..1000))
wbweave_2 = WeaverbirdsMeshFromLinesWeaveBack(Lines=crv, MaximumValence=4)
wbweave_3 = WeaverbirdsMeshFromLinesWeaveBack(Lines=crv_2, MaximumValence=4)
move = Move(Geometry=meshedges.NakedE, Motion=X)  # -> Geometry, Transform
mbridgecm = MbridgeCM(TriangulatedMeshOrCutMesh=wbweave_2)
movecm = MoveCutMesh(TriangulatedMeshOrCutMesh=meshcutbylines, MoveDirection=X)
meshedges_2 = MeshEdges(Mesh=wbweave_2)  # -> AllE, NakedE

opentreemesh = OpenTreeMesh(TriangulatedDevelopableMesh=wbweave_3)  # -> CutMesh, CutLines, MeshGraph
mbridgecm_2 = MbridgeCM(TriangulatedMeshOrCutMesh=opentreemesh.CutMesh)
cutmeshedges = CutMeshEdges(TriangulatedMeshOrCutMesh=opentreemesh.CutMesh)  # -> MeshAllEdges, MeshNakedEdges
crv_4 = Curve(cutmeshedges.MeshNakedEdges)

mbridgecm_3 = MbridgeCM(TriangulatedMeshOrCutMesh=wbweave_3)
meshedges_3 = MeshEdges(Mesh=wbweave_3)  # -> AllE, NakedE
meshcutbylines_2 = MeshCutWithCutLines(TriangulatedMeshOrCutMesh=wbweave_2, OpenCutLinesPolylines=crv_3)
developcm2 = DevelopCutMesh2(
    TriangulatedCutMesh=movecm,
    Iterations=Slider(100, range=0..100),
    XyMirror=False,
    YzMirror=False,
    ZxMirror=False,
    OuterBoundaryCurves=move.Geometry,
    Alpha=0.1)
panel = Panel("""47
49
53
61
4""")
number_slider = Slider(1000, range=0..1000)
item = ListItem(List=meshedges_3.AllE, Index=panel, Wrap=True)
mesh = Mesh(<mesh referenced from the Rhino model>)
item_2 = ListItem(List=meshedges_3.AllE, Index="78", Wrap=True)
crv_5 = Curve([<curve referenced from the Rhino model> x2])
sortcutmesh = SortCutMesh(TriangulatedMeshOrCutMesh=meshcutbylines_2)
cutmeshedges_2 = CutMeshEdges(TriangulatedMeshOrCutMesh=developcm2)  # -> MeshAllEdges, MeshNakedEdges
number_slider_2 = Slider(1000, range=0..1000)

merge = Merge(Data1=crv_5, Data2=item_2, Data3=item)  # -> flatten(Result)
meshcut = MeshCut(TriangulatedMeshOrCutMesh=mbridgecm_3, OpenCutLinesPolylines=merge)

merge_2 = Merge(Data1=crv_5, Data2=item_2)  # -> flatten(Result)
meshcut_2 = MeshCut(TriangulatedMeshOrCutMesh=mbridgecm_3, OpenCutLinesPolylines=merge_2)

number_slider_3 = Slider(4560, range=0..10000)
item_3 = ListItem(List=cutmeshedges_2.MeshAllEdges, Index="46", Wrap=True)
meshcutbylines_3 = MeshCutWithCutLines(TriangulatedMeshOrCutMesh=developcm2, OpenCutLinesPolylines=item_3)

gcurvature = GaussianCurvature(TriangulatedMesh=mesh)
sort = SortList(Keys=gcurvature, ValuesA=gcurvature)  # -> Keys, ValuesA
avr = Average(Input=gcurvature)
item_4 = ListItem(List=sort.ValuesA, Index=0, Wrap=True)  # -> Item1, Item
merge_3 = Merge(Data1=item_4.Item1, Data2=item_4.Item, Data3=avr)
panel_2 = Panel(merge_3)

sortcutmesh_2 = SortCutMesh(TriangulatedMeshOrCutMesh=meshcut_2)
develop_mesh = DevelopMesh(Mesh=mesh)  # -> DevelopMesh, FaceTree
meshnet4 = MeshNet4(TriangulatedMeshOrCutMesh=mesh)
developcm2_2 = DevelopCutMesh2(
    TriangulatedCutMesh=sortcutmesh,
    Iterations=Slider(2000, range=0..10000),
    XyMirror=False,
    YzMirror=False,
    ZxMirror=False,
    OuterBoundaryCurves=meshedges_2.NakedE,
    Alpha=0.1)
developcm3 = DevelopCutMesh3(
    TriangulatedCutMesh=sortcutmesh,
    Iterations=Slider(100, range=0..100),
    XyMirror=False,
    YzMirror=False,
    ZxMirror=False,
    OuterBoundaryCurves=meshedges_2.NakedE,
    Alpha=Slider(0.1, range=0..0.1))
cutmeshedges_3 = CutMeshEdges(TriangulatedMeshOrCutMesh=developcm3)  # -> MeshAllEdges, MeshNakedEdges
item_5 = ListItem(List=cutmeshedges_3.MeshAllEdges, Index="46", Wrap=True)
sortcutmesh_3 = SortCutMesh(TriangulatedMeshOrCutMesh=meshcut)
meshnet4_2 = MeshNet4(TriangulatedMeshOrCutMesh=meshcutbylines_3)
meshcutbylines_4 = MeshCutWithCutLines(TriangulatedMeshOrCutMesh=developcm3, OpenCutLinesPolylines=item_5)
number_slider_4 = Slider(9, range=0..50)
mbridgecm_4 = MbridgeCM(TriangulatedMeshOrCutMesh=meshnet4)
deccutmesh = DeconstructCutMesh(TriangulatedMeshOrCutMesh=sortcutmesh_2)  # -> Vertices, Faces, Edges
cutmeshedges_4 = CutMeshEdges(TriangulatedMeshOrCutMesh=developcm2_2)  # -> MeshAllEdges, MeshNakedEdges
center = Center(Geometry=wbweave_2)  # -> Center, Dimension
dividecutmesh = DivideCutMesh(TriangulatedMeshOrCutMesh=sortcutmesh_3)
meshnet4_3 = MeshNet4(TriangulatedMeshOrCutMesh=meshcutbylines_4)
mesh_2 = Mesh(develop_mesh.DevelopMesh)
mbridgecm_5 = MbridgeCM(TriangulatedMeshOrCutMesh=meshnet4_2)
item_6 = ListItem(List=cutmeshedges_4.MeshAllEdges, Index="46", Wrap=True)
meshedges_4 = MeshEdges(Mesh=mbridgecm_4)  # -> AllE, NakedE
crv_6 = Curve([<curve referenced from the Rhino model> x18])
mesh_3 = Mesh(<mesh referenced from the Rhino model>)
meshcutbylines_5 = MeshCutWithCutLines(TriangulatedMeshOrCutMesh=developcm2_2, OpenCutLinesPolylines=item_6)
center_2 = Center(Geometry=mbridgecm_5)  # -> Center, Dimension
cutmeshedges_5 = CutMeshEdges(TriangulatedMeshOrCutMesh=meshcut)  # -> MeshAllEdges, MeshNakedEdges
meshedges_5 = MeshEdges(Mesh=mesh_3)  # -> AllE, NakedE
wbweave_4 = WeaverbirdsMeshFromLinesWeaveBack(Lines=crv_6, MaximumValence=4)
mbridgecm_6 = MbridgeCM(TriangulatedMeshOrCutMesh=meshnet4_3)
crv_7 = Curve(meshedges_4.NakedE)
len = Length(Curve=crv_7)
item_7 = ListItem(List=dividecutmesh, Index="1", Wrap=True)
crv_8 = Curve(meshedges_5.AllE)
avr_2 = Average(Input=len)
crv_9 = Curve([<curve referenced from the Rhino model> x893])
meshnet4_4 = MeshNet4(TriangulatedMeshOrCutMesh=meshcutbylines_5)
center_3 = Center(Geometry=mbridgecm_6)  # -> Center, Dimension
center_4 = Center(Geometry=wbweave_2)  # -> Center, Dimension
opentreemesh_2 = OpenTreeMesh(TriangulatedDevelopableMesh=wbweave_4)  # -> CutMesh, CutLines, MeshGraph
move2pt = MoveToPoint(Geometry=mbridgecm_5, PointA=center_2.Center, PointB=center.Center)  # -> Moved, Vector, Transform
sortcutmesh_4 = SortCutMesh(TriangulatedMeshOrCutMesh=item_7)
move2pt_2 = MoveToPoint(Geometry=mbridgecm_6, PointA=center_3.Center, PointB=center_4.Center)  # -> Moved, Vector, Transform
center_5 = Center(Geometry=wbweave_2)  # -> Center, Dimension
wbweave_5 = WeaverbirdsMeshFromLinesWeaveBack(Lines=crv_9, MaximumValence=4)
meshnet4_5 = MeshNet4(TriangulatedMeshOrCutMesh=opentreemesh_2.CutMesh)
mbridgecm_7 = MbridgeCM(TriangulatedMeshOrCutMesh=meshnet4_4)
cutmeshedges_6 = CutMeshEdges(TriangulatedCutMesh=opentreemesh_2.CutMesh)  # -> MeshAllEdges, MeshNakedEdges
deccutmesh_2 = DeconstructCutMesh(TriangulatedMeshOrCutMesh=sortcutmesh_4)  # -> Vertices, Faces, Edges
mesh_4 = Mesh(wbweave_5)
center_6 = Center(Geometry=mbridgecm_7)  # -> Center, Dimension
panel_3 = Panel("2")
item_8 = ListItem(List=deccutmesh.Edges, Index="1", Wrap=True)  # -> flatten(Item)
item_9 = ListItem(List=deccutmesh.Edges, Index="0", Wrap=True)  # -> flatten(Item)
number_slider_5 = Slider(22, range=0..50)
item_10 = ListItem(List=deccutmesh.Vertices, Index=Slider(0, range=0..30), Wrap=True)

# ----
# 曲率0に
cmesh_from_mesh = CMeshFromMesh(Mesh=wbweave_5)
developable = Developable()
static_solver = CraneStaticSolver(
    CMesh=cmesh_from_mesh,
    Constraints=developable,
    NRIteration=50,
    CGNRIteration=100,
    Threshold=1e-13,
    Solve=Toggle(True),
    IsRigidEdge=False,
    IsPanelFlat=True,
    IsFoldBlock=True,
    IsConstraint=True)  # -> CMesh, RigidOrigami, Residual
deconstruct_cmesh = DeconstructCMesh(CMesh=static_solver.CMesh)  # -> Mesh, Mountain, Valley, Boundary, Unassigned, Triangulate, Edges, Inner
develop_mesh_2 = DevelopMesh(Mesh=deconstruct_cmesh.Mesh)  # -> DevelopMesh, FaceTree
gcurvature_2 = GaussianCurvature(TriangulatedMesh=deconstruct_cmesh.Mesh)
sort_2 = SortList(Keys=gcurvature_2, ValuesA=gcurvature_2)  # -> Keys, ValuesA
avr_3 = Average(Input=gcurvature_2)
item_11 = ListItem(List=sort_2.ValuesA, Index=0, Wrap=True)  # -> Item1, Item
merge_4 = Merge(Data1=item_11.Item1, Data2=item_11.Item, Data3=avr_3)
panel_4 = Panel(merge_4)

move2pt_3 = MoveToPoint(Geometry=mbridgecm_7, PointA=center_6.Center, PointB=center_5.Center)  # -> Moved, Vector, Transform
item_12 = ListItem(List=item_9, Index=number_slider_4, Wrap=True)
item_13 = ListItem(List=item_8, Index=number_slider_4, Wrap=True)
item_14 = ListItem(List=deccutmesh.Vertices, Index=item_12, Wrap=True)
item_15 = ListItem(List=deccutmesh.Vertices, Index=item_13, Wrap=True)

develop = DevelopMesh(TriangulatedMesh=wbweave_5, Count=Slider(1000, range=0..1000))  # -> ModifiedMesh, A
gcurvature_3 = GaussianCurvature(TriangulatedMesh=develop.ModifiedMesh)
sort_3 = SortList(Keys=gcurvature_3, ValuesA=gcurvature_3)  # -> Keys, ValuesA
avr_4 = Average(Input=gcurvature_3)
item_16 = ListItem(List=sort_3.ValuesA, Index=0, Wrap=True)  # -> Item1, Item
merge_5 = Merge(Data1=item_16.Item1, Data2=item_16.Item, Data3=avr_4)
# 長さの最適化まで入れたら長さのずれが0.1倍になった
panel_5 = Panel(merge_5)

ln = Line(StartPoint=item_14, EndPoint=item_15)
meshedges_6 = MeshEdges(Mesh=develop.ModifiedMesh)  # -> AllE, NakedE
mbridgecm_8 = MbridgeCM(TriangulatedMeshOrCutMesh=wbweave_5)
len_2 = Length(Curve=meshedges_6.NakedE)
item_17 = ListItem(List=deccutmesh_2.Edges, Index="1", Wrap=True)  # -> flatten(Item)
item_18 = ListItem(List=deccutmesh_2.Edges, Index="0", Wrap=True)  # -> flatten(Item)
avr_5 = Average(Input=len_2)
developcm = DevelopCutMesh(TriangulatedCutMesh=mbridgecm_8, Count=Slider(1000, range=0..1000))
item_19 = ListItem(List=deccutmesh_2.Vertices, Index=Slider(0, range=0..30), Wrap=True)
sortcutmesh_5 = SortCutMesh(TriangulatedMeshOrCutMesh=deconstruct_cmesh.Mesh)
item_20 = ListItem(List=item_18, Index=number_slider_5, Wrap=True)
item_21 = ListItem(List=item_17, Index=number_slider_5, Wrap=True)
cutmeshedges_7 = CutMeshEdges(TriangulatedMeshOrCutMesh=developcm)  # -> MeshAllEdges, MeshNakedEdges
meshnet6 = MeshNet6(TriangulatedMeshOrCutMesh=sortcutmesh_5)
item_22 = ListItem(List=deccutmesh_2.Vertices, Index=item_20, Wrap=True)
item_23 = ListItem(List=deccutmesh_2.Vertices, Index=item_21, Wrap=True)
ln_2 = Line(StartPoint=item_22, EndPoint=item_23)
cutmeshedges_8 = CutMeshEdges(TriangulatedMeshOrCutMesh=sortcutmesh_5)  # -> MeshAllEdges, MeshNakedEdges
cutmeshedges_9 = CutMeshEdges(TriangulatedMeshOrCutMesh=meshnet6)  # -> MeshAllEdges, MeshNakedEdges
meshedges_7 = MeshEdges(Mesh=deconstruct_cmesh.Mesh)  # -> AllE, NakedE
meshedges_8 = MeshEdges(Mesh=develop_mesh_2.DevelopMesh)  # -> AllE, NakedE
len_3 = Length(Curve=cutmeshedges_8.MeshAllEdges)
len_4 = Length(Curve=cutmeshedges_9.MeshAllEdges)
len_5 = Length(Curve=meshedges_8.AllE)
len_6 = Length(Curve=meshedges_7.AllE)
mesh_5 = Mesh(<mesh referenced from the Rhino model>)
subtraction = Subtraction(A=len_3, B=len_4)
subtraction_2 = Subtraction(A=len_5, B=len_6)
meshedges_9 = MeshEdges(Mesh=mesh_5)  # -> AllE, NakedE
preview = CustomPreview(Geometry=mesh_5, Material=ColourSwatch(SwatchColor=RGBA(173, 173, 173, 130)))
abs = Absolute(Value=subtraction)
abs_2 = Absolute(Value=subtraction_2)
previewlw = CustomPreviewLineweights(Geometry=meshedges_9.AllE, Shader=ColourSwatch(SwatchColor=RGBA(173, 173, 173, 130)), Absolute=False)

# ----
# 展開図
develop_mesh_3 = DevelopMesh(Mesh=develop.ModifiedMesh)  # -> DevelopMesh, FaceTree
meshedges_10 = MeshEdges(Mesh=develop_mesh_3.DevelopMesh)  # -> AllE, NakedE

sortcutmesh_6 = SortCutMesh(TriangulatedMeshOrCutMesh=develop.ModifiedMesh)
avr_6 = Average(Input=abs)
sort_4 = SortList(Keys=abs)  # -> Keys, ValuesA
avr_7 = Average(Input=abs_2)
meshnet4_6 = MeshNet4(TriangulatedMeshOrCutMesh=develop.ModifiedMesh)
meshnet6_2 = MeshNet6(TriangulatedMeshOrCutMesh=develop.ModifiedMesh)
sort_5 = SortList(Keys=abs_2)  # -> Keys, ValuesA
item_24 = ListItem(List=sort_4.Keys, Index=0, Wrap=True)  # -> Item1, Item
item_25 = ListItem(List=sort_5.Keys, Index=0, Wrap=True)  # -> Item1, Item
cutmeshedges_10 = CutMeshEdges(TriangulatedMeshOrCutMesh=sortcutmesh_6)  # -> MeshAllEdges, MeshNakedEdges
mbridgecm_9 = MbridgeCM(TriangulatedMeshOrCutMesh=meshnet4_6)
cutmeshedges_11 = CutMeshEdges(TriangulatedMeshOrCutMesh=meshnet6_2)  # -> MeshAllEdges, MeshNakedEdges
crv_10 = Curve([<curve referenced from the Rhino model> x2])
merge_6 = Merge(Data1=avr_6, Data2=item_24.Item1, Data3=item_24.Item)
merge_7 = Merge(Data1=avr_7, Data2=item_25.Item1, Data3=item_25.Item)
join = JoinCurves(Curves=crv_10, Preserve=False)
crv_11 = Curve(<curve referenced from the Rhino model>)
crv_12 = Curve(<curve referenced from the Rhino model>)
meshedges_11 = MeshEdges(Mesh=mbridgecm_9)  # -> AllE, NakedE
crv_13 = Curve(<curve referenced from the Rhino model>)
crv_14 = Curve(<curve referenced from the Rhino model>)
panel_7 = Panel(merge_6)
panel_8 = Panel(merge_7)
len_7 = Length(Curve=cutmeshedges_10.MeshAllEdges)
len_8 = Length(Curve=cutmeshedges_11.MeshAllEdges)
len_9 = Length(Curve=meshedges_11.NakedE)
merge_8 = Merge(Data1=join, Data2=crv_13, Data3=crv_12, Data4=crv_11, Data5=crv_14)  # -> flatten(Result)
avr_8 = Average(Input=len_9)
cutmeshedges_12 = CutMeshEdges(TriangulatedMeshOrCutMesh=meshnet4_6)  # -> MeshAllEdges, MeshNakedEdges
subtraction_3 = Subtraction(A=len_8, B=len_7)
meshcutbylines_6 = MeshCutWithCutLines(TriangulatedMeshOrCutMesh=mesh_5, OpenCutLinesPolylines=merge_8)
len_10 = Length(Curve=cutmeshedges_12.MeshAllEdges)
abs_3 = Absolute(Value=subtraction_3)
subtraction_4 = Subtraction(A=len_10, B=len_7)
crv_15 = Curve([<curve referenced from the Rhino model> x102])
avr_9 = Average(Input=abs_3)
sort_6 = SortList(Keys=abs_3)  # -> Keys, ValuesA
abs_4 = Absolute(Value=subtraction_4)
X_2 = UnitX(Factor=Slider(194, range=0..1000))
item_26 = ListItem(List=sort_6.Keys, Index=0, Wrap=True)  # -> Item1, Item
wbweave_6 = WeaverbirdsMeshFromLinesWeaveBack(Lines=crv_15, MaximumValence=4)
avr_10 = Average(Input=abs_4)
sort_7 = SortList(Keys=abs_4)  # -> Keys, ValuesA
number_slider_6 = Slider(2082, range=0..10000)  # disabled
mbridgecm_10 = MbridgeCM(TriangulatedMeshOrCutMesh=mesh_5)
meshedges_12 = MeshEdges(Mesh=wbweave_6)  # -> AllE, NakedE
merge_9 = Merge(Data1=avr_9, Data2=item_26.Item1, Data3=item_26.Item)
item_27 = ListItem(List=sort_7.Keys, Index=0, Wrap=True)  # -> Item1, Item
crv_16 = Curve([<curve referenced from the Rhino model> x1348])  # disabled
X_3 = UnitX(Factor=Slider(2000, range=0..10000))
panel_9 = Panel("""38
42""")
wbweave_7 = WeaverbirdsMeshFromLinesWeaveBack(Lines=crv_16, MaximumValence=4)  # disabled
merge_10 = Merge(Data1=avr_10, Data2=item_27.Item1, Data3=item_27.Item)
meshedges_13 = MeshEdges(Mesh=mesh_5)  # -> AllE, NakedE
panel_10 = Panel(merge_9)
sortcutmesh_7 = SortCutMesh(TriangulatedMeshOrCutMesh=mbridgecm_10)
item_28 = ListItem(List=meshedges_12.AllE, Index=panel_9, Wrap=True)
develop_2 = DevelopMesh(TriangulatedMesh=wbweave_7, Count=number_slider_6)  # -> ModifiedMesh, A; disabled
meshedges_14 = MeshEdges(Mesh=mesh_5)  # -> AllE, NakedE
move_2 = Move(Geometry=meshedges_14.NakedE, Motion=X_2)  # -> Geometry, Transform
mesh_6 = Mesh(wbweave_7)  # disabled
sortcutmesh_8 = SortCutMesh(TriangulatedMeshOrCutMesh=mesh_6)  # disabled
move_3 = Move(Geometry=mesh_5, Motion=X_3)  # -> Geometry, Transform
panel_11 = Panel(merge_10)
meshcutbylines_7 = MeshCutWithCutLines(TriangulatedMeshOrCutMesh=wbweave_6, OpenCutLinesPolylines=item_28)
deccutmesh_3 = DeconstructCutMesh(TriangulatedMeshOrCutMesh=sortcutmesh_7)  # -> Vertices, Faces, Edges
sortcutmesh_9 = SortCutMesh(TriangulatedMeshOrCutMesh=develop_2.ModifiedMesh)  # disabled
sortcutmesh_10 = SortCutMesh(TriangulatedMeshOrCutMesh=meshcutbylines_7)
movecm_2 = MoveCutMesh(TriangulatedMeshOrCutMesh=meshcutbylines_6, MoveDirection=X_2)
meshedges_15 = MeshEdges(Mesh=mesh_6)  # -> AllE, NakedE; disabled
developcm3_2 = DevelopCutMesh3(
    TriangulatedCutMesh=sortcutmesh_8,
    Iterations=number_slider_6,
    XyMirror=False,
    YzMirror=False,
    ZxMirror=False,
    OuterBoundaryCurves=meshedges_15.NakedE,
    Alpha=1)  # disabled
deccutmesh_4 = DeconstructCutMesh(TriangulatedMeshOrCutMesh=sortcutmesh_9)  # -> Vertices, Faces, Edges; disabled
cutmeshedges_13 = CutMeshEdges(TriangulatedMeshOrCutMesh=sortcutmesh_10)  # -> MeshAllEdges, MeshNakedEdges
deccutmesh_5 = DeconstructCutMesh(TriangulatedMeshOrCutMesh=developcm3_2)  # -> Vertices, Faces, Edges; disabled
mbridgecm_11 = MbridgeCM(TriangulatedMeshOrCutMesh=move_3.Geometry)
number_slider_7 = Slider(10000, range=0..10000)  # disabled
number_slider_8 = Slider(1000, range=0..1000)
number_slider_9 = Slider(1000, range=0..1000)
move_4 = Move(Geometry=meshedges_13.NakedE, Motion=X_3)  # -> Geometry, Transform
move_5 = Move(Geometry=merge_8, Motion=X_3)  # -> Geometry, Transform
crv_17 = Curve(cutmeshedges_13.MeshNakedEdges)
developcm2_3 = DevelopCutMesh2(
    TriangulatedCutMesh=meshcutbylines_7,
    Iterations=Slider(100, range=0..100),
    XyMirror=False,
    YzMirror=False,
    ZxMirror=False,
    OuterBoundaryCurves=crv_17,
    Alpha=0.1)
number_slider_10 = Slider(1000, range=0..1000)
sortcutmesh_11 = SortCutMesh(TriangulatedMeshOrCutMesh=movecm_2)
dist = Distance(PointA=deccutmesh_4.Vertices, PointB=deccutmesh_5.Vertices)  # disabled
number_slider_11 = Slider(1000, range=0..1000)  # disabled
number_slider_12 = Slider(0.4, range=0..1)
number_slider_13 = Slider(6000, range=0..100000)  # disabled
panel_12 = Panel(dist)  # disabled
deccutmesh_6 = DeconstructCutMesh(TriangulatedMeshOrCutMesh=sortcutmesh_11)  # -> Vertices, Faces, Edges
sortcutmesh_12 = SortCutMesh(TriangulatedMeshOrCutMesh=mbridgecm_11)
developcm3_3 = DevelopCutMesh3(
    TriangulatedCutMesh=movecm_2,
    Iterations=Slider(10000, range=0..10000),
    XyMirror=False,
    YzMirror=False,
    ZxMirror=False,
    OuterBoundaryCurves=move_2.Geometry,
    Alpha=Slider(0.1, range=0..0.1))  # disabled
mbridgecm_12 = MbridgeCM(TriangulatedMeshOrCutMesh=developcm2_3)  # disabled
cutmeshedges_14 = CutMeshEdges(TriangulatedMeshOrCutMesh=developcm2_3)  # -> MeshAllEdges, MeshNakedEdges
developcm2_4 = DevelopCutMesh2(
    TriangulatedCutMesh=movecm_2,
    Iterations=Slider(5000, range=0..10000),
    XyMirror=False,
    YzMirror=False,
    ZxMirror=False,
    OuterBoundaryCurves=move_2.Geometry,
    Alpha=Slider(0.01, range=0..0.1))  # disabled
mbridgecm_13 = MbridgeCM(TriangulatedMeshOrCutMesh=mesh_6)  # disabled
developcm3_4 = DevelopCutMesh3(
    TriangulatedCutMesh=move_3.Geometry,
    Iterations=Slider(10000, range=0..10000),
    XyMirror=False,
    YzMirror=False,
    ZxMirror=False,
    OuterBoundaryCurves=move_4.Geometry,
    FixPointsCrv=move_5.Geometry,
    Alpha=1)  # disabled
gcurvature_4 = GaussianCurvature(TriangulatedMesh=develop_2.ModifiedMesh)  # disabled
developcm2_5 = DevelopCutMesh2(
    TriangulatedCutMesh=move_3.Geometry,
    Iterations=Slider(10000, range=0..10000),
    XyMirror=False,
    YzMirror=False,
    ZxMirror=False,
    OuterBoundaryCurves=move_4.Geometry,
    FixPointsCrv=move_5.Geometry,
    Alpha=0.1)  # disabled
developcm2_6 = DevelopCutMesh2(
    TriangulatedCutMesh=mesh_6,
    Iterations=number_slider_13,
    XyMirror=False,
    YzMirror=False,
    ZxMirror=False,
    OuterBoundaryCurves=meshedges_15.NakedE,
    Alpha=0.1)  # disabled
deccutmesh_7 = DeconstructCutMesh(TriangulatedMeshOrCutMesh=sortcutmesh_12)  # -> Vertices, Faces, Edges
number_slider_14 = Slider(10000, range=0..10000)  # disabled
number_slider_15 = Slider(1000, range=0..1000)  # disabled
gcurvature_5 = GaussianCurvature(TriangulatedMesh=mbridgecm_12)
panel_13 = Panel("""26
50
74""")
cutmeshedges_15 = CutMeshEdges(TriangulatedMeshOrCutMesh=developcm2_6)  # -> MeshAllEdges, MeshNakedEdges; disabled
number_slider_16 = Slider(3440, range=0..10000)  # disabled
deccutmesh_8 = DeconstructCutMesh(TriangulatedMeshOrCutMesh=mbridgecm_13)  # -> Vertices, Faces, Edges; disabled
sort_8 = SortList(Keys=gcurvature_4, ValuesA=gcurvature_4)  # -> Keys, ValuesA; disabled
crv_18 = Curve(cutmeshedges_15.MeshNakedEdges)  # disabled
sort_9 = SortList(Keys=gcurvature_5, ValuesA=gcurvature_5)  # -> Keys, ValuesA
avr_11 = Average(Input=gcurvature_4)  # disabled

# ----
# 移動距離が大きかったもの
number_slider_17 = Slider(30, range=0..100)
deccutmesh_9 = DeconstructCutMesh(TriangulatedMeshOrCutMesh=developcm2_5)  # -> Vertices, Faces, Edges
dist_2 = Distance(PointA=deccutmesh_7.Vertices, PointB=deccutmesh_9.Vertices)
lng = ListLength(List=dist_2)
series = Series(Start=0, Step=1, Count=lng)
series_2 = Series(Start=0, Step=1, Count=number_slider_17)
x_plus_one = XPlusOne(NumberX=series_2)
avr_12 = Average(Input=dist_2)
sort_10 = SortList(Keys=dist_2, ValuesA=series)  # -> Keys, ValuesA
neg = Negative(Value=x_plus_one)
item_29 = ListItem(List=sort_10.Keys, Index=0, Wrap=True)  # -> Item1, Item
item_30 = ListItem(List=sort_10.ValuesA, Index=neg, Wrap=True)
merge_11 = Merge(Data1=item_29.Item1, Data2=item_29.Item, Data3=avr_12)  # -> flatten(Result)
panel_14 = Panel(merge_11)
item_31 = ListItem(List=deccutmesh_9.Vertices, Index=item_30, Wrap=True)

# ----
# 移動距離が大きかったもの
number_slider_18 = Slider(30, range=0..100)
deccutmesh_10 = DeconstructCutMesh(TriangulatedMeshOrCutMesh=developcm3_4)  # -> Vertices, Faces, Edges
dist_3 = Distance(PointA=deccutmesh_7.Vertices, PointB=deccutmesh_10.Vertices)
lng_2 = ListLength(List=dist_3)
series_3 = Series(Start=0, Step=1, Count=lng_2)
series_4 = Series(Start=0, Step=1, Count=number_slider_18)
x_plus_one_2 = XPlusOne(NumberX=series_4)
avr_13 = Average(Input=dist_3)
sort_11 = SortList(Keys=dist_3, ValuesA=series_3)  # -> Keys, ValuesA
neg_2 = Negative(Value=x_plus_one_2)
item_32 = ListItem(List=sort_11.Keys, Index=0, Wrap=True)  # -> Item1, Item
item_33 = ListItem(List=sort_11.ValuesA, Index=neg_2, Wrap=True)
merge_12 = Merge(Data1=item_32.Item1, Data2=item_32.Item, Data3=avr_13)  # -> flatten(Result)
panel_15 = Panel(merge_12)
item_34 = ListItem(List=deccutmesh_10.Vertices, Index=item_33, Wrap=True)

item_35 = ListItem(List=cutmeshedges_14.MeshAllEdges, Index=panel_13, Wrap=True)

# ----
# ガウス曲率が大きかったもの
cutmeshgcurvature = CutMeshGCurvature(TriangulatedMeshOrCutMesh=developcm3_3)
deccutmesh_11 = DeconstructCutMesh(TriangulatedMeshOrCutMesh=developcm3_3)  # -> Vertices, Faces, Edges
lng_3 = ListLength(List=cutmeshgcurvature)
abs_5 = Absolute(Value=cutmeshgcurvature)
series_5 = Series(Start=0, Step=1, Count=lng_3)
series_6 = Series(Start=0, Step=1, Count=Slider(100, range=0..100))
sort_12 = SortList(Keys=abs_5, ValuesA=series_5)  # -> Keys, ValuesA
x_plus_one_3 = XPlusOne(NumberX=series_6)
neg_3 = Negative(Value=x_plus_one_3)
item_36 = ListItem(List=sort_12.ValuesA, Index=neg_3, Wrap=True)
avr_14 = Average(Input=sort_12.Keys)
item_37 = ListItem(List=sort_12.Keys, Index=0, Wrap=True)  # -> Item1, Item
merge_13 = Merge(Data1=avr_14, Data2=item_37.Item1, Data3=item_37.Item)
panel_16 = Panel(merge_13)
item_38 = ListItem(List=deccutmesh_11.Vertices, Index=item_36, Wrap=True)

# ----
# 移動距離が大きかったもの
number_slider_19 = Slider(30, range=0..100)
deccutmesh_12 = DeconstructCutMesh(TriangulatedMeshOrCutMesh=developcm3_3)  # -> Vertices, Faces, Edges
dist_4 = Distance(PointA=deccutmesh_6.Vertices, PointB=deccutmesh_12.Vertices)
lng_4 = ListLength(List=dist_4)
series_7 = Series(Start=0, Step=1, Count=lng_4)
series_8 = Series(Start=0, Step=1, Count=number_slider_19)
x_plus_one_4 = XPlusOne(NumberX=series_8)
avr_15 = Average(Input=dist_4)
sort_13 = SortList(Keys=dist_4, ValuesA=series_7)  # -> Keys, ValuesA
neg_4 = Negative(Value=x_plus_one_4)
item_39 = ListItem(List=sort_13.Keys, Index=0, Wrap=True)  # -> Item1, Item
item_40 = ListItem(List=sort_13.ValuesA, Index=neg_4, Wrap=True)
merge_14 = Merge(Data1=item_39.Item1, Data2=item_39.Item, Data3=avr_15)  # -> flatten(Result)
panel_17 = Panel(merge_14)
item_41 = ListItem(List=deccutmesh_12.Vertices, Index=item_40, Wrap=True)

avr_16 = Average(Input=sort_9.ValuesA)

# ----
# ガウス曲率が大きかったもの
cutmeshgcurvature_2 = CutMeshGCurvature(TriangulatedMeshOrCutMesh=developcm2_4)
deccutmesh_13 = DeconstructCutMesh(TriangulatedMeshOrCutMesh=developcm2_4)  # -> Vertices, Faces, Edges
lng_5 = ListLength(List=cutmeshgcurvature_2)
abs_6 = Absolute(Value=cutmeshgcurvature_2)
series_9 = Series(Start=0, Step=1, Count=lng_5)
series_10 = Series(Start=0, Step=1, Count=Slider(59, range=0..100))
sort_14 = SortList(Keys=abs_6, ValuesA=series_9)  # -> Keys, ValuesA
x_plus_one_5 = XPlusOne(NumberX=series_10)
neg_5 = Negative(Value=x_plus_one_5)
item_42 = ListItem(List=sort_14.ValuesA, Index=neg_5, Wrap=True)
avr_17 = Average(Input=sort_14.Keys)
item_43 = ListItem(List=sort_14.Keys, Index=0, Wrap=True)  # -> Item1, Item
merge_15 = Merge(Data1=avr_17, Data2=item_43.Item1, Data3=item_43.Item)
panel_18 = Panel(merge_15)
item_44 = ListItem(List=deccutmesh_13.Vertices, Index=item_42, Wrap=True)

item_45 = ListItem(List=sort_8.ValuesA, Index=0, Wrap=True)  # -> Item1, Item; disabled
developcm3_5 = DevelopCutMesh3(
    TriangulatedCutMesh=developcm2_6,
    Iterations=number_slider_16,
    XyMirror=False,
    YzMirror=False,
    ZxMirror=False,
    OuterBoundaryCurves=crv_18,
    Alpha=1)  # disabled
deccutmesh_14 = DeconstructCutMesh(TriangulatedMeshOrCutMesh=developcm3_5)  # -> Vertices, Faces, Edges; disabled
developcm4 = DevelopCutMesh4(
    TriangulatedCutMesh=mesh_6,
    Iterations=number_slider_14,
    XyMirror=False,
    YzMirror=False,
    ZxMirror=False,
    OuterBoundaryCurves=meshedges_15.NakedE)  # disabled

# ----
# 移動距離が大きかったもの
number_slider_20 = Slider(30, range=0..100)
deccutmesh_15 = DeconstructCutMesh(TriangulatedMeshOrCutMesh=developcm2_4)  # -> Vertices, Faces, Edges
dist_5 = Distance(PointA=deccutmesh_6.Vertices, PointB=deccutmesh_15.Vertices)
lng_6 = ListLength(List=dist_5)
series_11 = Series(Start=0, Step=1, Count=lng_6)
series_12 = Series(Start=0, Step=1, Count=number_slider_20)
x_plus_one_6 = XPlusOne(NumberX=series_12)
avr_18 = Average(Input=dist_5)
sort_15 = SortList(Keys=dist_5, ValuesA=series_11)  # -> Keys, ValuesA
neg_6 = Negative(Value=x_plus_one_6)
item_46 = ListItem(List=sort_15.Keys, Index=0, Wrap=True)  # -> Item1, Item
item_47 = ListItem(List=sort_15.ValuesA, Index=neg_6, Wrap=True)
merge_16 = Merge(Data1=item_46.Item1, Data2=item_46.Item, Data3=avr_18)  # -> flatten(Result)
panel_19 = Panel(merge_16)
item_48 = ListItem(List=deccutmesh_15.Vertices, Index=item_47, Wrap=True)

mbridgecm_14 = MbridgeCM(TriangulatedMeshOrCutMesh=developcm2_6)  # disabled
item_49 = ListItem(List=sort_9.ValuesA, Index=0, Wrap=True)  # -> Item1, Item
dist_6 = Distance(PointA=deccutmesh_8.Vertices, PointB=deccutmesh_14.Vertices)  # disabled
meshcutbylines_8 = MeshCutWithCutLines(TriangulatedMeshOrCutMesh=developcm2_3, OpenCutLinesPolylines=item_35)
sort_16 = SortList(Keys=dist_6, ValuesA=dist_6)  # -> Keys, ValuesA; disabled

gcurvature_6 = GaussianCurvature(TriangulatedMesh=mbridgecm_14)  # disabled
sort_17 = SortList(Keys=gcurvature_6, ValuesA=gcurvature_6)  # -> Keys, ValuesA; disabled
avr_19 = Average(Input=gcurvature_6)  # disabled
item_50 = ListItem(List=sort_17.ValuesA, Index=0, Wrap=True)  # -> Item1, Item; disabled
merge_17 = Merge(Data1=item_50.Item1, Data2=item_50.Item, Data3=avr_19)  # disabled
panel_20 = Panel(merge_17)  # disabled

merge_18 = Merge(Data1=item_45.Item1, Data2=item_45.Item, Data3=avr_11)  # disabled
panel_21 = Panel(merge_18)  # disabled
merge_19 = Merge(Data1=item_49.Item1, Data2=item_49.Item, Data3=avr_16)
avr_20 = Average(Input=dist_6)  # disabled
deccutmesh_16 = DeconstructCutMesh(TriangulatedMeshOrCutMesh=developcm3_5)  # -> Vertices, Faces, Edges; disabled
mbridgecm_15 = MbridgeCM(TriangulatedMeshOrCutMesh=developcm3_5)  # disabled
mbridgecm_16 = MbridgeCM(TriangulatedMeshOrCutMesh=developcm3_5)  # disabled
mbridgecm_17 = MbridgeCM(TriangulatedMeshOrCutMesh=developcm4)  # disabled
dividecutmesh_2 = DivideCutMesh(TriangulatedMeshOrCutMesh=meshcutbylines_8)
item_51 = ListItem(List=sort_16.Keys, Index=0, Wrap=True)  # -> Item1, Item; disabled
panel_22 = Panel(merge_19)
dist_7 = Distance(PointA=deccutmesh_8.Vertices, PointB=deccutmesh_16.Vertices)  # disabled
lng_7 = ListLength(List=dist_7)  # disabled
gcurvature_7 = GaussianCurvature(TriangulatedMesh=mbridgecm_16)  # disabled
gcurvature_8 = GaussianCurvature(TriangulatedMesh=mbridgecm_15)  # disabled
lng_8 = ListLength(List=gcurvature_8)  # disabled
gcurvature_9 = GaussianCurvature(TriangulatedMesh=mbridgecm_17)  # disabled
number_slider_21 = Slider(26, range=0..100)  # disabled

# ----
# Crane
cmesh_from_mesh_2 = CMeshFromMesh(Mesh=mesh_5)
developable_2 = Developable()
static_solver_2 = CraneStaticSolver(
    CMesh=cmesh_from_mesh_2,
    Constraints=developable_2,
    NRIteration=50,
    CGNRIteration=100,
    Threshold=1e-13,
    Solve=Toggle(True),
    IsRigidEdge=False,
    IsPanelFlat=True,
    IsFoldBlock=True,
    IsConstraint=True)  # -> CMesh, RigidOrigami, Residual
deconstruct_cmesh_2 = DeconstructCMesh(CMesh=static_solver_2.CMesh)  # -> Mesh, Mountain, Valley, Boundary, Unassigned, Triangulate, Edges, Inner
develop_mesh_4 = DevelopMesh(Mesh=deconstruct_cmesh_2.Mesh)  # -> DevelopMesh, FaceTree
gcurvature_10 = GaussianCurvature(TriangulatedMesh=deconstruct_cmesh_2.Mesh)
sort_18 = SortList(Keys=gcurvature_10, ValuesA=gcurvature_10)  # -> Keys, ValuesA
avr_21 = Average(Input=gcurvature_10)
item_52 = ListItem(List=sort_18.ValuesA, Index=0, Wrap=True)  # -> Item1, Item
merge_20 = Merge(Data1=item_52.Item1, Data2=item_52.Item, Data3=avr_21)
panel_23 = Panel(merge_20)

demesh = DeconstructMesh(Mesh=deconstruct_cmesh_2.Mesh)  # -> Vertices, Faces, Colours, Normals
demesh_2 = DeconstructMesh(Mesh=mesh_5)  # -> Vertices, Faces, Colours, Normals
dist_8 = Distance(PointA=demesh.Vertices, PointB=demesh_2.Vertices)
sort_19 = SortList(Keys=dist_8)  # -> Keys, ValuesA
avr_22 = Average(Input=dist_8)
item_53 = ListItem(List=sort_19.Keys, Index=0, Wrap=True)  # -> Item1, Item
merge_21 = Merge(Data1=item_53.Item, Data2=item_53.Item1, Data3=avr_22)
panel_24 = Panel(merge_21)

merge_22 = Merge(Data1=item_51.Item1, Data2=item_51.Item, Data3=avr_20)  # disabled
panel_25 = Panel(merge_22)  # disabled
series_13 = Series(Start=0, Step=1, Count=lng_8)  # disabled
series_14 = Series(Start=0, Step=1, Count=lng_7)  # disabled
number_slider_22 = Slider(30, range=0..100)  # disabled
meshnet4_7 = MeshNet4(TriangulatedMeshOrCutMesh=dividecutmesh_2)
demesh_3 = DeconstructMesh(Mesh=mbridgecm_15)  # -> Vertices, Faces, Colours, Normals; disabled
sort_20 = SortList(Keys=dist_7, ValuesA=series_14)  # -> flatten(Keys), ValuesA; disabled
avr_23 = Average(Input=gcurvature_8)  # -> flatten(ArithmeticMean); disabled
avr_24 = Average(Input=dist_7)  # -> flatten(ArithmeticMean); disabled
sort_21 = SortList(Keys=gcurvature_7, ValuesA=gcurvature_7)  # -> Keys, ValuesA; disabled
series_15 = Series(Start=0, Step=1, Count=number_slider_21)  # disabled
sort_22 = SortList(Keys=gcurvature_9, ValuesA=gcurvature_9)  # -> Keys, ValuesA; disabled
sort_23 = SortList(Keys=gcurvature_8, ValuesA=series_13)  # -> flatten(Keys), ValuesA; disabled

# ----
# 最適化前
# ガウス曲率が大きかったもの
cutmeshgcurvature_3 = CutMeshGCurvature(TriangulatedMeshOrCutMesh=sortcutmesh_7)
abs_7 = Absolute(Value=cutmeshgcurvature_3)
lng_9 = ListLength(List=cutmeshgcurvature_3)
series_16 = Series(Start=0, Step=1, Count=lng_9)
series_17 = Series(Start=0, Step=1, Count=Slider(30, range=0..100))
sort_24 = SortList(Keys=abs_7, ValuesA=series_16)  # -> Keys, ValuesA
x_plus_one_7 = XPlusOne(NumberX=series_17)
neg_7 = Negative(Value=x_plus_one_7)
item_54 = ListItem(List=sort_24.ValuesA, Index=neg_7, Wrap=True)
avr_25 = Average(Input=sort_24.Keys)
item_55 = ListItem(List=sort_24.Keys, Index=0, Wrap=True)  # -> Item1, Item
merge_23 = Merge(Data1=avr_25, Data2=item_55.Item1, Data3=item_55.Item)
panel_26 = Panel(merge_23)
item_56 = ListItem(List=deccutmesh_3.Vertices, Index=item_54, Wrap=True)

neg_8 = Negative(Value=series_15)  # disabled
avr_26 = Average(Input=gcurvature_7)  # disabled
item_57 = ListItem(List=sort_20.Keys, Index=0, Wrap=True)  # -> Item1, Item; disabled
avr_27 = Average(Input=gcurvature_9)  # disabled
mbridgecm_18 = MbridgeCM(TriangulatedMeshOrCutMesh=meshnet4_7)
series_18 = Series(Start=0, Step=1, Count=number_slider_22)  # disabled
item_58 = ListItem(List=sort_23.ValuesA, Index=neg_8, Wrap=True)  # disabled
item_59 = ListItem(List=sort_21.ValuesA, Index=0, Wrap=True)  # -> Item1, Item; disabled
item_60 = ListItem(List=sort_23.Keys, Index=0, Wrap=True)  # -> Item1, Item; disabled
X_4 = UnitX(Factor=Slider(400, range=0..100000))
msphere = MeshSphere(Base=PlaneXY(0, 0, 0), Radius=Slider(60, range=0..100), UCount=10, VCount=20)
item_61 = ListItem(List=sort_22.ValuesA, Index=0, Wrap=True)  # -> Item1, Item; disabled
neg_9 = Negative(Value=series_18)  # disabled
merge_24 = Merge(Data1=item_57.Item1, Data2=item_57.Item, Data3=avr_24)  # disabled
panel_27 = Panel(merge_24)  # disabled
item_62 = ListItem(List=mbridgecm_18, Index=0, Wrap=True)
item_63 = ListItem(List=demesh_3.Vertices, Index=item_58, Wrap=True)  # disabled
move_6 = Move(Geometry=mbridgecm_18, Motion=Vector(0, 0, 10))  # -> Geometry, Transform
move_7 = Move(Geometry=msphere, Motion=X_4)  # -> Geometry, Transform
merge_25 = Merge(Data1=item_59.Item1, Data2=item_59.Item, Data3=avr_26)  # disabled
panel_28 = Panel(merge_25)  # disabled
merge_26 = Merge(Data1=item_60.Item1, Data2=item_60.Item, Data3=avr_23)  # disabled
panel_29 = Panel(merge_26)  # disabled
merge_27 = Merge(Data1=item_61.Item1, Data2=item_61.Item, Data3=avr_27)  # disabled
panel_30 = Panel(merge_27)  # disabled
item_64 = ListItem(List=sort_20.ValuesA, Index=neg_9, Wrap=True)  # disabled
tri = Triangulate(Mesh=move_7.Geometry)  # -> Mesh, Count
item_65 = ListItem(List=deccutmesh_16.Vertices, Index=item_64, Wrap=True)  # disabled
mesh_7 = Mesh(mesh_5)
mbridgecm_19 = MbridgeCM(TriangulatedMeshOrCutMesh=deconstruct_cmesh_2.Mesh)
meshedges_16 = MeshEdges(Mesh=tri.Mesh)  # -> AllE, NakedE
gcurvature_11 = GaussianCurvature(TriangulatedMesh=mesh_7)
demesh_4 = DeconstructMesh(Mesh=mesh_7)  # -> Vertices, Faces, Colours, Normals
crv_19 = Curve(meshedges_16.AllE)
number_slider_23 = Slider(1.5, range=0..10)
division = Division(B=4)  # -> flatten(Result)
abs_8 = Absolute(Value=gcurvature_11)
number_slider_24 = Slider(0.6, range=0..1)
sort_25 = SortList(Keys=abs_8)  # -> Keys, ValuesA
item_66 = ListItem(List=sort_25.Keys, Index=0, Wrap=True)  # -> Item1, Item
avr_28 = Average(Input=abs_8)
gradient = Gradient(
    LowerLimit=item_66.Item,
    UpperLimit=Slider(0.12, range=0..1),
    Parameter=gcurvature_11,
    stops=[0: RGB(234, 38, 0), 0.25: RGB(234, 126, 0), 0.5: RGB(254, 244, 84), 0.75: RGB(173, 203, 249), 1: RGB(75, 107, 169)])
panel_31 = Panel(avr_28)
msphere_2 = MeshSphere(Base=PlaneXY(0, 0, 0), Radius=Slider(50, range=0..1000), UCount=10, VCount=20)
wbweave_8 = WeaverbirdsMeshFromLinesWeaveBack(MaximumValence=4)
tri_2 = Triangulate(Mesh=msphere_2)  # -> Mesh, Count
meshedges_17 = MeshEdges(Mesh=tri_2.Mesh)  # -> AllE, NakedE

# ----
# 中間用
mesh_8 = Mesh(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)
mesh_9 = Mesh(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)
mesh_10 = Mesh(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)

meshedges_18 = MeshEdges(Mesh=mesh_10)  # -> AllE, NakedE
crv_20 = Curve(meshedges_17.AllE)
mcol = MeshColours(Mesh=mesh_7, Colours=gradient)
crv_21 = Curve([<curve referenced from the Rhino model> x220])
swatch = ColourSwatch(SwatchColor=RGBA(0, 0, 0, 130))
gcurvature_12 = GaussianCurvature(TriangulatedMesh=mesh_10)
previewlw_2 = CustomPreviewLineweights(Geometry=meshedges_18.AllE, Shader=ColourSwatch(SwatchColor=RGBA(194, 194, 255, 0)), Absolute=False)
wbweave_9 = WeaverbirdsMeshFromLinesWeaveBack(Lines=crv_21, MaximumValence=4)
meshedges_19 = MeshEdges(Mesh=mesh_8)  # -> AllE, NakedE
mesh_11 = Mesh(wbweave_9)
lng_10 = ListLength(List=gcurvature_12)
preview_2 = CustomPreview(Geometry=wbweave_9, Material=ColourSwatch(SwatchColor=RGBA(52, 92, 65, 130)))
previewlw_3 = CustomPreviewLineweights(Geometry=crv_21, Shader=ColourSwatch(SwatchColor=RGBA(173, 173, 173, 130)), Absolute=False)
sort_26 = SortList(Keys=gcurvature_12, ValuesA=gcurvature_12)  # -> Keys, ValuesA
number_slider_25 = Slider(100000, range=0..100000)
meshedges_20 = MeshEdges(Mesh=wbweave_9)  # -> AllE, NakedE
avr_29 = Average(Input=gcurvature_12)
multiplication = Multiplication(A=lng_10, B=avr_29)
panel_32 = Panel(multiplication)
preview_3 = CustomPreview(
    Geometry=mesh_8,
    Material={diffuse=RGB(221, 160, 221), emission=RGB(66, 48, 66), shine=0.5, specular=RGB(255, 255, 255), transparency=0})
previewlw_4 = CustomPreviewLineweights(Geometry=meshedges_19.AllE, Shader=ColourSwatch(SwatchColor=RGB(0, 0, 0)), Absolute=False)
item_67 = ListItem(List=sort_26.ValuesA, Index=0, Wrap=True)  # -> Item1, Item
deccutmesh_17 = DeconstructCutMesh(TriangulatedMeshOrCutMesh=mbridgecm_19)  # -> Vertices, Faces, Edges
developcm2_7 = DevelopCutMesh2(
    TriangulatedCutMesh=wbweave_9,
    Iterations=Slider(400000, range=0..1000000),
    XyMirror=False,
    YzMirror=False,
    ZxMirror=False,
    OuterBoundaryCurves=meshedges_20.NakedE,
    Alpha=0.1)
sortcutmesh_13 = SortCutMesh(TriangulatedMeshOrCutMesh=developcm2_7)
mbridgecm_20 = MbridgeCM(TriangulatedMeshOrCutMesh=sortcutmesh_13)
mesh_12 = Mesh(mbridgecm_20)
merge_28 = Merge(Data1=item_67.Item1, Data2=item_67.Item, Data3=avr_29)
mbridgecm_21 = MbridgeCM(TriangulatedMeshOrCutMesh=developcm2_7)
sortcutmesh_14 = SortCutMesh(TriangulatedMeshOrCutMesh=wbweave_9)
deccutmesh_18 = DeconstructCutMesh(TriangulatedMeshOrCutMesh=sortcutmesh_14)  # -> Vertices, Faces, Edges
deccutmesh_19 = DeconstructCutMesh(TriangulatedMeshOrCutMesh=sortcutmesh_13)  # -> Vertices, Faces, Edges
demesh_5 = DeconstructMesh()  # -> Vertices, Faces, Colours, Normals
meshedges_21 = MeshEdges(Mesh=mbridgecm_21)  # -> AllE, NakedE
preview_4 = CustomPreview(Geometry=mbridgecm_21, Material=ColourSwatch(SwatchColor=RGBA(52, 92, 65, 130)))
previewlw_5 = CustomPreviewLineweights(Geometry=meshedges_21.AllE, Shader=ColourSwatch(SwatchColor=RGBA(0, 0, 0, 130)), Absolute=False)

# ----
# ガウス曲率が大きかったもの
cutmeshgcurvature_4 = CutMeshGCurvature(TriangulatedMeshOrCutMesh=developcm2_5)
deccutmesh_20 = DeconstructCutMesh(TriangulatedMeshOrCutMesh=developcm2_5)  # -> Vertices, Faces, Edges
lng_11 = ListLength(List=cutmeshgcurvature_4)
abs_9 = Absolute(Value=cutmeshgcurvature_4)
series_19 = Series(Start=0, Step=1, Count=lng_11)
series_20 = Series(Start=0, Step=1, Count=Slider(100, range=0..100))
sort_27 = SortList(Keys=abs_9, ValuesA=series_19)  # -> Keys, ValuesA
x_plus_one_8 = XPlusOne(NumberX=series_20)
neg_10 = Negative(Value=x_plus_one_8)
item_68 = ListItem(List=sort_27.ValuesA, Index=neg_10, Wrap=True)
avr_30 = Average(Input=sort_27.Keys)
item_69 = ListItem(List=sort_27.Keys, Index=0, Wrap=True)  # -> Item1, Item
item_70 = ListItem(List=deccutmesh_20.Vertices, Index=item_68, Wrap=True)

cull_i = CullIndex(List=sort_27.Keys, Indices=neg_10, Wrap=True)
avr_31 = Average(Input=cull_i)

merge_29 = Merge(Data1=avr_30, Data2=item_69.Item1, Data3=item_69.Item, Data4=avr_31)  # -> flatten(Result)
panel_33 = Panel(merge_29)

# ----
# ガウス曲率が大きかったもの
cutmeshgcurvature_5 = CutMeshGCurvature(TriangulatedMeshOrCutMesh=developcm3_4)
deccutmesh_21 = DeconstructCutMesh(TriangulatedMeshOrCutMesh=developcm3_4)  # -> Vertices, Faces, Edges
lng_12 = ListLength(List=cutmeshgcurvature_5)
abs_10 = Absolute(Value=cutmeshgcurvature_5)
series_21 = Series(Start=0, Step=1, Count=lng_12)
series_22 = Series(Start=0, Step=1, Count=Slider(100, range=0..100))
sort_28 = SortList(Keys=abs_10, ValuesA=series_21)  # -> Keys, ValuesA
x_plus_one_9 = XPlusOne(NumberX=series_22)
neg_11 = Negative(Value=x_plus_one_9)
item_71 = ListItem(List=sort_28.ValuesA, Index=neg_11, Wrap=True)
item_72 = ListItem(List=sort_28.Keys, Index=0, Wrap=True)  # -> Item1, Item
avr_32 = Average(Input=sort_28.Keys)
item_73 = ListItem(List=deccutmesh_21.Vertices, Index=item_71, Wrap=True)

cull_i_2 = CullIndex(List=sort_28.Keys, Indices=neg_11, Wrap=True)
avr_33 = Average(Input=cull_i_2)

merge_30 = Merge(Data1=avr_32, Data2=item_72.Item1, Data3=item_72.Item, Data4=avr_33)  # -> flatten(Result)
panel_34 = Panel(merge_30)

# ----
# Selfのみ
number_slider_26 = Slider(1000, range=0..10000)
number_slider_27 = Slider(100000, range=0..100000)
develop_3 = DevelopMesh(TriangulatedMesh=mesh_5, Count=number_slider_26)  # -> ModifiedMesh, A
sortcutmesh_15 = SortCutMesh(TriangulatedMeshOrCutMesh=develop_3.ModifiedMesh)
deccutmesh_22 = DeconstructCutMesh(TriangulatedMeshOrCutMesh=sortcutmesh_15)  # -> Vertices, Faces, Edges

meshedges_22 = MeshEdges(Mesh=develop_3.ModifiedMesh)  # -> AllE, NakedE
preview_5 = CustomPreview(Geometry=develop_3.ModifiedMesh, Material=ColourSwatch(SwatchColor=RGBA(52, 92, 65, 130)))
previewlw_6 = CustomPreviewLineweights(Geometry=meshedges_22.AllE, Shader=ColourSwatch(SwatchColor=RGBA(0, 0, 0, 130)), Absolute=False)
demesh_6 = DeconstructMesh(Mesh=develop_3.ModifiedMesh)  # -> Vertices, Faces, Colours, Normals
dist_9 = Distance(PointA=demesh_6.Vertices, PointB=demesh_4.Vertices)

# ----
# ハイブリッド
number_slider_28 = Slider(100000, range=0..100000)
developcm2_8 = DevelopCutMesh2(
    TriangulatedCutMesh=mesh_5,
    Iterations=number_slider_28,
    XyMirror=False,
    YzMirror=False,
    ZxMirror=False,
    OuterBoundaryCurves=meshedges_14.NakedE,
    Alpha=0.1)
cutmeshedges_16 = CutMeshEdges(TriangulatedMeshOrCutMesh=developcm2_8)  # -> MeshAllEdges, MeshNakedEdges
crv_22 = Curve(cutmeshedges_16.MeshNakedEdges)
developcm3_6 = DevelopCutMesh3(
    TriangulatedCutMesh=developcm2_8,
    Iterations=Slider(10000, range=0..10000),
    XyMirror=False,
    YzMirror=False,
    ZxMirror=False,
    OuterBoundaryCurves=crv_22,
    Alpha=1)

mbridgecm_22 = MbridgeCM(TriangulatedMeshOrCutMesh=developcm3_6)
meshedges_23 = MeshEdges(Mesh=mbridgecm_22)  # -> AllE, NakedE
previewlw_7 = CustomPreviewLineweights(Geometry=meshedges_23.AllE, Shader=ColourSwatch(SwatchColor=RGBA(0, 0, 0, 130)), Absolute=False)
preview_6 = CustomPreview(Geometry=mbridgecm_22, Material=ColourSwatch(SwatchColor=RGBA(52, 92, 65, 130)))
meshnet6_3 = MeshNet6(TriangulatedMeshOrCutMesh=developcm3_6)
cutmeshedges_17 = CutMeshEdges(TriangulatedMeshOrCutMesh=meshnet6_3)  # -> MeshAllEdges, MeshNakedEdges
cutmeshedges_18 = CutMeshEdges(TriangulatedMeshOrCutMesh=developcm3_6)  # -> MeshAllEdges, MeshNakedEdges
len_11 = Length(Curve=cutmeshedges_18.MeshAllEdges)
len_12 = Length(Curve=cutmeshedges_17.MeshAllEdges)
subtraction_5 = Subtraction(A=len_12, B=len_11)
abs_11 = Absolute(Value=subtraction_5)
sort_29 = SortList(Keys=abs_11)  # -> Keys, ValuesA
avr_34 = Average(Input=abs_11)
item_74 = ListItem(List=sort_29.Keys, Index=0, Wrap=True)  # -> Item1, Item
merge_31 = Merge(Data1=item_74.Item1, Data2=item_74.Item, Data3=avr_34)  # -> flatten(Result)
panel_35 = Panel(merge_31)

# ----
# Selfのみ
number_slider_29 = Slider(2000, range=0..10000)
developcm3_7 = DevelopCutMesh3(
    TriangulatedCutMesh=mesh_5,
    Iterations=number_slider_29,
    XyMirror=False,
    YzMirror=False,
    ZxMirror=False,
    OuterBoundaryCurves=meshedges_14.NakedE,
    Alpha=1)  # disabled
deccutmesh_23 = DeconstructCutMesh(TriangulatedMeshOrCutMesh=developcm3_7)  # -> Vertices, Faces, Edges

meshnet6_4 = MeshNet6(TriangulatedMeshOrCutMesh=developcm3_7)
meshnet4_8 = MeshNet4(TriangulatedMeshOrCutMesh=developcm3_7)
cutmeshedges_19 = CutMeshEdges(TriangulatedMeshOrCutMesh=developcm3_7)  # -> MeshAllEdges, MeshNakedEdges
cutmeshedges_20 = CutMeshEdges(TriangulatedMeshOrCutMesh=meshnet6_4)  # -> MeshAllEdges, MeshNakedEdges
cutmeshedges_21 = CutMeshEdges(TriangulatedMeshOrCutMesh=meshnet4_8)  # -> MeshAllEdges, MeshNakedEdges
len_13 = Length(Curve=cutmeshedges_19.MeshAllEdges)
len_14 = Length(Curve=cutmeshedges_21.MeshAllEdges)
len_15 = Length(Curve=cutmeshedges_19.MeshAllEdges)
len_16 = Length(Curve=cutmeshedges_20.MeshAllEdges)
subtraction_6 = Subtraction(A=len_14, B=len_13)
subtraction_7 = Subtraction(A=len_16, B=len_15)
abs_12 = Absolute(Value=subtraction_6)
abs_13 = Absolute(Value=subtraction_7)
sort_30 = SortList(Keys=abs_12)  # -> Keys, ValuesA
avr_35 = Average(Input=abs_12)
sort_31 = SortList(Keys=abs_13)  # -> Keys, ValuesA
avr_36 = Average(Input=abs_13)
item_75 = ListItem(List=sort_30.Keys, Index=0, Wrap=True)  # -> Item1, Item
item_76 = ListItem(List=sort_31.Keys, Index=0, Wrap=True)  # -> Item1, Item
merge_32 = Merge(Data1=item_75.Item1, Data2=item_75.Item, Data3=avr_35)  # -> flatten(Result)
panel_36 = Panel(merge_32)
merge_33 = Merge(Data1=item_76.Item1, Data2=item_76.Item, Data3=avr_36)  # -> flatten(Result)
panel_37 = Panel(merge_33)

# ----
# ガウス曲率が大きかったもの
cutmeshgcurvature_6 = CutMeshGCurvature(TriangulatedMeshOrCutMesh=developcm2_8)
abs_14 = Absolute(Value=cutmeshgcurvature_6)
lng_13 = ListLength(List=cutmeshgcurvature_6)
series_23 = Series(Start=0, Step=1, Count=lng_13)
series_24 = Series(Start=0, Step=1, Count=Slider(30, range=0..100))
sort_32 = SortList(Keys=abs_14, ValuesA=series_23)  # -> Keys, ValuesA

# ----
# ガウス曲率が大きかったもの
cutmeshgcurvature_7 = CutMeshGCurvature(TriangulatedMeshOrCutMesh=sortcutmesh_15)
lng_14 = ListLength(List=cutmeshgcurvature_7)
abs_15 = Absolute(Value=cutmeshgcurvature_7)
series_25 = Series(Start=0, Step=1, Count=lng_14)
series_26 = Series(Start=0, Step=1, Count=Slider(59, range=0..100))
sort_33 = SortList(Keys=abs_15, ValuesA=series_25)  # -> Keys, ValuesA

# ----
# ガウス曲率が大きかったもの
cutmeshgcurvature_8 = CutMeshGCurvature(TriangulatedMeshOrCutMesh=developcm3_7)
abs_16 = Absolute(Value=cutmeshgcurvature_8)
lng_15 = ListLength(List=cutmeshgcurvature_8)
series_27 = Series(Start=0, Step=1, Count=lng_15)
series_28 = Series(Start=0, Step=1, Count=Slider(30, range=0..100))
sort_34 = SortList(Keys=abs_16, ValuesA=series_27)  # -> Keys, ValuesA

# ----
# 移動距離が大きかったもの
number_slider_30 = Slider(30, range=0..100)
deccutmesh_24 = DeconstructCutMesh(TriangulatedMeshOrCutMesh=sortcutmesh_15)  # -> Vertices, Faces, Edges
dist_10 = Distance(PointA=deccutmesh_3.Vertices, PointB=deccutmesh_24.Vertices)
lng_16 = ListLength(List=dist_10)
series_29 = Series(Start=0, Step=1, Count=lng_16)
series_30 = Series(Start=0, Step=1, Count=number_slider_30)
avr_37 = Average(Input=dist_10)
sort_35 = SortList(Keys=dist_10, ValuesA=series_29)  # -> Keys, ValuesA
item_77 = ListItem(List=sort_35.Keys, Index=0, Wrap=True)  # -> Item1, Item
merge_34 = Merge(Data1=item_77.Item1, Data2=item_77.Item, Data3=avr_37)  # -> flatten(Result)
panel_38 = Panel(merge_34)

x_plus_one_10 = XPlusOne(NumberX=series_30)
x_plus_one_11 = XPlusOne(NumberX=series_26)
avr_38 = Average(Input=sort_33.Keys)
item_78 = ListItem(List=sort_33.Keys, Index=0, Wrap=True)  # -> Item1, Item
merge_35 = Merge(Data1=avr_38, Data2=item_78.Item1, Data3=item_78.Item)

neg_12 = Negative(Value=x_plus_one_10)
item_79 = ListItem(List=sort_35.ValuesA, Index=neg_12, Wrap=True)
item_80 = ListItem(List=deccutmesh_3.Vertices, Index=item_79, Wrap=True)

neg_13 = Negative(Value=x_plus_one_11)
item_81 = ListItem(List=sort_33.ValuesA, Index=neg_13, Wrap=True)
panel_39 = Panel(merge_35)
item_82 = ListItem(List=deccutmesh_22.Vertices, Index=item_81, Wrap=True)

# ----
# 移動距離が大きかったもの
number_slider_31 = Slider(30, range=0..100)
deccutmesh_25 = DeconstructCutMesh(TriangulatedMeshOrCutMesh=developcm3_7)  # -> Vertices, Faces, Edges
dist_11 = Distance(PointA=deccutmesh_3.Vertices, PointB=deccutmesh_25.Vertices)
lng_17 = ListLength(List=dist_11)
series_31 = Series(Start=0, Step=1, Count=lng_17)
series_32 = Series(Start=0, Step=1, Count=number_slider_31)
avr_39 = Average(Input=dist_11)
sort_36 = SortList(Keys=dist_11, ValuesA=series_31)  # -> Keys, ValuesA
item_83 = ListItem(List=sort_36.Keys, Index=0, Wrap=True)  # -> Item1, Item
merge_36 = Merge(Data1=item_83.Item1, Data2=item_83.Item, Data3=avr_39)  # -> flatten(Result)
panel_40 = Panel(merge_36)

x_plus_one_12 = XPlusOne(NumberX=series_32)
x_plus_one_13 = XPlusOne(NumberX=series_28)
avr_40 = Average(Input=sort_34.Keys)
item_84 = ListItem(List=sort_34.Keys, Index=0, Wrap=True)  # -> Item1, Item
merge_37 = Merge(Data1=avr_40, Data2=item_84.Item1, Data3=item_84.Item)

neg_14 = Negative(Value=x_plus_one_12)
item_85 = ListItem(List=sort_36.ValuesA, Index=neg_14, Wrap=True)
item_86 = ListItem(List=deccutmesh_3.Vertices, Index=item_85, Wrap=True)

neg_15 = Negative(Value=x_plus_one_13)
item_87 = ListItem(List=sort_34.ValuesA, Index=neg_15, Wrap=True)
item_88 = ListItem(List=deccutmesh_23.Vertices, Index=item_87, Wrap=True)
panel_41 = Panel(merge_37)

# ----
# ガウス曲率が大きかったもの
cutmeshgcurvature_9 = CutMeshGCurvature(TriangulatedMeshOrCutMesh=developcm3_6)
abs_17 = Absolute(Value=cutmeshgcurvature_9)
lng_18 = ListLength(List=cutmeshgcurvature_9)
series_33 = Series(Start=0, Step=1, Count=lng_18)
series_34 = Series(Start=0, Step=1, Count=Slider(30, range=0..100))
sort_37 = SortList(Keys=abs_17, ValuesA=series_33)  # -> Keys, ValuesA

# ----
# 移動距離が大きかったもの
number_slider_32 = Slider(30, range=0..100)
deccutmesh_26 = DeconstructCutMesh(TriangulatedMeshOrCutMesh=developcm3_6)  # -> Vertices, Faces, Edges
dist_12 = Distance(PointA=deccutmesh_3.Vertices, PointB=deccutmesh_26.Vertices)
lng_19 = ListLength(List=dist_12)
series_35 = Series(Start=0, Step=1, Count=lng_19)
series_36 = Series(Start=0, Step=1, Count=number_slider_32)
avr_41 = Average(Input=dist_12)
sort_38 = SortList(Keys=dist_12, ValuesA=series_35)  # -> Keys, ValuesA
item_89 = ListItem(List=sort_38.Keys, Index=0, Wrap=True)  # -> Item1, Item
merge_38 = Merge(Data1=item_89.Item1, Data2=item_89.Item, Data3=avr_41)  # -> flatten(Result)
panel_42 = Panel(merge_38)

x_plus_one_14 = XPlusOne(NumberX=series_24)
x_plus_one_15 = XPlusOne(NumberX=series_36)
avr_42 = Average(Input=sort_32.Keys)
item_90 = ListItem(List=sort_32.Keys, Index=0, Wrap=True)  # -> Item1, Item
x_plus_one_16 = XPlusOne(NumberX=series_34)
merge_39 = Merge(Data1=avr_42, Data2=item_90.Item1, Data3=item_90.Item)
avr_43 = Average(Input=sort_37.Keys)
item_91 = ListItem(List=sort_37.Keys, Index=0, Wrap=True)  # -> Item1, Item
merge_40 = Merge(Data1=avr_43, Data2=item_91.Item1, Data3=item_91.Item)

neg_16 = Negative(Value=x_plus_one_14)
item_92 = ListItem(List=sort_32.ValuesA, Index=neg_16, Wrap=True)
panel_43 = Panel(merge_39)
item_93 = ListItem(List=deccutmesh_3.Vertices, Index=item_92, Wrap=True)

neg_17 = Negative(Value=x_plus_one_15)
item_94 = ListItem(List=sort_38.ValuesA, Index=neg_17, Wrap=True)
item_95 = ListItem(List=deccutmesh_3.Vertices, Index=item_94, Wrap=True)

neg_18 = Negative(Value=x_plus_one_16)
item_96 = ListItem(List=sort_37.ValuesA, Index=neg_18, Wrap=True)
item_97 = ListItem(List=deccutmesh_3.Vertices, Index=item_96, Wrap=True)
panel_44 = Panel(merge_40)

# ----
# ガウス曲率が大きかったもの
cutmeshgcurvature_10 = CutMeshGCurvature(TriangulatedMeshOrCutMesh=mbridgecm_19)
lng_20 = ListLength(List=cutmeshgcurvature_10)
abs_18 = Absolute(Value=cutmeshgcurvature_10)
series_37 = Series(Start=0, Step=1, Count=lng_20)
series_38 = Series(Start=0, Step=1, Count=Slider(59, range=0..100))
sort_39 = SortList(Keys=abs_18, ValuesA=series_37)  # -> Keys, ValuesA

x_plus_one_17 = XPlusOne(NumberX=series_38)
avr_44 = Average(Input=sort_39.Keys)
item_98 = ListItem(List=sort_39.Keys, Index=0, Wrap=True)  # -> Item1, Item
merge_41 = Merge(Data1=avr_44, Data2=item_98.Item1, Data3=item_98.Item)

neg_19 = Negative(Value=x_plus_one_17)
item_99 = ListItem(List=sort_39.ValuesA, Index=neg_19, Wrap=True)
panel_45 = Panel(merge_41)
item_100 = ListItem(List=deccutmesh_17.Vertices, Index=item_99, Wrap=True)

# ----
# Selfのみ
number_slider_33 = Slider(10000, range=0..10000)
develop_4 = DevelopMesh(TriangulatedMesh=wbweave_9, Count=Slider(100000, range=0..100000))  # -> ModifiedMesh, A
sortcutmesh_16 = SortCutMesh(TriangulatedMeshOrCutMesh=develop_4.ModifiedMesh)
deccutmesh_27 = DeconstructCutMesh(TriangulatedMeshOrCutMesh=sortcutmesh_16)  # -> Vertices, Faces, Edges

mesh_13 = Mesh(develop_4.ModifiedMesh)
meshedges_24 = MeshEdges(Mesh=develop_4.ModifiedMesh)  # -> AllE, NakedE
preview_7 = CustomPreview(Geometry=develop_4.ModifiedMesh, Material=ColourSwatch(SwatchColor=RGBA(52, 92, 65, 130)))
previewlw_8 = CustomPreviewLineweights(Geometry=meshedges_24.AllE, Shader=ColourSwatch(SwatchColor=RGBA(0, 0, 0, 130)), Absolute=False)

# ----
# ガウス曲率が大きかったもの
cutmeshgcurvature_11 = CutMeshGCurvature(TriangulatedMeshOrCutMesh=developcm2_7)
abs_19 = Absolute(Value=cutmeshgcurvature_11)
lng_21 = ListLength(List=cutmeshgcurvature_11)
series_39 = Series(Start=0, Step=1, Count=lng_21)
series_40 = Series(Start=0, Step=1, Count=Slider(30, range=0..100))
sort_40 = SortList(Keys=abs_19, ValuesA=series_39)  # -> Keys, ValuesA

x_plus_one_18 = XPlusOne(NumberX=series_40)
avr_45 = Average(Input=sort_40.Keys)
item_101 = ListItem(List=sort_40.Keys, Index=0, Wrap=True)  # -> Item1, Item
merge_42 = Merge(Data1=avr_45, Data2=item_101.Item1, Data3=item_101.Item)

neg_20 = Negative(Value=x_plus_one_18)
item_102 = ListItem(List=sort_40.ValuesA, Index=neg_20, Wrap=True)
panel_46 = Panel(merge_42)
item_103 = ListItem(List=deccutmesh_3.Vertices, Index=item_102, Wrap=True)

# ----
# ガウス曲率が大きかったもの
cutmeshgcurvature_12 = CutMeshGCurvature(TriangulatedMeshOrCutMesh=sortcutmesh_16)
lng_22 = ListLength(List=cutmeshgcurvature_12)
abs_20 = Absolute(Value=cutmeshgcurvature_12)
series_41 = Series(Start=0, Step=1, Count=lng_22)
series_42 = Series(Start=0, Step=1, Count=Slider(59, range=0..100))
sort_41 = SortList(Keys=abs_20, ValuesA=series_41)  # -> Keys, ValuesA

# ----
# 移動距離が大きかったもの
deccutmesh_28 = DeconstructCutMesh(TriangulatedMeshOrCutMesh=sortcutmesh_16)  # -> Vertices, Faces, Edges
dist_13 = Distance(PointA=deccutmesh_18.Vertices, PointB=deccutmesh_19.Vertices)
lng_23 = ListLength(List=dist_13)
series_43 = Series(Start=0, Step=1, Count=lng_23)
series_44 = Series(Start=0, Step=1, Count=Slider(30, range=0..100))
avr_46 = Average(Input=dist_13)
sort_42 = SortList(Keys=dist_13, ValuesA=series_43)  # -> Keys, ValuesA
item_104 = ListItem(List=sort_42.Keys, Index=0, Wrap=True)  # -> Item1, Item
merge_43 = Merge(Data1=item_104.Item1, Data2=item_104.Item, Data3=avr_46)  # -> flatten(Result)
panel_47 = Panel(merge_43)

x_plus_one_19 = XPlusOne(NumberX=series_44)
x_plus_one_20 = XPlusOne(NumberX=series_42)
avr_47 = Average(Input=sort_41.Keys)
item_105 = ListItem(List=sort_41.Keys, Index=0, Wrap=True)  # -> Item1, Item
merge_44 = Merge(Data1=avr_47, Data2=item_105.Item1, Data3=item_105.Item)

neg_21 = Negative(Value=x_plus_one_19)
item_106 = ListItem(List=sort_42.ValuesA, Index=neg_21, Wrap=True)
item_107 = ListItem(List=deccutmesh_3.Vertices, Index=item_106, Wrap=True)

neg_22 = Negative(Value=x_plus_one_20)
item_108 = ListItem(List=sort_41.ValuesA, Index=neg_22, Wrap=True)
item_109 = ListItem(List=deccutmesh_27.Vertices, Index=item_108, Wrap=True)
panel_48 = Panel(merge_44)
