# Grasshopper definition curvatureTest.gh (Grasshopper 1.0.8)
# plug-ins: Human, Hagoromo, NGon_RH8

crv = Curve([<curve referenced from the Rhino model> x2])  # disabled
mesh = Mesh(<mesh referenced from the Rhino model>)
mbridgecm = MbridgeCM(TriangulatedMeshOrCutMesh=mesh)
curvaturegroup = CurvatureGroup(TriangulatedMeshOrCutMesh=mbridgecm, I=Slider(1, range=0..10))  # -> Points, TriangulatedCutMesh
pt = Point(curvaturegroup.Points)
meshcutbylines = MeshCutWithCutLines(TriangulatedMeshOrCutMesh=mbridgecm, OpenCutLinesPolylines=crv)  # disabled
meshedges = MeshEdges(Mesh=mesh)  # -> AllE, NakedE
cutmeshgcurvature = CutMeshGCurvature(TriangulatedMeshOrCutMesh=mbridgecm)  # -> GC, GCMap
sort = SortList(Keys=cutmeshgcurvature.GCMap)  # -> Keys, ValuesA
sortcutmesh = SortCutMesh(TriangulatedMeshOrCutMesh=meshcutbylines)
number_slider = Slider(0.02, range=0..0.1)
cutmeshedges = CutMeshEdges(TriangulatedMeshOrCutMesh=sortcutmesh)  # -> MeshAllEdges, MeshNakedEdges
abs = Absolute(Value=cutmeshgcurvature.GCMap)
deccutmesh = DeconstructCutMesh(TriangulatedMeshOrCutMesh=mbridgecm)  # -> Vertices, Faces, Edges
item = ListItem(List=sort.Keys, Index=0, Wrap=True)  # -> Item1, Item
avr = Average(Input=abs)
curvaturegroup_2 = CurvatureGroup(TriangulatedMeshOrCutMesh=mbridgecm, I=Slider(3, range=0..10))  # -> Points, TriangulatedCutMesh
crv_2 = Curve(cutmeshedges.MeshNakedEdges)
number_slider_2 = Slider(0, range=0..100)
previewlw = CustomPreviewLineweights(
    Geometry=cutmeshedges.MeshNakedEdges,
    Shader={diffuse=RGB(255, 105, 180), emission=RGB(76, 32, 54), shine=0.5, specular=RGB(255, 255, 255), transparency=0},
    Thickness=Slider(6, range=0..10),
    Absolute=False)
gradient = Gradient(
    LowerLimit=item.Item,
    UpperLimit=item.Item1,
    Parameter=cutmeshgcurvature.GCMap,
    stops=[0: RGB(234, 38, 0), 0.25: RGB(234, 126, 0), 0.5: RGB(254, 244, 84), 0.75: RGB(173, 203, 249), 1: RGB(75, 107, 169)])
dupln = RemoveDuplicateLines(Lines=crv_2, Tolerance=0.01)
join = JoinCurves(Curves=meshedges.NakedE, Preserve=False)
number_slider_3 = Slider(100, range=0..100)
_10º = PowerOf10(Value=Slider(3, range=0..10))
_10º_2 = PowerOf10(Value=Slider(2, range=0..10))
_10º_3 = PowerOf10(Value=Slider(2, range=0..10))
deccutmesh_2 = DeconstructCutMesh(TriangulatedMeshOrCutMesh=sortcutmesh)  # -> Vertices, Faces, Edges
categorycheck = CategoryCheck(TriangulatedCutMesh=sortcutmesh, XyMirror=False, YzMirror=False, ZxMirror=False, OuterBoundaryCurves=dupln)
developcgls = DevelopCGLS(
    TriangulatedCutMesh=meshcutbylines,
    InnerIter=100,
    OuterIter=Slider(500, range=0..1000),
    XyMirror=False,
    YzMirror=False,
    ZxMirror=False,
    OuterBoundaryCurves=dupln,
    EdgeW=1,
    SmoothW=_10º_3,
    DevW=_10º,
    PositionW="0",
    LenRangeW=1,
    SmoothingPolylines=join)  # disabled
bang = ExplodeTree(Data=categorycheck)  # -> Branch0, Branch1
mcol = MeshColours(Mesh=mesh, Colours=gradient)
checkobjective = CheckObjective(TriangulatedCutMesh=developcgls, XyMirror=False, YzMirror=False, ZxMirror=False, OuterBoundaryCurves=dupln)
mbridgecm_2 = MbridgeCM(TriangulatedMeshOrCutMesh=developcgls)
item_2 = ListItem(List=deccutmesh_2.Vertices, Index=bang.Branch0, Wrap=True)
sortcutmesh_2 = SortCutMesh(TriangulatedMeshOrCutMesh=developcgls)
cutmeshgcurvature_2 = CutMeshGCurvature(TriangulatedMeshOrCutMesh=sortcutmesh_2)  # -> GC, GCMap
_10º_4 = PowerOf10(Value=Slider(4, range=0..10))
abs_2 = Absolute(Value=cutmeshgcurvature_2.GC)
avr_2 = Average(Input=abs_2)
netlbfgs2 = NetLBFGS2(TriangulatedMeshOrCutMesh=sortcutmesh_2, W0=_10º_4, W1=1)  # -> CutMesh, FeatureLinesPolylines
panel = Panel(cutmeshgcurvature_2.GC)
cutmeshedges_2 = CutMeshEdges(TriangulatedMeshOrCutMesh=sortcutmesh_2)  # -> MeshAllEdges, MeshNakedEdges
cutmeshedges_3 = CutMeshEdges(TriangulatedMeshOrCutMesh=netlbfgs2.CutMesh)  # -> MeshAllEdges, MeshNakedEdges
len = Length(Curve=cutmeshedges_2.MeshAllEdges)
len_2 = Length(Curve=cutmeshedges_3.MeshAllEdges)
subtraction = Subtraction(A=len, B=len_2)
abs_3 = Absolute(Value=subtraction)
avr_3 = Average(Input=abs_3)
