# Grasshopper definition heuristic.gh (Grasshopper 1.0.8)
# plug-ins: Hagoromo, NGon_RH8

mesh = Mesh(<mesh referenced from the Rhino model>)
ウサギ切込み線2 = Curve([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])
ウサギ切込み線 = Curve([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])
msmooth = SmoothMesh(Mesh=mesh, Strength=0.5, SkipNaked=True, Iterations=1)
crv = Curve([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])
_200 = Curve([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])
crv_2 = Curve([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])
crv_3 = Curve([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])
crv_4 = Curve([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])
crv_5 = Curve([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])
crv_6 = Curve([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])
crv_7 = Curve([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])
crv_8 = Curve([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])
crv_9 = Curve([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])
ウサギ3 = Curve([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])
mbridgecm = MbridgeCM(TriangulatedMeshOrCutMesh=msmooth)
crv_10 = Curve([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])
crv_11 = Curve([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])
number_slider = Slider(99, range=60..100)
cutmeshgcurvature = CutMeshGCurvature(TriangulatedMeshOrCutMesh=mbridgecm)  # -> GC, GCMap
number_slider_2 = Slider(1, range=0..10)
mbridgecm_2 = MbridgeCM(TriangulatedMeshOrCutMesh=mesh)
sort = SortList(Keys=cutmeshgcurvature.GCMap)  # -> Keys, ValuesA
sortcutmesh = SortCutMesh(TriangulatedMeshOrCutMesh=mbridgecm)
meshcutbylines = MeshCutWithCutLines(TriangulatedMeshOrCutMesh=sortcutmesh, OpenCutLinesPolylines=crv_3)
number_slider_3 = Slider(30, range=0..30)
item = ListItem(List=sort.Keys, Index=0, Wrap=True)  # -> Item1, Item
number_slider_4 = Slider(30, range=0..100)
dividecutmesh = DivideCutMesh(TriangulatedMeshOrCutMesh=meshcutbylines)
curvaturegroup = CurvatureGroup(TriangulatedMeshOrCutMesh=mbridgecm_2, I=Slider(14, range=0..27))  # -> Points, TriangulatedCutMesh, Count
cleancut = CleanCut(TriangulatedMeshOrCutMesh=meshcutbylines, FaceCount=Slider(10, range=0..10))
cutmeshedges = CutMeshEdges(TriangulatedMeshOrCutMesh=cleancut)  # -> MeshAllEdges, MeshNakedEdges
gradient = Gradient(
    LowerLimit=item.Item,
    UpperLimit=item.Item1,
    Parameter=cutmeshgcurvature.GCMap,
    stops=[0: RGB(234, 38, 0), 0.25: RGB(234, 126, 0), 0.5: RGB(254, 244, 84), 0.75: RGB(173, 203, 249), 1: RGB(75, 107, 169)])
mcol = MeshColours(Mesh=msmooth, Colours=gradient)
crv_12 = Curve(cutmeshedges.MeshNakedEdges)
item_2 = ListItem(List=dividecutmesh, Index=Slider(1, range=0..11), Wrap=True)
outerboundary = OuterBoundary(TriangulatedMeshOrCutMesh=item_2)  # -> OuterEdges, OuterVertsIndices
number_slider_5 = Slider(2, range=0..4)
number_slider_6 = Slider(0, range=0..100)
number_slider_7 = Slider(2, range=0..9)
meshedges = MeshEdges(Mesh=msmooth)  # -> AllE, NakedE
number_slider_8 = Slider(15, range=0..100)
pt = Point(curvaturegroup.Points)
number_slider_9 = Slider(100, range=0..100)
number_slider_10 = Slider(100, range=0..100)
crv_13 = Curve([<curve referenced from the Rhino model> x2])
crv_14 = Curve(<curve referenced from the Rhino model>)
meshcutbylines_2 = MeshCutWithCutLines(TriangulatedMeshOrCutMesh=sortcutmesh, OpenCutLinesPolylines=crv_13)  # disabled
series = Series(Start=0, Step=1, Count=Slider(245, range=0..1000))  # disabled
meshcutbylines_3 = MeshCutWithCutLines(TriangulatedMeshOrCutMesh=sortcutmesh, OpenCutLinesPolylines=crv_14)  # disabled
sortcutmesh_2 = SortCutMesh(TriangulatedMeshOrCutMesh=meshcutbylines_2)
checkdevobj = CheckDevObj(TriangulatedMeshOrCutMesh=sortcutmesh)  # -> TriangulatedMeshOrCutMesh, Obj
number_slider_11 = Slider(5, range=0..10)
dividecutmesh_2 = DivideCutMesh(TriangulatedMeshOrCutMesh=sortcutmesh_2)
sortcutmesh_3 = SortCutMesh(TriangulatedMeshOrCutMesh=meshcutbylines_3)
cutopt = ClusterCutNSGAII(TriangulatedMeshOrCutMesh=sortcutmesh, PopSize=Slider(200, range=0..1000), Generations=Slider(200, range=0..1000))  # -> CutMeshes, TotalLength, DevObj, Seams; disabled
sort_2 = SortList(Keys=cutopt.Seams, ValuesA=cutopt.CutMeshes)  # -> Keys, ValuesA
item_3 = ListItem(List=sort_2.ValuesA, Index=Slider(41, range=30..60), Wrap=True)
sortcutmesh_4 = SortCutMesh(TriangulatedMeshOrCutMesh=item_3)  # disabled
cutmeshedges_2 = CutMeshEdges(TriangulatedMeshOrCutMesh=item_3)  # -> MeshAllEdges, MeshNakedEdges
dividecutmesh_3 = DivideCutMesh(TriangulatedMeshOrCutMesh=item_3)  # disabled
lng = ListLength(List=dividecutmesh_3)
panel = Panel(lng)
item_4 = ListItem(List=dividecutmesh_3, Index=0, Wrap=True)  # -> Item, Item1
mbridgecm_3 = MbridgeCM(TriangulatedMeshOrCutMesh=item_4.Item1)
weld = WeldMesh(Mesh=mbridgecm_3, Angle=3.141592654)
crv_15 = Curve(cutmeshedges_2.MeshNakedEdges)
deccutmesh = DeconstructCutMesh(TriangulatedMeshOrCutMesh=sortcutmesh_4)  # -> Vertices, Faces, Edges, Dups; disabled
item_5 = ListItem(List=deccutmesh.Vertices, Index=series, Wrap=True)
meshedges_2 = MeshEdges(Mesh=weld)  # -> AllE, NakedE
dividecutmesh_4 = DivideCutMesh(TriangulatedMeshOrCutMesh=sortcutmesh_3)
number_slider_12 = Slider(100, range=0..100)
crv_16 = Curve(meshedges_2.NakedE)
item_6 = ListItem(List=dividecutmesh_2, Index=Slider(0, range=0..1), Wrap=True)
deccutmesh_2 = DeconstructCutMesh(TriangulatedMeshOrCutMesh=item_6)  # -> Vertices, Faces, Edges, Dups
sortcutmesh_5 = SortCutMesh(TriangulatedMeshOrCutMesh=dividecutmesh_3)
panel_2 = Panel(cutopt.Seams)
_10º = PowerOf10(Value=Slider(4, range=0..10))
_10º_2 = PowerOf10(Value=Slider(3, range=0..10))
_10º_3 = PowerOf10(Value=Slider(3, range=0..10))
_10º_4 = PowerOf10(Value=Slider(5, range=0..10))
_10º_5 = PowerOf10(Value=Slider(3, range=0..10))
_10º_6 = PowerOf10(Value=Slider(3, range=0..10))
panel_3 = Panel(cutopt.TotalLength)
checkobjective = CheckObjective(
    TriangulatedCutMesh=dividecutmesh_4,
    XyMirror=False,
    YzMirror=False,
    ZxMirror=False,
    OuterBoundaryCurves=meshedges.NakedE)
_10º_7 = PowerOf10(Value=Slider(4, range=0..10))
_10º_8 = PowerOf10(Value=Slider(3, range=0..10))
cutmeshedges_3 = CutMeshEdges(TriangulatedMeshOrCutMesh=item_6)  # -> MeshAllEdges, MeshNakedEdges
_10º_9 = PowerOf10(Value=Slider(3, range=0..10))
panel_4 = Panel(cutopt.DevObj)
sort_3 = SortList(Keys=flatten(deccutmesh_2.Dups))  # -> Keys, ValuesA
categorycheck = CategoryCheck(
    TriangulatedCutMesh=dividecutmesh_4,
    XyMirror=False,
    YzMirror=False,
    ZxMirror=False,
    OuterBoundaryCurves=meshedges.NakedE)
developcgls = DevelopCGLS(
    TriangulatedCutMesh=item_4.Item1,
    InnerIter=100,
    OuterIter=number_slider_12,
    XyMirror=False,
    YzMirror=False,
    ZxMirror=False,
    OuterBoundaryCurves=crv_16,
    FixPointsCrv=crv_16,
    EdgeW=1,
    SmoothW=_10º,
    DevW=_10º_2,
    PositionW=_10º_3,
    LenRangeW=1)  # disabled
developcgls_2 = DevelopCGLS(
    TriangulatedCutMesh=item_4.Item,
    InnerIter=100,
    OuterIter=number_slider_12,
    XyMirror=False,
    YzMirror=False,
    ZxMirror=False,
    OuterBoundaryCurves=crv_16,
    FixPointsCrv=crv_16,
    EdgeW=1,
    SmoothW=_10º_4,
    DevW=_10º_5,
    PositionW=1,
    LenRangeW=1)  # disabled
deccutmesh_3 = DeconstructCutMesh(TriangulatedMeshOrCutMesh=dividecutmesh_4)  # -> Vertices, Faces, Edges, Dups
panel_5 = Panel(deccutmesh_2.Dups)
checkobjective_2 = CheckObjective(
    TriangulatedCutMesh=item_6,
    XyMirror=False,
    YzMirror=False,
    ZxMirror=False,
    OuterBoundaryCurves=cutmeshedges_3.MeshNakedEdges)
number_slider_13 = Slider(0, range=0..1000)
deccutmesh_4 = DeconstructCutMesh(TriangulatedMeshOrCutMesh=sortcutmesh_3)  # -> Vertices, Faces, Edges, Dups
bang = ExplodeTree(Data=categorycheck)  # -> Branch0, Branch1, Branch2, Branch3, Branch4
developcgls_3 = DevelopCGLS(
    TriangulatedCutMesh=item_2,
    InnerIter=100,
    OuterIter=Slider(100, range=0..100),
    XyMirror=False,
    YzMirror=False,
    ZxMirror=False,
    OuterBoundaryCurves=outerboundary.OuterEdges,
    EdgeW=1,
    SmoothW=_10º_7,
    DevW=_10º_8,
    PositionW=_10º_9,
    LenRangeW=1)  # disabled
flip = FlipMatrix(Data=deccutmesh_3.Dups)
item_7 = ListItem(List=deccutmesh_4.Vertices, Index=bang.Branch0, Wrap=True)  # -> flatten(Item)
sortcutmesh_6 = SortCutMesh(TriangulatedMeshOrCutMesh=developcgls_2)
deccutmesh_5 = DeconstructCutMesh(TriangulatedMeshOrCutMesh=sortcutmesh_6)  # -> Vertices, Faces, Edges, Dups
categorycheck_2 = CategoryCheck(TriangulatedCutMesh=sortcutmesh_3, XyMirror=False, YzMirror=False, ZxMirror=False, OuterBoundaryCurves=meshedges.NakedE)
item_8 = ListItem(List=flip, Index=Slider(8, range=0..10), Wrap=True)  # -> flatten(Item)
sortcutmesh_7 = SortCutMesh(TriangulatedMeshOrCutMesh=developcgls)
item_9 = ListItem(List=deccutmesh_3.Vertices, Index=item_8, Wrap=True)
number_slider_14 = Slider(100, range=0..100)
item_10 = ListItem(List=item_7, Index=Slider(0, range=0..100), Wrap=True)
item_11 = ListItem(List=deccutmesh_3.Vertices, Index=bang.Branch0, Wrap=True)
_10º_10 = PowerOf10(Value=Slider(3, range=0..10))
_10º_11 = PowerOf10(Value=Slider(3, range=0..10))
cutmeshedges_4 = CutMeshEdges(TriangulatedMeshOrCutMesh=sortcutmesh_6)  # -> MeshAllEdges, MeshNakedEdges
checkobjective_3 = CheckObjective(
    TriangulatedCutMesh=developcgls_2,
    XyMirror=False,
    YzMirror=False,
    ZxMirror=False,
    OuterBoundaryCurves=cutmeshedges_4.MeshNakedEdges)
panel_6 = Panel(item_8)
series_2 = Series(Start=0, Step=1, Count=Slider(123, range=0..1000))
bang_2 = ExplodeTree(Data=categorycheck_2)  # -> Branch0, Branch1, Branch2, Branch3, Branch4
item_12 = ListItem(List=item_11, Index=Slider(100, range=0..100), Wrap=True)
cutmeshedges_5 = CutMeshEdges(TriangulatedMeshOrCutMesh=sortcutmesh_7)  # -> MeshAllEdges, MeshNakedEdges
netlbfgs2 = NetLBFGS2(TriangulatedMeshOrCutMesh=sortcutmesh_6, FeatureLinesPolylines=crv_16, W0=_10º_10, W1=1)  # -> CutMesh, FeatureLinesPolylines
sortcutmesh_8 = SortCutMesh(TriangulatedMeshOrCutMesh=developcgls_3)
netlbfgs2_2 = NetLBFGS2(TriangulatedMeshOrCutMesh=sortcutmesh_7, W0=_10º_11, W1=1)  # -> CutMesh, FeatureLinesPolylines
checkarea = CheckArea(TriangulatedMeshOrCutMesh=sortcutmesh_3, MoveDirection=flatten(bang_2.Branch0))  # -> TriangulatedMeshOrCutMesh, Area
item_13 = ListItem(List=deccutmesh_5.Vertices, Index=series_2, Wrap=True)
cutmeshedges_6 = CutMeshEdges(TriangulatedMeshOrCutMesh=netlbfgs2.CutMesh)  # -> MeshAllEdges, MeshNakedEdges
len = Length(Curve=cutmeshedges_4.MeshAllEdges)
panel_7 = Panel(bang_2.Branch0)
cutmeshedges_7 = CutMeshEdges(TriangulatedMeshOrCutMesh=netlbfgs2_2.CutMesh)  # -> MeshAllEdges, MeshNakedEdges
_10º_12 = PowerOf10(Value=Slider(3, range=0..10))
len_2 = Length(Curve=cutmeshedges_5.MeshAllEdges)
cutmeshedges_8 = CutMeshEdges(TriangulatedMeshOrCutMesh=sortcutmesh_8)  # -> MeshAllEdges, MeshNakedEdges
len_3 = Length(Curve=cutmeshedges_6.MeshAllEdges)
subtraction = Subtraction(A=len, B=len_3)
netlbfgs2_3 = NetLBFGS2(TriangulatedMeshOrCutMesh=sortcutmesh_8, W0=_10º_12, W1=1)  # -> CutMesh, FeatureLinesPolylines
len_4 = Length(Curve=cutmeshedges_7.MeshAllEdges)
subtraction_2 = Subtraction(A=len_2, B=len_4)
division = Division(A=subtraction, B=len)
division_2 = Division(A=subtraction_2, B=len_2)
crv_17 = Curve(netlbfgs2.FeatureLinesPolylines)
cutmeshedges_9 = CutMeshEdges(TriangulatedMeshOrCutMesh=netlbfgs2_3.CutMesh)  # -> MeshAllEdges, MeshNakedEdges
len_5 = Length(Curve=cutmeshedges_8.MeshAllEdges)
abs = Absolute(Value=division)
abs_2 = Absolute(Value=division_2)
len_6 = Length(Curve=cutmeshedges_9.MeshAllEdges)
subtraction_3 = Subtraction(A=len_5, B=len_6)
avr = Average(Input=abs)
avr_2 = Average(Input=abs_2)
division_3 = Division(A=subtraction_3, B=len_5)
abs_3 = Absolute(Value=division_3)
sort_4 = SortList(Keys=abs_3)  # -> Keys, ValuesA
panel_8 = Panel(sort_4.Keys)
avr_3 = Average(Input=abs_3)
