# Grasshopper definition heuristicTest.gh (Grasshopper 1.0.8)
# plug-ins: Hagoromo

msphere = MeshSphere(Base=PlaneXY(0, 0, 0), Radius=10, UCount=10, VCount=20)
tri = Triangulate(Mesh=msphere)  # -> Mesh, Count
mesh = Mesh(tri.Mesh)
meshnsga2 = MeshNSGAII(Mesh=mesh)  # -> ParetoPoints, ParetoMeshes, F1List, F2List, F3List; disabled
panel = Panel(meshnsga2.ParetoPoints)
item = ListItem(List=meshnsga2.ParetoMeshes, Index=Slider(1, range=0..100), Wrap=True)
area = Area(Geometry=item)  # -> Area, Centroid
volume = Volume(Geometry=item)  # -> Volume, Centroid
