# Grasshopper definition DevCheck.gh (Grasshopper 1.0.8)
# plug-ins: Heteroptera, Crane, Hagoromo, Weaverbird, NGon_RH8

angle = Angle()  # -> Angle, Reflex
number_slider = Slider(1, range=0..1)
number_slider_2 = Slider(100, range=0..100)
mesh = Mesh(<mesh referenced from the Rhino model>)
number_slider_3 = Slider(100000, range=0..100000)
number_slider_4 = Slider(10000, range=0..10000)
number_slider_5 = Slider(1000, range=0..1000)
develop_mesh = DevelopMesh(Mesh=mesh)  # -> DevelopMesh, FaceTree
mesh_2 = Mesh(<mesh referenced from the Rhino model>)
meshnet4 = MeshNet4(TriangulatedMeshOrCutMesh=mesh)

gcurvature = GaussianCurvature(TriangulatedMesh=mesh)
sort = SortList(Keys=gcurvature, ValuesA=gcurvature)  # -> Keys, ValuesA
avr = Average(Input=gcurvature)
item = ListItem(List=sort.ValuesA, Index=0, Wrap=True)  # -> Item1, Item
merge = Merge(Data1=item.Item1, Data2=item.Item, Data3=avr)
panel = Panel(merge)

gcurvature_2 = GaussianCurvature(TriangulatedMesh=mesh_2)
sort_2 = SortList(Keys=gcurvature_2, ValuesA=gcurvature_2)  # -> Keys, ValuesA
avr_2 = Average(Input=gcurvature_2)
item_2 = ListItem(List=sort_2.ValuesA, Index=0, Wrap=True)  # -> Item1, Item
merge_2 = Merge(Data1=item_2.Item1, Data2=item_2.Item, Data3=avr_2)
panel_2 = Panel(merge_2)

panel_3 = Panel("""282
1132""")
develop3 = DevelopMesh3(TriangulatedMesh=mesh_2, Count=Slider(10000, range=0..10000))  # -> ModifiedMesh, A; disabled

gcurvature_3 = GaussianCurvature()
sort_3 = SortList(Keys=gcurvature_3, ValuesA=gcurvature_3)  # -> Keys, ValuesA
avr_3 = Average(Input=gcurvature_3)
item_3 = ListItem(List=sort_3.ValuesA, Index=0, Wrap=True)  # -> Item1, Item
merge_3 = Merge(Data1=item_3.Item1, Data2=item_3.Item, Data3=avr_3)
panel_4 = Panel(merge_3)

gcurvature_4 = GaussianCurvature(TriangulatedMesh=develop3.ModifiedMesh)
sort_4 = SortList(Keys=gcurvature_4, ValuesA=gcurvature_4)  # -> Keys, ValuesA
avr_4 = Average(Input=gcurvature_4)
item_4 = ListItem(List=sort_4.ValuesA, Index=0, Wrap=True)  # -> Item1, Item
merge_4 = Merge(Data1=item_4.Item1, Data2=item_4.Item, Data3=avr_4)
panel_5 = Panel(merge_4)

number_slider_6 = Slider(8, range=0..10)
crv = Curve([<curve referenced from the Rhino model> x893])
number_slider_7 = Slider(100000, range=0..100000)
crv_2 = Curve()
wbweave = WeaverbirdsMeshFromLinesWeaveBack(Lines=crv, MaximumValence=4)

# ----
# 曲率0に
cmesh_from_mesh = CMeshFromMesh(Mesh=wbweave)
developable = Developable()
static_solver = CraneStaticSolver(
    CMesh=cmesh_from_mesh,
    Constraints=developable,
    NRIteration=50,
    CGNRIteration=100,
    Threshold=1e-13,
    Solve=Toggle(True),
    IsRigidEdge=False,
    IsPanelFlat=True,
    IsFoldBlock=True,
    IsConstraint=True)  # -> CMesh, RigidOrigami, Residual
deconstruct_cmesh = DeconstructCMesh(CMesh=static_solver.CMesh)  # -> Mesh, Mountain, Valley, Boundary, Unassigned, Triangulate, Edges, Inner
develop_mesh_2 = DevelopMesh(Mesh=deconstruct_cmesh.Mesh)  # -> DevelopMesh, FaceTree
gcurvature_5 = GaussianCurvature(TriangulatedMesh=deconstruct_cmesh.Mesh)
sort_5 = SortList(Keys=gcurvature_5, ValuesA=gcurvature_5)  # -> Keys, ValuesA
avr_5 = Average(Input=gcurvature_5)
item_5 = ListItem(List=sort_5.ValuesA, Index=0, Wrap=True)  # -> Item1, Item
merge_5 = Merge(Data1=item_5.Item1, Data2=item_5.Item, Data3=avr_5)
panel_6 = Panel(merge_5)

number_slider_8 = Slider(100000, range=0..100000)
mesh_3 = Mesh(wbweave)
crv_3 = Curve([<curve referenced from the Rhino model> x10])

develop = DevelopMesh(TriangulatedMesh=wbweave, Count="50")  # -> ModifiedMesh, A
gcurvature_6 = GaussianCurvature(TriangulatedMesh=develop.ModifiedMesh)
sort_6 = SortList(Keys=gcurvature_6, ValuesA=gcurvature_6)  # -> Keys, ValuesA
avr_6 = Average(Input=gcurvature_6)
item_6 = ListItem(List=sort_6.ValuesA, Index=0, Wrap=True)  # -> Item1, Item
merge_6 = Merge(Data1=item_6.Item1, Data2=item_6.Item, Data3=avr_6)
panel_7 = Panel(merge_6)

gcurvature_7 = GaussianCurvature(TriangulatedMesh=wbweave)
sort_7 = SortList(Keys=gcurvature_7, ValuesA=gcurvature_7)  # -> Keys, ValuesA
avr_7 = Average(Input=gcurvature_7)
item_7 = ListItem(List=sort_7.ValuesA, Index=0, Wrap=True)  # -> Item1, Item
merge_7 = Merge(Data1=item_7.Item1, Data2=item_7.Item, Data3=avr_7)
panel_8 = Panel(merge_7)

develop3_2 = DevelopMesh3(TriangulatedMesh=wbweave, Count=Slider(1000, range=0..1000))  # -> ModifiedMesh, A
gcurvature_8 = GaussianCurvature(TriangulatedMesh=develop3_2.ModifiedMesh)
sort_8 = SortList(Keys=gcurvature_8, ValuesA=gcurvature_8)  # -> Keys, ValuesA
avr_8 = Average(Input=gcurvature_8)
item_8 = ListItem(List=sort_8.ValuesA, Index=0, Wrap=True)  # -> Item1, Item
merge_8 = Merge(Data1=item_8.Item1, Data2=item_8.Item, Data3=avr_8)
panel_9 = Panel(merge_8)

tuttemesh = TutteMesh(TriangulatedMesh=develop3_2.ModifiedMesh)  # -> TutteMesh, Point
meshedges = MeshEdges(Mesh=tuttemesh.TutteMesh)  # -> AllE, NakedE
len = Length(Curve=meshedges.NakedE)
wbweave_2 = WeaverbirdsMeshFromLinesWeaveBack(Lines=crv_3, MaximumValence=4)
meshnet4_2 = MeshNet4(TriangulatedMeshOrCutMesh=tuttemesh.TutteMesh)
opentreemesh = OpenTreeMesh(TriangulatedDevelopableMesh=tuttemesh.TutteMesh)  # -> CutMesh, CutLines, MeshGraph
deccutmesh = DeconstructCutMesh()  # -> Vertices, Faces, Edges
opentreemesh_2 = OpenTreeMesh(TriangulatedDevelopableMesh=wbweave_2)  # -> CutMesh, CutLines, MeshGraph
crv_4 = Curve([<curve referenced from the Rhino model> x71])
meshnet4_3 = MeshNet4(TriangulatedMeshOrCutMesh=opentreemesh_2.CutMesh)
deccutmesh_2 = DeconstructCutMesh(TriangulatedMeshOrCutMesh=meshnet4_3)  # -> Vertices, Faces, Edges
pt = Point(<point referenced from the Rhino model>)
item_9 = ListItem(List=deccutmesh_2.Vertices, Index=deccutmesh_2.Edges, Wrap=True)
item_10 = ListItem(List=deccutmesh_2.Vertices, Index=deccutmesh_2.Edges, Wrap=True)
item_11 = ListItem(List=deccutmesh.Vertices, Index=deccutmesh.Edges, Wrap=True)
item_12 = ListItem(List=deccutmesh.Vertices, Index=deccutmesh.Edges, Wrap=True)
crv_5 = Curve([<curve referenced from the Rhino model> x18])
wbweave_3 = WeaverbirdsMeshFromLinesWeaveBack(Lines=crv_4, MaximumValence=4)
deccutmesh_3 = DeconstructCutMesh(TriangulatedMeshOrCutMesh=wbweave_3)  # -> Vertices, Faces, Edges
pdecon = Deconstruct(Point=pt)  # -> XComponent, YComponent, ZComponent
wbweave_4 = WeaverbirdsMeshFromLinesWeaveBack(Lines=crv_5, MaximumValence=4)
cutmesh = CutMesh(TriangulatedDevelopableMesh=wbweave_4)  # -> CutMesh, CutLines, MeshGraph
meshnet4_4 = MeshNet4(TriangulatedMeshOrCutMesh=cutmesh.CutMesh)
item_13 = ListItem(List=item_9, Index=0, Wrap=True)
cutmeshedges = CutMeshEdges(TriangulatedCutMesh=cutmesh.CutMesh)  # -> MeshAllEdges, MeshNakedEdges
item_14 = ListItem(List=item_9, Index="1", Wrap=True)
item_15 = ListItem(List=item_11, Index=0, Wrap=True)
item_16 = ListItem(List=item_11, Index="1", Wrap=True)
cutmeshedges_2 = CutMeshEdges(TriangulatedCutMesh=meshnet4_4)  # -> MeshAllEdges, MeshNakedEdges
number_slider_9 = Slider(0, range=0..100)
meshedges_2 = MeshEdges(Mesh=wbweave_3)  # -> AllE, NakedE
ln = Line(StartPoint=item_13, EndPoint=item_14)
nickname = MyComponent1(TriangulatedMeshOrCutMesh=wbweave_4)  # -> CutMesh, Gaussian, K, B, A, MatrixText
meshedges_3 = MeshEdges(Mesh=wbweave_4)  # -> AllE, NakedE
ln_2 = Line(StartPoint=item_15, EndPoint=item_16)
cutmesh_2 = CutMesh(TriangulatedDevelopableMesh=wbweave_3)  # -> CutMesh, CutLines, MeshGraph
meshnet4_5 = MeshNet4(TriangulatedMeshOrCutMesh=opentreemesh.CutMesh)
len_2 = Length(Curve=cutmeshedges.MeshAllEdges)
tuttemesh_2 = TutteMesh(TriangulatedMesh=develop3_2.ModifiedMesh)  # -> TutteMesh, Point
cutmesh_3 = CutMesh(TriangulatedDevelopableMesh=tuttemesh_2.TutteMesh)  # -> CutMesh, CutLines, MeshGraph
deccutmesh_4 = DeconstructCutMesh(TriangulatedCutMesh=cutmesh_3.CutMesh)  # -> Vertices, Faces, Edges
item_17 = ListItem(List=deccutmesh_4.Edges, Index=0, Wrap=True)  # -> Item, Item1
flip = FlipMatrix(Data=deccutmesh_4.Edges)
flip_2 = FlipMatrix(Data=deccutmesh_4.Faces)
item_18 = ListItem(List=deccutmesh_4.Vertices, Index=Slider(320, range=0..1000), Wrap=True)
item_19 = ListItem(List=deccutmesh_4.Vertices, Index=item_17.Item, Wrap=True)
item_20 = ListItem(List=deccutmesh_4.Vertices, Index=item_17.Item1, Wrap=True)
item_21 = ListItem(List=deccutmesh_4.Vertices, Index=deccutmesh_4.Faces, Wrap=True)
item_22 = ListItem(List=flip_2, Index=Slider(278, range=0..1000), Wrap=True)  # -> flatten(Item)
ln_3 = Line(StartPoint=item_19, EndPoint=item_20)  # -> flatten(Line)
item_23 = ListItem(List=flip, Index=panel_3, Wrap=True)
pline = PolyLine(Vertices=item_21, Closed="true")  # -> flatten(Polyline)
panel_10 = Panel(item_22)
center = Center(Geometry=ln_3)  # -> Center, Dimension
flip_3 = FlipMatrix(Data=item_23)
sort_9 = SortList(Keys=ln_3, ValuesA=ln_3)  # -> Keys, ValuesA
center_2 = Center(Geometry=pline)  # -> Center, Dimension
item_24 = ListItem(List=pline, Index=Slider(277, range=0..1697), Wrap=True)
panel_11 = Panel(flip_3)
item_25 = ListItem(List=ln_3, Index=Slider(581, range=0..581), Wrap=True)
lng = ListLength(List=center.Center)
dist = Distance(PointA=item_18, PointB=center_2.Center)
lng_2 = ListLength(List=center_2.Center)
series = Series(Start=0, Step=1, Count=lng)
series_2 = Series(Start=0, Step=1, Count=lng_2)
sort_10 = SortList(Keys=dist, ValuesA=series_2)  # -> Keys, ValuesA
panel_12 = Panel(sort_10.ValuesA)
cutmeshedges_3 = CutMeshEdges(TriangulatedCutMesh=cutmesh_3.CutMesh)  # -> MeshAllEdges, MeshNakedEdges
crv_6 = Curve(cutmesh_3.MeshGraph)
meshgraph = MeshGraph(TriangulatedMeshOrCutMesh=cutmesh_3.CutMesh)
crv_7 = Curve(cutmeshedges_3.MeshNakedEdges)
len_3 = Length(Curve=flatten(ln_2))
# 切込み
len_4 = Length(Curve=flatten(ln))
len_5 = Length(Curve=cutmeshedges_2.MeshAllEdges)
sort_11 = SortList(Keys=len_2, ValuesA=len_2)  # -> Keys, ValuesA
sort_12 = SortList(Keys=crv_7, ValuesA=crv_7)  # -> Keys, ValuesA
cutmeshedges_4 = CutMeshEdges(TriangulatedCutMesh=wbweave_4)  # -> MeshAllEdges, MeshNakedEdges
checkmesh = CheckMesh(TriangulatedMesh=wbweave_4, VertexIndex="0")
sort_13 = SortList(Keys=len_5, ValuesA=len_5)  # -> Keys, ValuesA
dupln = RemoveDuplicateLines(Lines=cutmeshedges_3.MeshNakedEdges, Tolerance=0.01)
meshgraph_2 = MeshGraph(TriangulatedDevelopableMesh=tuttemesh_2.TutteMesh)
checkmesh_2 = CheckMesh(TriangulatedMesh=tuttemesh_2.TutteMesh, VertexIndex=Slider(320, range=0..1000))
panel_13 = Panel(checkmesh_2)
subtraction = Subtraction(A=len_4, B=len_3)
cutmeshedges_5 = CutMeshEdges(TriangulatedMeshOrCutMesh=cutmesh_2.CutMesh)  # -> MeshAllEdges, MeshNakedEdges
panel_14 = Panel(nickname.A)
item_26 = ListItem(List=sort_12.ValuesA, Index=Slider(359, range=340..360), Wrap=True)
panel_15 = Panel(sort_11.ValuesA)
panel_16 = Panel(checkmesh)
Z = UnitZ(Factor=number_slider_9)
center_3 = Center(Geometry=crv_2)  # -> Center, Dimension
center_4 = Center(Geometry=dupln)  # -> Center, Dimension
panel_17 = Panel(subtraction)

meshedges_4 = MeshEdges(Mesh=develop3_2.ModifiedMesh)  # -> AllE, NakedE
crv_8 = Curve(meshedges_4.AllE)
crv_9 = Curve()
mesh_4 = Mesh(develop3_2.ModifiedMesh)

X = UnitX(Factor=number_slider_9)
move = Move(Geometry=crv_7, Motion=X)  # -> Geometry, Transform
meshedges_5 = MeshEdges(Mesh=tuttemesh_2.TutteMesh)  # -> AllE, NakedE
crv_10 = Curve(cutmeshedges_5.MeshNakedEdges)
item_27 = ListItem(Index=Slider(12, range=0..12), Wrap=True)
crv_11 = Curve(cutmeshedges.MeshNakedEdges)
merge_9 = Merge(Data1=center_4.Center, Data2=center_3.Center)  # -> flatten(Result)
cullpt = CullDuplicates(Points=merge_9, Tolerance=0.1, CullMode=2)  # -> Points, Indices, Valence
item_28 = ListItem(List=cullpt.Points, Index=Slider(2, range=0..10), Wrap=True)
dist_2 = Distance(PointA=item_28, PointB=center.Center)
sort_14 = SortList(Keys=dist_2, ValuesA=series)  # -> Keys, ValuesA
panel_18 = Panel(sort_14.ValuesA)
panel_19 = Panel(sort_13.ValuesA)
wbdual = WeaverbirdsDualGraph(DualMode=0)
mesh_5 = Mesh(tuttemesh_2.TutteMesh)
crv_12 = Curve()
deccutmesh_5 = DeconstructCutMesh(TriangulatedCutMesh=cutmesh_2.CutMesh)  # -> Vertices, Faces, Edges
crv_13 = Curve(meshedges_5.NakedE)
meshedges_6 = MeshEdges()  # -> AllE, NakedE
deccutmesh_6 = DeconstructCutMesh(TriangulatedCutMesh=cutmesh.CutMesh)  # -> Vertices, Faces, Edges
sort_15 = SortList(Keys=deccutmesh_6.Vertices, ValuesA=deccutmesh_6.Vertices)  # -> Keys, ValuesA
crv_14 = Curve(meshedges_6.NakedE)
item_29 = ListItem(List=deccutmesh_6.Vertices, Index=Slider(3, range=0..10), Wrap=True)
item_30 = ListItem(List=deccutmesh_6.Edges, Index=0, Wrap=True)  # -> Item, Item1
mesh_6 = Mesh(<mesh referenced from the Rhino model>)
flip_4 = FlipMatrix(Data=deccutmesh_6.Faces)
panel_20 = Panel(deccutmesh_5.Vertices)
meshgraph_3 = MeshGraph(TriangulatedDevelopableMesh=mesh_6)

# ----
# 展開図
develop_mesh_3 = DevelopMesh(Mesh=develop3_2.ModifiedMesh)  # -> DevelopMesh, FaceTree
meshedges_7 = MeshEdges(Mesh=develop_mesh_3.DevelopMesh)  # -> AllE, NakedE

meshnet5 = MeshNet5(TriangulatedMeshOrCutMesh=develop3_2.ModifiedMesh)  # -> CutMesh, CutMesh_2; disabled
tuttemesh_3 = TutteMesh(TriangulatedMesh=mesh_6)  # -> TutteMesh, Point

meshnet = MeshNet(TriangulatedDevelopableMesh=develop3_2.ModifiedMesh, Count=Slider(100000, range=0..100000))  # -> TutteMesh, Point; disabled
meshedges_8 = MeshEdges(Mesh=meshnet.TutteMesh)  # -> AllE, NakedE
meshedges_9 = MeshEdges(Mesh=develop3_2.ModifiedMesh)  # -> AllE, NakedE
len_6 = Length(Curve=meshedges_9.AllE)
len_7 = Length(Curve=meshedges_8.AllE)
subtraction_2 = Subtraction(A=len_7, B=len_6)
abs = Absolute(Value=subtraction_2)
lng_3 = ListLength(List=abs)
series_3 = Series(Start=0, Step=1, Count=lng_3)
sort_16 = SortList(Keys=abs, ValuesA=series_3)  # -> Keys, ValuesA
item_31 = ListItem(List=sort_16.ValuesA, Index=Slider(892, range=0..892), Wrap=True)
item_32 = ListItem(List=meshedges_8.AllE, Index=item_31, Wrap=True)
panel_21 = Panel(sort_16.ValuesA)

dupln_2 = RemoveDuplicateLines(Tolerance=0.01)
panel_22 = Panel(deccutmesh_6.Vertices)
item_33 = ListItem(List=deccutmesh_6.Vertices, Index=item_30.Item, Wrap=True)
item_34 = ListItem(List=deccutmesh_6.Vertices, Index=item_30.Item1, Wrap=True)
item_35 = ListItem(List=deccutmesh_6.Vertices, Index=deccutmesh_6.Faces, Wrap=True)
panel_23 = Panel(deccutmesh_6.Faces)
panel_24 = Panel(deccutmesh_5.Faces)
ln_4 = Line(StartPoint=item_33, EndPoint=item_34)  # -> flatten(Line)
pline_2 = PolyLine(Vertices=item_35, Closed="true")  # -> flatten(Polyline)
tuttemesh_4 = TutteMesh(TriangulatedMesh=develop3_2.ModifiedMesh)  # -> TutteMesh, Point
mesh_7 = Mesh(meshnet.TutteMesh)
panel_25 = Panel(deccutmesh_5.Edges)
sort_17 = SortList(Keys=ln_4, ValuesA=ln_4)  # -> Keys, ValuesA
number_slider_10 = Slider(10, range=0..10)
meshedges_10 = MeshEdges(Mesh=tuttemesh_4.TutteMesh)  # -> AllE, NakedE
meshnet4_6 = MeshNet4(TriangulatedMeshOrCutMesh=develop3_2.ModifiedMesh)
item_36 = ListItem(List=pline_2, Index=Slider(8, range=0..10), Wrap=True)
item_37 = ListItem(List=ln_4, Index=Slider(15, range=0..21), Wrap=True)
panel_26 = Panel(deccutmesh_6.Edges)
meshnet2 = MeshNet2(TriangulatedDevelopableMesh=mesh_7, Count=Slider(1000, range=0..1000))  # -> TutteMesh, Point
mesh_8 = Mesh(meshnet2.TutteMesh)
meshedges_11 = MeshEdges(Mesh=mesh_8)  # -> AllE, NakedE
