# Grasshopper definition DevCheck2.gh (Grasshopper 1.0.8)
# plug-ins: Heteroptera, Pufferfish, Human, Crane, Hagoromo, Weaverbird, NGon_RH8

crv = Curve([<curve referenced from the Rhino model> x81])
project = Project(Geometry=crv, Plane=PlaneXY(0, 0, 0))  # -> Geometry, Transform
wbweave = WeaverbirdsMeshFromLinesWeaveBack(Lines=project.Geometry, MaximumValence=4)
# カットメッシュとは
crv_2 = Curve([<curve referenced from the Rhino model> x71])
meshedges = MeshEdges(Mesh=wbweave)  # -> AllE, NakedE
crv_3 = Curve(<curve referenced from the Rhino model>)
project_2 = Project(Geometry=crv_3, Plane=PlaneXY(0, 0, 0))  # -> Geometry, Transform
meshcutbylines = MeshCutWithCutLines(TriangulatedMeshOrCutMesh=wbweave, OpenCutLinesPolylines=project_2.Geometry)
X = UnitX(Factor=Slider(123, range=0..1000))
wbweave_2 = WeaverbirdsMeshFromLinesWeaveBack(Lines=crv, MaximumValence=4)
wbweave_3 = WeaverbirdsMeshFromLinesWeaveBack(Lines=crv_2, MaximumValence=4)
move = Move(Geometry=meshedges.NakedE, Motion=X)  # -> Geometry, Transform
mbridgecm = MbridgeCM(TriangulatedMeshOrCutMesh=wbweave_2)
movecm = MoveCutMesh(TriangulatedMeshOrCutMesh=meshcutbylines, MoveDirection=X)
meshedges_2 = MeshEdges(Mesh=wbweave_2)  # -> AllE, NakedE

opentreemesh = OpenTreeMesh(TriangulatedDevelopableMesh=wbweave_3)  # -> CutMesh, CutLines, MeshGraph
mbridgecm_2 = MbridgeCM(TriangulatedMeshOrCutMesh=opentreemesh.CutMesh)
cutmeshedges = CutMeshEdges(TriangulatedMeshOrCutMesh=opentreemesh.CutMesh)  # -> MeshAllEdges, MeshNakedEdges
crv_4 = Curve(cutmeshedges.MeshNakedEdges)

mbridgecm_3 = MbridgeCM(TriangulatedMeshOrCutMesh=wbweave_3)
meshedges_3 = MeshEdges(Mesh=wbweave_3)  # -> AllE, NakedE
meshcutbylines_2 = MeshCutWithCutLines(TriangulatedMeshOrCutMesh=wbweave_2, OpenCutLinesPolylines=crv_3)
developcm2 = DevelopCutMesh2(
    TriangulatedCutMesh=movecm,
    Iterations=Slider(100, range=0..100),
    XyMirror=False,
    YzMirror=False,
    ZxMirror=False,
    OuterBoundaryCurves=move.Geometry,
    Alpha=0.1)
panel = Panel("""47
49
53
61
4""")
number_slider = Slider(1000, range=0..1000)
item = ListItem(List=meshedges_3.AllE, Index=panel, Wrap=True)
mesh = Mesh(<mesh referenced from the Rhino model>)
item_2 = ListItem(List=meshedges_3.AllE, Index="78", Wrap=True)
crv_5 = Curve([<curve referenced from the Rhino model> x2])
sortcutmesh = SortCutMesh(TriangulatedMeshOrCutMesh=meshcutbylines_2)
cutmeshedges_2 = CutMeshEdges(TriangulatedMeshOrCutMesh=developcm2)  # -> MeshAllEdges, MeshNakedEdges
number_slider_2 = Slider(1000, range=0..1000)

merge = Merge(Data1=crv_5, Data2=item_2, Data3=item)  # -> flatten(Result)
meshcut = MeshCut(TriangulatedMeshOrCutMesh=mbridgecm_3, OpenCutLinesPolylines=merge)

merge_2 = Merge(Data1=crv_5, Data2=item_2)  # -> flatten(Result)
meshcut_2 = MeshCut(TriangulatedMeshOrCutMesh=mbridgecm_3, OpenCutLinesPolylines=merge_2)

number_slider_3 = Slider(4560, range=0..10000)
item_3 = ListItem(List=cutmeshedges_2.MeshAllEdges, Index="46", Wrap=True)
meshcutbylines_3 = MeshCutWithCutLines(TriangulatedMeshOrCutMesh=developcm2, OpenCutLinesPolylines=item_3)

gcurvature = GaussianCurvature(TriangulatedMesh=mesh)
sort = SortList(Keys=gcurvature, ValuesA=gcurvature)  # -> Keys, ValuesA
avr = Average(Input=gcurvature)
item_4 = ListItem(List=sort.ValuesA, Index=0, Wrap=True)  # -> Item1, Item
merge_3 = Merge(Data1=item_4.Item1, Data2=item_4.Item, Data3=avr)
panel_2 = Panel(merge_3)

sortcutmesh_2 = SortCutMesh(TriangulatedMeshOrCutMesh=meshcut_2)
develop_mesh = DevelopMesh(Mesh=mesh)  # -> DevelopMesh, FaceTree
meshnet4 = MeshNet4(TriangulatedMeshOrCutMesh=mesh)  # -> CutMesh, FeatureLinesPolylines
developcm2_2 = DevelopCutMesh2(
    TriangulatedCutMesh=sortcutmesh,
    Iterations=Slider(2000, range=0..10000),
    XyMirror=False,
    YzMirror=False,
    ZxMirror=False,
    OuterBoundaryCurves=meshedges_2.NakedE,
    Alpha=0.1)
developcm3 = DevelopCutMesh3(
    TriangulatedCutMesh=sortcutmesh,
    Iterations=Slider(100, range=0..100),
    XyMirror=False,
    YzMirror=False,
    ZxMirror=False,
    OuterBoundaryCurves=meshedges_2.NakedE,
    Alpha=Slider(0.1, range=0..0.1))
cutmeshedges_3 = CutMeshEdges(TriangulatedMeshOrCutMesh=developcm3)  # -> MeshAllEdges, MeshNakedEdges
item_5 = ListItem(List=cutmeshedges_3.MeshAllEdges, Index="46", Wrap=True)
sortcutmesh_3 = SortCutMesh(TriangulatedMeshOrCutMesh=meshcut)
meshnet4_2 = MeshNet4(TriangulatedMeshOrCutMesh=meshcutbylines_3)  # -> CutMesh, FeatureLinesPolylines
meshcutbylines_4 = MeshCutWithCutLines(TriangulatedMeshOrCutMesh=developcm3, OpenCutLinesPolylines=item_5)
number_slider_4 = Slider(9, range=0..50)
mbridgecm_4 = MbridgeCM(TriangulatedMeshOrCutMesh=meshnet4.CutMesh)
deccutmesh = DeconstructCutMesh(TriangulatedMeshOrCutMesh=sortcutmesh_2)  # -> Vertices, Faces, Edges
cutmeshedges_4 = CutMeshEdges(TriangulatedMeshOrCutMesh=developcm2_2)  # -> MeshAllEdges, MeshNakedEdges
center = Center(Geometry=wbweave_2)  # -> Center, Dimension
dividecutmesh = DivideCutMesh(TriangulatedMeshOrCutMesh=sortcutmesh_3)
meshnet4_3 = MeshNet4(TriangulatedMeshOrCutMesh=meshcutbylines_4)  # -> CutMesh, FeatureLinesPolylines
mesh_2 = Mesh(develop_mesh.DevelopMesh)
mbridgecm_5 = MbridgeCM(TriangulatedMeshOrCutMesh=meshnet4_2.CutMesh)
item_6 = ListItem(List=cutmeshedges_4.MeshAllEdges, Index="46", Wrap=True)
meshedges_4 = MeshEdges(Mesh=mbridgecm_4)  # -> AllE, NakedE
crv_6 = Curve([<curve referenced from the Rhino model> x18])
mesh_3 = Mesh(<mesh referenced from the Rhino model>)
meshcutbylines_5 = MeshCutWithCutLines(TriangulatedMeshOrCutMesh=developcm2_2, OpenCutLinesPolylines=item_6)
center_2 = Center(Geometry=mbridgecm_5)  # -> Center, Dimension
cutmeshedges_5 = CutMeshEdges(TriangulatedMeshOrCutMesh=meshcut)  # -> MeshAllEdges, MeshNakedEdges
meshedges_5 = MeshEdges(Mesh=mesh_3)  # -> AllE, NakedE
wbweave_4 = WeaverbirdsMeshFromLinesWeaveBack(Lines=crv_6, MaximumValence=4)
mbridgecm_6 = MbridgeCM(TriangulatedMeshOrCutMesh=meshnet4_3.CutMesh)
crv_7 = Curve(meshedges_4.NakedE)
len = Length(Curve=crv_7)
item_7 = ListItem(List=dividecutmesh, Index="1", Wrap=True)
crv_8 = Curve(meshedges_5.AllE)
avr_2 = Average(Input=len)
crv_9 = Curve([<curve referenced from the Rhino model> x893])
meshnet4_4 = MeshNet4(TriangulatedMeshOrCutMesh=meshcutbylines_5)  # -> CutMesh, FeatureLinesPolylines
center_3 = Center(Geometry=mbridgecm_6)  # -> Center, Dimension
center_4 = Center(Geometry=wbweave_2)  # -> Center, Dimension
opentreemesh_2 = OpenTreeMesh(TriangulatedDevelopableMesh=wbweave_4)  # -> CutMesh, CutLines, MeshGraph
move2pt = MoveToPoint(Geometry=mbridgecm_5, PointA=center_2.Center, PointB=center.Center)  # -> Moved, Vector, Transform
sortcutmesh_4 = SortCutMesh(TriangulatedMeshOrCutMesh=item_7)
move2pt_2 = MoveToPoint(Geometry=mbridgecm_6, PointA=center_3.Center, PointB=center_4.Center)  # -> Moved, Vector, Transform
center_5 = Center(Geometry=wbweave_2)  # -> Center, Dimension
wbweave_5 = WeaverbirdsMeshFromLinesWeaveBack(Lines=crv_9, MaximumValence=4)
meshnet4_5 = MeshNet4(TriangulatedMeshOrCutMesh=opentreemesh_2.CutMesh)  # -> CutMesh, FeatureLinesPolylines
mbridgecm_7 = MbridgeCM(TriangulatedMeshOrCutMesh=meshnet4_4.CutMesh)
cutmeshedges_6 = CutMeshEdges(TriangulatedCutMesh=opentreemesh_2.CutMesh)  # -> MeshAllEdges, MeshNakedEdges
deccutmesh_2 = DeconstructCutMesh(TriangulatedMeshOrCutMesh=sortcutmesh_4)  # -> Vertices, Faces, Edges
mesh_4 = Mesh(wbweave_5)
center_6 = Center(Geometry=mbridgecm_7)  # -> Center, Dimension
panel_3 = Panel("2")
item_8 = ListItem(List=deccutmesh.Edges, Index="1", Wrap=True)  # -> flatten(Item)
item_9 = ListItem(List=deccutmesh.Edges, Index="0", Wrap=True)  # -> flatten(Item)
number_slider_5 = Slider(22, range=0..50)
item_10 = ListItem(List=deccutmesh.Vertices, Index=Slider(0, range=0..30), Wrap=True)

# ----
# 曲率0に
cmesh_from_mesh = CMeshFromMesh(Mesh=wbweave_5)
developable = Developable()
static_solver = CraneStaticSolver(
    CMesh=cmesh_from_mesh,
    Constraints=developable,
    NRIteration=50,
    CGNRIteration=100,
    Threshold=1e-13,
    Solve=Toggle(True),
    IsRigidEdge=False,
    IsPanelFlat=True,
    IsFoldBlock=True,
    IsConstraint=True)  # -> CMesh, RigidOrigami, Residual
deconstruct_cmesh = DeconstructCMesh(CMesh=static_solver.CMesh)  # -> Mesh, Mountain, Valley, Boundary, Unassigned, Triangulate, Edges, Inner
develop_mesh_2 = DevelopMesh(Mesh=deconstruct_cmesh.Mesh)  # -> DevelopMesh, FaceTree
gcurvature_2 = GaussianCurvature(TriangulatedMesh=deconstruct_cmesh.Mesh)
sort_2 = SortList(Keys=gcurvature_2, ValuesA=gcurvature_2)  # -> Keys, ValuesA
avr_3 = Average(Input=gcurvature_2)
item_11 = ListItem(List=sort_2.ValuesA, Index=0, Wrap=True)  # -> Item1, Item
merge_4 = Merge(Data1=item_11.Item1, Data2=item_11.Item, Data3=avr_3)
panel_4 = Panel(merge_4)

move2pt_3 = MoveToPoint(Geometry=mbridgecm_7, PointA=center_6.Center, PointB=center_5.Center)  # -> Moved, Vector, Transform
item_12 = ListItem(List=item_9, Index=number_slider_4, Wrap=True)
item_13 = ListItem(List=item_8, Index=number_slider_4, Wrap=True)
item_14 = ListItem(List=deccutmesh.Vertices, Index=item_12, Wrap=True)
item_15 = ListItem(List=deccutmesh.Vertices, Index=item_13, Wrap=True)

develop = DevelopMesh(TriangulatedMesh=wbweave_5, Count=Slider(1000, range=0..1000))  # -> ModifiedMesh, A
gcurvature_3 = GaussianCurvature(TriangulatedMesh=develop.ModifiedMesh)
sort_3 = SortList(Keys=gcurvature_3, ValuesA=gcurvature_3)  # -> Keys, ValuesA
avr_4 = Average(Input=gcurvature_3)
item_16 = ListItem(List=sort_3.ValuesA, Index=0, Wrap=True)  # -> Item1, Item
merge_5 = Merge(Data1=item_16.Item1, Data2=item_16.Item, Data3=avr_4)
# 長さの最適化まで入れたら長さのずれが0.1倍になった
panel_5 = Panel(merge_5)

ln = Line(StartPoint=item_14, EndPoint=item_15)
meshedges_6 = MeshEdges(Mesh=develop.ModifiedMesh)  # -> AllE, NakedE
mbridgecm_8 = MbridgeCM(TriangulatedMeshOrCutMesh=wbweave_5)
len_2 = Length(Curve=meshedges_6.NakedE)
item_17 = ListItem(List=deccutmesh_2.Edges, Index="1", Wrap=True)  # -> flatten(Item)
item_18 = ListItem(List=deccutmesh_2.Edges, Index="0", Wrap=True)  # -> flatten(Item)
avr_5 = Average(Input=len_2)
developcm = DevelopCutMesh(TriangulatedCutMesh=mbridgecm_8, Count=Slider(1000, range=0..1000))
item_19 = ListItem(List=deccutmesh_2.Vertices, Index=Slider(0, range=0..30), Wrap=True)
sortcutmesh_5 = SortCutMesh(TriangulatedMeshOrCutMesh=deconstruct_cmesh.Mesh)
item_20 = ListItem(List=item_18, Index=number_slider_5, Wrap=True)
item_21 = ListItem(List=item_17, Index=number_slider_5, Wrap=True)
cutmeshedges_7 = CutMeshEdges(TriangulatedMeshOrCutMesh=developcm)  # -> MeshAllEdges, MeshNakedEdges
meshnet6 = MeshNet6(TriangulatedMeshOrCutMesh=sortcutmesh_5)
item_22 = ListItem(List=deccutmesh_2.Vertices, Index=item_20, Wrap=True)
item_23 = ListItem(List=deccutmesh_2.Vertices, Index=item_21, Wrap=True)
ln_2 = Line(StartPoint=item_22, EndPoint=item_23)
cutmeshedges_8 = CutMeshEdges(TriangulatedMeshOrCutMesh=sortcutmesh_5)  # -> MeshAllEdges, MeshNakedEdges
cutmeshedges_9 = CutMeshEdges(TriangulatedMeshOrCutMesh=meshnet6)  # -> MeshAllEdges, MeshNakedEdges
number_slider_6 = Slider(8, range=0..10)
meshedges_7 = MeshEdges(Mesh=deconstruct_cmesh.Mesh)  # -> AllE, NakedE
mesh_5 = Mesh(<mesh referenced from the Rhino model>)
meshedges_8 = MeshEdges(Mesh=develop_mesh_2.DevelopMesh)  # -> AllE, NakedE
mesh_6 = Mesh(<mesh referenced from the Rhino model>)
len_3 = Length(Curve=cutmeshedges_8.MeshAllEdges)
len_4 = Length(Curve=cutmeshedges_9.MeshAllEdges)
mbridgecm_9 = MbridgeCM(TriangulatedMeshOrCutMesh=mesh_5)
len_5 = Length(Curve=meshedges_8.AllE)
len_6 = Length(Curve=meshedges_7.AllE)
series = Series(Start=Slider(124, range=0..1000), Step="0", Count=number_slider_6)
subtraction = Subtraction(A=len_3, B=len_4)
sortcutmesh_6 = SortCutMesh(TriangulatedMeshOrCutMesh=mbridgecm_9)
mbridgecm_10 = MbridgeCM(TriangulatedMeshOrCutMesh=mesh_6)
sortcutmesh_7 = SortCutMesh(TriangulatedMeshOrCutMesh=mbridgecm_10)
subtraction_2 = Subtraction(A=len_5, B=len_6)
meshedges_9 = MeshEdges(Mesh=mesh_6)  # -> AllE, NakedE
number_slider_7 = Slider(30, range=0..1000)
develop_2 = DevelopMesh(TriangulatedMesh=mesh_5, Count=Slider(105, range=0..10000))  # -> ModifiedMesh, A
abs = Absolute(Value=subtraction)
abs_2 = Absolute(Value=subtraction_2)
toggle = BooleanToggle(True)
principle = PrincipleCurvature(TriangulatedMeshOrCutMesh=sortcutmesh_7)
len_7 = Length(Curve=meshedges_9.AllE)
mesh_7 = Mesh(develop_2.ModifiedMesh)
cutchoice1 = CutChoice1(TriangulatedCutMesh=sortcutmesh_6, MaxLength=series, SeedCount=number_slider_6, Distance=number_slider_7, Branch=toggle)  # -> TriangulatedCutMesh, CutChoices

# ----
# 展開図
develop_mesh_3 = DevelopMesh(Mesh=develop.ModifiedMesh)  # -> DevelopMesh, FaceTree
meshedges_10 = MeshEdges(Mesh=develop_mesh_3.DevelopMesh)  # -> AllE, NakedE

sortcutmesh_8 = SortCutMesh(TriangulatedMeshOrCutMesh=develop.ModifiedMesh)
avr_6 = Average(Input=abs)
cutchoice1_2 = CutChoice1(TriangulatedCutMesh=sortcutmesh_7, MaxLength=series, SeedCount=number_slider_6, Distance=number_slider_7, Branch=toggle)  # -> TriangulatedCutMesh, CutChoices
oneseedcut = OneSeedCut(TriangulatedCutMesh=sortcutmesh_7, MaxLength=Slider(48, range=0..100), Branch=Toggle(False))  # -> TriangulatedCutMesh, CutChoices
sort_4 = SortList(Keys=abs)  # -> Keys, ValuesA
avr_7 = Average(Input=abs_2)
meshnet4_6 = MeshNet4(TriangulatedMeshOrCutMesh=develop.ModifiedMesh)  # -> CutMesh, FeatureLinesPolylines
meshnet6_2 = MeshNet6(TriangulatedMeshOrCutMesh=develop.ModifiedMesh)
sort_5 = SortList(Keys=abs_2)  # -> Keys, ValuesA
panel_7 = Panel(principle)
item_24 = ListItem(List=sort_4.Keys, Index=0, Wrap=True)  # -> Item1, Item
crv_10 = Curve(cutchoice1.CutChoices)
item_25 = ListItem(List=sort_5.Keys, Index=0, Wrap=True)  # -> Item1, Item
crv_11 = Curve(cutchoice1_2.CutChoices)
cutmeshedges_10 = CutMeshEdges(TriangulatedMeshOrCutMesh=sortcutmesh_8)  # -> MeshAllEdges, MeshNakedEdges
crv_12 = Curve(oneseedcut.CutChoices)
mbridgecm_11 = MbridgeCM(TriangulatedMeshOrCutMesh=meshnet4_6.CutMesh)
cutmeshedges_11 = CutMeshEdges(TriangulatedMeshOrCutMesh=meshnet6_2)  # -> MeshAllEdges, MeshNakedEdges
crv_13 = Curve([<curve referenced from the Rhino model> x2])
merge_6 = Merge(Data1=avr_6, Data2=item_24.Item1, Data3=item_24.Item)
merge_7 = Merge(Data1=avr_7, Data2=item_25.Item1, Data3=item_25.Item)
join = JoinCurves(Curves=crv_13, Preserve=False)
crv_14 = Curve(<curve referenced from the Rhino model>)
crv_15 = Curve(<curve referenced from the Rhino model>)
meshedges_11 = MeshEdges(Mesh=mbridgecm_11)  # -> AllE, NakedE
crv_16 = Curve(<curve referenced from the Rhino model>)
crv_17 = Curve(<curve referenced from the Rhino model>)
panel_8 = Panel(merge_6)
panel_9 = Panel(merge_7)
len_8 = Length(Curve=cutmeshedges_10.MeshAllEdges)
len_9 = Length(Curve=cutmeshedges_11.MeshAllEdges)
len_10 = Length(Curve=meshedges_11.NakedE)
merge_8 = Merge(Data1=join, Data2=crv_16, Data3=crv_15, Data4=crv_14, Data5=crv_17)  # -> flatten(Result)
avr_8 = Average(Input=len_10)
cutmeshedges_12 = CutMeshEdges(TriangulatedMeshOrCutMesh=meshnet4_6.CutMesh)  # -> MeshAllEdges, MeshNakedEdges
subtraction_3 = Subtraction(A=len_9, B=len_8)
meshcutbylines_6 = MeshCutWithCutLines(TriangulatedMeshOrCutMesh=mesh_6, OpenCutLinesPolylines=merge_8)
len_11 = Length(Curve=cutmeshedges_12.MeshAllEdges)
abs_3 = Absolute(Value=subtraction_3)
mplane = MeshPlane(Boundary={Plane=PlaneXY(0, 0, 0), Size=Domain2(u=-10..10, v=-10..10)}, WidthCount=10, HeightCount=10)  # -> Mesh, Area
subtraction_4 = Subtraction(A=len_11, B=len_8)
crv_18 = Curve([<curve referenced from the Rhino model> x102])
avr_9 = Average(Input=abs_3)
tri = Triangulate(Mesh=mplane.Mesh)  # -> Mesh, Count
sort_6 = SortList(Keys=abs_3)  # -> Keys, ValuesA
abs_4 = Absolute(Value=subtraction_4)
X_2 = UnitX(Factor=Slider(194, range=0..1000))
Y = UnitY(Factor=Slider(234, range=0..1000))
move_2 = Move(Geometry=tri.Mesh, Motion=Y)  # -> Geometry, Transform
item_26 = ListItem(List=sort_6.Keys, Index=0, Wrap=True)  # -> Item1, Item
wbweave_6 = WeaverbirdsMeshFromLinesWeaveBack(Lines=crv_18, MaximumValence=4)
avr_10 = Average(Input=abs_4)
sort_7 = SortList(Keys=abs_4)  # -> Keys, ValuesA
grab = Grab(On=True, Strength=1, Range=3)
mbridgecm_12 = MbridgeCM(TriangulatedMeshOrCutMesh=mesh_6)
meshedges_12 = MeshEdges(Mesh=wbweave_6)  # -> AllE, NakedE
merge_9 = Merge(Data1=avr_9, Data2=item_26.Item1, Data3=item_26.Item)
item_27 = ListItem(List=sort_7.Keys, Index=0, Wrap=True)  # -> Item1, Item
X_3 = UnitX(Factor=Slider(2000, range=0..10000))
panel_10 = Panel("""38
42""")
merge_10 = Merge(Data1=avr_10, Data2=item_27.Item1, Data3=item_27.Item)
meshedges_13 = MeshEdges(Mesh=mesh_6)  # -> AllE, NakedE
panel_11 = Panel(merge_9)
sortcutmesh_9 = SortCutMesh(TriangulatedMeshOrCutMesh=mbridgecm_12)
item_28 = ListItem(List=meshedges_12.AllE, Index=panel_10, Wrap=True)
meshedges_14 = MeshEdges(Mesh=mesh_6)  # -> AllE, NakedE
move_3 = Move(Geometry=meshedges_14.NakedE, Motion=X_2)  # -> Geometry, Transform
move_4 = Move(Geometry=mesh_6, Motion=X_3)  # -> Geometry, Transform
panel_12 = Panel(merge_10)
meshcutbylines_7 = MeshCutWithCutLines(TriangulatedMeshOrCutMesh=wbweave_6, OpenCutLinesPolylines=item_28)
deccutmesh_3 = DeconstructCutMesh(TriangulatedMeshOrCutMesh=sortcutmesh_9)  # -> Vertices, Faces, Edges
sortcutmesh_10 = SortCutMesh(TriangulatedMeshOrCutMesh=meshcutbylines_7)
movecm_2 = MoveCutMesh(TriangulatedMeshOrCutMesh=meshcutbylines_6, MoveDirection=X_2)
crv_19 = Curve([<curve referenced from the Rhino model> x2])
crv_20 = Curve([<curve referenced from the Rhino model> x2])
number_slider_8 = Slider(100, range=0..100)
cutmeshedges_13 = CutMeshEdges(TriangulatedMeshOrCutMesh=sortcutmesh_10)  # -> MeshAllEdges, MeshNakedEdges
divide = DivideCurve(Curve=crv_19, Count=10, Kinks=False)  # -> Points, Tangents, Parameters
divide_2 = DivideCurve(Curve=crv_20, Count=10, Kinks=False)  # -> Points, Tangents, Parameters
mbridgecm_13 = MbridgeCM(TriangulatedMeshOrCutMesh=move_4.Geometry)
mesh_8 = Mesh(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)
number_slider_9 = Slider(1000, range=0..1000)
number_slider_10 = Slider(1000, range=0..1000)
move_5 = Move(Geometry=meshedges_13.NakedE, Motion=X_3)  # -> Geometry, Transform
bang = ExplodeTree(Data=divide.Points)  # -> Branch0, Branch1
developcm2_3 = DevelopCutMesh2(
    TriangulatedCutMesh=mesh_6,
    Iterations=Slider(10000, range=0..10000),
    XyMirror=False,
    YzMirror=False,
    ZxMirror=False,
    OuterBoundaryCurves=meshedges_14.NakedE,
    Alpha=0.1)
move_6 = Move(Geometry=merge_8, Motion=X_3)  # -> Geometry, Transform
bang_2 = ExplodeTree(Data=divide_2.Points)  # -> Branch0, Branch1
crv_21 = Curve(cutmeshedges_13.MeshNakedEdges)
developcm2_4 = DevelopCutMesh2(
    TriangulatedCutMesh=meshcutbylines_7,
    Iterations=Slider(100, range=0..100),
    XyMirror=False,
    YzMirror=False,
    ZxMirror=False,
    OuterBoundaryCurves=crv_21,
    Alpha=0.1)
number_slider_11 = Slider(1000, range=0..1000)
sortcutmesh_11 = SortCutMesh(TriangulatedMeshOrCutMesh=movecm_2)
scale = Scale(Geometry=mesh_8, Center=Point(0, 0, 0), Factor=Slider(20, range=0..100))  # -> Geometry, Transform
mesh_9 = Mesh(<mesh referenced from the Rhino model>)
number_slider_12 = Slider(0.4, range=0..1)
ln_3 = Line(StartPoint=bang.Branch0, EndPoint=bang.Branch1)
ln_4 = Line(StartPoint=bang_2.Branch0, EndPoint=bang_2.Branch1)
meshedges_15 = MeshEdges(Mesh=mesh_9)  # -> AllE, NakedE
mbridgecm_14 = MbridgeCM(TriangulatedMeshOrCutMesh=developcm2_3)
develop_3 = DevelopMesh(TriangulatedMesh=scale.Geometry, Count=Slider(10000, range=0..10000))  # -> ModifiedMesh, A
mesh_10 = Mesh(develop_3.ModifiedMesh)
mbridgecm_15 = MbridgeCM(TriangulatedMeshOrCutMesh=mesh_10)
deccutmesh_4 = DeconstructCutMesh(TriangulatedMeshOrCutMesh=sortcutmesh_11)  # -> Vertices, Faces, Edges
divide_3 = DivideCurve(Curve=ln_4, Count=10, Kinks=False)  # -> Points, Tangents, Parameters
sortcutmesh_12 = SortCutMesh(TriangulatedMeshOrCutMesh=mbridgecm_13)
developcm3_2 = DevelopCutMesh3(
    TriangulatedCutMesh=movecm_2,
    Iterations=Slider(10000, range=0..10000),
    XyMirror=False,
    YzMirror=False,
    ZxMirror=False,
    OuterBoundaryCurves=move_3.Geometry,
    Alpha=Slider(0.1, range=0..0.1))  # disabled
divide_4 = DivideCurve(Curve=ln_3, Count=10, Kinks=False)  # -> Points, Tangents, Parameters
mbridgecm_16 = MbridgeCM(TriangulatedMeshOrCutMesh=developcm2_4)  # disabled
sortcutmesh_13 = SortCutMesh(TriangulatedMeshOrCutMesh=mbridgecm_15)
crv_22 = Curve(meshedges_15.AllE)
cutmeshedges_14 = CutMeshEdges(TriangulatedMeshOrCutMesh=developcm2_4)  # -> MeshAllEdges, MeshNakedEdges
developcm2_5 = DevelopCutMesh2(
    TriangulatedCutMesh=movecm_2,
    Iterations=Slider(5000, range=0..10000),
    XyMirror=False,
    YzMirror=False,
    ZxMirror=False,
    OuterBoundaryCurves=move_3.Geometry,
    Alpha=Slider(0.01, range=0..0.1))  # disabled
meshnet6_3 = MeshNet6(TriangulatedMeshOrCutMesh=sortcutmesh_13)
mbridgecm_17 = MbridgeCM(TriangulatedMeshOrCutMesh=meshnet6_3)
developcm3_3 = DevelopCutMesh3(
    TriangulatedCutMesh=move_4.Geometry,
    Iterations=Slider(10000, range=0..10000),
    XyMirror=False,
    YzMirror=False,
    ZxMirror=False,
    OuterBoundaryCurves=move_5.Geometry,
    FixPointsCrv=move_6.Geometry,
    Alpha=1)  # disabled
shatter = Shatter(Curve=graft(ln_4), Parameters=divide_3.Parameters)
shatter_2 = Shatter(Curve=graft(ln_3), Parameters=divide_4.Parameters)
panel_13 = Panel(shatter_2)
developcm2_6 = DevelopCutMesh2(
    TriangulatedCutMesh=move_4.Geometry,
    Iterations=Slider(10000, range=0..10000),
    XyMirror=False,
    YzMirror=False,
    ZxMirror=False,
    OuterBoundaryCurves=move_5.Geometry,
    FixPointsCrv=move_6.Geometry,
    Alpha=0.1)  # disabled
mesh_11 = Mesh(<mesh referenced from the Rhino model>)
series_2 = Series(Start=0, Step=1, Count=10)
cutmeshedges_15 = CutMeshEdges(TriangulatedMeshOrCutMesh=sortcutmesh_13)  # -> flatten(MeshAllEdges), MeshNakedEdges
deccutmesh_5 = DeconstructCutMesh(TriangulatedMeshOrCutMesh=sortcutmesh_12)  # -> Vertices, Faces, Edges
meshnet4_7 = MeshNet4(TriangulatedMeshOrCutMesh=sortcutmesh_13)  # -> CutMesh, FeatureLinesPolylines
x_plus_one = XPlusOne(NumberX=series_2)
gcurvature_4 = GaussianCurvature(TriangulatedMesh=mbridgecm_16)
panel_14 = Panel("""26
50
74""")
cutmeshedges_16 = CutMeshEdges(TriangulatedMeshOrCutMesh=meshnet6_3)  # -> flatten(MeshAllEdges), MeshNakedEdges
meshedges_16 = MeshEdges(Mesh=mesh_11)  # -> AllE, NakedE
item_29 = ListItem(List=divide_3.Points, Index=x_plus_one, Wrap=True)
flip = FlipMatrix(Data=item_29)
sort_8 = SortList(Keys=gcurvature_4, ValuesA=gcurvature_4)  # -> Keys, ValuesA
len_12 = Length(Curve=cutmeshedges_15.MeshAllEdges)
item_30 = ListItem(List=divide_3.Points, Index=series_2, Wrap=True)
crv_23 = Curve(meshedges_16.NakedE)
len_13 = Length(Curve=cutmeshedges_16.MeshAllEdges)
subtraction_5 = Subtraction(A=len_13, B=len_12)

# ----
# 移動距離が大きかったもの
number_slider_13 = Slider(30, range=0..100)
deccutmesh_6 = DeconstructCutMesh(TriangulatedMeshOrCutMesh=developcm2_6)  # -> Vertices, Faces, Edges
dist = Distance(PointA=deccutmesh_5.Vertices, PointB=deccutmesh_6.Vertices)
lng = ListLength(List=dist)
series_3 = Series(Start=0, Step=1, Count=lng)
series_4 = Series(Start=0, Step=1, Count=number_slider_13)
x_plus_one_2 = XPlusOne(NumberX=series_4)
avr_11 = Average(Input=dist)
sort_9 = SortList(Keys=dist, ValuesA=series_3)  # -> Keys, ValuesA
neg = Negative(Value=x_plus_one_2)
item_31 = ListItem(List=sort_9.Keys, Index=0, Wrap=True)  # -> Item1, Item
item_32 = ListItem(List=sort_9.ValuesA, Index=neg, Wrap=True)
merge_11 = Merge(Data1=item_31.Item1, Data2=item_31.Item, Data3=avr_11)  # -> flatten(Result)
panel_15 = Panel(merge_11)
item_33 = ListItem(List=deccutmesh_6.Vertices, Index=item_32, Wrap=True)

# ----
# 移動距離が大きかったもの
number_slider_14 = Slider(30, range=0..100)
deccutmesh_7 = DeconstructCutMesh(TriangulatedMeshOrCutMesh=developcm3_3)  # -> Vertices, Faces, Edges
dist_2 = Distance(PointA=deccutmesh_5.Vertices, PointB=deccutmesh_7.Vertices)
lng_2 = ListLength(List=dist_2)
series_5 = Series(Start=0, Step=1, Count=lng_2)
series_6 = Series(Start=0, Step=1, Count=number_slider_14)
x_plus_one_3 = XPlusOne(NumberX=series_6)
avr_12 = Average(Input=dist_2)
sort_10 = SortList(Keys=dist_2, ValuesA=series_5)  # -> Keys, ValuesA
neg_2 = Negative(Value=x_plus_one_3)
item_34 = ListItem(List=sort_10.Keys, Index=0, Wrap=True)  # -> Item1, Item
item_35 = ListItem(List=sort_10.ValuesA, Index=neg_2, Wrap=True)
merge_12 = Merge(Data1=item_34.Item1, Data2=item_34.Item, Data3=avr_12)  # -> flatten(Result)
panel_16 = Panel(merge_12)
item_36 = ListItem(List=deccutmesh_7.Vertices, Index=item_35, Wrap=True)

item_37 = ListItem(List=cutmeshedges_14.MeshAllEdges, Index=panel_14, Wrap=True)
cull_i = CullIndex(List=flip, Indices="-1", Wrap=True)

# ----
# ガウス曲率が大きかったもの
cutmeshgcurvature = CutMeshGCurvature(TriangulatedMeshOrCutMesh=developcm3_2)
deccutmesh_8 = DeconstructCutMesh(TriangulatedMeshOrCutMesh=developcm3_2)  # -> Vertices, Faces, Edges
lng_3 = ListLength(List=cutmeshgcurvature)
abs_5 = Absolute(Value=cutmeshgcurvature)
series_7 = Series(Start=0, Step=1, Count=lng_3)
series_8 = Series(Start=0, Step=1, Count=Slider(100, range=0..100))
sort_11 = SortList(Keys=abs_5, ValuesA=series_7)  # -> Keys, ValuesA
x_plus_one_4 = XPlusOne(NumberX=series_8)
neg_3 = Negative(Value=x_plus_one_4)
item_38 = ListItem(List=sort_11.ValuesA, Index=neg_3, Wrap=True)
avr_13 = Average(Input=sort_11.Keys)
item_39 = ListItem(List=sort_11.Keys, Index=0, Wrap=True)  # -> Item1, Item
merge_13 = Merge(Data1=avr_13, Data2=item_39.Item1, Data3=item_39.Item)
panel_17 = Panel(merge_13)
item_40 = ListItem(List=deccutmesh_8.Vertices, Index=item_38, Wrap=True)

# ----
# 移動距離が大きかったもの
number_slider_15 = Slider(30, range=0..100)
deccutmesh_9 = DeconstructCutMesh(TriangulatedMeshOrCutMesh=developcm3_2)  # -> Vertices, Faces, Edges
dist_3 = Distance(PointA=deccutmesh_4.Vertices, PointB=deccutmesh_9.Vertices)
lng_4 = ListLength(List=dist_3)
series_9 = Series(Start=0, Step=1, Count=lng_4)
series_10 = Series(Start=0, Step=1, Count=number_slider_15)
x_plus_one_5 = XPlusOne(NumberX=series_10)
avr_14 = Average(Input=dist_3)
sort_12 = SortList(Keys=dist_3, ValuesA=series_9)  # -> Keys, ValuesA
neg_4 = Negative(Value=x_plus_one_5)
item_41 = ListItem(List=sort_12.Keys, Index=0, Wrap=True)  # -> Item1, Item
item_42 = ListItem(List=sort_12.ValuesA, Index=neg_4, Wrap=True)
merge_14 = Merge(Data1=item_41.Item1, Data2=item_41.Item, Data3=avr_14)  # -> flatten(Result)
panel_18 = Panel(merge_14)
item_43 = ListItem(List=deccutmesh_9.Vertices, Index=item_42, Wrap=True)

avr_15 = Average(Input=sort_8.ValuesA)

# ----
# ガウス曲率が大きかったもの
cutmeshgcurvature_2 = CutMeshGCurvature(TriangulatedMeshOrCutMesh=developcm2_5)
deccutmesh_10 = DeconstructCutMesh(TriangulatedMeshOrCutMesh=developcm2_5)  # -> Vertices, Faces, Edges
lng_5 = ListLength(List=cutmeshgcurvature_2)
abs_6 = Absolute(Value=cutmeshgcurvature_2)
series_11 = Series(Start=0, Step=1, Count=lng_5)
series_12 = Series(Start=0, Step=1, Count=Slider(59, range=0..100))
sort_13 = SortList(Keys=abs_6, ValuesA=series_11)  # -> Keys, ValuesA
x_plus_one_6 = XPlusOne(NumberX=series_12)
neg_5 = Negative(Value=x_plus_one_6)
item_44 = ListItem(List=sort_13.ValuesA, Index=neg_5, Wrap=True)
avr_16 = Average(Input=sort_13.Keys)
item_45 = ListItem(List=sort_13.Keys, Index=0, Wrap=True)  # -> Item1, Item
merge_15 = Merge(Data1=avr_16, Data2=item_45.Item1, Data3=item_45.Item)
panel_19 = Panel(merge_15)
item_46 = ListItem(List=deccutmesh_10.Vertices, Index=item_44, Wrap=True)

flip_2 = FlipMatrix(Data=item_30)
cull_i_2 = CullIndex(List=flip_2, Indices="0", Wrap=True)
ln_5 = Line(StartPoint=cull_i_2, EndPoint=cull_i)
wbweave_7 = WeaverbirdsMeshFromLinesWeaveBack(Lines=flatten([ln_5, shatter_2, shatter]), MaximumValence=4)
meshedges_17 = MeshEdges(Mesh=wbweave_7)  # -> AllE, NakedE
length_line = LengthLine(Line=meshedges_17.AllE, Strength=10)
show = Show(G=wbweave_7)
solver = Solver(GoalObjects=[length_line, grab, show], Reset=Button(), Threshold=1e-15, Tolerance=0.0001, On=Toggle(False))  # -> I, V, O
mesh_12 = Mesh(solver.O)
meshedges_18 = MeshEdges(Mesh=mesh_12)  # -> AllE, NakedE
len_14 = Length(Curve=meshedges_18.AllE)
mesh_13 = Mesh(mesh_12)
develop_4 = DevelopMesh(TriangulatedMesh=mesh_13, Count=Slider(10000, range=0..10000))  # -> ModifiedMesh, A; disabled

# ----
# 移動距離が大きかったもの
number_slider_16 = Slider(30, range=0..100)
deccutmesh_11 = DeconstructCutMesh(TriangulatedMeshOrCutMesh=developcm2_5)  # -> Vertices, Faces, Edges
dist_4 = Distance(PointA=deccutmesh_4.Vertices, PointB=deccutmesh_11.Vertices)
lng_6 = ListLength(List=dist_4)
series_13 = Series(Start=0, Step=1, Count=lng_6)
series_14 = Series(Start=0, Step=1, Count=number_slider_16)
x_plus_one_7 = XPlusOne(NumberX=series_14)
avr_17 = Average(Input=dist_4)
sort_14 = SortList(Keys=dist_4, ValuesA=series_13)  # -> Keys, ValuesA
neg_6 = Negative(Value=x_plus_one_7)
item_47 = ListItem(List=sort_14.Keys, Index=0, Wrap=True)  # -> Item1, Item
item_48 = ListItem(List=sort_14.ValuesA, Index=neg_6, Wrap=True)
merge_16 = Merge(Data1=item_47.Item1, Data2=item_47.Item, Data3=avr_17)  # -> flatten(Result)
panel_20 = Panel(merge_16)
item_49 = ListItem(List=deccutmesh_11.Vertices, Index=item_48, Wrap=True)

panel_21 = Panel(subtraction_5)
item_50 = ListItem(List=sort_8.ValuesA, Index=0, Wrap=True)  # -> Item1, Item
meshcutbylines_8 = MeshCutWithCutLines(TriangulatedMeshOrCutMesh=developcm2_4, OpenCutLinesPolylines=item_37)
merge_17 = Merge(Data1=item_50.Item1, Data2=item_50.Item, Data3=avr_15)
dividecutmesh_2 = DivideCutMesh(TriangulatedMeshOrCutMesh=meshcutbylines_8)
panel_22 = Panel(merge_17)

# ----
# Crane
cmesh_from_mesh_2 = CMeshFromMesh(Mesh=mesh_6)
developable_2 = Developable()
static_solver_2 = CraneStaticSolver(
    CMesh=cmesh_from_mesh_2,
    Constraints=developable_2,
    NRIteration=50,
    CGNRIteration=100,
    Threshold=1e-13,
    Solve=Toggle(True),
    IsRigidEdge=False,
    IsPanelFlat=True,
    IsFoldBlock=True,
    IsConstraint=True)  # -> CMesh, RigidOrigami, Residual
deconstruct_cmesh_2 = DeconstructCMesh(CMesh=static_solver_2.CMesh)  # -> Mesh, Mountain, Valley, Boundary, Unassigned, Triangulate, Edges, Inner
develop_mesh_4 = DevelopMesh(Mesh=deconstruct_cmesh_2.Mesh)  # -> DevelopMesh, FaceTree
gcurvature_5 = GaussianCurvature(TriangulatedMesh=deconstruct_cmesh_2.Mesh)
sort_15 = SortList(Keys=gcurvature_5, ValuesA=gcurvature_5)  # -> Keys, ValuesA
avr_18 = Average(Input=gcurvature_5)
item_51 = ListItem(List=sort_15.ValuesA, Index=0, Wrap=True)  # -> Item1, Item
merge_18 = Merge(Data1=item_51.Item1, Data2=item_51.Item, Data3=avr_18)
panel_23 = Panel(merge_18)

demesh = DeconstructMesh(Mesh=deconstruct_cmesh_2.Mesh)  # -> Vertices, Faces, Colours, Normals
demesh_2 = DeconstructMesh(Mesh=mesh_6)  # -> Vertices, Faces, Colours, Normals
dist_5 = Distance(PointA=demesh.Vertices, PointB=demesh_2.Vertices)
sort_16 = SortList(Keys=dist_5)  # -> Keys, ValuesA
avr_19 = Average(Input=dist_5)
item_52 = ListItem(List=sort_16.Keys, Index=0, Wrap=True)  # -> Item1, Item
merge_19 = Merge(Data1=item_52.Item, Data2=item_52.Item1, Data3=avr_19)
panel_24 = Panel(merge_19)

meshnet4_8 = MeshNet4(TriangulatedMeshOrCutMesh=dividecutmesh_2)  # -> CutMesh, FeatureLinesPolylines

# ----
# 最適化前
# ガウス曲率が大きかったもの
cutmeshgcurvature_3 = CutMeshGCurvature(TriangulatedMeshOrCutMesh=sortcutmesh_9)
abs_7 = Absolute(Value=cutmeshgcurvature_3)
lng_7 = ListLength(List=cutmeshgcurvature_3)
series_15 = Series(Start=0, Step=1, Count=lng_7)
series_16 = Series(Start=0, Step=1, Count=Slider(30, range=0..100))
sort_17 = SortList(Keys=abs_7, ValuesA=series_15)  # -> Keys, ValuesA
x_plus_one_8 = XPlusOne(NumberX=series_16)
neg_7 = Negative(Value=x_plus_one_8)
item_53 = ListItem(List=sort_17.ValuesA, Index=neg_7, Wrap=True)
avr_20 = Average(Input=sort_17.Keys)
item_54 = ListItem(List=sort_17.Keys, Index=0, Wrap=True)  # -> Item1, Item
merge_20 = Merge(Data1=avr_20, Data2=item_54.Item1, Data3=item_54.Item)
panel_25 = Panel(merge_20)
item_55 = ListItem(List=deccutmesh_3.Vertices, Index=item_53, Wrap=True)

mbridgecm_18 = MbridgeCM(TriangulatedMeshOrCutMesh=meshnet4_8.CutMesh)
X_4 = UnitX(Factor=Slider(400, range=0..100000))
msphere = MeshSphere(Base=PlaneXY(0, 0, 0), Radius=Slider(60, range=0..100), UCount=10, VCount=20)
item_56 = ListItem(List=mbridgecm_18, Index=0, Wrap=True)
move_7 = Move(Geometry=msphere, Motion=X_4)  # -> Geometry, Transform
move_8 = Move(Geometry=mbridgecm_18, Motion=Vector(0, 0, 10))  # -> Geometry, Transform
tri_2 = Triangulate(Mesh=move_7.Geometry)  # -> Mesh, Count
mbridgecm_19 = MbridgeCM(TriangulatedMeshOrCutMesh=deconstruct_cmesh_2.Mesh)
meshedges_19 = MeshEdges(Mesh=tri_2.Mesh)  # -> AllE, NakedE
crv_24 = Curve(meshedges_19.AllE)
crv_25 = Curve([<curve referenced from the Rhino model> x970])
number_slider_17 = Slider(23, range=0..100)
ハイブリッド = Mesh(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)
従来手法 = Mesh(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)
元形状 = Mesh(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)
新手法 = Mesh(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)
wbweave_8 = WeaverbirdsMeshFromLinesWeaveBack(Lines=crv_25, MaximumValence=4)
# 中間用
merge_21 = Merge(Data1=元形状, Data2=従来手法, Data3=新手法, Data4=ハイブリッド)  # -> flatten(Result)
X_5 = UnitX(Factor=Slider(534, range=0..1000))
move_9 = Move(Geometry=merge_21, Motion=X_5)  # -> Geometry, Transform

# ----
# 中間用
mesh_14 = Mesh(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)
mesh_15 = Mesh(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)
mesh_16 = Mesh(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)

item_57 = ListItem(List=move_9.Geometry, Index=0, Wrap=True)  # -> Item, Item1, Item2, Item3
mesh_17 = Mesh(item_57.Item)
meshedges_20 = MeshEdges(Mesh=mesh_16)  # -> AllE, NakedE
crv_26 = Curve([<curve referenced from the Rhino model> x26])
meshedges_21 = MeshEdges(Mesh=item_57.Item)  # -> AllE, NakedE
meshedges_22 = MeshEdges(Mesh=item_57.Item)  # -> AllE, NakedE
crv_27 = Curve([<curve referenced from the Rhino model> x10])
crv_28 = Curve([<curve referenced from the Rhino model> x220])
swatch = ColourSwatch(SwatchColor=RGBA(0, 0, 0, 130))
crv_29 = Curve(meshedges_22.AllE)
gcurvature_6 = GaussianCurvature(TriangulatedMesh=mesh_16)
previewlw = CustomPreviewLineweights(Geometry=meshedges_20.AllE, Shader=ColourSwatch(SwatchColor=RGBA(194, 194, 255, 0)), Absolute=False)
gcurvature_7 = GaussianCurvature(TriangulatedMesh=元形状)
wbweave_9 = WeaverbirdsMeshFromLinesWeaveBack(Lines=crv_28, MaximumValence=4)
meshedges_23 = MeshEdges(Mesh=mesh_14)  # -> AllE, NakedE
previewlw_2 = CustomPreviewLineweights(Geometry=meshedges_21.AllE, Shader=ColourSwatch(SwatchColor=RGBA(194, 194, 255, 0)), Absolute=False)
lng_8 = ListLength(List=gcurvature_6)
previewlw_3 = CustomPreviewLineweights(Geometry=crv_27, Shader=ColourSwatch(SwatchColor=RGB(87, 87, 212)), Thickness=Slider(3, range=0..10), Absolute=False)
previewlw_4 = CustomPreviewLineweights(Geometry=crv_26, Shader=ColourSwatch(SwatchColor=RGB(232, 174, 49)), Thickness=Slider(3, range=0..10), Absolute=False)
previewlw_5 = CustomPreviewLineweights(Geometry=crv_28, Shader=ColourSwatch(SwatchColor=RGBA(173, 173, 173, 130)), Absolute=False)
preview = CustomPreview(Geometry=wbweave_9, Material=ColourSwatch(SwatchColor=RGBA(52, 92, 65, 130)))
meshedges_24 = MeshEdges(Mesh=item_57.Item3)  # -> AllE, NakedE
sort_18 = SortList(Keys=gcurvature_6, ValuesA=gcurvature_6)  # -> Keys, ValuesA
lng_9 = ListLength(List=gcurvature_7)
meshedges_25 = MeshEdges(Mesh=wbweave_9)  # -> AllE, NakedE
sort_19 = SortList(Keys=gcurvature_7, ValuesA=gcurvature_7)  # -> Keys, ValuesA
avr_21 = Average(Input=gcurvature_6)
multiplication = Multiplication(A=lng_8, B=avr_21)
panel_26 = Panel(multiplication)
preview_2 = CustomPreview(
    Geometry=mesh_14,
    Material={diffuse=RGB(221, 160, 221), emission=RGB(66, 48, 66), shine=0.5, specular=RGB(255, 255, 255), transparency=0})
avr_22 = Average(Input=gcurvature_7)
multiplication_2 = Multiplication(A=lng_9, B=avr_22)
previewlw_6 = CustomPreviewLineweights(Geometry=meshedges_23.AllE, Shader=ColourSwatch(SwatchColor=RGB(0, 0, 0)), Absolute=False)
item_58 = ListItem(List=sort_18.ValuesA, Index=0, Wrap=True)  # -> Item1, Item
preview_3 = CustomPreview(
    Geometry=item_57.Item3,
    Material={diffuse=RGB(221, 160, 221), emission=RGB(66, 48, 66), shine=0.5, specular=RGB(255, 255, 255), transparency=0})
previewlw_7 = CustomPreviewLineweights(Geometry=meshedges_24.AllE, Shader=ColourSwatch(SwatchColor=RGB(0, 0, 0)), Absolute=False)
deccutmesh_12 = DeconstructCutMesh(TriangulatedMeshOrCutMesh=mbridgecm_19)  # -> Vertices, Faces, Edges
item_59 = ListItem(List=sort_19.ValuesA, Index=0, Wrap=True)  # -> Item1, Item
developcm2_7 = DevelopCutMesh2(
    TriangulatedCutMesh=wbweave_9,
    Iterations=Slider(100000, range=0..100000),
    XyMirror=False,
    YzMirror=False,
    ZxMirror=False,
    OuterBoundaryCurves=meshedges_25.NakedE,
    Alpha=0.1)
panel_27 = Panel(multiplication_2)
merge_22 = Merge(Data1=item_58.Item1, Data2=item_58.Item, Data3=avr_21)
mbridgecm_20 = MbridgeCM(TriangulatedMeshOrCutMesh=developcm2_7)
merge_23 = Merge(Data1=item_59.Item1, Data2=item_59.Item, Data3=avr_22)
meshedges_26 = MeshEdges(Mesh=mbridgecm_20)  # -> AllE, NakedE
preview_4 = CustomPreview(Geometry=mbridgecm_20, Material=ColourSwatch(SwatchColor=RGBA(52, 92, 65, 130)))
previewlw_8 = CustomPreviewLineweights(Geometry=meshedges_26.AllE, Shader=ColourSwatch(SwatchColor=RGBA(0, 0, 0, 130)), Absolute=False)
meshnet6_4 = MeshNet6(TriangulatedMeshOrCutMesh=<missing>)
meshnet6_5 = MeshNet6(TriangulatedMeshOrCutMesh=<missing>)
meshnet6_6 = MeshNet6(TriangulatedMeshOrCutMesh=<missing>)
meshnet6_7 = MeshNet6(TriangulatedMeshOrCutMesh=<missing>)
meshnet6_8 = MeshNet6(TriangulatedMeshOrCutMesh=<missing>)

# ----
# ガウス曲率が大きかったもの
cutmeshgcurvature_4 = CutMeshGCurvature(TriangulatedMeshOrCutMesh=developcm2_6)
deccutmesh_13 = DeconstructCutMesh(TriangulatedMeshOrCutMesh=developcm2_6)  # -> Vertices, Faces, Edges
lng_10 = ListLength(List=cutmeshgcurvature_4)
abs_8 = Absolute(Value=cutmeshgcurvature_4)
series_17 = Series(Start=0, Step=1, Count=lng_10)
series_18 = Series(Start=0, Step=1, Count=Slider(100, range=0..100))
sort_20 = SortList(Keys=abs_8, ValuesA=series_17)  # -> Keys, ValuesA
x_plus_one_9 = XPlusOne(NumberX=series_18)
neg_8 = Negative(Value=x_plus_one_9)
item_60 = ListItem(List=sort_20.ValuesA, Index=neg_8, Wrap=True)
avr_23 = Average(Input=sort_20.Keys)
item_61 = ListItem(List=sort_20.Keys, Index=0, Wrap=True)  # -> Item1, Item
item_62 = ListItem(List=deccutmesh_13.Vertices, Index=item_60, Wrap=True)

cull_i_3 = CullIndex(List=sort_20.Keys, Indices=neg_8, Wrap=True)
avr_24 = Average(Input=cull_i_3)

merge_24 = Merge(Data1=avr_23, Data2=item_61.Item1, Data3=item_61.Item, Data4=avr_24)  # -> flatten(Result)
panel_28 = Panel(merge_24)

# ----
# ガウス曲率が大きかったもの
cutmeshgcurvature_5 = CutMeshGCurvature(TriangulatedMeshOrCutMesh=developcm3_3)
deccutmesh_14 = DeconstructCutMesh(TriangulatedMeshOrCutMesh=developcm3_3)  # -> Vertices, Faces, Edges
lng_11 = ListLength(List=cutmeshgcurvature_5)
abs_9 = Absolute(Value=cutmeshgcurvature_5)
series_19 = Series(Start=0, Step=1, Count=lng_11)
series_20 = Series(Start=0, Step=1, Count=Slider(100, range=0..100))
sort_21 = SortList(Keys=abs_9, ValuesA=series_19)  # -> Keys, ValuesA
x_plus_one_10 = XPlusOne(NumberX=series_20)
neg_9 = Negative(Value=x_plus_one_10)
item_63 = ListItem(List=sort_21.ValuesA, Index=neg_9, Wrap=True)
item_64 = ListItem(List=sort_21.Keys, Index=0, Wrap=True)  # -> Item1, Item
avr_25 = Average(Input=sort_21.Keys)
item_65 = ListItem(List=deccutmesh_14.Vertices, Index=item_63, Wrap=True)

cull_i_4 = CullIndex(List=sort_21.Keys, Indices=neg_9, Wrap=True)
avr_26 = Average(Input=cull_i_4)

merge_25 = Merge(Data1=avr_25, Data2=item_64.Item1, Data3=item_64.Item, Data4=avr_26)  # -> flatten(Result)
panel_29 = Panel(merge_25)

# ----
# Selfのみ
number_slider_18 = Slider(10000, range=0..10000)
number_slider_19 = Slider(100000, range=0..100000)
develop_5 = DevelopMesh(TriangulatedMesh=mesh_6, Count=number_slider_18)  # -> ModifiedMesh, A
sortcutmesh_14 = SortCutMesh(TriangulatedMeshOrCutMesh=develop_5.ModifiedMesh)
deccutmesh_15 = DeconstructCutMesh(TriangulatedMeshOrCutMesh=sortcutmesh_14)  # -> Vertices, Faces, Edges

# ----
# ハイブリッド
number_slider_20 = Slider(100000, range=0..100000)
developcm2_8 = DevelopCutMesh2(
    TriangulatedCutMesh=mesh_6,
    Iterations=number_slider_20,
    XyMirror=False,
    YzMirror=False,
    ZxMirror=False,
    OuterBoundaryCurves=meshedges_14.NakedE,
    Alpha=0.1)
cutmeshedges_17 = CutMeshEdges(TriangulatedMeshOrCutMesh=developcm2_8)  # -> MeshAllEdges, MeshNakedEdges
crv_30 = Curve(cutmeshedges_17.MeshNakedEdges)
developcm3_4 = DevelopCutMesh3(
    TriangulatedCutMesh=developcm2_8,
    Iterations=Slider(10000, range=0..10000),
    XyMirror=False,
    YzMirror=False,
    ZxMirror=False,
    OuterBoundaryCurves=crv_30,
    Alpha=1)

mbridgecm_21 = MbridgeCM(TriangulatedMeshOrCutMesh=developcm3_4)
meshnet6_9 = MeshNet6(TriangulatedMeshOrCutMesh=developcm3_4)
cutmeshedges_18 = CutMeshEdges(TriangulatedMeshOrCutMesh=meshnet6_9)  # -> MeshAllEdges, MeshNakedEdges
cutmeshedges_19 = CutMeshEdges(TriangulatedMeshOrCutMesh=developcm3_4)  # -> MeshAllEdges, MeshNakedEdges
len_15 = Length(Curve=cutmeshedges_19.MeshAllEdges)
len_16 = Length(Curve=cutmeshedges_18.MeshAllEdges)
subtraction_6 = Subtraction(A=len_16, B=len_15)
abs_10 = Absolute(Value=subtraction_6)
sort_22 = SortList(Keys=abs_10)  # -> Keys, ValuesA
avr_27 = Average(Input=abs_10)
item_66 = ListItem(List=sort_22.Keys, Index=0, Wrap=True)  # -> Item1, Item
merge_26 = Merge(Data1=item_66.Item1, Data2=item_66.Item, Data3=avr_27)  # -> flatten(Result)
panel_30 = Panel(merge_26)

# ----
# Selfのみ
number_slider_21 = Slider(2000, range=0..10000)
developcm3_5 = DevelopCutMesh3(
    TriangulatedCutMesh=mesh_6,
    Iterations=number_slider_21,
    XyMirror=False,
    YzMirror=False,
    ZxMirror=False,
    OuterBoundaryCurves=meshedges_14.NakedE,
    Alpha=1)  # disabled
deccutmesh_16 = DeconstructCutMesh(TriangulatedMeshOrCutMesh=developcm3_5)  # -> Vertices, Faces, Edges

meshnet6_10 = MeshNet6(TriangulatedMeshOrCutMesh=developcm3_5)
meshnet4_9 = MeshNet4(TriangulatedMeshOrCutMesh=developcm3_5)  # -> CutMesh, FeatureLinesPolylines
cutmeshedges_20 = CutMeshEdges(TriangulatedMeshOrCutMesh=developcm3_5)  # -> MeshAllEdges, MeshNakedEdges
cutmeshedges_21 = CutMeshEdges(TriangulatedMeshOrCutMesh=meshnet6_10)  # -> MeshAllEdges, MeshNakedEdges
cutmeshedges_22 = CutMeshEdges(TriangulatedMeshOrCutMesh=meshnet4_9.CutMesh)  # -> MeshAllEdges, MeshNakedEdges
len_17 = Length(Curve=cutmeshedges_20.MeshAllEdges)
len_18 = Length(Curve=cutmeshedges_22.MeshAllEdges)
len_19 = Length(Curve=cutmeshedges_20.MeshAllEdges)
len_20 = Length(Curve=cutmeshedges_21.MeshAllEdges)
subtraction_7 = Subtraction(A=len_18, B=len_17)
subtraction_8 = Subtraction(A=len_20, B=len_19)
abs_11 = Absolute(Value=subtraction_7)
abs_12 = Absolute(Value=subtraction_8)
sort_23 = SortList(Keys=abs_11)  # -> Keys, ValuesA
avr_28 = Average(Input=abs_11)
sort_24 = SortList(Keys=abs_12)  # -> Keys, ValuesA
avr_29 = Average(Input=abs_12)
item_67 = ListItem(List=sort_23.Keys, Index=0, Wrap=True)  # -> Item1, Item
item_68 = ListItem(List=sort_24.Keys, Index=0, Wrap=True)  # -> Item1, Item
merge_27 = Merge(Data1=item_67.Item1, Data2=item_67.Item, Data3=avr_28)  # -> flatten(Result)
panel_31 = Panel(merge_27)
merge_28 = Merge(Data1=item_68.Item1, Data2=item_68.Item, Data3=avr_29)  # -> flatten(Result)
panel_32 = Panel(merge_28)

# ----
# ガウス曲率が大きかったもの
cutmeshgcurvature_6 = CutMeshGCurvature(TriangulatedMeshOrCutMesh=developcm2_8)
abs_13 = Absolute(Value=cutmeshgcurvature_6)
lng_12 = ListLength(List=cutmeshgcurvature_6)
series_21 = Series(Start=0, Step=1, Count=lng_12)
series_22 = Series(Start=0, Step=1, Count=Slider(30, range=0..100))
sort_25 = SortList(Keys=abs_13, ValuesA=series_21)  # -> Keys, ValuesA

# ----
# ガウス曲率が大きかったもの
cutmeshgcurvature_7 = CutMeshGCurvature(TriangulatedMeshOrCutMesh=sortcutmesh_14)
lng_13 = ListLength(List=cutmeshgcurvature_7)
abs_14 = Absolute(Value=cutmeshgcurvature_7)
series_23 = Series(Start=0, Step=1, Count=lng_13)
series_24 = Series(Start=0, Step=1, Count=Slider(59, range=0..100))
sort_26 = SortList(Keys=abs_14, ValuesA=series_23)  # -> Keys, ValuesA

# ----
# ガウス曲率が大きかったもの
cutmeshgcurvature_8 = CutMeshGCurvature(TriangulatedMeshOrCutMesh=developcm3_5)
abs_15 = Absolute(Value=cutmeshgcurvature_8)
lng_14 = ListLength(List=cutmeshgcurvature_8)
series_25 = Series(Start=0, Step=1, Count=lng_14)
series_26 = Series(Start=0, Step=1, Count=Slider(30, range=0..100))
sort_27 = SortList(Keys=abs_15, ValuesA=series_25)  # -> Keys, ValuesA

# ----
# 移動距離が大きかったもの
number_slider_22 = Slider(30, range=0..100)
deccutmesh_17 = DeconstructCutMesh(TriangulatedMeshOrCutMesh=sortcutmesh_14)  # -> Vertices, Faces, Edges
dist_6 = Distance(PointA=deccutmesh_3.Vertices, PointB=deccutmesh_17.Vertices)
lng_15 = ListLength(List=dist_6)
series_27 = Series(Start=0, Step=1, Count=lng_15)
series_28 = Series(Start=0, Step=1, Count=number_slider_22)
avr_30 = Average(Input=dist_6)
sort_28 = SortList(Keys=dist_6, ValuesA=series_27)  # -> Keys, ValuesA
item_69 = ListItem(List=sort_28.Keys, Index=0, Wrap=True)  # -> Item1, Item
merge_29 = Merge(Data1=item_69.Item1, Data2=item_69.Item, Data3=avr_30)  # -> flatten(Result)
panel_33 = Panel(merge_29)

x_plus_one_11 = XPlusOne(NumberX=series_28)
x_plus_one_12 = XPlusOne(NumberX=series_24)
avr_31 = Average(Input=sort_26.Keys)
item_70 = ListItem(List=sort_26.Keys, Index=0, Wrap=True)  # -> Item1, Item
merge_30 = Merge(Data1=avr_31, Data2=item_70.Item1, Data3=item_70.Item)

neg_10 = Negative(Value=x_plus_one_11)
item_71 = ListItem(List=sort_28.ValuesA, Index=neg_10, Wrap=True)
item_72 = ListItem(List=deccutmesh_3.Vertices, Index=item_71, Wrap=True)

neg_11 = Negative(Value=x_plus_one_12)
item_73 = ListItem(List=sort_26.ValuesA, Index=neg_11, Wrap=True)
panel_34 = Panel(merge_30)
item_74 = ListItem(List=deccutmesh_15.Vertices, Index=item_73, Wrap=True)

# ----
# 移動距離が大きかったもの
number_slider_23 = Slider(30, range=0..100)
deccutmesh_18 = DeconstructCutMesh(TriangulatedMeshOrCutMesh=developcm3_5)  # -> Vertices, Faces, Edges
dist_7 = Distance(PointA=deccutmesh_3.Vertices, PointB=deccutmesh_18.Vertices)
lng_16 = ListLength(List=dist_7)
series_29 = Series(Start=0, Step=1, Count=lng_16)
series_30 = Series(Start=0, Step=1, Count=number_slider_23)
avr_32 = Average(Input=dist_7)
sort_29 = SortList(Keys=dist_7, ValuesA=series_29)  # -> Keys, ValuesA
item_75 = ListItem(List=sort_29.Keys, Index=0, Wrap=True)  # -> Item1, Item
merge_31 = Merge(Data1=item_75.Item1, Data2=item_75.Item, Data3=avr_32)  # -> flatten(Result)
panel_35 = Panel(merge_31)

x_plus_one_13 = XPlusOne(NumberX=series_30)
x_plus_one_14 = XPlusOne(NumberX=series_26)
avr_33 = Average(Input=sort_27.Keys)
item_76 = ListItem(List=sort_27.Keys, Index=0, Wrap=True)  # -> Item1, Item
merge_32 = Merge(Data1=avr_33, Data2=item_76.Item1, Data3=item_76.Item)

neg_12 = Negative(Value=x_plus_one_13)
item_77 = ListItem(List=sort_29.ValuesA, Index=neg_12, Wrap=True)
item_78 = ListItem(List=deccutmesh_3.Vertices, Index=item_77, Wrap=True)

neg_13 = Negative(Value=x_plus_one_14)
item_79 = ListItem(List=sort_27.ValuesA, Index=neg_13, Wrap=True)
item_80 = ListItem(List=deccutmesh_16.Vertices, Index=item_79, Wrap=True)
panel_36 = Panel(merge_32)

# ----
# ガウス曲率が大きかったもの
cutmeshgcurvature_9 = CutMeshGCurvature(TriangulatedMeshOrCutMesh=developcm3_4)
abs_16 = Absolute(Value=cutmeshgcurvature_9)
lng_17 = ListLength(List=cutmeshgcurvature_9)
series_31 = Series(Start=0, Step=1, Count=lng_17)
series_32 = Series(Start=0, Step=1, Count=Slider(30, range=0..100))
sort_30 = SortList(Keys=abs_16, ValuesA=series_31)  # -> Keys, ValuesA

# ----
# 移動距離が大きかったもの
number_slider_24 = Slider(30, range=0..100)
deccutmesh_19 = DeconstructCutMesh(TriangulatedMeshOrCutMesh=developcm3_4)  # -> Vertices, Faces, Edges
dist_8 = Distance(PointA=deccutmesh_3.Vertices, PointB=deccutmesh_19.Vertices)
lng_18 = ListLength(List=dist_8)
series_33 = Series(Start=0, Step=1, Count=lng_18)
series_34 = Series(Start=0, Step=1, Count=number_slider_24)
avr_34 = Average(Input=dist_8)
sort_31 = SortList(Keys=dist_8, ValuesA=series_33)  # -> Keys, ValuesA
item_81 = ListItem(List=sort_31.Keys, Index=0, Wrap=True)  # -> Item1, Item
merge_33 = Merge(Data1=item_81.Item1, Data2=item_81.Item, Data3=avr_34)  # -> flatten(Result)
panel_37 = Panel(merge_33)

x_plus_one_15 = XPlusOne(NumberX=series_22)
x_plus_one_16 = XPlusOne(NumberX=series_34)
avr_35 = Average(Input=sort_25.Keys)
item_82 = ListItem(List=sort_25.Keys, Index=0, Wrap=True)  # -> Item1, Item
x_plus_one_17 = XPlusOne(NumberX=series_32)
merge_34 = Merge(Data1=avr_35, Data2=item_82.Item1, Data3=item_82.Item)
avr_36 = Average(Input=sort_30.Keys)
item_83 = ListItem(List=sort_30.Keys, Index=0, Wrap=True)  # -> Item1, Item
merge_35 = Merge(Data1=avr_36, Data2=item_83.Item1, Data3=item_83.Item)

neg_14 = Negative(Value=x_plus_one_15)
item_84 = ListItem(List=sort_25.ValuesA, Index=neg_14, Wrap=True)
panel_38 = Panel(merge_34)
item_85 = ListItem(List=deccutmesh_3.Vertices, Index=item_84, Wrap=True)

neg_15 = Negative(Value=x_plus_one_16)
item_86 = ListItem(List=sort_31.ValuesA, Index=neg_15, Wrap=True)
item_87 = ListItem(List=deccutmesh_3.Vertices, Index=item_86, Wrap=True)

neg_16 = Negative(Value=x_plus_one_17)
item_88 = ListItem(List=sort_30.ValuesA, Index=neg_16, Wrap=True)
item_89 = ListItem(List=deccutmesh_3.Vertices, Index=item_88, Wrap=True)
panel_39 = Panel(merge_35)

# ----
# ガウス曲率が大きかったもの
cutmeshgcurvature_10 = CutMeshGCurvature(TriangulatedMeshOrCutMesh=mbridgecm_19)
lng_19 = ListLength(List=cutmeshgcurvature_10)
abs_17 = Absolute(Value=cutmeshgcurvature_10)
series_35 = Series(Start=0, Step=1, Count=lng_19)
series_36 = Series(Start=0, Step=1, Count=Slider(59, range=0..100))
sort_32 = SortList(Keys=abs_17, ValuesA=series_35)  # -> Keys, ValuesA

x_plus_one_18 = XPlusOne(NumberX=series_36)
avr_37 = Average(Input=sort_32.Keys)
item_90 = ListItem(List=sort_32.Keys, Index=0, Wrap=True)  # -> Item1, Item
merge_36 = Merge(Data1=avr_37, Data2=item_90.Item1, Data3=item_90.Item)

neg_17 = Negative(Value=x_plus_one_18)
item_91 = ListItem(List=sort_32.ValuesA, Index=neg_17, Wrap=True)
panel_40 = Panel(merge_36)
item_92 = ListItem(List=deccutmesh_12.Vertices, Index=item_91, Wrap=True)

# ----
# Selfのみ
number_slider_25 = Slider(10000, range=0..10000)
number_slider_26 = Slider(100000, range=0..100000)
develop_6 = DevelopMesh(TriangulatedMesh=wbweave_9, Count=number_slider_25)  # -> ModifiedMesh, A
sortcutmesh_15 = SortCutMesh(TriangulatedMeshOrCutMesh=develop_6.ModifiedMesh)
deccutmesh_20 = DeconstructCutMesh(TriangulatedMeshOrCutMesh=sortcutmesh_15)  # -> Vertices, Faces, Edges

meshedges_27 = MeshEdges(Mesh=develop_6.ModifiedMesh)  # -> AllE, NakedE
preview_5 = CustomPreview(Geometry=develop_6.ModifiedMesh, Material=ColourSwatch(SwatchColor=RGBA(52, 92, 65, 130)))
previewlw_9 = CustomPreviewLineweights(Geometry=meshedges_27.AllE, Shader=ColourSwatch(SwatchColor=RGBA(0, 0, 0, 130)), Absolute=False)

# ----
# ガウス曲率が大きかったもの
cutmeshgcurvature_11 = CutMeshGCurvature(TriangulatedMeshOrCutMesh=developcm2_7)
abs_18 = Absolute(Value=cutmeshgcurvature_11)
lng_20 = ListLength(List=cutmeshgcurvature_11)
series_37 = Series(Start=0, Step=1, Count=lng_20)
series_38 = Series(Start=0, Step=1, Count=Slider(30, range=0..100))
sort_33 = SortList(Keys=abs_18, ValuesA=series_37)  # -> Keys, ValuesA

x_plus_one_19 = XPlusOne(NumberX=series_38)
avr_38 = Average(Input=sort_33.Keys)
item_93 = ListItem(List=sort_33.Keys, Index=0, Wrap=True)  # -> Item1, Item
merge_37 = Merge(Data1=avr_38, Data2=item_93.Item1, Data3=item_93.Item)

neg_18 = Negative(Value=x_plus_one_19)
item_94 = ListItem(List=sort_33.ValuesA, Index=neg_18, Wrap=True)
panel_41 = Panel(merge_37)
item_95 = ListItem(List=deccutmesh_3.Vertices, Index=item_94, Wrap=True)

# ----
# ガウス曲率が大きかったもの
cutmeshgcurvature_12 = CutMeshGCurvature(TriangulatedMeshOrCutMesh=sortcutmesh_15)
lng_21 = ListLength(List=cutmeshgcurvature_12)
abs_19 = Absolute(Value=cutmeshgcurvature_12)
series_39 = Series(Start=0, Step=1, Count=lng_21)
series_40 = Series(Start=0, Step=1, Count=Slider(59, range=0..100))
sort_34 = SortList(Keys=abs_19, ValuesA=series_39)  # -> Keys, ValuesA

# ----
# 移動距離が大きかったもの
number_slider_27 = Slider(30, range=0..100)
deccutmesh_21 = DeconstructCutMesh(TriangulatedMeshOrCutMesh=sortcutmesh_15)  # -> Vertices, Faces, Edges
dist_9 = Distance(PointA=deccutmesh_3.Vertices, PointB=deccutmesh_21.Vertices)
lng_22 = ListLength(List=dist_9)
series_41 = Series(Start=0, Step=1, Count=lng_22)
series_42 = Series(Start=0, Step=1, Count=number_slider_27)
avr_39 = Average(Input=dist_9)
sort_35 = SortList(Keys=dist_9, ValuesA=series_41)  # -> Keys, ValuesA
item_96 = ListItem(List=sort_35.Keys, Index=0, Wrap=True)  # -> Item1, Item
merge_38 = Merge(Data1=item_96.Item1, Data2=item_96.Item, Data3=avr_39)  # -> flatten(Result)
panel_42 = Panel(merge_38)

x_plus_one_20 = XPlusOne(NumberX=series_42)
x_plus_one_21 = XPlusOne(NumberX=series_40)
avr_40 = Average(Input=sort_34.Keys)
item_97 = ListItem(List=sort_34.Keys, Index=0, Wrap=True)  # -> Item1, Item
merge_39 = Merge(Data1=avr_40, Data2=item_97.Item1, Data3=item_97.Item)

neg_19 = Negative(Value=x_plus_one_20)
item_98 = ListItem(List=sort_35.ValuesA, Index=neg_19, Wrap=True)
item_99 = ListItem(List=deccutmesh_3.Vertices, Index=item_98, Wrap=True)

neg_20 = Negative(Value=x_plus_one_21)
item_100 = ListItem(List=sort_34.ValuesA, Index=neg_20, Wrap=True)
item_101 = ListItem(List=deccutmesh_20.Vertices, Index=item_100, Wrap=True)
panel_43 = Panel(merge_39)
