# Grasshopper definition DevTotal.gh (Grasshopper 1.0.8)
# plug-ins: Heteroptera, Pufferfish, Human, Crane, Hagoromo, Weaverbird, NGon_RH8

crv = Curve([<curve referenced from the Rhino model> x81])
project = Project(Geometry=crv, Plane=PlaneXY(0, 0, 0))  # -> Geometry, Transform
wbweave = WeaverbirdsMeshFromLinesWeaveBack(Lines=project.Geometry, MaximumValence=4)
meshedges = MeshEdges(Mesh=wbweave)  # -> AllE, NakedE
crv_2 = Curve(<curve referenced from the Rhino model>)
project_2 = Project(Geometry=crv_2, Plane=PlaneXY(0, 0, 0))  # -> Geometry, Transform
meshcutbylines = MeshCutWithCutLines(TriangulatedMeshOrCutMesh=wbweave, OpenCutLinesPolylines=project_2.Geometry)
X = UnitX(Factor=Slider(123, range=0..1000))
wbweave_2 = WeaverbirdsMeshFromLinesWeaveBack(Lines=crv, MaximumValence=4)
move = Move(Geometry=meshedges.NakedE, Motion=X)  # -> Geometry, Transform
mbridgecm = MbridgeCM(TriangulatedMeshOrCutMesh=wbweave_2)
movecm = MoveCutMesh(TriangulatedMeshOrCutMesh=meshcutbylines, MoveDirection=X)
meshedges_2 = MeshEdges(Mesh=wbweave_2)  # -> AllE, NakedE
meshcutbylines_2 = MeshCutWithCutLines(TriangulatedMeshOrCutMesh=wbweave_2, OpenCutLinesPolylines=crv_2)
developcm2 = DevelopCutMesh2(
    TriangulatedCutMesh=movecm,
    Iterations=Slider(100, range=0..100),
    XyMirror=False,
    YzMirror=False,
    ZxMirror=False,
    OuterBoundaryCurves=move.Geometry,
    Alpha=0.1)
number_slider = Slider(1000, range=0..1000)
sortcutmesh = SortCutMesh(TriangulatedMeshOrCutMesh=meshcutbylines_2)
cutmeshedges = CutMeshEdges(TriangulatedMeshOrCutMesh=developcm2)  # -> MeshAllEdges, MeshNakedEdges
number_slider_2 = Slider(1000, range=0..1000)
number_slider_3 = Slider(4560, range=0..10000)
item = ListItem(List=cutmeshedges.MeshAllEdges, Index="46", Wrap=True)
meshcutbylines_3 = MeshCutWithCutLines(TriangulatedMeshOrCutMesh=developcm2, OpenCutLinesPolylines=item)
developcm2_2 = DevelopCutMesh2(
    TriangulatedCutMesh=sortcutmesh,
    Iterations=Slider(2000, range=0..10000),
    XyMirror=False,
    YzMirror=False,
    ZxMirror=False,
    OuterBoundaryCurves=meshedges_2.NakedE,
    Alpha=0.1)
developcm3 = DevelopCutMesh3(
    TriangulatedCutMesh=sortcutmesh,
    Iterations=Slider(100, range=0..100),
    XyMirror=False,
    YzMirror=False,
    ZxMirror=False,
    OuterBoundaryCurves=meshedges_2.NakedE,
    Alpha=Slider(0.1, range=0..0.1))
cutmeshedges_2 = CutMeshEdges(TriangulatedMeshOrCutMesh=developcm3)  # -> MeshAllEdges, MeshNakedEdges
item_2 = ListItem(List=cutmeshedges_2.MeshAllEdges, Index="46", Wrap=True)
meshnet4 = MeshNet4(TriangulatedMeshOrCutMesh=meshcutbylines_3)  # -> CutMesh, FeatureLinesPolylines
meshcutbylines_4 = MeshCutWithCutLines(TriangulatedMeshOrCutMesh=developcm3, OpenCutLinesPolylines=item_2)
cutmeshedges_3 = CutMeshEdges(TriangulatedMeshOrCutMesh=developcm2_2)  # -> MeshAllEdges, MeshNakedEdges
center = Center(Geometry=wbweave_2)  # -> Center, Dimension
meshnet4_2 = MeshNet4(TriangulatedMeshOrCutMesh=meshcutbylines_4)  # -> CutMesh, FeatureLinesPolylines
mbridgecm_2 = MbridgeCM(TriangulatedMeshOrCutMesh=meshnet4.CutMesh)
item_3 = ListItem(List=cutmeshedges_3.MeshAllEdges, Index="46", Wrap=True)
X_2 = UnitX(Factor=Slider(400, range=0..100000))
msphere = MeshSphere(Base=PlaneXY(0, 0, 0), Radius=Slider(60, range=0..100), UCount=10, VCount=20)
meshcutbylines_5 = MeshCutWithCutLines(TriangulatedMeshOrCutMesh=developcm2_2, OpenCutLinesPolylines=item_3)
center_2 = Center(Geometry=mbridgecm_2)  # -> Center, Dimension
mbridgecm_3 = MbridgeCM(TriangulatedMeshOrCutMesh=meshnet4_2.CutMesh)
move_2 = Move(Geometry=msphere, Motion=X_2)  # -> Geometry, Transform
meshnet4_3 = MeshNet4(TriangulatedMeshOrCutMesh=meshcutbylines_5)  # -> CutMesh, FeatureLinesPolylines
center_3 = Center(Geometry=mbridgecm_3)  # -> Center, Dimension
center_4 = Center(Geometry=wbweave_2)  # -> Center, Dimension
move2pt = MoveToPoint(Geometry=mbridgecm_2, PointA=center_2.Center, PointB=center.Center)  # -> Moved, Vector, Transform
move2pt_2 = MoveToPoint(Geometry=mbridgecm_3, PointA=center_3.Center, PointB=center_4.Center)  # -> Moved, Vector, Transform
tri = Triangulate(Mesh=move_2.Geometry)  # -> Mesh, Count
center_5 = Center(Geometry=wbweave_2)  # -> Center, Dimension
mbridgecm_4 = MbridgeCM(TriangulatedMeshOrCutMesh=meshnet4_3.CutMesh)
center_6 = Center(Geometry=mbridgecm_4)  # -> Center, Dimension
meshedges_3 = MeshEdges(Mesh=tri.Mesh)  # -> AllE, NakedE
crv_3 = Curve(meshedges_3.AllE)
move2pt_3 = MoveToPoint(Geometry=mbridgecm_4, PointA=center_6.Center, PointB=center_5.Center)  # -> Moved, Vector, Transform
meshnet6 = MeshNet6(TriangulatedMeshOrCutMesh=<missing>)
mesh = Mesh(<mesh referenced from the Rhino model>)
meshedges_4 = MeshEdges(Mesh=mesh)  # -> AllE, NakedE
preview = CustomPreview(Geometry=mesh, Material=ColourSwatch(SwatchColor=RGBA(173, 173, 173, 130)))
previewlw = CustomPreviewLineweights(Geometry=meshedges_4.AllE, Shader=ColourSwatch(SwatchColor=RGBA(173, 173, 173, 130)), Absolute=False)
meshnet6_2 = MeshNet6(TriangulatedMeshOrCutMesh=<missing>)
crv_4 = Curve([<curve referenced from the Rhino model> x2])
join = JoinCurves(Curves=crv_4, Preserve=False)
crv_5 = Curve(<curve referenced from the Rhino model>)
crv_6 = Curve(<curve referenced from the Rhino model>)
crv_7 = Curve(<curve referenced from the Rhino model>)
crv_8 = Curve(<curve referenced from the Rhino model>)
merge = Merge(Data1=join, Data2=crv_7, Data3=crv_6, Data4=crv_5, Data5=crv_8)  # -> flatten(Result)
meshcutbylines_6 = MeshCutWithCutLines(TriangulatedMeshOrCutMesh=mesh, OpenCutLinesPolylines=merge)
X_3 = UnitX(Factor=Slider(194, range=0..1000))
X_4 = UnitX(Factor=Slider(2000, range=0..10000))
meshedges_5 = MeshEdges(Mesh=mesh)  # -> AllE, NakedE
move_3 = Move(Geometry=mesh, Motion=X_4)  # -> Geometry, Transform
movecm_2 = MoveCutMesh(TriangulatedMeshOrCutMesh=meshcutbylines_6, MoveDirection=X_3)
mbridgecm_5 = MbridgeCM(TriangulatedMeshOrCutMesh=move_3.Geometry)
number_slider_4 = Slider(1000, range=0..1000)
number_slider_5 = Slider(1000, range=0..1000)
move_4 = Move(Geometry=meshedges_5.NakedE, Motion=X_4)  # -> Geometry, Transform
move_5 = Move(Geometry=merge, Motion=X_4)  # -> Geometry, Transform
number_slider_6 = Slider(1000, range=0..1000)
sortcutmesh_2 = SortCutMesh(TriangulatedMeshOrCutMesh=movecm_2)
number_slider_7 = Slider(0.4, range=0..1)
deccutmesh = DeconstructCutMesh(TriangulatedMeshOrCutMesh=sortcutmesh_2)  # -> Vertices, Faces, Edges
sortcutmesh_3 = SortCutMesh(TriangulatedMeshOrCutMesh=mbridgecm_5)
developcm3_2 = DevelopCutMesh3(
    TriangulatedCutMesh=move_3.Geometry,
    Iterations=Slider(10000, range=0..10000),
    XyMirror=False,
    YzMirror=False,
    ZxMirror=False,
    OuterBoundaryCurves=move_4.Geometry,
    FixPointsCrv=move_5.Geometry,
    Alpha=1)  # disabled
developcm2_3 = DevelopCutMesh2(
    TriangulatedCutMesh=move_3.Geometry,
    Iterations=Slider(10000, range=0..10000),
    XyMirror=False,
    YzMirror=False,
    ZxMirror=False,
    OuterBoundaryCurves=move_4.Geometry,
    FixPointsCrv=move_5.Geometry,
    Alpha=0.1)  # disabled
deccutmesh_2 = DeconstructCutMesh(TriangulatedMeshOrCutMesh=sortcutmesh_3)  # -> Vertices, Faces, Edges
cutmeshgcurvature = CutMeshGCurvature(TriangulatedMeshOrCutMesh=developcm2_3)
cutmeshgcurvature_2 = CutMeshGCurvature(TriangulatedMeshOrCutMesh=developcm3_2)
deccutmesh_3 = DeconstructCutMesh(TriangulatedMeshOrCutMesh=developcm2_3)  # -> Vertices, Faces, Edges
deccutmesh_4 = DeconstructCutMesh(TriangulatedMeshOrCutMesh=developcm3_2)  # -> Vertices, Faces, Edges
dist = Distance(PointA=deccutmesh_2.Vertices, PointB=deccutmesh_3.Vertices)
lng = ListLength(List=dist)
dist_2 = Distance(PointA=deccutmesh_2.Vertices, PointB=deccutmesh_4.Vertices)
lng_2 = ListLength(List=dist_2)
deccutmesh_5 = DeconstructCutMesh(TriangulatedMeshOrCutMesh=developcm2_3)  # -> Vertices, Faces, Edges
deccutmesh_6 = DeconstructCutMesh(TriangulatedMeshOrCutMesh=developcm3_2)  # -> Vertices, Faces, Edges
lng_3 = ListLength(List=cutmeshgcurvature)
lng_4 = ListLength(List=cutmeshgcurvature_2)
series = Series(Start=0, Step=1, Count=lng)
series_2 = Series(Start=0, Step=1, Count=lng_2)
series_3 = Series(Start=0, Step=1, Count=Slider(30, range=0..100))
series_4 = Series(Start=0, Step=1, Count=Slider(30, range=0..100))
x_plus_one = XPlusOne(NumberX=series_3)
x_plus_one_2 = XPlusOne(NumberX=series_4)
series_5 = Series(Start=0, Step=1, Count=Slider(30, range=0..100))
abs = Absolute(Value=cutmeshgcurvature)
abs_2 = Absolute(Value=cutmeshgcurvature_2)
series_6 = Series(Start=0, Step=1, Count=lng_3)
series_7 = Series(Start=0, Step=1, Count=lng_4)
x_plus_one_3 = XPlusOne(NumberX=series_5)
series_8 = Series(Start=0, Step=1, Count=Slider(30, range=0..100))
x_plus_one_4 = XPlusOne(NumberX=series_8)
series_9 = Series(Start=0, Step=1, Count=Slider(100, range=0..100))
series_10 = Series(Start=0, Step=1, Count=Slider(100, range=0..100))
avr = Average(Input=dist)
avr_2 = Average(Input=dist_2)
sort = SortList(Keys=dist, ValuesA=series)  # -> Keys, ValuesA
sort_2 = SortList(Keys=dist_2, ValuesA=series_2)  # -> Keys, ValuesA
series_11 = Series(Start=0, Step=1, Count=Slider(100, range=0..100))
series_12 = Series(Start=0, Step=1, Count=Slider(59, range=0..100))
neg = Negative(Value=x_plus_one)
neg_2 = Negative(Value=x_plus_one_2)
sort_3 = SortList(Keys=abs, ValuesA=series_6)  # -> Keys, ValuesA
sort_4 = SortList(Keys=abs_2, ValuesA=series_7)  # -> Keys, ValuesA
neg_3 = Negative(Value=x_plus_one_3)
x_plus_one_5 = XPlusOne(NumberX=series_9)
x_plus_one_6 = XPlusOne(NumberX=series_10)
item_4 = ListItem(List=sort.Keys, Index=0, Wrap=True)  # -> Item1, Item
item_5 = ListItem(List=sort_2.Keys, Index=0, Wrap=True)  # -> Item1, Item
x_plus_one_7 = XPlusOne(NumberX=series_11)
neg_4 = Negative(Value=x_plus_one_4)
x_plus_one_8 = XPlusOne(NumberX=series_12)
neg_5 = Negative(Value=x_plus_one_5)
neg_6 = Negative(Value=x_plus_one_6)
item_6 = ListItem(List=sort.ValuesA, Index=neg, Wrap=True)
item_7 = ListItem(List=sort_2.ValuesA, Index=neg_2, Wrap=True)
neg_7 = Negative(Value=x_plus_one_7)
neg_8 = Negative(Value=x_plus_one_8)
cull_i = CullIndex(List=sort_4.Keys, Indices=neg_6, Wrap=True)
merge_2 = Merge(Data1=item_4.Item1, Data2=item_4.Item, Data3=avr)  # -> flatten(Result)
merge_3 = Merge(Data1=item_5.Item1, Data2=item_5.Item, Data3=avr_2)  # -> flatten(Result)
item_8 = ListItem(List=sort_3.ValuesA, Index=neg_5, Wrap=True)
item_9 = ListItem(List=sort_4.ValuesA, Index=neg_6, Wrap=True)
avr_3 = Average(Input=sort_3.Keys)
cull_i_2 = CullIndex(List=sort_3.Keys, Indices=neg_5, Wrap=True)
item_10 = ListItem(List=sort_3.Keys, Index=0, Wrap=True)  # -> Item1, Item
item_11 = ListItem(List=sort_4.Keys, Index=0, Wrap=True)  # -> Item1, Item
avr_4 = Average(Input=sort_4.Keys)
avr_5 = Average(Input=cull_i)
avr_6 = Average(Input=cull_i_2)
panel = Panel(merge_2)
panel_2 = Panel(merge_3)
merge_4 = Merge(Data1=avr_3, Data2=item_10.Item1, Data3=item_10.Item, Data4=avr_6)  # -> flatten(Result)
merge_5 = Merge(Data1=avr_4, Data2=item_11.Item1, Data3=item_11.Item, Data4=avr_5)  # -> flatten(Result)
item_12 = ListItem(List=deccutmesh_3.Vertices, Index=item_6, Wrap=True)
item_13 = ListItem(List=deccutmesh_4.Vertices, Index=item_7, Wrap=True)
panel_3 = Panel(merge_4)
item_14 = ListItem(List=deccutmesh_5.Vertices, Index=item_8, Wrap=True)
panel_4 = Panel(merge_5)
item_15 = ListItem(List=deccutmesh_6.Vertices, Index=item_9, Wrap=True)
demesh = DeconstructMesh()  # -> Vertices, Faces, Colours, Normals
mesh_2 = Mesh(mesh)
gcurvature = GaussianCurvature(TriangulatedMesh=mesh_2)
demesh_2 = DeconstructMesh(Mesh=mesh_2)  # -> Vertices, Faces, Colours, Normals
number_slider_8 = Slider(1.5, range=0..10)
division = Division(B=4)  # -> flatten(Result)
dist_3 = Distance(PointA=demesh.Vertices, PointB=demesh_2.Vertices)
abs_3 = Absolute(Value=gcurvature)
number_slider_9 = Slider(0.6, range=0..1)
sort_5 = SortList(Keys=abs_3)  # -> Keys, ValuesA
item_16 = ListItem(List=sort_5.Keys, Index=0, Wrap=True)  # -> Item1, Item
avr_7 = Average(Input=abs_3)
gradient = Gradient(
    LowerLimit=item_16.Item,
    UpperLimit=Slider(0.12, range=0..1),
    Parameter=gcurvature,
    stops=[0: RGB(234, 38, 0), 0.25: RGB(234, 126, 0), 0.5: RGB(254, 244, 84), 0.75: RGB(173, 203, 249), 1: RGB(75, 107, 169)])
panel_5 = Panel(avr_7)
msphere_2 = MeshSphere(Base=PlaneXY(0, 0, 0), Radius=Slider(50, range=0..1000), UCount=10, VCount=20)
wbweave_3 = WeaverbirdsMeshFromLinesWeaveBack(MaximumValence=4)
tri_2 = Triangulate(Mesh=msphere_2)  # -> Mesh, Count
meshedges_6 = MeshEdges(Mesh=tri_2.Mesh)  # -> AllE, NakedE
mbridgecm_6 = MbridgeCM(TriangulatedMeshOrCutMesh=mesh)

# ----
# 中間用
mesh_3 = Mesh(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)
mesh_4 = Mesh(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)
mesh_5 = Mesh(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)

meshedges_7 = MeshEdges(Mesh=mesh_5)  # -> AllE, NakedE
meshnet6_3 = MeshNet6(TriangulatedMeshOrCutMesh=<missing>)
crv_9 = Curve(meshedges_6.AllE)
meshnet6_4 = MeshNet6(TriangulatedMeshOrCutMesh=<missing>)
mcol = MeshColours(Mesh=mesh_2, Colours=gradient)
sortcutmesh_4 = SortCutMesh(TriangulatedMeshOrCutMesh=mbridgecm_6)
meshedges_8 = MeshEdges(Mesh=mesh)  # -> AllE, NakedE
move_6 = Move(Geometry=meshedges_8.NakedE, Motion=X_3)  # -> Geometry, Transform
developcm3_3 = DevelopCutMesh3(
    TriangulatedCutMesh=movecm_2,
    Iterations=Slider(10000, range=0..10000),
    XyMirror=False,
    YzMirror=False,
    ZxMirror=False,
    OuterBoundaryCurves=move_6.Geometry,
    Alpha=Slider(0.1, range=0..0.1))  # disabled
developcm2_4 = DevelopCutMesh2(
    TriangulatedCutMesh=movecm_2,
    Iterations=Slider(5000, range=0..10000),
    XyMirror=False,
    YzMirror=False,
    ZxMirror=False,
    OuterBoundaryCurves=move_6.Geometry,
    Alpha=Slider(0.01, range=0..0.1))  # disabled
cutmeshgcurvature_3 = CutMeshGCurvature(TriangulatedMeshOrCutMesh=developcm3_3)
deccutmesh_7 = DeconstructCutMesh(TriangulatedMeshOrCutMesh=developcm3_3)  # -> Vertices, Faces, Edges
cutmeshgcurvature_4 = CutMeshGCurvature(TriangulatedMeshOrCutMesh=developcm2_4)
deccutmesh_8 = DeconstructCutMesh(TriangulatedMeshOrCutMesh=developcm2_4)  # -> Vertices, Faces, Edges
dist_4 = Distance(PointA=deccutmesh.Vertices, PointB=deccutmesh_7.Vertices)
lng_5 = ListLength(List=dist_4)
deccutmesh_9 = DeconstructCutMesh(TriangulatedMeshOrCutMesh=developcm3_3)  # -> Vertices, Faces, Edges
deccutmesh_10 = DeconstructCutMesh(TriangulatedMeshOrCutMesh=developcm2_4)  # -> Vertices, Faces, Edges
dist_5 = Distance(PointA=deccutmesh.Vertices, PointB=deccutmesh_8.Vertices)
lng_6 = ListLength(List=dist_5)
lng_7 = ListLength(List=cutmeshgcurvature_3)
lng_8 = ListLength(List=cutmeshgcurvature_4)
series_13 = Series(Start=0, Step=1, Count=lng_5)
series_14 = Series(Start=0, Step=1, Count=lng_6)
abs_4 = Absolute(Value=cutmeshgcurvature_3)
series_15 = Series(Start=0, Step=1, Count=lng_7)
abs_5 = Absolute(Value=cutmeshgcurvature_4)
series_16 = Series(Start=0, Step=1, Count=lng_8)
avr_8 = Average(Input=dist_4)
sort_6 = SortList(Keys=dist_4, ValuesA=series_13)  # -> Keys, ValuesA
avr_9 = Average(Input=dist_5)
sort_7 = SortList(Keys=dist_5, ValuesA=series_14)  # -> Keys, ValuesA
sort_8 = SortList(Keys=abs_4, ValuesA=series_15)  # -> Keys, ValuesA
sort_9 = SortList(Keys=abs_5, ValuesA=series_16)  # -> Keys, ValuesA
item_17 = ListItem(List=sort_6.Keys, Index=0, Wrap=True)  # -> Item1, Item
item_18 = ListItem(List=sort_6.ValuesA, Index=neg_3, Wrap=True)
item_19 = ListItem(List=sort_7.Keys, Index=0, Wrap=True)  # -> Item1, Item
item_20 = ListItem(List=sort_7.ValuesA, Index=neg_4, Wrap=True)
merge_6 = Merge(Data1=item_17.Item1, Data2=item_17.Item, Data3=avr_8)  # -> flatten(Result)
item_21 = ListItem(List=sort_8.ValuesA, Index=neg_7, Wrap=True)
item_22 = ListItem(List=sort_9.ValuesA, Index=neg_8, Wrap=True)
merge_7 = Merge(Data1=item_19.Item1, Data2=item_19.Item, Data3=avr_9)  # -> flatten(Result)
avr_10 = Average(Input=sort_8.Keys)
item_23 = ListItem(List=sort_8.Keys, Index=0, Wrap=True)  # -> Item1, Item
avr_11 = Average(Input=sort_9.Keys)
item_24 = ListItem(List=sort_9.Keys, Index=0, Wrap=True)  # -> Item1, Item
panel_6 = Panel(merge_6)
merge_8 = Merge(Data1=avr_10, Data2=item_23.Item1, Data3=item_23.Item)
item_25 = ListItem(List=deccutmesh_7.Vertices, Index=item_18, Wrap=True)
merge_9 = Merge(Data1=avr_11, Data2=item_24.Item1, Data3=item_24.Item)
panel_7 = Panel(merge_7)
item_26 = ListItem(List=deccutmesh_8.Vertices, Index=item_20, Wrap=True)
panel_8 = Panel(merge_8)
item_27 = ListItem(List=deccutmesh_9.Vertices, Index=item_21, Wrap=True)
panel_9 = Panel(merge_9)
item_28 = ListItem(List=deccutmesh_10.Vertices, Index=item_22, Wrap=True)
gcurvature_2 = GaussianCurvature(TriangulatedMesh=mesh_5)
previewlw_2 = CustomPreviewLineweights(Geometry=meshedges_7.AllE, Shader=ColourSwatch(SwatchColor=RGBA(194, 194, 255, 0)), Absolute=False)
meshedges_9 = MeshEdges(Mesh=mesh_3)  # -> AllE, NakedE
deccutmesh_11 = DeconstructCutMesh(TriangulatedMeshOrCutMesh=sortcutmesh_4)  # -> Vertices, Faces, Edges
lng_9 = ListLength(List=gcurvature_2)
sort_10 = SortList(Keys=gcurvature_2, ValuesA=gcurvature_2)  # -> Keys, ValuesA
avr_12 = Average(Input=gcurvature_2)
multiplication = Multiplication(A=lng_9, B=avr_12)
preview_2 = CustomPreview(
    Geometry=mesh_3,
    Material={diffuse=RGB(221, 160, 221), emission=RGB(66, 48, 66), shine=0.5, specular=RGB(255, 255, 255), transparency=0})
previewlw_3 = CustomPreviewLineweights(Geometry=meshedges_9.AllE, Shader=ColourSwatch(SwatchColor=RGB(0, 0, 0)), Absolute=False)
item_29 = ListItem(List=sort_10.ValuesA, Index=0, Wrap=True)  # -> Item1, Item
panel_10 = Panel(multiplication)
crv_10 = Curve([<curve referenced from the Rhino model> x220])
swatch = ColourSwatch(SwatchColor=RGBA(0, 0, 0, 130))
merge_10 = Merge(Data1=item_29.Item1, Data2=item_29.Item, Data3=avr_12)
wbweave_4 = WeaverbirdsMeshFromLinesWeaveBack(Lines=crv_10, MaximumValence=4)
mesh_6 = Mesh(wbweave_4)
preview_3 = CustomPreview(Geometry=wbweave_4, Material=ColourSwatch(SwatchColor=RGBA(52, 92, 65, 130)))
previewlw_4 = CustomPreviewLineweights(Geometry=crv_10, Shader=ColourSwatch(SwatchColor=RGBA(173, 173, 173, 130)), Absolute=False)
number_slider_10 = Slider(100000, range=0..100000)
meshedges_10 = MeshEdges(Mesh=wbweave_4)  # -> AllE, NakedE
number_slider_11 = Slider(10000, range=0..10000)
# Selfのみ
number_slider_12 = Slider(100000, range=0..100000)
developcm2_5 = DevelopCutMesh2(
    TriangulatedCutMesh=wbweave_4,
    Iterations=Slider(400000, range=0..1000000),
    XyMirror=False,
    YzMirror=False,
    ZxMirror=False,
    OuterBoundaryCurves=meshedges_10.NakedE,
    Alpha=0.1)
sortcutmesh_5 = SortCutMesh(TriangulatedMeshOrCutMesh=developcm2_5)
mbridgecm_7 = MbridgeCM(TriangulatedMeshOrCutMesh=sortcutmesh_5)
mesh_7 = Mesh(mbridgecm_7)
develop = DevelopMesh(TriangulatedMesh=wbweave_4, Count=number_slider_12)  # -> ModifiedMesh, A
mesh_8 = Mesh(develop.ModifiedMesh)
mbridgecm_8 = MbridgeCM(TriangulatedMeshOrCutMesh=developcm2_5)
sortcutmesh_6 = SortCutMesh(TriangulatedMeshOrCutMesh=wbweave_4)
deccutmesh_12 = DeconstructCutMesh(TriangulatedMeshOrCutMesh=sortcutmesh_6)  # -> Vertices, Faces, Edges
cutmeshgcurvature_5 = CutMeshGCurvature(TriangulatedMeshOrCutMesh=developcm2_5)
sortcutmesh_7 = SortCutMesh(TriangulatedMeshOrCutMesh=develop.ModifiedMesh)
meshedges_11 = MeshEdges(Mesh=develop.ModifiedMesh)  # -> AllE, NakedE
preview_4 = CustomPreview(Geometry=develop.ModifiedMesh, Material=ColourSwatch(SwatchColor=RGBA(52, 92, 65, 130)))
deccutmesh_13 = DeconstructCutMesh(TriangulatedMeshOrCutMesh=sortcutmesh_5)  # -> Vertices, Faces, Edges
previewlw_5 = CustomPreviewLineweights(Geometry=meshedges_11.AllE, Shader=ColourSwatch(SwatchColor=RGBA(0, 0, 0, 130)), Absolute=False)
abs_6 = Absolute(Value=cutmeshgcurvature_5)
lng_10 = ListLength(List=cutmeshgcurvature_5)
demesh_3 = DeconstructMesh()  # -> Vertices, Faces, Colours, Normals
meshedges_12 = MeshEdges(Mesh=mbridgecm_8)  # -> AllE, NakedE
cutmeshgcurvature_6 = CutMeshGCurvature(TriangulatedMeshOrCutMesh=sortcutmesh_7)
deccutmesh_14 = DeconstructCutMesh(TriangulatedMeshOrCutMesh=sortcutmesh_7)  # -> Vertices, Faces, Edges
series_17 = Series(Start=0, Step=1, Count=lng_10)
series_18 = Series(Start=0, Step=1, Count=Slider(30, range=0..100))
deccutmesh_15 = DeconstructCutMesh(TriangulatedMeshOrCutMesh=sortcutmesh_7)  # -> Vertices, Faces, Edges
preview_5 = CustomPreview(Geometry=mbridgecm_8, Material=ColourSwatch(SwatchColor=RGBA(52, 92, 65, 130)))
previewlw_6 = CustomPreviewLineweights(Geometry=meshedges_12.AllE, Shader=ColourSwatch(SwatchColor=RGBA(0, 0, 0, 130)), Absolute=False)
x_plus_one_9 = XPlusOne(NumberX=series_18)
lng_11 = ListLength(List=cutmeshgcurvature_6)
dist_6 = Distance(PointA=deccutmesh_12.Vertices, PointB=deccutmesh_13.Vertices)
lng_12 = ListLength(List=dist_6)
sort_11 = SortList(Keys=abs_6, ValuesA=series_17)  # -> Keys, ValuesA
neg_9 = Negative(Value=x_plus_one_9)
abs_7 = Absolute(Value=cutmeshgcurvature_6)
series_19 = Series(Start=0, Step=1, Count=lng_12)
series_20 = Series(Start=0, Step=1, Count=lng_11)
series_21 = Series(Start=0, Step=1, Count=Slider(30, range=0..100))
item_30 = ListItem(List=sort_11.ValuesA, Index=neg_9, Wrap=True)
series_22 = Series(Start=0, Step=1, Count=Slider(59, range=0..100))
x_plus_one_10 = XPlusOne(NumberX=series_21)
avr_13 = Average(Input=sort_11.Keys)
item_31 = ListItem(List=sort_11.Keys, Index=0, Wrap=True)  # -> Item1, Item
avr_14 = Average(Input=dist_6)
x_plus_one_11 = XPlusOne(NumberX=series_22)
sort_12 = SortList(Keys=abs_7, ValuesA=series_20)  # -> Keys, ValuesA
sort_13 = SortList(Keys=dist_6, ValuesA=series_19)  # -> Keys, ValuesA
neg_10 = Negative(Value=x_plus_one_10)
merge_11 = Merge(Data1=avr_13, Data2=item_31.Item1, Data3=item_31.Item)
neg_11 = Negative(Value=x_plus_one_11)
item_32 = ListItem(List=sort_13.Keys, Index=0, Wrap=True)  # -> Item1, Item
item_33 = ListItem(List=sort_13.ValuesA, Index=neg_10, Wrap=True)
item_34 = ListItem(List=sort_12.ValuesA, Index=neg_11, Wrap=True)
avr_15 = Average(Input=sort_12.Keys)
item_35 = ListItem(List=sort_12.Keys, Index=0, Wrap=True)  # -> Item1, Item
panel_11 = Panel(merge_11)
merge_12 = Merge(Data1=item_32.Item1, Data2=item_32.Item, Data3=avr_14)  # -> flatten(Result)
item_36 = ListItem(List=deccutmesh_11.Vertices, Index=item_30, Wrap=True)
merge_13 = Merge(Data1=avr_15, Data2=item_35.Item1, Data3=item_35.Item)
panel_12 = Panel(merge_12)
item_37 = ListItem(List=deccutmesh_11.Vertices, Index=item_33, Wrap=True)
item_38 = ListItem(List=deccutmesh_15.Vertices, Index=item_34, Wrap=True)
panel_13 = Panel(merge_13)
number_slider_13 = Slider(8, range=0..10)
mesh_9 = Mesh(<mesh referenced from the Rhino model>)
mesh_10 = Mesh(<mesh referenced from the Rhino model>)
mbridgecm_9 = MbridgeCM(TriangulatedMeshOrCutMesh=mesh_9)
mbridgecm_10 = MbridgeCM(TriangulatedMeshOrCutMesh=mesh_10)
series_23 = Series(Start=Slider(124, range=0..1000), Step="0", Count=number_slider_13)
sortcutmesh_8 = SortCutMesh(TriangulatedMeshOrCutMesh=mbridgecm_10)
sortcutmesh_9 = SortCutMesh(TriangulatedMeshOrCutMesh=mbridgecm_9)
number_slider_14 = Slider(30, range=0..1000)
toggle = BooleanToggle(True)
develop_2 = DevelopMesh(TriangulatedMesh=mesh_9, Count=Slider(105, range=0..10000))  # -> ModifiedMesh, A
principle = PrincipleCurvature(TriangulatedMeshOrCutMesh=sortcutmesh_8)
cutchoice1 = CutChoice1(
    TriangulatedCutMesh=sortcutmesh_9,
    MaxLength=series_23,
    SeedCount=number_slider_13,
    Distance=number_slider_14,
    Branch=toggle)  # -> TriangulatedCutMesh, CutChoices
mesh_11 = Mesh(develop_2.ModifiedMesh)
cutchoice1_2 = CutChoice1(
    TriangulatedCutMesh=sortcutmesh_8,
    MaxLength=series_23,
    SeedCount=number_slider_13,
    Distance=number_slider_14,
    Branch=toggle)  # -> TriangulatedCutMesh, CutChoices
oneseedcut = OneSeedCut(TriangulatedCutMesh=sortcutmesh_8, MaxLength=Slider(48, range=0..100), Branch=Toggle(False))  # -> TriangulatedCutMesh, CutChoices
panel_14 = Panel(principle)
crv_11 = Curve(cutchoice1.CutChoices)
crv_12 = Curve(cutchoice1_2.CutChoices)
crv_13 = Curve(oneseedcut.CutChoices)
crv_14 = Curve([<curve referenced from the Rhino model> x2])
join_2 = JoinCurves(Curves=crv_14, Preserve=False)
crv_15 = Curve(<curve referenced from the Rhino model>)
crv_16 = Curve(<curve referenced from the Rhino model>)
crv_17 = Curve(<curve referenced from the Rhino model>)
crv_18 = Curve(<curve referenced from the Rhino model>)
merge_14 = Merge(Data1=join_2, Data2=crv_17, Data3=crv_16, Data4=crv_15, Data5=crv_18)  # -> flatten(Result)
meshcutbylines_7 = MeshCutWithCutLines(TriangulatedMeshOrCutMesh=mesh_10, OpenCutLinesPolylines=merge_14)
mplane = MeshPlane(Boundary={Plane=PlaneXY(0, 0, 0), Size=Domain2(u=-10..10, v=-10..10)}, WidthCount=10, HeightCount=10)  # -> Mesh, Area
tri_3 = Triangulate(Mesh=mplane.Mesh)  # -> Mesh, Count
X_5 = UnitX(Factor=Slider(194, range=0..1000))
Y = UnitY(Factor=Slider(234, range=0..1000))
move_7 = Move(Geometry=tri_3.Mesh, Motion=Y)  # -> Geometry, Transform
grab = Grab(On=True, Strength=1, Range=3)
mbridgecm_11 = MbridgeCM(TriangulatedMeshOrCutMesh=mesh_10)
X_6 = UnitX(Factor=Slider(2000, range=0..10000))
meshedges_13 = MeshEdges(Mesh=mesh_10)  # -> AllE, NakedE
sortcutmesh_10 = SortCutMesh(TriangulatedMeshOrCutMesh=mbridgecm_11)
meshedges_14 = MeshEdges(Mesh=mesh_10)  # -> AllE, NakedE
move_8 = Move(Geometry=meshedges_14.NakedE, Motion=X_5)  # -> Geometry, Transform
move_9 = Move(Geometry=mesh_10, Motion=X_6)  # -> Geometry, Transform
deccutmesh_16 = DeconstructCutMesh(TriangulatedMeshOrCutMesh=sortcutmesh_10)  # -> Vertices, Faces, Edges
movecm_3 = MoveCutMesh(TriangulatedMeshOrCutMesh=meshcutbylines_7, MoveDirection=X_5)
crv_19 = Curve([<curve referenced from the Rhino model> x2])
crv_20 = Curve([<curve referenced from the Rhino model> x2])
number_slider_15 = Slider(100, range=0..100)
divide = DivideCurve(Curve=crv_19, Count=10, Kinks=False)  # -> Points, Tangents, Parameters
divide_2 = DivideCurve(Curve=crv_20, Count=10, Kinks=False)  # -> Points, Tangents, Parameters
mbridgecm_12 = MbridgeCM(TriangulatedMeshOrCutMesh=move_9.Geometry)
mesh_12 = Mesh(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)
number_slider_16 = Slider(1000, range=0..1000)
number_slider_17 = Slider(1000, range=0..1000)
move_10 = Move(Geometry=meshedges_13.NakedE, Motion=X_6)  # -> Geometry, Transform
bang = ExplodeTree(Data=divide.Points)  # -> Branch0, Branch1
developcm2_6 = DevelopCutMesh2(
    TriangulatedCutMesh=mesh_10,
    Iterations=Slider(10000, range=0..10000),
    XyMirror=False,
    YzMirror=False,
    ZxMirror=False,
    OuterBoundaryCurves=meshedges_14.NakedE,
    Alpha=0.1)
move_11 = Move(Geometry=merge_14, Motion=X_6)  # -> Geometry, Transform
bang_2 = ExplodeTree(Data=divide_2.Points)  # -> Branch0, Branch1
number_slider_18 = Slider(1000, range=0..1000)
sortcutmesh_11 = SortCutMesh(TriangulatedMeshOrCutMesh=movecm_3)
scale = Scale(Geometry=mesh_12, Center=Point(0, 0, 0), Factor=Slider(20, range=0..100))  # -> Geometry, Transform
mesh_13 = Mesh(<mesh referenced from the Rhino model>)
number_slider_19 = Slider(0.4, range=0..1)
ln = Line(StartPoint=bang.Branch0, EndPoint=bang.Branch1)
ln_2 = Line(StartPoint=bang_2.Branch0, EndPoint=bang_2.Branch1)
meshedges_15 = MeshEdges(Mesh=mesh_13)  # -> AllE, NakedE
mbridgecm_13 = MbridgeCM(TriangulatedMeshOrCutMesh=developcm2_6)
develop_3 = DevelopMesh(TriangulatedMesh=scale.Geometry, Count=Slider(10000, range=0..10000))  # -> ModifiedMesh, A
mesh_14 = Mesh(develop_3.ModifiedMesh)
mbridgecm_14 = MbridgeCM(TriangulatedMeshOrCutMesh=mesh_14)
deccutmesh_17 = DeconstructCutMesh(TriangulatedMeshOrCutMesh=sortcutmesh_11)  # -> Vertices, Faces, Edges
divide_3 = DivideCurve(Curve=ln_2, Count=10, Kinks=False)  # -> Points, Tangents, Parameters
sortcutmesh_12 = SortCutMesh(TriangulatedMeshOrCutMesh=mbridgecm_12)
developcm3_4 = DevelopCutMesh3(
    TriangulatedCutMesh=movecm_3,
    Iterations=Slider(10000, range=0..10000),
    XyMirror=False,
    YzMirror=False,
    ZxMirror=False,
    OuterBoundaryCurves=move_8.Geometry,
    Alpha=Slider(0.1, range=0..0.1))  # disabled
divide_4 = DivideCurve(Curve=ln, Count=10, Kinks=False)  # -> Points, Tangents, Parameters
sortcutmesh_13 = SortCutMesh(TriangulatedMeshOrCutMesh=mbridgecm_14)
crv_21 = Curve(meshedges_15.AllE)
mbridgecm_15 = MbridgeCM()
developcm2_7 = DevelopCutMesh2(
    TriangulatedCutMesh=movecm_3,
    Iterations=Slider(5000, range=0..10000),
    XyMirror=False,
    YzMirror=False,
    ZxMirror=False,
    OuterBoundaryCurves=move_8.Geometry,
    Alpha=Slider(0.01, range=0..0.1))  # disabled
developcm3_5 = DevelopCutMesh3(
    TriangulatedCutMesh=move_9.Geometry,
    Iterations=Slider(10000, range=0..10000),
    XyMirror=False,
    YzMirror=False,
    ZxMirror=False,
    OuterBoundaryCurves=move_10.Geometry,
    FixPointsCrv=move_11.Geometry,
    Alpha=1)  # disabled
shatter = Shatter(Curve=graft(ln_2), Parameters=divide_3.Parameters)
shatter_2 = Shatter(Curve=graft(ln), Parameters=divide_4.Parameters)
panel_15 = Panel(shatter_2)
developcm2_8 = DevelopCutMesh2(
    TriangulatedCutMesh=move_9.Geometry,
    Iterations=Slider(10000, range=0..10000),
    XyMirror=False,
    YzMirror=False,
    ZxMirror=False,
    OuterBoundaryCurves=move_10.Geometry,
    FixPointsCrv=move_11.Geometry,
    Alpha=0.1)  # disabled
mesh_15 = Mesh(<mesh referenced from the Rhino model>)
series_24 = Series(Start=0, Step=1, Count=10)
cutmeshedges_4 = CutMeshEdges(TriangulatedMeshOrCutMesh=sortcutmesh_13)  # -> flatten(MeshAllEdges), MeshNakedEdges
deccutmesh_18 = DeconstructCutMesh(TriangulatedMeshOrCutMesh=sortcutmesh_12)  # -> Vertices, Faces, Edges
meshnet4_4 = MeshNet4(TriangulatedMeshOrCutMesh=sortcutmesh_13)  # -> CutMesh, FeatureLinesPolylines
x_plus_one_12 = XPlusOne(NumberX=series_24)
cutmeshedges_5 = CutMeshEdges()  # -> flatten(MeshAllEdges), MeshNakedEdges
meshedges_16 = MeshEdges(Mesh=mesh_15)  # -> AllE, NakedE
item_39 = ListItem(List=divide_3.Points, Index=x_plus_one_12, Wrap=True)
flip = FlipMatrix(Data=item_39)
len = Length(Curve=cutmeshedges_4.MeshAllEdges)
item_40 = ListItem(List=divide_3.Points, Index=series_24, Wrap=True)
crv_22 = Curve(meshedges_16.NakedE)
len_2 = Length(Curve=cutmeshedges_5.MeshAllEdges)
subtraction = Subtraction(A=len_2, B=len)

# ----
# 移動距離が大きかったもの
number_slider_20 = Slider(30, range=0..100)
deccutmesh_19 = DeconstructCutMesh(TriangulatedMeshOrCutMesh=developcm2_8)  # -> Vertices, Faces, Edges
dist_7 = Distance(PointA=deccutmesh_18.Vertices, PointB=deccutmesh_19.Vertices)
lng_13 = ListLength(List=dist_7)
series_25 = Series(Start=0, Step=1, Count=lng_13)
series_26 = Series(Start=0, Step=1, Count=number_slider_20)
x_plus_one_13 = XPlusOne(NumberX=series_26)
avr_16 = Average(Input=dist_7)
sort_14 = SortList(Keys=dist_7, ValuesA=series_25)  # -> Keys, ValuesA
neg_12 = Negative(Value=x_plus_one_13)
item_41 = ListItem(List=sort_14.Keys, Index=0, Wrap=True)  # -> Item1, Item
item_42 = ListItem(List=sort_14.ValuesA, Index=neg_12, Wrap=True)
merge_15 = Merge(Data1=item_41.Item1, Data2=item_41.Item, Data3=avr_16)  # -> flatten(Result)
panel_16 = Panel(merge_15)
item_43 = ListItem(List=deccutmesh_19.Vertices, Index=item_42, Wrap=True)

# ----
# 移動距離が大きかったもの
number_slider_21 = Slider(30, range=0..100)
deccutmesh_20 = DeconstructCutMesh(TriangulatedMeshOrCutMesh=developcm3_5)  # -> Vertices, Faces, Edges
dist_8 = Distance(PointA=deccutmesh_18.Vertices, PointB=deccutmesh_20.Vertices)
lng_14 = ListLength(List=dist_8)
series_27 = Series(Start=0, Step=1, Count=lng_14)
series_28 = Series(Start=0, Step=1, Count=number_slider_21)
x_plus_one_14 = XPlusOne(NumberX=series_28)
avr_17 = Average(Input=dist_8)
sort_15 = SortList(Keys=dist_8, ValuesA=series_27)  # -> Keys, ValuesA
neg_13 = Negative(Value=x_plus_one_14)
item_44 = ListItem(List=sort_15.Keys, Index=0, Wrap=True)  # -> Item1, Item
item_45 = ListItem(List=sort_15.ValuesA, Index=neg_13, Wrap=True)
merge_16 = Merge(Data1=item_44.Item1, Data2=item_44.Item, Data3=avr_17)  # -> flatten(Result)
panel_17 = Panel(merge_16)
item_46 = ListItem(List=deccutmesh_20.Vertices, Index=item_45, Wrap=True)

cull_i_3 = CullIndex(List=flip, Indices="-1", Wrap=True)

# ----
# ガウス曲率が大きかったもの
cutmeshgcurvature_7 = CutMeshGCurvature(TriangulatedMeshOrCutMesh=developcm3_4)
deccutmesh_21 = DeconstructCutMesh(TriangulatedMeshOrCutMesh=developcm3_4)  # -> Vertices, Faces, Edges
lng_15 = ListLength(List=cutmeshgcurvature_7)
abs_8 = Absolute(Value=cutmeshgcurvature_7)
series_29 = Series(Start=0, Step=1, Count=lng_15)
series_30 = Series(Start=0, Step=1, Count=Slider(100, range=0..100))
sort_16 = SortList(Keys=abs_8, ValuesA=series_29)  # -> Keys, ValuesA
x_plus_one_15 = XPlusOne(NumberX=series_30)
neg_14 = Negative(Value=x_plus_one_15)
item_47 = ListItem(List=sort_16.ValuesA, Index=neg_14, Wrap=True)
avr_18 = Average(Input=sort_16.Keys)
item_48 = ListItem(List=sort_16.Keys, Index=0, Wrap=True)  # -> Item1, Item
merge_17 = Merge(Data1=avr_18, Data2=item_48.Item1, Data3=item_48.Item)
panel_18 = Panel(merge_17)
item_49 = ListItem(List=deccutmesh_21.Vertices, Index=item_47, Wrap=True)

# ----
# 移動距離が大きかったもの
number_slider_22 = Slider(30, range=0..100)
deccutmesh_22 = DeconstructCutMesh(TriangulatedMeshOrCutMesh=developcm3_4)  # -> Vertices, Faces, Edges
dist_9 = Distance(PointA=deccutmesh_17.Vertices, PointB=deccutmesh_22.Vertices)
lng_16 = ListLength(List=dist_9)
series_31 = Series(Start=0, Step=1, Count=lng_16)
series_32 = Series(Start=0, Step=1, Count=number_slider_22)
x_plus_one_16 = XPlusOne(NumberX=series_32)
avr_19 = Average(Input=dist_9)
sort_17 = SortList(Keys=dist_9, ValuesA=series_31)  # -> Keys, ValuesA
neg_15 = Negative(Value=x_plus_one_16)
item_50 = ListItem(List=sort_17.Keys, Index=0, Wrap=True)  # -> Item1, Item
item_51 = ListItem(List=sort_17.ValuesA, Index=neg_15, Wrap=True)
merge_18 = Merge(Data1=item_50.Item1, Data2=item_50.Item, Data3=avr_19)  # -> flatten(Result)
panel_19 = Panel(merge_18)
item_52 = ListItem(List=deccutmesh_22.Vertices, Index=item_51, Wrap=True)

# ----
# ガウス曲率が大きかったもの
cutmeshgcurvature_8 = CutMeshGCurvature(TriangulatedMeshOrCutMesh=developcm2_7)
deccutmesh_23 = DeconstructCutMesh(TriangulatedMeshOrCutMesh=developcm2_7)  # -> Vertices, Faces, Edges
lng_17 = ListLength(List=cutmeshgcurvature_8)
abs_9 = Absolute(Value=cutmeshgcurvature_8)
series_33 = Series(Start=0, Step=1, Count=lng_17)
series_34 = Series(Start=0, Step=1, Count=Slider(59, range=0..100))
sort_18 = SortList(Keys=abs_9, ValuesA=series_33)  # -> Keys, ValuesA
x_plus_one_17 = XPlusOne(NumberX=series_34)
neg_16 = Negative(Value=x_plus_one_17)
item_53 = ListItem(List=sort_18.ValuesA, Index=neg_16, Wrap=True)
avr_20 = Average(Input=sort_18.Keys)
item_54 = ListItem(List=sort_18.Keys, Index=0, Wrap=True)  # -> Item1, Item
merge_19 = Merge(Data1=avr_20, Data2=item_54.Item1, Data3=item_54.Item)
panel_20 = Panel(merge_19)
item_55 = ListItem(List=deccutmesh_23.Vertices, Index=item_53, Wrap=True)

flip_2 = FlipMatrix(Data=item_40)
cull_i_4 = CullIndex(List=flip_2, Indices="0", Wrap=True)
ln_3 = Line(StartPoint=cull_i_4, EndPoint=cull_i_3)
wbweave_5 = WeaverbirdsMeshFromLinesWeaveBack(Lines=flatten([ln_3, shatter_2, shatter]), MaximumValence=4)
meshedges_17 = MeshEdges(Mesh=wbweave_5)  # -> AllE, NakedE
length_line = LengthLine(Line=meshedges_17.AllE, Strength=10)
show = Show(G=wbweave_5)
solver = Solver(GoalObjects=[length_line, grab, show], Reset=Button(), Threshold=1e-15, Tolerance=0.0001, On=Toggle(False))  # -> I, V, O
mesh_16 = Mesh(solver.O)
meshedges_18 = MeshEdges(Mesh=mesh_16)  # -> AllE, NakedE
len_3 = Length(Curve=meshedges_18.AllE)
mesh_17 = Mesh(mesh_16)
develop_4 = DevelopMesh(TriangulatedMesh=mesh_17, Count=Slider(10000, range=0..10000))  # -> ModifiedMesh, A; disabled

# ----
# 移動距離が大きかったもの
number_slider_23 = Slider(30, range=0..100)
deccutmesh_24 = DeconstructCutMesh(TriangulatedMeshOrCutMesh=developcm2_7)  # -> Vertices, Faces, Edges
dist_10 = Distance(PointA=deccutmesh_17.Vertices, PointB=deccutmesh_24.Vertices)
lng_18 = ListLength(List=dist_10)
series_35 = Series(Start=0, Step=1, Count=lng_18)
series_36 = Series(Start=0, Step=1, Count=number_slider_23)
x_plus_one_18 = XPlusOne(NumberX=series_36)
avr_21 = Average(Input=dist_10)
sort_19 = SortList(Keys=dist_10, ValuesA=series_35)  # -> Keys, ValuesA
neg_17 = Negative(Value=x_plus_one_18)
item_56 = ListItem(List=sort_19.Keys, Index=0, Wrap=True)  # -> Item1, Item
item_57 = ListItem(List=sort_19.ValuesA, Index=neg_17, Wrap=True)
merge_20 = Merge(Data1=item_56.Item1, Data2=item_56.Item, Data3=avr_21)  # -> flatten(Result)
panel_21 = Panel(merge_20)
item_58 = ListItem(List=deccutmesh_24.Vertices, Index=item_57, Wrap=True)

panel_22 = Panel(subtraction)

# ----
# Crane
cmesh_from_mesh = CMeshFromMesh(Mesh=mesh_10)
developable = Developable()
static_solver = CraneStaticSolver(
    CMesh=cmesh_from_mesh,
    Constraints=developable,
    NRIteration=50,
    CGNRIteration=100,
    Threshold=1e-13,
    Solve=Toggle(True),
    IsRigidEdge=False,
    IsPanelFlat=True,
    IsFoldBlock=True,
    IsConstraint=True)  # -> CMesh, RigidOrigami, Residual
deconstruct_cmesh = DeconstructCMesh(CMesh=static_solver.CMesh)  # -> Mesh, Mountain, Valley, Boundary, Unassigned, Triangulate, Edges, Inner

# ----
# 節点の移動距離
demesh_4 = DeconstructMesh(Mesh=deconstruct_cmesh.Mesh)  # -> Vertices, Faces, Colours, Normals
demesh_5 = DeconstructMesh(Mesh=mesh_10)  # -> Vertices, Faces, Colours, Normals
dist_11 = Distance(PointA=demesh_4.Vertices, PointB=demesh_5.Vertices)
sort_20 = SortList(Keys=dist_11)  # -> Keys, ValuesA
avr_22 = Average(Input=dist_11)
item_59 = ListItem(List=sort_20.Keys, Index=0, Wrap=True)  # -> Item1, Item
merge_21 = Merge(Data1=item_59.Item, Data2=item_59.Item1, Data3=avr_22)
panel_23 = Panel(merge_21)

# ----
# 最適化前
# ガウス曲率が大きかったもの
cutmeshgcurvature_9 = CutMeshGCurvature(TriangulatedMeshOrCutMesh=sortcutmesh_10)
abs_10 = Absolute(Value=cutmeshgcurvature_9)
lng_19 = ListLength(List=cutmeshgcurvature_9)
series_37 = Series(Start=0, Step=1, Count=lng_19)
series_38 = Series(Start=0, Step=1, Count=Slider(30, range=0..100))
sort_21 = SortList(Keys=abs_10, ValuesA=series_37)  # -> Keys, ValuesA
x_plus_one_19 = XPlusOne(NumberX=series_38)
neg_18 = Negative(Value=x_plus_one_19)
item_60 = ListItem(List=sort_21.ValuesA, Index=neg_18, Wrap=True)
avr_23 = Average(Input=sort_21.Keys)
item_61 = ListItem(List=sort_21.Keys, Index=0, Wrap=True)  # -> Item1, Item
merge_22 = Merge(Data1=avr_23, Data2=item_61.Item1, Data3=item_61.Item)
panel_24 = Panel(merge_22)
item_62 = ListItem(List=deccutmesh_16.Vertices, Index=item_60, Wrap=True)

# ----
# ガウス曲率が大きかったもの
cutmeshgcurvature_10 = CutMeshGCurvature(TriangulatedMeshOrCutMesh=deconstruct_cmesh.Mesh)
mbridgecm_16 = MbridgeCM(TriangulatedMeshOrCutMesh=deconstruct_cmesh.Mesh)
cutmeshgcurvature_11 = CutMeshGCurvature(TriangulatedMeshOrCutMesh=mbridgecm_16)
deccutmesh_25 = DeconstructCutMesh(TriangulatedMeshOrCutMesh=mbridgecm_16)  # -> Vertices, Faces, Edges
lng_20 = ListLength(List=cutmeshgcurvature_11)
abs_11 = Absolute(Value=cutmeshgcurvature_11)
series_39 = Series(Start=0, Step=1, Count=lng_20)
series_40 = Series(Start=0, Step=1, Count=Slider(59, range=0..100))
x_plus_one_20 = XPlusOne(NumberX=series_40)
sort_22 = SortList(Keys=abs_11, ValuesA=series_39)  # -> Keys, ValuesA
neg_19 = Negative(Value=x_plus_one_20)
item_63 = ListItem(List=sort_22.ValuesA, Index=neg_19, Wrap=True)
avr_24 = Average(Input=sort_22.Keys)
item_64 = ListItem(List=sort_22.Keys, Index=0, Wrap=True)  # -> Item1, Item
merge_23 = Merge(Data1=avr_24, Data2=item_64.Item1, Data3=item_64.Item)
panel_25 = Panel(merge_23)
item_65 = ListItem(List=deccutmesh_25.Vertices, Index=item_63, Wrap=True)

crv_23 = Curve([<curve referenced from the Rhino model> x970])
number_slider_24 = Slider(23, range=0..100)
ハイブリッド = Mesh(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)
従来手法 = Mesh(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)
元形状 = Mesh(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)
新手法 = Mesh(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)

# ----
# 展開図
develop_mesh = DevelopMesh(Mesh=deconstruct_cmesh.Mesh)  # -> DevelopMesh, FaceTree

wbweave_6 = WeaverbirdsMeshFromLinesWeaveBack(Lines=crv_23, MaximumValence=4)
merge_24 = Merge(Data1=元形状, Data2=従来手法, Data3=新手法, Data4=ハイブリッド)  # -> flatten(Result)
X_7 = UnitX(Factor=Slider(534, range=0..1000))
move_12 = Move(Geometry=merge_24, Motion=X_7)  # -> Geometry, Transform

mesh_18 = Mesh(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)
mesh_19 = Mesh(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)
mesh_20 = Mesh(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)

item_66 = ListItem(List=move_12.Geometry, Index=0, Wrap=True)  # -> Item, Item1, Item2, Item3
mesh_21 = Mesh(item_66.Item)
meshedges_19 = MeshEdges(Mesh=mesh_20)  # -> AllE, NakedE
crv_24 = Curve([<curve referenced from the Rhino model> x26])
meshedges_20 = MeshEdges(Mesh=item_66.Item)  # -> AllE, NakedE
meshedges_21 = MeshEdges(Mesh=item_66.Item)  # -> AllE, NakedE
crv_25 = Curve([<curve referenced from the Rhino model> x10])
cutmeshedges_6 = CutMeshEdges(TriangulatedMeshOrCutMesh=meshnet6_3)  # -> MeshAllEdges, MeshNakedEdges
crv_26 = Curve([<curve referenced from the Rhino model> x220])
crv_27 = Curve(meshedges_21.AllE)
cutmeshedges_7 = CutMeshEdges(TriangulatedMeshOrCutMesh=meshnet6_4)  # -> MeshAllEdges, MeshNakedEdges
gcurvature_3 = GaussianCurvature(TriangulatedMesh=mesh_20)
swatch_2 = ColourSwatch(SwatchColor=RGBA(0, 0, 0, 130))
previewlw_7 = CustomPreviewLineweights(Geometry=meshedges_19.AllE, Shader=ColourSwatch(SwatchColor=RGBA(194, 194, 255, 0)), Absolute=False)
gcurvature_4 = GaussianCurvature(TriangulatedMesh=元形状)
meshedges_22 = MeshEdges(Mesh=mesh_18)  # -> AllE, NakedE
previewlw_8 = CustomPreviewLineweights(Geometry=meshedges_20.AllE, Shader=ColourSwatch(SwatchColor=RGBA(194, 194, 255, 0)), Absolute=False)
lng_21 = ListLength(List=gcurvature_3)
wbweave_7 = WeaverbirdsMeshFromLinesWeaveBack(Lines=crv_26, MaximumValence=4)
previewlw_9 = CustomPreviewLineweights(Geometry=crv_25, Shader=ColourSwatch(SwatchColor=RGB(87, 87, 212)), Thickness=Slider(3, range=0..10), Absolute=False)
previewlw_10 = CustomPreviewLineweights(Geometry=crv_24, Shader=ColourSwatch(SwatchColor=RGB(232, 174, 49)), Thickness=Slider(3, range=0..10), Absolute=False)
meshedges_23 = MeshEdges(Mesh=item_66.Item3)  # -> AllE, NakedE
preview_6 = CustomPreview(Geometry=wbweave_7, Material=ColourSwatch(SwatchColor=RGBA(52, 92, 65, 130)))
sort_23 = SortList(Keys=gcurvature_3, ValuesA=gcurvature_3)  # -> Keys, ValuesA
previewlw_11 = CustomPreviewLineweights(Geometry=crv_26, Shader=ColourSwatch(SwatchColor=RGBA(173, 173, 173, 130)), Absolute=False)
len_4 = Length(Curve=cutmeshedges_6.MeshAllEdges)
lng_22 = ListLength(List=gcurvature_4)
len_5 = Length(Curve=cutmeshedges_7.MeshAllEdges)
sort_24 = SortList(Keys=gcurvature_4, ValuesA=gcurvature_4)  # -> Keys, ValuesA
avr_25 = Average(Input=gcurvature_3)
multiplication_2 = Multiplication(A=lng_21, B=avr_25)
panel_26 = Panel(multiplication_2)
meshedges_24 = MeshEdges(Mesh=wbweave_7)  # -> AllE, NakedE
preview_7 = CustomPreview(
    Geometry=mesh_18,
    Material={diffuse=RGB(221, 160, 221), emission=RGB(66, 48, 66), shine=0.5, specular=RGB(255, 255, 255), transparency=0})
avr_26 = Average(Input=gcurvature_4)
multiplication_3 = Multiplication(A=lng_22, B=avr_26)
previewlw_12 = CustomPreviewLineweights(Geometry=meshedges_22.AllE, Shader=ColourSwatch(SwatchColor=RGB(0, 0, 0)), Absolute=False)
item_67 = ListItem(List=sort_23.ValuesA, Index=0, Wrap=True)  # -> Item1, Item
preview_8 = CustomPreview(
    Geometry=item_66.Item3,
    Material={diffuse=RGB(221, 160, 221), emission=RGB(66, 48, 66), shine=0.5, specular=RGB(255, 255, 255), transparency=0})
previewlw_13 = CustomPreviewLineweights(Geometry=meshedges_23.AllE, Shader=ColourSwatch(SwatchColor=RGB(0, 0, 0)), Absolute=False)
item_68 = ListItem(List=sort_24.ValuesA, Index=0, Wrap=True)  # -> Item1, Item
panel_27 = Panel(multiplication_3)
developcm2_9 = DevelopCutMesh2(
    TriangulatedCutMesh=wbweave_7,
    Iterations=Slider(100000, range=0..100000),
    XyMirror=False,
    YzMirror=False,
    ZxMirror=False,
    OuterBoundaryCurves=meshedges_24.NakedE,
    Alpha=0.1)
merge_25 = Merge(Data1=item_67.Item1, Data2=item_67.Item, Data3=avr_25)
mbridgecm_17 = MbridgeCM(TriangulatedMeshOrCutMesh=developcm2_9)
merge_26 = Merge(Data1=item_68.Item1, Data2=item_68.Item, Data3=avr_26)
meshedges_25 = MeshEdges(Mesh=mbridgecm_17)  # -> AllE, NakedE

# ----
# 長さの最適化まで入れたら長さのずれが0.1倍になった
sortcutmesh_14 = SortCutMesh()
netbfflength = NetBFFLength()  # -> CutMesh, FeatureLinesPolylines
netbff = NetBFF()  # -> CutMesh, FeatureLinesPolylines
cutmeshedges_8 = CutMeshEdges(TriangulatedMeshOrCutMesh=sortcutmesh_14)  # -> MeshAllEdges, MeshNakedEdges
cutmeshedges_9 = CutMeshEdges(TriangulatedMeshOrCutMesh=netbff.CutMesh)  # -> MeshAllEdges, MeshNakedEdges
cutmeshedges_10 = CutMeshEdges(TriangulatedMeshOrCutMesh=netbfflength.CutMesh)  # -> MeshAllEdges, MeshNakedEdges
len_6 = Length(Curve=cutmeshedges_8.MeshAllEdges)
len_7 = Length(Curve=cutmeshedges_9.MeshAllEdges)
len_8 = Length(Curve=cutmeshedges_10.MeshAllEdges)
subtraction_2 = Subtraction(A=len_8, B=len_6)
subtraction_3 = Subtraction(A=len_7, B=len_6)
abs_12 = Absolute(Value=subtraction_3)
abs_13 = Absolute(Value=subtraction_2)
sort_25 = SortList(Keys=abs_12)  # -> Keys, ValuesA
avr_27 = Average(Input=abs_12)
avr_28 = Average(Input=abs_13)
sort_26 = SortList(Keys=abs_13)  # -> Keys, ValuesA
item_69 = ListItem(List=sort_25.Keys, Index=0, Wrap=True)  # -> Item1, Item
item_70 = ListItem(List=sort_26.Keys, Index=0, Wrap=True)  # -> Item1, Item
merge_27 = Merge(Data1=avr_27, Data2=item_69.Item1, Data3=item_69.Item)
merge_28 = Merge(Data1=avr_28, Data2=item_70.Item1, Data3=item_70.Item)
panel_28 = Panel(merge_27)
panel_29 = Panel(merge_28)

preview_9 = CustomPreview(Geometry=mbridgecm_17, Material=ColourSwatch(SwatchColor=RGBA(52, 92, 65, 130)))
previewlw_14 = CustomPreviewLineweights(Geometry=meshedges_25.AllE, Shader=ColourSwatch(SwatchColor=RGBA(0, 0, 0, 130)), Absolute=False)

# ----
# ガウス曲率が大きかったもの
cutmeshgcurvature_12 = CutMeshGCurvature(TriangulatedMeshOrCutMesh=developcm2_8)
deccutmesh_26 = DeconstructCutMesh(TriangulatedMeshOrCutMesh=developcm2_8)  # -> Vertices, Faces, Edges
lng_23 = ListLength(List=cutmeshgcurvature_12)
abs_14 = Absolute(Value=cutmeshgcurvature_12)
series_41 = Series(Start=0, Step=1, Count=lng_23)
series_42 = Series(Start=0, Step=1, Count=Slider(100, range=0..100))
sort_27 = SortList(Keys=abs_14, ValuesA=series_41)  # -> Keys, ValuesA
x_plus_one_21 = XPlusOne(NumberX=series_42)
neg_20 = Negative(Value=x_plus_one_21)
item_71 = ListItem(List=sort_27.ValuesA, Index=neg_20, Wrap=True)
avr_29 = Average(Input=sort_27.Keys)
item_72 = ListItem(List=sort_27.Keys, Index=0, Wrap=True)  # -> Item1, Item
item_73 = ListItem(List=deccutmesh_26.Vertices, Index=item_71, Wrap=True)

cull_i_5 = CullIndex(List=sort_27.Keys, Indices=neg_20, Wrap=True)
avr_30 = Average(Input=cull_i_5)

merge_29 = Merge(Data1=avr_29, Data2=item_72.Item1, Data3=item_72.Item, Data4=avr_30)  # -> flatten(Result)
panel_30 = Panel(merge_29)

# ----
# ガウス曲率が大きかったもの
cutmeshgcurvature_13 = CutMeshGCurvature(TriangulatedMeshOrCutMesh=developcm3_5)
deccutmesh_27 = DeconstructCutMesh(TriangulatedMeshOrCutMesh=developcm3_5)  # -> Vertices, Faces, Edges
lng_24 = ListLength(List=cutmeshgcurvature_13)
abs_15 = Absolute(Value=cutmeshgcurvature_13)
series_43 = Series(Start=0, Step=1, Count=lng_24)
series_44 = Series(Start=0, Step=1, Count=Slider(100, range=0..100))
sort_28 = SortList(Keys=abs_15, ValuesA=series_43)  # -> Keys, ValuesA
x_plus_one_22 = XPlusOne(NumberX=series_44)
neg_21 = Negative(Value=x_plus_one_22)
item_74 = ListItem(List=sort_28.ValuesA, Index=neg_21, Wrap=True)
item_75 = ListItem(List=sort_28.Keys, Index=0, Wrap=True)  # -> Item1, Item
avr_31 = Average(Input=sort_28.Keys)
item_76 = ListItem(List=deccutmesh_27.Vertices, Index=item_74, Wrap=True)

cull_i_6 = CullIndex(List=sort_28.Keys, Indices=neg_21, Wrap=True)
avr_32 = Average(Input=cull_i_6)

merge_30 = Merge(Data1=avr_31, Data2=item_75.Item1, Data3=item_75.Item, Data4=avr_32)  # -> flatten(Result)
panel_31 = Panel(merge_30)

# ----
# Selfのみ
number_slider_25 = Slider(10000, range=0..10000)
number_slider_26 = Slider(100000, range=0..100000)
develop_5 = DevelopMesh(TriangulatedMesh=mesh_10, Count=number_slider_25)  # -> ModifiedMesh, A
sortcutmesh_15 = SortCutMesh(TriangulatedMeshOrCutMesh=develop_5.ModifiedMesh)
deccutmesh_28 = DeconstructCutMesh(TriangulatedMeshOrCutMesh=sortcutmesh_15)  # -> Vertices, Faces, Edges

# ----
# ハイブリッド
number_slider_27 = Slider(100000, range=0..100000)
developcm2_10 = DevelopCutMesh2(
    TriangulatedCutMesh=mesh_10,
    Iterations=number_slider_27,
    XyMirror=False,
    YzMirror=False,
    ZxMirror=False,
    OuterBoundaryCurves=meshedges_14.NakedE,
    Alpha=0.1)
cutmeshedges_11 = CutMeshEdges(TriangulatedMeshOrCutMesh=developcm2_10)  # -> MeshAllEdges, MeshNakedEdges
crv_28 = Curve(cutmeshedges_11.MeshNakedEdges)
developcm3_6 = DevelopCutMesh3(
    TriangulatedCutMesh=developcm2_10,
    Iterations=Slider(10000, range=0..10000),
    XyMirror=False,
    YzMirror=False,
    ZxMirror=False,
    OuterBoundaryCurves=crv_28,
    Alpha=1)

cutmeshedges_12 = CutMeshEdges(TriangulatedMeshOrCutMesh=developcm3_6)  # -> MeshAllEdges, MeshNakedEdges
len_9 = Length(Curve=cutmeshedges_12.MeshAllEdges)
subtraction_4 = Subtraction(A=len_5, B=len_9)
abs_16 = Absolute(Value=subtraction_4)
sort_29 = SortList(Keys=abs_16)  # -> Keys, ValuesA
avr_33 = Average(Input=abs_16)
item_77 = ListItem(List=sort_29.Keys, Index=0, Wrap=True)  # -> Item1, Item
merge_31 = Merge(Data1=item_77.Item1, Data2=item_77.Item, Data3=avr_33)  # -> flatten(Result)
panel_32 = Panel(merge_31)

# ----
# Selfのみ
number_slider_28 = Slider(2000, range=0..10000)
developcm3_7 = DevelopCutMesh3(
    TriangulatedCutMesh=mesh_10,
    Iterations=number_slider_28,
    XyMirror=False,
    YzMirror=False,
    ZxMirror=False,
    OuterBoundaryCurves=meshedges_14.NakedE,
    Alpha=1)  # disabled
deccutmesh_29 = DeconstructCutMesh(TriangulatedMeshOrCutMesh=developcm3_7)  # -> Vertices, Faces, Edges

meshnet4_5 = MeshNet4(TriangulatedMeshOrCutMesh=developcm3_7)  # -> CutMesh, FeatureLinesPolylines
cutmeshedges_13 = CutMeshEdges(TriangulatedMeshOrCutMesh=developcm3_7)  # -> MeshAllEdges, MeshNakedEdges
cutmeshedges_14 = CutMeshEdges(TriangulatedMeshOrCutMesh=meshnet4_5.CutMesh)  # -> MeshAllEdges, MeshNakedEdges
len_10 = Length(Curve=cutmeshedges_13.MeshAllEdges)
len_11 = Length(Curve=cutmeshedges_14.MeshAllEdges)
len_12 = Length(Curve=cutmeshedges_13.MeshAllEdges)
subtraction_5 = Subtraction(A=len_11, B=len_10)
subtraction_6 = Subtraction(A=len_4, B=len_12)
abs_17 = Absolute(Value=subtraction_5)
abs_18 = Absolute(Value=subtraction_6)
sort_30 = SortList(Keys=abs_17)  # -> Keys, ValuesA
avr_34 = Average(Input=abs_17)
sort_31 = SortList(Keys=abs_18)  # -> Keys, ValuesA
avr_35 = Average(Input=abs_18)
item_78 = ListItem(List=sort_30.Keys, Index=0, Wrap=True)  # -> Item1, Item
item_79 = ListItem(List=sort_31.Keys, Index=0, Wrap=True)  # -> Item1, Item
merge_32 = Merge(Data1=item_78.Item1, Data2=item_78.Item, Data3=avr_34)  # -> flatten(Result)
panel_33 = Panel(merge_32)
merge_33 = Merge(Data1=item_79.Item1, Data2=item_79.Item, Data3=avr_35)  # -> flatten(Result)
panel_34 = Panel(merge_33)

# ----
# ガウス曲率が大きかったもの
cutmeshgcurvature_14 = CutMeshGCurvature(TriangulatedMeshOrCutMesh=developcm2_10)
abs_19 = Absolute(Value=cutmeshgcurvature_14)
lng_25 = ListLength(List=cutmeshgcurvature_14)
series_45 = Series(Start=0, Step=1, Count=lng_25)
series_46 = Series(Start=0, Step=1, Count=Slider(30, range=0..100))
sort_32 = SortList(Keys=abs_19, ValuesA=series_45)  # -> Keys, ValuesA

# ----
# ガウス曲率が大きかったもの
cutmeshgcurvature_15 = CutMeshGCurvature(TriangulatedMeshOrCutMesh=sortcutmesh_15)
lng_26 = ListLength(List=cutmeshgcurvature_15)
abs_20 = Absolute(Value=cutmeshgcurvature_15)
series_47 = Series(Start=0, Step=1, Count=lng_26)
series_48 = Series(Start=0, Step=1, Count=Slider(59, range=0..100))
sort_33 = SortList(Keys=abs_20, ValuesA=series_47)  # -> Keys, ValuesA

# ----
# ガウス曲率が大きかったもの
cutmeshgcurvature_16 = CutMeshGCurvature(TriangulatedMeshOrCutMesh=developcm3_7)
abs_21 = Absolute(Value=cutmeshgcurvature_16)
lng_27 = ListLength(List=cutmeshgcurvature_16)
series_49 = Series(Start=0, Step=1, Count=lng_27)
series_50 = Series(Start=0, Step=1, Count=Slider(30, range=0..100))
sort_34 = SortList(Keys=abs_21, ValuesA=series_49)  # -> Keys, ValuesA

# ----
# 移動距離が大きかったもの
number_slider_29 = Slider(30, range=0..100)
deccutmesh_30 = DeconstructCutMesh(TriangulatedMeshOrCutMesh=sortcutmesh_15)  # -> Vertices, Faces, Edges
dist_12 = Distance(PointA=deccutmesh_16.Vertices, PointB=deccutmesh_30.Vertices)
lng_28 = ListLength(List=dist_12)
series_51 = Series(Start=0, Step=1, Count=lng_28)
series_52 = Series(Start=0, Step=1, Count=number_slider_29)
avr_36 = Average(Input=dist_12)
sort_35 = SortList(Keys=dist_12, ValuesA=series_51)  # -> Keys, ValuesA
item_80 = ListItem(List=sort_35.Keys, Index=0, Wrap=True)  # -> Item1, Item
merge_34 = Merge(Data1=item_80.Item1, Data2=item_80.Item, Data3=avr_36)  # -> flatten(Result)
panel_35 = Panel(merge_34)

x_plus_one_23 = XPlusOne(NumberX=series_52)
x_plus_one_24 = XPlusOne(NumberX=series_48)
avr_37 = Average(Input=sort_33.Keys)
item_81 = ListItem(List=sort_33.Keys, Index=0, Wrap=True)  # -> Item1, Item
merge_35 = Merge(Data1=avr_37, Data2=item_81.Item1, Data3=item_81.Item)

neg_22 = Negative(Value=x_plus_one_23)
item_82 = ListItem(List=sort_35.ValuesA, Index=neg_22, Wrap=True)
item_83 = ListItem(List=deccutmesh_16.Vertices, Index=item_82, Wrap=True)

neg_23 = Negative(Value=x_plus_one_24)
item_84 = ListItem(List=sort_33.ValuesA, Index=neg_23, Wrap=True)
panel_36 = Panel(merge_35)
item_85 = ListItem(List=deccutmesh_28.Vertices, Index=item_84, Wrap=True)

# ----
# 移動距離が大きかったもの
deccutmesh_31 = DeconstructCutMesh(TriangulatedMeshOrCutMesh=developcm3_7)  # -> Vertices, Faces, Edges
dist_13 = Distance(PointA=deccutmesh_16.Vertices, PointB=deccutmesh_31.Vertices)
lng_29 = ListLength(List=dist_13)
series_53 = Series(Start=0, Step=1, Count=lng_29)
series_54 = Series(Start=0, Step=1, Count=Slider(30, range=0..100))
avr_38 = Average(Input=dist_13)
sort_36 = SortList(Keys=dist_13, ValuesA=series_53)  # -> Keys, ValuesA
item_86 = ListItem(List=sort_36.Keys, Index=0, Wrap=True)  # -> Item1, Item
merge_36 = Merge(Data1=item_86.Item1, Data2=item_86.Item, Data3=avr_38)  # -> flatten(Result)
panel_37 = Panel(merge_36)

x_plus_one_25 = XPlusOne(NumberX=series_54)
x_plus_one_26 = XPlusOne(NumberX=series_50)
avr_39 = Average(Input=sort_34.Keys)
item_87 = ListItem(List=sort_34.Keys, Index=0, Wrap=True)  # -> Item1, Item
merge_37 = Merge(Data1=avr_39, Data2=item_87.Item1, Data3=item_87.Item)

neg_24 = Negative(Value=x_plus_one_25)
item_88 = ListItem(List=sort_36.ValuesA, Index=neg_24, Wrap=True)
item_89 = ListItem(List=deccutmesh_16.Vertices, Index=item_88, Wrap=True)

neg_25 = Negative(Value=x_plus_one_26)
item_90 = ListItem(List=sort_34.ValuesA, Index=neg_25, Wrap=True)
item_91 = ListItem(List=deccutmesh_29.Vertices, Index=item_90, Wrap=True)
panel_38 = Panel(merge_37)

# ----
# ガウス曲率が大きかったもの
cutmeshgcurvature_17 = CutMeshGCurvature(TriangulatedMeshOrCutMesh=developcm3_6)
abs_22 = Absolute(Value=cutmeshgcurvature_17)
lng_30 = ListLength(List=cutmeshgcurvature_17)
series_55 = Series(Start=0, Step=1, Count=lng_30)
series_56 = Series(Start=0, Step=1, Count=Slider(30, range=0..100))
sort_37 = SortList(Keys=abs_22, ValuesA=series_55)  # -> Keys, ValuesA

# ----
# 移動距離が大きかったもの
number_slider_30 = Slider(30, range=0..100)
deccutmesh_32 = DeconstructCutMesh(TriangulatedMeshOrCutMesh=developcm3_6)  # -> Vertices, Faces, Edges
dist_14 = Distance(PointA=deccutmesh_16.Vertices, PointB=deccutmesh_32.Vertices)
lng_31 = ListLength(List=dist_14)
series_57 = Series(Start=0, Step=1, Count=lng_31)
series_58 = Series(Start=0, Step=1, Count=number_slider_30)
avr_40 = Average(Input=dist_14)
sort_38 = SortList(Keys=dist_14, ValuesA=series_57)  # -> Keys, ValuesA
item_92 = ListItem(List=sort_38.Keys, Index=0, Wrap=True)  # -> Item1, Item
merge_38 = Merge(Data1=item_92.Item1, Data2=item_92.Item, Data3=avr_40)  # -> flatten(Result)
panel_39 = Panel(merge_38)

x_plus_one_27 = XPlusOne(NumberX=series_46)
x_plus_one_28 = XPlusOne(NumberX=series_58)
avr_41 = Average(Input=sort_32.Keys)
item_93 = ListItem(List=sort_32.Keys, Index=0, Wrap=True)  # -> Item1, Item
x_plus_one_29 = XPlusOne(NumberX=series_56)
merge_39 = Merge(Data1=avr_41, Data2=item_93.Item1, Data3=item_93.Item)
avr_42 = Average(Input=sort_37.Keys)
item_94 = ListItem(List=sort_37.Keys, Index=0, Wrap=True)  # -> Item1, Item
merge_40 = Merge(Data1=avr_42, Data2=item_94.Item1, Data3=item_94.Item)

neg_26 = Negative(Value=x_plus_one_27)
item_95 = ListItem(List=sort_32.ValuesA, Index=neg_26, Wrap=True)
panel_40 = Panel(merge_39)
item_96 = ListItem(List=deccutmesh_16.Vertices, Index=item_95, Wrap=True)

neg_27 = Negative(Value=x_plus_one_28)
item_97 = ListItem(List=sort_38.ValuesA, Index=neg_27, Wrap=True)
item_98 = ListItem(List=deccutmesh_16.Vertices, Index=item_97, Wrap=True)

neg_28 = Negative(Value=x_plus_one_29)
item_99 = ListItem(List=sort_37.ValuesA, Index=neg_28, Wrap=True)
item_100 = ListItem(List=deccutmesh_16.Vertices, Index=item_99, Wrap=True)
panel_41 = Panel(merge_40)

# ----
# Selfのみ
number_slider_31 = Slider(10000, range=0..10000)
number_slider_32 = Slider(100000, range=0..100000)
develop_6 = DevelopMesh(TriangulatedMesh=wbweave_7, Count=number_slider_31)  # -> ModifiedMesh, A
sortcutmesh_16 = SortCutMesh(TriangulatedMeshOrCutMesh=develop_6.ModifiedMesh)
deccutmesh_33 = DeconstructCutMesh(TriangulatedMeshOrCutMesh=sortcutmesh_16)  # -> Vertices, Faces, Edges

meshedges_26 = MeshEdges(Mesh=develop_6.ModifiedMesh)  # -> AllE, NakedE
preview_10 = CustomPreview(Geometry=develop_6.ModifiedMesh, Material=ColourSwatch(SwatchColor=RGBA(52, 92, 65, 130)))
previewlw_15 = CustomPreviewLineweights(Geometry=meshedges_26.AllE, Shader=ColourSwatch(SwatchColor=RGBA(0, 0, 0, 130)), Absolute=False)

# ----
# ガウス曲率が大きかったもの
cutmeshgcurvature_18 = CutMeshGCurvature(TriangulatedMeshOrCutMesh=developcm2_9)
abs_23 = Absolute(Value=cutmeshgcurvature_18)
lng_32 = ListLength(List=cutmeshgcurvature_18)
series_59 = Series(Start=0, Step=1, Count=lng_32)
series_60 = Series(Start=0, Step=1, Count=Slider(30, range=0..100))
sort_39 = SortList(Keys=abs_23, ValuesA=series_59)  # -> Keys, ValuesA

x_plus_one_30 = XPlusOne(NumberX=series_60)
avr_43 = Average(Input=sort_39.Keys)
item_101 = ListItem(List=sort_39.Keys, Index=0, Wrap=True)  # -> Item1, Item
merge_41 = Merge(Data1=avr_43, Data2=item_101.Item1, Data3=item_101.Item)

neg_29 = Negative(Value=x_plus_one_30)
item_102 = ListItem(List=sort_39.ValuesA, Index=neg_29, Wrap=True)
panel_42 = Panel(merge_41)
item_103 = ListItem(List=deccutmesh_16.Vertices, Index=item_102, Wrap=True)

# ----
# ガウス曲率が大きかったもの
cutmeshgcurvature_19 = CutMeshGCurvature(TriangulatedMeshOrCutMesh=sortcutmesh_16)
lng_33 = ListLength(List=cutmeshgcurvature_19)
abs_24 = Absolute(Value=cutmeshgcurvature_19)
series_61 = Series(Start=0, Step=1, Count=lng_33)
series_62 = Series(Start=0, Step=1, Count=Slider(59, range=0..100))
sort_40 = SortList(Keys=abs_24, ValuesA=series_61)  # -> Keys, ValuesA

# ----
# 移動距離が大きかったもの
number_slider_33 = Slider(30, range=0..100)
deccutmesh_34 = DeconstructCutMesh(TriangulatedMeshOrCutMesh=sortcutmesh_16)  # -> Vertices, Faces, Edges
dist_15 = Distance(PointA=deccutmesh_16.Vertices, PointB=deccutmesh_34.Vertices)
lng_34 = ListLength(List=dist_15)
series_63 = Series(Start=0, Step=1, Count=lng_34)
series_64 = Series(Start=0, Step=1, Count=number_slider_33)
avr_44 = Average(Input=dist_15)
sort_41 = SortList(Keys=dist_15, ValuesA=series_63)  # -> Keys, ValuesA
item_104 = ListItem(List=sort_41.Keys, Index=0, Wrap=True)  # -> Item1, Item
merge_42 = Merge(Data1=item_104.Item1, Data2=item_104.Item, Data3=avr_44)  # -> flatten(Result)
panel_43 = Panel(merge_42)

x_plus_one_31 = XPlusOne(NumberX=series_64)
x_plus_one_32 = XPlusOne(NumberX=series_62)
avr_45 = Average(Input=sort_40.Keys)
item_105 = ListItem(List=sort_40.Keys, Index=0, Wrap=True)  # -> Item1, Item
merge_43 = Merge(Data1=avr_45, Data2=item_105.Item1, Data3=item_105.Item)

neg_30 = Negative(Value=x_plus_one_31)
item_106 = ListItem(List=sort_41.ValuesA, Index=neg_30, Wrap=True)
item_107 = ListItem(List=deccutmesh_16.Vertices, Index=item_106, Wrap=True)

neg_31 = Negative(Value=x_plus_one_32)
item_108 = ListItem(List=sort_40.ValuesA, Index=neg_31, Wrap=True)
item_109 = ListItem(List=deccutmesh_33.Vertices, Index=item_108, Wrap=True)
panel_44 = Panel(merge_43)
