# Grasshopper definition 外皮1030.gh (Grasshopper 1.0.8)
# plug-ins: Heteroptera, Hagoromo, NGon_RH8

mesh = Mesh(<mesh referenced from the Rhino model>)  # disabled
number_slider = Slider(10000, range=0..10000)  # disabled
number_slider_2 = Slider(1000, range=0..1000)  # disabled
number_slider_3 = Slider(20000, range=0..100000)  # disabled
# 外皮1030
meshedges = MeshEdges(Mesh=mesh)  # -> AllE, NakedE; disabled
tri = Triangulate(Mesh=mesh)  # -> Mesh, Count; disabled
meshedges_2 = MeshEdges(Mesh=tri.Mesh)  # -> AllE, NakedE; disabled
develop = DevelopMesh(TriangulatedMesh=mesh, Count=number_slider_3)  # -> ModifiedMesh, A; disabled
crv = Curve(meshedges.AllE)  # disabled
center = Center(Geometry=meshedges_2.AllE)  # -> Center, Dimension; disabled
center_2 = Center(Geometry=meshedges.AllE)  # -> Center, Dimension; disabled
mesh_2 = Mesh(develop.ModifiedMesh)  # disabled
dupln = RemoveDuplicateLines(Lines=flatten([meshedges.AllE, meshedges_2.AllE]), Tolerance=0.01)  # disabled
cullpt = CullDuplicates(Points=flatten([center_2.Center, center.Center]), Tolerance=0.1, CullMode=2)  # -> Points, Indices, Valence; disabled
crv_2 = Curve(<curve referenced from the Rhino model>)  # disabled
crv_3 = Curve(<curve referenced from the Rhino model>)  # disabled
gcurvature = GaussianCurvature(TriangulatedMesh=mesh)  # disabled
gcurvature_2 = GaussianCurvature(TriangulatedMesh=develop.ModifiedMesh)  # disabled
merge = Merge(Data1=crv_2, Data2=crv_3)  # disabled
netbff = NetBFF(TriangulatedMeshOrCutMesh=mesh_2, FeatureLinesPolylines=merge)  # -> CutMesh, FeatureLinesPolylines; disabled
sort = SortList(Keys=gcurvature, ValuesA=gcurvature)  # -> Keys, ValuesA; disabled
sort_2 = SortList(Keys=gcurvature_2, ValuesA=gcurvature_2)  # -> Keys, ValuesA; disabled
netbfflength = NetBFFLength(TriangulatedMeshOrCutMesh=mesh_2, FeatureLinesPolylines=merge)  # -> CutMesh, FeatureLinesPolylines; disabled
avr = Average(Input=gcurvature)  # disabled
avr_2 = Average(Input=gcurvature_2)  # disabled
mbridgecm = MbridgeCM(TriangulatedMeshOrCutMesh=netbff.CutMesh)  # disabled
item = ListItem(List=sort.ValuesA, Index=0, Wrap=True)  # -> Item1, Item; disabled
item_2 = ListItem(List=sort_2.ValuesA, Index=0, Wrap=True)  # -> Item1, Item; disabled
crv_4 = Curve(netbff.FeatureLinesPolylines)  # disabled
mbridgecm_2 = MbridgeCM(TriangulatedMeshOrCutMesh=netbfflength.CutMesh)  # disabled
crv_5 = Curve(netbfflength.FeatureLinesPolylines)  # disabled
merge_2 = Merge(Data1=item.Item1, Data2=item.Item, Data3=avr)  # disabled
merge_3 = Merge(Data1=item_2.Item1, Data2=item_2.Item, Data3=avr_2)  # disabled
mesh_3 = Mesh(mbridgecm_2)  # disabled
panel = Panel(merge_2)  # disabled
panel_2 = Panel(merge_3)  # disabled
