# Grasshopper definition 謎.gh (Grasshopper 1.0.8)
# plug-ins: Heteroptera, Pufferfish, Crane, Hagoromo, Weaverbird, NGon_RH8

crv = Curve([<curve referenced from the Rhino model> x1847])
number_slider = Slider(10000, range=0..10000)  # disabled
wbweave = WeaverbirdsMeshFromLinesWeaveBack(Lines=crv, MaximumValence=4)
crv_2 = Curve([<curve referenced from the Rhino model> x1847])
crv_3 = Curve([<curve referenced from the Rhino model> x449])
pt = Point(<point referenced from the Rhino model>)
crv_4 = Curve([<curve referenced from the Rhino model> x16])  # disabled
crv_5 = Curve([<curve referenced from the Rhino model> x25])  # disabled
crv_6 = Curve([<curve referenced from the Rhino model> x7])  # disabled
crv_7 = Curve([<curve referenced from the Rhino model> x13])  # disabled
number_slider_2 = Slider(0, range=0..10000)  # disabled
mesh = Mesh(wbweave)  # disabled
crv_8 = Curve(<curve referenced from the Rhino model>)  # disabled
crv_9 = Curve(<curve referenced from the Rhino model>)  # disabled
wbweave_2 = WeaverbirdsMeshFromLinesWeaveBack(Lines=crv_3, MaximumValence=4)
crv_10 = Curve([<curve referenced from the Rhino model> x2])  # disabled
merge = Merge(Data1=crv_4, Data2=crv_5, Data3=crv_6, Data4=crv_7)  # -> flatten(Result); disabled
merge_2 = Merge(Data1=crv_10, Data2=crv_8, Data3=crv_9)  # disabled
wbweave_3 = WeaverbirdsMeshFromLinesWeaveBack(Lines=crv_2, MaximumValence=4)
meshedges = MeshEdges(Mesh=wbweave_3)  # -> AllE, NakedE; disabled
mbridgecm = MbridgeCM(TriangulatedMeshOrCutMesh=wbweave_3)  # disabled
number_slider_3 = Slider(10000, range=0..10000)  # disabled
developcm3 = DevelopCutMesh3(
    TriangulatedCutMesh=mbridgecm,
    Iterations=number_slider,
    XyMirror=False,
    YzMirror=False,
    ZxMirror=False,
    OuterBoundaryCurves=meshedges.NakedE,
    FixPointsCrv=merge,
    Alpha=1)  # disabled
crv_11 = Curve([<curve referenced from the Rhino model> x2])
yz = YZPlane(Origin=pt)  # disabled
mirror = Mirror(Geometry=crv_11, Plane=yz)  # -> Geometry, Transform; disabled
mbridgecm_2 = MbridgeCM(TriangulatedMeshOrCutMesh=mesh)  # disabled
mirror_2 = Mirror(Geometry=crv_3, Plane=yz)  # -> Geometry, Transform; disabled
wbweave_4 = WeaverbirdsMeshFromLinesWeaveBack(Lines=flatten([mirror_2.Geometry, crv_3]), MaximumValence=4)  # disabled
mbridgecm_3 = MbridgeCM(TriangulatedMeshOrCutMesh=wbweave_2)  # disabled
crv_12 = Curve([<curve referenced from the Rhino model> x1445])
merge_3 = Merge(Data1=crv_11, Data2=mirror.Geometry)  # -> flatten(Result); disabled
meshedges_2 = MeshEdges(Mesh=wbweave_4)  # -> AllE, NakedE; disabled
crv_13 = Curve(meshedges_2.NakedE)  # disabled
meshedges_3 = MeshEdges(Mesh=wbweave_4)  # -> AllE, NakedE; disabled
mbridgecm_4 = MbridgeCM(TriangulatedMeshOrCutMesh=developcm3)  # disabled
number_slider_4 = Slider(10000, range=0..10000)  # disabled
wbweave_5 = WeaverbirdsMeshFromLinesWeaveBack(Lines=crv_12, MaximumValence=4)
mbridgecm_5 = MbridgeCM(TriangulatedMeshOrCutMesh=wbweave_4)  # disabled
meshcutbylines = MeshCutWithCutLines(TriangulatedMeshOrCutMesh=mbridgecm_5, OpenCutLinesPolylines=merge_3)  # disabled
developcm3_2 = DevelopCutMesh3(
    TriangulatedCutMesh=meshcutbylines,
    Iterations=number_slider_2,
    XyMirror=False,
    YzMirror=False,
    ZxMirror=False,
    OuterBoundaryCurves=crv_13,
    Alpha=1)  # disabled
meshcutbylines_2 = MeshCutWithCutLines(TriangulatedMeshOrCutMesh=mbridgecm_3, OpenCutLinesPolylines=crv_11)  # disabled
cutmeshedges = CutMeshEdges(TriangulatedMeshOrCutMesh=meshcutbylines_2)  # -> MeshAllEdges, MeshNakedEdges; disabled
develop = DevelopMesh(TriangulatedMesh=wbweave_3, Count=number_slider_3)  # -> ModifiedMesh, A; disabled
crv_14 = Curve(cutmeshedges.MeshNakedEdges)  # disabled
number_slider_5 = Slider(10000, range=0..10000)  # disabled
gcurvature = GaussianCurvature(TriangulatedMesh=wbweave_3)  # disabled
meshcutbylines_3 = MeshCutWithCutLines(TriangulatedMeshOrCutMesh=mbridgecm_2, OpenCutLinesPolylines=merge_2)  # disabled
number_slider_6 = Slider(10000, range=0..10000)  # disabled
meshnet4 = MeshNet4(TriangulatedMeshOrCutMesh=mbridgecm_4)  # -> CutMesh, FeatureLinesPolylines; disabled
cutmeshedges_2 = CutMeshEdges(TriangulatedMeshOrCutMesh=meshcutbylines_3)  # -> MeshAllEdges, MeshNakedEdges; disabled
meshnet4_2 = MeshNet4(TriangulatedMeshOrCutMesh=develop.ModifiedMesh)  # -> CutMesh, FeatureLinesPolylines; disabled
number_slider_7 = Slider(100000, range=0..100000)  # disabled
gcurvature_2 = GaussianCurvature(TriangulatedMesh=mbridgecm_4)  # disabled
developcm3_3 = DevelopCutMesh3(
    TriangulatedCutMesh=meshcutbylines_2,
    Iterations=number_slider_4,
    XyMirror=False,
    YzMirror=False,
    ZxMirror=False,
    OuterBoundaryCurves=crv_14,
    Alpha=1)  # disabled
gcurvature_3 = GaussianCurvature(TriangulatedMesh=develop.ModifiedMesh)  # disabled
sort = SortList(Keys=gcurvature, ValuesA=gcurvature)  # -> Keys, ValuesA; disabled
crv_15 = Curve(cutmeshedges_2.MeshNakedEdges)  # disabled
meshedges_4 = MeshEdges()  # -> AllE, NakedE; disabled
develop_2 = DevelopMesh(TriangulatedMesh=mesh, Count=number_slider_6)  # -> ModifiedMesh, A; disabled
avr = Average(Input=gcurvature)  # disabled
sort_2 = SortList(Keys=gcurvature_2, ValuesA=gcurvature_2)  # -> Keys, ValuesA; disabled
number_slider_8 = Slider(10000, range=0..10000)  # disabled
number_slider_9 = Slider(100000, range=0..100000)  # disabled
develop_3 = DevelopMesh(TriangulatedMesh=wbweave_5, Count=number_slider_7)  # -> ModifiedMesh, A; disabled
developcm3_4 = DevelopCutMesh3(
    TriangulatedCutMesh=meshcutbylines_3,
    Iterations=number_slider_5,
    XyMirror=False,
    YzMirror=False,
    ZxMirror=False,
    OuterBoundaryCurves=crv_15,
    Alpha=1)  # disabled
sort_3 = SortList(Keys=gcurvature_3, ValuesA=gcurvature_3)  # -> Keys, ValuesA; disabled
item = ListItem(List=sort.ValuesA, Index=0, Wrap=True)  # -> Item1, Item; disabled
len = Length()  # disabled
avr_2 = Average(Input=gcurvature_2)  # disabled
gcurvature_4 = GaussianCurvature(TriangulatedMesh=wbweave_5)  # disabled
meshnet4_3 = MeshNet4(TriangulatedMeshOrCutMesh=develop_2.ModifiedMesh)  # -> CutMesh, FeatureLinesPolylines; disabled
number_slider_10 = Slider(1000, range=0..1000)  # disabled
avr_3 = Average(Input=gcurvature_3)  # disabled
meshnet4_4 = MeshNet4(TriangulatedMeshOrCutMesh=developcm3_3)  # -> CutMesh, FeatureLinesPolylines; disabled
item_2 = ListItem(List=sort_2.ValuesA, Index=0, Wrap=True)  # -> Item1, Item; disabled
meshnet4_5 = MeshNet4(TriangulatedMeshOrCutMesh=develop_3.ModifiedMesh)  # -> CutMesh, FeatureLinesPolylines; disabled
mesh_2 = Mesh(wbweave_2)  # disabled
gcurvature_5 = GaussianCurvature(TriangulatedMesh=develop_2.ModifiedMesh)  # disabled
meshnet4_6 = MeshNet4(TriangulatedMeshOrCutMesh=developcm3_4)  # -> CutMesh, FeatureLinesPolylines; disabled
item_3 = ListItem(List=sort_3.ValuesA, Index=0, Wrap=True)  # -> Item1, Item; disabled
merge_4 = Merge(Data1=item.Item1, Data2=item.Item, Data3=avr)  # disabled
panel = Panel(merge_4)  # disabled
develop_4 = DevelopMesh(TriangulatedMesh=mesh_2, Count=number_slider_9)  # -> ModifiedMesh, A; disabled
sort_4 = SortList(Keys=gcurvature_4, ValuesA=gcurvature_4)  # -> Keys, ValuesA; disabled
gcurvature_6 = GaussianCurvature(TriangulatedMesh=develop_3.ModifiedMesh)  # disabled
develop_mesh = DevelopMesh(Mesh=develop_2.ModifiedMesh)  # -> DevelopMesh, FaceTree; disabled
merge_5 = Merge(Data1=item_2.Item1, Data2=item_2.Item, Data3=avr_2)  # disabled
panel_2 = Panel(merge_5)  # disabled
avr_4 = Average(Input=gcurvature_4)  # disabled
sort_5 = SortList(Keys=gcurvature_5, ValuesA=gcurvature_5)  # -> Keys, ValuesA; disabled
merge_6 = Merge(Data1=item_3.Item1, Data2=item_3.Item, Data3=avr_3)  # disabled
panel_3 = Panel(merge_6)  # disabled
gcurvature_7 = GaussianCurvature(TriangulatedMesh=mesh_2)  # disabled
X = UnitX(Factor=number_slider_10)  # disabled
item_4 = ListItem(List=sort_4.ValuesA, Index=0, Wrap=True)  # -> Item1, Item; disabled
avr_5 = Average(Input=gcurvature_5)  # disabled
sort_6 = SortList(Keys=gcurvature_6, ValuesA=gcurvature_6)  # -> Keys, ValuesA; disabled
meshnet4_7 = MeshNet4(TriangulatedMeshOrCutMesh=develop_4.ModifiedMesh)  # -> CutMesh, FeatureLinesPolylines; disabled
move = Move(Geometry=develop.ModifiedMesh, Motion=X)  # -> Geometry, Transform; disabled
crv_16 = Curve(<curve referenced from the Rhino model>)  # disabled
avr_6 = Average(Input=gcurvature_6)  # disabled
crv_17 = Curve(<curve referenced from the Rhino model>)  # disabled
item_5 = ListItem(List=sort_5.ValuesA, Index=0, Wrap=True)  # -> Item1, Item; disabled
merge_7 = Merge(Data1=item_4.Item1, Data2=item_4.Item, Data3=avr_4)  # disabled
panel_4 = Panel(merge_7)  # disabled
sort_7 = SortList(Keys=gcurvature_7, ValuesA=gcurvature_7)  # -> Keys, ValuesA; disabled
gcurvature_8 = GaussianCurvature(TriangulatedMesh=develop_4.ModifiedMesh)  # disabled
merge_8 = Merge(Data1=crv_16, Data2=crv_17)  # -> flatten(Result); disabled
explode = Explode(Curve=merge_8, Recursive=True)  # -> flatten(Segments), Vertices; disabled
item_6 = ListItem(List=sort_6.ValuesA, Index=0, Wrap=True)  # -> Item1, Item; disabled
preview = CustomPreview(
    Geometry=develop.ModifiedMesh,
    Material={diffuse=RGB(221, 160, 221), emission=RGB(66, 48, 66), shine=0.5, specular=RGB(255, 255, 255), transparency=0})  # disabled
avr_7 = Average(Input=gcurvature_7)  # disabled
merge_9 = Merge(Data1=item_5.Item1, Data2=item_5.Item, Data3=avr_5)  # disabled
panel_5 = Panel(merge_9)  # disabled
meshnet7 = MeshNet7(TriangulatedMeshOrCutMesh=move.Geometry, FeatureLinesPolylines=merge_8)  # -> CutMesh, FeatureLinesPolylines; disabled
item_7 = ListItem(List=sort_7.ValuesA, Index=0, Wrap=True)  # -> Item1, Item; disabled
merge_10 = Merge(Data1=item_6.Item1, Data2=item_6.Item, Data3=avr_6)  # disabled
panel_6 = Panel(merge_10)  # disabled
len_2 = Length(Curve=explode.Segments)  # disabled
sort_8 = SortList(Keys=gcurvature_8, ValuesA=gcurvature_8)  # -> Keys, ValuesA; disabled
avr_8 = Average(Input=gcurvature_8)  # disabled
panel_7 = Panel(len_2)  # disabled
crv_18 = Curve(meshnet7.FeatureLinesPolylines)  # disabled
crv_19 = Curve(crv_18)  # disabled
join = JoinCurves(Curves=crv_19, Preserve=False)  # disabled
merge_11 = Merge(Data1=item_7.Item1, Data2=item_7.Item, Data3=avr_7)  # disabled
mbridgecm_6 = MbridgeCM(TriangulatedMeshOrCutMesh=meshnet7.CutMesh)  # disabled
item_8 = ListItem(List=sort_8.ValuesA, Index=0, Wrap=True)  # -> Item1, Item; disabled
len_3 = Length(Curve=crv_18)  # disabled
panel_8 = Panel(merge_11)  # disabled
merge_12 = Merge(Data1=item_8.Item1, Data2=item_8.Item, Data3=avr_8)  # disabled
panel_9 = Panel(merge_12)  # disabled
panel_10 = Panel(len_3)  # disabled
toggle = BooleanToggle(True)  # disabled
developable = Developable()  # disabled
cmesh_from_mesh = CMeshFromMesh(Mesh=develop_2.ModifiedMesh)  # disabled
static_solver = CraneStaticSolver(
    CMesh=cmesh_from_mesh,
    Constraints=developable,
    NRIteration=50,
    CGNRIteration=100,
    Threshold=1e-13,
    Solve=toggle,
    IsRigidEdge=False,
    IsPanelFlat=True,
    IsFoldBlock=True,
    IsConstraint=True)  # -> CMesh, RigidOrigami, Residual; disabled
deconstruct_cmesh = DeconstructCMesh(CMesh=static_solver.CMesh)  # -> Mesh, Mountain, Valley, Boundary, Unassigned, Triangulate, Edges, Inner; disabled
mesh_3 = Mesh(<mesh referenced from the Rhino model>)
develop_mesh_2 = DevelopMesh(Mesh=deconstruct_cmesh.Mesh)  # -> DevelopMesh, FaceTree; disabled
gcurvature_9 = GaussianCurvature(TriangulatedMesh=deconstruct_cmesh.Mesh)  # disabled
number_slider_11 = Slider(10000, range=0..10000)  # disabled
number_slider_12 = Slider(1000, range=0..1000)  # disabled
number_slider_13 = Slider(20000, range=0..100000)  # disabled
sort_9 = SortList(Keys=gcurvature_9, ValuesA=gcurvature_9)  # -> Keys, ValuesA; disabled
# 外皮1030
meshedges_5 = MeshEdges(Mesh=mesh_3)  # -> AllE, NakedE; disabled
avr_9 = Average(Input=gcurvature_9)  # disabled
tri = Triangulate(Mesh=mesh_3)  # -> Mesh, Count; disabled
meshedges_6 = MeshEdges(Mesh=tri.Mesh)  # -> AllE, NakedE; disabled
develop_5 = DevelopMesh(TriangulatedMesh=mesh_3, Count=number_slider_13)  # -> ModifiedMesh, A; disabled
crv_20 = Curve(meshedges_5.AllE)  # disabled
item_9 = ListItem(List=sort_9.ValuesA, Index=0, Wrap=True)  # -> Item1, Item; disabled
center = Center(Geometry=meshedges_6.AllE)  # -> Center, Dimension; disabled
center_2 = Center(Geometry=meshedges_5.AllE)  # -> Center, Dimension; disabled
mesh_4 = Mesh(develop_5.ModifiedMesh)  # disabled
dupln = RemoveDuplicateLines(Lines=flatten([meshedges_5.AllE, meshedges_6.AllE]), Tolerance=0.01)  # disabled
cullpt = CullDuplicates(Points=flatten([center_2.Center, center.Center]), Tolerance=0.1, CullMode=2)  # -> Points, Indices, Valence; disabled
crv_21 = Curve(<curve referenced from the Rhino model>)  # disabled
crv_22 = Curve(<curve referenced from the Rhino model>)  # disabled
merge_13 = Merge(Data1=item_9.Item1, Data2=item_9.Item, Data3=avr_9)  # disabled
panel_11 = Panel(merge_13)  # disabled
gcurvature_10 = GaussianCurvature(TriangulatedMesh=mesh_3)  # disabled
gcurvature_11 = GaussianCurvature(TriangulatedMesh=develop_5.ModifiedMesh)  # disabled
merge_14 = Merge(Data1=crv_21, Data2=crv_22)  # disabled
netbff = NetBFF(TriangulatedMeshOrCutMesh=mesh_4, FeatureLinesPolylines=merge_14)  # -> CutMesh, FeatureLinesPolylines; disabled
sort_10 = SortList(Keys=gcurvature_10, ValuesA=gcurvature_10)  # -> Keys, ValuesA; disabled
sort_11 = SortList(Keys=gcurvature_11, ValuesA=gcurvature_11)  # -> Keys, ValuesA; disabled
netbfflength = NetBFFLength(TriangulatedMeshOrCutMesh=mesh_4, FeatureLinesPolylines=merge_14)  # -> CutMesh, FeatureLinesPolylines; disabled
avr_10 = Average(Input=gcurvature_10)  # disabled
avr_11 = Average(Input=gcurvature_11)  # disabled
mbridgecm_7 = MbridgeCM(TriangulatedMeshOrCutMesh=netbff.CutMesh)  # disabled
item_10 = ListItem(List=sort_10.ValuesA, Index=0, Wrap=True)  # -> Item1, Item; disabled
item_11 = ListItem(List=sort_11.ValuesA, Index=0, Wrap=True)  # -> Item1, Item; disabled
crv_23 = Curve(netbff.FeatureLinesPolylines)  # disabled
mbridgecm_8 = MbridgeCM(TriangulatedMeshOrCutMesh=netbfflength.CutMesh)  # disabled
crv_24 = Curve(netbfflength.FeatureLinesPolylines)  # disabled
merge_15 = Merge(Data1=item_10.Item1, Data2=item_10.Item, Data3=avr_10)  # disabled
merge_16 = Merge(Data1=item_11.Item1, Data2=item_11.Item, Data3=avr_11)  # disabled
mesh_5 = Mesh(mbridgecm_8)  # disabled
panel_12 = Panel(merge_15)  # disabled
panel_13 = Panel(merge_16)  # disabled

cutmeshgcurvature = CutMeshGCurvature(TriangulatedMeshOrCutMesh=meshcutbylines_3)  # disabled
number_slider_14 = Slider(30, range=0..100)  # disabled
abs = Absolute(Value=cutmeshgcurvature)  # disabled
lng = ListLength(List=cutmeshgcurvature)  # disabled
series = Series(Start=0, Step=1, Count=lng)  # disabled
series_2 = Series(Start=0, Step=1, Count=number_slider_14)  # disabled
sort_12 = SortList(Keys=abs, ValuesA=series)  # -> Keys, ValuesA; disabled

x_plus_one = XPlusOne(NumberX=series_2)  # disabled
avr_12 = Average(Input=sort_12.Keys)  # disabled
item_12 = ListItem(List=sort_12.Keys, Index=0, Wrap=True)  # -> Item1, Item; disabled
merge_17 = Merge(Data1=avr_12, Data2=item_12.Item1, Data3=item_12.Item)  # disabled

neg = Negative(Value=x_plus_one)  # disabled
item_13 = ListItem(List=sort_12.ValuesA, Index=neg, Wrap=True)  # disabled
panel_14 = Panel(merge_17)  # disabled

cutmeshgcurvature_2 = CutMeshGCurvature(TriangulatedMeshOrCutMesh=meshcutbylines_2)  # disabled
number_slider_15 = Slider(30, range=0..100)  # disabled
abs_2 = Absolute(Value=cutmeshgcurvature_2)  # disabled
lng_2 = ListLength(List=cutmeshgcurvature_2)  # disabled
series_3 = Series(Start=0, Step=1, Count=lng_2)  # disabled
series_4 = Series(Start=0, Step=1, Count=number_slider_15)  # disabled
sort_13 = SortList(Keys=abs_2, ValuesA=series_3)  # -> Keys, ValuesA; disabled

x_plus_one_2 = XPlusOne(NumberX=series_4)  # disabled
avr_13 = Average(Input=sort_13.Keys)  # disabled
item_14 = ListItem(List=sort_13.Keys, Index=0, Wrap=True)  # -> Item1, Item; disabled
merge_18 = Merge(Data1=avr_13, Data2=item_14.Item1, Data3=item_14.Item)  # disabled

panel_15 = Panel(merge_18)  # disabled
neg_2 = Negative(Value=x_plus_one_2)  # disabled
item_15 = ListItem(List=sort_13.ValuesA, Index=neg_2, Wrap=True)  # disabled

cutmeshgcurvature_3 = CutMeshGCurvature(TriangulatedMeshOrCutMesh=developcm3_3)  # disabled
number_slider_16 = Slider(30, range=0..100)  # disabled
abs_3 = Absolute(Value=cutmeshgcurvature_3)  # disabled
lng_3 = ListLength(List=cutmeshgcurvature_3)  # disabled
series_5 = Series(Start=0, Step=1, Count=lng_3)  # disabled
series_6 = Series(Start=0, Step=1, Count=number_slider_16)  # disabled
sort_14 = SortList(Keys=abs_3, ValuesA=series_5)  # -> Keys, ValuesA; disabled

x_plus_one_3 = XPlusOne(NumberX=series_6)  # disabled
avr_14 = Average(Input=sort_14.Keys)  # disabled
item_16 = ListItem(List=sort_14.Keys, Index=0, Wrap=True)  # -> Item1, Item; disabled
merge_19 = Merge(Data1=avr_14, Data2=item_16.Item1, Data3=item_16.Item)  # disabled

panel_16 = Panel(merge_19)  # disabled
neg_3 = Negative(Value=x_plus_one_3)  # disabled
item_17 = ListItem(List=sort_14.ValuesA, Index=neg_3, Wrap=True)  # disabled

cutmeshgcurvature_4 = CutMeshGCurvature(TriangulatedMeshOrCutMesh=developcm3_4)  # disabled
number_slider_17 = Slider(30, range=0..100)  # disabled
abs_4 = Absolute(Value=cutmeshgcurvature_4)  # disabled
lng_4 = ListLength(List=cutmeshgcurvature_4)  # disabled
series_7 = Series(Start=0, Step=1, Count=lng_4)  # disabled
series_8 = Series(Start=0, Step=1, Count=number_slider_17)  # disabled
sort_15 = SortList(Keys=abs_4, ValuesA=series_7)  # -> Keys, ValuesA; disabled

x_plus_one_4 = XPlusOne(NumberX=series_8)  # disabled
avr_15 = Average(Input=sort_15.Keys)  # disabled
item_18 = ListItem(List=sort_15.Keys, Index=0, Wrap=True)  # -> Item1, Item; disabled
merge_20 = Merge(Data1=avr_15, Data2=item_18.Item1, Data3=item_18.Item)  # disabled

panel_17 = Panel(merge_20)  # disabled
neg_4 = Negative(Value=x_plus_one_4)  # disabled
item_19 = ListItem(List=sort_15.ValuesA, Index=neg_4, Wrap=True)  # disabled
