# Grasshopper definition innerCutDev.gh (Grasshopper 1.0.8)
# plug-ins: Heteroptera, Pufferfish, Human, Hagoromo, Weaverbird, NGon_RH8

crv = Curve([<curve referenced from the Rhino model> x35])
wbweave = WeaverbirdsMeshFromLinesWeaveBack(Lines=crv, MaximumValence=4)
mbridgecm = MbridgeCM(TriangulatedMeshOrCutMesh=wbweave)
crv_2 = Curve([<curve referenced from the Rhino model> x3])
meshcutbylines = MeshCutWithCutLines(TriangulatedMeshOrCutMesh=mbridgecm, OpenCutLinesPolylines=crv_2)
sortcutmesh = SortCutMesh(TriangulatedMeshOrCutMesh=meshcutbylines)
outerboundary = OuterBoundary(TriangulatedMeshOrCutMesh=sortcutmesh)  # -> OuterEdges, OuterVertsIndices
_10º = PowerOf10(Value=Slider(3, range=0..10))
developcgls = DevelopCGLS(
    TriangulatedCutMesh=meshcutbylines,
    InnerIter=100,
    OuterIter=30,
    XyMirror=False,
    YzMirror=False,
    ZxMirror=False,
    OuterBoundaryCurves=outerboundary.OuterEdges,
    FixPointsCrv=flatten([crv_2, outerboundary.OuterEdges]),
    EdgeW=1,
    SmoothW=1,
    DevW=_10º,
    PositionW=1,
    LenRangeW=1)
mbridgecm_2 = MbridgeCM(TriangulatedMeshOrCutMesh=developcgls)
netlbfgs2 = NetLBFGS2(TriangulatedMeshOrCutMesh=developcgls, W0=1, W1=1)  # -> CutMesh, FeatureLinesPolylines
crv_3 = Curve([<curve referenced from the Rhino model> x6])
mbridgecm_3 = MbridgeCM(TriangulatedMeshOrCutMesh=netlbfgs2.CutMesh)
preview = CustomPreview(Geometry=mbridgecm_3, Material=ColourSwatch(SwatchColor=RGBA(0, 0, 0, 114)))
crv_4 = Curve([<curve referenced from the Rhino model> x3])
preview_2 = CustomPreview(Geometry=mbridgecm_2, Material=ColourSwatch(SwatchColor=RGBA(0, 0, 0, 114)))
previewlw = CustomPreviewLineweights(Geometry=crv_3, Shader=ColourSwatch(SwatchColor=RGB(255, 0, 0)), Thickness=Slider(5, range=0..10), Absolute=False)
meshedges = MeshEdges(Mesh=mbridgecm_2)  # -> AllE, NakedE
meshedges_2 = MeshEdges(Mesh=mbridgecm_3)  # -> AllE, NakedE
previewlw_2 = CustomPreviewLineweights(Geometry=crv_4, Shader=ColourSwatch(SwatchColor=RGB(255, 0, 0)), Thickness=Slider(5, range=0..10), Absolute=False)
previewlw_3 = CustomPreviewLineweights(
    Geometry=meshedges.AllE,
    Shader=ColourSwatch(SwatchColor=RGBA(0, 0, 0, 114)),
    Thickness=Slider(0, range=0..10),
    Absolute=False)
previewlw_4 = CustomPreviewLineweights(
    Geometry=meshedges_2.AllE,
    Shader=ColourSwatch(SwatchColor=RGBA(0, 0, 0, 114)),
    Thickness=Slider(0, range=0..10),
    Absolute=False)
mesh = Mesh(<mesh referenced from the Rhino model>)
meshedges_3 = MeshEdges(Mesh=mesh)  # -> AllE, NakedE
_10º_2 = PowerOf10(Value=Slider(-3, range=-10..10))
crv_5 = Curve(meshedges_3.AllE)
_10º_3 = PowerOf10(Value=Slider(4, range=-10..10))
crv_6 = Curve([<curve referenced from the Rhino model> x81])
crv_7 = Curve(<curve referenced from the Rhino model>)
number_slider = Slider(5000, range=0..10000)
project = Project(Geometry=crv_6, Plane=PlaneXY(0, 0, 0))  # -> Geometry, Transform
number_slider_2 = Slider(1000, range=0..1000)
len = Length(Curve=crv_6)
number_slider_3 = Slider(1, range=0..100)
wbweave_2 = WeaverbirdsMeshFromLinesWeaveBack(Lines=project.Geometry, MaximumValence=4)
avr = Average(Input=len)
crv_8 = Curve(<curve referenced from the Rhino model>)
explode = Explode(Curve=crv_8, Recursive=True)  # -> Segments, Vertices
project_2 = Project(Geometry=crv_8, Plane=PlaneXY(0, 0, 0))  # -> Geometry, Transform
_10º_4 = PowerOf10(Value=Slider(3, range=0..10))
_10º_5 = PowerOf10(Value=Slider(-3, range=-3..10))
panel = Panel("""0
1
2
3
4""")
panel_2 = Panel("12")
item = ListItem(List=explode.Segments, Index=panel, Wrap=True)
wbweave_3 = WeaverbirdsMeshFromLinesWeaveBack(Lines=crv_6, MaximumValence=4)
mbridgecm_4 = MbridgeCM(TriangulatedMeshOrCutMesh=wbweave_3)
sortcutmesh_2 = SortCutMesh(TriangulatedMeshOrCutMesh=mbridgecm_4)
mbridgecm_5 = MbridgeCM(TriangulatedMeshOrCutMesh=wbweave_3)
meshcutbylines_2 = MeshCutWithCutLines(TriangulatedMeshOrCutMesh=mbridgecm_5, OpenCutLinesPolylines=item)
meshcutbylines_3 = MeshCutWithCutLines(TriangulatedMeshOrCutMesh=meshcutbylines_2, OpenCutLinesPolylines=crv_7)
dividecutmesh = DivideCutMesh(TriangulatedMeshOrCutMesh=meshcutbylines_3)
item_2 = ListItem(List=dividecutmesh, Index="1", Wrap=True)
mbridgecm_6 = MbridgeCM(TriangulatedMeshOrCutMesh=item_2)
meshedges_4 = MeshEdges(Mesh=mbridgecm_6)  # -> AllE, NakedE
sortcutmesh_3 = SortCutMesh(TriangulatedMeshOrCutMesh=meshcutbylines_2)
cutmeshedges = CutMeshEdges(TriangulatedMeshOrCutMesh=mbridgecm_4)  # -> MeshAllEdges, MeshNakedEdges
meshedges_5 = MeshEdges(Mesh=wbweave_3)  # -> AllE, NakedE
deccutmesh = DeconstructCutMesh(TriangulatedMeshOrCutMesh=sortcutmesh_3)  # -> Vertices, Faces, Edges, Dups
categorycheck = CategoryCheck(
    TriangulatedCutMesh=sortcutmesh_3,
    XyMirror=False,
    YzMirror=False,
    ZxMirror=False,
    OuterBoundaryCurves=cutmeshedges.MeshNakedEdges)
meshcutbylines_4 = MeshCutWithCutLines(TriangulatedMeshOrCutMesh=wbweave_2, OpenCutLinesPolylines=project_2.Geometry)
series = Series(Start=_10º_4, Step="0", Count="6")
meshedges_6 = MeshEdges(Mesh=wbweave_2)  # -> AllE, NakedE
X = UnitX(Factor=Slider(123, range=0..1000))
deccutmesh_2 = DeconstructCutMesh(TriangulatedMeshOrCutMesh=sortcutmesh_3)  # -> Vertices, Faces, Edges, Dups
number_slider_4 = Slider(40, range=0..100)
checkobjective = CheckObjective(TriangulatedCutMesh=mbridgecm_4, XyMirror=False, YzMirror=False, ZxMirror=False, OuterBoundaryCurves=meshedges_5.NakedE)
consvalue = CheckConstraintsValue(
    TriangulatedCutMesh=sortcutmesh_3,
    Iterations=Slider(2, range=0..10),
    XyMirror=False,
    YzMirror=False,
    ZxMirror=False,
    OuterBoundaryCurves=cutmeshedges.MeshNakedEdges)  # -> VertToConstraints, ConstraintsOrder, VertOrderInDup, DupVertIndices, DevConsCount
number_slider_5 = Slider(12, range=0..100)
developcgnr = DevelopCGNR(
    TriangulatedCutMesh=item_2,
    Iterations=number_slider_5,
    XyMirror=False,
    YzMirror=False,
    ZxMirror=False,
    OuterBoundaryCurves=meshedges_4.NakedE,
    EdgeW=_10º_2,
    SmoothW=1,
    DevW=_10º_3)  # -> ModifiedCutMesh, DevEnergy
panel_3 = Panel(developcgnr.DevEnergy)
cutmeshedges_2 = CutMeshEdges(TriangulatedMeshOrCutMesh=developcgnr.ModifiedCutMesh)  # -> MeshAllEdges, MeshNakedEdges
merge = Merge(Data1=_10º_5, Data2=series)  # -> flatten(Result)
developcm5 = DevelopCutMesh5(
    TriangulatedCutMesh=sortcutmesh_2,
    Iterations=number_slider_3,
    XyMirror=False,
    YzMirror=False,
    ZxMirror=False,
    OuterBoundaryCurves=cutmeshedges.MeshNakedEdges,
    Weight=merge)
cutmeshedges_3 = CutMeshEdges(TriangulatedMeshOrCutMesh=developcm5)  # -> MeshAllEdges, MeshNakedEdges
move = Move(Geometry=meshedges_6.NakedE, Motion=X)  # -> Geometry, Transform
movecm = MoveCutMesh(TriangulatedMeshOrCutMesh=meshcutbylines_4, MoveDirection=X)
meshedges_7 = MeshEdges(Mesh=wbweave_3)  # -> AllE, NakedE
number_slider_6 = Slider(100, range=0..100)
number_slider_7 = Slider(0, range=0..10)
checkobjective_2 = CheckObjective(
    TriangulatedCutMesh=developcm5,
    XyMirror=False,
    YzMirror=False,
    ZxMirror=False,
    OuterBoundaryCurves=cutmeshedges_3.MeshNakedEdges)
panel_4 = Panel(checkobjective_2)
number_slider_8 = Slider(10, range=0..10)
item_3 = ListItem(List=cutmeshedges_2.MeshAllEdges, Index=Slider(29, range=0..100), Wrap=True)
deccutmesh_3 = DeconstructCutMesh(TriangulatedMeshOrCutMesh=sortcutmesh_2)  # -> Vertices, Faces, Edges, Dups
bang = ExplodeTree(Data=categorycheck)  # -> Branch0, Branch1, Branch2, Branch3, Branch4
panel_5 = Panel(avr)
panel_6 = Panel(checkobjective)
consvalue_2 = CheckConstraintsValue(
    TriangulatedCutMesh=sortcutmesh_3,
    Iterations=number_slider_3,
    XyMirror=False,
    YzMirror=False,
    ZxMirror=False,
    OuterBoundaryCurves=cutmeshedges.MeshNakedEdges)  # -> VertToConstraints, ConstraintsOrder, VertOrderInDup, DupVertIndices, DevConsCount
_10º_6 = PowerOf10(Value=Slider(0, range=-10..10))
meshcutbylines_5 = MeshCutWithCutLines(TriangulatedMeshOrCutMesh=developcgnr.ModifiedCutMesh, OpenCutLinesPolylines=item_3)
panel_7 = Panel(merge)
sort = SortList(Keys=consvalue.VertOrderInDup)  # -> Keys, ValuesA
item_4 = ListItem(List=deccutmesh_3.Vertices, Index=Slider(26, range=0..100), Wrap=True)
developcm2 = DevelopCutMesh2(
    TriangulatedCutMesh=movecm,
    Iterations=number_slider_4,
    XyMirror=False,
    YzMirror=False,
    ZxMirror=False,
    OuterBoundaryCurves=move.Geometry,
    Alpha=0.1)
item_5 = ListItem(List=deccutmesh_2.Vertices, Index=bang.Branch1, Wrap=True)
developcgnr_2 = DevelopCGNR(
    TriangulatedCutMesh=meshcutbylines_4,
    Iterations=number_slider_4,
    XyMirror=False,
    YzMirror=False,
    ZxMirror=False,
    OuterBoundaryCurves=meshedges_6.NakedE,
    EdgeW=1,
    SmoothW=1,
    DevW=_10º_6)  # -> ModifiedCutMesh, DevEnergy
developcm5_2 = DevelopCutMesh5(
    TriangulatedCutMesh=sortcutmesh_3,
    Iterations=number_slider_5,
    XyMirror=False,
    YzMirror=False,
    ZxMirror=False,
    OuterBoundaryCurves=cutmeshedges.MeshNakedEdges,
    Weight=merge)
larger = LargerThan(SecondNumber="0")  # -> LargerThan, OrEqualTo
number_slider_9 = Slider(21, range=0..100)
categorycheck_2 = CategoryCheck(
    TriangulatedCutMesh=sortcutmesh_3,
    XyMirror=False,
    YzMirror=False,
    ZxMirror=False,
    OuterBoundaryCurves=cutmeshedges.MeshNakedEdges)
_10º_7 = PowerOf10()
consvalue_3 = CheckConstraintsValue(
    TriangulatedCutMesh=sortcutmesh_2,
    Iterations=number_slider_3,
    XyMirror=False,
    YzMirror=False,
    ZxMirror=False,
    OuterBoundaryCurves=cutmeshedges.MeshNakedEdges)  # -> VertToConstraints, ConstraintsOrder, VertOrderInDup, DupVertIndices, DevConsCount
_10º_8 = PowerOf10(Value=Slider(0, range=-10..10))
netbff = NetBFF(TriangulatedMeshOrCutMesh=meshcutbylines_5)  # -> CutMesh, FeatureLinesPolylines
cutmeshedges_4 = CutMeshEdges(TriangulatedMeshOrCutMesh=developcm2)  # -> MeshAllEdges, MeshNakedEdges
sort_2 = SortList(Keys=consvalue_2.VertOrderInDup)  # -> Keys, ValuesA
panel_8 = Panel(bang.Branch4)
sort_3 = SortList(Keys=consvalue_2.ConstraintsOrder)  # -> Keys, ValuesA
sortcutmesh_4 = SortCutMesh(TriangulatedMeshOrCutMesh=sortcutmesh_2)
mbridgecm_7 = MbridgeCM(TriangulatedMeshOrCutMesh=developcm5_2)
mbridgecm_8 = MbridgeCM(TriangulatedMeshOrCutMesh=netbff.CutMesh)
number_slider_10 = Slider(100, range=0..100)
_10º_9 = PowerOf10(Value=Slider(0, range=-10..10))
_10º_10 = PowerOf10(Value=Slider(3, range=-10..10))
_10º_11 = PowerOf10(Value=Slider(2, range=-10..10))
number_slider_11 = Slider(6846, range=0..10000)
_10º_12 = PowerOf10(Value=Slider(-3, range=-10..10))
number_slider_12 = Slider(0.01, range=0..0.01)
number_slider_13 = Slider(0.1, range=0..0.1)
number_slider_14 = Slider(10, range=0..10)
panel_9 = Panel(developcgnr_2.DevEnergy)
center = Center(Geometry=mbridgecm_8)  # -> Center, Dimension
pt = Point(Point(0, 0, 0))
item_6 = ListItem(List=cutmeshedges_4.MeshAllEdges, Index="46", Wrap=True)
meshedges_8 = MeshEdges(Mesh=mbridgecm_7)  # -> AllE, NakedE
division = Division(A=avr, B=Slider(200, range=0..1000))
meshcutbylines_6 = MeshCutWithCutLines(TriangulatedMeshOrCutMesh=developcm2, OpenCutLinesPolylines=item_6)
developcgnr_3 = DevelopCGNR(
    TriangulatedCutMesh=sortcutmesh_3,
    Iterations=number_slider_5,
    XyMirror=False,
    YzMirror=False,
    ZxMirror=False,
    OuterBoundaryCurves=cutmeshedges.MeshNakedEdges,
    EdgeW=1,
    SmoothW=1,
    DevW=_10º_8)  # -> ModifiedCutMesh, DevEnergy
division_2 = Division(A=developcgnr_3.DevEnergy, B=_10º_8)
move2pt = MoveToPoint(Geometry=mbridgecm_8, PointA=center.Center, PointB=pt)  # -> Moved, Vector, Transform
larger_2 = LargerThan(FirstNumber=consvalue_3.ConstraintsOrder, SecondNumber="-1")  # -> LargerThan, OrEqualTo
checkobjective_3 = CheckObjective(TriangulatedCutMesh=developcm5_2, XyMirror=False, YzMirror=False, ZxMirror=False, OuterBoundaryCurves=meshedges_8.NakedE)
larger_3 = LargerThan(FirstNumber=consvalue_3.DupVertIndices, SecondNumber=Slider(26, range=0..100))  # -> LargerThan, OrEqualTo
developcgls_2 = DevelopCGLS(
    TriangulatedCutMesh=sortcutmesh_3,
    Iterations=number_slider_5,
    YzMirror=False,
    ZxMirror=False,
    OuterBoundaryCurves=cutmeshedges.MeshNakedEdges,
    EdgeW=_10º_12,
    SmoothW=1,
    DevW=_10º_9,
    DevW_2=1,
    PositionW=1,
    LenRangeW=1)
number_slider_15 = Slider(26, range=0..100)
cutmeshedges_5 = CutMeshEdges(TriangulatedMeshOrCutMesh=developcgnr_2.ModifiedCutMesh)  # -> MeshAllEdges, MeshNakedEdges
panel_10 = Panel(division_2)
cutmeshedges_6 = CutMeshEdges(TriangulatedMeshOrCutMesh=developcm5_2)  # -> MeshAllEdges, MeshNakedEdges
panel_11 = Panel(checkobjective_3)
netbff_2 = NetBFF(TriangulatedMeshOrCutMesh=meshcutbylines_6)  # -> CutMesh, FeatureLinesPolylines
item_7 = ListItem(List=cutmeshedges_5.MeshAllEdges, Index="46", Wrap=True)
subtraction = Subtraction(A=larger_2.LargerThan, B=larger_3.LargerThan)
panel_12 = Panel(larger_3.LargerThan)
cutmeshedges_7 = CutMeshEdges(TriangulatedMeshOrCutMesh=developcm5_2)  # -> MeshAllEdges, MeshNakedEdges
item_8 = ListItem(List=cutmeshedges_6.MeshAllEdges, Index="46", Wrap=True)
center_2 = Center(Geometry=wbweave_3)  # -> Center, Dimension
cutmeshedges_8 = CutMeshEdges(TriangulatedMeshOrCutMesh=developcgnr_3.ModifiedCutMesh)  # -> MeshAllEdges, MeshNakedEdges
mbridgecm_9 = MbridgeCM(TriangulatedMeshOrCutMesh=netbff_2.CutMesh)
meshcutbylines_7 = MeshCutWithCutLines(TriangulatedMeshOrCutMesh=developcgnr_2.ModifiedCutMesh, OpenCutLinesPolylines=item_7)
series_2 = Series(Start=0, Step=1, Count=Slider(27, range=0..100))
cutmeshedges_9 = CutMeshEdges(TriangulatedMeshOrCutMesh=developcgls_2)  # -> MeshAllEdges, MeshNakedEdges
meshcutbylines_8 = MeshCutWithCutLines(TriangulatedMeshOrCutMesh=developcm5_2, OpenCutLinesPolylines=item_8)
len_2 = Length(Curve=cutmeshedges_7.MeshAllEdges)
論文用 = Mesh(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)
panel_13 = Panel(categorycheck_2)
center_3 = Center(Geometry=mbridgecm_9)  # -> Center, Dimension
item_9 = ListItem(List=cutmeshedges_8.MeshAllEdges, Index="46", Wrap=True)
panel_14 = Panel(subtraction)
netbff_3 = NetBFF(TriangulatedMeshOrCutMesh=meshcutbylines_8)  # -> CutMesh, FeatureLinesPolylines
item_10 = ListItem(List=cutmeshedges_9.MeshAllEdges, Index="46", Wrap=True)
netbff_4 = NetBFF(TriangulatedMeshOrCutMesh=meshcutbylines_7)  # -> CutMesh, FeatureLinesPolylines
mbridgecm_10 = MbridgeCM(TriangulatedMeshOrCutMesh=netbff_4.CutMesh)
meshcutbylines_9 = MeshCutWithCutLines(TriangulatedMeshOrCutMesh=developcgnr_3.ModifiedCutMesh, OpenCutLinesPolylines=item_9)
mbridgecm_11 = MbridgeCM(TriangulatedMeshOrCutMesh=netbff_3.CutMesh)
center_4 = Center(Geometry=mbridgecm_10)  # -> Center, Dimension
move2pt_2 = MoveToPoint(Geometry=mbridgecm_9, PointA=center_3.Center, PointB=center_2.Center)  # -> Moved, Vector, Transform
meshcutbylines_10 = MeshCutWithCutLines(TriangulatedMeshOrCutMesh=developcgls_2, OpenCutLinesPolylines=item_10)
center_5 = Center(Geometry=wbweave_3)  # -> Center, Dimension
_10º_13 = PowerOf10(Value=Slider(-6, range=-10..10))
_10º_14 = PowerOf10(Value=Slider(0, range=-10..10))
pt_2 = Point(Point(0, 0, 0))
panel_15 = Panel("0")
move2pt_3 = MoveToPoint(Geometry=mbridgecm_10, PointA=center_4.Center, PointB=pt_2)  # -> Moved, Vector, Transform
netbff_5 = NetBFF(TriangulatedMeshOrCutMesh=meshcutbylines_9)  # -> CutMesh, FeatureLinesPolylines
netcgnr = NetCGNR(TriangulatedMeshOrCutMesh=developcm5_2, Iterations=Slider(300, range=0..1000), W0=_10º_10, W1=_10º_11, Switch=False)  # -> CutMesh, FeatureLinesPolylines
deccutmesh_4 = DeconstructCutMesh(TriangulatedMeshOrCutMesh=netcgnr.CutMesh)  # -> Vertices, Faces, Edges, Dups
cutmeshedges_10 = CutMeshEdges(TriangulatedMeshOrCutMesh=netcgnr.CutMesh)  # -> MeshAllEdges, MeshNakedEdges
len_3 = Length(Curve=cutmeshedges_10.MeshAllEdges)
pdecon = Deconstruct(Point=deccutmesh_4.Vertices)  # -> XComponent, YComponent, ZComponent
subtraction_2 = Subtraction(A=len_2, B=len_3)
avr_2 = Average(Input=pdecon.ZComponent)
sort_4 = SortList(Keys=subtraction_2)  # -> Keys, ValuesA
sqr = Square(Value=sort_4.Keys)
subtraction_3 = Subtraction(A=pdecon.ZComponent, B=avr_2)
sort_5 = SortList(Keys=subtraction_3)  # -> Keys, ValuesA
avr_3 = Average(Input=sort_5.Keys)
item_11 = ListItem(List=sort_5.Keys, Index=0, Wrap=True)  # -> Item1, Item
avr_4 = Average(Input=sqr)
panel_16 = Panel(avr_4)
center_6 = Center(Geometry=mbridgecm_11)  # -> Center, Dimension
_10º_15 = PowerOf10(Value=Slider(2, range=-10..10))
netbff_6 = NetBFF(TriangulatedMeshOrCutMesh=meshcutbylines_10)  # -> CutMesh, FeatureLinesPolylines
mbridgecm_12 = MbridgeCM(TriangulatedMeshOrCutMesh=netbff_5.CutMesh)
panel_17 = Panel(sort_4.Keys)
_10º_16 = PowerOf10(Value=Slider(-10, range=-10..10))
panel_18 = Panel([item_11.Item1, item_11.Item])
mbridgecm_13 = MbridgeCM(TriangulatedMeshOrCutMesh=netbff_6.CutMesh)
center_7 = Center(Geometry=mbridgecm_12)  # -> Center, Dimension
pt_3 = Point(Point(0, 0, 0))
move2pt_4 = MoveToPoint(Geometry=mbridgecm_11, PointA=center_6.Center, PointB="0,0,0")  # -> Moved, Vector, Transform
center_8 = Center(Geometry=mbridgecm_13)  # -> Center, Dimension
pt_4 = Point(Point(0, 0, 0))
move2pt_5 = MoveToPoint(Geometry=mbridgecm_12, PointA=center_7.Center, PointB=pt_3)  # -> Moved, Vector, Transform
move2pt_6 = MoveToPoint(Geometry=mbridgecm_13, PointA=center_8.Center, PointB=pt_4)  # -> Moved, Vector, Transform
panel_19 = Panel("""0.001
1000
1000
1000
1000
1000
1000""")
meshcutbylines_11 = MeshCutWithCutLines(TriangulatedMeshOrCutMesh=wbweave_3, OpenCutLinesPolylines=crv_8)
number_slider_16 = Slider(100, range=0..100)
sortcutmesh_5 = SortCutMesh(TriangulatedMeshOrCutMesh=meshcutbylines_11)
sortcutmesh_6 = SortCutMesh(TriangulatedMeshOrCutMesh=sortcutmesh_5)
developcm5_3 = DevelopCutMesh5(
    TriangulatedCutMesh=sortcutmesh_6,
    Iterations=Slider(300, range=0..1000),
    XyMirror=False,
    YzMirror=False,
    ZxMirror=False,
    OuterBoundaryCurves=meshedges_7.NakedE,
    Weight=merge)
mbridgecm_14 = MbridgeCM(TriangulatedMeshOrCutMesh=developcm5_3)
meshedges_9 = MeshEdges(Mesh=mbridgecm_14)  # -> AllE, NakedE
cutmeshedges_11 = CutMeshEdges(TriangulatedMeshOrCutMesh=developcm5_3)  # -> MeshAllEdges, MeshNakedEdges
checkobjective_4 = CheckObjective(TriangulatedCutMesh=developcm5_3, XyMirror=False, YzMirror=False, ZxMirror=False, OuterBoundaryCurves=meshedges_9.NakedE)
item_12 = ListItem(List=cutmeshedges_11.MeshAllEdges, Index="46", Wrap=True)
rondomcutmesh = RondomCutMesh(TriangulatedMeshOrCutMesh=sortcutmesh_6, Difference=Slider(0.1, range=0..1), Count=Slider(100, range=0..100))
cutmeshedges_12 = CutMeshEdges(TriangulatedMeshOrCutMesh=sortcutmesh_6)  # -> MeshAllEdges, MeshNakedEdges
panel_20 = Panel(checkobjective_4)
meshcutbylines_12 = MeshCutWithCutLines(TriangulatedMeshOrCutMesh=developcm5_3, OpenCutLinesPolylines=item_12)
developcm3 = DevelopCutMesh3(
    TriangulatedCutMesh=sortcutmesh_6,
    Iterations=Slider(1000, range=0..1000),
    XyMirror=False,
    YzMirror=False,
    ZxMirror=False,
    OuterBoundaryCurves=meshedges_7.NakedE,
    Alpha=1)
cutmeshedges_13 = CutMeshEdges(TriangulatedMeshOrCutMesh=developcm3)  # -> MeshAllEdges, MeshNakedEdges
item_13 = ListItem(List=cutmeshedges_13.MeshAllEdges, Index="46", Wrap=True)
item_14 = ListItem(List=rondomcutmesh, Index=Slider(17, range=0..100), Wrap=True)
item_15 = ListItem(List=cutmeshedges_12.MeshAllEdges, Index="46", Wrap=True)
panel_21 = Panel(rondomcutmesh)
meshcutbylines_13 = MeshCutWithCutLines(TriangulatedMeshOrCutMesh=developcm3, OpenCutLinesPolylines=item_13)
netbff_7 = NetBFF(TriangulatedMeshOrCutMesh=meshcutbylines_12)  # -> CutMesh, FeatureLinesPolylines
cutmeshedges_14 = CutMeshEdges(TriangulatedMeshOrCutMesh=item_14)  # -> MeshAllEdges, MeshNakedEdges
meshcutbylines_14 = MeshCutWithCutLines(TriangulatedMeshOrCutMesh=sortcutmesh_6, OpenCutLinesPolylines=item_15)
mbridgecm_15 = MbridgeCM(TriangulatedMeshOrCutMesh=item_14)
sortcutmesh_7 = SortCutMesh(TriangulatedMeshOrCutMesh=meshcutbylines_13)
mbridgecm_16 = MbridgeCM(TriangulatedMeshOrCutMesh=netbff_7.CutMesh)
cutmeshedges_15 = CutMeshEdges(TriangulatedMeshOrCutMesh=meshcutbylines_13)  # -> MeshAllEdges, MeshNakedEdges
netbff_8 = NetBFF(TriangulatedMeshOrCutMesh=sortcutmesh_7)  # -> CutMesh, FeatureLinesPolylines
netbff_9 = NetBFF(TriangulatedMeshOrCutMesh=meshcutbylines_14)  # -> CutMesh, FeatureLinesPolylines
netbfflength = NetBFFLength(TriangulatedMeshOrCutMesh=meshcutbylines_14, OuterBoundaryVertCount=-1)  # -> CutMesh, FeatureLinesPolylines
item_16 = ListItem(List=cutmeshedges_14.MeshNakedEdges, Index=series_2, Wrap=True)
developcm2_2 = DevelopCutMesh2(
    TriangulatedCutMesh=item_14,
    Iterations=Slider(94, range=0..200),
    XyMirror=False,
    YzMirror=False,
    ZxMirror=False,
    OuterBoundaryCurves=item_16,
    Alpha=division)
cutmeshedges_16 = CutMeshEdges(TriangulatedMeshOrCutMesh=developcm2_2)  # -> MeshAllEdges, MeshNakedEdges
item_17 = ListItem(List=cutmeshedges_16.MeshAllEdges, Index="46", Wrap=True)
meshcutbylines_15 = MeshCutWithCutLines(TriangulatedMeshOrCutMesh=developcm2_2, OpenCutLinesPolylines=item_17)
crv_9 = Curve(cutmeshedges_15.MeshNakedEdges)
center_9 = Center(Geometry=mbridgecm_16)  # -> Center, Dimension
deccutmesh_5 = DeconstructCutMesh(TriangulatedMeshOrCutMesh=netbff_8.CutMesh)  # -> Vertices, Faces, Edges, Dups
mbridgecm_17 = MbridgeCM(TriangulatedMeshOrCutMesh=netbff_8.CutMesh)
netbff_10 = NetBFF(TriangulatedMeshOrCutMesh=meshcutbylines_15)  # -> CutMesh, FeatureLinesPolylines
move2pt_7 = MoveToPoint(Geometry=mbridgecm_16, PointA=center_9.Center, PointB="0,0,0")  # -> Moved, Vector, Transform
center_10 = Center(Geometry=mbridgecm_17)  # -> Center, Dimension
mbridgecm_18 = MbridgeCM(TriangulatedMeshOrCutMesh=netbff_10.CutMesh)
categorycheck_3 = CategoryCheck(
    TriangulatedCutMesh=sortcutmesh_6,
    XyMirror=False,
    YzMirror=False,
    ZxMirror=False,
    OuterBoundaryCurves=meshedges_7.NakedE)
move2pt_8 = MoveToPoint(Geometry=mbridgecm_17, PointA=center_10.Center, PointB=center_5.Center)  # -> Moved, Vector, Transform
developcgnr_4 = DevelopCGNR(
    TriangulatedCutMesh=sortcutmesh_6,
    Iterations=number_slider_9,
    XyMirror=False,
    YzMirror=False,
    ZxMirror=False,
    OuterBoundaryCurves=meshedges_7.NakedE,
    EdgeW=_10º_13,
    SmoothW=1,
    DevW=_10º_14)  # -> ModifiedCutMesh, DevEnergy
center_11 = Center(Geometry=mbridgecm_18)  # -> Center, Dimension
developcgls_3 = DevelopCGLS(
    TriangulatedCutMesh=sortcutmesh_6,
    Iterations=number_slider_9,
    YzMirror=False,
    ZxMirror=False,
    OuterBoundaryCurves=meshedges_7.NakedE,
    EdgeW=_10º_16,
    SmoothW=1,
    DevW=_10º_15,
    DevW_2=1,
    PositionW=1,
    LenRangeW=1)
move2pt_9 = MoveToPoint(Geometry=mbridgecm_18, PointA=center_11.Center, PointB="0,0,0")  # -> Moved, Vector, Transform
division_3 = Division(A=developcgnr_4.DevEnergy, B=_10º_14)
panel_22 = Panel(division_3)
panel_23 = Panel(categorycheck_3)
meshcutbylines_16 = MeshCutWithCutLines(TriangulatedMeshOrCutMesh=developcm3, OpenCutLinesPolylines=item_13)
deccutmesh_6 = DeconstructCutMesh(TriangulatedMeshOrCutMesh=sortcutmesh_6)  # -> Vertices, Faces, Edges, Dups
cutmeshedges_17 = CutMeshEdges(TriangulatedMeshOrCutMesh=developcgnr_4.ModifiedCutMesh)  # -> MeshAllEdges, MeshNakedEdges
item_18 = ListItem(List=cutmeshedges_17.MeshAllEdges, Index="46", Wrap=True)
cutmeshedges_18 = CutMeshEdges(TriangulatedMeshOrCutMesh=developcgls_3)  # -> MeshAllEdges, MeshNakedEdges
crv_10 = Curve(meshedges_7.NakedE)
item_19 = ListItem(List=cutmeshedges_18.MeshAllEdges, Index="46", Wrap=True)
item_20 = ListItem(List=deccutmesh_6.Vertices, Index=Slider(44, range=0..100), Wrap=True)
developcm5_4 = DevelopCutMesh5(
    TriangulatedCutMesh=sortcutmesh_6,
    Iterations=Slider(680, range=0..1000),
    XyMirror=False,
    YzMirror=False,
    ZxMirror=False,
    OuterBoundaryCurves=meshedges_7.NakedE,
    Weight=panel_19)
meshcutbylines_17 = MeshCutWithCutLines(TriangulatedMeshOrCutMesh=developcgnr_4.ModifiedCutMesh, OpenCutLinesPolylines=item_18)
meshcutbylines_18 = MeshCutWithCutLines(TriangulatedMeshOrCutMesh=developcgls_3, OpenCutLinesPolylines=item_19)
categorycheck_4 = CategoryCheck(
    TriangulatedCutMesh=sortcutmesh_5,
    XyMirror=False,
    YzMirror=False,
    ZxMirror=False,
    OuterBoundaryCurves=meshedges_7.NakedE)
deccutmesh_7 = DeconstructCutMesh(TriangulatedMeshOrCutMesh=sortcutmesh_5)  # -> Vertices, Faces, Edges, Dups
developcgls_4 = DevelopCGLS(
    TriangulatedCutMesh=sortcutmesh_5,
    InnerIter=100,
    OuterIter=30,
    XyMirror=False,
    YzMirror=False,
    ZxMirror=False,
    OuterBoundaryCurves=meshedges_7.NakedE,
    EdgeW="0",
    SmoothW="0",
    DevW=1,
    PositionW="0",
    LenRangeW="0")
netbff_11 = NetBFF(TriangulatedMeshOrCutMesh=meshcutbylines_17)  # -> CutMesh, FeatureLinesPolylines
mbridgecm_19 = MbridgeCM(TriangulatedMeshOrCutMesh=netbff_11.CutMesh)
bang_2 = ExplodeTree(Data=categorycheck_4)  # -> Branch0, Branch1, Branch2, Branch3
center_12 = Center(Geometry=mbridgecm_19)  # -> Center, Dimension
netbff_12 = NetBFF(TriangulatedMeshOrCutMesh=meshcutbylines_18)  # -> CutMesh, FeatureLinesPolylines
mbridgecm_20 = MbridgeCM(TriangulatedMeshOrCutMesh=netbff_12.CutMesh)
pt_5 = Point(Point(0, 0, 0))
move2pt_10 = MoveToPoint(Geometry=mbridgecm_19, PointA=center_12.Center, PointB=pt_5)  # -> Moved, Vector, Transform
center_13 = Center(Geometry=mbridgecm_20)  # -> Center, Dimension
cutmeshedges_19 = CutMeshEdges(TriangulatedMeshOrCutMesh=developcgls_4)  # -> MeshAllEdges, MeshNakedEdges
item_21 = ListItem(List=deccutmesh_7.Vertices, Index=bang_2.Branch0, Wrap=True)
pt_6 = Point(Point(0, 0, 0))
move2pt_11 = MoveToPoint(Geometry=mbridgecm_20, PointA=center_13.Center, PointB=pt_6)  # -> Moved, Vector, Transform
item_22 = ListItem(List=deccutmesh_7.Vertices, Index=Slider(27, range=0..100), Wrap=True)
panel_24 = Panel(bang_2.Branch2)
item_23 = ListItem(List=cutmeshedges_19.MeshAllEdges, Index=Slider(48, range=0..100), Wrap=True)
meshcutbylines_19 = MeshCutWithCutLines(TriangulatedMeshOrCutMesh=developcgls_4, OpenCutLinesPolylines=item_23)
previewlw_5 = CustomPreviewLineweights(Geometry=crv_6, Shader=ColourSwatch(SwatchColor=RGB(0, 0, 0)), Thickness=Slider(1, range=0..10), Absolute=False)
preview_3 = CustomPreview(Geometry=wbweave_3, Material=ColourSwatch(SwatchColor=RGB(166, 166, 166)))
previewlw_6 = CustomPreviewLineweights(
    Geometry=crv_8,
    Shader={diffuse=RGB(255, 105, 180), emission=RGB(76, 32, 54), shine=0.5, specular=RGB(255, 255, 255), transparency=0},
    Thickness=Slider(3, range=0..10),
    Absolute=False)
_10º_17 = PowerOf10(Value=Slider(3, range=0..10))
netlbfgs2_2 = NetLBFGS2(TriangulatedMeshOrCutMesh=meshcutbylines_19, W0=_10º_17, W1=1)  # -> CutMesh, FeatureLinesPolylines
cutmeshedges_20 = CutMeshEdges(TriangulatedMeshOrCutMesh=netlbfgs2_2.CutMesh)  # -> MeshAllEdges, MeshNakedEdges
join = JoinCurves(Curves=cutmeshedges_20.MeshNakedEdges, Preserve=False)
crv_11 = Curve(cutmeshedges_20.MeshAllEdges)
