# Grasshopper definition testHagoromo.gh (Grasshopper 1.0.8)
# plug-ins: Hagoromo, ghHogan

number_slider = Slider(1, range=-5..5)
number_slider_2 = Slider(0, range=-5..5)
number_slider_3 = Slider(4, range=0..10)
number_slider_4 = Slider(1, range=-5..5)
number_slider_5 = Slider(0, range=-5..5)
number_slider_6 = Slider(4, range=0..10)
pt = Point(Point(0, 0, -9.8))
pt_2 = Point(Point(0, 0, -9.8))
unit = AdjustUnits(
    YoungsModulus="2",
    EDigit="5",
    Density="40.8163",
    DDigit="0",
    Area="49",
    ADigit="1",
    Inertia_x="2000.8333",
    IxDigit="0",
    Inertia_y="200083.333",
    IyDigit="0",
    SaintVenant="200083.333",
    VDigit="0",
    Length="600",
    LDigit="0",
    体積力の加速度ベクトルの和=pt,
    ForceUnitParameter=number_slider_2,
    LengthUnitParameter=number_slider,
    EUnitParameter=number_slider_3)  # -> YoungsModulus, Density, Area, Inertia_x, Inertia_y, SaintVenant, Length, Gravity, ModelScale, ShowingEachValueAsText
merge = Merge(
    Data1=unit.YoungsModulus,
    Data2=unit.Density,
    Data3=unit.Area,
    Data4=unit.Inertia_x,
    Data5=unit.Inertia_y,
    Data6=unit.SaintVenant,
    Data7=unit.Length,
    Data8=unit.Gravity,
    Data9=unit.ModelScale)
panel = Panel(merge)
unit_2 = AdjustUnits(
    YoungsModulus="9",
    EDigit="8",
    Density="1530.6",
    DDigit="0",
    Area="4",
    ADigit="0",
    Inertia_x="133.333",
    IxDigit="-2",
    Inertia_y="133.333",
    IyDigit="-2",
    SaintVenant="133.333",
    VDigit="-2",
    Length="600",
    LDigit="0",
    体積力の加速度ベクトルの和=pt,
    ForceUnitParameter=number_slider_2,
    LengthUnitParameter=number_slider,
    EUnitParameter=number_slider_3)  # -> YoungsModulus, Density, Area, Inertia_x, Inertia_y, SaintVenant, Length, Gravity, ModelScale, ShowingEachValueAsText
merge_2 = Merge(
    Data1=unit_2.YoungsModulus,
    Data2=unit_2.Density,
    Data3=unit_2.Area,
    Data4=unit_2.Inertia_x,
    Data5=unit_2.Inertia_y,
    Data6=unit_2.SaintVenant,
    Data7=unit_2.Length,
    Data8=unit_2.Gravity,
    Data9=unit_2.ModelScale)
panel_2 = Panel(merge_2)
unit_3 = AdjustUnits(
    YoungsModulus="21",
    EDigit="7",
    Density="8010.2",
    DDigit="0",
    Area="3.6",
    ADigit="-1",
    Inertia_x="108",
    IxDigit="-4",
    Inertia_y="108",
    IyDigit="-4",
    SaintVenant="108",
    VDigit="-4",
    Length="600",
    LDigit="0",
    体積力の加速度ベクトルの和=pt,
    ForceUnitParameter=number_slider_2,
    LengthUnitParameter=number_slider,
    EUnitParameter=number_slider_3)  # -> YoungsModulus, Density, Area, Inertia_x, Inertia_y, SaintVenant, Length, Gravity, ModelScale, ShowingEachValueAsText
merge_3 = Merge(
    Data1=unit_3.YoungsModulus,
    Data2=unit_3.Density,
    Data3=unit_3.Area,
    Data4=unit_3.Inertia_x,
    Data5=unit_3.Inertia_y,
    Data6=unit_3.SaintVenant,
    Data7=unit_3.Length,
    Data8=unit_3.Gravity,
    Data9=unit_3.ModelScale)
panel_3 = Panel(merge_3)
unit_4 = AdjustUnits(
    YoungsModulus="2",
    EDigit="5",
    Density="40.8163",
    DDigit="0",
    Area="49",
    ADigit="1",
    Inertia_x="2000.8333",
    IxDigit="0",
    Inertia_y="200083.333",
    IyDigit="0",
    SaintVenant="200083.333",
    VDigit="0",
    Length="600",
    LDigit="0",
    体積力の加速度ベクトルの和=pt_2,
    ForceUnitParameter=number_slider_5,
    LengthUnitParameter=number_slider_4,
    EUnitParameter=number_slider_6)  # -> YoungsModulus, Density, Area, Inertia_x, Inertia_y, SaintVenant, Length, Gravity, ModelScale, ShowingEachValueAsText
merge_4 = Merge(
    Data1=unit_4.YoungsModulus,
    Data2=unit_4.Density,
    Data3=unit_4.Area,
    Data4=unit_4.Inertia_x,
    Data5=unit_4.Inertia_y,
    Data6=unit_4.SaintVenant,
    Data7=unit_4.Length,
    Data8=unit_4.Gravity,
    Data9=unit_4.ModelScale)
panel_4 = Panel(merge_4)
unit_5 = AdjustUnits(
    YoungsModulus="9",
    EDigit="8",
    Density="1530.6",
    DDigit="0",
    Area="4",
    ADigit="0",
    Inertia_x="133.333",
    IxDigit="-2",
    Inertia_y="133.333",
    IyDigit="-2",
    SaintVenant="133.333",
    VDigit="-2",
    Length="600",
    LDigit="0",
    体積力の加速度ベクトルの和=pt_2,
    ForceUnitParameter=number_slider_5,
    LengthUnitParameter=number_slider_4,
    EUnitParameter=number_slider_6)  # -> YoungsModulus, Density, Area, Inertia_x, Inertia_y, SaintVenant, Length, Gravity, ModelScale, ShowingEachValueAsText
merge_5 = Merge(
    Data1=unit_5.YoungsModulus,
    Data2=unit_5.Density,
    Data3=unit_5.Area,
    Data4=unit_5.Inertia_x,
    Data5=unit_5.Inertia_y,
    Data6=unit_5.SaintVenant,
    Data7=unit_5.Length,
    Data8=unit_5.Gravity,
    Data9=unit_5.ModelScale)
panel_5 = Panel(merge_5)
unit_6 = AdjustUnits(
    YoungsModulus="21",
    EDigit="7",
    Density="8010.2",
    DDigit="0",
    Area="3.6",
    ADigit="-1",
    Inertia_x="108",
    IxDigit="-4",
    Inertia_y="108",
    IyDigit="-4",
    SaintVenant="108",
    VDigit="-4",
    Length="600",
    LDigit="0",
    体積力の加速度ベクトルの和=pt_2,
    ForceUnitParameter=number_slider_5,
    LengthUnitParameter=number_slider_4,
    EUnitParameter=number_slider_6)  # -> YoungsModulus, Density, Area, Inertia_x, Inertia_y, SaintVenant, Length, Gravity, ModelScale, ShowingEachValueAsText
merge_6 = Merge(
    Data1=unit_6.YoungsModulus,
    Data2=unit_6.Density,
    Data3=unit_6.Area,
    Data4=unit_6.Inertia_x,
    Data5=unit_6.Inertia_y,
    Data6=unit_6.SaintVenant,
    Data7=unit_6.Length,
    Data8=unit_6.Gravity,
    Data9=unit_6.ModelScale)
panel_6 = Panel(merge_6)
pt_3 = Point([<point referenced from the Rhino model> x5])
number_slider_7 = Slider(23, range=0..100)
panel_7 = Panel("""1
1
1
0
0
0
1
1
1
0
0
1""")
panel_8 = Panel("""1
1
1
0
0
1
1
1
1
0
0
0""")
panel_9 = Panel("""1
1
1
0
0
0""")
item = ListItem(List=pt_3, Index=0, Wrap="false")  # -> Item, Item1, Item2, Item3, Item4
crv = Curve([<curve referenced from the Rhino model> x95])
crv_2 = Curve([<curve referenced from the Rhino model> x304])
crv_3 = Curve([<curve referenced from the Rhino model> x50])
multiplication = Multiplication(A=unit.Inertia_y, B="2")
crv_4 = Curve([<curve referenced from the Rhino model> x31])
multiplication_2 = Multiplication(A=unit.Inertia_x, B="8")
crv_5 = Curve([<curve referenced from the Rhino model> x45])
multiplication_3 = Multiplication(A=unit.Area, B="2")
pt_4 = Point([<point referenced from the Rhino model> x5])
end = EndPoints(Curve=crv_5)  # -> Start, End
cull_i = CullIndex(List=crv_3, Indices=number_slider_7, Wrap=True)
panel_10 = Panel("""1
1
1
1
1
1
1
1
1
0
0
0""")
line = Line(flatten(cull_i))
item_2 = ListItem(List=crv_3, Index=number_slider_7, Wrap=True)
line_2 = Line(flatten(item_2))
line_3 = Line(crv)
line_4 = Line(crv_2)
panel_11 = Panel("""1
1
1
0
0
0""")
item_3 = ListItem(List=pt_4, Index=0, Wrap="false")  # -> Item, Item1, Item2, Item3, Item4
line_5 = Line(crv_5)
line_6 = Line(crv_4)
crv_6 = Curve([<curve referenced from the Rhino model> x95])
crv_7 = Curve([<curve referenced from the Rhino model> x304])
prop = PropertyInfo(PropName="PName", PropId="3", Density=unit.Density, YoungsModulus=unit.YoungsModulus, PoissonsRatio="0.3")
prop_2 = PropertyInfo(PropName="PName", PropId="1", Density=unit_3.Density, YoungsModulus=unit_3.YoungsModulus, PoissonsRatio="0.3")
prop_3 = PropertyInfo(PropName="PName", PropId="2", Density=unit_2.Density, YoungsModulus=unit_2.YoungsModulus, PoissonsRatio="0.3")
pt_5 = Point(end.End)
crv_8 = Curve([<curve referenced from the Rhino model> x50])
crv_9 = Curve([<curve referenced from the Rhino model> x31])
multiplication_4 = Multiplication(A=unit_4.Inertia_y, B="2")
crv_10 = Curve([<curve referenced from the Rhino model> x45])
multiplication_5 = Multiplication(A=unit_4.Inertia_x, B="8")
multiplication_6 = Multiplication(A=unit_4.Area, B="2")
sect = SectionInfo(
    SectName="tension",
    SectId="1",
    PropId="1",
    Area=unit_3.Area,
    IXX=unit_3.Inertia_x,
    IYY=unit_3.Inertia_y,
    VEN=unit_3.SaintVenant)
sect_2 = SectionInfo(SectName="styro", SectId="3", PropId="3", Area=unit.Area, IXX=unit.Inertia_x, IYY=unit.Inertia_y, VEN=unit.SaintVenant)
sect_3 = SectionInfo(
    SectName="carbon",
    SectId="2",
    PropId="2",
    Area=unit_2.Area,
    IXX=unit_2.Inertia_x,
    IYY=unit_2.Inertia_y,
    VEN=unit_2.SaintVenant)
sect_4 = SectionInfo(
    SectName="styronibai",
    SectId="4",
    PropId="3",
    Area=multiplication_3,
    IXX=multiplication_2,
    IYY=multiplication,
    VEN=unit.SaintVenant)
end_2 = EndPoints(Curve=crv_10)  # -> Start, End
panel_12 = Panel("""0
0
0
0
0
0""")
pt_6 = Point(<point referenced from the Rhino model>)
line_7 = Line(crv_8)
line_8 = Line(crv_6)
line_9 = Line(crv_7)
elem = ElementInfo(
    Lines=line,
    SectId="1",
    Constraint=[True, True, True, True, True, True, True, True, True, True, True, True],
    CoordAngle=0,
    CMQ=[0, 0, 0, 0, 0, 0, 0, 0, 0, 0, 0, 0],
    CMQEd=[0, 0, 0, 0, 0, 0])
line_10 = Line(crv_10)
icon = IconInfo(Points=item.Item2, Constraints=panel_9)
elem_2 = ElementInfo(
    Lines=line_3,
    SectId="2",
    Constraint=[True, True, True, True, True, True, True, True, True, True, True, True],
    CoordAngle=0,
    CMQ=[0, 0, 0, 0, 0, 0, 0, 0, 0, 0, 0, 0],
    CMQEd=[0, 0, 0, 0, 0, 0])
elem_3 = ElementInfo(
    Lines=line_4,
    SectId="3",
    Constraint=[True, True, True, True, True, True, True, True, True, True, True, True],
    CoordAngle=0,
    CMQ=[0, 0, 0, 0, 0, 0, 0, 0, 0, 0, 0, 0],
    CMQEd=[0, 0, 0, 0, 0, 0])
icon_2 = IconInfo(Points=item.Item3, Constraints=panel_9)
icon_3 = IconInfo(Points=item.Item4, Constraints=panel_9)
icon_4 = IconInfo(Points=item.Item, Constraints=panel_9)
elem_4 = ElementInfo(
    Lines=line_6,
    SectId="4",
    Constraint=[True, True, True, True, True, True, True, True, True, True, True, True],
    CoordAngle=0,
    CMQ=[0, 0, 0, 0, 0, 0, 0, 0, 0, 0, 0, 0],
    CMQEd=[0, 0, 0, 0, 0, 0])
line_11 = Line(crv_9)
elem_5 = ElementInfo(
    Lines=line_2,
    SectId="1",
    Constraint=panel_7,
    CoordAngle=0,
    CMQ=[0, 0, 0, 0, 0, 0, 0, 0, 0, 0, 0, 0],
    CMQEd=[0, 0, 0, 0, 0, 0])
icon_5 = IconInfo(Points=item.Item1, Constraints=panel_9)
Z = UnitZ(Factor="2000")
prop_4 = PropertyInfo(PropName="PName", PropId="3", Density=unit_4.Density, YoungsModulus=unit_4.YoungsModulus, PoissonsRatio="0.3")
elem_6 = ElementInfo(
    Lines=line_5,
    SectId="4",
    Constraint=[True, True, True, True, True, True, True, True, True, True, True, True],
    CoordAngle=0,
    CMQ=[0, 0, 0, 0, 0, 0, 0, 0, 0, 0, 0, 0],
    CMQEd=[0, 0, 0, 0, 0, 0])
prop_5 = PropertyInfo(PropName="PName", PropId="1", Density=unit_6.Density, YoungsModulus=unit_6.YoungsModulus, PoissonsRatio="0.3")
prop_6 = PropertyInfo(PropName="PName", PropId="2", Density=unit_5.Density, YoungsModulus=unit_5.YoungsModulus, PoissonsRatio="0.3")
pt_7 = Point(end_2.End)
vcon = VconInfo(Points=pt_6, Forces=panel_12)
sect_5 = SectionInfo(
    SectName="tension",
    SectId="1",
    PropId="1",
    Area=unit_6.Area,
    IXX=unit_6.Inertia_x,
    IYY=unit_6.Inertia_y,
    VEN=unit_6.SaintVenant)
pt_8 = ConstructPoint(XCoordinate="0", YCoordinate="0", ZCoordinate="0")
sect_6 = SectionInfo(
    SectName="styro",
    SectId="3",
    PropId="3",
    Area=unit_4.Area,
    IXX=unit_4.Inertia_x,
    IYY=unit_4.Inertia_y,
    VEN=unit_4.SaintVenant)
sect_7 = SectionInfo(
    SectName="carbon",
    SectId="2",
    PropId="2",
    Area=unit_5.Area,
    IXX=unit_5.Inertia_x,
    IYY=unit_5.Inertia_y,
    VEN=unit_5.SaintVenant)
sect_8 = SectionInfo(
    SectName="styronibai",
    SectId="4",
    PropId="3",
    Area=multiplication_6,
    IXX=multiplication_5,
    IYY=multiplication_4,
    VEN=unit_4.SaintVenant)
panel_13 = Panel("""0
0
0
0
0
0""")
merge_7 = Merge(Data1=prop_2, Data2=prop_3, Data3=prop)  # -> flatten(Result)
pt_9 = Point(<point referenced from the Rhino model>)
elem_7 = ElementInfo(
    Lines=line_7,
    SectId="1",
    Constraint=panel_8,
    CoordAngle=0,
    CMQ=[0, 0, 0, 0, 0, 0, 0, 0, 0, 0, 0, 0],
    CMQEd=[0, 0, 0, 0, 0, 0])
X = UnitX(Factor="2000")
merge_8 = Merge(Data1=sect, Data2=sect_3, Data3=sect_2, Data4=sect_4)
icon_6 = IconInfo(Points=item_3.Item2, Constraints=panel_11)
elem_8 = ElementInfo(
    Lines=line_8,
    SectId="2",
    Constraint=[True, True, True, True, True, True, True, True, True, True, True, True],
    CoordAngle=0,
    CMQ=[0, 0, 0, 0, 0, 0, 0, 0, 0, 0, 0, 0],
    CMQEd=[0, 0, 0, 0, 0, 0])
elem_9 = ElementInfo(
    Lines=line_9,
    SectId="3",
    Constraint=[True, True, True, True, True, True, True, True, True, True, True, True],
    CoordAngle=0,
    CMQ=[0, 0, 0, 0, 0, 0, 0, 0, 0, 0, 0, 0],
    CMQEd=[0, 0, 0, 0, 0, 0])
merge_9 = Merge(Data1=icon_4, Data2=icon_5, Data3=icon, Data4=icon_2, Data5=icon_3)
icon_7 = IconInfo(Points=item_3.Item3, Constraints=panel_11)
icon_8 = IconInfo(Points=item_3.Item4, Constraints=panel_11)
icon_9 = IconInfo(Points=item_3.Item, Constraints=panel_11)
elem_10 = ElementInfo(
    Lines=line_11,
    SectId="4",
    Constraint=[True, True, True, True, True, True, True, True, True, True, True, True],
    CoordAngle=0,
    CMQ=[0, 0, 0, 0, 0, 0, 0, 0, 0, 0, 0, 0],
    CMQEd=[0, 0, 0, 0, 0, 0])
icon_10 = IconInfo(Points=item_3.Item1, Constraints=panel_11)
neg = Negative(Value="2000")
elem_11 = ElementInfo(
    Lines=line_10,
    SectId="4",
    Constraint=panel_10,
    CoordAngle=0,
    CMQ=[0, 0, 0, 0, 0, 0, 0, 0, 0, 0, 0, 0],
    CMQEd=[0, 0, 0, 0, 0, 0])
move = Move(Geometry=pt_8, Motion=Z)  # -> Geometry, Transform
vcon_2 = VconInfo(Points=pt_9, Forces=panel_13)
merge_10 = Merge(Data1=elem, Data2=elem_2, Data3=elem_3, Data4=elem_4, Data5=elem_6, Data6=elem_5)
merge_11 = Merge(Data1=prop_5, Data2=prop_6, Data3=prop_4)  # -> flatten(Result)
allprop = AllPropertyInfo(Propdata=merge_7)  # -> AllPropdata, Contents
allvcon = AllVconInfo(Vcondata=vcon)  # -> AllVcondata, Contents
move_2 = Move(Geometry=move.Geometry, Motion=X)  # -> Geometry, Transform
allsect = AllSectionInfo(Sectdata=merge_8)  # -> AllSectdata, Contents
Z_2 = UnitZ(Factor=neg)
allicon = AllIconInfo(Icondata=merge_9)  # -> AllIcondata, Contents
allelem = AllElemntInfo(Elemdata=merge_10)  # -> AllElemdata, Contents
merge_12 = Merge(Data1=sect_5, Data2=sect_7, Data3=sect_6, Data4=sect_8)
merge_13 = Merge(Data1=icon_9, Data2=icon_10, Data3=icon_6, Data4=icon_7, Data5=icon_8)
merge_14 = Merge(Data1=elem_7, Data2=elem_8, Data3=elem_9, Data4=elem_10, Data5=elem_11)
panel_14 = Panel(allsect.AllSectdata)
ln = Line(StartPoint=pt_8, EndPoint=move.Geometry)
crv_cp = CurveClosestPoint(Point=pt_8, Curve=ln)  # -> Point, Parameter, Distance
panel_15 = Panel(allprop.AllPropdata)
panel_16 = Panel(allprop.Contents)
panel_17 = Panel(allsect.Contents)
panel_18 = Panel(allicon.Contents)
allprop_2 = AllPropertyInfo(Propdata=merge_11)  # -> AllPropdata, Contents
panel_19 = Panel(allvcon.Contents)
move_3 = Move(Geometry=move_2.Geometry, Motion=Z_2)  # -> Geometry, Transform
allvcon_2 = AllVconInfo(Vcondata=vcon_2)  # -> AllVcondata, Contents
allsect_2 = AllSectionInfo(Sectdata=merge_12)  # -> AllSectdata, Contents
panel_20 = Panel(allelem.AllElemdata)
allicon_2 = AllIconInfo(Icondata=merge_13)  # -> AllIcondata, Contents
allelem_2 = AllElemntInfo(Elemdata=merge_14)  # -> AllElemdata, Contents
panel_21 = Panel(allvcon.AllVcondata)
ln_2 = Line(StartPoint=move.Geometry, EndPoint=move_2.Geometry)
crv_cp_2 = CurveClosestPoint(Point=[move_2.Geometry, move.Geometry], Curve=ln_2)  # -> Point, Parameter, Distance
ln_3 = Line(StartPoint=move_2.Geometry, EndPoint=move_3.Geometry)
crv_cp_3 = CurveClosestPoint(Point=move_3.Geometry, Curve=ln_3)  # -> Point, Parameter, Distance
panel_22 = Panel(allicon.AllIcondata)
panel_23 = Panel(allprop_2.AllPropdata)
panel_24 = Panel(allprop_2.Contents)
panel_25 = Panel(allsect_2.AllSectdata)
panel_26 = Panel(allsect_2.Contents)
panel_27 = Panel(allicon_2.Contents)
panel_28 = Panel(allvcon_2.Contents)
panel_29 = Panel(allelem_2.AllElemdata)
merge_15 = Merge(Data1=ln, Data2=ln_2, Data3=ln_3)
panel_30 = Panel(allvcon_2.AllVcondata)
panel_31 = Panel(allicon_2.AllIcondata)
merge_16 = Merge(
    Data1=allprop.AllPropdata,
    Data2=allsect.AllSectdata,
    Data3=allelem.AllElemdata,
    Data4=allicon.AllIcondata,
    Data5=allvcon.AllVcondata)
elem_12 = Geometry(merge_15)
number_slider_8 = Slider(4, range=0..10)
item_4 = ListItem(List=merge_16, Index=0, Wrap=True)  # -> Item, Item1, Item2, Item3, Item4
X_2 = UnitX(Factor="4000")
merge_17 = Merge(
    Data1=allprop_2.AllPropdata,
    Data2=allsect_2.AllSectdata,
    Data3=allelem_2.AllElemdata,
    Data4=allicon_2.AllIcondata,
    Data5=allvcon_2.AllVcondata)
move_4 = Move(Motion=X_2)  # -> Geometry, Transform
alldata = CombineAlldata(
    AllPropdata=item_4.Item,
    AllSectdata=item_4.Item1,
    AllElemdata=item_4.Item2,
    AllIcondata=item_4.Item3,
    AllVcondata=item_4.Item4)  # -> Alldata, Contents
number_slider_9 = Slider(4, range=0..10)
_10º = PowerOf10(Value=Slider(0, range=-10..3))
item_5 = ListItem(List=merge_17, Index=0, Wrap=True)  # -> Item, Item1, Item2, Item3, Item4
branch = TreeBranch(Tree=alldata.Contents, Path=Slider(4, range=1..4), MaintainPaths=True)
alldata_2 = CombineAlldata(
    AllPropdata=item_5.Item,
    AllSectdata=item_5.Item1,
    AllElemdata=item_5.Item2,
    AllIcondata=item_5.Item3,
    AllVcondata=item_5.Item4)  # -> Alldata, Contents
ldisp = LinearAnalysisDisp(Alldata=alldata_2.Alldata)  # -> Deformed, Colors
_10º_2 = PowerOf10(Value=Slider(0, range=-10..3))
ldisp_2 = LinearAnalysisDisp(Alldata=alldata.Alldata)  # -> Deformed, Colors
item_6 = ListItem(List=branch, Index=0, Wrap=True)
branch_2 = TreeBranch(Tree=alldata_2.Contents, Path=Slider(4, range=1..4), MaintainPaths=True)
divide_curve = DivideCurve(Curve=reparameterize(flatten(elem_12)), Count="2", Kinks=False)  # -> Points, Tangents, simplify(Parameters)
dprod = DotProduct(Unitize=False)
lng = ListLength(List=dprod)
series = Series(Start=0, Step=1, Count=lng)
item_7 = ListItem(List=branch_2, Index=0, Wrap=True)
sort = SortList(Keys=dprod, ValuesA=series)  # -> Keys, ValuesA
sqrt = SquareRoot(Value=sort.Keys)
item_8 = ListItem(List=sqrt, Index=0, Wrap=True)  # -> Item1, Item
panel_32 = Panel(item_8.Item)
panel_33 = Panel(item_8.Item1)
dprod_2 = DotProduct(Unitize=False)
lng_2 = ListLength(List=dprod_2)
series_2 = Series(Start=0, Step=1, Count=lng_2)
shatter = Shatter(Curve=graft(elem_12), Parameters=divide_curve.Parameters)  # -> flatten(Segments)
panel_34 = Panel(branch)
sort_2 = SortList(Keys=dprod_2, ValuesA=series_2)  # -> Keys, ValuesA
sqrt_2 = SquareRoot(Value=sort_2.Keys)
item_9 = ListItem(List=sqrt_2, Index=0, Wrap=True)  # -> Item1, Item
panel_35 = Panel(item_9.Item1)
panel_36 = Panel(item_9.Item)
end_points = EndPoints(Curve=shatter)  # -> Start, End; disabled
panel_37 = Panel(branch_2)
merge_18 = Merge(Data1=end_points.Start, Data2=end_points.End)  # disabled
# LineCurve
line_12 = Line(shatter)
item_10 = ListItem(List=line_12, Index=0, Wrap=True)  # -> Item, Item1, Item2, Item3, Item4, Item5
panel_38 = Panel("""a
d
c""")
panel_39 = Panel("""h
k
t""")
nickname = MyComponent1(Alldata=alldata.Alldata, Index=Slider(524, range=0..1000))
panel_40 = Panel(nickname)
removeduplicatepts = RemoveDuplicatePts(Points=merge_18, Tolerance=0.01)  # disabled
hkyou = HKYOU(
    NSECT="101",
    MATERIAL="S",
    MatTYPE="SN400",
    MemTYPE="COLUMN",
    DF="10000",
    X="1.2",
    Y="1.2",
    COMMENT=panel_38,
    H="30",
    B="15",
    Tw="0.65",
    Tf="0.9",
    BTYPEChange="BBFAC")  # -> LSTSECT, AREA, IXX, IYY, VEN
hweek = HWEEK(
    NSECT="102",
    MATERIAL="S",
    MatTYPE="SN490",
    MemTYPE="COLUMN",
    DF="10000",
    X="1.5",
    Y="1.5",
    COMMENT=panel_39,
    H="40",
    B="20",
    Tw="0.75",
    Tf="1.2",
    BTYPEChange="BBFAC")  # -> LSTSECT, AREA, IXX, IYY, VEN
item_11 = ListItem(List=item_10.Item, Index=0, Wrap=True)
filepath = Panel("C:\D\Cdocs\Hogan_2020\DATA")
filepath_2 = Panel("C:\Users\chonv\AppData\Roaming\Grasshopper\Libraries\ghHogan")
number = Number(hkyou.IXX)
number_2 = Number(hkyou.IYY)
number_3 = Number(hkyou.VEN)
filename = Panel("sampleb")
number_4 = Number(hkyou.AREA)
number_5 = Number(hweek.AREA)
number_6 = Number(hweek.IXX)
number_7 = Number(hweek.IYY)
number_8 = Number(hweek.VEN)
deconstruct = Deconstruct(Point=removeduplicatepts)  # -> XComponent, YComponent, ZComponent; disabled
merge_19 = Merge(Data1=item_10.Item, Data2=item_10.Item1, Data3=item_10.Item4, Data4=item_10.Item5)
merge_20 = Merge(Data1=item_10.Item2, Data2=item_10.Item3)
panel_41 = Panel("""0
0
0
0
0
0""")
panel_42 = Panel("""0
0
0
0
0
0""")
panel_43 = Panel("""0
0
0
0
0
0""")
merge_21 = Merge(Data1=hkyou.LSTSECT, Data2=hweek.LSTSECT)
panel_44 = Panel("""0
0
0
0
0
0""")
lstassemble = LSTASSEMBLE(HEAD="INPUT DATA", LSTSECT=merge_21, BUTTON=Button(), PATH=filepath, TITLE=filename)
bonds = BONDS(I=panel_42, J=panel_41)
bounds = Bounds(Numbers=deconstruct.ZComponent)  # disabled
cmq = CMQ(I=panel_43, J=panel_44)

# ----
# ELEM(segment)
# UNIT:[mm],[rad]
panel_45 = Panel("""0
0
0
0
0
0""")
panel_46 = Panel("""0
0
0
0
0
0""")
panel_47 = Panel("""0
0
0
0
0
0""")
panel_48 = Panel("""0
0
0
0
0
0""")
cmq_2 = CMQ(I=panel_45, J=panel_47)
line_13 = Line(merge_19)
line_14 = Line(merge_20)
bonds_2 = BONDS(I=panel_46, J=panel_48)
elem_13 = ELEM(
    GEO=line_13,
    ESECT="101",
    BONDS=bonds_2,
    CMQ=cmq_2,
    CANG="0",
    ElementTYPEChange="COLUMN",
    X_Axis_display_mode_changed=False,
    Y_Axis_display_mode_changed=False,
    Z_Axis_display_mode_changed=False)
elem_14 = ELEM(
    GEO=line_14,
    ESECT="102",
    BONDS=bonds,
    CMQ=cmq,
    CANG="0",
    ElementTYPEChange="COLUMN",
    X_Axis_display_mode_changed=False,
    Y_Axis_display_mode_changed=False,
    Z_Axis_display_mode_changed=False)

deconstruct_domain = DeconstructDomain(Domain=bounds)  # -> Start, End; disabled
panel_49 = Panel(lstassemble)
member_index = MemberIndex(Set=deconstruct.ZComponent, Member=deconstruct_domain.End)  # -> Index, Count; disabled
list_item = ListItem(List=removeduplicatepts, Index=member_index.Index, Wrap=True)  # disabled
number_9 = Number(hkyou.IYY)
number_10 = Number(hkyou.VEN)
number_11 = Number(hkyou.AREA)
number_12 = Number(hkyou.IXX)

# ----
# SECT(for segment)
# -1: select min bandwidth from List
#  0: bandwidth with original model
#  1: bandwidth with model whose nodes are sorted in X axis
#  2: bandwidth with model whose nodes are sorted in Y axis
#  3: bandwidth with model whose nodes are sorted in Z axis
#  4: bandwidth with model whose nodes are sorted arbitrarily
# UNIT:[tf],[m]
panel_50 = Panel("Column:T-12x20x4.5x3(x10000)")
panel_51 = Panel("0.00000064")
panel_52 = Panel("0.2827")
panel_54 = Panel("0.00000127")
domain = Domain(Domain(-100, 100))
domain_2 = Domain(Domain(-100, 100))
domain_3 = Domain(Domain(-100, 100))
domain_4 = Domain(Domain(-100, 100))
domain_5 = Domain(Domain(-100, 100))
domain_6 = Domain(Domain(-100, 100))
merge_22 = Merge(Data1=domain, Data2=domain_2, Data3=domain_3, Data4=domain_4, Data5=domain_5, Data6=domain_6)
fig = FIGSEGMENT(FIG="1", FPROP="101", AREA=number_11, IXX=number_12, IYY=number_9, VEN=number_10, YIELD=merge_22)
sect_9 = SECT(NSECT="101", SNAME=panel_50, SFIG=fig, COLOR=ColourSwatch(SwatchColor=RGB(255, 0, 204)))

number_13 = Number(hweek.AREA)
number_14 = Number(hweek.IXX)
number_15 = Number(hweek.IYY)
number_16 = Number(hweek.VEN)

# ----
# SECT(for segment)
# UNIT:[tf],[m]
panel_55 = Panel("Column:T-12x20x4.5x3(x10000)")
domain_7 = Domain(Domain(-100, 100))
domain_8 = Domain(Domain(-100, 100))
domain_9 = Domain(Domain(-100, 100))
domain_10 = Domain(Domain(-100, 100))
domain_11 = Domain(Domain(-100, 100))
domain_12 = Domain(Domain(-100, 100))
merge_23 = Merge(Data1=domain_7, Data2=domain_8, Data3=domain_9, Data4=domain_10, Data5=domain_11, Data6=domain_12)
fig_2 = FIGSEGMENT(FIG="1", FPROP="101", AREA=number_13, IXX=number_14, IYY=number_15, VEN=number_16, YIELD=merge_23)
sect_10 = SECT(NSECT="102", SNAME=panel_55, SFIG=fig_2, COLOR=ColourSwatch(SwatchColor=RGB(255, 0, 204)))

icon_11 = Point([crv_cp.Point, crv_cp_3.Point])
vcon_3 = Point([move_2.Geometry, move.Geometry])
panel_60 = Panel("""0.200
0.200""")

# ----
# OPTS
panel_61 = Panel("\"SAMPLE INPUTFILE FOR HOGAN UNIT:[tf],[m]\"")
panel_62 = Panel("0.100")
opts = GHhogan(NAME=panel_61, BASE=panel_60, LOCATE="1.000", TFACT="0.030", GPERIOD="0.600")

# ----
# VIEW
panel_63 = Panel("""0.5
0
0.6""")
panel_64 = Panel("""0
-90.3""")
panel_65 = Panel("""5
4000""")
view = VIEW(GFACT="0.5", FOCUS=panel_63, ANGLE=panel_64, DISTS=panel_65)

X_3 = UnitX(Factor="4000")
pt_10 = Point(icon_11)
pt_11 = Point(vcon_3)

# ----
# VCON(vector)
# This component requests
#  a load vector for each point.
panel_66 = Panel("8")  # disabled
lng_3 = ListLength(List=pt_11)  # disabled
vec = VectorXYZ(XComponent=panel_66, YComponent=panel_66, ZComponent=0)  # -> Vector, Length; disabled
dup = DuplicateData(Data=vec.Vector, Number=lng_3, Order=True)  # disabled
vcon_4 = VCONSimple(POINT=pt_11, ExF=dup)  # disabled

negative = Negative(Value=Slider(10, range=0..10))
icon2 = Point(crv_cp_2.Point)
file_path = Panel("C:\D\Cdocs\Hogan_2020\Debug")
# ICON
icon_12 = ICON(
    POINT=pt_10,
    Condition_TX_Changed=True,
    Condition_TY_Changed=False,
    Condition_TZ_Changed=True,
    Condition_X_Changed=True,
    Condition_Y_Changed=True,
    Condition_Z_Changed=True)
icon_13 = ICON(
    POINT=icon2,
    Condition_TX_Changed=True,
    Condition_TY_Changed=False,
    Condition_TZ_Changed=True,
    Condition_X_Changed=False,
    Condition_Y_Changed=True,
    Condition_Z_Changed=False)

# ----
# VCON(vector components)
vcon_5 = VCON(POINT=pt_11, X=0, Y=0, Z=negative, RX=0, RY=0, RZ=0)

relay = Relay([icon_13, icon_12])
relay_2 = Relay([elem_13, elem_14])
relay_3 = Relay([sect_9, sect_10])
number_slider_10 = Slider(1, range=-5..5)
number_slider_11 = Slider(0, range=-5..5)
save_inp = Button()
number_slider_12 = Slider(4, range=0..10)
file_title = Panel("sampleb")
pt_12 = Point(Point(0, 0, -9.8))
unit_7 = AdjustUnits(
    YoungsModulus="2",
    EDigit="5",
    Density="40.8163",
    DDigit="0",
    Area="49",
    ADigit="1",
    Inertia_x="2000.8333",
    IxDigit="0",
    Inertia_y="200083.333",
    IyDigit="0",
    SaintVenant="200083.333",
    VDigit="0",
    Length="600",
    LDigit="0",
    体積力の加速度ベクトルの和=pt_12,
    ForceUnitParameter=number_slider_11,
    LengthUnitParameter=number_slider_10,
    EUnitParameter=number_slider_12)  # -> YoungsModulus, Density, Area, Inertia_x, Inertia_y, SaintVenant, Length, Gravity, ModelScale, ShowingEachValueAsText
merge_24 = Merge(
    Data1=unit_7.YoungsModulus,
    Data2=unit_7.Density,
    Data3=unit_7.Area,
    Data4=unit_7.Inertia_x,
    Data5=unit_7.Inertia_y,
    Data6=unit_7.SaintVenant,
    Data7=unit_7.Length,
    Data8=unit_7.Gravity,
    Data9=unit_7.ModelScale)
panel_67 = Panel(merge_24)
unit_8 = AdjustUnits(
    YoungsModulus="9",
    EDigit="8",
    Density="1530.6",
    DDigit="0",
    Area="4",
    ADigit="0",
    Inertia_x="133.333",
    IxDigit="-2",
    Inertia_y="133.333",
    IyDigit="-2",
    SaintVenant="133.333",
    VDigit="-2",
    Length="600",
    LDigit="0",
    体積力の加速度ベクトルの和=pt_12,
    ForceUnitParameter=number_slider_11,
    LengthUnitParameter=number_slider_10,
    EUnitParameter=number_slider_12)  # -> YoungsModulus, Density, Area, Inertia_x, Inertia_y, SaintVenant, Length, Gravity, ModelScale, ShowingEachValueAsText
merge_25 = Merge(
    Data1=unit_8.YoungsModulus,
    Data2=unit_8.Density,
    Data3=unit_8.Area,
    Data4=unit_8.Inertia_x,
    Data5=unit_8.Inertia_y,
    Data6=unit_8.SaintVenant,
    Data7=unit_8.Length,
    Data8=unit_8.Gravity,
    Data9=unit_8.ModelScale)
panel_68 = Panel(merge_25)
unit_9 = AdjustUnits(
    YoungsModulus="21",
    EDigit="7",
    Density="8010.2",
    DDigit="0",
    Area="3.6",
    ADigit="-1",
    Inertia_x="108",
    IxDigit="-4",
    Inertia_y="108",
    IyDigit="-4",
    SaintVenant="108",
    VDigit="-4",
    Length="600",
    LDigit="0",
    体積力の加速度ベクトルの和=pt_12,
    ForceUnitParameter=number_slider_11,
    LengthUnitParameter=number_slider_10,
    EUnitParameter=number_slider_12)  # -> YoungsModulus, Density, Area, Inertia_x, Inertia_y, SaintVenant, Length, Gravity, ModelScale, ShowingEachValueAsText
merge_26 = Merge(
    Data1=unit_9.YoungsModulus,
    Data2=unit_9.Density,
    Data3=unit_9.Area,
    Data4=unit_9.Inertia_x,
    Data5=unit_9.Inertia_y,
    Data6=unit_9.SaintVenant,
    Data7=unit_9.Length,
    Data8=unit_9.Gravity,
    Data9=unit_9.ModelScale)
panel_69 = Panel(merge_26)
filepath_3 = Panel("C:\Users\chonv\AppData\Roaming\Grasshopper\Libraries\ghHogan")  # disabled
filename_2 = Panel("sample_buckling.inl")  # disabled
# LinearBclngAnalysis
button = Button()  # disabled
panel_70 = Panel("""1
1
1
0
0
1
1
1
1
0
0
1""")
pt_13 = Point([<point referenced from the Rhino model> x5])
panel_71 = Panel("""1
1
1
1
1
1
1
1
1
0
0
1""")
panel_72 = Panel("""1
1
1
0
0
0""")
item_12 = ListItem(List=pt_13, Index=0, Wrap="false")  # -> Item, Item1, Item2, Item3, Item4
crv_11 = Curve([<curve referenced from the Rhino model> x95])
crv_12 = Curve([<curve referenced from the Rhino model> x304])
crv_13 = Curve([<curve referenced from the Rhino model> x50])
crv_14 = Curve([<curve referenced from the Rhino model> x31])
multiplication_7 = Multiplication(A=unit_7.Inertia_y, B="2")
crv_15 = Curve([<curve referenced from the Rhino model> x45])
multiplication_8 = Multiplication(A=unit_7.Inertia_x, B="8")
multiplication_9 = Multiplication(A=unit_7.Area, B="2")
file_path_2 = Panel("C:\D\Cdocs\Hogan_2020\Debug")  # disabled
end_3 = EndPoints(Curve=crv_15)  # -> Start, End
line_15 = Line(crv_13)
line_16 = Line(crv_11)
line_17 = Line(crv_12)
line_18 = Line(crv_15)
line_19 = Line(crv_14)
prop_7 = PropertyInfo(PropName="PName", PropId="3", Density=unit_7.Density, YoungsModulus=unit_7.YoungsModulus, PoissonsRatio="0.3")
prop_8 = PropertyInfo(PropName="PName", PropId="1", Density=unit_9.Density, YoungsModulus=unit_9.YoungsModulus, PoissonsRatio="0.3")
prop_9 = PropertyInfo(PropName="PName", PropId="2", Density=unit_8.Density, YoungsModulus=unit_8.YoungsModulus, PoissonsRatio="0.3")
pt_14 = Point(end_3.End)
sect_11 = SectionInfo(
    SectName="tension",
    SectId="1",
    PropId="1",
    Area=unit_9.Area,
    IXX=unit_9.Inertia_x,
    IYY=unit_9.Inertia_y,
    VEN=unit_9.SaintVenant)
sect_12 = SectionInfo(
    SectName="styro",
    SectId="3",
    PropId="3",
    Area=unit_7.Area,
    IXX=unit_7.Inertia_x,
    IYY=unit_7.Inertia_y,
    VEN=unit_7.SaintVenant)
sect_13 = SectionInfo(
    SectName="carbon",
    SectId="2",
    PropId="2",
    Area=unit_8.Area,
    IXX=unit_8.Inertia_x,
    IYY=unit_8.Inertia_y,
    VEN=unit_8.SaintVenant)
sect_14 = SectionInfo(
    SectName="styronibai",
    SectId="4",
    PropId="3",
    Area=multiplication_9,
    IXX=multiplication_8,
    IYY=multiplication_7,
    VEN=unit_7.SaintVenant)
panel_73 = Panel("""0
0
0
0
0
0""")
save_inp_2 = Button()  # disabled
pt_15 = Point(<point referenced from the Rhino model>)
file_title_2 = Panel("sampleb")  # disabled
elem_15 = ElementInfo(
    Lines=line_15,
    SectId="1",
    Constraint=panel_70,
    CoordAngle=0,
    CMQ=[0, 0, 0, 0, 0, 0, 0, 0, 0, 0, 0, 0],
    CMQEd=[0, 0, 0, 0, 0, 0])
icon_14 = IconInfo(Points=item_12.Item2, Constraints=panel_72)
elem_16 = ElementInfo(
    Lines=line_16,
    SectId="2",
    Constraint=[True, True, True, True, True, True, True, True, True, True, True, True],
    CoordAngle=0,
    CMQ=[0, 0, 0, 0, 0, 0, 0, 0, 0, 0, 0, 0],
    CMQEd=[0, 0, 0, 0, 0, 0])
elem_17 = ElementInfo(
    Lines=line_17,
    SectId="3",
    Constraint=[True, True, True, True, True, True, True, True, True, True, True, True],
    CoordAngle=0,
    CMQ=[0, 0, 0, 0, 0, 0, 0, 0, 0, 0, 0, 0],
    CMQEd=[0, 0, 0, 0, 0, 0])
icon_15 = IconInfo(Points=item_12.Item3, Constraints=panel_72)
icon_16 = IconInfo(Points=item_12.Item4, Constraints=panel_72)
icon_17 = IconInfo(Points=item_12.Item, Constraints=panel_72)
elem_18 = ElementInfo(
    Lines=line_19,
    SectId="4",
    Constraint=[True, True, True, True, True, True, True, True, True, True, True, True],
    CoordAngle=0,
    CMQ=[0, 0, 0, 0, 0, 0, 0, 0, 0, 0, 0, 0],
    CMQEd=[0, 0, 0, 0, 0, 0])
icon_18 = IconInfo(Points=item_12.Item1, Constraints=panel_72)
elem_19 = ElementInfo(
    Lines=line_18,
    SectId="4",
    Constraint=panel_71,
    CoordAngle=0,
    CMQ=[0, 0, 0, 0, 0, 0, 0, 0, 0, 0, 0, 0],
    CMQEd=[0, 0, 0, 0, 0, 0])
vcon_6 = VconInfo(Points=pt_15, Forces=panel_73)
merge_27 = Merge(Data1=prop_8, Data2=prop_9, Data3=prop_7)  # -> flatten(Result)
merge_28 = Merge(Data1=sect_11, Data2=sect_13, Data3=sect_12, Data4=sect_14)
merge_29 = Merge(Data1=icon_17, Data2=icon_18, Data3=icon_14, Data4=icon_15, Data5=icon_16)
panel_74 = Panel("1")  # disabled
merge_30 = Merge(Data1=elem_15, Data2=elem_16, Data3=elem_17, Data4=elem_18, Data5=elem_19)
allprop_3 = AllPropertyInfo(Propdata=merge_27)  # -> AllPropdata, Contents
allvcon_3 = AllVconInfo(Vcondata=vcon_6)  # -> AllVcondata, Contents
allsect_3 = AllSectionInfo(Sectdata=merge_28)  # -> AllSectdata, Contents
allicon_3 = AllIconInfo(Icondata=merge_29)  # -> AllIcondata, Contents
allelem_3 = AllElemntInfo(Elemdata=merge_30)  # -> AllElemdata, Contents
panel_75 = Panel(allsect_3.AllSectdata)
panel_76 = Panel(allprop_3.AllPropdata)
panel_77 = Panel(allprop_3.Contents)
panel_78 = Panel(allsect_3.Contents)
panel_79 = Panel(allicon_3.Contents)
panel_80 = Panel(allvcon_3.Contents)
panel_81 = Panel(allelem_3.AllElemdata)
panel_82 = Panel(allvcon_3.AllVcondata)
colour_swatch = ColourSwatch(SwatchColor=RGB(77, 77, 255))  # disabled
colour_swatch_2 = ColourSwatch(SwatchColor=RGB(255, 77, 204))  # disabled
panel_83 = Panel(allicon_3.AllIcondata)
merge_31 = Merge(
    Data1=allprop_3.AllPropdata,
    Data2=allsect_3.AllSectdata,
    Data3=allelem_3.AllElemdata,
    Data4=allicon_3.AllIcondata,
    Data5=allvcon_3.AllVcondata)
number_slider_13 = Slider(4, range=0..10)
item_13 = ListItem(List=merge_31, Index=0, Wrap=True)  # -> Item, Item1, Item2, Item3, Item4
alldata_3 = CombineAlldata(
    AllPropdata=item_13.Item,
    AllSectdata=item_13.Item1,
    AllElemdata=item_13.Item2,
    AllIcondata=item_13.Item3,
    AllVcondata=item_13.Item4)  # -> Alldata, Contents
ldisp_3 = LinearAnalysisDisp(Alldata=alldata_3.Alldata)  # -> Deformed, Colors
pt_16 = Point(icon2)
_10º_3 = PowerOf10(Value=Slider(0, range=-10..3))
pt_17 = Point(Point(0, 0, -9.8))
crv_16 = Curve(line_14)
pt_18 = Point(pt_11)
crv_17 = Curve(line_13)
pt_19 = Point(pt_10)
pt_20 = Point(icon2)
item_14 = ListItem(List=pt_16, Index=0, Wrap=True)  # -> Item, Item1
pt_21 = Point(Point(0, 0, 0))
branch_3 = TreeBranch(Tree=alldata_3.Contents, Path=Slider(4, range=1..4), MaintainPaths=True)
pt_22 = Point(icon2)
pt_23 = Point(Point(0, 0, -9.8))
crv_18 = Curve(line_14)
pt_24 = Point(Point(0, 0, 0))
item_15 = ListItem(List=pt_22, Index=0, Wrap=True)  # -> Item, Item1
item_16 = ListItem(List=branch_3, Index=0, Wrap=True)
pt_25 = Point(Point(0, 0, -9.8))
crv_19 = Curve(line_14)
pt_26 = Point(Point(0, 0, 0))
dprod_3 = DotProduct(Unitize=False)
lng_4 = ListLength(List=dprod_3)
series_3 = Series(Start=0, Step=1, Count=lng_4)
pt_27 = Point(item_14.Item)
sort_3 = SortList(Keys=dprod_3, ValuesA=series_3)  # -> Keys, ValuesA
sqrt_3 = SquareRoot(Value=sort_3.Keys)
item_17 = ListItem(List=sqrt_3, Index=0, Wrap=True)  # -> Item1, Item
panel_84 = Panel(item_17.Item1)
panel_85 = Panel(item_17.Item)
pt_28 = Point(item_15.Item)
panel_86 = Panel(branch_3)
number_slider_14 = Slider(3, range=-5..5)
number_slider_15 = Slider(2, range=-5..5)
number_slider_16 = Slider(1, range=0..10)
unit_10 = AdjustUnits(
    YoungsModulus="22.54",
    EDigit="3",
    Density="7.8",
    DDigit="-1",
    Area="76.2",
    ADigit="6",
    Inertia_x="160.132",
    IxDigit="9",
    Inertia_y="2139.338",
    IyDigit="9",
    SaintVenant="28.33",
    VDigit="8",
    Length="1000",
    LDigit="0",
    体積力の加速度ベクトルの和=pt_17,
    ForceUnitParameter=number_slider_15,
    LengthUnitParameter=number_slider_14,
    EUnitParameter=number_slider_16)  # -> YoungsModulus, Density, Area, Inertia_x, Inertia_y, SaintVenant, Length, Gravity, ModelScale, ShowingEachValueAsText
scale = Scale(Geometry=crv_16, Center=pt_21, Factor=unit_10.ModelScale)  # -> Geometry, Transform
scale_2 = Scale(Geometry=pt_19, Center=pt_21, Factor=unit_10.ModelScale)  # -> Geometry, Transform
scale_3 = Scale(Geometry=crv_17, Center=pt_21, Factor=unit_10.ModelScale)  # -> Geometry, Transform
scale_4 = Scale(Geometry=pt_18, Center=pt_21, Factor=unit_10.ModelScale)  # -> Geometry, Transform
scale_5 = Scale(Geometry=pt_20, Center=pt_21, Factor=unit_10.ModelScale)  # -> Geometry, Transform
unit_11 = AdjustUnits(
    YoungsModulus="22.54",
    EDigit="3",
    Density="7.8",
    DDigit="-1",
    Area="45.33",
    ADigit="6",
    Inertia_x="693.252",
    IxDigit="9",
    Inertia_y="50.69",
    IyDigit="9",
    SaintVenant="9.87",
    VDigit="8",
    Length="1000",
    LDigit="0",
    体積力の加速度ベクトルの和=pt_17,
    ForceUnitParameter=number_slider_15,
    LengthUnitParameter=number_slider_14,
    EUnitParameter=number_slider_16)  # -> YoungsModulus, Density, Area, Inertia_x, Inertia_y, SaintVenant, Length, Gravity, ModelScale, ShowingEachValueAsText
merge_32 = Merge(
    Data1=unit_11.YoungsModulus,
    Data2=unit_11.Density,
    Data3=unit_11.Area,
    Data4=unit_11.Inertia_x,
    Data5=unit_11.Inertia_y,
    Data6=unit_11.SaintVenant,
    Data7=unit_11.Length,
    Data8=unit_11.Gravity,
    Data9=unit_11.ModelScale)
merge_33 = Merge(
    Data1=unit_10.YoungsModulus,
    Data2=unit_10.Density,
    Data3=unit_10.Area,
    Data4=unit_10.Inertia_x,
    Data5=unit_10.Inertia_y,
    Data6=unit_10.SaintVenant,
    Data7=unit_10.Length,
    Data8=unit_10.Gravity,
    Data9=unit_10.ModelScale)
number_slider_17 = Slider(3, range=-5..5)
number_slider_18 = Slider(2, range=-5..5)
number_slider_19 = Slider(1, range=0..10)
unit_12 = AdjustUnits(
    YoungsModulus="22.54",
    EDigit="3",
    Density="7.8",
    DDigit="-1",
    Area="76.2",
    ADigit="6",
    Inertia_x="160.132",
    IxDigit="9",
    Inertia_y="2139.338",
    IyDigit="9",
    SaintVenant="28.33",
    VDigit="8",
    Length="1000",
    LDigit="0",
    体積力の加速度ベクトルの和=pt_23,
    ForceUnitParameter=number_slider_18,
    LengthUnitParameter=number_slider_17,
    EUnitParameter=number_slider_19)  # -> YoungsModulus, Density, Area, Inertia_x, Inertia_y, SaintVenant, Length, Gravity, ModelScale, ShowingEachValueAsText
scale_6 = Scale(Geometry=item_14.Item, Center=pt_24, Factor=unit_12.ModelScale)  # -> Geometry, Transform
scale_7 = Scale(Geometry=item_14.Item1, Center=pt_24, Factor=unit_12.ModelScale)  # -> Geometry, Transform
scale_8 = Scale(Geometry=crv_18, Center=pt_24, Factor=unit_12.ModelScale)  # -> Geometry, Transform
unit_13 = AdjustUnits(
    YoungsModulus="22.54",
    EDigit="3",
    Density="7.8",
    DDigit="-1",
    Area="45.33",
    ADigit="6",
    Inertia_x="693.252",
    IxDigit="9",
    Inertia_y="50.69",
    IyDigit="9",
    SaintVenant="9.87",
    VDigit="8",
    Length="1000",
    LDigit="0",
    体積力の加速度ベクトルの和=pt_23,
    ForceUnitParameter=number_slider_18,
    LengthUnitParameter=number_slider_17,
    EUnitParameter=number_slider_19)  # -> YoungsModulus, Density, Area, Inertia_x, Inertia_y, SaintVenant, Length, Gravity, ModelScale, ShowingEachValueAsText
merge_34 = Merge(
    Data1=unit_13.YoungsModulus,
    Data2=unit_13.Density,
    Data3=unit_13.Area,
    Data4=unit_13.Inertia_x,
    Data5=unit_13.Inertia_y,
    Data6=unit_13.SaintVenant,
    Data7=unit_13.Length,
    Data8=unit_13.Gravity,
    Data9=unit_13.ModelScale)
merge_35 = Merge(
    Data1=unit_12.YoungsModulus,
    Data2=unit_12.Density,
    Data3=unit_12.Area,
    Data4=unit_12.Inertia_x,
    Data5=unit_12.Inertia_y,
    Data6=unit_12.SaintVenant,
    Data7=unit_12.Length,
    Data8=unit_12.Gravity,
    Data9=unit_12.ModelScale)
item_18 = ListItem(List=scale_2.Geometry, Index=0, Wrap="false")  # -> Item, Item1
item_19 = ListItem(List=scale_5.Geometry, Index=0, Wrap="false")  # -> Item, Item1
panel_87 = Panel(merge_34)
number_slider_20 = Slider(3, range=-5..5)
number_slider_21 = Slider(2, range=-5..5)
join = JoinCurves(Curves=flatten(scale_8.Geometry), Preserve=False)  # -> flatten(Curves)
number_slider_22 = Slider(1, range=0..10)
unit_14 = AdjustUnits(
    YoungsModulus="22.54",
    EDigit="3",
    Density="7.8",
    DDigit="-1",
    Area="76.2",
    ADigit="6",
    Inertia_x="160.132",
    IxDigit="9",
    Inertia_y="2139.338",
    IyDigit="9",
    SaintVenant="28.33",
    VDigit="8",
    Length="1000",
    LDigit="0",
    体積力の加速度ベクトルの和=pt_25,
    ForceUnitParameter=number_slider_21,
    LengthUnitParameter=number_slider_20,
    EUnitParameter=number_slider_22)  # -> YoungsModulus, Density, Area, Inertia_x, Inertia_y, SaintVenant, Length, Gravity, ModelScale, ShowingEachValueAsText
scale_9 = Scale(Geometry=item_15.Item, Center=pt_26, Factor=unit_14.ModelScale)  # -> Geometry, Transform
scale_10 = Scale(Geometry=item_15.Item1, Center=pt_26, Factor=unit_14.ModelScale)  # -> Geometry, Transform
scale_11 = Scale(Geometry=crv_19, Center=pt_26, Factor=unit_14.ModelScale)  # -> Geometry, Transform
unit_15 = AdjustUnits(
    YoungsModulus="22.54",
    EDigit="3",
    Density="7.8",
    DDigit="-1",
    Area="45.33",
    ADigit="6",
    Inertia_x="693.252",
    IxDigit="9",
    Inertia_y="50.69",
    IyDigit="9",
    SaintVenant="9.87",
    VDigit="8",
    Length="1000",
    LDigit="0",
    体積力の加速度ベクトルの和=pt_25,
    ForceUnitParameter=number_slider_21,
    LengthUnitParameter=number_slider_20,
    EUnitParameter=number_slider_22)  # -> YoungsModulus, Density, Area, Inertia_x, Inertia_y, SaintVenant, Length, Gravity, ModelScale, ShowingEachValueAsText
merge_36 = Merge(
    Data1=unit_15.YoungsModulus,
    Data2=unit_15.Density,
    Data3=unit_15.Area,
    Data4=unit_15.Inertia_x,
    Data5=unit_15.Inertia_y,
    Data6=unit_15.SaintVenant,
    Data7=unit_15.Length,
    Data8=unit_15.Gravity,
    Data9=unit_15.ModelScale)
merge_37 = Merge(
    Data1=unit_14.YoungsModulus,
    Data2=unit_14.Density,
    Data3=unit_14.Area,
    Data4=unit_14.Inertia_x,
    Data5=unit_14.Inertia_y,
    Data6=unit_14.SaintVenant,
    Data7=unit_14.Length,
    Data8=unit_14.Gravity,
    Data9=unit_14.ModelScale)
panel_88 = Panel(merge_32)
item_20 = ListItem(List=scale_7.Geometry, Index=0, Wrap="false")
item_21 = ListItem(List=scale_4.Geometry, Index=0, Wrap=True)  # -> Item, Item1
panel_89 = Panel(merge_36)
line_20 = Line(scale.Geometry)
panel_90 = Panel(merge_35)
panel_91 = Panel("""0
1
0
0
1
0""")
panel_92 = Panel("""1
1
1
1
0
1""")
panel_93 = Panel("""0
1
0
1
0
1""")
join_2 = JoinCurves(Curves=flatten(scale_11.Geometry), Preserve=False)  # -> flatten(Curves)
panel_94 = Panel("""0
0
-980
0
0
0""")
line_21 = Line(scale_8.Geometry)
line_22 = Line(scale_3.Geometry)
prop_10 = PropertyInfo(PropName="PName", PropId="1", Density=unit_11.Density, YoungsModulus=unit_11.YoungsModulus, PoissonsRatio="0.33333")
sect_15 = SectionInfo(
    SectName="tension",
    SectId="1",
    PropId="1",
    Area=unit_11.Area,
    IXX=unit_11.Inertia_x,
    IYY=unit_11.Inertia_y,
    VEN=unit_11.SaintVenant)
sect_16 = SectionInfo(
    SectName="carbon",
    SectId="2",
    PropId="1",
    Area=unit_10.Area,
    IXX=unit_10.Inertia_x,
    IYY=unit_10.Inertia_y,
    VEN=unit_10.SaintVenant)
item_22 = ListItem(List=scale_10.Geometry, Index=0, Wrap="false")
item_23 = ListItem(List=scale_6.Geometry, Index=0, Wrap=True)
len = Length(Curve=join)
panel_95 = Panel("""1
1
1
1
1
1""")
panel_96 = Panel("""0
1
0
0
1
0""")
panel_97 = Panel("""0
0
-980
0
0
0""")
panel_98 = Panel(merge_33)
line_23 = Line(scale_11.Geometry)
prop_11 = PropertyInfo(PropName="PName", PropId="1", Density=unit_13.Density, YoungsModulus=unit_13.YoungsModulus, PoissonsRatio="0.33333")
sect_17 = SectionInfo(
    SectName="tension",
    SectId="1",
    PropId="1",
    Area=unit_13.Area,
    IXX=unit_13.Inertia_x,
    IYY=unit_13.Inertia_y,
    VEN=unit_13.SaintVenant)
elem_20 = ElementInfo(
    Lines=line_22,
    SectId="1",
    Constraint=[True, True, True, True, True, True, True, True, True, True, True, True],
    CoordAngle=0,
    CMQ=[0, 0, 0, 0, 0, 0, 0, 0, 0, 0, 0, 0],
    CMQEd=[0, 0, 0, 0, 0, 0])
icon_19 = IconInfo(Points=item_18.Item1, Constraints=panel_92)
icon_20 = IconInfo(Points=item_19.Item1, Constraints=panel_93)
elem_21 = ElementInfo(
    Lines=line_20,
    SectId="2",
    Constraint=[True, True, True, True, True, True, True, True, True, True, True, True],
    CoordAngle=0,
    CMQ=[0, 0, 0, 0, 0, 0, 0, 0, 0, 0, 0, 0],
    CMQEd=[0, 0, 0, 0, 0, 0])
icon_21 = IconInfo(Points=item_18.Item, Constraints=panel_92)
icon_22 = IconInfo(Points=item_19.Item, Constraints=panel_93)
sect_18 = SectionInfo(
    SectName="carbon",
    SectId="2",
    PropId="1",
    Area=unit_12.Area,
    IXX=unit_12.Inertia_x,
    IYY=unit_12.Inertia_y,
    VEN=unit_12.SaintVenant)
panel_99 = Panel(merge_37)
item_24 = ListItem(List=scale_9.Geometry, Index=0, Wrap=True)
len_2 = Length(Curve=join_2)
vcon_7 = VconInfo(Points=item_21.Item, Forces=panel_94)
vcon_8 = VconInfo(Points=item_21.Item1, Forces=panel_94)
panel_100 = Panel("""1
1
1
1
1
1""")
prop_12 = PropertyInfo(PropName="PName", PropId="1", Density=unit_15.Density, YoungsModulus=unit_15.YoungsModulus, PoissonsRatio="0.33333")
sect_19 = SectionInfo(
    SectName="tension",
    SectId="1",
    PropId="1",
    Area=unit_15.Area,
    IXX=unit_15.Inertia_x,
    IYY=unit_15.Inertia_y,
    VEN=unit_15.SaintVenant)
elem_22 = ElementInfo(
    Lines=line_21,
    SectId="2",
    Constraint=[True, True, True, True, True, True, True, True, True, True, True, True],
    CoordAngle=0,
    CMQ=[0, 0, 0, 0, 0, 0, 0, 0, 0, 0, 0, 0],
    CMQEd=[0, 0, 0, 0, 0, 0])
icon_23 = IconInfo(Points=item_20, Constraints=panel_95)
sect_20 = SectionInfo(
    SectName="carbon",
    SectId="2",
    PropId="1",
    Area=unit_14.Area,
    IXX=unit_14.Inertia_x,
    IYY=unit_14.Inertia_y,
    VEN=unit_14.SaintVenant)
icon_24 = IconInfo(Points="1,0,2", Constraints=panel_91)
icon_25 = IconInfo(Points="2,0,2", Constraints=panel_91)
vcon_9 = VconInfo(Points=item_23, Forces=panel_97)
merge_38 = Merge(Data1=vcon_7, Data2=vcon_8)
merge_39 = Merge(Data1=sect_15, Data2=sect_16)
merge_40 = Merge(Data1=icon_21, Data2=icon_19, Data3=icon_22, Data4=icon_20)
merge_41 = Merge(Data1=elem_20, Data2=elem_21)
elem_23 = ElementInfo(
    Lines=line_23,
    SectId="2",
    Constraint=[True, True, True, True, True, True, True, True, True, True, True, True],
    CoordAngle=0,
    CMQ=[0, 0, 0, 0, 0, 0, 0, 0, 0, 0, 0, 0],
    CMQEd=[0, 0, 0, 0, 0, 0])
icon_26 = IconInfo(Points=item_22, Constraints=panel_100)
icon_27 = IconInfo(Points="1,0,2", Constraints=panel_96)
icon_28 = IconInfo(Points="2,0,2", Constraints=panel_96)
allprop_4 = AllPropertyInfo(Propdata=prop_10)  # -> AllPropdata, Contents
allvcon_4 = AllVconInfo(Vcondata=merge_38)  # -> AllVcondata, Contents
merge_42 = Merge(Data1=vcon_9)
merge_43 = Merge(Data1=sect_17, Data2=sect_18)
allsect_4 = AllSectionInfo(Sectdata=merge_39)  # -> AllSectdata, Contents
merge_44 = Merge(Data1=icon_23)
allicon_4 = AllIconInfo(Icondata=merge_40)  # -> AllIcondata, Contents
merge_45 = Merge(Data1=elem_22)
allelem_4 = AllElemntInfo(Elemdata=merge_41)  # -> AllElemdata, Contents
allprop_5 = AllPropertyInfo(Propdata=prop_11)  # -> AllPropdata, Contents
allvcon_5 = AllVconInfo(Vcondata=merge_42)  # -> AllVcondata, Contents
merge_46 = Merge(Data1=sect_19, Data2=sect_20)
panel_101 = Panel(allprop_4.AllPropdata)
panel_102 = Panel(allprop_4.Contents)
panel_103 = Panel(allsect_4.AllSectdata)
panel_104 = Panel(allsect_4.Contents)
allsect_5 = AllSectionInfo(Sectdata=merge_43)  # -> AllSectdata, Contents
merge_47 = Merge(Data1=icon_26)
panel_105 = Panel(allicon_4.Contents)
merge_48 = Merge(Data1=elem_23)
allicon_5 = AllIconInfo(Icondata=merge_44)  # -> AllIcondata, Contents
panel_106 = Panel(allvcon_4.Contents)
allelem_5 = AllElemntInfo(Elemdata=merge_45)  # -> AllElemdata, Contents
allprop_6 = AllPropertyInfo(Propdata=prop_12)  # -> AllPropdata, Contents
panel_107 = Panel(allvcon_4.AllVcondata)
panel_108 = Panel(allsect_5.AllSectdata)
panel_109 = Panel(allprop_5.AllPropdata)
panel_110 = Panel(allprop_5.Contents)
panel_111 = Panel(allsect_5.Contents)
allsect_6 = AllSectionInfo(Sectdata=merge_46)  # -> AllSectdata, Contents
panel_112 = Panel(allicon_5.Contents)
panel_113 = Panel(allicon_4.AllIcondata)
allicon_6 = AllIconInfo(Icondata=merge_47)  # -> AllIcondata, Contents
panel_114 = Panel(allvcon_5.Contents)
panel_115 = Panel(allelem_4.AllElemdata)
allelem_6 = AllElemntInfo(Elemdata=merge_48)  # -> AllElemdata, Contents
panel_116 = Panel(allvcon_5.AllVcondata)
panel_117 = Panel(allprop_6.AllPropdata)
panel_118 = Panel(allprop_6.Contents)
panel_119 = Panel(allsect_6.AllSectdata)
panel_120 = Panel(allsect_6.Contents)
panel_121 = Panel(allicon_6.Contents)
panel_122 = Panel(allicon_5.AllIcondata)
panel_123 = Panel(allelem_5.AllElemdata)
panel_124 = Panel(allicon_6.AllIcondata)
panel_125 = Panel(allelem_6.AllElemdata)
multiplication_10 = Multiplication(B=Slider(100000, range=0..100000))
panel_126 = Panel(multiplication_10)
multiplication_11 = Multiplication(B=Slider(100000, range=0..100000))
panel_127 = Panel(multiplication_11)
merge_49 = Merge(
    Data1=allprop_4.AllPropdata,
    Data2=allsect_4.AllSectdata,
    Data3=allelem_4.AllElemdata,
    Data4=allicon_4.AllIcondata,
    Data5=allvcon_4.AllVcondata)
panel_128 = Panel("0,0,0")
number_slider_23 = Slider(4, range=0..10)
multiplication_12 = Multiplication(B=Slider(100000, range=0..100000))
panel_129 = Panel(multiplication_12)
item_25 = ListItem(List=merge_49, Index=0, Wrap=True)  # -> Item, Item1, Item2, Item3, Item4
merge_50 = Merge(
    Data1=allprop_5.AllPropdata,
    Data2=allsect_5.AllSectdata,
    Data3=allelem_5.AllElemdata,
    Data4=allicon_5.AllIcondata,
    Data5=allvcon_5.AllVcondata)
number_slider_24 = Slider(4, range=0..10)
item_26 = ListItem(List=merge_50, Index=0, Wrap=True)  # -> Item, Item1, Item2, Item3, Item4
alldata_4 = CombineAlldata(
    AllPropdata=item_25.Item,
    AllSectdata=item_25.Item1,
    AllElemdata=item_25.Item2,
    AllIcondata=item_25.Item3,
    AllVcondata=item_25.Item4)  # -> Alldata, Contents
ldisp_4 = LinearAnalysisDisp(Alldata=alldata_4.Alldata)  # -> Deformed, Colors
_10º_4 = PowerOf10(Value=Slider(0, range=-10..3))
number_slider_25 = Slider(4, range=0..10)
alldata_5 = CombineAlldata(
    AllPropdata=item_26.Item,
    AllSectdata=item_26.Item1,
    AllElemdata=item_26.Item2,
    AllIcondata=item_26.Item3,
    AllVcondata=item_26.Item4)  # -> Alldata, Contents
ldisp_5 = LinearAnalysisDisp(Alldata=alldata_5.Alldata)  # -> Deformed, Colors
panel_130 = Panel("""0
-980
0
10
0
0""")
vcon_10 = VconInfo(Points=item_24, Forces=panel_130)
merge_51 = Merge(Data1=vcon_10)
allvcon_6 = AllVconInfo(Vcondata=merge_51)  # -> AllVcondata, Contents
panel_131 = Panel(allvcon_6.Contents)
panel_132 = Panel(allvcon_6.AllVcondata)
merge_52 = Merge(
    Data1=allprop_6.AllPropdata,
    Data2=allsect_6.AllSectdata,
    Data3=allelem_6.AllElemdata,
    Data4=allicon_6.AllIcondata,
    Data5=allvcon_6.AllVcondata)
item_27 = ListItem(List=merge_52, Index=0, Wrap=True)  # -> Item, Item1, Item2, Item3, Item4
_10º_5 = PowerOf10(Value=Slider(0, range=-10..3))
branch_4 = TreeBranch(Tree=alldata_4.Contents, Path=Slider(3, range=1..4), MaintainPaths=True)
alldata_6 = CombineAlldata(
    AllPropdata=item_27.Item,
    AllSectdata=item_27.Item1,
    AllElemdata=item_27.Item2,
    AllIcondata=item_27.Item3,
    AllVcondata=item_27.Item4,
    体積力の加速度ベクトルの和="0,0,0")  # -> Alldata, Contents
ldisp_6 = LinearAnalysisDisp(Alldata=alldata_6.Alldata)  # -> Deformed, Colors
panel_133 = Panel(ldisp_6.Colors)
_10º_6 = PowerOf10(Value=Slider(0, range=-10..3))
checkuf = CheckUf(Alldata=alldata_5.Alldata)
branch_5 = TreeBranch(Tree=alldata_5.Contents, Path=Slider(3, range=1..4), MaintainPaths=True)
panel_134 = Panel(ldisp_6.Deformed)
dprod_4 = DotProduct(Unitize=False)
lng_5 = ListLength(List=dprod_4)
checkpf = CheckPf(Alldata=alldata_5.Alldata)
series_4 = Series(Start=0, Step=1, Count=lng_5)
checkke = CheckElemK(Alldata=alldata_5.Alldata, Index=Slider(1, range=0..10))
checkkff = CheckKff(Alldata=alldata_5.Alldata)
checkuf_2 = CheckUf(Alldata=alldata_6.Alldata)
panel_135 = Panel(checkuf_2)
branch_6 = TreeBranch(Tree=alldata_6.Contents, Path=Slider(4, range=1..4), MaintainPaths=True)
checkpf_2 = CheckPf(Alldata=alldata_6.Alldata)
panel_136 = Panel(checkpf_2)
dprod_5 = DotProduct(Unitize=False)
lng_6 = ListLength(List=dprod_5)
panel_137 = Panel(checkpf)
panel_138 = Panel(checkke)
series_5 = Series(Start=0, Step=1, Count=lng_6)
item_28 = ListItem(List=branch_4, Index=0, Wrap=True)
sort_4 = SortList(Keys=dprod_4, ValuesA=series_4)  # -> Keys, ValuesA
sqrt_4 = SquareRoot(Value=sort_4.Keys)
item_29 = ListItem(List=sqrt_4, Index=0, Wrap=True)  # -> Item1, Item
checkke_2 = CheckElemK(Alldata=alldata_6.Alldata, Index=Slider(0, range=0..10))
checkkff_2 = CheckKff(Alldata=alldata_6.Alldata)
panel_139 = Panel(checkkff)
dprod_6 = DotProduct(Unitize=False)
lng_7 = ListLength(List=dprod_6)
series_6 = Series(Start=0, Step=1, Count=lng_7)
sort_5 = SortList(Keys=dprod_5, ValuesA=series_5)  # -> Keys, ValuesA
sqrt_5 = SquareRoot(Value=sort_5.Keys)
item_30 = ListItem(List=sqrt_5, Index=0, Wrap=True)  # -> Item1, Item
item_31 = ListItem(List=branch_5, Index=0, Wrap=True)
panel_140 = Panel(branch_4)
panel_141 = Panel(checkke_2)
sort_6 = SortList(Keys=dprod_6, ValuesA=series_6)  # -> Keys, ValuesA
sqrt_6 = SquareRoot(Value=sort_6.Keys)
item_32 = ListItem(List=sqrt_6, Index=0, Wrap=True)  # -> Item1, Item
panel_142 = Panel(checkkff_2)
item_33 = ListItem(List=branch_6, Index=0, Wrap=True)
panel_143 = Panel(branch_5)
panel_145 = Panel(checkuf)
panel_146 = Panel(branch_6)
pt_29 = Point([Point(2000, 0, 2000), Point(0, 0, 2000)])
crv_20 = Curve([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])
xz = XZPlane(Origin=Point(0, 0, 0))
rotate = Rotate(Geometry=pt_29, Angle=1.570796327, Plane=xz)  # -> Geometry, Transform
rotate_2 = Rotate(Geometry=pt_29, Angle=1.570796327, Plane=PlaneXY(0, 0, 0))  # -> Geometry, Transform
item_34 = ListItem(List=rotate.Geometry, Index=0, Wrap=True)  # -> Item, Item1
rotate_3 = Rotate(Geometry=crv_20, Angle=1.570796327, Plane=xz)  # -> Geometry, Transform
item_35 = ListItem(List=rotate_2.Geometry, Index=0, Wrap=True)  # -> Item, Item1
rotate_4 = Rotate(Geometry=crv_20, Angle=1.570796327, Plane=PlaneXY(0, 0, 0))  # -> Geometry, Transform

number_slider_26 = Slider(3, range=-5..5)
number_slider_27 = Slider(2, range=-5..5)
number_slider_28 = Slider(1, range=0..10)
pt_30 = Point(Point(0, 0, -9.8))
line_24 = Line(rotate_3.Geometry)
pt_31 = Point(item_34.Item1)
pt_32 = Point(item_34.Item)
adjust_units = AdjustUnits(
    YoungsModulus="22.54",
    EDigit="3",
    Density="7.8",
    DDigit="-1",
    Area="45.33",
    ADigit="6",
    Inertia_x="693.252",
    IxDigit="9",
    Inertia_y="50.69",
    IyDigit="9",
    SaintVenant="9.87",
    VDigit="8",
    Length="1000",
    LDigit="0",
    体積力の加速度ベクトルの和=pt_30,
    ForceUnitParameter=number_slider_27,
    LengthUnitParameter=number_slider_26,
    EUnitParameter=number_slider_28)  # -> YoungsModulus, Density, Area, Inertia_x, Inertia_y, SaintVenant, Length, Gravity, ModelScale, ShowingEachValueAsText
adjust_units_2 = AdjustUnits(
    YoungsModulus="22.54",
    EDigit="3",
    Density="7.8",
    DDigit="-1",
    Area="76.2",
    ADigit="6",
    Inertia_x="160.132",
    IxDigit="9",
    Inertia_y="2139.338",
    IyDigit="9",
    SaintVenant="28.33",
    VDigit="8",
    Length="1000",
    LDigit="0",
    体積力の加速度ベクトルの和=pt_30,
    ForceUnitParameter=number_slider_27,
    LengthUnitParameter=number_slider_26,
    EUnitParameter=number_slider_28)  # -> YoungsModulus, Density, Area, Inertia_x, Inertia_y, SaintVenant, Length, Gravity, ModelScale, ShowingEachValueAsText
pt_33 = Point(Point(0, 0, 0))
sect_21 = SectionInfo(
    SectName="carbon",
    SectId="2",
    PropId="1",
    Area=adjust_units_2.Area,
    IXX=adjust_units_2.Inertia_x,
    IYY=adjust_units_2.Inertia_y,
    VEN=adjust_units_2.SaintVenant)
prop_13 = PropertyInfo(
    PropName="PName",
    PropId="1",
    Density=adjust_units.Density,
    YoungsModulus=adjust_units.YoungsModulus,
    PoissonsRatio="0.33333")
sect_22 = SectionInfo(
    SectName="tension",
    SectId="1",
    PropId="1",
    Area=adjust_units.Area,
    IXX=adjust_units.Inertia_x,
    IYY=adjust_units.Inertia_y,
    VEN=adjust_units.SaintVenant)
scale_12 = Scale(Geometry=line_24, Center=pt_33, Factor=adjust_units_2.ModelScale)  # -> Geometry, Transform
scale_13 = Scale(Geometry=pt_32, Center=pt_33, Factor=adjust_units_2.ModelScale)  # -> Geometry, Transform
scale_14 = Scale(Geometry=pt_31, Center=pt_33, Factor=adjust_units_2.ModelScale)  # -> Geometry, Transform
panel_147 = Panel(adjust_units.ShowingEachValueAsText)
merge_53 = Merge(Data1=sect_22, Data2=sect_21)
panel_148 = Panel("""-980
0
0
0
10
0""")
panel_149 = Panel("90")
allprop_7 = AllPropertyInfo(Propdata=prop_13)  # -> AllPropdata, Contents
allsect_7 = AllSectionInfo(Sectdata=merge_53)  # -> AllSectdata, Contents
elem_24 = ElementInfo(
    Lines=scale_12.Geometry,
    SectId="2",
    CoordAngle=0,
    CMQSTA=[0, 0, 0, 0, 0, 0],
    CMQEND=[0, 0, 0, 0, 0, 0],
    Condition_TX_Changed=True,
    Condition_TX2_Changed=True,
    Condition_TY_Changed=True,
    Condition_TY2_Changed=True,
    Condition_TZ_Changed=True,
    Condition_TZ2_Changed=True,
    Condition_X_Changed=True,
    Condition_X2_Changed=True,
    Condition_Y_Changed=True,
    Condition_Y2_Changed=True,
    Condition_Z_Changed=True,
    Condition_Z2_Changed=True)
icon2_2 = Icon2Info(
    Points=scale_14.Geometry,
    Condition_TX_Changed=True,
    Condition_TY_Changed=True,
    Condition_TZ_Changed=True,
    Condition_X_Changed=True,
    Condition_Y_Changed=True,
    Condition_Z_Changed=True)
vcon_11 = VconInfo(Points=scale_13.Geometry, Forces=panel_148)
panel_150 = Panel(adjust_units_2.ShowingEachValueAsText)
allvcon_7 = AllVconInfo(Vcondata=vcon_11)  # -> AllVcondata, Contents
allelem_7 = AllElemntInfo(Elemdata=elem_24)  # -> AllElemdata, Contents
allicon_7 = AllIconInfo(Icondata=icon2_2)  # -> AllIcondata, Contents
vec_2 = Vector(adjust_units_2.Gravity)
alldata_7 = CombineAlldata(
    AllPropdata=allprop_7.AllPropdata,
    AllSectdata=allsect_7.AllSectdata,
    AllElemdata=allelem_7.AllElemdata,
    AllIcondata=allicon_7.AllIcondata,
    AllVcondata=allvcon_7.AllVcondata,
    体積力の加速度ベクトルの和="0,0,0")  # -> Alldata, Contents
ptelem = PointsAndElems(Alldata=alldata_7.Alldata)  # -> Nodes, Elements
branch_7 = TreeBranch(Tree=alldata_7.Contents, Path=Slider(4, range=1..4), MaintainPaths=True)
la = LinearAnalysis(Alldata=alldata_7.Alldata)  # -> AllDisplacement, AllStress
panel_151 = Panel(branch_7)
panel_152 = Panel(la.AllDisplacement)

number_slider_29 = Slider(3, range=-5..5)
number_slider_30 = Slider(2, range=-5..5)
number_slider_31 = Slider(1, range=0..10)
pt_34 = Point(Point(0, 0, -9.8))
line_25 = Line(rotate_4.Geometry)
pt_35 = Point(item_35.Item1)
pt_36 = Point(item_35.Item)
adjust_units_3 = AdjustUnits(
    YoungsModulus="22.54",
    EDigit="3",
    Density="7.8",
    DDigit="-1",
    Area="45.33",
    ADigit="6",
    Inertia_x="693.252",
    IxDigit="9",
    Inertia_y="50.69",
    IyDigit="9",
    SaintVenant="9.87",
    VDigit="8",
    Length="1000",
    LDigit="0",
    体積力の加速度ベクトルの和=pt_34,
    ForceUnitParameter=number_slider_30,
    LengthUnitParameter=number_slider_29,
    EUnitParameter=number_slider_31)  # -> YoungsModulus, Density, Area, Inertia_x, Inertia_y, SaintVenant, Length, Gravity, ModelScale, ShowingEachValueAsText
adjust_units_4 = AdjustUnits(
    YoungsModulus="22.54",
    EDigit="3",
    Density="7.8",
    DDigit="-1",
    Area="76.2",
    ADigit="6",
    Inertia_x="160.132",
    IxDigit="9",
    Inertia_y="2139.338",
    IyDigit="9",
    SaintVenant="28.33",
    VDigit="8",
    Length="1000",
    LDigit="0",
    体積力の加速度ベクトルの和=pt_34,
    ForceUnitParameter=number_slider_30,
    LengthUnitParameter=number_slider_29,
    EUnitParameter=number_slider_31)  # -> YoungsModulus, Density, Area, Inertia_x, Inertia_y, SaintVenant, Length, Gravity, ModelScale, ShowingEachValueAsText
pt_37 = Point(Point(0, 0, 0))
sect_23 = SectionInfo(
    SectName="carbon",
    SectId="2",
    PropId="1",
    Area=adjust_units_4.Area,
    IXX=adjust_units_4.Inertia_x,
    IYY=adjust_units_4.Inertia_y,
    VEN=adjust_units_4.SaintVenant)
prop_14 = PropertyInfo(
    PropName="PName",
    PropId="1",
    Density=adjust_units_3.Density,
    YoungsModulus=adjust_units_3.YoungsModulus,
    PoissonsRatio="0.33333")
sect_24 = SectionInfo(
    SectName="tension",
    SectId="1",
    PropId="1",
    Area=adjust_units_3.Area,
    IXX=adjust_units_3.Inertia_x,
    IYY=adjust_units_3.Inertia_y,
    VEN=adjust_units_3.SaintVenant)
scale_15 = Scale(Geometry=line_25, Center=pt_37, Factor=adjust_units_4.ModelScale)  # -> Geometry, Transform
scale_16 = Scale(Geometry=pt_36, Center=pt_37, Factor=adjust_units_4.ModelScale)  # -> Geometry, Transform
scale_17 = Scale(Geometry=pt_35, Center=pt_37, Factor=adjust_units_4.ModelScale)  # -> Geometry, Transform
panel_153 = Panel(adjust_units_3.ShowingEachValueAsText)
merge_54 = Merge(Data1=sect_24, Data2=sect_23)
panel_154 = Panel("""-980
0
0
0
10
0""")
allprop_8 = AllPropertyInfo(Propdata=prop_14)  # -> AllPropdata, Contents
allsect_8 = AllSectionInfo(Sectdata=merge_54)  # -> AllSectdata, Contents
elem_25 = ElementInfo(
    Lines=scale_15.Geometry,
    SectId="2",
    CoordAngle=0,
    CMQSTA=[0, 0, 0, 0, 0, 0],
    CMQEND=[0, 0, 0, 0, 0, 0],
    Condition_TX_Changed=True,
    Condition_TX2_Changed=True,
    Condition_TY_Changed=True,
    Condition_TY2_Changed=True,
    Condition_TZ_Changed=True,
    Condition_TZ2_Changed=True,
    Condition_X_Changed=True,
    Condition_X2_Changed=True,
    Condition_Y_Changed=True,
    Condition_Y2_Changed=True,
    Condition_Z_Changed=True,
    Condition_Z2_Changed=True)
icon2_3 = Icon2Info(
    Points=scale_17.Geometry,
    Condition_TX_Changed=True,
    Condition_TY_Changed=True,
    Condition_TZ_Changed=True,
    Condition_X_Changed=True,
    Condition_Y_Changed=True,
    Condition_Z_Changed=True)
vcon_12 = VconInfo(Points=scale_16.Geometry, Forces=panel_154)
panel_156 = Panel(adjust_units_4.ShowingEachValueAsText)
allvcon_8 = AllVconInfo(Vcondata=vcon_12)  # -> AllVcondata, Contents
allelem_8 = AllElemntInfo(Elemdata=elem_25)  # -> AllElemdata, Contents
allicon_8 = AllIconInfo(Icondata=icon2_3)  # -> AllIcondata, Contents
vec_3 = Vector(adjust_units_4.Gravity)
alldata_8 = CombineAlldata(
    AllPropdata=allprop_8.AllPropdata,
    AllSectdata=allsect_8.AllSectdata,
    AllElemdata=allelem_8.AllElemdata,
    AllIcondata=allicon_8.AllIcondata,
    AllVcondata=allvcon_8.AllVcondata,
    体積力の加速度ベクトルの和="0,0,0")  # -> Alldata, Contents
ptelem_2 = PointsAndElems(Alldata=alldata_8.Alldata)  # -> Nodes, Elements
branch_8 = TreeBranch(Tree=alldata_8.Contents, Path=Slider(4, range=1..4), MaintainPaths=True)
la_2 = LinearAnalysis(Alldata=alldata_8.Alldata)  # -> AllDisplacement, AllStress
panel_157 = Panel(branch_8)
panel_158 = Panel(la_2.AllDisplacement)

xz_2 = XZPlane(Origin=Point(0, 0, 0))
pt_38 = Point(icon2)
crv_21 = Curve(line_14)
rotate_5 = Rotate(Geometry=crv_21, Angle=1.570796327, Plane=xz_2)  # -> Geometry, Transform
rotate_6 = Rotate(Geometry=pt_38, Angle=1.570796327, Plane=xz_2)  # -> Geometry, Transform
item_36 = ListItem(List=pt_29, Index=0, Wrap=True)  # -> Item, Item1

number_slider_32 = Slider(3, range=-5..5)
number_slider_33 = Slider(2, range=-5..5)
number_slider_34 = Slider(1, range=0..10)
pt_39 = Point(Point(0, 0, -9.8))
line_26 = Line(crv_20)
pt_40 = Point(item_36.Item1)
pt_41 = Point(item_36.Item)
adjust_units_5 = AdjustUnits(
    YoungsModulus="22.54",
    EDigit="3",
    Density="7.8",
    DDigit="-1",
    Area="45.33",
    ADigit="6",
    Inertia_x="693.252",
    IxDigit="9",
    Inertia_y="50.69",
    IyDigit="9",
    SaintVenant="9.87",
    VDigit="8",
    Length="1000",
    LDigit="0",
    体積力の加速度ベクトルの和=pt_39,
    ForceUnitParameter=number_slider_33,
    LengthUnitParameter=number_slider_32,
    EUnitParameter=number_slider_34)  # -> YoungsModulus, Density, Area, Inertia_x, Inertia_y, SaintVenant, Length, Gravity, ModelScale, ShowingEachValueAsText
adjust_units_6 = AdjustUnits(
    YoungsModulus="22.54",
    EDigit="3",
    Density="7.8",
    DDigit="-1",
    Area="76.2",
    ADigit="6",
    Inertia_x="160.132",
    IxDigit="9",
    Inertia_y="2139.338",
    IyDigit="9",
    SaintVenant="28.33",
    VDigit="8",
    Length="1000",
    LDigit="0",
    体積力の加速度ベクトルの和=pt_39,
    ForceUnitParameter=number_slider_33,
    LengthUnitParameter=number_slider_32,
    EUnitParameter=number_slider_34)  # -> YoungsModulus, Density, Area, Inertia_x, Inertia_y, SaintVenant, Length, Gravity, ModelScale, ShowingEachValueAsText
pt_42 = Point(Point(0, 0, 0))
sect_25 = SectionInfo(
    SectName="carbon",
    SectId="2",
    PropId="1",
    Area=adjust_units_6.Area,
    IXX=adjust_units_6.Inertia_x,
    IYY=adjust_units_6.Inertia_y,
    VEN=adjust_units_6.SaintVenant)
prop_15 = PropertyInfo(
    PropName="PName",
    PropId="1",
    Density=adjust_units_5.Density,
    YoungsModulus=adjust_units_5.YoungsModulus,
    PoissonsRatio="0.33333")
sect_26 = SectionInfo(
    SectName="tension",
    SectId="1",
    PropId="1",
    Area=adjust_units_5.Area,
    IXX=adjust_units_5.Inertia_x,
    IYY=adjust_units_5.Inertia_y,
    VEN=adjust_units_5.SaintVenant)
scale_18 = Scale(Geometry=line_26, Center=pt_42, Factor=adjust_units_6.ModelScale)  # -> Geometry, Transform
scale_19 = Scale(Geometry=pt_41, Center=pt_42, Factor=adjust_units_6.ModelScale)  # -> Geometry, Transform
scale_20 = Scale(Geometry=pt_40, Center=pt_42, Factor=adjust_units_6.ModelScale)  # -> Geometry, Transform
panel_159 = Panel(adjust_units_5.ShowingEachValueAsText)
merge_55 = Merge(Data1=sect_26, Data2=sect_25)
panel_160 = Panel("""-980
0
0
0
10
0""")
allprop_9 = AllPropertyInfo(Propdata=prop_15)  # -> AllPropdata, Contents
allsect_9 = AllSectionInfo(Sectdata=merge_55)  # -> AllSectdata, Contents
elem_26 = ElementInfo(
    Lines=scale_18.Geometry,
    SectId="2",
    CoordAngle=0,
    CMQSTA=[0, 0, 0, 0, 0, 0],
    CMQEND=[0, 0, 0, 0, 0, 0],
    Condition_TX_Changed=True,
    Condition_TX2_Changed=True,
    Condition_TY_Changed=True,
    Condition_TY2_Changed=True,
    Condition_TZ_Changed=True,
    Condition_TZ2_Changed=True,
    Condition_X_Changed=True,
    Condition_X2_Changed=True,
    Condition_Y_Changed=True,
    Condition_Y2_Changed=True,
    Condition_Z_Changed=True,
    Condition_Z2_Changed=True)
icon2_4 = Icon2Info(
    Points=scale_20.Geometry,
    Condition_TX_Changed=True,
    Condition_TY_Changed=True,
    Condition_TZ_Changed=True,
    Condition_X_Changed=True,
    Condition_Y_Changed=True,
    Condition_Z_Changed=True)
vcon_13 = VconInfo(Points=scale_19.Geometry, Forces=panel_160)
panel_162 = Panel(adjust_units_6.ShowingEachValueAsText)
allvcon_9 = AllVconInfo(Vcondata=vcon_13)  # -> AllVcondata, Contents
allelem_9 = AllElemntInfo(Elemdata=elem_26)  # -> AllElemdata, Contents
allicon_9 = AllIconInfo(Icondata=icon2_4)  # -> AllIcondata, Contents
vec_4 = Vector(adjust_units_6.Gravity)
alldata_9 = CombineAlldata(
    AllPropdata=allprop_9.AllPropdata,
    AllSectdata=allsect_9.AllSectdata,
    AllElemdata=allelem_9.AllElemdata,
    AllIcondata=allicon_9.AllIcondata,
    AllVcondata=allvcon_9.AllVcondata,
    体積力の加速度ベクトルの和="0,0,0")  # -> Alldata, Contents
ptelem_3 = PointsAndElems(Alldata=alldata_9.Alldata)  # -> Nodes, Elements
branch_9 = TreeBranch(Tree=alldata_9.Contents, Path=Slider(4, range=1..4), MaintainPaths=True)
la_3 = LinearAnalysis(Alldata=alldata_9.Alldata)  # -> AllDisplacement, AllStress
panel_163 = Panel(branch_9)
panel_164 = Panel(la_3.AllDisplacement)

pt_43 = Point(Point(0, 0, 0))
pt_44 = Point(Point(0, 0, -9.8))
item_37 = ListItem(List=rotate_6.Geometry, Index=0, Wrap=True)  # -> Item, Item1
pt_45 = Point("2,0,2")
number_slider_35 = Slider(3, range=-5..5)
number_slider_36 = Slider(2, range=-5..5)
number_slider_37 = Slider(1, range=0..10)
unit_16 = AdjustUnits(
    YoungsModulus="22.54",
    EDigit="3",
    Density="7.8",
    DDigit="-1",
    Area="76.2",
    ADigit="6",
    Inertia_x="160.132",
    IxDigit="9",
    Inertia_y="2139.338",
    IyDigit="9",
    SaintVenant="28.33",
    VDigit="8",
    Length="1000",
    LDigit="0",
    体積力の加速度ベクトルの和=pt_44,
    ForceUnitParameter=number_slider_36,
    LengthUnitParameter=number_slider_35,
    EUnitParameter=number_slider_37)  # -> YoungsModulus, Density, Area, Inertia_x, Inertia_y, SaintVenant, Length, Gravity, ModelScale, ShowingEachValueAsText
scale_21 = Scale(Geometry=item_37.Item, Center=pt_43, Factor=unit_16.ModelScale)  # -> Geometry, Transform
scale_22 = Scale(Geometry=rotate_5.Geometry, Center=pt_43, Factor=unit_16.ModelScale)  # -> Geometry, Transform
unit_17 = AdjustUnits(
    YoungsModulus="22.54",
    EDigit="3",
    Density="7.8",
    DDigit="-1",
    Area="45.33",
    ADigit="6",
    Inertia_x="693.252",
    IxDigit="9",
    Inertia_y="50.69",
    IyDigit="9",
    SaintVenant="9.87",
    VDigit="8",
    Length="1000",
    LDigit="0",
    体積力の加速度ベクトルの和=pt_44,
    ForceUnitParameter=number_slider_36,
    LengthUnitParameter=number_slider_35,
    EUnitParameter=number_slider_37)  # -> YoungsModulus, Density, Area, Inertia_x, Inertia_y, SaintVenant, Length, Gravity, ModelScale, ShowingEachValueAsText
scale_23 = Scale(Geometry=item_37.Item1, Center=pt_43, Factor=unit_16.ModelScale)  # -> Geometry, Transform
merge_56 = Merge(
    Data1=unit_17.YoungsModulus,
    Data2=unit_17.Density,
    Data3=unit_17.Area,
    Data4=unit_17.Inertia_x,
    Data5=unit_17.Inertia_y,
    Data6=unit_17.SaintVenant,
    Data7=unit_17.Length,
    Data8=unit_17.Gravity,
    Data9=unit_17.ModelScale)
merge_57 = Merge(
    Data1=unit_16.YoungsModulus,
    Data2=unit_16.Density,
    Data3=unit_16.Area,
    Data4=unit_16.Inertia_x,
    Data5=unit_16.Inertia_y,
    Data6=unit_16.SaintVenant,
    Data7=unit_16.Length,
    Data8=unit_16.Gravity,
    Data9=unit_16.ModelScale)
merge_58 = Merge(Data1=scale_23.Geometry, Data2=pt_45)
panel_165 = Panel(merge_56)
join_3 = JoinCurves(Curves=flatten(scale_22.Geometry), Preserve=False)  # -> flatten(Curves)
item_38 = ListItem(List=scale_23.Geometry, Index=0, Wrap="false")
panel_166 = Panel("""0
1
0
0
1
0""")
item_39 = ListItem(List=scale_21.Geometry, Index=0, Wrap=True)
line_27 = Line(scale_22.Geometry)
panel_167 = Panel(merge_57)
len_3 = Length(Curve=join_3)
panel_168 = Panel("""1
1
1
1
1
1""")
panel_169 = Panel("""0
1
1
1
1
0""")
panel_170 = Panel("1,0,2")
prop_16 = PropertyInfo(PropName="PName", PropId="1", Density=unit_17.Density, YoungsModulus=unit_17.YoungsModulus, PoissonsRatio="0.33333")
sect_27 = SectionInfo(
    SectName="tension",
    SectId="1",
    PropId="1",
    Area=unit_17.Area,
    IXX=unit_17.Inertia_x,
    IYY=unit_17.Inertia_y,
    VEN=unit_17.SaintVenant)
elem_27 = ElementInfo(
    Lines=<missing>,
    SectId=<missing>,
    Constraint=[True, True, True, True, True, True, True, True, True, True, True, True],
    CoordAngle=<missing>,
    CMQSt=[0, 0, 0, 0, 0, 0],
    CMQEd=[0, 0, 0, 0, 0, 0])
sect_28 = SectionInfo(
    SectName="carbon",
    SectId="2",
    PropId="1",
    Area=unit_16.Area,
    IXX=unit_16.Inertia_x,
    IYY=unit_16.Inertia_y,
    VEN=unit_16.SaintVenant)
elem_28 = ElementInfo(
    Lines=line_27,
    SectId="2",
    Constraint=[True, True, True, True, True, True, True, True, True, True, True, True],
    CoordAngle=0,
    CMQ=[0, 0, 0, 0, 0, 0, 0, 0, 0, 0, 0, 0],
    CMQEd=[0, 0, 0, 0, 0, 0])
icon_29 = IconInfo(Points=item_38, Constraints=panel_168)
entwine = Entwine(Branch00=panel_166, Branch01=panel_169, FlattenInputs=True)
merge_59 = Merge(Data1=sect_27, Data2=sect_28)
merge_60 = Merge(Data1=icon_29)
icon_30 = IconInfo(Points=graft(merge_58), Constraints=entwine)  # -> flatten(Icondata)
merge_61 = Merge(Data1=elem_28)
icon_31 = IconInfo(Points=merge_58, Constraints=panel_166)
allprop_10 = AllPropertyInfo(Propdata=prop_16)  # -> AllPropdata, Contents
allsect_10 = AllSectionInfo(Sectdata=merge_59)  # -> AllSectdata, Contents
allelem_10 = AllElemntInfo(Elemdata=merge_61)  # -> AllElemdata, Contents
allicon_10 = AllIconInfo(Icondata=merge_60)  # -> AllIcondata, Contents
panel_171 = Panel(allprop_10.AllPropdata)
panel_172 = Panel(allprop_10.Contents)
panel_173 = Panel(allsect_10.AllSectdata)
panel_174 = Panel(allsect_10.Contents)
panel_175 = Panel(allicon_10.AllIcondata)
panel_176 = Panel(allicon_10.Contents)
panel_177 = Panel(allelem_10.AllElemdata)
multiplication_13 = Multiplication(B=Slider(100000, range=0..100000))
panel_178 = Panel(multiplication_13)
number_slider_38 = Slider(4, range=0..10)
panel_179 = Panel("""0
-980
0
0
0
0""")
vcon_14 = VconInfo(Points=item_39, Forces=panel_179)
merge_62 = Merge(Data1=vcon_14)
allvcon_10 = AllVconInfo(Vcondata=merge_62)  # -> AllVcondata, Contents
panel_180 = Panel(allvcon_10.Contents)
panel_181 = Panel(allvcon_10.AllVcondata)
merge_63 = Merge(
    Data1=allprop_10.AllPropdata,
    Data2=allsect_10.AllSectdata,
    Data3=allelem_10.AllElemdata,
    Data4=allicon_10.AllIcondata,
    Data5=allvcon_10.AllVcondata)
item_40 = ListItem(List=merge_63, Index=0, Wrap=True)  # -> Item, Item1, Item2, Item3, Item4
alldata_10 = CombineAlldata(
    AllPropdata=item_40.Item,
    AllSectdata=item_40.Item1,
    AllElemdata=item_40.Item2,
    AllIcondata=item_40.Item3,
    AllVcondata=item_40.Item4,
    体積力の加速度ベクトルの和="0,0,0")  # -> Alldata, Contents
ldisp_7 = LinearAnalysisDisp(Alldata=alldata_10.Alldata)  # -> Deformed, Colors
panel_182 = Panel(ldisp_7.Colors)
_10º_7 = PowerOf10(Value=Slider(0, range=-10..3))
alias = MyComponent()
checkuf_3 = CheckUf(Alldata=alldata_10.Alldata)
branch_10 = TreeBranch(Tree=alldata_10.Contents, Path=Slider(4, range=1..4), MaintainPaths=True)
checkpf_3 = CheckPf(Alldata=alldata_10.Alldata)
panel_183 = Panel(ldisp_7.Deformed)
checkke_3 = CheckElemK(Alldata=alldata_10.Alldata, Index=Slider(0, range=0..10))
checkkff_3 = CheckKff(Alldata=alldata_10.Alldata)
dprod_7 = DotProduct(Unitize=False)
lng_8 = ListLength(List=dprod_7)
series_7 = Series(Start=0, Step=1, Count=lng_8)
panel_185 = Panel(checkke_3)
sort_7 = SortList(Keys=dprod_7, ValuesA=series_7)  # -> Keys, ValuesA
sqrt_7 = SquareRoot(Value=sort_7.Keys)
item_41 = ListItem(List=sqrt_7, Index=0, Wrap=True)  # -> Item1, Item
panel_186 = Panel(checkkff_3)
item_42 = ListItem(List=branch_10, Index=0, Wrap=True)
panel_187 = Panel(checkpf_3)
panel_188 = Panel(branch_10)

# ----
# PROP
# UNIT:[tf],[m]
panel_190 = Panel("2.3e7")
panel_191 = Panel("22.4")

division = Division(A="7.8", B="10000")
division_2 = Division(A=panel_190, B="10000")

prop_17 = PROP(
    NPROP="101",
    PNAME="SN490B(1/10000)",
    HIJU=division,
    E=division_2,
    POI="0.33333",
    PCOLOR=ColourSwatch(SwatchColor=RGB(64, 0, 255)))

# ----
# original
# sorted node in X axis
# sorted node in Y axis
# sorted node in Z axis
# (sorted node arbitrary)
assemble = ASSEMBLEOPT(
    OPTS=opts,
    VIEW=view,
    ELEM=flatten(relay_2),
    PROP=flatten(prop_17),
    SECT=flatten(relay_3),
    ICON=flatten(relay),
    Sort_Mode=Slider(0, range=-1..4))  # -> INP, Bandwidth, BandwidthList; disabled
# ASSEMBLE
assemble_2 = ASSEMBLE(
    OPTS=opts,
    VIEW=view,
    ELEM=flatten(relay_2),
    PROP=flatten(prop_17),
    SECT=flatten(relay_3),
    ICON=flatten(relay),
    VCON=flatten(vcon_5))
extractarclm = ExtractArclm(INP=assemble_2, DIGIT=False)  # -> ArclmFrameZ, ArclmFrameX, ArclmFrameY
optimized_bandwidth = Panel(assemble.Bandwidth)
list_of_bandwidths = Panel(assemble.BandwidthList)
# LinearAnalysis
arclm001 = ARCLM001(ARCLMFRAME=extractarclm.ArclmFrameZ, DFACT=1)  # -> OTL, GlobalMatrix, GlobalVector, ErrorMessage, Lines, ARCLMFRAME
panel_192 = Panel(arclm001.OTL)
saveasarclm = SaveAsArclm(ARCLMFRAME=extractarclm.ArclmFrameZ, BUTTON=button, PATH=filepath_3, TITLE=filename_2)  # disabled
bclng001 = BCLNG001(ARCLMFRAME=arclm001.ARCLMFRAME, NEIGEN=1, DFACT=1, EPS=1e-08)  # -> OTP, ElasticMatrix, GeometricMatrix, Lines, ARCLMFRAME; disabled
panel_193 = Panel(bclng001.OTP)
generate = GENERATE(INP=assemble_2, BUTTON=save_inp_2, PATH=file_path_2, TITLE=file_title_2)  # disabled
drawdisplacement = DrawDisplacement(ARCLMFRAME=bclng001.ARCLMFRAME, DFACT=panel_74)  # -> InitialLines, DeformedLines; disabled
custom_preview = CustomPreview(Geometry=drawdisplacement.InitialLines, Material=colour_swatch_2)  # disabled
custom_preview_2 = CustomPreview(Geometry=drawdisplacement.DeformedLines, Material=colour_swatch)  # disabled
