# Grasshopper definition ジョーロ.gh (Grasshopper 1.0.8)
# plug-ins: Hagoromo

mesh = Mesh(<mesh referenced from the Rhino model>)
mbridgecm = MbridgeCM(TriangulatedMeshOrCutMesh=mesh)
sortcutmesh = SortCutMesh(TriangulatedMeshOrCutMesh=mbridgecm)
number_slider = Slider(8, range=0..10)
develop = DevelopMesh(TriangulatedMesh=mesh, Count=Slider(105, range=0..10000))  # -> ModifiedMesh, A
mesh_2 = Mesh(develop.ModifiedMesh)
series = Series(Start=Slider(124, range=0..1000), Step="0", Count=number_slider)
cutchoice1 = CutChoice1(
    TriangulatedCutMesh=sortcutmesh,
    MaxLength=series,
    SeedCount=number_slider,
    Distance=Slider(30, range=0..1000),
    Branch=Toggle(True))  # -> TriangulatedCutMesh, CutChoices
crv = Curve(cutchoice1.CutChoices)
