# Grasshopper definition メッシュ分割.gh (Grasshopper 1.0.8)
# plug-ins: Flexibility

mesh = Mesh(<mesh referenced from the Rhino model>)
bbox = BoundingBox(Content=mesh, Plane=PlaneXY(0, 0, 0))  # -> Box, Box_2
debrep = DeconstructBrep(Brep=bbox.Box)  # -> Faces, Edges, Vertices
item = ListItem(List=debrep.Edges, Index=Slider(4, range=0..10), Wrap=True)
item_2 = ListItem(List=debrep.Edges, Index=Slider(7, range=0..10), Wrap=True)
item_3 = ListItem(List=debrep.Edges, Index=Slider(8, range=0..10), Wrap=True)
item_4 = ListItem(List=debrep.Faces, Index=Slider(7, range=0..10), Wrap=True)
item_5 = ListItem(List=debrep.Faces, Index=0, Wrap=True)
item_6 = ListItem(List=debrep.Faces, Index=Slider(5, range=0..10), Wrap=True)

# ---- group: x+1
number_slider = Slider(3, range=0..100)

# ---- group: y+1
number_slider_2 = Slider(4, range=0..100)

# ---- group: z+1
number_slider_3 = Slider(3, range=0..100)

# ---- group: x等分
arrcurve = CurveArray(Geometry=item_4, Curve=item, Count=number_slider)  # -> Geometry, Transform

# ---- group: y等分
arrcurve_2 = CurveArray(Geometry=item_5, Curve=item_2, Count=number_slider_2)  # -> Geometry, Transform

# ---- group: z等分
arrcurve_3 = CurveArray(Geometry=item_6, Curve=item_3, Count=number_slider_3)  # -> Geometry, Transform

# ---- group: cutへ
merge = Merge(Data1=arrcurve.Geometry, Data2=arrcurve_2.Geometry, Data3=arrcurve_3.Geometry)

# ----
meshsplit = MeshSplit(Mesh=mesh, T=simplify(flatten(0.001)))  # -> Mesh, ProjectCurve

# ---- group: 分割後メッシュ
mesh_2 = Mesh(meshsplit.Mesh)

# ----
mesh_3 = Mesh([<mesh referenced from the Rhino model> x239])
triremesh = TriRemesh(Geometry=mesh_3, Iterations=25)  # -> Triangulation, Dual, Creases

# ---- group: 三角形メッシュ
mesh_4 = Mesh(triremesh.Triangulation)
