# Grasshopper definition 内部切込み_01.gh (Grasshopper 1.0.8)
# plug-ins: Heteroptera, MeshEdit Components, Pufferfish, Human, Hagoromo, Weaverbird, NGon_RH8, Flexibility

number_slider = Slider(2, range=0..10)
number_slider_2 = Slider(10, range=0..10)
number_slider_3 = Slider(100, range=0..100)
x_plus_one = XPlusOne(NumberX=number_slider)
number_slider_4 = Slider(10, range=0..10)
crv = Curve(<curve referenced from the Rhino model>)
number_slider_5 = Slider(1, range=0..10)
mesh = Mesh(<mesh referenced from the Rhino model>)
_10º = PowerOf10(Value=number_slider)
_10º_2 = PowerOf10(Value=Slider(3, range=-10..10))
_10º_3 = PowerOf10(Value=Slider(3, range=0..10))
_10º_4 = PowerOf10(Value=Slider(7, range=-10..10))
_10º_5 = PowerOf10(Value=Slider(1, range=-10..10))
swatch = ColourSwatch(SwatchColor=RGB(0, 42, 255))
crv_2 = Curve(<curve referenced from the Rhino model>)
mesh_2 = Mesh(<mesh referenced from the Rhino model>)
_10º_6 = PowerOf10(Value=Slider(3, range=0..10))
number_slider_6 = Slider(8, range=0..10)
crv_3 = Curve([<curve referenced from the Rhino model> x1248])
mesh_3 = Mesh(<mesh referenced from the Rhino model>)
previewlw = CustomPreviewLineweights(Geometry=crv_2, Shader=swatch, Thickness=Slider(0.5, range=0..1), Absolute=swatch)
meshedges = MeshEdges(Mesh=mesh_3)  # -> AllE, NakedE
preview = CustomPreview(
    Geometry=mesh_2,
    Material={diffuse=RGB(221, 160, 221), emission=RGB(66, 48, 66), shine=0.5, specular=RGB(255, 255, 255), transparency=0})
wbweave = WeaverbirdsMeshFromLinesWeaveBack(Lines=crv_3, MaximumValence=4)
mesh_4 = Mesh(<mesh referenced from the Rhino model>)
mbridgecm = MbridgeCM(TriangulatedMeshOrCutMesh=mesh)
sortcutmesh = SortCutMesh(TriangulatedMeshOrCutMesh=mbridgecm)
meshedges_2 = MeshEdges(Mesh=wbweave)  # -> AllE, NakedE
形状調整切込み = Curve([<curve referenced from the Rhino model> x5])
len = Length(Curve=形状調整切込み)
curvaturegroup = CurvatureGroup(TriangulatedMeshOrCutMesh=mesh, I=Slider(1, range=0..10))  # -> Points, TriangulatedCutMesh, Count
meshedges_3 = MeshEdges(Mesh=mesh_4)  # -> AllE, NakedE
meshedges_4 = MeshEdges(Mesh=mesh)  # -> AllE, NakedE
crv_4 = Curve(meshedges.AllE)
lng = ListLength(List=len)
mesh_5 = Mesh(<mesh referenced from the Rhino model>)
avr = Average(Input=len)
number_slider_7 = Slider(8, range=0..10)
meshedges_5 = MeshEdges(Mesh=mesh_5)  # -> AllE, NakedE
cutmeshgcurvature = CutMeshGCurvature(TriangulatedMeshOrCutMesh=mesh_5)  # -> GC, GCMap
multiplication = Multiplication(A=lng, B=avr)
crv_5 = Curve(meshedges_2.NakedE)
cutopt = ClusterCutNSGAII(TriangulatedMeshOrCutMesh=sortcutmesh, PopSize=Slider(30, range=0..100), Generations=Slider(1, range=0..10))  # -> CutMeshes, TotalLength, DevObj, Seams
pt = Point([Point(-8.457410962, -7.118696298, -6.2041049), Point(-8.287973817, -6.170987288, -4.559029102), Point(-9.044202954, -5.28890809, -5.733854294), Point(-8.909864575, -6.243692483, -7.70445013), Point(-7.089857251, -7.989626016, -5.814617634), Point(-7.659650952, -7.760591592, -7.654247761), Point(-8.838041455, -4.418111886, -7.62543869), Point(-8.181425244, -3.647451486, -6.226211548), Point(-9.110471875, -5.243482675, -9.330919266), Point(-8.54853645, -7.167451944, -9.309287071), Point(-8.324674756, -3.80214509, -9.099074364), Point(-6.703637983, -5.757847083, -4.154056549), Point(-6.769865186, -8.144655313, -9.200679779), Point(-5.777937085, -8.180280771, -7.335777283)])
pt_2 = Point([Point(-8.888899765, -6.327688074, 4.556653976), Point(-8.994779737, -5.595468606, 5.834084988), Point(-8.524107129, -7.154859628, 6.887122631), Point(-8.189344556, -3.688440408, 6.105777264), Point(-7.32525459, -7.845205392, 5.585268974), Point(-8.999265821, -4.938173379, 7.529882908)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])
area = Area(Geometry=mesh_5)  # -> Area, Centroid
pt_3 = Point([Point(-4.466691541, -5.174528513, 1.57534492), Point(-4.781470807, -5.256612101, -0.7009733915), Point(-2.935362012, -8.127893533, 1.29205513), Point(-2.976347119, -8.136983957, -2.430050611), Point(-3.850477368, -8.16315278, 3.314163923), Point(-5.019896257, -5.318785245, -2.875643492)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])
panel = Panel(multiplication)
previewlw_2 = CustomPreviewLineweights(
    Geometry=形状調整切込み,
    Shader={diffuse=RGB(255, 105, 180), emission=RGB(76, 32, 54), shine=0.5, specular=RGB(255, 255, 255), transparency=0},
    Thickness=Slider(8, range=0..10),
    Absolute=False)
dupln = RemoveDuplicateLines(Lines=meshedges_2.AllE, Tolerance=0.01)
center = Center(Geometry=crv_5)  # -> Center, Dimension
demesh = DeconstructMesh(Mesh=wbweave)  # -> Vertices, Faces, Colours, Normals
join = JoinCurves(Curves=crv_5, Preserve=False)
curvaturegroup_2 = CurvatureGroup(TriangulatedMeshOrCutMesh=mesh_5, I=Slider(2, range=0..10))  # -> Points, TriangulatedCutMesh, Count
sort = SortList(Keys=cutmeshgcurvature.GCMap)  # -> Keys, ValuesA
preview_2 = CustomPreview(Geometry=mesh, Material=ColourSwatch(SwatchColor=RGBA(0, 0, 0, 123)))
preview_3 = CustomPreview(Geometry=mesh_4, Material=ColourSwatch(SwatchColor=RGBA(0, 0, 0, 123)))
explode = Explode(Curve=join, Recursive=True)  # -> Segments, flatten(Vertices)
previewlw_3 = CustomPreviewLineweights(
    Geometry=meshedges_3.AllE,
    Shader=ColourSwatch(SwatchColor=RGB(0, 0, 0)),
    Thickness=Slider(1, range=0..10),
    Absolute=False)
previewlw_4 = CustomPreviewLineweights(
    Geometry=meshedges_4.AllE,
    Shader=ColourSwatch(SwatchColor=RGB(0, 0, 255)),
    Thickness=Slider(4, range=0..10),
    Absolute=False)
previewlw_5 = CustomPreviewLineweights(
    Geometry=meshedges_4.AllE,
    Shader=ColourSwatch(SwatchColor=RGB(0, 0, 0)),
    Thickness=Slider(1, range=0..10),
    Absolute=False)
item = ListItem(List=sort.Keys, Index=0, Wrap=True)  # -> Item1, Item
number_slider_8 = Slider(4, range=0..10)
meshedges_6 = MeshEdges(Mesh=mesh_5)  # -> AllE, NakedE
cullpt = CullDuplicates(Points=demesh.Vertices, Tolerance=0.1, CullMode=3)  # -> Points, Indices, Valence
center_2 = Center(Geometry=dupln)  # -> Center, Dimension
previewlw_6 = CustomPreviewLineweights(
    Geometry=meshedges_5.AllE,
    Shader={diffuse=RGB(255, 105, 180), emission=RGB(76, 32, 54), shine=0.5, specular=RGB(255, 255, 255), transparency=0},
    Thickness=Slider(1, range=0..10),
    Absolute=False)
cullpt_2 = CullDuplicates(Points=explode.Vertices, Tolerance=0.1, CullMode=3)  # -> Points, Indices, Valence
merge = Merge(Data1=flatten(center_2.Center), Data2=flatten(center.Center))  # -> flatten(Result)
gradient = Gradient(
    LowerLimit="-0.14",
    UpperLimit=Slider(0.17, range=0..1),
    Parameter=cutmeshgcurvature.GCMap,
    stops=[0: RGB(234, 38, 0), 0.25: RGB(234, 126, 0), 0.5: RGB(254, 244, 84), 0.75: RGB(173, 203, 249), 1: RGB(75, 107, 169)])
pts_prv = PointPreview(
    TargetPoint=pt_2,
    DisplayColour=ColourSwatch(SwatchColor=RGB(0, 255, 255)),
    MarkerSize=number_slider_7,
    MarkerStyle=4,
    DrawPriority="true")
pts_prv_2 = PointPreview(
    TargetPoint=pt_3,
    DisplayColour=ColourSwatch(SwatchColor=RGB(0, 0, 255)),
    MarkerSize=number_slider_7,
    MarkerStyle=4,
    DrawPriority="true")
pts_prv_3 = PointPreview(
    TargetPoint=pt,
    DisplayColour=ColourSwatch(SwatchColor=RGB(0, 188, 0)),
    MarkerSize=number_slider_7,
    MarkerStyle=4,
    DrawPriority="true")
swatch_2 = ColourSwatch(SwatchColor=RGB(0, 0, 0))
number_slider_9 = Slider(100, range=0..100)
cutmeshedges = CutMeshEdges(TriangulatedMeshOrCutMesh=curvaturegroup_2.TriangulatedCutMesh)  # -> MeshAllEdges, MeshNakedEdges
mesh_6 = Mesh(<mesh referenced from the Rhino model>)
mesh_7 = Mesh(<mesh referenced from the Rhino model>)
mesh_8 = Mesh(<mesh referenced from the Rhino model>)
mesh_9 = Mesh(<mesh referenced from the Rhino model>)
mesh_10 = Mesh(<mesh referenced from the Rhino model>)
mesh_11 = Mesh(<mesh referenced from the Rhino model>)
mesh_12 = Mesh(<mesh referenced from the Rhino model>)
mesh_13 = Mesh(<mesh referenced from the Rhino model>)
number_slider_10 = Slider(2, range=0..10)
mesh_14 = Mesh(<mesh referenced from the Rhino model>)
mesh_15 = Mesh(<mesh referenced from the Rhino model>)
mesh_16 = Mesh(<mesh referenced from the Rhino model>)
mesh_17 = Mesh(<mesh referenced from the Rhino model>)
mesh_18 = Mesh(<mesh referenced from the Rhino model>)
mesh_19 = Mesh(<mesh referenced from the Rhino model>)
mesh_20 = Mesh(<mesh referenced from the Rhino model>)
mesh_21 = Mesh(<mesh referenced from the Rhino model>)
mesh_22 = Mesh(<mesh referenced from the Rhino model>)
mesh_23 = Mesh(<mesh referenced from the Rhino model>)
cullpt_3 = CullDuplicates(Points=merge, Tolerance=0.1, CullMode=1)  # -> Points, Indices, Valence
cullpt_4 = CullDuplicates(Points=flatten([cullpt_2.Points, cullpt.Points]), Tolerance=0.1, CullMode=2)  # -> Points, Indices, Valence
meshedges_7 = MeshEdges(Mesh=mesh_5)  # -> AllE, NakedE
preview_4 = CustomPreview(Geometry=mesh_5, Material=ColourSwatch(SwatchColor=RGBA(0, 0, 0, 123)))
dupln_2 = RemoveDuplicateLines(Lines=cutmeshedges.MeshNakedEdges, Tolerance=0.01)
cir = Circle(Plane=cullpt_2.Points, Radius=Slider(0.3, range=0..1))
previewlw_7 = CustomPreviewLineweights(
    Geometry=meshedges_6.AllE,
    Shader={diffuse=RGB(255, 105, 180), emission=RGB(76, 32, 54), shine=0.5, specular=RGB(255, 255, 255), transparency=0},
    Thickness=Slider(3, range=0..10),
    Absolute=False)
center_3 = Center(Geometry=dupln_2)  # -> Center, Dimension
x_minus_one = XMinusOne(NumberX=cullpt_3.Valence)
mcol = MeshColours(Mesh=mesh_5, Colours=gradient)
crv_6 = Curve(meshedges_7.NakedE)
center_4 = Center(Geometry=meshedges_7.NakedE)  # -> Center, Dimension
merge_2 = Merge(Data1=flatten(center_3.Center), Data2=flatten(center_4.Center))  # -> flatten(Result)
cir_2 = Circle(Plane=cullpt_4.Points, Radius=Slider(0.3, range=0..1))
merge_3 = Merge(
    Data1=mesh_6,
    Data2=mesh_8,
    Data3=mesh_7,
    Data4=mesh_9,
    Data5=mesh_10,
    Data6=mesh_12,
    Data7=mesh_11,
    Data8=mesh_13,
    Data9=mesh_14,
    Data10=mesh_16,
    Data11=mesh_15,
    Data12=mesh_17,
    Data13=mesh_19,
    Data14=mesh_20,
    Data15=mesh_18,
    Data16=mesh_21,
    Data17=mesh_22,
    Data18=mesh_23)
crv_7 = Curve(<curve referenced from the Rhino model>)
x_minus_one_2 = XMinusOne(NumberX=x_minus_one)
_10º_7 = PowerOf10(Value=Slider(3, range=-5..5))
cullpt_5 = CullDuplicates(Points=merge_2, Tolerance=0.1, CullMode=1)  # -> Points, Indices, Valence
_10º_8 = PowerOf10(Value=Slider(0, range=-5..5))
abs = Absolute(Value=x_minus_one_2)
cull = CullPattern(List=dupln, CullPattern=abs)
crv_8 = Curve(cull)
x_minus_one_3 = XMinusOne(NumberX=cullpt_5.Valence)
mbridgecm_2 = MbridgeCM(TriangulatedMeshOrCutMesh=mesh_5)
mesh_24 = Mesh(merge_3)
x_minus_one_4 = XMinusOne(NumberX=x_minus_one_3)
mesh_25 = Mesh(<mesh referenced from the Rhino model>)
abs_2 = Absolute(Value=x_minus_one_4)
cull_2 = CullPattern(List=dupln_2, CullPattern=abs_2)
previewlw_8 = CustomPreviewLineweights(Geometry=cull_2, Shader=ColourSwatch(SwatchColor=RGB(255, 0, 0)), Thickness=Slider(7, range=0..10), Absolute=False)
item_2 = ListItem(List=mesh_24, Index=Slider(17, range=0..17), Wrap=True)
_10º_9 = PowerOf10(Value=Slider(4, range=-10..10))
_10º_10 = PowerOf10(Value=Slider(3, range=-10..10))
crv_9 = Curve(<curve referenced from the Rhino model>)
_10º_11 = PowerOf10(Value=Slider(-1, range=-10..10))
mbridgecm_3 = MbridgeCM(TriangulatedMeshOrCutMesh=mesh_25)
meshcutbylines = MeshCutWithCutLines(TriangulatedMeshOrCutMesh=mbridgecm_3, OpenCutLinesPolylines=crv_7)
number_slider_11 = Slider(30, range=0..100)
center_5 = Center(Geometry=item_2)  # -> Center, Dimension
_10º_12 = PowerOf10(Value=Slider(3, range=-5..5))
pt_4 = Point(Point(389.1974851, 129.8338337, 0))
move2pt = MoveToPoint(Geometry=item_2, PointA=center_5.Center, PointB=pt_4)  # -> Moved, Vector, Transform
number_slider_12 = Slider(10, range=0..10)
_10º_13 = PowerOf10(Value=Slider(0, range=-5..5))
number_slider_13 = Slider(1, range=0..1)
number_slider_14 = Slider(10, range=0..10)
panel_2 = Panel("""855
845
283
2055
1928
2506""")
meshedges_8 = MeshEdges(Mesh=move2pt.Moved)  # -> AllE, NakedE
preview_5 = CustomPreview(Geometry=move2pt.Moved, Material=ColourSwatch(SwatchColor=RGBA(0, 0, 0, 119)))
meshedges_9 = MeshEdges(Mesh=mesh_5)  # -> AllE, NakedE
len_2 = Length(Curve=meshedges_9.AllE)
number_slider_15 = Slider(3, range=0..10)
sortcutmesh_2 = SortCutMesh(TriangulatedMeshOrCutMesh=mbridgecm_2)
item_3 = ListItem(List=mbridgecm_2, Index=0, Wrap=True)
number_slider_16 = Slider(2, range=0..10)
panel_3 = Panel("true")
number_slider_17 = Slider(10, range=0..10)
panel_4 = Panel(len_2)
toggle = BooleanToggle(True)
previewlw_9 = CustomPreviewLineweights(
    Geometry=meshedges_8.NakedE,
    Shader=ColourSwatch(SwatchColor=RGB(0, 0, 0)),
    Thickness=Slider(0.5, range=0..1),
    Absolute=False)
_10º_14 = PowerOf10(Value=Slider(3, range=0..10))
_10º_15 = PowerOf10(Value=Slider(0, range=0..10))
previewlw_10 = CustomPreviewLineweights(
    Geometry=meshedges_8.AllE,
    Shader=ColourSwatch(SwatchColor=RGBA(125, 129, 128, 119)),
    Thickness=Slider(0.5, range=0..1),
    Absolute=False)
number_slider_18 = Slider(17, range=0..20)
pcnoloop = CutChoicePrincipleNoLoop(
    TriangulatedCutMesh=mbridgecm_2,
    MaxLength=Slider(69, range=0..100),
    SeedCount=Slider(1, range=0..100),
    Distance=Slider(10, range=0..100),
    Branch=False)  # -> TriangulatedCutMesh, CutChoices; disabled
mbridgecm_4 = MbridgeCM(TriangulatedMeshOrCutMesh=pcnoloop.TriangulatedCutMesh)
_10º_16 = PowerOf10(Value=Slider(3, range=-5..5))
number_slider_19 = Slider(14, range=0..100)
_10º_17 = PowerOf10(Value=Slider(0, range=-5..5))
number_slider_20 = Slider(118, range=100..200)
crv_10 = Curve(<curve referenced from the Rhino model>)
meshcutbylines_2 = MeshCutWithCutLines(TriangulatedMeshOrCutMesh=mbridgecm_2, OpenCutLinesPolylines=crv_10)
sortcutmesh_3 = SortCutMesh(TriangulatedMeshOrCutMesh=meshcutbylines_2)
netlbfgs = NetLBFGS(TriangulatedMeshOrCutMesh=meshcutbylines_2, HasHole="true", W0=_10º_12, W1=_10º_13, Switch="true")  # -> CutMesh, FeatureLinesPolylines
cutmeshedges_2 = CutMeshEdges(TriangulatedMeshOrCutMesh=netlbfgs.CutMesh)  # -> MeshAllEdges, MeshNakedEdges
cutmeshedges_3 = CutMeshEdges(TriangulatedMeshOrCutMesh=sortcutmesh_3)  # -> MeshAllEdges, MeshNakedEdges
number_slider_21 = Slider(10, range=0..10)
_10º_18 = PowerOf10(Value=Slider(2, range=-5..5))
_10º_19 = PowerOf10(Value=Slider(3, range=-5..5))
sortcutmesh_4 = SortCutMesh(TriangulatedMeshOrCutMesh=meshcutbylines_2)
cutmeshedges_4 = CutMeshEdges(TriangulatedMeshOrCutMesh=sortcutmesh_4)  # -> MeshAllEdges, MeshNakedEdges
item_4 = ListItem(List=cutmeshedges_4.MeshAllEdges, Index=panel_2, Wrap=True)
meshedges_10 = MeshEdges(Mesh=mbridgecm_4)  # -> AllE, NakedE
number_slider_22 = Slider(2, range=0..10)
number_slider_23 = Slider(10, range=0..10)
number_slider_24 = Slider(5, range=-10..10)
len_3 = Length(Curve=cutmeshedges_2.MeshAllEdges)
len_4 = Length(Curve=cutmeshedges_3.MeshAllEdges)
number_slider_25 = Slider(10, range=0..10)
mbridgecm_5 = MbridgeCM(TriangulatedMeshOrCutMesh=sortcutmesh_2)
crv_11 = Curve(pcnoloop.CutChoices)
_10º_20 = PowerOf10(Value=Slider(0, range=-5..5))
swatch_3 = ColourSwatch(SwatchColor=RGB(255, 0, 0))
_10º_21 = PowerOf10(Value=Slider(0, range=-5..5))
_10º_22 = PowerOf10(Value=Slider(7, range=-10..10))
_10º_23 = PowerOf10(Value=Slider(-1, range=-10..10))
_10º_24 = PowerOf10(Value=Slider(3, range=-10..10))
number_slider_26 = Slider(10, range=0..10)
crv_12 = Curve([<curve referenced from the Rhino model> x6])
merge_4 = Merge(Data1=_10º_19, Data2=_10º_18)
meshcutbylines_3 = MeshCutWithCutLines(TriangulatedMeshOrCutMesh=sortcutmesh_4, OpenCutLinesPolylines=item_4)
meshedges_11 = MeshEdges(Mesh=mesh_5)  # -> AllE, NakedE
number_slider_27 = Slider(100, range=0..100)
cutmeshedges_5 = CutMeshEdges(TriangulatedMeshOrCutMesh=meshcutbylines_2)  # -> MeshAllEdges, MeshNakedEdges
crv_13 = Curve(meshedges_10.AllE)
mbridgecm_6 = MbridgeCM(TriangulatedMeshOrCutMesh=meshcutbylines_2)
number_slider_28 = Slider(3, range=-10..10)  # disabled
subtraction = Subtraction(A=len_3, B=len_4)
mesh_26 = Mesh(mbridgecm_6)
meshedges_12 = MeshEdges(Mesh=mesh_26)  # -> AllE, NakedE
number_slider_29 = Slider(1000, range=0..1000)
sqr = Square(Value=subtraction)
merge_5 = Merge(Data1=_10º_20, Data2=_10º_21)
x_plus_one_2 = XPlusOne(NumberX=number_slider_22)
crv_14 = Curve(crv_10)
cutbytear = CutByTear(Triangulated3dCutMesh=sortcutmesh_2, Iterations=Slider(18, range=0..100), W0=_10º_16, W1=_10º_17)  # -> Triangulated3dCutMesh, Triangulated2dCutMesh; disabled
_10º_25 = PowerOf10(Value=Slider(3, range=-3..10))
weldvertices = MeshWeldVertices(Mesh=mesh_26, Tolerance=0.01)  # -> RuntimeMessage, Mesh
crv_15 = Curve(crv_10)
_10º_26 = PowerOf10(Value=Slider(-3, range=-3..10))
crv_16 = Curve(meshedges_12.NakedE)
avr_2 = Average(Input=sqr)
panel_5 = Panel(avr_2)
cutmeshedges_6 = CutMeshEdges(TriangulatedMeshOrCutMesh=meshcutbylines_3)  # -> MeshAllEdges, MeshNakedEdges
number_slider_30 = Slider(0, range=0..100)
number_slider_31 = Slider(10, range=0..10)
number_slider_32 = Slider(17, range=0..100)
crv_17 = Curve(meshedges_11.NakedE)
crv_18 = Curve(<curve referenced from the Rhino model>)
_10º_27 = PowerOf10(Value=Slider(4, range=-10..10))
_10º_28 = PowerOf10(Value=Slider(-2, range=-10..10))
x_plus_one_3 = XPlusOne(NumberX=number_slider_24)
_10º_29 = PowerOf10(Value=Slider(-6, range=-10..10))
preview_6 = CustomPreview(Geometry=mbridgecm_4, Material=ColourSwatch(SwatchColor=RGBA(0, 0, 0, 119)))
_10º_30 = PowerOf10(Value=Slider(2, range=-10..10))
_10º_31 = PowerOf10(Value=Slider(1, range=-10..10))
mbridgecm_7 = MbridgeCM(TriangulatedMeshOrCutMesh=weldvertices.Mesh)
_10º_32 = PowerOf10(Value=Slider(3, range=-10..10))
crv_19 = Curve(cutmeshedges_5.MeshNakedEdges)
crv_20 = Curve(crv_19)
_10º_33 = PowerOf10(Value=Slider(-1, range=-10..10))
_10º_34 = PowerOf10(Value=Slider(3, range=-10..10))
weld = WeldMesh(Angle=3.141592654)
_10º_35 = PowerOf10(Value=number_slider_22)
_10º_36 = PowerOf10(Value=Slider(3, range=-10..10))
cutmeshedges_7 = CutMeshEdges(TriangulatedMeshOrCutMesh=mbridgecm_7)  # -> MeshAllEdges, MeshNakedEdges
unsmooth = Curve([<curve referenced from the Rhino model> x41])
_10º_37 = PowerOf10(Value=Slider(3, range=0..10))
previewlw_11 = CustomPreviewLineweights(
    Geometry=meshedges_10.AllE,
    Shader=ColourSwatch(SwatchColor=RGBA(94, 94, 94, 119)),
    Thickness=Slider(0, range=0..10),
    Absolute=False)
_10º_38 = PowerOf10(Value=Slider(7, range=-10..10))
_10º_39 = PowerOf10(Value=Slider(1, range=-10..10))
number_slider_33 = Slider(0, range=0..100)
number_slider_34 = Slider(300, range=0..1000)
series = Series(Start=_10º_25, Step="0", Count="6")
merge_6 = Merge(Data1=_10º_26, Data2=series)  # -> flatten(Result)
_10º_40 = PowerOf10(Value=Slider(4, range=-10..10))
_10º_41 = PowerOf10(Value=Slider(-1, range=-10..10))
_10º_42 = PowerOf10(Value=number_slider_28)  # disabled
number_slider_35 = Slider(10, range=0..10)
crv_21 = Curve(<curve referenced from the Rhino model>)
unsmooth_2 = Curve([<curve referenced from the Rhino model> x41])
developcm5 = DevelopCutMesh5(
    TriangulatedCutMesh=meshcutbylines_2,
    Iterations=Slider(1000, range=0..1000),
    XyMirror=False,
    YzMirror=False,
    ZxMirror=False,
    OuterBoundaryCurves=crv_17,
    FixPointsCrv=crv_10,
    Weight=merge_6)  # disabled
item_5 = ListItem(List=curvaturegroup.TriangulatedCutMesh, Index=number_slider_33, Wrap=True)
fixcrv = Curve(crv_10)
_10º_43 = PowerOf10(Value=x_plus_one_3)
_10º_44 = PowerOf10(Value=number_slider_24)
_10º_45 = PowerOf10(Value=Slider(2, range=-10..10))
_10º_46 = PowerOf10(Value=Slider(1, range=-10..10))
_10º_47 = PowerOf10(Value=Slider(1, range=-10..10))
mbridgecm_8 = MbridgeCM(TriangulatedMeshOrCutMesh=developcm5)
number_slider_36 = Slider(7, range=0..7)
panel_6 = Panel(merge_6)
developcgnr = DevelopCGNR(
    TriangulatedCutMesh=meshcutbylines_2,
    Iterations=Slider(0, range=0..100),
    XyMirror=False,
    YzMirror=False,
    ZxMirror=False,
    OuterBoundaryCurves=crv_17,
    FixPointsCrv=crv_10,
    EdgeW=_10º_29,
    SmoothW=1,
    DevW=_10º_31)  # -> ModifiedCutMesh, DevEnergy
number_slider_37 = Slider(200, range=0..1000)
meshedges_13 = MeshEdges(Mesh=mbridgecm_5)  # -> AllE, NakedE
checkobjective = CheckObjective(TriangulatedCutMesh=meshcutbylines_2, XyMirror=False, YzMirror=False, ZxMirror=False, OuterBoundaryCurves=crv_17)
_10º_48 = PowerOf10(Value=Slider(3, range=-10..10))
sortcutmesh_5 = SortCutMesh(TriangulatedMeshOrCutMesh=mbridgecm_7)
pcnoloop_2 = CutChoicePrincipleNoLoop(
    TriangulatedCutMesh=sortcutmesh_5,
    MaxLength=Slider(49, range=0..100),
    SeedCount=Slider(1, range=0..10),
    Distance=Slider(100, range=0..100),
    Branch="true")  # -> TriangulatedCutMesh, CutChoices; disabled
mbridgecm_9 = MbridgeCM(TriangulatedMeshOrCutMesh=sortcutmesh_5)
mesh_27 = Mesh(mbridgecm_9)
crv_22 = Curve(pcnoloop_2.CutChoices)
cutbytear_2 = CutByTear(Triangulated3dCutMesh=sortcutmesh_5, Iterations=Slider(4, range=0..10), W0=_10º_7, W1=_10º_8)  # -> Triangulated3dCutMesh, Triangulated2dCutMesh; disabled
item_6 = ListItem(List=cutbytear_2.Triangulated3dCutMesh, Index=Slider(3, range=0..10), Wrap=True)
mbridgecm_10 = MbridgeCM(TriangulatedMeshOrCutMesh=item_6)
meshedges_14 = MeshEdges(Mesh=mbridgecm_10)  # -> AllE, NakedE
developcgls = DevelopCGLS(
    TriangulatedCutMesh=item_6,
    InnerIter=Slider(100, range=0..100),
    OuterIter=Slider(1000, range=0..1000),
    XyMirror=False,
    YzMirror=False,
    ZxMirror=False,
    OuterBoundaryCurves=meshedges_14.NakedE,
    EdgeW=_10º_11,
    SmoothW=_10º_9,
    DevW=_10º_10,
    PositionW="0",
    LenRangeW=1)  # disabled
mbridgecm_11 = MbridgeCM(TriangulatedMeshOrCutMesh=developcgls)
meshedges_15 = MeshEdges(Mesh=mbridgecm_11)  # -> AllE, NakedE
checkobjective_2 = CheckObjective(TriangulatedCutMesh=developcgls, XyMirror=False, YzMirror=False, ZxMirror=False, OuterBoundaryCurves=meshedges_15.NakedE)
cutbytear_3 = CutByTear(Triangulated3dCutMesh=sortcutmesh_5, Iterations=Slider(19, range=0..100), W0=_10º_14, W1=_10º_15)  # -> Triangulated3dCutMesh, Triangulated2dCutMesh
item_7 = ListItem(List=cutbytear_3.Triangulated2dCutMesh, Index=number_slider_19, Wrap=True)
item_8 = ListItem(List=cutbytear_3.Triangulated2dCutMesh, Index=number_slider_19, Wrap=True)
item_9 = ListItem(List=cutbytear_3.Triangulated3dCutMesh, Index=number_slider_19, Wrap=True)
deccutmesh = DeconstructCutMesh(TriangulatedMeshOrCutMesh=item_9)  # -> Vertices, Faces, Edges, Dups
item_10 = ListItem(List=deccutmesh.Vertices, Index=Slider(122, range=117..125), Wrap=True)
mbridgecm_12 = MbridgeCM(TriangulatedMeshOrCutMesh=item_9)
cutbytear_4 = CutByTear(Triangulated3dCutMesh=sortcutmesh_5, Iterations=Slider(20, range=0..100), W0=merge_4, W1=merge_5)  # -> Triangulated3dCutMesh, Triangulated2dCutMesh; disabled
mbridgecm_13 = MbridgeCM(TriangulatedMeshOrCutMesh=cutbytear_4.Triangulated2dCutMesh)
cutmeshedges_8 = CutMeshEdges(TriangulatedMeshOrCutMesh=item_9)  # -> MeshAllEdges, MeshNakedEdges
item_11 = ListItem(List=cutbytear_4.Triangulated3dCutMesh, Index=number_slider_32, Wrap=True)
mbridgecm_14 = MbridgeCM(TriangulatedMeshOrCutMesh=item_11)
cutmeshedges_9 = CutMeshEdges(TriangulatedMeshOrCutMesh=item_11)  # -> MeshAllEdges, MeshNakedEdges
crv_23 = Curve(cutmeshedges_9.MeshNakedEdges)
mbridgecm_15 = MbridgeCM(TriangulatedMeshOrCutMesh=item_11)
meshedges_16 = MeshEdges(Mesh=mbridgecm_15)  # -> AllE, NakedE
weld_2 = WeldMesh(Mesh=mbridgecm_15, Angle=3.141592654)
crv_24 = Curve(meshedges_16.NakedE)
item_12 = ListItem(List=cutbytear_3.Triangulated2dCutMesh, Index=number_slider_19, Wrap=True)
meshedges_17 = MeshEdges(Mesh=mbridgecm_12)  # -> AllE, NakedE
merge_7 = Merge(Data1=meshedges_17.NakedE)  # -> flatten(Result)
crv_25 = Curve(meshedges_17.NakedE)
developcgls_2 = DevelopCGLS(
    TriangulatedCutMesh=pcnoloop_2.TriangulatedCutMesh,
    InnerIter=Slider(100, range=0..100),
    OuterIter=Slider(500, range=0..1000),
    XyMirror=False,
    YzMirror=False,
    ZxMirror=False,
    OuterBoundaryCurves=meshedges_17.NakedE,
    EdgeW="0",
    SmoothW=_10º,
    DevW=_10º_3,
    PositionW=_10º_2,
    LenRangeW="0",
    SmoothingPolylines=meshedges_17.NakedE)  # disabled
sortcutmesh_6 = SortCutMesh(TriangulatedMeshOrCutMesh=developcgls_2)
netlbfgs2 = NetLBFGS2(TriangulatedMeshOrCutMesh=sortcutmesh_6, W0=_10º_6, W1=1)  # -> CutMesh, FeatureLinesPolylines
cutmeshedges_10 = CutMeshEdges(TriangulatedMeshOrCutMesh=netlbfgs2.CutMesh)  # -> MeshAllEdges, MeshNakedEdges
cutmeshedges_11 = CutMeshEdges(TriangulatedMeshOrCutMesh=sortcutmesh_6)  # -> MeshAllEdges, MeshNakedEdges
mbridgecm_16 = MbridgeCM(TriangulatedMeshOrCutMesh=developcgls_2)
len_5 = Length(Curve=cutmeshedges_10.MeshAllEdges)
len_6 = Length(Curve=cutmeshedges_11.MeshAllEdges)
subtraction_2 = Subtraction(A=len_5, B=len_6)
sqr_2 = Square(Value=subtraction_2)
avr_3 = Average(Input=sqr_2)
panel_7 = Panel(avr_3)
developcgls_3 = DevelopCGLS(
    TriangulatedCutMesh=item_11,
    InnerIter=Slider(80, range=0..1000),
    OuterIter=Slider(10, range=0..1000),
    XyMirror=False,
    YzMirror=False,
    ZxMirror=False,
    OuterBoundaryCurves=crv_24,
    UnSmoothCrv=crv_14,
    EdgeW=_10º_23,
    SmoothW=_10º_22,
    DevW=_10º_24,
    PositionW=1,
    LenRangeW=1)  # disabled
merge_8 = Merge(Data1=meshedges_17.NakedE)  # -> flatten(Result)
crv_26 = Curve(cutmeshedges_8.MeshNakedEdges)
crv_27 = Curve(meshedges_17.NakedE)
mbridgecm_17 = MbridgeCM(TriangulatedMeshOrCutMesh=item_9)
item_13 = ListItem(List=cutbytear_4.Triangulated2dCutMesh, Index=number_slider_32, Wrap=True)
item_14 = ListItem(List=mbridgecm_13, Index=Slider(17, range=0..17), Wrap=True)
merge_9 = Merge(Data1=crv_26, Data2=crv_27)  # -> flatten(Result)
lng_2 = ListLength(List=crv_27)
crv_28 = Curve(meshedges_17.NakedE)
cutmeshedges_12 = CutMeshEdges(TriangulatedMeshOrCutMesh=item_13)  # -> MeshAllEdges, MeshNakedEdges
cutmeshedges_13 = CutMeshEdges(TriangulatedMeshOrCutMesh=item_11)  # -> MeshAllEdges, MeshNakedEdges
developcgls_4 = DevelopCGLS(
    TriangulatedCutMesh=meshcutbylines_2,
    InnerIter=Slider(100, range=0..1000),
    OuterIter=Slider(300, range=0..1000),
    XyMirror=False,
    YzMirror=False,
    ZxMirror=False,
    OuterBoundaryCurves=crv_17,
    EdgeW="0",
    SmoothW=_10º_30,
    DevW=_10º_32,
    PositionW=_10º_34,
    LenRangeW="0",
    SmoothingPolylines=crv_17)  # disabled
number_slider_38 = Slider(17, range=0..100)
developcm5_2 = DevelopCutMesh5(
    TriangulatedCutMesh=meshcutbylines_3,
    Iterations=Slider(100, range=0..1000),
    XyMirror=False,
    YzMirror=False,
    ZxMirror=False,
    OuterBoundaryCurves=cutmeshedges_6.MeshNakedEdges,
    FixPointsCrv=crv_10,
    Weight=merge_6)  # disabled
meshedges_18 = MeshEdges(Mesh=mbridgecm_8)  # -> AllE, NakedE
cutmeshedges_14 = CutMeshEdges(TriangulatedMeshOrCutMesh=item_5)  # -> MeshAllEdges, flatten(MeshNakedEdges)
netbfflength = NetBFFLength(TriangulatedMeshOrCutMesh=sortcutmesh_5, OuterBoundaryVertCount=-1)  # -> CutMesh, FeatureLinesPolylines
dupln_3 = RemoveDuplicateLines(Lines=cutmeshedges_14.MeshNakedEdges, Tolerance=0.01)
center_6 = Center(Geometry=meshedges_13.NakedE)  # -> Center, Dimension
split = SplitList(List=crv_26, Index=lng_2)  # -> flatten(ListA), ListB
crv_29 = Curve(split.ListB)
crv_30 = Curve(split.ListB)
crv_31 = Curve(split.ListB)
merge_10 = Merge(Data1=meshedges_17.NakedE, Data2=crv_31)  # -> flatten(Result)
crv_32 = Curve(meshedges_18.NakedE)
meshedges_19 = MeshEdges(Mesh=mbridgecm_17)  # -> AllE, NakedE
panel_8 = Panel("""855
845
283
2055
1928
2506""")
developcgls_5 = DevelopCGLS(
    TriangulatedCutMesh=item_9,
    InnerIter=Slider(100, range=0..100),
    OuterIter=Slider(500, range=0..1000),
    XyMirror=False,
    YzMirror=False,
    ZxMirror=False,
    OuterBoundaryCurves=meshedges_17.NakedE,
    EdgeW="0",
    SmoothW=_10º_35,
    DevW=_10º_37,
    PositionW=_10º_36,
    LenRangeW="0",
    SmoothingPolylines=meshedges_17.NakedE)  # disabled
number_slider_39 = Slider(12, range=0..100)
cutmeshedges_15 = CutMeshEdges(TriangulatedMeshOrCutMesh=sortcutmesh_5)  # -> MeshAllEdges, MeshNakedEdges
_10º_49 = PowerOf10(Value=Slider(3, range=0..10))
_10º_50 = PowerOf10(Value=Slider(1, range=-10..10))
cutmeshedges_16 = CutMeshEdges(TriangulatedMeshOrCutMesh=developcm5)  # -> MeshAllEdges, MeshNakedEdges
dupln_4 = RemoveDuplicateLines(Lines=flatten(merge_9), Tolerance=0.01)
developcgls_6 = DevelopCGLS(
    TriangulatedCutMesh=sortcutmesh_5,
    InnerIter=Slider(80, range=0..100),
    OuterIter=Slider(100, range=0..100),
    XyMirror=False,
    YzMirror=False,
    ZxMirror=False,
    OuterBoundaryCurves=meshedges_17.NakedE,
    FixPointsCrv=merge_10,
    EdgeW=_10º_47,
    SmoothW=_10º_43,
    DevW=_10º_44,
    PositionW=_10º_45,
    LenRangeW="0")  # disabled
panel_9 = Panel(checkobjective)
mbridgecm_18 = MbridgeCM(TriangulatedMeshOrCutMesh=developcgnr.ModifiedCutMesh)
developcgls_7 = DevelopCGLS(
    TriangulatedCutMesh=sortcutmesh_5,
    InnerIter=Slider(100, range=0..1000),
    OuterIter=Slider(20, range=0..1000),
    XyMirror=False,
    YzMirror=False,
    ZxMirror=False,
    OuterBoundaryCurves=cutmeshedges_7.MeshNakedEdges,
    EdgeW=_10º_28,
    SmoothW="0",
    DevW=_10º_48,
    PositionW=1,
    LenRangeW=1)  # disabled
developcgls_8 = DevelopCGLS(
    TriangulatedCutMesh=meshcutbylines_2,
    InnerIter=Slider(200, range=0..1000),
    OuterIter=Slider(100, range=0..1000),
    XyMirror=False,
    YzMirror=False,
    ZxMirror=False,
    OuterBoundaryCurves=crv_17,
    FixPointsCrv=crv_19,
    UnSmoothCrv=crv_10,
    EdgeW=_10º_41,
    SmoothW=_10º_40,
    DevW=_10º_42,
    PositionW=1,
    LenRangeW=1)
len_7 = Length(Curve=cutmeshedges_13.MeshAllEdges)
len_8 = Length(Curve=cutmeshedges_12.MeshAllEdges)
mbridgecm_19 = MbridgeCM(TriangulatedMeshOrCutMesh=developcm5)
checkobjective_3 = CheckObjective(TriangulatedCutMesh=item_9, XyMirror=False, YzMirror=False, ZxMirror=False, OuterBoundaryCurves=meshedges_19.NakedE)
panel_10 = Panel(checkobjective_3)
sortcutmesh_7 = SortCutMesh(TriangulatedMeshOrCutMesh=developcgls_5)
panel_11 = Panel("0")
crv_33 = Curve(cutmeshedges_14.MeshNakedEdges)
center_7 = Center(Geometry=dupln_3)  # -> Center, Dimension
checkobjective_4 = CheckObjective(TriangulatedCutMesh=developcm5, XyMirror=False, YzMirror=False, ZxMirror=False, OuterBoundaryCurves=crv_32)
netbff = NetBFF(TriangulatedMeshOrCutMesh=developcm5_2)  # -> CutMesh, FeatureLinesPolylines
item_15 = ListItem(List=cutopt.CutMeshes, Index=number_slider_33, Wrap=True)
cutmeshedges_17 = CutMeshEdges(TriangulatedMeshOrCutMesh=developcm5_2)  # -> MeshAllEdges, MeshNakedEdges
number_slider_40 = Slider(8, range=0..10)
previewlw_12 = CustomPreviewLineweights(Geometry=crv_11, Shader=swatch_3, Thickness=number_slider_40, Absolute=False)
merge_11 = Merge(Data1=flatten(center_7.Center), Data2=flatten(center_6.Center))  # -> flatten(Result)
panel_12 = Panel(developcgnr.DevEnergy)
netlbfgs2_2 = NetLBFGS2(TriangulatedMeshOrCutMesh=sortcutmesh_7, W0=_10º_49, W1=1)  # -> CutMesh, FeatureLinesPolylines
principle = PrincipleCurvature()
netlbfgs_2 = NetLBFGS(TriangulatedMeshOrCutMesh=developcgls_8, HasHole="true", W0=_10º_50, W1=1, Switch="true")  # -> CutMesh, FeatureLinesPolylines
cutmeshedges_18 = CutMeshEdges(TriangulatedMeshOrCutMesh=netbfflength.CutMesh)  # -> MeshAllEdges, MeshNakedEdges
subtraction_3 = Subtraction(A=len_7, B=len_8)
_10º_51 = PowerOf10(Value=Slider(3, range=-5..5))
item_16 = ListItem(List=cutmeshedges_16.MeshAllEdges, Index=panel_8, Wrap=True)
meshedges_20 = MeshEdges(Mesh=mbridgecm_18)  # -> AllE, NakedE
_10º_52 = PowerOf10(Value=Slider(3, range=-5..5))
mbridgecm_20 = MbridgeCM(TriangulatedMeshOrCutMesh=developcgls_4)
_10º_53 = PowerOf10(Value=Slider(0, range=-3..10))
_10º_54 = PowerOf10(Value=Slider(0, range=-5..5))
_10º_55 = PowerOf10(Value=Slider(0, range=-5..5))
sqr_3 = Square(Value=subtraction_3)
cutmeshedges_19 = CutMeshEdges(TriangulatedMeshOrCutMesh=developcm5)  # -> MeshAllEdges, MeshNakedEdges
mbridgecm_21 = MbridgeCM(TriangulatedMeshOrCutMesh=developcgls_6)
center_8 = Center(Geometry=mbridgecm_19)  # -> Center, Dimension
panel_13 = Panel(checkobjective_4)
avr_4 = Average(Input=sqr_3)
len_9 = Length(Curve=cutmeshedges_15.MeshAllEdges)
checkobjective_5 = CheckObjective(
    TriangulatedCutMesh=developcgnr.ModifiedCutMesh,
    XyMirror=False,
    YzMirror=False,
    ZxMirror=False,
    OuterBoundaryCurves=meshedges_20.NakedE)
mbridgecm_22 = MbridgeCM(TriangulatedMeshOrCutMesh=developcgls_5)
len_10 = Length(Curve=cutmeshedges_18.MeshAllEdges)
cutmeshedges_20 = CutMeshEdges(TriangulatedMeshOrCutMesh=developcgls_6)  # -> MeshAllEdges, MeshNakedEdges
mbridgecm_23 = MbridgeCM(TriangulatedMeshOrCutMesh=developcgls_7)
netcgnr = NetCGNR(TriangulatedMeshOrCutMesh=developcm5, HasHole=Toggle(True), W0=1, W1=_10º_53, Switch=Toggle(True))  # -> CutMesh, FeatureLinesPolylines
mesh_28 = Mesh(mbridgecm_20)
deccutmesh_2 = DeconstructCutMesh(TriangulatedMeshOrCutMesh=developcgls_7)  # -> Vertices, Faces, Edges, Dups
meshedges_21 = MeshEdges(Mesh=mbridgecm_22)  # -> AllE, NakedE
checkobjective_6 = CheckObjective(
    TriangulatedCutMesh=developcm5_2,
    XyMirror=False,
    YzMirror=False,
    ZxMirror=False,
    OuterBoundaryCurves=cutmeshedges_17.MeshNakedEdges)
panel_14 = Panel(checkobjective_6)
deccutmesh_3 = DeconstructCutMesh(TriangulatedMeshOrCutMesh=sortcutmesh_5)  # -> Vertices, Faces, Edges, Dups
cullpt_6 = CullDuplicates(Points=merge_11, Tolerance=0.1, CullMode=1)  # -> Points, Indices, Valence
mesh_29 = Mesh(mbridgecm_22)
netlbfgs_3 = NetLBFGS(TriangulatedMeshOrCutMesh=sortcutmesh_5, HasHole=False, W0=_10º_51, W1=_10º_54, Switch=False)  # -> CutMesh, FeatureLinesPolylines
netlbfgs_4 = NetLBFGS(TriangulatedMeshOrCutMesh=sortcutmesh_5, HasHole="true", W0=_10º_52, W1=_10º_55, Switch=False)  # -> CutMesh, FeatureLinesPolylines
cutmeshedges_21 = CutMeshEdges(TriangulatedMeshOrCutMesh=netlbfgs2_2.CutMesh)  # -> MeshAllEdges, MeshNakedEdges
cutmeshedges_22 = CutMeshEdges(TriangulatedMeshOrCutMesh=sortcutmesh_7)  # -> MeshAllEdges, MeshNakedEdges
meshedges_22 = MeshEdges(Mesh=mbridgecm_21)  # -> AllE, NakedE
len_11 = Length(Curve=cutmeshedges_19.MeshAllEdges)
meshedges_23 = MeshEdges(Mesh=mbridgecm_20)  # -> AllE, NakedE
mesh_30 = Mesh(mbridgecm_21)
meshcutbylines_4 = MeshCutWithCutLines(TriangulatedMeshOrCutMesh=developcm5, OpenCutLinesPolylines=item_16)
mbridgecm_24 = MbridgeCM(TriangulatedMeshOrCutMesh=developcgls_8)
crv_34 = Curve(cutmeshedges_20.MeshNakedEdges)
sortcutmesh_8 = SortCutMesh(TriangulatedMeshOrCutMesh=developcgls_4)
panel_15 = Panel(avr_4)
panel_16 = Panel(checkobjective_5)
X = UnitX(Factor=1)
Z = UnitZ(Factor=1)
cutmeshedges_23 = CutMeshEdges(TriangulatedMeshOrCutMesh=developcgls_8)  # -> MeshAllEdges, MeshNakedEdges
x_minus_one_5 = XMinusOne(NumberX=cullpt_6.Valence)
checkobjective_7 = CheckObjective(
    TriangulatedCutMesh=developcgls_5,
    XyMirror=False,
    YzMirror=False,
    ZxMirror=False,
    OuterBoundaryCurves=meshedges_21.NakedE)
subtraction_4 = Subtraction(A=len_9, B=len_10)
abs_3 = Absolute(Value=subtraction_4)
crv_35 = Curve(meshedges_21.NakedE)
_10º_56 = PowerOf10(Value=Slider(3, range=-10..10))
number_slider_41 = Slider(23, range=0..100)
checkobjective_8 = CheckObjective(
    TriangulatedCutMesh=developcgls_6,
    XyMirror=False,
    YzMirror=False,
    ZxMirror=False,
    OuterBoundaryCurves=meshedges_22.NakedE)
crv_36 = Curve(meshedges_22.NakedE)
cutmeshedges_24 = CutMeshEdges(TriangulatedMeshOrCutMesh=netcgnr.CutMesh)  # -> MeshAllEdges, MeshNakedEdges
len_12 = Length(Curve=crv_34)
avr_5 = Average(Input=abs_3)
checkobjective_9 = CheckObjective(
    TriangulatedCutMesh=developcgls_4,
    XyMirror=False,
    YzMirror=False,
    ZxMirror=False,
    OuterBoundaryCurves=meshedges_23.NakedE)
panel_17 = Panel(checkobjective_9)
mesh_31 = Mesh(mbridgecm_23)
mesh_32 = Mesh(mbridgecm_24)
meshedges_24 = MeshEdges(Mesh=mbridgecm_24)  # -> AllE, NakedE
len_13 = Length(Curve=cutmeshedges_21.MeshAllEdges)
len_14 = Length(Curve=cutmeshedges_22.MeshAllEdges)
netbfflength_2 = NetBFFLength(TriangulatedMeshOrCutMesh=meshcutbylines_4, OuterBoundaryVertCount=-1)  # -> CutMesh, FeatureLinesPolylines; disabled
dist = Distance(PointA=deccutmesh_3.Vertices, PointB=deccutmesh_2.Vertices)
x_minus_one_6 = XMinusOne(NumberX=x_minus_one_5)
panel_18 = Panel(checkobjective_7)
mesh_33 = Mesh(<mesh referenced from the Rhino model>)
rotatecutmesh = RotateCutMesh(
    TriangulatedMeshOrCutMesh=developcm5,
    RotationCenter=center_8.Center,
    RotationAxis=X,
    RotationAngle=degrees(Slider(77, range=0..100)))
netlbfgs2_3 = NetLBFGS2(TriangulatedMeshOrCutMesh=sortcutmesh_8, W0=_10º_56, W1=1)  # -> CutMesh, FeatureLinesPolylines
len_15 = Length(Curve=cutmeshedges_23.MeshAllEdges)
len_16 = Length(Curve=cutmeshedges_24.MeshAllEdges)
subtraction_5 = Subtraction(A=len_11, B=len_16)
cutmeshedges_25 = CutMeshEdges(TriangulatedMeshOrCutMesh=netlbfgs_3.CutMesh)  # -> MeshAllEdges, MeshNakedEdges
sqr_4 = Square(Value=subtraction_5)
panel_19 = Panel(len_12)
sortcutmesh_9 = SortCutMesh(TriangulatedMeshOrCutMesh=developcm5)
lng_3 = ListLength(List=deccutmesh_3.Vertices)
number_slider_42 = Slider(0, range=0..100)
netbff_2 = NetBFF(TriangulatedMeshOrCutMesh=meshcutbylines_4)  # -> CutMesh, FeatureLinesPolylines
panel_20 = Panel(checkobjective_8)
subtraction_6 = Subtraction(A=len_13, B=len_14)
checkobjective_10 = CheckObjective(
    TriangulatedCutMesh=developcgls_8,
    XyMirror=False,
    YzMirror=False,
    ZxMirror=False,
    OuterBoundaryCurves=meshedges_24.NakedE)
abs_4 = Absolute(Value=x_minus_one_6)
cull_3 = CullPattern(List=dupln_3, CullPattern=abs_4)
previewlw_13 = CustomPreviewLineweights(Geometry=cull_3, Shader=swatch_3, Thickness=number_slider_40, Absolute=False)
neg = Negative(Value=dist)
sqr_5 = Square(Value=subtraction_6)
_10º_57 = PowerOf10(Value=Slider(0, range=0..10))
_10º_58 = PowerOf10(Value=Slider(1, range=0..10))
division = Division(B=0)
cutmeshedges_26 = CutMeshEdges(TriangulatedMeshOrCutMesh=netlbfgs2_3.CutMesh)  # -> MeshAllEdges, MeshNakedEdges
toggle_2 = BooleanToggle(False)
cutmeshedges_27 = CutMeshEdges(TriangulatedMeshOrCutMesh=sortcutmesh_8)  # -> MeshAllEdges, MeshNakedEdges
_10º_59 = PowerOf10(Value=Slider(4, range=0..10))
number_slider_43 = Slider(80, range=0..100)
_10º_60 = PowerOf10(Value=Slider(0, range=0..6))
_10º_61 = PowerOf10(Value=Slider(0, range=0..6))
series_2 = Series(Start=0, Step=1, Count=lng_3)
avr_6 = Average(Input=sqr_4)
avr_7 = Average(Input=sqr_5)
panel_21 = Panel(avr_7)
number_slider_44 = Slider(327, range=0..1000)
netbff2 = NetBFF2(TriangulatedMeshOrCutMesh=sortcutmesh_9, OuterBoundaryVertCount="120")  # -> CutMesh, FeatureLinesPolylines
meshedges_25 = MeshEdges(Mesh=mesh_33)  # -> AllE, NakedE
len_17 = Length(Curve=cutmeshedges_27.MeshAllEdges)
netlbfgs2_4 = NetLBFGS2(TriangulatedMeshOrCutMesh=developcgls_8, W0=_10º_59, W1=1)  # -> CutMesh, FeatureLinesPolylines
cutmeshedges_28 = CutMeshEdges(TriangulatedMeshOrCutMesh=netlbfgs2_4.CutMesh)  # -> MeshAllEdges, MeshNakedEdges
crv_37 = Curve(cutmeshedges_28.MeshAllEdges)
len_18 = Length(Curve=cutmeshedges_28.MeshAllEdges)
subtraction_7 = Subtraction(A=len_15, B=len_18)
crv_38 = Curve(meshedges_25.AllE)
meshcutbylines_5 = MeshCutWithCutLines(TriangulatedMeshOrCutMesh=mbridgecm_2, OpenCutLinesPolylines=cull_3)  # disabled
mbridgecm_25 = MbridgeCM(TriangulatedMeshOrCutMesh=meshcutbylines_5)
meshedges_26 = MeshEdges(Mesh=mbridgecm_25)  # -> AllE, NakedE
crv_39 = Curve(meshedges_26.NakedE)
sortcutmesh_10 = SortCutMesh(TriangulatedMeshOrCutMesh=meshcutbylines_5)  # disabled
len_19 = Length(Curve=cutmeshedges_26.MeshAllEdges)
sort_2 = SortList(Keys=neg, ValuesA=series_2)  # -> Keys, ValuesA
subtraction_8 = Subtraction(A=len_17, B=len_19)
series_3 = Series(Start=0, Step=1, Count=Slider(38, range=0..100))
netbfflength2 = NetBFFLength2(TriangulatedMeshOrCutMesh=developcm5, OuterBoundaryVertCount="120")  # -> CutMesh, FeatureLinesPolylines
cutmeshedges_29 = CutMeshEdges(TriangulatedMeshOrCutMesh=sortcutmesh_9)  # -> MeshAllEdges, MeshNakedEdges
Y = UnitY(Factor=1)
abs_5 = Absolute(Value=subtraction_7)
avr_8 = Average(Input=abs_5)
panel_24 = Panel(avr_8)
abs_6 = Absolute(Value=subtraction_8)
avr_9 = Average(Input=abs_6)
cutmeshedges_30 = CutMeshEdges()  # -> MeshAllEdges, MeshNakedEdges
item_17 = ListItem(List=sort_2.ValuesA, Index=series_3, Wrap=True)
deccutmesh_4 = DeconstructCutMesh(TriangulatedMeshOrCutMesh=developcgls_8)  # -> Vertices, Faces, Edges, Dups
panel_25 = Panel(checkobjective_10)
deccutmesh_5 = DeconstructCutMesh(TriangulatedMeshOrCutMesh=netlbfgs2_4.CutMesh)  # -> Vertices, Faces, Edges, Dups
number_slider_45 = Slider(100, range=0..100)
division_2 = Division(A=Slider(22, range=0..360), B="180")
deccutmesh_6 = DeconstructCutMesh(TriangulatedMeshOrCutMesh=sortcutmesh_10)  # -> Vertices, Faces, Edges, Dups
outerboundary = OuterBoundary(TriangulatedMeshOrCutMesh=sortcutmesh_10)  # -> OuterEdges, OuterVertsIndices
dividecutmesh = DivideCutMesh(TriangulatedMeshOrCutMesh=sortcutmesh_10)
_10º_62 = PowerOf10(Value=Slider(2, range=0..10))
item_18 = ListItem(List=deccutmesh_2.Vertices, Index=item_17, Wrap=True)
_10º_63 = PowerOf10(Value=Slider(2, range=0..10))
_10º_64 = PowerOf10(Value=Slider(3, range=0..10))
number_slider_46 = Slider(3, range=-10..10)  # disabled
len_20 = Length(Curve=cutmeshedges_29.MeshAllEdges)
len_21 = Length(Curve=cutmeshedges_30.MeshAllEdges)
number_slider_47 = Slider(122, range=0..900)
number_slider_48 = Slider(133, range=100..150)
_10º_65 = PowerOf10(Value=Slider(2, range=0..10))
pi = Pi(Factor=division_2)
rotatecutmesh_2 = RotateCutMesh(TriangulatedMeshOrCutMesh=rotatecutmesh, RotationCenter=center_8.Center, RotationAxis=Y, RotationAngle=degrees(pi))
_10º_66 = PowerOf10(Value=Slider(2, range=0..10))
_10º_67 = PowerOf10(Value=Slider(3, range=0..10))
facenormal = FaceNormal(TriangulatedMeshOrCutMesh=rotatecutmesh_2, Scale=Slider(0.1, range=0..0.1))
categorycheck = CategoryCheck(
    TriangulatedCutMesh=sortcutmesh_10,
    XyMirror=False,
    YzMirror=False,
    ZxMirror=False,
    OuterBoundaryCurves=outerboundary.OuterEdges)
subtraction_9 = Subtraction(A=len_21, B=len_20)
deccutmesh_7 = DeconstructCutMesh(TriangulatedMeshOrCutMesh=dividecutmesh)  # -> Vertices, Faces, Edges, Dups
_10º_68 = PowerOf10(Value=Slider(4, range=-10..10))
developcgls_9 = DevelopCGLS(
    TriangulatedCutMesh=mbridgecm_2,
    InnerIter=100,
    OuterIter=30,
    XyMirror=False,
    YzMirror=False,
    ZxMirror=False,
    OuterBoundaryCurves=meshedges_5.NakedE,
    EdgeW=1,
    SmoothW=_10º_66,
    DevW=_10º_67,
    PositionW=_10º_65,
    LenRangeW=1)  # disabled
_10º_69 = PowerOf10(Value=Slider(3, range=-10..10))
_10º_70 = PowerOf10(Value=Slider(3, range=-10..10))
item_19 = ListItem(List=deccutmesh_4.Vertices, Index=number_slider_48, Wrap=True)
_10º_71 = PowerOf10(Value=Slider(4, range=-10..10))
developcgls_10 = DevelopCGLS(
    TriangulatedCutMesh=sortcutmesh_10,
    InnerIter=Slider(300, range=0..1000),
    OuterIter=Slider(300, range=0..1000),
    XyMirror=False,
    YzMirror=False,
    ZxMirror=False,
    OuterBoundaryCurves=crv_39,
    EdgeW="0",
    SmoothW=_10º_63,
    DevW=_10º_64,
    PositionW=_10º_62,
    LenRangeW="0")  # disabled
_10º_72 = PowerOf10(Value=number_slider_46)  # disabled
bang = ExplodeTree(Data=categorycheck)  # -> Branch0, Branch1, Branch2, Branch3, Branch4
item_20 = ListItem(List=deccutmesh_6.Vertices, Index=bang.Branch0, Wrap=True)
sort_3 = SortList(Keys=subtraction_9)  # -> Keys, ValuesA
panel_26 = Panel(len_20)
item_21 = ListItem(List=deccutmesh_5.Vertices, Index=number_slider_48, Wrap=True)
netcgnr_2 = NetCGNR(TriangulatedMeshOrCutMesh=rotatecutmesh_2, Iterations=Slider(400, range=0..1000), W0=_10º_58, W1=_10º_57, Switch=False)  # -> CutMesh, FeatureLinesPolylines; disabled
panel_27 = Panel(sort_3.Keys)
merge_12 = Merge(Data1=item_19, Data2=item_21)
_10º_73 = PowerOf10(Value=Slider(3, range=0..10))
crv_40 = Curve(crv_17)
developcgls_11 = DevelopCGLS(
    TriangulatedCutMesh=mbridgecm_2,
    InnerIter=Slider(100, range=0..1000),
    OuterIter=Slider(300, range=0..1000),
    XyMirror=False,
    YzMirror=False,
    ZxMirror=False,
    OuterBoundaryCurves=crv_17,
    EdgeW=_10º_69,
    SmoothW=_10º_68,
    DevW=_10º_70,
    PositionW=_10º_71,
    LenRangeW="0",
    SmoothingPolylines=crv_17)  # disabled
outerboundary_2 = OuterBoundary(TriangulatedMeshOrCutMesh=developcgls_10)  # -> OuterEdges, OuterVertsIndices

flip = FlipCurve(Curve=cutmeshedges_25.MeshAllEdges)  # -> Curve, Flag
len_22 = Length(Curve=cutmeshedges_25.MeshAllEdges)
vec = Vector(cutmeshedges_25.MeshAllEdges)
subtraction_10 = Subtraction(A=len_22, B=len_9)
multiplication_2 = Multiplication(A=vec, B=subtraction_10)
end = EndPoints(Curve=cutmeshedges_25.MeshAllEdges)  # -> Start, End
vec_2 = Vector(flip.Curve)
abs_7 = Absolute(Value=subtraction_10)
multiplication_3 = Multiplication(A=vec_2, B=subtraction_10)
larger = LargerThan(FirstNumber=subtraction_10, SecondNumber="0")  # -> flatten(LargerThan), OrEqualTo
avr_10 = Average(Input=abs_7)
merge_13 = Merge(Data1=ColourSwatch(SwatchColor=RGB(0, 42, 255)), Data2=ColourSwatch(SwatchColor=RGB(255, 0, 0)))
item_22 = ListItem(List=merge_13, Index=larger.LargerThan, Wrap=True)
vdisex = VectorDisplayEx(Point=end.Start, Vector=multiplication_2, Colour=item_22, Width=2)
previewlw_14 = CustomPreviewLineweights(Geometry=cutmeshedges_25.MeshAllEdges, Shader=ColourSwatch(SwatchColor=RGB(158, 158, 158)), Absolute=False)
vdisex_2 = VectorDisplayEx(Point=end.End, Vector=multiplication_3, Colour=item_22, Width=2)

sortcutmesh_11 = SortCutMesh(TriangulatedMeshOrCutMesh=developcgls_10)
panel_28 = Panel(bang.Branch0)
netlbfgs2_5 = NetLBFGS2(TriangulatedMeshOrCutMesh=sortcutmesh_11, W0=_10º_73, W1=1)  # -> CutMesh, FeatureLinesPolylines
checkobjective_11 = CheckObjective(
    TriangulatedCutMesh=developcgls_10,
    XyMirror=False,
    YzMirror=False,
    ZxMirror=False,
    OuterBoundaryCurves=outerboundary_2.OuterEdges)
item_23 = ListItem(List=deccutmesh_7.Vertices, Index=bang.Branch4, Wrap=True)
sortcutmesh_12 = SortCutMesh(TriangulatedMeshOrCutMesh=developcgls_11)
_10º_74 = PowerOf10(Value=Slider(3, range=-10..10))
cutmeshedges_31 = CutMeshEdges(TriangulatedMeshOrCutMesh=netlbfgs2_5.CutMesh)  # -> MeshAllEdges, MeshNakedEdges
cutmeshedges_32 = CutMeshEdges(TriangulatedMeshOrCutMesh=sortcutmesh_11)  # -> MeshAllEdges, MeshNakedEdges
netlbfgs2_6 = NetLBFGS2(TriangulatedMeshOrCutMesh=sortcutmesh_12, W0=_10º_74, W1=1)  # -> CutMesh, FeatureLinesPolylines
mbridgecm_26 = MbridgeCM(TriangulatedMeshOrCutMesh=developcgls_9)
cutmeshedges_33 = CutMeshEdges(TriangulatedMeshOrCutMesh=netlbfgs2_6.CutMesh)  # -> MeshAllEdges, MeshNakedEdges
cutmeshedges_34 = CutMeshEdges(TriangulatedMeshOrCutMesh=sortcutmesh_12)  # -> MeshAllEdges, MeshNakedEdges
len_23 = Length(Curve=cutmeshedges_31.MeshAllEdges)
len_24 = Length(Curve=cutmeshedges_32.MeshAllEdges)
meshedges_27 = MeshEdges(Mesh=mbridgecm_26)  # -> AllE, NakedE
preview_7 = CustomPreview(Geometry=mbridgecm_26, Material=ColourSwatch(SwatchColor=RGBA(0, 0, 0, 119)))
subtraction_11 = Subtraction(A=len_23, B=len_24)
len_25 = Length(Curve=cutmeshedges_34.MeshAllEdges)
len_26 = Length(Curve=cutmeshedges_33.MeshAllEdges)
abs_8 = Absolute(Value=subtraction_11)
subtraction_12 = Subtraction(A=len_25, B=len_26)
abs_9 = Absolute(Value=subtraction_12)
avr_11 = Average(Input=abs_9)
panel_29 = Panel(avr_11)
avr_12 = Average(Input=abs_8)
previewlw_15 = CustomPreviewLineweights(
    Geometry=meshedges_27.AllE,
    Shader=ColourSwatch(SwatchColor=RGB(0, 0, 255)),
    Thickness=Slider(1, range=0..10),
    Absolute=False)

cutmeshedges_35 = CutMeshEdges(TriangulatedMeshOrCutMesh=netlbfgs_4.CutMesh)  # -> MeshAllEdges, MeshNakedEdges
edgepushpull = EdgePushPull(Triangulated3dCutMesh=sortcutmesh_5, Triangulated2dCutMesh=netlbfgs_4.CutMesh)  # -> VectorStartPoints, PushPullColourFlag, PushPullVector
merge_14 = Merge(Data1=ColourSwatch(SwatchColor=RGB(0, 42, 255)), Data2=ColourSwatch(SwatchColor=RGB(255, 0, 0)))
item_24 = ListItem(List=merge_14, Index=edgepushpull.PushPullColourFlag, Wrap=True)

rotate = Rotate(Geometry=edgepushpull.PushPullVector, Angle=degrees(number_slider_41), Plane=PlaneXY(0, 0, 0))  # -> Geometry, Transform
rotate_2 = Rotate(Geometry=edgepushpull.VectorStartPoints, Angle=degrees(number_slider_41), Plane=PlaneXY(0, 0, 0))  # -> Geometry, Transform
rotate_3 = Rotate(Geometry=cutmeshedges_35.MeshAllEdges, Angle=degrees(number_slider_41), Plane=PlaneXY(0, 0, 0))  # -> Geometry, Transform
multiplication_4 = Multiplication(A=rotate.Geometry, B=Slider(2, range=0..10))

previewlw_16 = CustomPreviewLineweights(Geometry=rotate_3.Geometry, Shader=ColourSwatch(SwatchColor=RGB(158, 158, 158)), Absolute=False)
vdisex_3 = VectorDisplayEx(Point=rotate_2.Geometry, Vector=multiplication_4, Colour=item_24, Width=2)
