# Grasshopper definition 内部切込みheuristic.gh (Grasshopper 1.0.8)
# plug-ins: Hagoromo, NGon_RH8

mesh = Mesh(<mesh referenced from the Rhino model>)
msmooth = SmoothMesh(Mesh=mesh, Strength=0.5, SkipNaked=True, Iterations=1)
mbridgecm = MbridgeCM(TriangulatedMeshOrCutMesh=mesh)
sortcutmesh = SortCutMesh(TriangulatedMeshOrCutMesh=mbridgecm)
cutmeshgcurvature = CutMeshGCurvature(TriangulatedMeshOrCutMesh=mbridgecm)  # -> GC, GCMap
number_slider = Slider(1, range=0..10)
mbridgecm_2 = MbridgeCM(TriangulatedMeshOrCutMesh=mesh)
sort = SortList(Keys=cutmeshgcurvature.GCMap)  # -> Keys, ValuesA
meshedges = MeshEdges(Mesh=mesh)  # -> AllE, NakedE
item = ListItem(List=sort.Keys, Index=0, Wrap=True)  # -> Item1, Item
curvaturegroup = CurvatureGroup(TriangulatedMeshOrCutMesh=mbridgecm_2, I=Slider(14, range=0..27))  # -> Points, TriangulatedCutMesh, Count
gradient = Gradient(
    LowerLimit=item.Item,
    UpperLimit=item.Item1,
    Parameter=cutmeshgcurvature.GCMap,
    stops=[0: RGB(234, 38, 0), 0.25: RGB(234, 126, 0), 0.5: RGB(254, 244, 84), 0.75: RGB(173, 203, 249), 1: RGB(75, 107, 169)])
mcol = MeshColours(Mesh=msmooth, Colours=gradient)
cutopt = ClusterCutNSGAII(TriangulatedMeshOrCutMesh=sortcutmesh, PopSize=Slider(10, range=0..100), Generations=Slider(5, range=0..100))  # -> CutMeshes, TotalLength, DevObj, Seams; disabled
meshedges_2 = MeshEdges(Mesh=msmooth)  # -> AllE, NakedE
item_2 = ListItem(List=cutopt.CutMeshes, Index=Slider(2, range=0..10), Wrap=True)
pt = Point(curvaturegroup.Points)
panel = Panel(cutopt.DevObj)
_10º = PowerOf10(Value=Slider(4, range=0..10))
_10º_2 = PowerOf10(Value=Slider(3, range=0..10))
_10º_3 = PowerOf10(Value=Slider(2, range=0..10))
developcgls = DevelopCGLS(
    TriangulatedCutMesh=item_2,
    InnerIter=100,
    OuterIter=Slider(15, range=0..100),
    XyMirror=False,
    YzMirror=False,
    ZxMirror=False,
    OuterBoundaryCurves=meshedges.NakedE,
    EdgeW=1,
    SmoothW=_10º,
    DevW=_10º_2,
    PositionW=_10º_3,
    LenRangeW=1)
dividecutmesh = DivideCutMesh(TriangulatedMeshOrCutMesh=developcgls)
_10º_4 = PowerOf10(Value=Slider(3, range=0..10))
_10º_5 = PowerOf10(Value=Slider(3, range=0..10))
item_3 = ListItem(List=dividecutmesh, Index=0, Wrap=True)  # -> Item1, Item
item_4 = ListItem(List=dividecutmesh, Index=0, Wrap=True)
netlbfgs2 = NetLBFGS2(TriangulatedMeshOrCutMesh=item_3.Item1, W0=_10º_4, W1=1)  # -> CutMesh, FeatureLinesPolylines
netlbfgs2_2 = NetLBFGS2(TriangulatedMeshOrCutMesh=item_4, W0=_10º_5, W1=1)  # -> CutMesh, FeatureLinesPolylines
