# Grasshopper definition 内部切込み梗概用.gh (Grasshopper 1.0.8)
# plug-ins: Human, Weaverbird, NGon_RH8

crv = Curve(<curve referenced from the Rhino model>)
crv_2 = Curve([<curve referenced from the Rhino model> x2561])
mesh = Mesh(<mesh referenced from the Rhino model>)
meshedges = MeshEdges(Mesh=mesh)  # -> AllE, NakedE
wbweave = WeaverbirdsMeshFromLinesWeaveBack(Lines=crv_2, MaximumValence=4)
previewlw = CustomPreviewLineweights(Geometry=crv, Shader=ColourSwatch(SwatchColor=RGB(255, 0, 0)), Thickness=Slider(8, range=0..10), Absolute=False)
meshedges_2 = MeshEdges(Mesh=wbweave)  # -> AllE, NakedE
preview = CustomPreview(Geometry=mesh, Material=ColourSwatch(SwatchColor=RGBA(0, 0, 0, 104)))
previewlw_2 = CustomPreviewLineweights(
    Geometry=meshedges.AllE,
    Shader=ColourSwatch(SwatchColor=RGB(145, 141, 142)),
    Thickness=Slider(0.5, range=0..10),
    Absolute=False)
crv_3 = Curve(meshedges_2.NakedE)
join = JoinCurves(Curves=crv_3, Preserve=False)
