# Grasshopper definition 半球.gh (Grasshopper 1.0.8)
# plug-ins: Pufferfish, Human, Hagoromo, Weaverbird, eleFront, NGon_RH8

number_slider = Slider(100000, range=0..100000)
number_slider_2 = Slider(10000, range=0..10000)

# ----
# 中間用
mesh = Mesh(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)
mesh_2 = Mesh(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)
mesh_3 = Mesh(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)

meshedges = MeshEdges(Mesh=mesh_3)  # -> AllE, NakedE
X = UnitX(Factor=Slider(400, range=0..100000))
msphere = MeshSphere(Base=PlaneXY(0, 0, 0), Radius=Slider(60, range=0..100), UCount=10, VCount=20)
number_slider_3 = Slider(10000, range=0..10000)
cutmeshgcurvature = CutMeshGCurvature(TriangulatedMeshOrCutMesh=mesh_3)
previewlw = CustomPreviewLineweights(Geometry=meshedges.AllE, Shader=ColourSwatch(SwatchColor=RGBA(194, 194, 255, 0)), Absolute=False)
move = Move(Geometry=msphere, Motion=X)  # -> Geometry, Transform
meshedges_2 = MeshEdges(Mesh=mesh)  # -> AllE, NakedE
crv = Curve([<curve referenced from the Rhino model> x220])
lng = ListLength(List=cutmeshgcurvature)
swatch = ColourSwatch(SwatchColor=RGBA(0, 0, 0, 130))
tri = Triangulate(Mesh=move.Geometry)  # -> Mesh, Count
sort = SortList(Keys=cutmeshgcurvature, ValuesA=cutmeshgcurvature)  # -> Keys, ValuesA
swatch_2 = ColourSwatch(SwatchColor=RGBA(255, 255, 255, 80))
wbweave = WeaverbirdsMeshFromLinesWeaveBack(Lines=crv, MaximumValence=4)
元形状 = Mesh(wbweave)
sortcutmesh = SortCutMesh(TriangulatedMeshOrCutMesh=元形状)
deccutmesh = DeconstructCutMesh(TriangulatedMeshOrCutMesh=sortcutmesh)  # -> Vertices, Faces, Edges
area = Area(Geometry=元形状)  # -> Area, Centroid
meshedges_3 = MeshEdges(Mesh=元形状)  # -> AllE, NakedE
number_slider_4 = Slider(2, range=0..2)
number_slider_5 = Slider(2, range=0..2)
number_slider_6 = Slider(2, range=0..2)
avr = Average(Input=cutmeshgcurvature)
multiplication = Multiplication(A=lng, B=avr)
number_slider_7 = Slider(100000, range=0..100000)
preview = CustomPreview(
    Geometry=mesh,
    Material={diffuse=RGB(221, 160, 221), emission=RGB(66, 48, 66), shine=0.5, specular=RGB(255, 255, 255), transparency=0})
preview_2 = CustomPreview(Geometry=wbweave, Material=ColourSwatch(SwatchColor=RGBA(52, 92, 65, 130)))
previewlw_2 = CustomPreviewLineweights(Geometry=crv, Shader=ColourSwatch(SwatchColor=RGBA(173, 173, 173, 130)), Absolute=False)
previewlw_3 = CustomPreviewLineweights(Geometry=meshedges_2.AllE, Shader=ColourSwatch(SwatchColor=RGB(0, 0, 0)), Absolute=False)
item = ListItem(List=sort.ValuesA, Index=0, Wrap=True)  # -> Item1, Item
mesh_4 = Mesh(wbweave)
panel = Panel(multiplication)
meshedges_4 = MeshEdges(Mesh=tri.Mesh)  # -> AllE, NakedE
meshedges_5 = MeshEdges(Mesh=wbweave)  # -> AllE, NakedE
developcm2 = DevelopCutMesh2(
    TriangulatedCutMesh=wbweave,
    Iterations=Slider(200000, range=0..1000000),
    XyMirror=False,
    YzMirror=False,
    ZxMirror=False,
    OuterBoundaryCurves=meshedges_5.NakedE,
    Alpha=0.1)  # disabled
mbridgecm = MbridgeCM(TriangulatedMeshOrCutMesh=developcm2)
develop = DevelopMesh(TriangulatedMesh=mbridgecm, Count=Slider(100000, range=0..100000))  # -> ModifiedMesh, A
ハイブリッド = Mesh(develop.ModifiedMesh)
sortcutmesh_2 = SortCutMesh(TriangulatedMeshOrCutMesh=ハイブリッド)
deccutmesh_2 = DeconstructCutMesh(TriangulatedMeshOrCutMesh=sortcutmesh_2)  # -> Vertices, Faces, Edges
dist = Distance(PointA=deccutmesh_2.Vertices, PointB=deccutmesh.Vertices)
sqr = Square(Value=dist)
avr_2 = Average(Input=sqr)
division = Division(A=avr_2, B=area.Area)
multiplication_2 = Multiplication(A=division, B="100")
panel_2 = Panel(multiplication_2)
sortcutmesh_3 = SortCutMesh(TriangulatedMeshOrCutMesh=ハイブリッド)
netbff = NetBFF(TriangulatedMeshOrCutMesh=sortcutmesh_3)  # -> CutMesh, FeatureLinesPolylines
meshedges_6 = MeshEdges(Mesh=ハイブリッド)  # -> AllE, NakedE
scale = Scale(Geometry=meshedges_3.AllE, Center=Point(0, 0, 0), Factor=Slider(1.00001, range=0..10))  # -> Geometry, Transform
scale_2 = Scale(Geometry=meshedges_6.AllE, Center=Point(0, 0, 0), Factor=Slider(1.00002, range=0..10))  # -> Geometry, Transform
cutmeshedges = CutMeshEdges(TriangulatedMeshOrCutMesh=netbff.CutMesh)  # -> MeshAllEdges, MeshNakedEdges
cutmeshedges_2 = CutMeshEdges(TriangulatedMeshOrCutMesh=sortcutmesh_3)  # -> MeshAllEdges, MeshNakedEdges
number_slider_8 = Slider(10000, range=0..10000)
crv_2 = Curve(meshedges_4.AllE)

preview_3 = CustomPreview(Geometry=ハイブリッド, Material=ColourSwatch(SwatchColor=RGBA(255, 255, 255, 80)))
previewlw_4 = CustomPreviewLineweights(Geometry=scale_2.Geometry, Shader=ColourSwatch(SwatchColor=RGB(0, 0, 255)), Thickness=number_slider_6, Absolute=False)
previewlw_5 = CustomPreviewLineweights(
    Geometry=scale.Geometry,
    Shader={diffuse=RGB(255, 105, 180), emission=RGB(76, 32, 54), shine=0.5, specular=RGB(255, 255, 255), transparency=0},
    Thickness=number_slider_6,
    Absolute=False)

merge = Merge(Data1=item.Item1, Data2=item.Item, Data3=avr)
sortcutmesh_4 = SortCutMesh(TriangulatedMeshOrCutMesh=wbweave)

previewlw_6 = CustomPreviewLineweights(
    Geometry=scale.Geometry,
    Shader=ColourSwatch(SwatchColor=RGB(0, 0, 255)),
    Thickness=Slider(2, range=0..2),
    Absolute=False)
preview_4 = CustomPreview(Geometry=元形状, Material=swatch_2)

len = Length(Curve=cutmeshedges.MeshAllEdges)
developcm2_2 = DevelopCutMesh2(
    TriangulatedCutMesh=wbweave,
    Iterations=Slider(400000, range=0..1000000),
    XyMirror=False,
    YzMirror=False,
    ZxMirror=False,
    OuterBoundaryCurves=meshedges_5.NakedE,
    Alpha=0.1)  # disabled
len_2 = Length(Curve=cutmeshedges_2.MeshAllEdges)
sortcutmesh_5 = SortCutMesh(TriangulatedMeshOrCutMesh=developcm2_2)
mbridgecm_2 = MbridgeCM(TriangulatedMeshOrCutMesh=sortcutmesh_5)
従来 = Mesh(mbridgecm_2)
meshedges_7 = MeshEdges(Mesh=従来)  # -> AllE, NakedE
scale_3 = Scale(Geometry=meshedges_7.AllE, Center=Point(0, 0, 0), Factor=Slider(1.00002, range=0..10))  # -> Geometry, Transform

preview_5 = CustomPreview(Geometry=従来, Material=ColourSwatch(SwatchColor=RGBA(255, 255, 255, 80)))
previewlw_7 = CustomPreviewLineweights(Geometry=scale_3.Geometry, Shader=ColourSwatch(SwatchColor=RGB(0, 0, 255)), Thickness=number_slider_5, Absolute=False)
previewlw_8 = CustomPreviewLineweights(
    Geometry=scale.Geometry,
    Shader={diffuse=RGB(255, 105, 180), emission=RGB(76, 32, 54), shine=0.5, specular=RGB(255, 255, 255), transparency=0},
    Thickness=number_slider_5,
    Absolute=False)

develop_2 = DevelopMesh(TriangulatedMesh=wbweave, Count=Slider(100000, range=0..100000))  # -> ModifiedMesh, A; disabled
提案 = Mesh(develop_2.ModifiedMesh)
meshedges_8 = MeshEdges(Mesh=提案)  # -> AllE, NakedE
scale_4 = Scale(Geometry=meshedges_8.AllE, Center=Point(0, 0, 0), Factor=Slider(1.00002, range=0..10))  # -> Geometry, Transform

preview_6 = CustomPreview(Geometry=提案, Material=swatch_2)
previewlw_9 = CustomPreviewLineweights(Geometry=scale_4.Geometry, Shader=ColourSwatch(SwatchColor=RGB(0, 0, 255)), Thickness=number_slider_4, Absolute=False)
previewlw_10 = CustomPreviewLineweights(
    Geometry=scale.Geometry,
    Shader={diffuse=RGB(255, 105, 180), emission=RGB(76, 32, 54), shine=0.5, specular=RGB(255, 255, 255), transparency=0},
    Thickness=number_slider_4,
    Absolute=False)

mesh_5 = Mesh(develop_2.ModifiedMesh)
mbridgecm_3 = MbridgeCM(TriangulatedMeshOrCutMesh=developcm2_2)
subtraction = Subtraction(A=len, B=len_2)
deccutmesh_3 = DeconstructCutMesh(TriangulatedMeshOrCutMesh=sortcutmesh_4)  # -> Vertices, Faces, Edges
abs = Absolute(Value=subtraction)
cutmeshgcurvature_2 = CutMeshGCurvature(TriangulatedMeshOrCutMesh=developcm2_2)
division_2 = Division(A=abs, B=len_2)
sortcutmesh_6 = SortCutMesh(TriangulatedMeshOrCutMesh=develop_2.ModifiedMesh)
meshedges_9 = MeshEdges(Mesh=develop_2.ModifiedMesh)  # -> AllE, NakedE
preview_7 = CustomPreview(Geometry=develop_2.ModifiedMesh, Material=ColourSwatch(SwatchColor=RGBA(52, 92, 65, 130)))
mesh_6 = Mesh(mbridgecm_3)
multiplication_3 = Multiplication(A=division_2, B=Slider(100, range=0..100))
sort_2 = SortList(Keys=multiplication_3)  # -> Keys, ValuesA
avr_3 = Average(Input=multiplication_3)
deccutmesh_4 = DeconstructCutMesh(TriangulatedMeshOrCutMesh=sortcutmesh_5)  # -> Vertices, Faces, Edges
preview_8 = CustomPreview(
    Geometry=develop_2.ModifiedMesh,
    Material={diffuse=RGB(221, 160, 221), emission=RGB(66, 48, 66), shine=0.5, specular=RGB(255, 255, 255), transparency=0})
previewlw_11 = CustomPreviewLineweights(Geometry=meshedges_9.AllE, Shader=ColourSwatch(SwatchColor=RGBA(0, 0, 0, 130)), Absolute=False)
abs_2 = Absolute(Value=cutmeshgcurvature_2)
lng_2 = ListLength(List=cutmeshgcurvature_2)
meshedges_10 = MeshEdges(Mesh=mbridgecm_3)  # -> AllE, NakedE
item_2 = ListItem(List=sort_2.Keys, Index=0, Wrap=True)  # -> Item1, Item
cutmeshgcurvature_3 = CutMeshGCurvature(TriangulatedMeshOrCutMesh=sortcutmesh_6)
deccutmesh_5 = DeconstructCutMesh(TriangulatedMeshOrCutMesh=sortcutmesh_6)  # -> Vertices, Faces, Edges
series = Series(Start=0, Step=1, Count=lng_2)
series_2 = Series(Start=0, Step=1, Count=Slider(30, range=0..100))
deccutmesh_6 = DeconstructCutMesh(TriangulatedMeshOrCutMesh=sortcutmesh_6)  # -> Vertices, Faces, Edges
preview_9 = CustomPreview(Geometry=mbridgecm_3, Material=ColourSwatch(SwatchColor=RGBA(52, 92, 65, 130)))
previewlw_12 = CustomPreviewLineweights(Geometry=meshedges_10.AllE, Shader=ColourSwatch(SwatchColor=RGBA(0, 0, 0, 130)), Absolute=False)
panel_3 = Panel([item_2.Item1, item_2.Item, avr_3])
x_plus_one = XPlusOne(NumberX=series_2)
lng_3 = ListLength(List=cutmeshgcurvature_3)
dist_2 = Distance(PointA=deccutmesh_3.Vertices, PointB=deccutmesh_4.Vertices)
lng_4 = ListLength(List=dist_2)
sort_3 = SortList(Keys=abs_2, ValuesA=series)  # -> Keys, ValuesA
neg = Negative(Value=x_plus_one)
gradient = Gradient(
    LowerLimit="0",
    UpperLimit="3",
    Parameter=multiplication_3,
    stops=[0: RGB(75, 107, 169), 0.247: RGB(173, 203, 249), 0.5: RGB(254, 244, 84), 0.748: RGB(234, 126, 0), 1: RGB(234, 38, 0)])
abs_3 = Absolute(Value=cutmeshgcurvature_3)
series_3 = Series(Start=0, Step=1, Count=lng_4)
object = ModelObject(Object=cutmeshedges.MeshAllEdges, Layer="a", Display=gradient)  # -> Object, Geometry, Name, Layer, Visibility, Display, Drafting, Render
series_4 = Series(Start=0, Step=1, Count=lng_3)
series_5 = Series(Start=0, Step=1, Count=Slider(30, range=0..100))
item_3 = ListItem(List=sort_3.ValuesA, Index=neg, Wrap=True)
series_6 = Series(Start=0, Step=1, Count=Slider(59, range=0..100))
x_plus_one_2 = XPlusOne(NumberX=series_5)
avr_4 = Average(Input=sort_3.Keys)
item_4 = ListItem(List=sort_3.Keys, Index=0, Wrap=True)  # -> Item1, Item
avr_5 = Average(Input=dist_2)
x_plus_one_3 = XPlusOne(NumberX=series_6)
sort_4 = SortList(Keys=abs_3, ValuesA=series_4)  # -> Keys, ValuesA
sort_5 = SortList(Keys=dist_2, ValuesA=series_3)  # -> Keys, ValuesA
display = DisplayAttributes(DisplayColour=gradient)  # -> Display, DisplayColour, DisplayMode
crv_3 = Curve(object.Object)
neg_2 = Negative(Value=x_plus_one_2)
merge_2 = Merge(Data1=avr_4, Data2=item_4.Item1, Data3=item_4.Item)
neg_3 = Negative(Value=x_plus_one_3)
cache = ContentCache(Content=object.Object, Action=2)
item_5 = ListItem(List=sort_5.Keys, Index=0, Wrap=True)  # -> Item1, Item
crv_4 = Curve(flatten(cutmeshedges.MeshAllEdges))
color = DefineColor(Color=gradient, Source=cutmeshedges.MeshAllEdges)  # -> flatten(Color)
item_6 = ListItem(List=sort_5.ValuesA, Index=neg_2, Wrap=True)
item_7 = ListItem(List=sort_4.ValuesA, Index=neg_3, Wrap=True)
avr_6 = Average(Input=sort_4.Keys)
item_8 = ListItem(List=sort_4.Keys, Index=0, Wrap=True)  # -> Item1, Item
item_9 = ListItem(List=crv_4, Index=0, Wrap=True)
panel_4 = Panel(merge_2)
merge_3 = Merge(Data1=item_5.Item1, Data2=item_5.Item, Data3=avr_5)  # -> flatten(Result)
item_10 = ListItem(List=color, Index=0, Wrap=True)
merge_4 = Merge(Data1=avr_6, Data2=item_8.Item1, Data3=item_8.Item)
panel_5 = Panel(merge_3)
ef_att = EleFrontAttributes(Layer="s", ColourSource=gradient, maintainBakeName=False)  # -> Attributes, Keys, Values, Name, Layer, ColourSource, DisplayColour, MaterialSource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
item_11 = ListItem(List=deccutmesh_6.Vertices, Index=item_7, Wrap=True)
panel_6 = Panel(merge_4)
panel_7 = Panel("ele")
panel_8 = Panel(color)
bake = BakeObjects(Geometry=object.Object, Attributes=ef_att.Attributes, Bake=False, createGroups=False)  # -> Message, Ghosts
