# Grasshopper definition 外皮0125.gh (Grasshopper 1.0.8)
# plug-ins: Heteroptera, MeshEdit Components, Pufferfish, Human, Crane, Hagoromo, Weaverbird, NGon_RH8

developable = Developable()
pt = Point(Point(915.5175781, 1973.361938, 224.4235382))
crv = Curve([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])
pt_2 = Point(Point(915.5175781, 1973.361938, 224.4235382))
xz = XZPlane(Origin=pt)
yz = YZPlane(Origin=pt)
xz_2 = XZPlane(Origin=pt_2)
yz_2 = YZPlane(Origin=pt_2)
dupln = RemoveDuplicateLines(Lines=crv, Tolerance=0.01)
center = Center(Geometry=dupln)  # -> Center, Dimension
外皮crv = Curve(Tree({0;0;0}: [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], {0;0;1}: [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], {0;0;2}: [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], {0;0;3}: [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], {0;0;4}: [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], {0;0;5}: [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], {0;0;6}: [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], {0;0;7}: [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], {0;0;8}: [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], {0;0;9}: [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]))
data = Data(Tree({0;0}: [0, 3712.424253, 233.2104609, 1893.171993, 2899.812874, 1893.171993, 2327.74279, 0, 3141.287001, 3443.854349], {0;1}: [18.63986381, 6.640256402, 16.56566644, 9.801354279, 7.478090285, 9.801354279, 8.761138521, 18.63986381, 6.884593793, 6.817342953], {0;2}: [0, 235, 0, 27, 95, 27, 42, 0, 111, 165]))
number_slider = Slider(0.1, range=0..0.1)
data_2 = Data(Tree({0;0}: [0, 6333.289761, 6587.924564, 5163.816044, 288.0232182, 6333.289761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], {0;1}: [1.955920081, 0.609013928, 0.6079466476, 0.6102125287, 1.822159948, 0.609013928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], {0;2}: [0, 55, 45, 35, 2, 55, 15, 25, 45, 0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]))
crv_2 = Curve(Tree({0;0;0}: [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], {0;0;1}: [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], {0;0;2}: [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], {0;0;3}: [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], {0;0;4}: [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], {0;0;5}: [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]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))
mesh = Mesh(<mesh referenced from the Rhino model>)
mesh_2 = Mesh(<mesh referenced from the Rhino model>)
geo = Geometry(mesh_2)
cmesh_from_mesh = CMeshFromMesh(Mesh=geo)
static_solver = CraneStaticSolver(
    CMesh=cmesh_from_mesh,
    Constraints=developable,
    NRIteration=50,
    CGNRIteration=100,
    Threshold=1e-13,
    Solve="true",
    IsRigidEdge=False,
    IsPanelFlat=True,
    IsFoldBlock=True,
    IsConstraint=True)  # -> CMesh, RigidOrigami, Residual
deconstruct_cmesh = DeconstructCMesh(CMesh=static_solver.CMesh)  # -> Mesh, Mountain, Valley, Boundary, Unassigned, Triangulate, Edges, Inner
mirror = Mirror(Geometry=geo, Plane=xz)  # -> Geometry, Transform
netbff = NetBFF(TriangulatedMeshOrCutMesh=deconstruct_cmesh.Mesh)  # -> CutMesh, FeatureLinesPolylines
develop_mesh = DevelopMesh(Mesh=deconstruct_cmesh.Mesh)  # -> DevelopMesh, FaceTree
merge = Merge(Data1=mirror.Geometry, Data2=geo)  # -> flatten(Result)
mirror_2 = Mirror(Geometry=merge, Plane=yz)  # -> Geometry, Transform
meshedges = MeshEdges(Mesh=mesh_2)  # -> AllE, NakedE
merge_2 = Merge(Data1=merge, Data2=mirror_2.Geometry)  # -> flatten(Result)
center_2 = Center(Geometry=meshedges.NakedE)  # -> Center, Dimension
merge_3 = Merge(Data1=flatten(center.Center), Data2=flatten(center_2.Center))
cullpt = CullDuplicates(Points=merge_3, Tolerance=0.1, CullMode=1)  # -> Points, Indices, Valence
x_minus_one = XMinusOne(NumberX=cullpt.Valence)
x_minus_one_2 = XMinusOne(NumberX=x_minus_one)
abs = Absolute(Value=x_minus_one_2)
mjoin = MeshJoin(Meshes=merge_2)
cull = CullPattern(List=dupln, CullPattern=abs)
crv_3 = Curve(cull)
geo_2 = Geometry(crv_3)
mirror_3 = Mirror(Geometry=geo_2, Plane=xz_2)  # -> Geometry, Transform
merge_4 = Merge(Data1=mirror_3.Geometry, Data2=geo_2)  # -> flatten(Result)
mirror_4 = Mirror(Geometry=merge_4, Plane=yz_2)  # -> Geometry, Transform
merge_5 = Merge(Data1=merge_4, Data2=mirror_4.Geometry)  # -> flatten(Result)
weldvertices = MeshWeldVertices(Mesh=mjoin, Tolerance=0.01)  # -> RuntimeMessage, Mesh
crv_4 = Curve(<curve referenced from the Rhino model>)
mesh_3 = Mesh(<mesh referenced from the Rhino model>)
mesh_4 = Mesh(weldvertices.Mesh)
crv_5 = Curve(merge_5)
meshedges_2 = MeshEdges(Mesh=mesh_3)  # -> AllE, NakedE
最適化後メッシュ = Mesh(<mesh referenced from the Rhino model>)
mbridgecm = MbridgeCM(TriangulatedMeshOrCutMesh=mesh_4)
group = Group(Geometry=crv_2)  # -> flatten(Group)
カットライン = Curve(crv_4)
元mesh = Mesh(mesh)
bang = ExplodeTree(Data=data_2)  # -> Branch0, Branch1, Branch2
number_slider_2 = Slider(10, range=0..10)
crv_6 = Curve([<curve referenced from the Rhino model> x888])
crv_7 = Curve(meshedges_2.AllE)
mesh_5 = Mesh(mesh_2)
number_slider_3 = Slider(98, range=94..100)
dupln_2 = RemoveDuplicateLines(Lines=crv_6, Tolerance=Slider(0.1, range=0..0.1))
meshcutbylines = MeshCutWithCutLines(TriangulatedMeshOrCutMesh=mbridgecm, OpenCutLinesPolylines=crv_5)
sort = SortList(Keys=flatten(bang.Branch0), ValuesA=group)  # -> Keys, ValuesA
meshedges_3 = MeshEdges(Mesh=元mesh)  # -> AllE, NakedE
meshedges_4 = MeshEdges(Mesh=最適化後メッシュ)  # -> AllE, NakedE
wbweave = WeaverbirdsMeshFromLinesWeaveBack(Lines=dupln_2, MaximumValence=4)
mesh_6 = Mesh(wbweave)
swatch = ColourSwatch(SwatchColor=RGB(0, 0, 255))
swatch_2 = ColourSwatch(SwatchColor=RGB(0, 0, 0))
item = ListItem(List=sort.ValuesA, Index=Slider(11, range=0..99), Wrap=True)
ungroup = Ungroup(Group=item)
panel = Panel(ungroup)
preview = CustomPreview(Geometry=最適化後メッシュ, Material=ColourSwatch(SwatchColor=RGBA(0, 0, 0, 123)))
previewlw = CustomPreviewLineweights(Geometry=カットライン, Shader=ColourSwatch(SwatchColor=RGB(255, 0, 0)), Thickness=Slider(8, range=0..10), Absolute=False)
preview_2 = CustomPreview(Geometry=元mesh, Material=ColourSwatch(SwatchColor=RGBA(0, 0, 0, 123)))
previewlw_2 = CustomPreviewLineweights(
    Geometry=meshedges_4.AllE,
    Shader=ColourSwatch(SwatchColor=RGB(0, 0, 255)),
    Thickness=Slider(4, range=0..10),
    Absolute=False)
previewlw_3 = CustomPreviewLineweights(
    Geometry=meshedges_3.AllE,
    Shader=ColourSwatch(SwatchColor=RGB(0, 0, 0)),
    Thickness=Slider(2, range=0..10),
    Absolute=False)
crv_8 = Curve(flatten(ungroup))
null = NullItem(Item=crv_8)  # -> NullFlags, InvalidFlags, Description
number_slider_4 = Slider(27, range=0..27)
mbridgecm_2 = MbridgeCM(TriangulatedMeshOrCutMesh=mesh_5)
cutmeshgcurvature = CutMeshGCurvature(TriangulatedMeshOrCutMesh=mbridgecm_2)  # -> GC, GCMap
x_minus_one_3 = XMinusOne(NumberX=null.NullFlags)
abs_2 = Absolute(Value=x_minus_one_3)
cull_2 = CullPattern(List=crv_8, CullPattern=abs_2)
sort_2 = SortList(Keys=cutmeshgcurvature.GCMap)  # -> Keys, ValuesA
mbridgecm_3 = MbridgeCM(TriangulatedMeshOrCutMesh=mesh_5)
sortcutmesh = SortCutMesh(TriangulatedMeshOrCutMesh=mbridgecm_2)
deccutmesh = DeconstructCutMesh(TriangulatedMeshOrCutMesh=sortcutmesh)  # -> Vertices, Faces, Edges, Dups
flip = FlipMatrix(Data=deccutmesh.Faces)
lng = ListLength(List=flip)  # -> flatten(Length)
item_2 = ListItem(List=lng, Index=0, Wrap=True)
meshcutbylines_2 = MeshCutWithCutLines(TriangulatedMeshOrCutMesh=sortcutmesh, OpenCutLinesPolylines=cull_2)
division = Division(A=item_2, B="100")
item_3 = ListItem(List=sort_2.Keys, Index=0, Wrap=True)  # -> Item1, Item
int = Integer(division)
cleancut = CleanCut(TriangulatedMeshOrCutMesh=meshcutbylines_2, FaceCount=int)
gradient = Gradient(
    LowerLimit=item_3.Item,
    UpperLimit=item_3.Item1,
    Parameter=cutmeshgcurvature.GCMap,
    stops=[0: RGB(234, 38, 0), 0.25: RGB(234, 126, 0), 0.5: RGB(254, 244, 84), 0.75: RGB(173, 203, 249), 1: RGB(75, 107, 169)])
curvaturegroup = CurvatureGroup(TriangulatedMeshOrCutMesh=mbridgecm_3, I=Slider(10, range=0..10))  # -> Points, TriangulatedCutMesh, Count
pt_3 = Point(curvaturegroup.Points)
mcol = MeshColours(Mesh=mesh_5, Colours=gradient)
cutopt = ClusterCutNSGAII(TriangulatedMeshOrCutMesh=sortcutmesh, PopSize=Slider(100, range=0..1000), Generations=Slider(100, range=0..1000))  # -> CutMeshes, TotalLength, DevObj, Seams; disabled
mesh_7 = Mesh(<mesh referenced from the Rhino model>)
checkdevobj = CheckDevObj(TriangulatedMeshOrCutMesh=sortcutmesh)  # -> TriangulatedMeshOrCutMesh, Obj
entwine = Entwine(Branch00=cutopt.TotalLength, Branch01=cutopt.DevObj, Branch02=cutopt.Seams, FlattenInputs=True)
crv_9 = Curve([<curve referenced from the Rhino model> x1758])
meshedges_5 = MeshEdges(Mesh=mesh_7)  # -> AllE, NakedE
crv_10 = Curve()
crv_11 = Curve(meshedges_5.AllE)
cutmeshedges = CutMeshEdges(TriangulatedMeshOrCutMesh=cutopt.CutMeshes)  # -> MeshAllEdges, MeshNakedEdges
crv_12 = Curve(<curve referenced from the Rhino model>)
wbweave_2 = WeaverbirdsMeshFromLinesWeaveBack(Lines=crv_9, MaximumValence=4)
crv_13 = Curve(<curve referenced from the Rhino model>)
meshcutbylines_3 = MeshCutWithCutLines(TriangulatedMeshOrCutMesh=wbweave_2, OpenCutLinesPolylines=crv_12)
sortcutmesh_2 = SortCutMesh(TriangulatedMeshOrCutMesh=meshcutbylines_3)
dividecutmesh = DivideCutMesh(TriangulatedMeshOrCutMesh=sortcutmesh_2)
item_4 = ListItem(List=dividecutmesh, Index=Slider(0, range=0..11), Wrap=True)
outerboundary = OuterBoundary(TriangulatedMeshOrCutMesh=sortcutmesh_2)  # -> OuterEdges, OuterVertsIndices
merge_6 = Merge(Data2=crv_13)  # -> flatten(Result)
crv_14 = Curve(<curve referenced from the Rhino model>)
merge_7 = Merge(Data1=outerboundary.OuterEdges, Data2=crv_14, Data3=crv_13)  # -> flatten(Result)
explode = Explode(Curve=merge_6, Recursive=True)  # -> flatten(Segments), Vertices
explode_2 = Explode(Curve=crv_14, Recursive=True)  # -> flatten(Segments), Vertices
_10º = PowerOf10(Value=Slider(3, range=0..10))
_10º_2 = PowerOf10(Value=Slider(1, range=0..10))
_10º_3 = PowerOf10(Value=Slider(5, range=0..10))
panel_2 = Panel("0")
developcgls = DevelopCGLS(
    TriangulatedCutMesh=sortcutmesh_2,
    InnerIter=100,
    OuterIter=Slider(100, range=0..100),
    XyMirror=False,
    YzMirror=False,
    ZxMirror=False,
    OuterBoundaryCurves=outerboundary.OuterEdges,
    FixPointsCrv=merge_7,
    UnSmoothCrv=explode.Segments,
    EdgeW=1,
    SmoothW=_10º,
    DevW=_10º_3,
    PositionW=_10º_2,
    LenRangeW=1)  # disabled
cutmeshedges_2 = CutMeshEdges(TriangulatedMeshOrCutMesh=developcgls)  # -> MeshAllEdges, MeshNakedEdges
crv_15 = Curve(<curve referenced from the Rhino model>)
meshcutbylines_4 = MeshCutWithCutLines(TriangulatedMeshOrCutMesh=developcgls, OpenCutLinesPolylines=crv_15)
dupln_3 = RemoveDuplicateLines(Lines=cutmeshedges_2.MeshNakedEdges, Tolerance=0.01)
mbridgecm_4 = MbridgeCM(TriangulatedMeshOrCutMesh=developcgls)
outerboundary_2 = OuterBoundary(TriangulatedMeshOrCutMesh=developcgls)  # -> OuterEdges, OuterVertsIndices
netbff_2 = NetBFF(TriangulatedMeshOrCutMesh=meshcutbylines_4)  # -> CutMesh, FeatureLinesPolylines
deccutmesh_2 = DeconstructCutMesh(TriangulatedMeshOrCutMesh=developcgls)  # -> Vertices, Faces, Edges, Dups
deccutmesh_3 = DeconstructCutMesh(TriangulatedMeshOrCutMesh=sortcutmesh_2)  # -> Vertices, Faces, Edges, Dups
sortcutmesh_3 = SortCutMesh(TriangulatedMeshOrCutMesh=developcgls)
dividecutmesh_2 = DivideCutMesh(TriangulatedMeshOrCutMesh=sortcutmesh_3)
sortcutmesh_4 = SortCutMesh(TriangulatedMeshOrCutMesh=dividecutmesh_2)
mbridgecm_5 = MbridgeCM(TriangulatedMeshOrCutMesh=sortcutmesh_2)
checkobjective = CheckObjective(
    TriangulatedCutMesh=developcgls,
    XyMirror=False,
    YzMirror=False,
    ZxMirror=False,
    OuterBoundaryCurves=outerboundary_2.OuterEdges)
panel_3 = Panel(checkobjective)
netbfflength = NetBFFLength(TriangulatedMeshOrCutMesh=sortcutmesh_4, OuterBoundaryVertCount=-1)  # -> CutMesh, FeatureLinesPolylines; disabled
outerboundary_3 = OuterBoundary(TriangulatedMeshOrCutMesh=sortcutmesh_4)  # -> OuterEdges, OuterVertsIndices
_10º_4 = PowerOf10(Value=Slider(3, range=0..10))
area = Area(Geometry=mbridgecm_5)  # -> Area, Centroid
dist = Distance(PointA=deccutmesh_2.Vertices, PointB=deccutmesh_3.Vertices)
sqr = Square(Value=dist)
number_slider_5 = Slider(100, range=0..100)
netlbfgs2 = NetLBFGS2(TriangulatedMeshOrCutMesh=sortcutmesh_4, W0=1, W1=Slider(10, range=0..10000))  # -> CutMesh, FeatureLinesPolylines
mbridgecm_6 = MbridgeCM(TriangulatedMeshOrCutMesh=netlbfgs2.CutMesh)
lng_2 = ListLength(List=netlbfgs2.CutMesh)
series = Series(Start=0, Step=1, Count=lng_2)
division_2 = Division(A=sqr, B=area.Area)
multiplication = Multiplication(A=series, B=Slider(397, range=0..1000))
netbff_3 = NetBFF(TriangulatedMeshOrCutMesh=mbridgecm_6)  # -> CutMesh, FeatureLinesPolylines
multiplication_2 = Multiplication(A=division_2, B="100")
sort_3 = SortList(Keys=multiplication_2)  # -> Keys, ValuesA
item_5 = ListItem(List=sort_3.Keys, Index=0, Wrap=True)  # -> Item1, Item
X = UnitX(Factor=multiplication)
movecm = MoveCutMesh(TriangulatedMeshOrCutMesh=graft(netlbfgs2.CutMesh), MoveDirection=graft(X))
deccutmesh_4 = DeconstructCutMesh(TriangulatedMeshOrCutMesh=netlbfgs2.CutMesh)  # -> Vertices, Faces, Edges, Dups
number_slider_6 = Slider(0, range=0..10)
avr = Average(Input=multiplication_2)
cutmeshedges_3 = CutMeshEdges(TriangulatedMeshOrCutMesh=movecm)  # -> MeshAllEdges, MeshNakedEdges
cutmeshedges_4 = CutMeshEdges(TriangulatedMeshOrCutMesh=sortcutmesh_4)  # -> MeshAllEdges, MeshNakedEdges
panel_4 = Panel([avr, item_5.Item1])
item_6 = ListItem(List=deccutmesh_4.Vertices, Index=Slider(100, range=0..100), Wrap=True)
crv_16 = Curve(cutmeshedges_3.MeshNakedEdges)
len = Length(Curve=flatten(cutmeshedges_4.MeshAllEdges))
len_2 = Length(Curve=flatten(cutmeshedges_3.MeshAllEdges))
cutmeshedges_5 = CutMeshEdges(TriangulatedMeshOrCutMesh=netlbfgs2.CutMesh)  # -> MeshAllEdges, MeshNakedEdges
subtraction = Subtraction(A=len_2, B=len)
abs_3 = Absolute(Value=subtraction)
division_3 = Division(A=abs_3, B=len)
cutmeshedges_6 = CutMeshEdges(TriangulatedMeshOrCutMesh=developcgls)  # -> MeshAllEdges, MeshNakedEdges
join = JoinCurves(Curves=cutmeshedges_5.MeshNakedEdges, Preserve=False)
multiplication_3 = Multiplication(A=division_3, B=Slider(100, range=0..100))
sort_4 = SortList(Keys=multiplication_3)  # -> Keys, ValuesA
avr_2 = Average(Input=multiplication_3)
mbridgecm_7 = MbridgeCM(TriangulatedMeshOrCutMesh=developcgls)
item_7 = ListItem(List=sort_4.Keys, Index=0, Wrap=True)  # -> Item1, Item
panel_5 = Panel([item_7.Item1, avr_2])
meshedges_6 = MeshEdges(Mesh=mbridgecm_7)  # -> AllE, NakedE
gradient_2 = Gradient(
    LowerLimit="0",
    UpperLimit="3",
    Parameter=multiplication_3,
    stops=[0: RGB(75, 107, 169), 0.247: RGB(173, 203, 249), 0.5: RGB(254, 244, 84), 0.748: RGB(234, 126, 0), 1: RGB(234, 38, 0)])
meshedges_7 = MeshEdges(Mesh=mesh_5)  # -> AllE, NakedE
object = ModelObject(Object=cutmeshedges_3.MeshAllEdges, Layer="39s2d3p0", Display=gradient_2)  # -> Object, Geometry, Name, Layer, Visibility, Display, Drafting, Render
swatch_3 = ColourSwatch(SwatchColor=RGB(0, 0, 255))

preview_3 = CustomPreview(Geometry=mesh_5, Material=ColourSwatch(SwatchColor=RGBA(128, 128, 128, 190)))
previewlw_4 = CustomPreviewLineweights(Geometry=crv_8, Shader=swatch_3, Thickness=Slider(2, range=0..2), Absolute=False)

preview_4 = CustomPreview(Geometry=mbridgecm_7, Material=ColourSwatch(SwatchColor=RGBA(128, 128, 128, 190)))
previewlw_5 = CustomPreviewLineweights(Geometry=meshedges_6.AllE, Shader=swatch_3, Thickness=Slider(2, range=0..2), Absolute=False)  # disabled
previewlw_6 = CustomPreviewLineweights(
    Geometry=meshedges_7.AllE,
    Shader={diffuse=RGB(255, 105, 180), emission=RGB(76, 32, 54), shine=0.5, specular=RGB(255, 255, 255), transparency=0},
    Thickness=Slider(1.5, range=0..2),
    Absolute=False)

mesh_8 = Mesh(mbridgecm_7)
crv_17 = Curve(cutmeshedges_6.MeshNakedEdges)
cache = ContentCache(Content=object.Object, Action=2)
