# Grasshopper definition 奥村メッシュ.gh (Grasshopper 1.0.8)
# plug-ins: Pufferfish, Hagoromo, Weaverbird, NGon_RH8

crv = Curve([<curve referenced from the Rhino model> x3])
crv_2 = Curve([<curve referenced from the Rhino model> x2])
item = ListItem(List=crv_2, Index=0, Wrap=True)
panel = Panel("""0
1""")
number_slider = Slider(1000, range=0..1000)
_10º = PowerOf10(Value=Slider(2, range=-10..10))
_10º_2 = PowerOf10(Value=Slider(3, range=-10..10))
_10º_3 = PowerOf10(Value=Slider(-1, range=-10..10))
_10º_4 = PowerOf10(Value=Slider(4, range=-10..10))
_10º_5 = PowerOf10(Value=Slider(3, range=-10..10))
panel_2 = Panel("-0.05")
sortcutmesh = SortCutMesh()
crv_3 = Curve([<curve referenced from the Rhino model> x3])
item_2 = ListItem(List=crv_3, Index=0, Wrap=True)
panel_3 = Panel("""0
1""")
number_slider_2 = Slider(1000, range=0..1000)
_10º_6 = PowerOf10(Value=Slider(2, range=-10..10))
_10º_7 = PowerOf10(Value=Slider(3, range=-10..10))
_10º_8 = PowerOf10(Value=Slider(-1, range=-10..10))
_10º_9 = PowerOf10(Value=Slider(4, range=-10..10))
crv_4 = Curve(<curve referenced from the Rhino model>)
_10º_10 = PowerOf10(Value=Slider(-1, range=-10..10))
_10º_11 = PowerOf10(Value=Slider(3, range=-10..10))
_10º_12 = PowerOf10(Value=Slider(-1, range=-10..10))
_10º_13 = PowerOf10(Value=Slider(4, range=-10..10))
number_slider_3 = Slider(2, range=-10..10)
_10º_14 = PowerOf10(Value=number_slider_3)
crv_5 = Curve([<curve referenced from the Rhino model> x1732])
series = Series(Start=0, Step=1, Count=Slider(34, range=0..100))
_10º_15 = PowerOf10(Value=number_slider_3)
_10º_16 = PowerOf10(Value=Slider(3, range=-10..10))
wbweave = WeaverbirdsMeshFromLinesWeaveBack(Lines=crv_5, MaximumValence=4)
cutmeshgcurvature = CutMeshGCurvature(TriangulatedMeshOrCutMesh=wbweave)  # -> GC, GCMap
sort = SortList(Keys=cutmeshgcurvature.GCMap)  # -> Keys, ValuesA
item_3 = ListItem(List=sort.Keys, Index=0, Wrap=True)  # -> Item1, Item
gradient = Gradient(
    LowerLimit="-0.05",
    UpperLimit=item_3.Item1,
    Parameter=cutmeshgcurvature.GCMap,
    stops=[0: RGB(234, 38, 0), 0.25: RGB(234, 126, 0), 0.5: RGB(254, 244, 84), 0.75: RGB(173, 203, 249), 1: RGB(75, 107, 169)])
panel_4 = Panel(sort.Keys)
mcol = MeshColours(Mesh=wbweave, Colours=gradient)
meshedges = MeshEdges(Mesh=wbweave)  # -> AllE, NakedE
join = JoinCurves(Curves=meshedges.NakedE, Preserve=False)
sortcutmesh_2 = SortCutMesh()
explode = Explode(Curve=join, Recursive=True)  # -> Segments, Vertices
_10º_17 = PowerOf10(Value=Slider(3, range=-10..10))
_10º_18 = PowerOf10(Value=Slider(0, range=-10..10))
mbridgecm = MbridgeCM(TriangulatedMeshOrCutMesh=wbweave)
number_slider_4 = Slider(1000, range=0..1000)
panel_5 = Panel(join)
_10º_19 = PowerOf10(Value=Slider(3, range=-10..10))
_10º_20 = PowerOf10(Value=Slider(-1, range=-10..10))
_10º_21 = PowerOf10(Value=Slider(4, range=-10..10))
mesh = Mesh(<mesh referenced from the Rhino model>)
number_slider_5 = Slider(4, range=0..10)
mesh_2 = Mesh(<mesh referenced from the Rhino model>)
panel_6 = Panel("""1519
1529
1559
1514""")
developcgls = DevelopCGLS(
    TriangulatedCutMesh=mbridgecm,
    InnerIter=100,
    OuterIter=Slider(100, range=0..1000),
    XyMirror=False,
    YzMirror=False,
    ZxMirror=False,
    OuterBoundaryCurves=meshedges.NakedE,
    FixPointsCrv=meshedges.NakedE,
    EdgeW=_10º_20,
    SmoothW=_10º_21,
    DevW=_10º_19,
    PositionW=1,
    LenRangeW=1)  # disabled
crv_6 = Curve(<curve referenced from the Rhino model>)
number_slider_6 = Slider(1514, range=1500..1560)
mbridgecm_2 = MbridgeCM(TriangulatedMeshOrCutMesh=mesh_2)
number_slider_7 = Slider(1417, range=1400..1420)
cutmeshedges = CutMeshEdges(TriangulatedMeshOrCutMesh=developcgls)  # -> MeshAllEdges, MeshNakedEdges
_10º_22 = PowerOf10(Value=Slider(3, range=-10..10))
number_slider_8 = Slider(1000, range=0..1000)
_10º_23 = PowerOf10(Value=Slider(-3, range=-4..10))
_10º_24 = PowerOf10(Value=Slider(4, range=0..10))
mbridgecm_3 = MbridgeCM(TriangulatedMeshOrCutMesh=mesh)
meshcutbylines = MeshCutWithCutLines(TriangulatedMeshOrCutMesh=mbridgecm_3, OpenCutLinesPolylines=crv_2)
meshcutbylines_2 = MeshCutWithCutLines(TriangulatedMeshOrCutMesh=mbridgecm_3, OpenCutLinesPolylines=crv_3)
sortcutmesh_3 = SortCutMesh(TriangulatedMeshOrCutMesh=mbridgecm_3)
deccutmesh = DeconstructCutMesh(TriangulatedMeshOrCutMesh=sortcutmesh_3)  # -> Vertices, Faces, Edges
item_4 = ListItem(List=deccutmesh.Vertices, Index=0, Wrap=True)
cutbytear = CutByTear(Triangulated3dCutMesh=mbridgecm_3, Iterations=Slider(2, range=0..100), W0=_10º_17, W1=_10º_18)  # -> Triangulated3dCutMesh, Triangulated2dCutMesh
item_5 = ListItem(List=cutbytear.Triangulated3dCutMesh, Index=Slider(2, range=0..10), Wrap=True)
series_2 = Series(Start=Slider(1001, range=0..10000), Step=1, Count=Slider(556, range=0..1000))
meshcutbylines_3 = MeshCutWithCutLines(TriangulatedMeshOrCutMesh=mbridgecm_2, OpenCutLinesPolylines=crv_6)  # disabled
cutmeshedges_2 = CutMeshEdges(TriangulatedMeshOrCutMesh=developcgls)  # -> MeshAllEdges, MeshNakedEdges
meshedges_2 = MeshEdges(Mesh=mesh)  # -> AllE, NakedE
crv_7 = Curve(meshedges_2.AllE)
crv_8 = Curve(meshedges_2.NakedE)
merge = Merge(Data1=crv_8)  # -> flatten(Result)
item_6 = ListItem(List=crv_8, Index=panel, Wrap=True)
crv_9 = Curve(crv_8)
join_2 = JoinCurves(Curves=crv_9, Preserve=False)
merge_2 = Merge(Data1=join_2, Data2=crv_2)  # -> flatten(Result)
developcgls_2 = DevelopCGLS(
    TriangulatedCutMesh=meshcutbylines,
    InnerIter=100,
    OuterIter=Slider(500, range=0..1000),
    XyMirror=False,
    YzMirror=False,
    ZxMirror=False,
    OuterBoundaryCurves=crv_8,
    EdgeW="0",
    SmoothW=_10º_4,
    DevW=_10º_2,
    PositionW=_10º,
    LenRangeW="0",
    SmoothingPolylines=merge_2)  # disabled
mbridgecm_4 = MbridgeCM(TriangulatedMeshOrCutMesh=developcgls_2)
weld = WeldMesh(Mesh=mbridgecm_4, Angle=3.141592654)
cutmeshgcurvature_2 = CutMeshGCurvature(TriangulatedMeshOrCutMesh=weld)  # -> GC, GCMap
sort_2 = SortList(Keys=cutmeshgcurvature_2.GCMap)  # -> Keys, ValuesA
item_7 = ListItem(List=sort_2.Keys, Index=0, Wrap=True)  # -> Item1, Item
cutmeshedges_3 = CutMeshEdges(TriangulatedMeshOrCutMesh=developcgls_2)  # -> MeshAllEdges, MeshNakedEdges
checkobjective = CheckObjective(
    TriangulatedCutMesh=developcgls_2,
    XyMirror=False,
    YzMirror=False,
    ZxMirror=False,
    OuterBoundaryCurves=cutmeshedges_3.MeshNakedEdges)
mbridgecm_5 = MbridgeCM(TriangulatedMeshOrCutMesh=developcgls_2)
panel_7 = Panel(checkobjective)
netlbfgs2 = NetLBFGS2(TriangulatedMeshOrCutMesh=developcgls_2, W0=_10º_5, W1=1)  # -> CutMesh, FeatureLinesPolylines
gradient_2 = Gradient(
    LowerLimit=item_7.Item,
    UpperLimit=item_7.Item1,
    Parameter=cutmeshgcurvature_2.GCMap,
    stops=[0: RGB(234, 38, 0), 0.5: RGB(254, 244, 84), 0.75: RGB(173, 203, 249), 1: RGB(75, 107, 169)])
panel_8 = Panel(sort_2.Keys)
mcol_2 = MeshColours(Mesh=weld, Colours=gradient_2)
merge_3 = Merge(Data1=crv_8)  # -> flatten(Result)
item_8 = ListItem(List=crv_8, Index=panel_3, Wrap=True)
crv_10 = Curve(crv_8)
join_3 = JoinCurves(Curves=crv_10, Preserve=False)
merge_4 = Merge(Data1=join_3, Data2=crv_3)  # -> flatten(Result)
developcgls_3 = DevelopCGLS(
    TriangulatedCutMesh=meshcutbylines_2,
    InnerIter=100,
    OuterIter=Slider(500, range=0..1000),
    XyMirror=False,
    YzMirror=False,
    ZxMirror=False,
    OuterBoundaryCurves=crv_8,
    EdgeW="0",
    SmoothW=_10º_9,
    DevW=_10º_7,
    PositionW=_10º_6,
    LenRangeW="0",
    SmoothingPolylines=merge_4)  # disabled
cutmeshedges_4 = CutMeshEdges(TriangulatedMeshOrCutMesh=developcgls_3)  # -> MeshAllEdges, MeshNakedEdges
checkobjective_2 = CheckObjective(
    TriangulatedCutMesh=developcgls_3,
    XyMirror=False,
    YzMirror=False,
    ZxMirror=False,
    OuterBoundaryCurves=cutmeshedges_4.MeshNakedEdges)
mbridgecm_6 = MbridgeCM(TriangulatedMeshOrCutMesh=developcgls_3)
meshedges_3 = MeshEdges(Mesh=mbridgecm_6)  # -> AllE, NakedE
meshcutbylines_4 = MeshCutWithCutLines(TriangulatedMeshOrCutMesh=mbridgecm_6, OpenCutLinesPolylines=crv_4)  # disabled
developcgls_4 = DevelopCGLS(
    TriangulatedCutMesh=meshcutbylines_4,
    InnerIter=100,
    OuterIter=Slider(100, range=0..1000),
    XyMirror=False,
    YzMirror=False,
    ZxMirror=False,
    OuterBoundaryCurves=meshedges_3.NakedE,
    EdgeW="0",
    SmoothW=_10º_13,
    DevW=_10º_11,
    PositionW=_10º_10,
    LenRangeW="0")  # disabled
panel_9 = Panel(checkobjective_2)
netlbfgs2_2 = NetLBFGS2(TriangulatedMeshOrCutMesh=developcgls_3, W0=_10º_16, W1=1)  # -> CutMesh, FeatureLinesPolylines
mbridgecm_7 = MbridgeCM(TriangulatedMeshOrCutMesh=developcgls_4)
meshedges_4 = MeshEdges(Mesh=mbridgecm_7)  # -> AllE, NakedE
checkobjective_3 = CheckObjective(
    TriangulatedCutMesh=developcgls_4,
    XyMirror=False,
    YzMirror=False,
    ZxMirror=False,
    OuterBoundaryCurves=meshedges_4.NakedE)
panel_10 = Panel(checkobjective_3)
sortcutmesh_4 = SortCutMesh(TriangulatedMeshOrCutMesh=developcgls_3)
_10º_25 = PowerOf10(Value=Slider(3, range=-10..10))
_10º_26 = PowerOf10(Value=Slider(-1, range=-10..10))
_10º_27 = PowerOf10(Value=Slider(4, range=-10..10))
netlbfgs2_3 = NetLBFGS2(TriangulatedMeshOrCutMesh=sortcutmesh_4, W0=_10º_22, W1=1)  # -> CutMesh, FeatureLinesPolylines
panel_11 = Panel("""1417
1414""")
series_3 = Series(Start=_10º_24, Step="0", Count="6")  # -> flatten(Series)
item_9 = ListItem(List=cutmeshedges.MeshAllEdges, Index=panel_6, Wrap=True)
checkobjective_4 = CheckObjective(
    TriangulatedCutMesh=developcgls,
    XyMirror=False,
    YzMirror=False,
    ZxMirror=False,
    OuterBoundaryCurves=cutmeshedges_2.MeshNakedEdges)
panel_12 = Panel(checkobjective_4)
sortcutmesh_5 = SortCutMesh(TriangulatedMeshOrCutMesh=meshcutbylines_3)
item_10 = ListItem(List=cutmeshedges.MeshAllEdges, Index=panel_11, Wrap=True)
developcgls_5 = DevelopCGLS(
    TriangulatedCutMesh=mbridgecm_3,
    InnerIter=100,
    OuterIter=Slider(100, range=0..1000),
    XyMirror=False,
    YzMirror=False,
    ZxMirror=False,
    OuterBoundaryCurves=crv_8,
    FixPointsCrv=crv_8,
    EdgeW=_10º_26,
    SmoothW=_10º_27,
    DevW=_10º_25,
    PositionW=1,
    LenRangeW=1)  # disabled
deccutmesh_2 = DeconstructCutMesh(TriangulatedMeshOrCutMesh=developcgls_5)  # -> Vertices, Faces, Edges
dist = Distance(PointA=deccutmesh_2.Vertices, PointB=deccutmesh.Vertices)
lng = ListLength(List=dist)
item_11 = ListItem(List=deccutmesh_2.Vertices, Index=0, Wrap=True)
series_4 = Series(Start=0, Step=1, Count=lng)
neg = Negative(Value=dist)
sort_3 = SortList(Keys=neg, ValuesA=series_4)  # -> Keys, ValuesA
item_12 = ListItem(List=sort_3.ValuesA, Index=series, Wrap=True)
item_13 = ListItem(List=deccutmesh_2.Vertices, Index=item_12, Wrap=True)
cutmeshedges_5 = CutMeshEdges(TriangulatedMeshOrCutMesh=sortcutmesh_4)  # -> MeshAllEdges, MeshNakedEdges
merge_5 = Merge(Data1=_10º_23, Data2=series_3)
cutmeshedges_6 = CutMeshEdges(TriangulatedMeshOrCutMesh=netlbfgs2_3.CutMesh)  # -> MeshAllEdges, MeshNakedEdges
merge_6 = Merge(Data1=item_9, Data2=item_10)
meshcutbylines_5 = MeshCutWithCutLines(TriangulatedMeshOrCutMesh=developcgls, OpenCutLinesPolylines=item_9)
sortcutmesh_6 = SortCutMesh(TriangulatedMeshOrCutMesh=meshcutbylines_5)
meshcutbylines_6 = MeshCutWithCutLines(TriangulatedMeshOrCutMesh=developcgls, OpenCutLinesPolylines=merge_6)
netbff = NetBFF(TriangulatedMeshOrCutMesh=developcgls)  # -> CutMesh, FeatureLinesPolylines
panel_13 = Panel(merge_5)
len = Length(Curve=cutmeshedges_5.MeshAllEdges)
len_2 = Length(Curve=cutmeshedges_6.MeshAllEdges)
netbfflength = NetBFFLength(TriangulatedMeshOrCutMesh=developcgls, OuterBoundaryVertCount="70")  # -> CutMesh, FeatureLinesPolylines
netlbfgs = NetLBFGS(TriangulatedMeshOrCutMesh=developcgls, HasHole="true", W0=1, W1=1, Switch=False)  # -> CutMesh, FeatureLinesPolylines
cutmeshedges_7 = CutMeshEdges(TriangulatedMeshOrCutMesh=sortcutmesh_5)  # -> MeshAllEdges, MeshNakedEdges
developcm5 = DevelopCutMesh5(
    TriangulatedCutMesh=mbridgecm_3,
    Iterations=Slider(100, range=0..1000),
    XyMirror=False,
    YzMirror=False,
    ZxMirror=False,
    OuterBoundaryCurves=meshedges_2.NakedE,
    Weight=merge_5)  # disabled
cutmeshedges_8 = CutMeshEdges(TriangulatedMeshOrCutMesh=developcgls_5)  # -> MeshAllEdges, MeshNakedEdges
checkobjective_5 = CheckObjective(
    TriangulatedCutMesh=developcgls_5,
    XyMirror=False,
    YzMirror=False,
    ZxMirror=False,
    OuterBoundaryCurves=cutmeshedges_8.MeshNakedEdges)
dividecutmesh = DivideCutMesh(TriangulatedMeshOrCutMesh=meshcutbylines_6)
subtraction = Subtraction(A=len, B=len_2)
abs = Absolute(Value=subtraction)
avr = Average(Input=abs)
cutmeshedges_9 = CutMeshEdges(TriangulatedMeshOrCutMesh=sortcutmesh_6)  # -> MeshAllEdges, MeshNakedEdges
lng_2 = ListLength(List=cutmeshedges_9.MeshNakedEdges)  # -> flatten(Length)
netbff2 = NetBFF2(TriangulatedMeshOrCutMesh=developcgls, OuterBoundaryVertCount="70")  # -> CutMesh, FeatureLinesPolylines
sortcutmesh_7 = SortCutMesh(TriangulatedMeshOrCutMesh=dividecutmesh)
panel_14 = Panel(checkobjective_5)
crv_11 = Curve(cutmeshedges_7.MeshNakedEdges)
panel_15 = Panel(avr)
item_14 = ListItem(List=sortcutmesh_7, Index=0, Wrap=True)  # -> flatten(Item), Item1
netbfflength_2 = NetBFFLength(TriangulatedMeshOrCutMesh=sortcutmesh_6, OuterBoundaryVertCount=lng_2)  # -> CutMesh, FeatureLinesPolylines
cutmeshedges_10 = CutMeshEdges(TriangulatedMeshOrCutMesh=item_14.Item)  # -> MeshAllEdges, MeshNakedEdges
lng_3 = ListLength(List=cutmeshedges_10.MeshNakedEdges)  # -> flatten(Length)
netbfflength_3 = NetBFFLength(TriangulatedMeshOrCutMesh=item_14.Item, OuterBoundaryVertCount=lng_3)  # -> CutMesh, FeatureLinesPolylines
mbridgecm_8 = MbridgeCM(TriangulatedMeshOrCutMesh=netbfflength_2.CutMesh)
cutmeshedges_11 = CutMeshEdges(TriangulatedMeshOrCutMesh=item_14.Item1)  # -> MeshAllEdges, MeshNakedEdges
lng_4 = ListLength(List=cutmeshedges_11.MeshNakedEdges)  # -> flatten(Length)
netbfflength_4 = NetBFFLength(TriangulatedMeshOrCutMesh=item_14.Item1, OuterBoundaryVertCount=lng_4)  # -> CutMesh, FeatureLinesPolylines
cutmeshedges_12 = CutMeshEdges(TriangulatedMeshOrCutMesh=netbfflength_3.CutMesh)  # -> MeshAllEdges, MeshNakedEdges
mbridgecm_9 = MbridgeCM(TriangulatedMeshOrCutMesh=netbfflength_3.CutMesh)
meshedges_5 = MeshEdges(Mesh=mbridgecm_8)  # -> AllE, NakedE
cutmeshedges_13 = CutMeshEdges(TriangulatedMeshOrCutMesh=netbfflength_4.CutMesh)  # -> MeshAllEdges, MeshNakedEdges
len_3 = Length(Curve=cutmeshedges_10.MeshAllEdges)
X = UnitX(Factor=Slider(149, range=0..1000))
mbridgecm_10 = MbridgeCM(TriangulatedMeshOrCutMesh=netbfflength_4.CutMesh)
len_4 = Length(Curve=cutmeshedges_12.MeshAllEdges)
subtraction_2 = Subtraction(A=len_3, B=len_4)
len_5 = Length(Curve=cutmeshedges_11.MeshAllEdges)
X_2 = UnitX(Factor=Slider(90, range=0..1000))
len_6 = Length(Curve=cutmeshedges_13.MeshAllEdges)
subtraction_3 = Subtraction(A=len_5, B=len_6)
move = Move(Geometry=mbridgecm_9, Motion=X)  # -> Geometry, Transform
crv_12 = Curve(meshedges_5.NakedE)
sqr = Square(Value=subtraction_2)
sqr_2 = Square(Value=subtraction_3)
move_2 = Move(Geometry=mbridgecm_10, Motion=X_2)  # -> Geometry, Transform
deccutmesh_3 = DeconstructCutMesh(TriangulatedMeshOrCutMesh=sortcutmesh_5)  # -> Vertices, Faces, Edges
avr_2 = Average(Input=sqr)
avr_3 = Average(Input=sqr_2)
panel_16 = Panel(avr_3)
panel_17 = Panel(avr_2)
netbff_2 = NetBFF(TriangulatedMeshOrCutMesh=sortcutmesh_5)  # -> CutMesh, FeatureLinesPolylines
netbfflength_5 = NetBFFLength(TriangulatedMeshOrCutMesh=sortcutmesh_5, OuterBoundaryVertCount=-1)  # -> CutMesh, FeatureLinesPolylines

# ----
# 長さの最適化まで入れたら長さのずれが0.1倍になった
cutmeshedges_14 = CutMeshEdges(TriangulatedMeshOrCutMesh=sortcutmesh_5)  # -> MeshAllEdges, MeshNakedEdges
cutmeshedges_15 = CutMeshEdges(TriangulatedMeshOrCutMesh=netbfflength_5.CutMesh)  # -> MeshAllEdges, MeshNakedEdges
cutmeshedges_16 = CutMeshEdges(TriangulatedMeshOrCutMesh=netbff_2.CutMesh)  # -> MeshAllEdges, MeshNakedEdges
len_7 = Length(Curve=cutmeshedges_14.MeshAllEdges)
len_8 = Length(Curve=cutmeshedges_16.MeshAllEdges)
len_9 = Length(Curve=cutmeshedges_14.MeshAllEdges)
len_10 = Length(Curve=cutmeshedges_15.MeshAllEdges)
subtraction_4 = Subtraction(A=len_8, B=len_7)
subtraction_5 = Subtraction(A=len_10, B=len_9)
abs_2 = Absolute(Value=subtraction_4)
abs_3 = Absolute(Value=subtraction_5)
sort_4 = SortList(Keys=abs_2)  # -> Keys, ValuesA
avr_4 = Average(Input=abs_2)
sort_5 = SortList(Keys=abs_3)  # -> Keys, ValuesA
avr_5 = Average(Input=abs_3)
item_15 = ListItem(List=sort_4.Keys, Index=0, Wrap=True)  # -> Item1, Item
item_16 = ListItem(List=sort_5.Keys, Index=0, Wrap=True)  # -> Item1, Item
merge_7 = Merge(Data1=item_15.Item1, Data2=item_15.Item, Data3=avr_4)  # -> flatten(Result)
merge_8 = Merge(Data1=item_16.Item1, Data2=item_16.Item, Data3=avr_5)  # -> flatten(Result)
panel_18 = Panel(merge_7)
panel_19 = Panel(merge_8)

# ----
# Selfのみ
number_slider_9 = Slider(190, range=0..10000)
developcm3 = DevelopCutMesh3(
    TriangulatedCutMesh=sortcutmesh_5,
    Iterations=number_slider_9,
    XyMirror=False,
    YzMirror=False,
    ZxMirror=False,
    OuterBoundaryCurves=crv_11,
    Alpha=Slider(0.1, range=0..0.1))
deccutmesh_4 = DeconstructCutMesh(TriangulatedMeshOrCutMesh=developcm3)  # -> Vertices, Faces, Edges

mbridgecm_11 = MbridgeCM(TriangulatedMeshOrCutMesh=developcm3)
preview = CustomPreview(
    Geometry=mbridgecm_11,
    Material={diffuse=RGB(221, 160, 221), emission=RGB(66, 48, 66), shine=0.5, specular=RGB(255, 255, 255), transparency=0})
sortcutmesh_8 = SortCutMesh(TriangulatedMeshOrCutMesh=developcm3)
cutmeshedges_17 = CutMeshEdges(TriangulatedMeshOrCutMesh=sortcutmesh_8)  # -> MeshAllEdges, MeshNakedEdges
netbff_3 = NetBFF(TriangulatedMeshOrCutMesh=developcm3)  # -> CutMesh, FeatureLinesPolylines
netbfflength_6 = NetBFFLength(TriangulatedMeshOrCutMesh=developcm3, OuterBoundaryVertCount=-1)  # -> CutMesh, FeatureLinesPolylines

# ----
# 長さの最適化まで入れたら長さのずれが0.1倍になった
cutmeshedges_18 = CutMeshEdges(TriangulatedMeshOrCutMesh=developcm3)  # -> MeshAllEdges, MeshNakedEdges
cutmeshedges_19 = CutMeshEdges(TriangulatedMeshOrCutMesh=netbfflength_6.CutMesh)  # -> MeshAllEdges, MeshNakedEdges
cutmeshedges_20 = CutMeshEdges(TriangulatedMeshOrCutMesh=netbff_3.CutMesh)  # -> MeshAllEdges, MeshNakedEdges
len_11 = Length(Curve=cutmeshedges_18.MeshAllEdges)
len_12 = Length(Curve=cutmeshedges_20.MeshAllEdges)
len_13 = Length(Curve=cutmeshedges_18.MeshAllEdges)
len_14 = Length(Curve=cutmeshedges_19.MeshAllEdges)
subtraction_6 = Subtraction(A=len_12, B=len_11)
subtraction_7 = Subtraction(A=len_14, B=len_13)
abs_4 = Absolute(Value=subtraction_6)
abs_5 = Absolute(Value=subtraction_7)
sort_6 = SortList(Keys=abs_4)  # -> Keys, ValuesA
avr_6 = Average(Input=abs_4)
sort_7 = SortList(Keys=abs_5)  # -> Keys, ValuesA
avr_7 = Average(Input=abs_5)
item_17 = ListItem(List=sort_6.Keys, Index=0, Wrap=True)  # -> Item1, Item
item_18 = ListItem(List=sort_7.Keys, Index=0, Wrap=True)  # -> Item1, Item
merge_9 = Merge(Data1=item_17.Item1, Data2=item_17.Item, Data3=avr_6)  # -> flatten(Result)
merge_10 = Merge(Data1=item_18.Item1, Data2=item_18.Item, Data3=avr_7)  # -> flatten(Result)
panel_20 = Panel(merge_9)
panel_21 = Panel(merge_10)

cruling = CheckRuling(TriangulatedDevelopableCutMesh=sortcutmesh_8, Lines=cutmeshedges_17.MeshNakedEdges)
panel_22 = Panel(cruling)

develop = DevelopMesh()  # -> ModifiedMesh, A
sortcutmesh_9 = SortCutMesh(TriangulatedMeshOrCutMesh=develop.ModifiedMesh)
deccutmesh_5 = DeconstructCutMesh(TriangulatedMeshOrCutMesh=sortcutmesh_9)  # -> Vertices, Faces, Edges

cutmeshgcurvature_3 = CutMeshGCurvature(TriangulatedMeshOrCutMesh=sortcutmesh_5)  # -> GC, GCMap
abs_6 = Absolute(Value=cutmeshgcurvature_3.GC)
lng_5 = ListLength(List=cutmeshgcurvature_3.GC)
series_5 = Series(Start=0, Step=1, Count=lng_5)
series_6 = Series(Start=0, Step=1, Count=Slider(30, range=0..100))
sort_8 = SortList(Keys=abs_6, ValuesA=series_5)  # -> Keys, ValuesA

x_plus_one = XPlusOne(NumberX=series_6)
avr_8 = Average(Input=sort_8.Keys)
item_19 = ListItem(List=sort_8.Keys, Index=0, Wrap=True)  # -> Item1, Item
merge_11 = Merge(Data1=avr_8, Data2=item_19.Item1, Data3=item_19.Item)

neg_2 = Negative(Value=x_plus_one)
item_20 = ListItem(List=sort_8.ValuesA, Index=neg_2, Wrap=True)
item_21 = ListItem(List=deccutmesh_3.Vertices, Index=item_20, Wrap=True)
panel_23 = Panel(merge_11)

cutmeshgcurvature_4 = CutMeshGCurvature(TriangulatedMeshOrCutMesh=sortcutmesh_9)  # -> GC, GCMap
lng_6 = ListLength(List=cutmeshgcurvature_4.GC)
abs_7 = Absolute(Value=cutmeshgcurvature_4.GC)
series_7 = Series(Start=0, Step=1, Count=lng_6)
series_8 = Series(Start=0, Step=1, Count=10)
sort_9 = SortList(Keys=abs_7, ValuesA=series_7)  # -> Keys, ValuesA

x_plus_one_2 = XPlusOne(NumberX=series_8)
avr_9 = Average(Input=sort_9.Keys)
item_22 = ListItem(List=sort_9.Keys, Index=0, Wrap=True)  # -> Item1, Item
merge_12 = Merge(Data1=avr_9, Data2=item_22.Item1, Data3=item_22.Item)

neg_3 = Negative(Value=x_plus_one_2)
item_23 = ListItem(List=sort_9.ValuesA, Index=neg_3, Wrap=True)
panel_24 = Panel(merge_12)
item_24 = ListItem(List=deccutmesh_5.Vertices, Index=item_23, Wrap=True)

deccutmesh_6 = DeconstructCutMesh(TriangulatedMeshOrCutMesh=developcm3)  # -> Vertices, Faces, Edges
dist_2 = Distance(PointB=deccutmesh_6.Vertices)
lng_7 = ListLength(List=dist_2)
series_9 = Series(Start=0, Step=1, Count=lng_7)
series_10 = Series(Start=0, Step=1, Count=Slider(30, range=0..100))
avr_10 = Average(Input=dist_2)
sort_10 = SortList(Keys=dist_2, ValuesA=series_9)  # -> Keys, ValuesA
item_25 = ListItem(List=sort_10.Keys, Index=0, Wrap=True)  # -> Item1, Item
merge_13 = Merge(Data1=item_25.Item1, Data2=item_25.Item, Data3=avr_10)  # -> flatten(Result)
panel_25 = Panel(merge_13)

cutmeshgcurvature_5 = CutMeshGCurvature(TriangulatedMeshOrCutMesh=developcm3)  # -> GC, GCMap
abs_8 = Absolute(Value=cutmeshgcurvature_5.GC)
lng_8 = ListLength(List=cutmeshgcurvature_5.GC)
series_11 = Series(Start=0, Step=1, Count=lng_8)
series_12 = Series(Start=0, Step=1, Count=Slider(30, range=0..100))
sort_11 = SortList(Keys=abs_8, ValuesA=series_11)  # -> Keys, ValuesA

x_plus_one_3 = XPlusOne(NumberX=series_10)
x_plus_one_4 = XPlusOne(NumberX=series_12)
avr_11 = Average(Input=sort_11.Keys)
item_26 = ListItem(List=sort_11.Keys, Index=0, Wrap=True)  # -> Item1, Item
merge_14 = Merge(Data1=avr_11, Data2=item_26.Item1, Data3=item_26.Item)

panel_26 = Panel(merge_14)
neg_4 = Negative(Value=x_plus_one_4)
item_27 = ListItem(List=sort_11.ValuesA, Index=neg_4, Wrap=True)
item_28 = ListItem(List=deccutmesh_4.Vertices, Index=item_27, Wrap=True)

neg_5 = Negative(Value=x_plus_one_3)
item_29 = ListItem(List=sort_10.ValuesA, Index=neg_5, Wrap=True)
item_30 = ListItem(Index=item_29, Wrap=True)

deccutmesh_7 = DeconstructCutMesh()  # -> Vertices, Faces, Edges
dist_3 = Distance(PointB=deccutmesh_7.Vertices)
lng_9 = ListLength(List=dist_3)
series_13 = Series(Start=0, Step=1, Count=lng_9)
series_14 = Series(Start=0, Step=1, Count=Slider(30, range=0..100))
sort_12 = SortList(Keys=dist_3, ValuesA=series_13)  # -> Keys, ValuesA
item_31 = ListItem(List=sort_12.Keys, Index=0, Wrap=True)  # -> Item1, Item
merge_15 = Merge(Data1=item_31.Item1, Data2=item_31.Item)  # -> flatten(Result)
panel_27 = Panel(merge_15)

# ----
# ハイブリッド
x_plus_one_5 = XPlusOne(NumberX=series_14)

neg_6 = Negative(Value=x_plus_one_5)
item_32 = ListItem(List=sort_12.ValuesA, Index=neg_6, Wrap=True)
item_33 = ListItem(Index=item_32, Wrap=True)
