# Grasshopper definition 放物双曲面.gh (Grasshopper 1.0.8)
# plug-ins: Pufferfish, Hagoromo, Weaverbird, NGon_RH8

crv = Curve([<curve referenced from the Rhino model> x2])
crv_2 = Curve([<curve referenced from the Rhino model> x2])
number_slider = Slider(100, range=0..100)
divide = DivideCurve(Curve=crv, Count=10, Kinks=False)  # -> Points, Tangents, Parameters
divide_2 = DivideCurve(Curve=crv_2, Count=10, Kinks=False)  # -> Points, Tangents, Parameters
mesh = Mesh(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)
bang = ExplodeTree(Data=divide.Points)  # -> Branch0, Branch1
bang_2 = ExplodeTree(Data=divide_2.Points)  # -> Branch0, Branch1
scale = Scale(Geometry=mesh, Center=Point(0, 0, 0), Factor=Slider(20, range=0..100))  # -> Geometry, Transform
ln = Line(StartPoint=bang.Branch0, EndPoint=bang.Branch1)
ln_2 = Line(StartPoint=bang_2.Branch0, EndPoint=bang_2.Branch1)
develop = DevelopMesh(TriangulatedMesh=scale.Geometry, Count=Slider(10000, range=0..10000))  # -> ModifiedMesh, A
mesh_2 = Mesh(develop.ModifiedMesh)
mbridgecm = MbridgeCM(TriangulatedMeshOrCutMesh=mesh_2)
divide_3 = DivideCurve(Curve=ln_2, Count=10, Kinks=False)  # -> Points, Tangents, Parameters
divide_4 = DivideCurve(Curve=ln, Count=10, Kinks=False)  # -> Points, Tangents, Parameters
sortcutmesh = SortCutMesh(TriangulatedMeshOrCutMesh=mbridgecm)
shatter = Shatter(Curve=graft(ln_2), Parameters=divide_3.Parameters)
shatter_2 = Shatter(Curve=graft(ln), Parameters=divide_4.Parameters)
mesh_3 = Mesh(<mesh referenced from the Rhino model>)
series = Series(Start=0, Step=1, Count=10)
cutmeshedges = CutMeshEdges(TriangulatedMeshOrCutMesh=sortcutmesh)  # -> flatten(MeshAllEdges), MeshNakedEdges
netbff = NetBFF(TriangulatedMeshOrCutMesh=sortcutmesh)  # -> CutMesh, FeatureLinesPolylines
x_plus_one = XPlusOne(NumberX=series)
meshedges = MeshEdges(Mesh=mesh_3)  # -> AllE, NakedE
cutmeshedges_2 = CutMeshEdges(TriangulatedMeshOrCutMesh=netbff.CutMesh)  # -> flatten(MeshAllEdges), MeshNakedEdges
item = ListItem(List=divide_3.Points, Index=x_plus_one, Wrap=True)
flip = FlipMatrix(Data=item)
len = Length(Curve=cutmeshedges.MeshAllEdges)
item_2 = ListItem(List=divide_3.Points, Index=series, Wrap=True)
crv_3 = Curve(meshedges.NakedE)
cull_i = CullIndex(List=flip, Indices="-1", Wrap=True)
len_2 = Length(Curve=cutmeshedges_2.MeshAllEdges)
flip_2 = FlipMatrix(Data=item_2)
cull_i_2 = CullIndex(List=flip_2, Indices="0", Wrap=True)
ln_3 = Line(StartPoint=cull_i_2, EndPoint=cull_i)
wbweave = WeaverbirdsMeshFromLinesWeaveBack(Lines=flatten([ln_3, shatter_2, shatter]), MaximumValence=4)
subtraction = Subtraction(A=len_2, B=len)
mesh_4 = Mesh(<mesh referenced from the Rhino model>)
number_slider_2 = Slider(234, range=0..1000)  # disabled
meshedges_2 = MeshEdges(Mesh=mesh_4)  # -> AllE, NakedE
mplane = MeshPlane(Boundary={Plane=PlaneXY(0, 0, 0), Size=Domain2(u=-10..10, v=-10..10)}, WidthCount=10, HeightCount=10)  # -> Mesh, Area; disabled
tri = Triangulate(Mesh=mplane.Mesh)  # -> Mesh, Count; disabled
Y = UnitY(Factor=number_slider_2)  # disabled
move = Move(Geometry=tri.Mesh, Motion=Y)  # -> Geometry, Transform; disabled
developcm3 = DevelopCutMesh3(
    TriangulatedCutMesh=mesh_4,
    Iterations=Slider(2000, range=0..10000),
    XyMirror=False,
    YzMirror=False,
    ZxMirror=False,
    OuterBoundaryCurves=meshedges_2.NakedE,
    Alpha=1)
grab = Grab(On=True, Strength=1, Range=3)  # disabled
meshedges_3 = MeshEdges(Mesh=wbweave)  # -> AllE, NakedE; disabled
cutmeshedges_3 = CutMeshEdges(TriangulatedMeshOrCutMesh=developcm3)  # -> MeshAllEdges, MeshNakedEdges
toggle = BooleanToggle(False)  # disabled
button = Button()  # disabled
length_line = LengthLine(Line=meshedges_3.AllE, Strength=10)  # disabled
show = Show(G=wbweave)  # disabled
deccutmesh = DeconstructCutMesh(TriangulatedMeshOrCutMesh=developcm3)  # -> Vertices, Faces, Edges
cruling = CheckRuling(TriangulatedDevelopableCutMesh=developcm3, Width=Slider(65, range=0..100), Lines=cutmeshedges_3.MeshNakedEdges)
solver = Solver(GoalObjects=[length_line, grab, show], Reset=button, Threshold=1e-15, Tolerance=0.0001, On=toggle)  # -> I, V, O; disabled
mesh_5 = Mesh(solver.O)  # disabled
meshedges_4 = MeshEdges(Mesh=mesh_5)  # -> AllE, NakedE; disabled
len_3 = Length(Curve=meshedges_4.AllE)  # disabled
mesh_6 = Mesh(mesh_5)  # disabled
lng = ListLength(List=cruling)
smaller = SmallerThan(FirstNumber=cruling, SecondNumber="0")  # -> SmallerThan, OrEqualTo
item_3 = ListItem(List=deccutmesh.Vertices, Index=Slider(34, range=0..100), Wrap=True)
series_2 = Series(Start=0, Step=1, Count=lng)
cull = CullPattern(List=series_2, CullPattern=smaller.SmallerThan)
addition = Addition(A="40", B=cull)
item_4 = ListItem(List=deccutmesh.Vertices, Index=addition, Wrap=True)
panel = Panel(cruling)
