# Grasshopper definition cutMeshWithCutLines.gh (Grasshopper 1.0.8)
# plug-ins: Hagoromo, Weaverbird, NGon_RH8

# ----
# カットメッシュとは
crv = Curve([<curve referenced from the Rhino model> x71])
wbweave = WeaverbirdsMeshFromLinesWeaveBack(Lines=crv, MaximumValence=4)
mbridgecm = MbridgeCM(TriangulatedMeshOrCutMesh=wbweave)
meshedges = MeshEdges(Mesh=wbweave)  # -> AllE, NakedE
panel = Panel("""47
49
53
61
4""")
item = ListItem(List=meshedges.AllE, Index=panel, Wrap=True)
item_2 = ListItem(List=meshedges.AllE, Index="78", Wrap=True)
crv_2 = Curve([<curve referenced from the Rhino model> x2])
merge = Merge(Data1=crv_2, Data2=item_2, Data3=item)  # -> flatten(Result)
meshcutbylines = MeshCutWithCutLines(TriangulatedMeshOrCutMesh=mbridgecm, OpenCutLinesPolylines=merge)
sortcutmesh = SortCutMesh(TriangulatedMeshOrCutMesh=meshcutbylines)
cutmeshedges = CutMeshEdges(TriangulatedMeshOrCutMesh=meshcutbylines)  # -> MeshAllEdges, MeshNakedEdges
dividecutmesh = DivideCutMesh(TriangulatedMeshOrCutMesh=sortcutmesh)
item_3 = ListItem(List=dividecutmesh, Index="1", Wrap=True)
sortcutmesh_2 = SortCutMesh(TriangulatedMeshOrCutMesh=item_3)
deccutmesh = DeconstructCutMesh(TriangulatedMeshOrCutMesh=sortcutmesh_2)  # -> Vertices, Faces, Edges

crv_3 = Curve([<curve referenced from the Rhino model> x18])
wbweave_2 = WeaverbirdsMeshFromLinesWeaveBack(Lines=crv_3, MaximumValence=4)
opentreemesh = OpenTreeMesh(TriangulatedDevelopableMesh=wbweave_2)  # -> CutMesh, CutLines, MeshGraph
cutmeshedges_2 = CutMeshEdges(TriangulatedCutMesh=opentreemesh.CutMesh)  # -> MeshAllEdges, MeshNakedEdges

opentreemesh_2 = OpenTreeMesh(TriangulatedDevelopableMesh=wbweave)  # -> CutMesh, CutLines, MeshGraph
mbridgecm_2 = MbridgeCM(TriangulatedMeshOrCutMesh=opentreemesh_2.CutMesh)
cutmeshedges_3 = CutMeshEdges(TriangulatedMeshOrCutMesh=opentreemesh_2.CutMesh)  # -> MeshAllEdges, MeshNakedEdges
crv_4 = Curve(cutmeshedges_3.MeshNakedEdges)
