# Grasshopper definition sampleb.gh (Grasshopper 1.0.8)
# plug-ins: ghHogan

Z = UnitZ(Factor="2000")
pt = ConstructPoint(XCoordinate="0", YCoordinate="0", ZCoordinate="0")
Z_2 = UnitZ(Factor="2000")
X = UnitX(Factor="2000")
neg = Negative(Value="2000")
pt_2 = ConstructPoint(XCoordinate="6000", YCoordinate="0", ZCoordinate="0")
move = Move(Geometry=pt, Motion=Z)  # -> Geometry, Transform
move_2 = Move(Geometry=pt_2, Motion=Z_2)  # -> Geometry, Transform
move_3 = Move(Geometry=move.Geometry, Motion=X)  # -> Geometry, Transform
Z_3 = UnitZ(Factor=neg)
X_2 = UnitX(Factor="2000")
neg_2 = Negative(Value="2000")
ln = Line(StartPoint=pt, EndPoint=move.Geometry)
crv_cp = CurveClosestPoint(Point=pt, Curve=ln)  # -> Point, Parameter, Distance
move_4 = Move(Geometry=move_2.Geometry, Motion=X_2)  # -> Geometry, Transform
move_5 = Move(Geometry=move_3.Geometry, Motion=Z_3)  # -> Geometry, Transform
Z_4 = UnitZ(Factor=neg_2)
ln_2 = Line(StartPoint=move.Geometry, EndPoint=move_3.Geometry)
crv_cp_2 = CurveClosestPoint(Point=[move_3.Geometry, move.Geometry], Curve=ln_2)  # -> Point, Parameter, Distance
ln_3 = Line(StartPoint=move_3.Geometry, EndPoint=move_5.Geometry)
crv_cp_3 = CurveClosestPoint(Point=move_5.Geometry, Curve=ln_3)  # -> Point, Parameter, Distance
icon2 = Point(crv_cp_2.Point)
ln_4 = Line(StartPoint=pt_2, EndPoint=move_2.Geometry)
crv_cp_4 = CurveClosestPoint(Point=pt_2, Curve=ln_4)  # -> Point, Parameter, Distance
move_6 = Move(Geometry=move_4.Geometry, Motion=Z_4)  # -> Geometry, Transform
vcon = Point([move_3.Geometry, move.Geometry])
merge = Merge(Data1=ln, Data2=ln_2, Data3=ln_3)
ln_5 = Line(StartPoint=move_2.Geometry, EndPoint=move_4.Geometry)
ln_6 = Line(StartPoint=move_4.Geometry, EndPoint=move_6.Geometry)
crv_cp_5 = CurveClosestPoint(Point=move_6.Geometry, Curve=ln_6)  # -> Point, Parameter, Distance
icon = Point([crv_cp.Point, crv_cp_3.Point])
icon_2 = Point([crv_cp_4.Point, crv_cp_5.Point])
vcon_2 = Point([move_4.Geometry, move_2.Geometry])
# Bclng001
elem = Geometry(merge)
merge_2 = Merge(Data1=ln_4, Data2=ln_5, Data3=ln_6)
elem_2 = Geometry(merge_2)

# ----
# VIEW
panel = Panel("""6.6
0
1.6""")
panel_2 = Panel("""0
-90.3""")
panel_3 = Panel("""5
700""")
view = VIEW(GFACT="0.5", FOCUS=panel, ANGLE=panel_2, DISTS=panel_3)

icon_3 = Point([crv_cp_4.Point, crv_cp_5.Point])
vcon_3 = Point([move_4.Geometry, move_2.Geometry])

# ----
# VIEW
panel_4 = Panel("""0.5
0
0.6""")
panel_5 = Panel("""0
-90.3""")
panel_6 = Panel("""5
4000""")
view_2 = VIEW(GFACT="0.5", FOCUS=panel_4, ANGLE=panel_5, DISTS=panel_6)

Z_5 = UnitZ(Factor="2000")
pt_3 = ConstructPoint(XCoordinate="0", YCoordinate="0", ZCoordinate="0")
Z_6 = UnitZ(Factor="2000")
Z_7 = UnitZ(Factor="2000")
pt_4 = ConstructPoint(XCoordinate="0", YCoordinate="0", ZCoordinate="0")
pt_5 = ConstructPoint(XCoordinate="0", YCoordinate="0", ZCoordinate="0")
X_3 = UnitX(Factor="2000")
neg_3 = Negative(Value="2000")
move_7 = Move(Geometry=pt_3, Motion=Z_5)  # -> Geometry, Transform
X_4 = UnitX(Factor="2000")
X_5 = UnitX(Factor="2000")
neg_4 = Negative(Value="2000")
move_8 = Move(Geometry=pt_4, Motion=Z_6)  # -> Geometry, Transform
neg_5 = Negative(Value="2000")
move_9 = Move(Geometry=pt_5, Motion=Z_7)  # -> Geometry, Transform
move_10 = Move(Geometry=move_7.Geometry, Motion=X_3)  # -> Geometry, Transform
Z_8 = UnitZ(Factor=neg_3)
move_11 = Move(Geometry=move_8.Geometry, Motion=X_4)  # -> Geometry, Transform
move_12 = Move(Geometry=move_9.Geometry, Motion=X_5)  # -> Geometry, Transform
Z_9 = UnitZ(Factor=neg_4)
Z_10 = UnitZ(Factor=neg_5)
ln_7 = Line(StartPoint=pt_3, EndPoint=move_7.Geometry)
crv_cp_6 = CurveClosestPoint(Point=pt_3, Curve=ln_7)  # -> Point, Parameter, Distance
move_13 = Move(Geometry=move_10.Geometry, Motion=Z_8)  # -> Geometry, Transform
ln_8 = Line(StartPoint=pt_4, EndPoint=move_8.Geometry)
crv_cp_7 = CurveClosestPoint(Point=pt_4, Curve=ln_8)  # -> Point, Parameter, Distance
ln_9 = Line(StartPoint=pt_5, EndPoint=move_9.Geometry)
crv_cp_8 = CurveClosestPoint(Point=pt_5, Curve=ln_9)  # -> Point, Parameter, Distance
move_14 = Move(Geometry=move_11.Geometry, Motion=Z_9)  # -> Geometry, Transform
move_15 = Move(Geometry=move_12.Geometry, Motion=Z_10)  # -> Geometry, Transform
ln_10 = Line(StartPoint=move_7.Geometry, EndPoint=move_10.Geometry)
crv_cp_9 = CurveClosestPoint(Point=[move_10.Geometry, move_7.Geometry], Curve=ln_10)  # -> Point, Parameter, Distance
ln_11 = Line(StartPoint=move_10.Geometry, EndPoint=move_13.Geometry)
crv_cp_10 = CurveClosestPoint(Point=move_13.Geometry, Curve=ln_11)  # -> Point, Parameter, Distance
icon2_2 = Point(crv_cp_9.Point)
ln_12 = Line(StartPoint=move_8.Geometry, EndPoint=move_11.Geometry)
crv_cp_11 = CurveClosestPoint(Point=[move_11.Geometry, move_8.Geometry], Curve=ln_12)  # -> Point, Parameter, Distance
ln_13 = Line(StartPoint=move_9.Geometry, EndPoint=move_12.Geometry)
crv_cp_12 = CurveClosestPoint(Point=[move_12.Geometry, move_9.Geometry], Curve=ln_13)  # -> Point, Parameter, Distance
ln_14 = Line(StartPoint=move_11.Geometry, EndPoint=move_14.Geometry)
crv_cp_13 = CurveClosestPoint(Point=move_14.Geometry, Curve=ln_14)  # -> Point, Parameter, Distance
icon2_3 = Point(crv_cp_11.Point)
ln_15 = Line(StartPoint=move_12.Geometry, EndPoint=move_15.Geometry)
crv_cp_14 = CurveClosestPoint(Point=move_15.Geometry, Curve=ln_15)  # -> Point, Parameter, Distance
icon2_4 = Point(crv_cp_12.Point)
vcon_4 = Point([move_10.Geometry, move_7.Geometry])
merge_3 = Merge(Data1=ln_7, Data2=ln_10, Data3=ln_11)
icon_4 = Point([crv_cp_6.Point, crv_cp_10.Point])
vcon_5 = Point([move_11.Geometry, move_8.Geometry])
merge_4 = Merge(Data1=ln_8, Data2=ln_12, Data3=ln_14)
vcon_6 = Point([move_12.Geometry, move_9.Geometry])
merge_5 = Merge(Data1=ln_9, Data2=ln_13, Data3=ln_15)
icon_5 = Point([crv_cp_7.Point, crv_cp_13.Point])
icon_6 = Point([crv_cp_8.Point, crv_cp_14.Point])
elem_3 = Geometry(merge_3)
# Bclng001
elem_4 = Geometry(merge_4)
elem_5 = Geometry(merge_5)
panel_7 = Panel("""0
0
0
0
0
0""")
panel_8 = Panel("""0
0
0
0
0
0""")
panel_9 = Panel("""0
0
0
0
0
0""")
panel_10 = Panel("""0
0
0
0
0
0""")
bonds = BONDS(I=panel_8, J=panel_10)
cmq = CMQ(I=panel_7, J=panel_9)
xz = XZPlane(Origin=Point(0, 0, 0))
icon_7 = Point([crv_cp_8.Point, crv_cp_14.Point])
vcon_7 = Point([move_12.Geometry, move_9.Geometry])
xz_2 = XZPlane(Origin=Point(0, 0, 0))

# ----
# VIEW
panel_11 = Panel("""0.5
0
0.6""")
panel_12 = Panel("""0
-90.3""")
panel_13 = Panel("""5
4000""")
view_3 = VIEW(GFACT="0.5", FOCUS=panel_11, ANGLE=panel_12, DISTS=panel_13)

# ----
# VIEW
panel_14 = Panel("""0.5
0
0.6""")
panel_15 = Panel("""0
-90.3""")
panel_16 = Panel("""5
4000""")
view_4 = VIEW(GFACT="0.5", FOCUS=panel_14, ANGLE=panel_15, DISTS=panel_16)

# ----
# VIEW
panel_17 = Panel("""0.5
0
0.6""")
panel_18 = Panel("""0
-90.3""")
panel_19 = Panel("""5
4000""")
view_5 = VIEW(GFACT="0.5", FOCUS=panel_17, ANGLE=panel_18, DISTS=panel_19)

file_path = Panel("C:\D\Cdocs\Hogan_2020\Debug")
save_inp = Button()
file_title = Panel("sampleb")

# ----
# LinearAnalysis
# LineCurve
# ASSEMBLE
# LinearBclngAnalysis
# original
# sorted node in X axis
# sorted node in Y axis
# sorted node in Z axis
# (sorted node arbitrary)
# EXECUTE
# -1: select min bandwidth from List
#  0: bandwidth with original model
#  1: bandwidth with model whose nodes are sorted in X axis
#  2: bandwidth with model whose nodes are sorted in Y axis
#  3: bandwidth with model whose nodes are sorted in Z axis
#  4: bandwidth with model whose nodes are sorted arbitrarily
panel_20 = Panel("4000")
X_6 = UnitX(Factor=panel_20)
move_16 = Move(Motion=X_6)  # -> Geometry, Transform
divide_curve = DivideCurve(Curve=reparameterize(flatten(elem)), Count="2", Kinks=False)  # -> Points, Tangents, simplify(Parameters)
shatter = Shatter(Curve=graft(elem), Parameters=divide_curve.Parameters)  # -> flatten(Segments)
line = Line(shatter)
list_length = ListLength(List=line)
item = ListItem(List=line, Index=0, Wrap=True)  # -> Item, Item1, Item2, Item3, Item4, Item5
random = Random(Range=Domain(0, 1), Number=list_length, Seed=2)
panel_21 = Panel("""a
d
c""")
panel_22 = Panel("""h
k
t""")
larger_than = LargerThan(FirstNumber=random, SecondNumber="0.5")  # -> LargerThan, OrEqualTo
hkyou = HKYOU(
    NSECT="101",
    MATERIAL="S",
    MatTYPE="SN400",
    MemTYPE="COLUMN",
    DF="10000",
    X="1.2",
    Y="1.2",
    COMMENT=panel_21,
    H="30",
    B="15",
    Tw="0.65",
    Tf="0.9",
    BTYPEChange="BBFAC")  # -> LSTSECT, AREA, IXX, IYY, VEN
dispatch = Dispatch(List=line, DispatchPattern=larger_than.LargerThan)  # -> ListA, ListB
hweek = HWEEK(
    NSECT="102",
    MATERIAL="S",
    MatTYPE="SN490",
    MemTYPE="COLUMN",
    DF="10000",
    X="1.5",
    Y="1.5",
    COMMENT=panel_22,
    H="40",
    B="20",
    Tw="0.75",
    Tf="1.2",
    BTYPEChange="BBFAC")  # -> LSTSECT, AREA, IXX, IYY, VEN
panel_23 = Panel("""0
0
0
0
0
0""")
panel_24 = Panel("""0
0
0
0
0
0""")
filepath = Panel("C:\D\Cdocs\Hogan_2020\DATA")
filepath_2 = Panel("C:\Users\chonv\AppData\Roaming\Grasshopper\Libraries\ghHogan")
panel_25 = Panel("""0
0
0
0
0
0""")
number = Number(hkyou.IXX)
number_2 = Number(hkyou.IYY)
number_3 = Number(hkyou.VEN)
filename = Panel("sampleb")
number_4 = Number(hkyou.AREA)
panel_26 = Panel("""0
0
0
0
0
0""")
number_5 = Number(hweek.AREA)
number_6 = Number(hweek.IXX)
number_7 = Number(hweek.IYY)
number_8 = Number(hweek.VEN)
merge_6 = Merge(Data1=item.Item, Data2=item.Item1, Data3=item.Item4, Data4=item.Item5)
merge_7 = Merge(Data1=item.Item2, Data2=item.Item3)
bonds_2 = BONDS(I=panel_24, J=panel_26)
cmq_2 = CMQ(I=panel_23, J=panel_25)
merge_8 = Merge(Data1=hkyou.LSTSECT, Data2=hweek.LSTSECT)
lstassemble = LSTASSEMBLE(HEAD="INPUT DATA", LSTSECT=merge_8, BUTTON=Button(), PATH=filepath, TITLE=filename)
end_points = EndPoints(Curve=shatter)  # -> Start, End
merge_9 = Merge(Data1=end_points.Start, Data2=end_points.End)
panel_27 = Panel(lstassemble)
removeduplicatepts = RemoveDuplicatePts(Points=merge_9, Tolerance=0.01)
deconstruct = Deconstruct(Point=removeduplicatepts)  # -> XComponent, YComponent, ZComponent
bounds = Bounds(Numbers=deconstruct.ZComponent)
deconstruct_domain = DeconstructDomain(Domain=bounds)  # -> Start, End
panel_28 = Panel("0")
member_index = MemberIndex(Set=deconstruct.ZComponent, Member=deconstruct_domain.End)  # -> Index, Count
number_9 = Number(hkyou.IYY)
number_10 = Number(hkyou.VEN)
number_11 = Number(hkyou.AREA)
number_12 = Number(hkyou.IXX)
number_13 = Number(hweek.AREA)
number_14 = Number(hweek.IXX)
number_15 = Number(hweek.IYY)
number_16 = Number(hweek.VEN)
icon_8 = Point([crv_cp.Point, crv_cp_3.Point])
list_item = ListItem(List=removeduplicatepts, Index=member_index.Index, Wrap=True)
vcon_8 = Point([move_3.Geometry, move.Geometry])
panel_29 = Panel("""0.200
0.200""")
X_7 = UnitX(Factor=panel_20)
pt_6 = Point(icon_8)
pt_7 = Point(vcon_8)
negative = Negative(Value=Slider(10, range=0..10))
icon2_5 = Point(crv_cp_2.Point)
# ICON
icon_9 = ICON(
    POINT=pt_6,
    Condition_TX_Changed=True,
    Condition_TY_Changed=False,
    Condition_TZ_Changed=True,
    Condition_X_Changed=True,
    Condition_Y_Changed=True,
    Condition_Z_Changed=True)
icon_10 = ICON(
    POINT=icon2_5,
    Condition_TX_Changed=True,
    Condition_TY_Changed=False,
    Condition_TZ_Changed=True,
    Condition_X_Changed=False,
    Condition_Y_Changed=True,
    Condition_Z_Changed=False)
relay = Relay([icon_10, icon_9])
save_inp_2 = Button()
filepath_3 = Panel("C:\Users\chonv\AppData\Roaming\Grasshopper\Libraries\ghHogan")
filename_2 = Panel("sample_buckling.inl")

# ----
# ELEM(segment)
# UNIT:[mm],[rad]
panel_30 = Panel("""0
0
0
0
0
0""")
panel_31 = Panel("""0
0
0
0
0
0""")
panel_32 = Panel("""0
0
0
0
0
0""")
panel_33 = Panel("""0
0
0
0
0
0""")
bonds_3 = BONDS(I=panel_31, J=panel_33)
cmq_3 = CMQ(I=panel_30, J=panel_32)
line_2 = Line(merge_6)
line_3 = Line(merge_7)
elem_6 = ELEM(
    GEO=line_2,
    ESECT="101",
    BONDS=bonds_3,
    CMQ=cmq_3,
    CANG="0",
    ElementTYPEChange="COLUMN",
    X_Axis_display_mode_changed=False,
    Y_Axis_display_mode_changed=False,
    Z_Axis_display_mode_changed=False)
elem_7 = ELEM(
    GEO=line_3,
    ESECT="102",
    BONDS=bonds_2,
    CMQ=cmq_2,
    CANG="0",
    ElementTYPEChange="COLUMN",
    X_Axis_display_mode_changed=False,
    Y_Axis_display_mode_changed=False,
    Z_Axis_display_mode_changed=False)

# ----
# SECT(for segment)
# UNIT:[tf],[m]
number_slider = Slider(0.02, range=0..0.1)
flatbarsect = FlatbarSect(B=number_slider, D=number_slider)  # -> out, Area, KYOU, WEEK, Jzz; inputs B: Double, D: Double
# ---------- flatbarsect: C# ----------
    Area = B * D;
    double Ixx = B * D * D * D / 12;
    double Iyy = D * B * B * B / 12;
    if(Ixx > Iyy)
    {
      KYOU = Ixx;
      WEEK = Iyy;
    }
    else
    {
      KYOU = Iyy;
      WEEK = Ixx;
    }
    Jzz = B * D * D * D / 3;
# ---------- end flatbarsect ----------
multiplication = Multiplication(A=flatbarsect.Area, B=10000)
multiplication_2 = Multiplication(A=flatbarsect.KYOU, B=10000)
multiplication_3 = Multiplication(A=flatbarsect.Jzz, B=10000)
panel_34 = Panel("0.2827")
panel_35 = Panel("0.00000064")
panel_37 = Panel("0.00000127")
domain = Domain(Domain(-100, 100))
domain_2 = Domain(Domain(-100, 100))
domain_3 = Domain(Domain(-100, 100))
domain_4 = Domain(Domain(-100, 100))
domain_5 = Domain(Domain(-100, 100))
domain_6 = Domain(Domain(-100, 100))
merge_10 = Merge(Data1=domain, Data2=domain_2, Data3=domain_3, Data4=domain_4, Data5=domain_5, Data6=domain_6)
fig = FIGSEGMENT(FIG="1", FPROP="101", AREA=number_13, IXX=number_14, IYY=number_15, VEN=number_16, YIELD=merge_10)
sect = SECT(NSECT="102", SNAME="Column:T-12x20x4.5x3(x10000)", SFIG=fig, COLOR=ColourSwatch(SwatchColor=RGB(255, 0, 204)))

# ----
# SECT(for segment)
# UNIT:[tf],[m]
panel_38 = Panel("Column:T-12x20x4.5x3(x10000)")
domain_7 = Domain(Domain(-100, 100))
domain_8 = Domain(Domain(-100, 100))
domain_9 = Domain(Domain(-100, 100))
domain_10 = Domain(Domain(-100, 100))
domain_11 = Domain(Domain(-100, 100))
domain_12 = Domain(Domain(-100, 100))
merge_11 = Merge(Data1=domain_7, Data2=domain_8, Data3=domain_9, Data4=domain_10, Data5=domain_11, Data6=domain_12)
fig_2 = FIGSEGMENT(FIG="1", FPROP="101", AREA=number_11, IXX=number_12, IYY=number_9, VEN=number_10, YIELD=merge_11)
sect_2 = SECT(NSECT="101", SNAME=panel_38, SFIG=fig_2, COLOR=ColourSwatch(SwatchColor=RGB(255, 0, 204)))

# ----
# OPTS
panel_43 = Panel("\"SAMPLE INPUTFILE FOR HOGAN UNIT:[tf],[m]\"")
panel_44 = Panel("0.100")
opts = GHhogan(NAME=panel_43, BASE=panel_29, LOCATE="1.000", TFACT="0.030", GPERIOD="0.600")

# ----
# VCON(vector)
# This component requests
#  a load vector for each point.
panel_45 = Panel("8")
lng = ListLength(List=pt_7)
vec = VectorXYZ(XComponent=panel_45, YComponent=panel_45, ZComponent=0)  # -> Vector, Length
dup = DuplicateData(Data=vec.Vector, Number=lng, Order=True)
vcon_9 = VCONSimple(POINT=pt_7, ExF=dup)

# ----
# UNIT:[tf],[m]
# VCON(vector components)
vcon_10 = VCON(POINT=pt_7, X=0, Y=0, Z=negative, RX=0, RY=0, RZ=0)

# ----
# Bclng002
# LineCurve
# ASSEMBLE
# 個材座屈固有値
# original
# sorted node in X axis
# sorted node in Y axis
# sorted node in Z axis
# (sorted node arbitrary)
panel_46 = Panel("10000")
num_桁落ち対策 = Number(panel_46)
line_部材 = Line(elem_2)
lng_2 = ListLength(List=line_部材)
num = Number(lng_2)
num_桁落ち対策_2 = Number(panel_46)
num_桁落ち対策_3 = Number(panel_46)
division = Division(A="2.1e7", B=num_桁落ち対策_3)
panel_47 = Panel("""0.200
0.200""")
pt_8 = Point(icon_3)
pt_9 = Point(vcon_3)
neg_6 = Negative(Value=Slider(10, range=0..100))
icon_11 = ICON(
    POINT=pt_8,
    Condition_TX_Changed=False,
    Condition_TY_Changed=False,
    Condition_TZ_Changed=False,
    Condition_X_Changed=True,
    Condition_Y_Changed=True,
    Condition_Z_Changed=True)
filepath_4 = Panel("C:\Users\chonv\AppData\Roaming\Grasshopper\Libraries\ghHogan")
filename_3 = Panel("sample_buckling.inl")
epsilon = Panel("1.0e-6")

# ----
# ELEM(segment)
# UNIT:[mm],[rad]
panel_48 = Panel("""0
0
0
0
0
0""")
panel_49 = Panel("""0
0
0
0
0
0""")
panel_50 = Panel("""0
0
0
0
0
0""")
panel_51 = Panel("""0
0
0
0
0
0""")
bonds_4 = BONDS(I=panel_49, J=panel_51)
cmq_4 = CMQ(I=panel_48, J=panel_50)
elem_8 = ELEM(
    GEO=line_部材,
    ESECT="101",
    BONDS=bonds_4,
    CMQ=cmq_4,
    CANG="0",
    ElementTYPEChange="COLUMN",
    X_Axis_display_mode_changed=False,
    Y_Axis_display_mode_changed=False,
    Z_Axis_display_mode_changed=False)

# ----
# OPTS
panel_52 = Panel("\"SAMPLE INPUTFILE FOR HOGAN UNIT:[tf],[m]\"")
opts_2 = GHhogan(NAME=panel_52, BASE=panel_47, LOCATE="1.000", TFACT="0.030", GPERIOD="0.600")

# ----
# ICON
# UNIT:[tf],[m]
toggle = BooleanToggle(True)
icon_12 = ICON(POINT=pt_8, X=toggle, Y=Toggle(True), Z=Toggle(True), RX=Toggle(True), RY=Toggle(True), RZ=Toggle(True))

# ----
# VCON(vector components)
# UNIT:[tf],[m]
vcon_11 = VCON(POINT=pt_9, X=0, Y=0, Z=neg_6, RX=0, RY=0, RZ=0)

# ----
# PROP
# UNIT:[tf],[m]
panel_54 = Panel("7.8")
panel_55 = Panel("22.4")

division_2 = Division(A=panel_54, B=num_桁落ち対策_3)

prop = PROP(
    NPROP="101",
    PNAME="SN490B(1/10000)",
    HIJU=division_2,
    E=division,
    POI="0.33333",
    PCOLOR=ColourSwatch(SwatchColor=RGB(64, 0, 255)))

# ----
# SECT(for segment)
# UNIT:[tf],[m]
panel_56 = Panel("101")
domain_13 = Domain(Domain(-100, 100))
domain_14 = Domain(Domain(-100, 100))
domain_15 = Domain(Domain(-100, 100))
domain_16 = Domain(Domain(-100, 100))
domain_17 = Domain(Domain(-100, 100))
domain_18 = Domain(Domain(-100, 100))
merge_12 = Merge(Data1=domain_13, Data2=domain_14, Data3=domain_15, Data4=domain_16, Data5=domain_17, Data6=domain_18)

cpipe = CPIPE(
    NSECT=panel_56,
    MATERIAL="S",
    MatTYPE="SN400",
    MemTYPE="COLUMN",
    DF=num_桁落ち対策_2,
    X=1,
    Y=1,
    D=Slider(5, range=0..10),
    T=Slider(0.5, range=0..1),
    BTYPEChange="BBFAC")  # -> LSTSECT, AREA, IXX, IYY, VEN

fig_3 = FIGSEGMENT(FIG="1", FPROP="101", AREA=cpipe.AREA, IXX=cpipe.IXX, IYY=cpipe.IYY, VEN=cpipe.VEN, YIELD=merge_12)
sect_3 = SECT(NSECT=panel_56, SNAME="Column:T-12x20x4.5x3(x10000)", SFIG=fig_3, COLOR=ColourSwatch(SwatchColor=RGB(255, 0, 204)))

assemble = ASSEMBLEOPT(
    OPTS=opts_2,
    VIEW=view,
    ELEM=flatten(elem_8),
    PROP=flatten(prop),
    SECT=flatten(sect_3),
    ICON=flatten(icon_11),
    Sort_Mode=Slider(0, range=-1..4))  # -> INP, Bandwidth, BandwidthList
assemble_2 = ASSEMBLE(
    OPTS=opts_2,
    VIEW=view,
    ELEM=flatten(elem_8),
    PROP=flatten(prop),
    SECT=flatten(sect_3),
    ICON=flatten(icon_11),
    VCON=flatten(vcon_11))
extractarclm = ExtractArclm(INP=assemble_2, DIGIT=False)  # -> ArclmFrameZ, ArclmFrameX, ArclmFrameY
optimized_bandwidth = Panel(assemble.Bandwidth)
list_of_bandwidths = Panel(assemble.BandwidthList)
arclm001 = ARCLM001(ARCLMFRAME=extractarclm.ArclmFrameZ, DFACT=1)  # -> OTL, GlobalMatrix, GlobalVector, ErrorMessage, Lines, ARCLMFRAME
saveasarclm = SaveAsArclm(ARCLMFRAME=extractarclm.ArclmFrameZ, BUTTON=Button(), PATH=filepath_4, TITLE=filename_3)
bclng002 = BCLNG002(ARCLMFRAME=arclm001.ARCLMFRAME, EPS=1e-08)  # -> EIG, RAT, SRATE, ElasticMatrix, GeometricMatrix
abs = Absolute(Value=bclng002.SRATE)
clrdstrbt = ColorDistribution(
    ELEMENT=line_部材,
    SRATE=abs,
    NumF=3,
    THICK=3,
    SIZE=Slider(7, range=0..10),
    DOMAIN=[Domain(10000, 1), Domain(1, 0.9), Domain(0.9, 0.8), Domain(0.8, 0.7), Domain(0.7, 0.6), Domain(0.6, 0.5), Domain(0.5, -10000)],
    COLOR=[RGB(255, 0, 150), RGB(255, 150, 50), RGB(255, 255, 0), RGB(150, 255, 0), RGB(0, 255, 0), RGB(0, 255, 150), RGB(80, 50, 200)])
panel_57 = Panel(bclng002.EIG)
eigin処理 = EIGIN処理(T=bclng002.EIG, num=lng_2)
one_over_x = OneOverX(Value=eigin処理)
panel_58 = Panel(one_over_x)

# ----
# GENERATE
file_path_3 = Panel("C:\D\Cdocs\Hogan_Hirabayashi\Debug\ghHogan")
save_inp_3 = Button()
file_title_3 = Panel("tower_bclng002_2")
generate = GENERATE(INP=assemble_2, BUTTON=save_inp_3, PATH=file_path_3, TITLE=file_title_3)

panel_59 = Panel(bclng002.RAT)

# ----
# PROP
# UNIT:[tf],[m]
panel_60 = Panel("2.3e7")

division_3 = Division(A=panel_60, B="10000")
division_4 = Division(A="7.8", B="10000")
relay_2 = Relay([elem_6, elem_7])
relay_3 = Relay([sect_2, sect])

prop_2 = PROP(
    NPROP="101",
    PNAME="SN490B(1/10000)",
    HIJU=division_4,
    E=division_3,
    POI="0.33333",
    PCOLOR=ColourSwatch(SwatchColor=RGB(64, 0, 255)))

assemble_3 = ASSEMBLEOPT(
    OPTS=opts,
    VIEW=view_2,
    ELEM=flatten(relay_2),
    PROP=flatten(prop_2),
    SECT=flatten(relay_3),
    ICON=flatten(relay),
    Sort_Mode=Slider(0, range=-1..4))  # -> INP, Bandwidth, BandwidthList
assemble_4 = ASSEMBLE(
    OPTS=opts,
    VIEW=view_2,
    ELEM=flatten(relay_2),
    PROP=flatten(prop_2),
    SECT=flatten(relay_3),
    ICON=flatten(relay),
    VCON=flatten(vcon_10))
extractarclm_2 = ExtractArclm(INP=assemble_4, DIGIT=False)  # -> ArclmFrameZ, ArclmFrameX, ArclmFrameY
optimized_bandwidth_2 = Panel(assemble_3.Bandwidth)
list_of_bandwidths_2 = Panel(assemble_3.BandwidthList)
saveasarclm_2 = SaveAsArclm(ARCLMFRAME=extractarclm_2.ArclmFrameZ, BUTTON=Button(), PATH=filepath_3, TITLE=filename_2)
arclm001_2 = ARCLM001(ARCLMFRAME=extractarclm_2.ArclmFrameZ, DFACT=1)  # -> OTL, GlobalMatrix, GlobalVector, ErrorMessage, Lines, ARCLMFRAME
panel_62 = Panel(arclm001_2.OTL)
bclng001 = BCLNG001(ARCLMFRAME=arclm001_2.ARCLMFRAME, NEIGEN=1, DFACT=1, EPS=1e-08)  # -> OTP, ElasticMatrix, GeometricMatrix, Lines, ARCLMFRAME
drawdisplacement = DrawDisplacement(ARCLMFRAME=bclng001.ARCLMFRAME, DFACT="1")  # -> InitialLines, DeformedLines
panel_63 = Panel(bclng001.OTP)
custom_preview = CustomPreview(Geometry=drawdisplacement.InitialLines, Material=ColourSwatch(SwatchColor=RGB(255, 77, 204)))
custom_preview_2 = CustomPreview(Geometry=drawdisplacement.DeformedLines, Material=ColourSwatch(SwatchColor=RGB(77, 77, 255)))

# ----
# GENERATE
file_path_4 = Panel("C:\D\Cdocs\Hogan_2020\Debug")
save_inp_4 = Button()
file_title_4 = Panel("sampleb")
generate_2 = GENERATE(INP=assemble_4, BUTTON=save_inp_4, PATH=file_path_4, TITLE=file_title_4)

# ----
# original
# sorted node in X axis
# sorted node in Y axis
# sorted node in Z axis
# (sorted node arbitrary)
panel_64 = Panel("4000")
X_8 = UnitX(Factor=panel_64)
move_17 = Move(Motion=X_8)  # -> Geometry, Transform
divide_curve_2 = DivideCurve(Curve=reparameterize(flatten(elem_3)), Count="2", Kinks=False)  # -> Points, Tangents, simplify(Parameters)
shatter_2 = Shatter(Curve=graft(elem_3), Parameters=divide_curve_2.Parameters)  # -> flatten(Segments)
# LineCurve
line_4 = Line(shatter_2)
list_length_2 = ListLength(List=line_4)
item_2 = ListItem(List=line_4, Index=0, Wrap=True)  # -> Item, Item1, Item2, Item3, Item4, Item5
random_2 = Random(Range=Domain(0, 1), Number=list_length_2, Seed=2)
panel_65 = Panel("""a
d
c""")
panel_66 = Panel("""h
k
t""")
larger_than_2 = LargerThan(FirstNumber=random_2, SecondNumber="0.5")  # -> LargerThan, OrEqualTo
hkyou_2 = HKYOU(
    NSECT="101",
    MATERIAL="S",
    MatTYPE="SN400",
    MemTYPE="COLUMN",
    DF="10000",
    X="1.2",
    Y="1.2",
    COMMENT=panel_65,
    H="30",
    B="15",
    Tw="0.65",
    Tf="0.9",
    BTYPEChange="BBFAC")  # -> LSTSECT, AREA, IXX, IYY, VEN
dispatch_2 = Dispatch(List=line_4, DispatchPattern=larger_than_2.LargerThan)  # -> ListA, ListB
hweek_2 = HWEEK(
    NSECT="102",
    MATERIAL="S",
    MatTYPE="SN490",
    MemTYPE="COLUMN",
    DF="10000",
    X="1.5",
    Y="1.5",
    COMMENT=panel_66,
    H="40",
    B="20",
    Tw="0.75",
    Tf="1.2",
    BTYPEChange="BBFAC")  # -> LSTSECT, AREA, IXX, IYY, VEN
panel_67 = Panel("""0
0
0
0
0
0""")
panel_68 = Panel("""0
0
0
0
0
0""")
filepath_5 = Panel("C:\D\Cdocs\Hogan_2020\DATA")
panel_69 = Panel("""0
0
0
0
0
0""")
number_17 = Number(hkyou_2.IXX)
number_18 = Number(hkyou_2.IYY)
number_19 = Number(hkyou_2.VEN)
filename_4 = Panel("sampleb")
number_20 = Number(hkyou_2.AREA)
panel_70 = Panel("""0
0
0
0
0
0""")
number_21 = Number(hweek_2.AREA)
number_22 = Number(hweek_2.IXX)
number_23 = Number(hweek_2.IYY)
number_24 = Number(hweek_2.VEN)
merge_13 = Merge(Data1=item_2.Item, Data2=item_2.Item1, Data3=item_2.Item4, Data4=item_2.Item5)
merge_14 = Merge(Data1=item_2.Item2, Data2=item_2.Item3)
bonds_5 = BONDS(I=panel_68, J=panel_70)
cmq_5 = CMQ(I=panel_67, J=panel_69)
merge_15 = Merge(Data1=hkyou_2.LSTSECT, Data2=hweek_2.LSTSECT)
lstassemble_2 = LSTASSEMBLE(HEAD="INPUT DATA", LSTSECT=merge_15, BUTTON=Button(), PATH=filepath_5, TITLE=filename_4)
join = JoinCurves(Curves=merge_14, Preserve=False)  # -> flatten(Curves)
xz_3 = XZPlane(Origin=Point(0, 0, 0))
end_points_2 = EndPoints(Curve=shatter_2)  # -> Start, End
merge_16 = Merge(Data1=end_points_2.Start, Data2=end_points_2.End)
panel_71 = Panel(lstassemble_2)
removeduplicatepts_2 = RemoveDuplicatePts(Points=merge_16, Tolerance=0.01)
deconstruct_2 = Deconstruct(Point=removeduplicatepts_2)  # -> XComponent, YComponent, ZComponent
bounds_2 = Bounds(Numbers=deconstruct_2.ZComponent)
deconstruct_domain_2 = DeconstructDomain(Domain=bounds_2)  # -> Start, End
member_index_2 = MemberIndex(Set=deconstruct_2.ZComponent, Member=deconstruct_domain_2.End)  # -> Index, Count
number_25 = Number(hkyou_2.IYY)
number_26 = Number(hkyou_2.VEN)
number_27 = Number(hkyou_2.AREA)
number_28 = Number(hkyou_2.IXX)
number_29 = Number(hweek_2.AREA)
number_30 = Number(hweek_2.IXX)
number_31 = Number(hweek_2.IYY)
number_32 = Number(hweek_2.VEN)
icon_13 = Point([crv_cp_6.Point, crv_cp_10.Point])
pt_10 = Point(icon_13)
list_item_2 = ListItem(List=removeduplicatepts_2, Index=member_index_2.Index, Wrap=True)
vcon_12 = Point([move_10.Geometry, move_7.Geometry])
panel_72 = Panel("""0.200
0.200""")
xz_4 = XZPlane(Origin=Point(0, 0, 0))
pt_11 = Point(vcon_12)
rotate = Rotate(Geometry=pt_11, Angle=1.570796327, Plane=xz_4)  # -> Geometry, Transform
X_9 = UnitX(Factor=panel_64)
# ICON
item_3 = ListItem(List=rotate.Geometry, Index=0, Wrap=True)  # -> Item, Item1
negative_2 = Negative(Value=Slider(10, range=0..10))
icon2_6 = Point(item_3.Item1)
icon_14 = ICON(
    POINT=icon2_6,
    Condition_TX_Changed=True,
    Condition_TY_Changed=True,
    Condition_TZ_Changed=True,
    Condition_X_Changed=True,
    Condition_Y_Changed=True,
    Condition_Z_Changed=True)
save_inp_5 = Button()
filepath_7 = Panel("C:\Users\chonv\AppData\Roaming\Grasshopper\Libraries\ghHogan")
filename_5 = Panel("sample_buckling.inl")

# ----
# SECT(for segment)
# UNIT:[tf],[m]
number_slider_2 = Slider(0.02, range=0..0.1)
flatbarsect_2 = FlatbarSect(B=number_slider_2, D=number_slider_2)  # -> out, Area, KYOU, WEEK, Jzz; inputs B: Double, D: Double; same code as flatbarsect
multiplication_4 = Multiplication(A=flatbarsect_2.Area, B=10000)
multiplication_5 = Multiplication(A=flatbarsect_2.KYOU, B=10000)
multiplication_6 = Multiplication(A=flatbarsect_2.Jzz, B=10000)
domain_19 = Domain(Domain(-100, 100))
domain_20 = Domain(Domain(-100, 100))
domain_21 = Domain(Domain(-100, 100))
domain_22 = Domain(Domain(-100, 100))
domain_23 = Domain(Domain(-100, 100))
domain_24 = Domain(Domain(-100, 100))
merge_17 = Merge(Data1=domain_19, Data2=domain_20, Data3=domain_21, Data4=domain_22, Data5=domain_23, Data6=domain_24)
fig_4 = FIGSEGMENT(FIG="1", FPROP="101", AREA=number_29, IXX=number_30, IYY=number_31, VEN=number_32, YIELD=merge_17)
sect_4 = SECT(NSECT="102", SNAME="Column:T-12x20x4.5x3(x10000)", SFIG=fig_4, COLOR=ColourSwatch(SwatchColor=RGB(255, 0, 204)))

# ----
# SECT(for segment)
# UNIT:[tf],[m]
panel_77 = Panel("Column:T-12x20x4.5x3(x10000)")
domain_25 = Domain(Domain(-100, 100))
domain_26 = Domain(Domain(-100, 100))
domain_27 = Domain(Domain(-100, 100))
domain_28 = Domain(Domain(-100, 100))
domain_29 = Domain(Domain(-100, 100))
domain_30 = Domain(Domain(-100, 100))
merge_18 = Merge(Data1=domain_25, Data2=domain_26, Data3=domain_27, Data4=domain_28, Data5=domain_29, Data6=domain_30)
fig_5 = FIGSEGMENT(FIG="1", FPROP="101", AREA=number_27, IXX=number_28, IYY=number_25, VEN=number_26, YIELD=merge_18)
sect_5 = SECT(NSECT="101", SNAME=panel_77, SFIG=fig_5, COLOR=ColourSwatch(SwatchColor=RGB(255, 0, 204)))

# ----
# OPTS
panel_82 = Panel("\"SAMPLE INPUTFILE FOR HOGAN UNIT:[tf],[m]\"")
opts_3 = GHhogan(NAME=panel_82, BASE=panel_72, LOCATE="1.000", TFACT="0.030", GPERIOD="0.600")

# ----
# VCON(vector)
# This component requests
#  a load vector for each point.
panel_84 = Panel("8")
lng_3 = ListLength(List=rotate.Geometry)
vec_2 = VectorXYZ(XComponent=panel_84, YComponent=panel_84, ZComponent=0)  # -> Vector, Length
dup_2 = DuplicateData(Data=vec_2.Vector, Number=lng_3, Order=True)
vcon_13 = VCONSimple(POINT=rotate.Geometry, ExF=dup_2)

# ----
# UNIT:[tf],[m]
# VCON(vector components)
vcon_14 = VCON(POINT=item_3.Item, X=negative_2, Y=0, Z=0, RX=0, RY=0, RZ=0)

# ----
# LinearAnalysis
# LineCurve
# ASSEMBLE
# LinearBclngAnalysis
# original
# sorted node in X axis
# sorted node in Y axis
# sorted node in Z axis
# (sorted node arbitrary)
# EXECUTE
panel_85 = Panel("4000")
X_10 = UnitX(Factor=panel_85)
move_18 = Move(Motion=X_10)  # -> Geometry, Transform
divide_curve_3 = DivideCurve(Curve=reparameterize(flatten(elem_4)), Count="2", Kinks=False)  # -> Points, Tangents, simplify(Parameters)
shatter_3 = Shatter(Curve=graft(elem_4), Parameters=divide_curve_3.Parameters)  # -> flatten(Segments)
line_5 = Line(shatter_3)
list_length_3 = ListLength(List=line_5)
item_4 = ListItem(List=line_5, Index=0, Wrap=True)  # -> Item, Item1, Item2, Item3, Item4, Item5
random_3 = Random(Range=Domain(0, 1), Number=list_length_3, Seed=2)
panel_86 = Panel("""a
d
c""")
panel_87 = Panel("""h
k
t""")
larger_than_3 = LargerThan(FirstNumber=random_3, SecondNumber="0.5")  # -> LargerThan, OrEqualTo
hkyou_3 = HKYOU(
    NSECT="101",
    MATERIAL="S",
    MatTYPE="SN400",
    MemTYPE="COLUMN",
    DF="10000",
    X="1.2",
    Y="1.2",
    COMMENT=panel_86,
    H="30",
    B="15",
    Tw="0.65",
    Tf="0.9",
    BTYPEChange="BBFAC")  # -> LSTSECT, AREA, IXX, IYY, VEN
dispatch_3 = Dispatch(List=line_5, DispatchPattern=larger_than_3.LargerThan)  # -> ListA, ListB
hweek_3 = HWEEK(
    NSECT="102",
    MATERIAL="S",
    MatTYPE="SN490",
    MemTYPE="COLUMN",
    DF="10000",
    X="1.5",
    Y="1.5",
    COMMENT=panel_87,
    H="40",
    B="20",
    Tw="0.75",
    Tf="1.2",
    BTYPEChange="BBFAC")  # -> LSTSECT, AREA, IXX, IYY, VEN
panel_88 = Panel("""0
0
0
0
0
0""")
panel_89 = Panel("""0
0
0
0
0
0""")
filepath_8 = Panel("C:\D\Cdocs\Hogan_2020\DATA")
panel_90 = Panel("""0
0
0
0
0
0""")
number_33 = Number(hkyou_3.IXX)
number_34 = Number(hkyou_3.IYY)
number_35 = Number(hkyou_3.VEN)
filename_6 = Panel("sampleb")
number_36 = Number(hkyou_3.AREA)
panel_91 = Panel("""0
0
0
0
0
0""")
number_37 = Number(hweek_3.AREA)
number_38 = Number(hweek_3.IXX)
number_39 = Number(hweek_3.IYY)
number_40 = Number(hweek_3.VEN)
merge_19 = Merge(Data1=item_4.Item, Data2=item_4.Item1, Data3=item_4.Item4, Data4=item_4.Item5)
merge_20 = Merge(Data1=item_4.Item2, Data2=item_4.Item3)
bonds_6 = BONDS(I=panel_89, J=panel_91)
cmq_6 = CMQ(I=panel_88, J=panel_90)
merge_21 = Merge(Data1=hkyou_3.LSTSECT, Data2=hweek_3.LSTSECT)
lstassemble_3 = LSTASSEMBLE(HEAD="INPUT DATA", LSTSECT=merge_21, BUTTON=Button(), PATH=filepath_8, TITLE=filename_6)
join_2 = JoinCurves(Curves=merge_20, Preserve=False)  # -> flatten(Curves)
end_points_3 = EndPoints(Curve=shatter_3)  # -> Start, End
merge_22 = Merge(Data1=end_points_3.Start, Data2=end_points_3.End)
panel_92 = Panel(lstassemble_3)
removeduplicatepts_3 = RemoveDuplicatePts(Points=merge_22, Tolerance=0.01)
deconstruct_3 = Deconstruct(Point=removeduplicatepts_3)  # -> XComponent, YComponent, ZComponent
bounds_3 = Bounds(Numbers=deconstruct_3.ZComponent)
deconstruct_domain_3 = DeconstructDomain(Domain=bounds_3)  # -> Start, End
member_index_3 = MemberIndex(Set=deconstruct_3.ZComponent, Member=deconstruct_domain_3.End)  # -> Index, Count
number_41 = Number(hkyou_3.IYY)
number_42 = Number(hkyou_3.VEN)
number_43 = Number(hkyou_3.AREA)
number_44 = Number(hkyou_3.IXX)
number_45 = Number(hweek_3.AREA)
number_46 = Number(hweek_3.IXX)
number_47 = Number(hweek_3.IYY)
number_48 = Number(hweek_3.VEN)
icon_15 = Point([crv_cp_7.Point, crv_cp_13.Point])
pt_12 = Point(icon_15)
list_item_3 = ListItem(List=removeduplicatepts_3, Index=member_index_3.Index, Wrap=True)
vcon_15 = Point([move_11.Geometry, move_8.Geometry])
panel_93 = Panel("""0.200
0.200""")
pt_13 = Point(vcon_15)
X_11 = UnitX(Factor=panel_85)
# ICON
item_5 = ListItem(List=pt_13, Index=0, Wrap=True)  # -> Item, Item1
negative_3 = Negative(Value=Slider(10, range=0..10))
icon2_7 = Point(item_5.Item1)
icon_16 = ICON(
    POINT=icon2_7,
    Condition_TX_Changed=True,
    Condition_TY_Changed=True,
    Condition_TZ_Changed=True,
    Condition_X_Changed=True,
    Condition_Y_Changed=True,
    Condition_Z_Changed=True)
save_inp_6 = Button()
filepath_10 = Panel("C:\Users\chonv\AppData\Roaming\Grasshopper\Libraries\ghHogan")
filename_7 = Panel("sample_buckling.inl")

# ----
# ELEM(segment)
# UNIT:[mm],[rad]
panel_94 = Panel("""0
0
0
0
0
0""")
panel_95 = Panel("""0
0
0
0
0
0""")
panel_96 = Panel("""0
0
0
0
0
0""")
panel_97 = Panel("""0
0
0
0
0
0""")
bonds_7 = BONDS(I=panel_95, J=panel_97)
cmq_7 = CMQ(I=panel_94, J=panel_96)
line_6 = Line(merge_19)
line_7 = Line(merge_20)
elem_9 = ELEM(
    GEO=line_6,
    ESECT="101",
    BONDS=bonds_7,
    CMQ=cmq_7,
    CANG="0",
    ElementTYPEChange="COLUMN",
    X_Axis_display_mode_changed=False,
    Y_Axis_display_mode_changed=False,
    Z_Axis_display_mode_changed=False)  # disabled
elem_10 = ELEM(
    GEO=line_7,
    ESECT="102",
    BONDS=bonds_6,
    CMQ=cmq_6,
    CANG="0",
    ElementTYPEChange="COLUMN",
    X_Axis_display_mode_changed=False,
    Y_Axis_display_mode_changed=False,
    Z_Axis_display_mode_changed=False)

# ----
# SECT(for segment)
# UNIT:[tf],[m]
number_slider_3 = Slider(0.02, range=0..0.1)
flatbarsect_3 = FlatbarSect(B=number_slider_3, D=number_slider_3)  # -> out, Area, KYOU, WEEK, Jzz; inputs B: Double, D: Double; same code as flatbarsect
multiplication_7 = Multiplication(A=flatbarsect_3.Area, B=10000)
multiplication_8 = Multiplication(A=flatbarsect_3.KYOU, B=10000)
multiplication_9 = Multiplication(A=flatbarsect_3.Jzz, B=10000)
domain_31 = Domain(Domain(-100, 100))
domain_32 = Domain(Domain(-100, 100))
domain_33 = Domain(Domain(-100, 100))
domain_34 = Domain(Domain(-100, 100))
domain_35 = Domain(Domain(-100, 100))
domain_36 = Domain(Domain(-100, 100))
merge_23 = Merge(Data1=domain_31, Data2=domain_32, Data3=domain_33, Data4=domain_34, Data5=domain_35, Data6=domain_36)
fig_6 = FIGSEGMENT(FIG="1", FPROP="101", AREA=number_45, IXX=number_46, IYY=number_47, VEN=number_48, YIELD=merge_23)
sect_6 = SECT(NSECT="102", SNAME="Column:T-12x20x4.5x3(x10000)", SFIG=fig_6, COLOR=ColourSwatch(SwatchColor=RGB(255, 0, 204)))

# ----
# SECT(for segment)
# UNIT:[tf],[m]
panel_102 = Panel("Column:T-12x20x4.5x3(x10000)")
domain_37 = Domain(Domain(-100, 100))
domain_38 = Domain(Domain(-100, 100))
domain_39 = Domain(Domain(-100, 100))
domain_40 = Domain(Domain(-100, 100))
domain_41 = Domain(Domain(-100, 100))
domain_42 = Domain(Domain(-100, 100))
merge_24 = Merge(Data1=domain_37, Data2=domain_38, Data3=domain_39, Data4=domain_40, Data5=domain_41, Data6=domain_42)
fig_7 = FIGSEGMENT(FIG="1", FPROP="101", AREA=number_43, IXX=number_44, IYY=number_41, VEN=number_42, YIELD=merge_24)
sect_7 = SECT(NSECT="101", SNAME=panel_102, SFIG=fig_7, COLOR=ColourSwatch(SwatchColor=RGB(255, 0, 204)))

# ----
# OPTS
panel_107 = Panel("\"SAMPLE INPUTFILE FOR HOGAN UNIT:[tf],[m]\"")
opts_4 = GHhogan(NAME=panel_107, BASE=panel_93, LOCATE="1.000", TFACT="0.030", GPERIOD="0.600")

# ----
# VCON(vector)
# This component requests
#  a load vector for each point.
panel_109 = Panel("8")
lng_4 = ListLength(List=pt_13)
vec_3 = VectorXYZ(XComponent=panel_109, YComponent=panel_109, ZComponent=0)  # -> Vector, Length
dup_3 = DuplicateData(Data=vec_3.Vector, Number=lng_4, Order=True)
vcon_16 = VCONSimple(POINT=pt_13, ExF=dup_3)

# ----
# UNIT:[tf],[m]
# VCON(vector components)
vcon_17 = VCON(POINT=item_5.Item, X=negative_3, Y=0, Z=0, RX=0, RY=0, RZ=0)

# ----
# LinearAnalysis
# LineCurve
# ASSEMBLE
# LinearBclngAnalysis
# original
# sorted node in X axis
# sorted node in Y axis
# sorted node in Z axis
# (sorted node arbitrary)
# EXECUTE
# UNIT:[tf],[m]
panel_110 = Panel("4000")
X_12 = UnitX(Factor=panel_110)
move_19 = Move(Motion=X_12)  # -> Geometry, Transform
divide_curve_4 = DivideCurve(Curve=reparameterize(flatten(elem_5)), Count="2", Kinks=False)  # -> Points, Tangents, simplify(Parameters)
shatter_4 = Shatter(Curve=graft(elem_5), Parameters=divide_curve_4.Parameters)  # -> flatten(Segments)
line_8 = Line(shatter_4)
list_length_4 = ListLength(List=line_8)
random_4 = Random(Range=Domain(0, 1), Number=list_length_4, Seed=2)
panel_111 = Panel("""a
d
c""")
panel_112 = Panel("""h
k
t""")
larger_than_4 = LargerThan(FirstNumber=random_4, SecondNumber="0.5")  # -> LargerThan, OrEqualTo
hkyou_4 = HKYOU(
    NSECT="101",
    MATERIAL="S",
    MatTYPE="SN400",
    MemTYPE="COLUMN",
    DF="10000",
    X="1.2",
    Y="1.2",
    COMMENT=panel_111,
    H="30",
    B="15",
    Tw="0.65",
    Tf="0.9",
    BTYPEChange="BBFAC")  # -> LSTSECT, AREA, IXX, IYY, VEN
dispatch_4 = Dispatch(List=line_8, DispatchPattern=larger_than_4.LargerThan)  # -> ListA, ListB
hweek_4 = HWEEK(
    NSECT="102",
    MATERIAL="S",
    MatTYPE="SN490",
    MemTYPE="COLUMN",
    DF="10000",
    X="1.5",
    Y="1.5",
    COMMENT=panel_112,
    H="40",
    B="20",
    Tw="0.75",
    Tf="1.2",
    BTYPEChange="BBFAC")  # -> LSTSECT, AREA, IXX, IYY, VEN
filepath_11 = Panel("C:\D\Cdocs\Hogan_2020\DATA")
number_49 = Number(hkyou_4.IXX)
number_50 = Number(hkyou_4.IYY)
number_51 = Number(hkyou_4.VEN)
filename_8 = Panel("sampleb")
number_52 = Number(hkyou_4.AREA)
number_53 = Number(hweek_4.AREA)
number_54 = Number(hweek_4.IXX)
number_55 = Number(hweek_4.IYY)
number_56 = Number(hweek_4.VEN)
merge_25 = Merge(Data1=hkyou_4.LSTSECT, Data2=hweek_4.LSTSECT)
lstassemble_4 = LSTASSEMBLE(HEAD="INPUT DATA", LSTSECT=merge_25, BUTTON=Button(), PATH=filepath_11, TITLE=filename_8)
end_points_4 = EndPoints(Curve=shatter_4)  # -> Start, End
merge_26 = Merge(Data1=end_points_4.Start, Data2=end_points_4.End)
panel_113 = Panel(lstassemble_4)
removeduplicatepts_4 = RemoveDuplicatePts(Points=merge_26, Tolerance=0.01)
deconstruct_4 = Deconstruct(Point=removeduplicatepts_4)  # -> XComponent, YComponent, ZComponent
bounds_4 = Bounds(Numbers=deconstruct_4.ZComponent)
deconstruct_domain_4 = DeconstructDomain(Domain=bounds_4)  # -> Start, End
member_index_4 = MemberIndex(Set=deconstruct_4.ZComponent, Member=deconstruct_domain_4.End)  # -> Index, Count
pt_14 = Point(icon_7)
number_57 = Number(hkyou_4.IYY)
number_58 = Number(hkyou_4.VEN)
number_59 = Number(hkyou_4.AREA)
number_60 = Number(hkyou_4.IXX)
number_61 = Number(hweek_4.AREA)
number_62 = Number(hweek_4.IXX)
number_63 = Number(hweek_4.IYY)
number_64 = Number(hweek_4.VEN)
list_item_4 = ListItem(List=removeduplicatepts_4, Index=member_index_4.Index, Wrap=True)
panel_114 = Panel("""0.200
0.200""")
pt_15 = Point(vcon_7)
X_13 = UnitX(Factor=panel_110)
negative_4 = Negative(Value=Slider(10, range=0..10))
filepath_13 = Panel("C:\Users\chonv\AppData\Roaming\Grasshopper\Libraries\ghHogan")
filename_9 = Panel("sample_buckling.inl")

item_6 = ListItem(List=line_8, Index=0, Wrap=True)  # -> Item, Item1, Item2, Item3, Item4, Item5
merge_27 = Merge(Data1=item_6.Item, Data2=item_6.Item1, Data3=item_6.Item4, Data4=item_6.Item5)
merge_28 = Merge(Data1=item_6.Item2, Data2=item_6.Item3)
join_3 = JoinCurves(Curves=merge_28, Preserve=False)  # -> flatten(Curves)

# ----
# SECT(for segment)
# UNIT:[tf],[m]
number_slider_4 = Slider(0.02, range=0..0.1)
flatbarsect_4 = FlatbarSect(B=number_slider_4, D=number_slider_4)  # -> out, Area, KYOU, WEEK, Jzz; inputs B: Double, D: Double; same code as flatbarsect
multiplication_10 = Multiplication(A=flatbarsect_4.Area, B=10000)
multiplication_11 = Multiplication(A=flatbarsect_4.KYOU, B=10000)
multiplication_12 = Multiplication(A=flatbarsect_4.Jzz, B=10000)
domain_43 = Domain(Domain(-100, 100))
domain_44 = Domain(Domain(-100, 100))
domain_45 = Domain(Domain(-100, 100))
domain_46 = Domain(Domain(-100, 100))
domain_47 = Domain(Domain(-100, 100))
domain_48 = Domain(Domain(-100, 100))
merge_29 = Merge(Data1=domain_43, Data2=domain_44, Data3=domain_45, Data4=domain_46, Data5=domain_47, Data6=domain_48)
fig_8 = FIGSEGMENT(FIG="1", FPROP="101", AREA=number_61, IXX=number_62, IYY=number_63, VEN=number_64, YIELD=merge_29)
sect_8 = SECT(NSECT="102", SNAME="Column:T-12x20x4.5x3(x10000)", SFIG=fig_8, COLOR=ColourSwatch(SwatchColor=RGB(255, 0, 204)))

# ----
# SECT(for segment)
# UNIT:[tf],[m]
panel_119 = Panel("Column:T-12x20x4.5x3(x10000)")
domain_49 = Domain(Domain(-100, 100))
domain_50 = Domain(Domain(-100, 100))
domain_51 = Domain(Domain(-100, 100))
domain_52 = Domain(Domain(-100, 100))
domain_53 = Domain(Domain(-100, 100))
domain_54 = Domain(Domain(-100, 100))
merge_30 = Merge(Data1=domain_49, Data2=domain_50, Data3=domain_51, Data4=domain_52, Data5=domain_53, Data6=domain_54)
fig_9 = FIGSEGMENT(FIG="1", FPROP="101", AREA=number_59, IXX=number_60, IYY=number_57, VEN=number_58, YIELD=merge_30)
sect_9 = SECT(NSECT="101", SNAME=panel_119, SFIG=fig_9, COLOR=ColourSwatch(SwatchColor=RGB(255, 0, 204)))

# ----
# OPTS
panel_124 = Panel("\"SAMPLE INPUTFILE FOR HOGAN UNIT:[tf],[m]\"")
opts_5 = GHhogan(NAME=panel_124, BASE=panel_114, LOCATE="1.000", TFACT="0.030", GPERIOD="0.600")

rotate_2 = Rotate(Geometry=pt_15, Angle=1.570796327, Plane=PlaneXY(0, 0, 0))  # -> Geometry, Transform
# ICON
item_7 = ListItem(List=rotate_2.Geometry, Index=0, Wrap=True)  # -> Item, Item1

# ----
# VCON(vector)
# This component requests
#  a load vector for each point.
panel_126 = Panel("8")
lng_5 = ListLength(List=rotate_2.Geometry)
vec_4 = VectorXYZ(XComponent=panel_126, YComponent=panel_126, ZComponent=0)  # -> Vector, Length
dup_4 = DuplicateData(Data=vec_4.Vector, Number=lng_5, Order=True)
vcon_18 = VCONSimple(POINT=rotate_2.Geometry, ExF=dup_4)

icon2_8 = Point(item_7.Item1)
icon_17 = ICON(
    POINT=icon2_8,
    Condition_TX_Changed=True,
    Condition_TY_Changed=True,
    Condition_TZ_Changed=True,
    Condition_X_Changed=True,
    Condition_Y_Changed=True,
    Condition_Z_Changed=True)

# ----
# UNIT:[tf],[m]
# VCON(vector components)
vcon_19 = VCON(POINT=item_7.Item, X=negative_4, Y=0, Z=0, RX=0, RY=0, RZ=0)

# ----
# ELEM(segment)
# UNIT:[mm],[rad]
panel_127 = Panel("""0
0
0
0
0
0""")
panel_128 = Panel("""0
0
0
0
0
0""")
panel_129 = Panel("""0
0
0
0
0
0""")
panel_130 = Panel("""0
0
0
0
0
0""")
bonds_8 = BONDS(I=panel_128, J=panel_130)
cmq_8 = CMQ(I=panel_127, J=panel_129)
line_9 = Line(merge_13)
line_10 = Line(merge_14)
elem_11 = ELEM(
    GEO=line_9,
    ESECT="101",
    BONDS=bonds_8,
    CMQ=cmq_8,
    CANG="0",
    ElementTYPEChange="COLUMN",
    X_Axis_display_mode_changed=False,
    Y_Axis_display_mode_changed=False,
    Z_Axis_display_mode_changed=False)  # disabled

# ----
# ELEM(segment)
# UNIT:[mm],[rad]
panel_131 = Panel("""0
0
0
0
0
0""")
panel_132 = Panel("""0
0
0
0
0
0""")
panel_133 = Panel("""0
0
0
0
0
0""")
panel_134 = Panel("""0
0
0
0
0
0""")
bonds_9 = BONDS(I=panel_132, J=panel_134)
cmq_9 = CMQ(I=panel_131, J=panel_133)
line_11 = Line(merge_27)
line_12 = Line(merge_28)
elem_12 = ELEM(
    GEO=line_11,
    ESECT="101",
    BONDS=bonds_9,
    CMQ=cmq_9,
    CANG="0",
    ElementTYPEChange="COLUMN",
    X_Axis_display_mode_changed=False,
    Y_Axis_display_mode_changed=False,
    Z_Axis_display_mode_changed=False)  # disabled

rotate_3 = Rotate(Geometry=line_12, Angle=1.570796327, Plane=PlaneXY(0, 0, 0))  # -> Geometry, Transform

elem_13 = ELEM(
    GEO=rotate_3.Geometry,
    ESECT="102",
    BONDS=bonds,
    CMQ=cmq,
    CANG="0",
    ElementTYPEChange="COLUMN",
    X_Axis_display_mode_changed=False,
    Y_Axis_display_mode_changed=False,
    Z_Axis_display_mode_changed=False)

rotate_4 = Rotate(Geometry=line_10, Angle=1.570796327, Plane=xz_3)  # -> Geometry, Transform
relay_4 = Relay([sect_5, sect_4])

elem_14 = ELEM(
    GEO=rotate_4.Geometry,
    ESECT="102",
    BONDS=bonds_5,
    CMQ=cmq_5,
    CANG="0",
    ElementTYPEChange="COLUMN",
    X_Axis_display_mode_changed=False,
    Y_Axis_display_mode_changed=False,
    Z_Axis_display_mode_changed=False)

# ----
# PROP
# UNIT:[tf],[m]
panel_135 = Panel("2.3e7")

# ----
# PROP
# UNIT:[tf],[m]
panel_137 = Panel("2.3e7")

# ----
# PROP
# UNIT:[tf],[m]
panel_139 = Panel("2.3e7")

division_5 = Division(A="7.8", B="10000")
division_6 = Division(A=panel_135, B="10000")

prop_3 = PROP(
    NPROP="101",
    PNAME="SN490B(1/10000)",
    HIJU="0",
    E=division_6,
    POI="0.33333",
    PCOLOR=ColourSwatch(SwatchColor=RGB(64, 0, 255)))

assemble_5 = ASSEMBLEOPT(
    OPTS=opts_3,
    VIEW=view_3,
    ELEM=flatten(elem_14),
    PROP=flatten(prop_3),
    SECT=flatten(relay_4),
    ICON=flatten(icon_14),
    Sort_Mode=Slider(0, range=-1..4))  # -> INP, Bandwidth, BandwidthList
# ASSEMBLE
assemble_6 = ASSEMBLE(
    OPTS=opts_3,
    VIEW=view_3,
    ELEM=flatten(elem_14),
    PROP=flatten(prop_3),
    SECT=flatten(relay_4),
    ICON=flatten(icon_14),
    VCON=flatten(vcon_14))
extractarclm_3 = ExtractArclm(INP=assemble_6, DIGIT=False)  # -> ArclmFrameZ, ArclmFrameX, ArclmFrameY
list_of_bandwidths_3 = Panel(assemble_5.BandwidthList)
optimized_bandwidth_3 = Panel(assemble_5.Bandwidth)
saveasarclm_3 = SaveAsArclm(ARCLMFRAME=extractarclm_3.ArclmFrameZ, BUTTON=Button(), PATH=filepath_7, TITLE=filename_5)
# LinearAnalysis
arclm001_3 = ARCLM001(ARCLMFRAME=extractarclm_3.ArclmFrameZ, DFACT=1)  # -> OTL, GlobalMatrix, GlobalVector, ErrorMessage, Lines, ARCLMFRAME
panel_141 = Panel(arclm001_3.OTL)
# LinearBclngAnalysis
bclng001_2 = BCLNG001(ARCLMFRAME=arclm001_3.ARCLMFRAME, NEIGEN=1, DFACT=1, EPS=1e-08)  # -> OTP, ElasticMatrix, GeometricMatrix, Lines, ARCLMFRAME
panel_142 = Panel(arclm001_3.GlobalMatrix)
drawdisplacement_2 = DrawDisplacement(ARCLMFRAME=bclng001_2.ARCLMFRAME, DFACT="1")  # -> InitialLines, DeformedLines
panel_143 = Panel(bclng001_2.OTP)
panel_144 = Panel(arclm001_3.GlobalVector)
custom_preview_3 = CustomPreview(Geometry=drawdisplacement_2.InitialLines, Material=ColourSwatch(SwatchColor=RGB(255, 77, 204)))
custom_preview_4 = CustomPreview(Geometry=drawdisplacement_2.DeformedLines, Material=ColourSwatch(SwatchColor=RGB(77, 77, 255)))

# ----
# GENERATE
file_path_7 = Panel("C:\D\Cdocs\Hogan_2020\Debug")
# EXECUTE
save_inp_7 = Button()
file_title_7 = Panel("sampleb")
generate_3 = GENERATE(INP=assemble_6, BUTTON=save_inp_7, PATH=file_path_7, TITLE=file_title_7)

division_7 = Division(A="7.8", B="10000")
division_8 = Division(A=panel_137, B="10000")
relay_5 = Relay([sect_7, sect_6])

prop_4 = PROP(
    NPROP="101",
    PNAME="SN490B(1/10000)",
    HIJU="0",
    E=division_8,
    POI="0.33333",
    PCOLOR=ColourSwatch(SwatchColor=RGB(64, 0, 255)))

assemble_7 = ASSEMBLEOPT(
    OPTS=opts_4,
    VIEW=view_4,
    ELEM=flatten(elem_10),
    PROP=flatten(prop_4),
    SECT=flatten(relay_5),
    ICON=flatten(icon_16),
    Sort_Mode=Slider(0, range=-1..4))  # -> INP, Bandwidth, BandwidthList
assemble_8 = ASSEMBLE(
    OPTS=opts_4,
    VIEW=view_4,
    ELEM=flatten(elem_10),
    PROP=flatten(prop_4),
    SECT=flatten(relay_5),
    ICON=flatten(icon_16),
    VCON=flatten(vcon_17))
extractarclm_4 = ExtractArclm(INP=assemble_8, DIGIT=False)  # -> ArclmFrameZ, ArclmFrameX, ArclmFrameY
list_of_bandwidths_4 = Panel(assemble_7.BandwidthList)
optimized_bandwidth_4 = Panel(assemble_7.Bandwidth)
saveasarclm_4 = SaveAsArclm(ARCLMFRAME=extractarclm_4.ArclmFrameZ, BUTTON=Button(), PATH=filepath_10, TITLE=filename_7)
arclm001_4 = ARCLM001(ARCLMFRAME=extractarclm_4.ArclmFrameZ, DFACT=1)  # -> OTL, GlobalMatrix, GlobalVector, ErrorMessage, Lines, ARCLMFRAME
panel_145 = Panel(arclm001_4.OTL)
bclng001_3 = BCLNG001(ARCLMFRAME=arclm001_4.ARCLMFRAME, NEIGEN=1, DFACT=1, EPS=1e-08)  # -> OTP, ElasticMatrix, GeometricMatrix, Lines, ARCLMFRAME
panel_146 = Panel(arclm001_4.GlobalMatrix)
drawdisplacement_3 = DrawDisplacement(ARCLMFRAME=bclng001_3.ARCLMFRAME, DFACT="1")  # -> InitialLines, DeformedLines
panel_147 = Panel(bclng001_3.OTP)
panel_148 = Panel(arclm001_4.GlobalVector)
custom_preview_5 = CustomPreview(Geometry=drawdisplacement_3.InitialLines, Material=ColourSwatch(SwatchColor=RGB(255, 77, 204)))
custom_preview_6 = CustomPreview(Geometry=drawdisplacement_3.DeformedLines, Material=ColourSwatch(SwatchColor=RGB(77, 77, 255)))

# ----
# GENERATE
file_path_8 = Panel("C:\D\Cdocs\Hogan_2020\Debug")
save_inp_8 = Button()
file_title_8 = Panel("sampleb")
generate_4 = GENERATE(INP=assemble_8, BUTTON=save_inp_8, PATH=file_path_8, TITLE=file_title_8)

division_9 = Division(A="7.8", B="10000")
division_10 = Division(A=panel_139, B="10000")
relay_6 = Relay([sect_9, sect_8])

prop_5 = PROP(
    NPROP="101",
    PNAME="SN490B(1/10000)",
    HIJU="0",
    E=division_10,
    POI="0.33333",
    PCOLOR=ColourSwatch(SwatchColor=RGB(64, 0, 255)))

assemble_9 = ASSEMBLEOPT(
    OPTS=opts_5,
    VIEW=view_5,
    ELEM=flatten(elem_13),
    PROP=flatten(prop_5),
    SECT=flatten(relay_6),
    ICON=flatten(icon_17),
    Sort_Mode=Slider(0, range=-1..4))  # -> INP, Bandwidth, BandwidthList
assemble_10 = ASSEMBLE(
    OPTS=opts_5,
    VIEW=view_5,
    ELEM=flatten(elem_13),
    PROP=flatten(prop_5),
    SECT=flatten(relay_6),
    ICON=flatten(icon_17),
    VCON=flatten(vcon_19))
extractarclm_5 = ExtractArclm(INP=assemble_10, DIGIT=False)  # -> ArclmFrameZ, ArclmFrameX, ArclmFrameY
list_of_bandwidths_5 = Panel(assemble_9.BandwidthList)
optimized_bandwidth_5 = Panel(assemble_9.Bandwidth)
saveasarclm_5 = SaveAsArclm(ARCLMFRAME=extractarclm_5.ArclmFrameZ, BUTTON=Button(), PATH=filepath_13, TITLE=filename_9)
arclm001_5 = ARCLM001(ARCLMFRAME=extractarclm_5.ArclmFrameZ, DFACT=1)  # -> OTL, GlobalMatrix, GlobalVector, ErrorMessage, Lines, ARCLMFRAME
panel_149 = Panel(arclm001_5.OTL)
bclng001_4 = BCLNG001(ARCLMFRAME=arclm001_5.ARCLMFRAME, NEIGEN=1, DFACT=1, EPS=1e-08)  # -> OTP, ElasticMatrix, GeometricMatrix, Lines, ARCLMFRAME
drawdisplacement_4 = DrawDisplacement(ARCLMFRAME=bclng001_4.ARCLMFRAME, DFACT="1")  # -> InitialLines, DeformedLines
panel_150 = Panel(bclng001_4.OTP)
custom_preview_7 = CustomPreview(Geometry=drawdisplacement_4.InitialLines, Material=ColourSwatch(SwatchColor=RGB(255, 77, 204)))
custom_preview_8 = CustomPreview(Geometry=drawdisplacement_4.DeformedLines, Material=ColourSwatch(SwatchColor=RGB(77, 77, 255)))

# ----
# GENERATE
file_path_9 = Panel("C:\D\Cdocs\Hogan_2020\Debug")
save_inp_9 = Button()
file_title_9 = Panel("sampleb")
generate_5 = GENERATE(INP=assemble_10, BUTTON=save_inp_9, PATH=file_path_9, TITLE=file_title_9)

panel_151 = Panel(arclm001_5.GlobalMatrix)
panel_152 = Panel(arclm001_5.GlobalVector)

# ==== cluster EIGIN処理
num = ClusterInput()
T = ClusterInput()
num_2 = Number(num)
split = TextSplit(Text=T, Separators="=")
addition = Addition(A=num_2, B=1)
panel = Panel(split)
series = Series(Start="0", Step="2", Count=addition)
cull_i = CullIndex(List=split, Indices=series, Wrap=False)
toggle = BooleanToggle(True)
split_2 = TextSplit(Text=cull_i, Separators="SAFETY")
trim = TextTrim(Text=split_2, Start=True, End=True)
clean = CleanTree(RemoveNulls=toggle, RemoveInvalid=toggle, RemoveEmpty=toggle, Tree=trim)  # -> flatten(Tree)
panel_2 = Panel("""true
false
false
false
false
false
false""")
cull = CullPattern(List=clean, CullPattern=panel_2)
L = ClusterOutput(cull)
