# Grasshopper definition testHagoromo2.gh (Grasshopper 1.0.8)
# plug-ins: Hagoromo

pt = Point([Point(2000, 0, 2000), Point(0, 0, 2000)])
crv = Curve([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])
xz = XZPlane(Origin=Point(0, 0, 0))
rotate = Rotate(Geometry=pt, Angle=1.570796327, Plane=xz)  # -> Geometry, Transform
rotate_2 = Rotate(Geometry=pt, Angle=1.570796327, Plane=PlaneXY(0, 0, 0))  # -> Geometry, Transform
item = ListItem(List=rotate.Geometry, Index=0, Wrap=True)  # -> Item, Item1
rotate_3 = Rotate(Geometry=crv, Angle=1.570796327, Plane=xz)  # -> Geometry, Transform
item_2 = ListItem(List=rotate_2.Geometry, Index=0, Wrap=True)  # -> Item, Item1
rotate_4 = Rotate(Geometry=crv, Angle=1.570796327, Plane=PlaneXY(0, 0, 0))  # -> Geometry, Transform
item_3 = ListItem(List=pt, Index=0, Wrap=True)  # -> Item, Item1
join = JoinCurves(Curves=rotate_3.Geometry, Preserve=False)
join_2 = JoinCurves(Curves=rotate_4.Geometry, Preserve=False)

number_slider = Slider(3, range=-5..5)
number_slider_2 = Slider(2, range=-5..5)
number_slider_3 = Slider(1, range=0..10)
pt_2 = Point(Point(0, 0, -9.8))
line = Line(join_2)
pt_3 = Point(item_2.Item1)
pt_4 = Point(item_2.Item)
adjust_units = AdjustUnits(
    YoungsModulus="22.54",
    EDigit="3",
    Density="7.8",
    DDigit="-1",
    Area="45.33",
    ADigit="6",
    Inertia_x="693.252",
    IxDigit="9",
    Inertia_y="50.69",
    IyDigit="9",
    SaintVenant="9.87",
    VDigit="8",
    Length="1000",
    LDigit="0",
    体積力の加速度ベクトルの和=pt_2,
    ForceUnitParameter=number_slider_2,
    LengthUnitParameter=number_slider,
    EUnitParameter=number_slider_3)  # -> YoungsModulus, Density, Area, Inertia_x, Inertia_y, SaintVenant, Length, Gravity, ModelScale, ShowingEachValueAsText
adjust_units_2 = AdjustUnits(
    YoungsModulus="22.54",
    EDigit="3",
    Density="7.8",
    DDigit="-1",
    Area="76.2",
    ADigit="6",
    Inertia_x="160.132",
    IxDigit="9",
    Inertia_y="2139.338",
    IyDigit="9",
    SaintVenant="28.33",
    VDigit="8",
    Length="1000",
    LDigit="0",
    体積力の加速度ベクトルの和=pt_2,
    ForceUnitParameter=number_slider_2,
    LengthUnitParameter=number_slider,
    EUnitParameter=number_slider_3)  # -> YoungsModulus, Density, Area, Inertia_x, Inertia_y, SaintVenant, Length, Gravity, ModelScale, ShowingEachValueAsText
pt_5 = Point(Point(0, 0, 0))
sect = SectionInfo(
    SectName="carbon",
    SectId="2",
    PropId="1",
    Area=adjust_units_2.Area,
    IXX=adjust_units_2.Inertia_x,
    IYY=adjust_units_2.Inertia_y,
    VEN=adjust_units_2.SaintVenant)
prop = PropertyInfo(
    PropName="PName",
    PropId="1",
    Density=adjust_units.Density,
    YoungsModulus=adjust_units.YoungsModulus,
    PoissonsRatio="0.33333")
sect_2 = SectionInfo(
    SectName="tension",
    SectId="1",
    PropId="1",
    Area=adjust_units.Area,
    IXX=adjust_units.Inertia_x,
    IYY=adjust_units.Inertia_y,
    VEN=adjust_units.SaintVenant)
scale = Scale(Geometry=line, Center=pt_5, Factor=adjust_units_2.ModelScale)  # -> Geometry, Transform
scale_2 = Scale(Geometry=pt_3, Center=pt_5, Factor=adjust_units_2.ModelScale)  # -> Geometry, Transform
scale_3 = Scale(Geometry=pt_3, Center=pt_5, Factor=adjust_units_2.ModelScale)  # -> Geometry, Transform
panel = Panel(adjust_units.ShowingEachValueAsText)
merge = Merge(Data1=sect_2, Data2=sect)
panel_2 = Panel("""0
0
0
10
0
0""")
panel_3 = Panel("90")
allprop = AllPropertyInfo(Propdata=prop)  # -> AllPropdata, Contents
allsect = AllSectionInfo(Sectdata=merge)  # -> AllSectdata, Contents
elem = ElementInfo(
    Lines=scale.Geometry,
    SectId="2",
    CoordAngle=0,
    CMQSTA=[0, 0, 0, 0, 0, 0],
    CMQEND=[0, 0, 0, 0, 0, 0],
    Condition_TX_Changed=True,
    Condition_TX2_Changed=True,
    Condition_TY_Changed=True,
    Condition_TY2_Changed=True,
    Condition_TZ_Changed=True,
    Condition_TZ2_Changed=True,
    Condition_X_Changed=True,
    Condition_X2_Changed=True,
    Condition_Y_Changed=True,
    Condition_Y2_Changed=True,
    Condition_Z_Changed=True,
    Condition_Z2_Changed=True)
icon2 = Icon2Info(
    Points=scale_3.Geometry,
    Condition_TX_Changed=True,
    Condition_TY_Changed=True,
    Condition_TZ_Changed=True,
    Condition_X_Changed=True,
    Condition_Y_Changed=True,
    Condition_Z_Changed=True)
vcon = VconInfo(Points=scale_2.Geometry, Forces=panel_2)
panel_4 = Panel(adjust_units_2.ShowingEachValueAsText)
allvcon = AllVconInfo(Vcondata=vcon)  # -> AllVcondata, Contents
allelem = AllElemntInfo(Elemdata=elem)  # -> AllElemdata, Contents
allicon = AllIconInfo(Icondata=icon2)  # -> AllIcondata, Contents
vec = Vector(adjust_units_2.Gravity)
alldata = CombineAlldata(
    AllPropdata=allprop.AllPropdata,
    AllSectdata=allsect.AllSectdata,
    AllElemdata=allelem.AllElemdata,
    AllIcondata=allicon.AllIcondata,
    AllVcondata=allvcon.AllVcondata,
    体積力の加速度ベクトルの和="0,0,0")  # -> Alldata, Contents
ptelem = PointsAndElems(Alldata=alldata.Alldata)  # -> Nodes, Elements
branch = TreeBranch(Tree=alldata.Contents, Path=Slider(4, range=1..4), MaintainPaths=True)
la = LinearAnalysis(Alldata=alldata.Alldata)  # -> AllDisplacement, AllStress
panel_5 = Panel(la.AllDisplacement)
panel_6 = Panel(branch)

join_3 = JoinCurves(Curves=crv, Preserve=False)
panel_7 = Panel("""0
0
0
10
0
0""")
panel_9 = Panel("""0
0
0
1045
0
0""")

number_slider_4 = Slider(3, range=-5..5)
number_slider_5 = Slider(2, range=-5..5)
number_slider_6 = Slider(1, range=0..10)
pt_6 = Point(Point(0, 0, -9.8))
line_2 = Line(join)
pt_7 = Point(item.Item1)
pt_8 = Point(item.Item)
adjust_units_3 = AdjustUnits(
    YoungsModulus="22.54",
    EDigit="3",
    Density="7.8",
    DDigit="-1",
    Area="45.33",
    ADigit="6",
    Inertia_x="693.252",
    IxDigit="9",
    Inertia_y="50.69",
    IyDigit="9",
    SaintVenant="9.87",
    VDigit="8",
    Length="1000",
    LDigit="0",
    体積力の加速度ベクトルの和=pt_6,
    ForceUnitParameter=number_slider_5,
    LengthUnitParameter=number_slider_4,
    EUnitParameter=number_slider_6)  # -> YoungsModulus, Density, Area, Inertia_x, Inertia_y, SaintVenant, Length, Gravity, ModelScale, ShowingEachValueAsText
adjust_units_4 = AdjustUnits(
    YoungsModulus="22.54",
    EDigit="3",
    Density="7.8",
    DDigit="-1",
    Area="76.2",
    ADigit="6",
    Inertia_x="160.132",
    IxDigit="9",
    Inertia_y="2139.338",
    IyDigit="9",
    SaintVenant="28.33",
    VDigit="8",
    Length="1000",
    LDigit="0",
    体積力の加速度ベクトルの和=pt_6,
    ForceUnitParameter=number_slider_5,
    LengthUnitParameter=number_slider_4,
    EUnitParameter=number_slider_6)  # -> YoungsModulus, Density, Area, Inertia_x, Inertia_y, SaintVenant, Length, Gravity, ModelScale, ShowingEachValueAsText
pt_9 = Point(Point(0, 0, 0))
sect_3 = SectionInfo(
    SectName="carbon",
    SectId="2",
    PropId="1",
    Area=adjust_units_4.Area,
    IXX=adjust_units_4.Inertia_x,
    IYY=adjust_units_4.Inertia_y,
    VEN=adjust_units_4.SaintVenant)
prop_2 = PropertyInfo(
    PropName="PName",
    PropId="1",
    Density=adjust_units_3.Density,
    YoungsModulus=adjust_units_3.YoungsModulus,
    PoissonsRatio="0.33333")
sect_4 = SectionInfo(
    SectName="tension",
    SectId="1",
    PropId="1",
    Area=adjust_units_3.Area,
    IXX=adjust_units_3.Inertia_x,
    IYY=adjust_units_3.Inertia_y,
    VEN=adjust_units_3.SaintVenant)
scale_4 = Scale(Geometry=line_2, Center=pt_9, Factor=adjust_units_4.ModelScale)  # -> Geometry, Transform
scale_5 = Scale(Geometry=pt_8, Center=pt_9, Factor=adjust_units_4.ModelScale)  # -> Geometry, Transform
scale_6 = Scale(Geometry=pt_7, Center=pt_9, Factor=adjust_units_4.ModelScale)  # -> Geometry, Transform
panel_10 = Panel(adjust_units_3.ShowingEachValueAsText)
merge_2 = Merge(Data1=sect_4, Data2=sect_3)
panel_11 = Panel("""0
0
0
0
0
0""")
allprop_2 = AllPropertyInfo(Propdata=prop_2)  # -> AllPropdata, Contents
allsect_2 = AllSectionInfo(Sectdata=merge_2)  # -> AllSectdata, Contents
elem_2 = ElementInfo(
    Lines=scale_4.Geometry,
    SectId="2",
    CoordAngle=0,
    CMQSTA=[0, 0, 0, 0, 0, 0],
    CMQEND=panel_9,
    Condition_TX_Changed=True,
    Condition_TX2_Changed=True,
    Condition_TY_Changed=True,
    Condition_TY2_Changed=True,
    Condition_TZ_Changed=True,
    Condition_TZ2_Changed=True,
    Condition_X_Changed=True,
    Condition_X2_Changed=True,
    Condition_Y_Changed=True,
    Condition_Y2_Changed=True,
    Condition_Z_Changed=True,
    Condition_Z2_Changed=True)
icon2_2 = Icon2Info(
    Points=scale_6.Geometry,
    Condition_TX_Changed=True,
    Condition_TY_Changed=True,
    Condition_TZ_Changed=True,
    Condition_X_Changed=True,
    Condition_Y_Changed=True,
    Condition_Z_Changed=True)
vcon_2 = VconInfo(Points=scale_5.Geometry, Forces=panel_11)
panel_13 = Panel(adjust_units_4.ShowingEachValueAsText)
allvcon_2 = AllVconInfo(Vcondata=vcon_2)  # -> AllVcondata, Contents
allelem_2 = AllElemntInfo(Elemdata=elem_2)  # -> AllElemdata, Contents
allicon_2 = AllIconInfo(Icondata=icon2_2)  # -> AllIcondata, Contents
vec_2 = Vector(adjust_units_4.Gravity)
alldata_2 = CombineAlldata(
    AllPropdata=allprop_2.AllPropdata,
    AllSectdata=allsect_2.AllSectdata,
    AllElemdata=allelem_2.AllElemdata,
    AllIcondata=allicon_2.AllIcondata,
    AllVcondata=allvcon_2.AllVcondata,
    体積力の加速度ベクトルの和="0,0,0")  # -> Alldata, Contents
ptelem_2 = PointsAndElems(Alldata=alldata_2.Alldata)  # -> Nodes, Elements
branch_2 = TreeBranch(Tree=alldata_2.Contents, Path=Slider(4, range=1..4), MaintainPaths=True)
la_2 = LinearAnalysis(Alldata=alldata_2.Alldata)  # -> AllDisplacement, AllStress
panel_14 = Panel(la_2.AllDisplacement)
panel_15 = Panel(branch_2)

panel_16 = Panel("""0
0
0
980
0
0""")
panel_18 = Panel("""-980
0
0
0
0
0""")
panel_19 = Panel("""0
0
10
0
0
0""")
panel_20 = Panel("""0
0
20
0
0
0""")
panel_21 = Panel(la_2.AllStress)
panel_22 = Panel(la.AllStress)
number_slider_7 = Slider(0.16, range=0..0.2)
beamla = BeamLinearAnalysis(Alldata=alldata.Alldata)  # -> AllDisplacement, AllStress

number_slider_8 = Slider(3, range=-5..5)
number_slider_9 = Slider(2, range=-5..5)
number_slider_10 = Slider(1, range=0..10)
pt_10 = Point(Point(0, 0, -9.8))
pt_11 = Point(item_3.Item)
pt_12 = Point(item_3.Item1)
line_3 = Line(crv)
adjust_units_5 = AdjustUnits(
    YoungsModulus="22.54",
    EDigit="3",
    Density="7.8",
    DDigit="-1",
    Area="45.33",
    ADigit="6",
    Inertia_x="693.252",
    IxDigit="9",
    Inertia_y="50.69",
    IyDigit="9",
    SaintVenant="9.87",
    VDigit="8",
    Length="1000",
    LDigit="0",
    体積力の加速度ベクトルの和=pt_10,
    ForceUnitParameter=number_slider_9,
    LengthUnitParameter=number_slider_8,
    EUnitParameter=number_slider_10)  # -> YoungsModulus, Density, Area, Inertia_x, Inertia_y, SaintVenant, Length, Gravity, ModelScale, ShowingEachValueAsText
adjust_units_6 = AdjustUnits(
    YoungsModulus="22.54",
    EDigit="3",
    Density="7.8",
    DDigit="-1",
    Area="76.2",
    ADigit="6",
    Inertia_x="160.132",
    IxDigit="9",
    Inertia_y="2139.338",
    IyDigit="9",
    SaintVenant="28.33",
    VDigit="8",
    Length="1000",
    LDigit="0",
    体積力の加速度ベクトルの和=pt_10,
    ForceUnitParameter=number_slider_9,
    LengthUnitParameter=number_slider_8,
    EUnitParameter=number_slider_10)  # -> YoungsModulus, Density, Area, Inertia_x, Inertia_y, SaintVenant, Length, Gravity, ModelScale, ShowingEachValueAsText
pt_13 = Point(Point(0, 0, 0))
prop_3 = PropertyInfo(
    PropName="PName",
    PropId="1",
    Density=adjust_units_5.Density,
    YoungsModulus=adjust_units_5.YoungsModulus,
    PoissonsRatio="0.33333")
sect_5 = SectionInfo(
    SectName="carbon",
    SectId="2",
    PropId="1",
    Area=adjust_units_6.Area,
    IXX=adjust_units_6.Inertia_x,
    IYY=adjust_units_6.Inertia_y,
    VEN=adjust_units_6.SaintVenant)
sect_6 = SectionInfo(
    SectName="tension",
    SectId="1",
    PropId="1",
    Area=adjust_units_5.Area,
    IXX=adjust_units_5.Inertia_x,
    IYY=adjust_units_5.Inertia_y,
    VEN=adjust_units_5.SaintVenant)
panel_23 = Panel(adjust_units_5.ShowingEachValueAsText)
scale_7 = Scale(Geometry=[pt_12, pt_11], Center=pt_13, Factor=adjust_units_6.ModelScale)  # -> Geometry, Transform
merge_3 = Merge(Data1=sect_6, Data2=sect_5)
panel_24 = Panel("""0
0
0
0
0
0""")
allprop_3 = AllPropertyInfo(Propdata=prop_3)  # -> AllPropdata, Contents
allsect_3 = AllSectionInfo(Sectdata=merge_3)  # -> AllSectdata, Contents
icon2_3 = Icon2Info(
    Points=scale_7.Geometry,
    Condition_TX_Changed=True,
    Condition_TY_Changed=True,
    Condition_TZ_Changed=True,
    Condition_X_Changed=True,
    Condition_Y_Changed=True,
    Condition_Z_Changed=True)
panel_26 = Panel(adjust_units_6.ShowingEachValueAsText)
allicon_3 = AllIconInfo(Icondata=icon2_3)  # -> AllIcondata, Contents
vec_3 = Vector(adjust_units_6.Gravity)

item_4 = ListItem(List=line_3, Index="1", Wrap=True)
item_5 = ListItem(List=line_3, Index=0, Wrap=True)
flip = FlipCurve(Curve=item_4)  # -> Curve, Flag
end = EndPoints(Curve=flip.Curve)  # -> Start, End
merge_4 = Merge(Data1=item_5, Data2=flip.Curve)
pt_14 = Point(end.Start)
pt_15 = Point(end.End)
scale_8 = Scale(Geometry=pt_15, Center=pt_13, Factor=adjust_units_6.ModelScale)  # -> Geometry, Transform

scale_9 = Scale(Geometry=pt_14, Center=pt_13, Factor=adjust_units_6.ModelScale)  # -> Geometry, Transform
scale_10 = Scale(Geometry=merge_4, Center=pt_13, Factor=adjust_units_6.ModelScale)  # -> Geometry, Transform
vcon_3 = VconInfo(Points=scale_8.Geometry, Forces=[0, 0, 0, 0, 0, 0])

len = Length(Curve=scale_10.Geometry)
item_6 = ListItem(List=scale_10.Geometry, Index=0, Wrap=True)  # -> Item, Item1
elem_3 = ElementInfo(
    Lines=item_6.Item1,
    SectId="2",
    CoordAngle=0,
    CMQSTA=[0, 0, 0, 0, 0, 0],
    CMQEND=[0, 0, 0, 0, 0, 0],
    Condition_TX_Changed=True,
    Condition_TX2_Changed=True,
    Condition_TY_Changed=True,
    Condition_TY2_Changed=True,
    Condition_TZ_Changed=True,
    Condition_TZ2_Changed=True,
    Condition_X_Changed=True,
    Condition_X2_Changed=True,
    Condition_Y_Changed=True,
    Condition_Y2_Changed=True,
    Condition_Z_Changed=True,
    Condition_Z2_Changed=True)
vcon_4 = VconInfo(Points=scale_9.Geometry, Forces=panel_20)

elem_4 = ElementInfo(
    Lines=item_6.Item,
    SectId="2",
    CoordAngle=0,
    CMQSTA=[0, 0, 0, 0, 0, 0],
    CMQEND=[0, 0, 0, 0, 0, 0],
    Condition_TX_Changed=True,
    Condition_TX2_Changed=True,
    Condition_TY_Changed=True,
    Condition_TY2_Changed=True,
    Condition_TZ_Changed=True,
    Condition_TZ2_Changed=True,
    Condition_X_Changed=True,
    Condition_X2_Changed=True,
    Condition_Y_Changed=True,
    Condition_Y2_Changed=True,
    Condition_Z_Changed=True,
    Condition_Z2_Changed=True)
allvcon_3 = AllVconInfo(Vcondata=[vcon_3, vcon_4])  # -> AllVcondata, Contents
allelem_3 = AllElemntInfo(Elemdata=[elem_4, elem_3])  # -> AllElemdata, Contents
alldata_3 = CombineAlldata(
    AllPropdata=allprop_3.AllPropdata,
    AllSectdata=allsect_3.AllSectdata,
    AllElemdata=allelem_3.AllElemdata,
    AllIcondata=allicon_3.AllIcondata,
    AllVcondata=allvcon_3.AllVcondata,
    体積力の加速度ベクトルの和="0,0,0")  # -> Alldata, Contents
ptelem_3 = PointsAndElems(Alldata=alldata_3.Alldata)  # -> Nodes, Elements
branch_3 = TreeBranch(Tree=alldata_3.Contents, Path=Slider(4, range=1..4), MaintainPaths=True)
panel_27 = Panel(branch_3)
la_3 = LinearAnalysis(Alldata=alldata_3.Alldata)  # -> AllDisplacement, AllStress
panel_28 = Panel(la_3.AllDisplacement)

panel_29 = Panel(la_3.AllStress)
showinput = ShowInput(
    Alldata=alldata_3.Alldata,
    SizeOfSectID=Slider(0.069, range=0..0.2),
    SizeOfNodeID=number_slider_7,
    SizeOfElemID=number_slider_7,
    SizeOfICon=0,
    SizeOfVCon=0,
    SizeOfBeamEndConditions=0,
    SizeOfCMQ=0)
