# Grasshopper definition 靴.gh (Grasshopper 1.0.8)
# plug-ins: Human, Hagoromo, Weaverbird, NGon_RH8, Flexibility

mesh = Mesh(<mesh referenced from the Rhino model>)
bbox = BoundingBox(Content=mesh, Plane=PlaneXY(0, 0, 0))  # -> Box, Box_2
debrep = DeconstructBrep(Brep=bbox.Box)  # -> Faces, Edges, Vertices
item = ListItem(List=debrep.Edges, Index=Slider(7, range=0..10), Wrap=True)
item_2 = ListItem(List=debrep.Edges, Index=Slider(8, range=0..10), Wrap=True)
item_3 = ListItem(List=debrep.Edges, Index=Slider(4, range=0..10), Wrap=True)
item_4 = ListItem(List=debrep.Faces, Index=Slider(7, range=0..10), Wrap=True)
item_5 = ListItem(List=debrep.Faces, Index=0, Wrap=True)
item_6 = ListItem(List=debrep.Faces, Index=Slider(5, range=0..10), Wrap=True)

# ---- group: x+1
number_slider = Slider(3, range=0..100)

# ---- group: y+1
number_slider_2 = Slider(4, range=0..100)

# ---- group: z+1
number_slider_3 = Slider(3, range=0..100)

# ---- group: x等分
arrcurve = CurveArray(Geometry=item_4, Curve=item_3, Count=number_slider)  # -> Geometry, Transform

# ---- group: y等分
arrcurve_2 = CurveArray(Geometry=item_5, Curve=item, Count=number_slider_2)  # -> Geometry, Transform

# ---- group: z等分
arrcurve_3 = CurveArray(Geometry=item_6, Curve=item_2, Count=number_slider_3)  # -> Geometry, Transform

# ---- group: cutへ
merge = Merge(Data1=arrcurve.Geometry, Data2=arrcurve_2.Geometry, Data3=arrcurve_3.Geometry)

# ----
meshsplit = MeshSplit(Mesh=mesh, Cutter=merge, T=simplify(flatten(0.001)))  # -> Mesh, ProjectCurve

# ---- group: 分割後メッシュ
mesh_2 = Mesh(meshsplit.Mesh)

# ----
item_7 = ListItem(List=mesh_2, Index=0, Wrap=True)
panel = Panel(mesh_2)
meshedges = MeshEdges(Mesh=item_7)  # -> AllE, NakedE
crv = Curve(meshedges.AllE)
crv_2 = Curve([<curve referenced from the Rhino model> x5000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])
wbweave = WeaverbirdsMeshFromLinesWeaveBack(Lines=crv_2, MaximumValence=4)
mesh_3 = Mesh(wbweave)
triremesh = TriRemesh(Geometry=mesh_3, Iterations=25)  # -> Triangulation, Dual, Creases
mesh_4 = Mesh(<mesh referenced from the Rhino model>)

# ---- group: 三角形メッシュ
mesh_5 = Mesh(triremesh.Triangulation)

# ----
meshedges_2 = MeshEdges(Mesh=mesh_5)  # -> AllE, NakedE
crv_3 = Curve([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])
number_slider_4 = Slider(100000, range=0..100000)
crv_4 = Curve(meshedges_2.AllE)
wbweave_2 = WeaverbirdsMeshFromLinesWeaveBack(Lines=crv_3, MaximumValence=4)
meshedges_3 = MeshEdges(Mesh=wbweave_2)  # -> AllE, NakedE
元形状 = Mesh(wbweave_2)
develop = DevelopMesh(TriangulatedMesh=wbweave_2, Count=Slider(100000, range=0..100000))  # -> ModifiedMesh, A; disabled
mbridgecm = MbridgeCM(TriangulatedMeshOrCutMesh=develop.ModifiedMesh)
area = Area(Geometry=元形状)  # -> Area, Centroid
mbridgecm_2 = MbridgeCM(TriangulatedMeshOrCutMesh=wbweave_2)
developcm2 = DevelopCutMesh2(
    TriangulatedCutMesh=mbridgecm_2,
    Iterations=number_slider_4,
    XyMirror=False,
    YzMirror=False,
    ZxMirror=False,
    OuterBoundaryCurves=meshedges_3.NakedE,
    Alpha=0.1)  # disabled
sortcutmesh = SortCutMesh(TriangulatedMeshOrCutMesh=developcm2)
deccutmesh = DeconstructCutMesh(TriangulatedMeshOrCutMesh=sortcutmesh)  # -> Vertices, Faces, Edges
mbridgecm_3 = MbridgeCM(TriangulatedMeshOrCutMesh=元形状)
mbridgecm_4 = MbridgeCM(TriangulatedMeshOrCutMesh=developcm2)
sortcutmesh_2 = SortCutMesh(TriangulatedMeshOrCutMesh=mbridgecm)
deccutmesh_2 = DeconstructCutMesh(TriangulatedMeshOrCutMesh=sortcutmesh_2)  # -> Vertices, Faces, Edges
提案 = Mesh(develop.ModifiedMesh)
develop_2 = DevelopMesh(TriangulatedMesh=mbridgecm_4, Count=number_slider_4)  # -> ModifiedMesh, A
sortcutmesh_3 = SortCutMesh(TriangulatedMeshOrCutMesh=mbridgecm_3)
deccutmesh_3 = DeconstructCutMesh(TriangulatedMeshOrCutMesh=sortcutmesh_3)  # -> Vertices, Faces, Edges
dist = Distance(PointA=deccutmesh_3.Vertices, PointB=deccutmesh_2.Vertices)
sqr = Square(Value=dist)
avr = Average(Input=sqr)
division = Division(A=avr, B=area.Area)
multiplication = Multiplication(A=division, B="100")
panel_2 = Panel(multiplication)
従来 = Mesh(mbridgecm_4)
mbridgecm_5 = MbridgeCM(TriangulatedMeshOrCutMesh=develop_2.ModifiedMesh)
ハイブリッド = Mesh(develop_2.ModifiedMesh)
mbridgecm_6 = MbridgeCM(TriangulatedMeshOrCutMesh=ハイブリッド)
sortcutmesh_4 = SortCutMesh(TriangulatedMeshOrCutMesh=mbridgecm_6)
deccutmesh_4 = DeconstructCutMesh(TriangulatedMeshOrCutMesh=sortcutmesh_4)  # -> Vertices, Faces, Edges
sortcutmesh_5 = SortCutMesh(TriangulatedMeshOrCutMesh=mbridgecm_5)
netbff = NetBFF(TriangulatedMeshOrCutMesh=sortcutmesh_5)  # -> CutMesh, FeatureLinesPolylines
cutmeshedges = CutMeshEdges(TriangulatedMeshOrCutMesh=sortcutmesh_5)  # -> MeshAllEdges, MeshNakedEdges
cutmeshedges_2 = CutMeshEdges(TriangulatedMeshOrCutMesh=netbff.CutMesh)  # -> MeshAllEdges, MeshNakedEdges
len = Length(Curve=cutmeshedges_2.MeshAllEdges)
len_2 = Length(Curve=cutmeshedges.MeshAllEdges)
subtraction = Subtraction(A=len, B=len_2)
abs = Absolute(Value=subtraction)
division_2 = Division(A=abs, B=len_2)
multiplication_2 = Multiplication(A=division_2, B=Slider(100, range=0..100))
sort = SortList(Keys=multiplication_2)  # -> Keys, ValuesA
avr_2 = Average(Input=multiplication_2)
item_8 = ListItem(List=sort.Keys, Index=0, Wrap=True)  # -> Item1, Item
panel_3 = Panel([item_8.Item1, avr_2])
gradient = Gradient(
    LowerLimit="0",
    UpperLimit="3",
    Parameter=multiplication_2,
    stops=[0: RGB(75, 107, 169), 0.247: RGB(173, 203, 249), 0.5: RGB(254, 244, 84), 0.748: RGB(234, 126, 0), 1: RGB(234, 38, 0)])
object = ModelObject(Object=cutmeshedges_2.MeshAllEdges, Layer="a", Display=gradient)  # -> Object, Geometry, Name, Layer, Visibility, Display, Drafting, Render
cache = ContentCache(Content=object.Object, Action=2)
meshedges_4 = MeshEdges(Mesh=元形状)  # -> AllE, NakedE
swatch = ColourSwatch(SwatchColor=RGBA(255, 255, 255, 80))
number_slider_5 = Slider(2, range=0..2)
meshedges_5 = MeshEdges(Mesh=ハイブリッド)  # -> AllE, NakedE
number_slider_6 = Slider(2, range=0..2)
number_slider_7 = Slider(2, range=0..2)
meshedges_6 = MeshEdges(Mesh=従来)  # -> AllE, NakedE
meshedges_7 = MeshEdges(Mesh=提案)  # -> AllE, NakedE
mesh_6 = Mesh(元形状)
scale = Scale(Geometry=meshedges_4.AllE, Center=Point(0, 0, 0), Factor=Slider(1.00001, range=0..10))  # -> Geometry, Transform
scale_2 = Scale(Geometry=meshedges_5.AllE, Center=Point(0, 0, 0), Factor=Slider(1.00002, range=0..10))  # -> Geometry, Transform
scale_3 = Scale(Geometry=meshedges_6.AllE, Center=Point(0, 0, 0), Factor=Slider(1.00002, range=0..10))  # -> Geometry, Transform
scale_4 = Scale(Geometry=meshedges_7.AllE, Center=Point(0, 0, 0), Factor=Slider(1.00002, range=0..10))  # -> Geometry, Transform

preview = CustomPreview(Geometry=ハイブリッド, Material=ColourSwatch(SwatchColor=RGBA(255, 255, 255, 80)))
previewlw = CustomPreviewLineweights(Geometry=scale_2.Geometry, Shader=ColourSwatch(SwatchColor=RGB(0, 0, 255)), Thickness=number_slider_7, Absolute=False)
previewlw_2 = CustomPreviewLineweights(
    Geometry=scale.Geometry,
    Shader={diffuse=RGB(255, 105, 180), emission=RGB(76, 32, 54), shine=0.5, specular=RGB(255, 255, 255), transparency=0},
    Thickness=number_slider_7,
    Absolute=False)

preview_2 = CustomPreview(Geometry=従来, Material=ColourSwatch(SwatchColor=RGBA(255, 255, 255, 80)))
previewlw_3 = CustomPreviewLineweights(Geometry=scale_3.Geometry, Shader=ColourSwatch(SwatchColor=RGB(0, 0, 255)), Thickness=number_slider_6, Absolute=False)
previewlw_4 = CustomPreviewLineweights(
    Geometry=scale.Geometry,
    Shader={diffuse=RGB(255, 105, 180), emission=RGB(76, 32, 54), shine=0.5, specular=RGB(255, 255, 255), transparency=0},
    Thickness=number_slider_6,
    Absolute=False)

previewlw_5 = CustomPreviewLineweights(
    Geometry=scale.Geometry,
    Shader=ColourSwatch(SwatchColor=RGB(0, 0, 255)),
    Thickness=Slider(2, range=0..2),
    Absolute=False)
preview_3 = CustomPreview(Geometry=元形状, Material=swatch)

preview_4 = CustomPreview(Geometry=提案, Material=swatch)
previewlw_6 = CustomPreviewLineweights(Geometry=scale_4.Geometry, Shader=ColourSwatch(SwatchColor=RGB(0, 0, 255)), Thickness=number_slider_5, Absolute=False)
previewlw_7 = CustomPreviewLineweights(
    Geometry=scale.Geometry,
    Shader={diffuse=RGB(255, 105, 180), emission=RGB(76, 32, 54), shine=0.5, specular=RGB(255, 255, 255), transparency=0},
    Thickness=number_slider_5,
    Absolute=False)
